# Grasshopper definition ROS2_mobile_robot_w_ur20.ghx (Grasshopper 1.0.8)
# plug-ins: RhinoCodePluginGH, MetaHopper

# ----
# IP Settings
# --> Set your IP address
# --> Set robot IP address
server_ip = ValueList({"192.168.0.67", "192.168.10.12", "192.168.10.11", "192.168.10.10", "192.168.10.2", "127.0.0.1", "192.168.10.111", "192.168.0.45", "192.168.0.30", "10.42.0.212", "10.42.0.133"}, selected="192.168.0.45")
ur_ip = ValueList({"192.168.10.10", "192.168.10.20", "192.168.10.11", "192.168.10.12", "127.0.0.1", "192.168.10.111", "192.168.0.210", "192.168.0.211", "192.168.0.235", "192.168.0.30"}, selected="192.168.0.235")
server_port = ValueList({"50002", "50003", "50005", "50006", "50007", "50008", "50009", "50010", "50011", "50012", "50013", "50014", "50015", "50016", "50017", "50018", "50019", "50020", "50021", "50022", "50023", "50024", "50025", "50026", "50027", "50028"}, selected="50020")
ur_port = ValueList({"30002"}, selected="30002")
globals = Python3Script(server_ip=server_ip, server_port=server_port, ur_ip=ur_ip, ur_port=ur_port, clear=Button())  # inputs server_ip: String, server_port: Int32, ur_ip: String, ur_port: Int32
# ---------- globals: Python ----------
from scriptcontext import sticky as st

st["server_ip"] = server_ip
st["server_port"] = server_port

st["ur_ip"] = ur_ip
st["ur_port"] = ur_port

if clear:
    st.clear()
# ---------- end globals ----------

# ----
# Check if UR robot
#  is available
ping = Button()
ping_2 = Python3Script(ip=ur_ip, ping=ping)  # -> out; inputs ip: String
# ---------- ping_2: Python ----------
from scriptcontext import sticky as st
from ur_fabrication_control.direct_control.utilities import is_available

guid = str(ghenv.Component.InstanceGuid)
txt_key = "txt_" + guid
if txt_key not in st:
    st[txt_key] = ""

if ping:
    
    available = is_available(ip)
    
    if available:
        st[txt_key] = "%s is up!" % ip
        trigger = True
    else:
        st[txt_key] = "%s is down!" % ip
        trigger = False

print(st[txt_key])
# ---------- end ping_2 ----------
panel = Panel(ping_2)

steps = Panel("200")

py3 = Python3Script()  # -> HERE, DATA, ROBOT_DESCRIPTION
# ---------- py3: Python ----------
import os

HERE = os.path.dirname(ghdoc.Path)
DATA = os.path.abspath(os.path.join(HERE, "..", "data"))
ROBOT_DESCRIPTION = os.path.abspath(os.path.join(DATA, "robot_description"))

print(HERE)
print(DATA)
print(ROBOT_DESCRIPTION)
# ---------- end py3 ----------
reload = Python3Script(reload=Button())  # -> out
# ---------- reload: Python ----------
if reload:
    from compas_rhino import unload_modules
    unload_modules("assembly_information_model")
    unload_modules('mobile_robot_control')
    unload_modules('fabrication_manager')
    unload_modules('ur_fabrication_control')
    unload_modules('spaicr')
# ---------- end reload ----------

crv = Curve(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)
crv_2 = Curve(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)

# ----
# Dual Ackerman Solver
wheelbase = Panel("0.959")
trackwidth = Panel("0.585")
linearvelocity = Panel("2.0")
wheeldia = Panel("0.285")
crv_3 = Curve(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)
c_ackerman = CSharpScript(
    c=crv_2,
    steps=steps,
    wheel_base=wheelbase,
    trackwidth=trackwidth,
    wheel_diameter=wheeldia,
    linear_velocity=linearvelocity)  # -> out, positions, velocities, timeIntervals; inputs c: Curve, steps: Int32, wheel_base: Double, trackwidth: Double, wheel_diameter: Double, linear_velocity: Double
#   port c: Path for the Mobile Robot
#   port wheel_base: Wheelbase in mm of the Mobile Robot
#   port trackwidth: Track Width in mm for the Mobile Robot
# ---------- c_ackerman: C# ----------
// Grasshopper Script Instance
#region Usings
using System;
using System.Linq;
using System.Collections;
using System.Collections.Generic;
using System.Drawing;

using Rhino;
using Rhino.Geometry;

using Grasshopper;
using Grasshopper.Kernel;
using Grasshopper.Kernel.Data;
using Grasshopper.Kernel.Types;
#endregion

public class Script_Instance : GH_ScriptInstance
{
    #region Notes
    /* 
      Members:
        RhinoDoc RhinoDocument
        GH_Document GrasshopperDocument
        IGH_Component Component
        int Iteration

      Methods (Virtual & overridable):
        Print(string text)
        Print(string format, params object[] args)
        Reflect(object obj)
        Reflect(object obj, string method_name)
    */
    #endregion
    /*
    This component takes
    */
    public List<double> CalculateWheelVelocities(double V, double R, double T, double WB, double WD)
    {
        List<double> wheelVelocity = new List<double>();

        double av_fl = (V / R) * (Math.Sqrt(Math.Pow(R + T, 2) + Math.Pow(WB / 2, 2)) / WD);
        wheelVelocity.Add(av_fl);

        double av_fr = (V / R) * (Math.Sqrt(Math.Pow(R - T, 2) + Math.Pow(WB / 2, 2)) / WD);
        wheelVelocity.Add(av_fr);

        double av_rl = (V / R) * (Math.Sqrt(Math.Pow(R + T, 2) + Math.Pow(WB / 2, 2)) / WD);
        wheelVelocity.Add(av_rl);

        double av_rr = (V / R) * (Math.Sqrt(Math.Pow(R - T, 2) + Math.Pow(WB / 2, 2)) / WD);
        wheelVelocity.Add(av_rr);

        return wheelVelocity;
    }

    private void RunScript(
	Curve c,
	int steps,
	double wheel_base,
	double trackwidth,
	double wheel_diameter,
	double linear_velocity,
	ref object positions,
	ref object velocities,
	ref object timeIntervals)
    {
        List<double> intervals = new List<double>();
        for (int step = 0; step < steps; step++)
        {
            double value = Math.Round(step * (1.0 / steps), 2);
            intervals.Add(value);
        }

        List<double> allZero = new List<double>{0,0,0,0};
        List<List<double>> positionsAll = new List<List<double>>();
        List<List<double>> velocitiesAll = new List<List<double>>();
        List<double> timeStepsAll = new List<double>();
        List<double> chassisVelocities = new List<double>();

        double lengthC = c.GetLength();
        double lengthInterval = lengthC / steps;
        Print("Curve length: " + lengthC);
        Print("Step length: " + lengthInterval);

        c.Domain = new Interval(0,1);

        double prevParam = 0.0;

        for (int i = 0; i < intervals.Count; i++) //foreach (double p in intervals)
        {
            double p = intervals[i];

            // Make a List holder for angles for the 
            List<double> position = new List<double>();
            List<double> velocity = new List<double>();

            Vector3d curvature = c.CurvatureAt(p);
            double curvatureLength = curvature.Length;
            Print("Curvature: " + curvatureLength);

            double tNorm = (double)i / (steps - 1); // normalized [0..1]
            double rampFraction = 0.2;              // 20% for accel/decel
            double vFactor;

            if (tNorm < rampFraction)
            {
                // Ramp up linearly 0 → 1
                vFactor = tNorm / rampFraction;
            }
            else if (tNorm > (1.0 - rampFraction))
            {
                // Ramp down linearly 1 → 0
                vFactor = (1.0 - tNorm) / rampFraction;
            }
            else
            {
                // Cruise at full velocity
                vFactor = 1.0;
            }

            double vCurrent = linear_velocity * vFactor;
            // store center velocity (linear, not per-wheel)
            double chassisVel = vCurrent;  // this is in m/s
            chassisVelocities.Add(chassisVel);

            if (curvatureLength == 0){
                Print("All wheel Zero");
                position = allZero;
                velocity = new List<double> { linear_velocity, linear_velocity, linear_velocity, linear_velocity };
            }
            else{
                
                /*
                Finding the radius of curvate at any given point of a curve
                It is the inverse of the Length of the Curvature Vector.
                */
                double RadCurvature = 1/curvatureLength;

                //Change the precision for faster computation
                double r = Math.Round(RadCurvature,3);
                Print("Radius of Curvature="+ r);

                // Calculate the velocity:
                velocity = CalculateWheelVelocities(vCurrent, r, trackwidth, wheel_base, wheel_diameter); 

                /*
                Calculate the orientation of the front wheels
                As the wheel position is symmertric then the same values will be used
                for the back wheels too
                */
                double fLAngle = Math.Atan((wheel_base/2)/(r+trackwidth/2));
                double fRAngle = Math.Atan((wheel_base/2)/(r-trackwidth/2));

                /*
                Calculate the direction in which the wheel will turn based on the curvature of the path
                */
                //Create two vectors to store the tangent and the accelaration
                Vector3d tangent, accel;
                Vector3d[] derriv= c.DerivativeAt(p,2);
                //Compute the Vectors    
                tangent = derriv[1];
                tangent.Unitize();

                accel = derriv[2];
                accel.Unitize();

                // Create the vector whose sign of the Z-Component decides the rotation direction of the wheels
                Vector3d signVector = Vector3d.CrossProduct(tangent,accel);     

                double sign = Math.Sign(signVector.Z);

                // Apply the sign of rotation to the wheel angles
                double fL = sign * fLAngle;
                double fR = sign * fRAngle;
                double rL = -sign * fLAngle;
                double rR = -sign * fRAngle;
                
                position.Add(fL);
                position.Add(fR);
                position.Add(rL);
                position.Add(rR);
                
            }
            positionsAll.Add(position);
            velocitiesAll.Add(velocity);

            // // ---- TIME STEP CALCULATION ----
            // double maxWheelVelocity = velocity.Max(); // rad/s
            // double maxLinearWheelSpeed = maxWheelVelocity * (wheel_diameter / 2.0); // m/s
            // double timeStep = lengthInterval / maxLinearWheelSpeed; // seconds
            

            // --- TIME STEP CALCULATION ---
            if (i > 0) // skip the first step
            {
                // Interval segDomain = new Interval(prevParam, p);
                // double stepArcLength = c.GetLength(segDomain);

                // // use average chassis velocity between last and current step
                // double avgChassisVel = (chassisVelocities[i - 1] + chassisVel) / 2.0;

                // // avoid divide-by-zero if starting at 0
                // double timeStep = (avgChassisVel > 1e-6) 
                //     ? stepArcLength / avgChassisVel 
                //     : 0.0;

                // timeStepsAll.Add(timeStep);


                Interval segDomain = new Interval(prevParam, p);
                double stepArcLength = c.GetLength(segDomain);

                // Compute average wheel linear velocity (convert rad/s to m/s)
                double avgWheelLinearVel = velocity.Average() * (wheel_diameter / 2.0);

                // Use chassis center velocity for timing
                double timeStep = stepArcLength / avgWheelLinearVel;
                Print($"Step {i}: Δs={Math.Round(stepArcLength,3)}, v_center={Math.Round(avgWheelLinearVel,3)}, dt={Math.Round(timeStep,3)}");
                timeStepsAll.Add(timeStep);
            }
            if (i == (steps - 1))
            {
                timeStepsAll.Add(0.0);
            }

            prevParam = p;
        }

        positions = positionsAll;
        velocities = velocitiesAll;
        timeIntervals = timeStepsAll;


        // Debug print
        for (int i = 0; i < steps; i++)
        {
            Print($"Step {i}: pos=({string.Join(", ", positionsAll[i])}), vel=({string.Join(", ", velocitiesAll[i])}), dt={timeStepsAll[i]:0.###}s");
        }
        
    }
}
# ---------- end c_ackerman ----------
panel_2 = Panel(c_ackerman.out)

crv_4 = Curve(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)

# ----
# ROS client
list = ValueList({"local": "127.0.0.1", "linux computer new": "192.168.0.235", "linux computer": "192.168.0.250", "linux eduroam": "10.181.95.254", "linux ccnet": "192.168.0.102", "linux vmware": "192.168.199.36", "robot": "192.168.0.200", "robotAA_wifi": "192.168.0.111", "robotAB_wifi": "192.168.0.112", "robotAB_eduroam": "10.181.67.95"}, selected="linux computer")
connect = BooleanToggle(True)
ros = Python3Script(ip=list, port="9090", connect=connect)  # -> out, ros_client, is_connected; inputs ip: String, port: Int32, connect: Boolean
# ---------- ros: Python ----------
"""
Connect or disconnect to ROS.

COMPAS FAB v0.27.0
"""
from scriptcontext import sticky as st

from compas_fab.backends import RosClient

ros_client = None

ip = ip or '127.0.0.1'
port = port or 9090
key = "ros_client_001"
ros_client = st.get(key, None)

if ros_client:
    st[key].close()
if connect:
    st[key] = RosClient(ip, port)
    st[key].run(5)

ros_client = st.get(key, None)
is_connected = ros_client.is_connected if ros_client else False
# ---------- end ros ----------
panel_3 = Panel(ros.is_connected)

# ----
# Load robot from ROS
# Make sure that ros bridge, file server, tf2_web_republisher and moveit config is running on the robot!
ros2 = BooleanToggle(True)
load = Button()
mobile_robot = Python3Script(ros_client=ros.ros_client, ros2=ros2, load=load)  # -> out, mobile_robot; inputs prefix: String
# ---------- mobile_robot: Python ----------
"""
Load robot directly from ROS.

COMPAS FAB v0.27.0
"""
from mobile_robot_control.mobile_robot import MobileRobot
from mobile_robot_control.mobile_robot_client import MobileRobotClient
import compas_robots.ghpython

# from ghpythonlib.componentbase import executingcomponent as component
from scriptcontext import sticky as st
import Rhino
import scriptcontext

scriptcontext.doc = Rhino.RhinoDoc.ActiveDoc

from compas_robots import RobotModel
from compas_robots.ghpython.scene import RobotModelObject
from compas.scene import SceneObject

scriptcontext.doc = ghdoc

key = 'robot_AA'

if ros2:
    rst = "robot_state_publisher:"
    mg = "move_group:"
else:
    rst = ""
    mg = ""

print(key)
if ros_client and ros_client.is_connected and load:
    # Load URDF from ROS
    robot = ros_client.load_robot(
            load_geometry=True, 
            urdf_param_name= '{}/{}robot_description'.format(prefix, rst),
            srdf_param_name= '{}/{}robot_description_semantic'.format(prefix, mg))
    try:
        robot.scene_object = SceneObject(item=robot.model)
    except:
        robot.scene_object = RobotModelObject(robot.model)
    #mobile_robot = MobileRobot(robot.model, robot.scene_object, robot.semantics, client=None)
    st[key] = robot

mobile_robot = st.get(key, None)
if mobile_robot:  # client sometimes need to be restarted, without needing to reload geometry
    mobile_robot.mobile_client = MobileRobotClient(ros_client)
    mobile_robot.client = ros_client
# ---------- end mobile_robot ----------
py3_2 = Python3Script(robot=mobile_robot.mobile_robot, ros_client=ros.ros_client)  # -> out, mobile_robot
# ---------- py3_2: Python ----------
from mobile_robot_control.mobile_robot import MobileRobot
from mobile_robot_control.mobile_robot_client import MobileRobotClient

mobile_robot = MobileRobot(robot.model, robot.scene_object, robot.semantics, client=None)
mobile_robot.mobile_client = MobileRobotClient(ros_client)
#mobile_robot.client = ros_client
# ---------- end py3_2 ----------

list_2 = ValueList({"rbvogui_xl_ur20", "rbvogui_xl_lift_ur10e_indoor", "rbvogui_xl_lift_ur10e_outdoor", "husky", "husky_ur10e"}, selected="rbvogui_xl_lift_ur10e_indoor")
py3_3 = Python3Script()  # -> mobile_robot_data_path, ur_data_path
# ---------- py3_3: Python ----------
import os

"""
ASSUMING THE BELOW PACKAGES ARE STORED IN THE SAME LOCATION:
    ur_fabrication_control;
    rbvogui_common; and
    mobile_additive_manufacturing.
"""

repositories_path = os.path.abspath(os.path.join(ghdoc.Path,"../../../"))

assert os.path.exists(os.path.join(repositories_path, "ur_fabrication_control/data"))
assert os.path.exists(os.path.join(repositories_path, "mobile_robot_control/data/robot_description/rbvogui_xl_lift_ur10e"))

ur_data_path = os.path.abspath(os.path.join(ghdoc.Path,"../../../ur_fabrication_control/data"))
mobile_robot_data_path = os.path.abspath(os.path.join(ghdoc.Path,"../../../mobile_robot_control/data"))
# ---------- end py3_3 ----------

# ----
# ROBOT
panel_4 = Panel("ee_link")

py3_4 = Python3Script(mobile_robot_data_path=py3_3.mobile_robot_data_path, ur_data_path=py3_3.ur_data_path, robot_type=list_2)  # -> loaders, urdf_filename, srdf_filename
# ---------- py3_4: Python ----------
import os
from compas_robots import RobotModel
from compas_robots.resources import LocalPackageMeshLoader

import compas_fab

#loaders

ur_path = os.path.join(ur_data_path, "robot_description")
ur_packages = ["ur_e_description"]
ur_loaders = [LocalPackageMeshLoader(ur_path, pck) for pck in ur_packages]

robot_folder = robot_type
if "_indoor" in robot_type:
    robot_folder = robot_folder.replace("_indoor", "")

mobile_robot_path = os.path.join(mobile_robot_data_path, "robot_description", robot_folder)

if "husky" in robot_folder:
    mobile_robot_packages = ["a200"]
else:
    mobile_robot_packages = ["rbvogui_description", "ewellix_description", "robotnik_sensors"]

mobile_robot_loaders = [LocalPackageMeshLoader(mobile_robot_path, pck) for pck in mobile_robot_packages]

loaders = ur_loaders + mobile_robot_loaders

#files
if robot_type == "rbvogui_xl_lift_ur10e_indoor":
    urdf_filename = os.path.join(mobile_robot_path, r"rbvogui_xl_lift_ur10e_indoor.urdf")
    srdf_filename = os.path.join(mobile_robot_path, r"rbvogui.srdf")
elif robot_type == "rbvogui_xl_lift_ur10e_outdoor":
    urdf_filename = os.path.join(mobile_robot_path, r"rbvogui_xl_lift_ur10e.urdf")
    srdf_filename = os.path.join(mobile_robot_path, r"rbvogui.srdf")
elif robot_type == "husky":
    urdf_filename = os.path.join(mobile_robot_path, r"husky_basic.urdf")
    srdf_filename = os.path.join(mobile_robot_path, r"robot.srdf")
elif robot_type == "husky_ur10e":
    urdf_filename = os.path.join(mobile_robot_path, r"husky_ur10e.urdf")
    srdf_filename = os.path.join(mobile_robot_path, r"husky_ur10e.srdf")

assert os.path.isfile(urdf_filename)
assert os.path.isfile(srdf_filename)
# ---------- end py3_4 ----------
units = ValueList({"m": 1, "cm": 100, "mm": 1000}, selected="m")
toggle = BooleanToggle(True)

# ----
# Load robot locally
load_2 = Button()
mobile_robot_2 = Python3Script(
    ros_client=ros.ros_client,
    loaders=py3_4.loaders,
    urdf_filename=py3_4.urdf_filename,
    srdf_filename=py3_4.srdf_filename,
    scale_factor=units,
    load=load_2)  # -> out, mobile_robot; inputs loaders: list
# ---------- mobile_robot_2: Python ----------
"""
Load robot directly from ROS.

COMPAS FAB v0.27.0
"""
from mobile_robot_control.mobile_robot import MobileRobot
from mobile_robot_control.mobile_robot_client import MobileRobotClient
import compas_robots.ghpython
import compas
import math

# from ghpythonlib.componentbase import executingcomponent as component
from scriptcontext import sticky as st
import Rhino
import scriptcontext

scriptcontext.doc = Rhino.RhinoDoc.ActiveDoc

from compas_robots import RobotModel
from compas_robots.ghpython.scene import RobotModelObject
from compas_fab.robots import RobotSemantics
from compas.scene import SceneObject
from compas.geometry import Rotation

scriptcontext.doc = ghdoc

compas.PRECISION = '12f'

key = 'a200-0000'


print(key)
if load:
    # Load URDF locally
    model = RobotModel.from_urdf_file(urdf_filename)
    model.load_geometry(*loaders)
    try:
        scene_object = SceneObject(item=model)
    except:
        scene_object = RobotModelObject(model)
    semantics = RobotSemantics.from_srdf_file(srdf_filename, model)
    mobile_robot = MobileRobot(model, scene_object, semantics, client=None)
    if ros_client is not None:
        mobile_robot.mobile_client = MobileRobotClient(ros_client)
        mobile_robot.client = ros_client

    # setting the base or base inertia frame by rotating base_link 180 degrees
    arm_base_link = mobile_robot.get_base_frame()
    arm_base_inertia = arm_base_link.transformed(Rotation.from_axis_and_angle(arm_base_link.zaxis, math.radians(180), arm_base_link.point))
    mobile_robot._RCF = arm_base_inertia
    st[key] = mobile_robot

mobile_robot = st.get(key, None)
# if mobile_robot:  # client sometimes need to be restarted, without needing to reload geometry
#     mobile_robot.mobile_client = MobileRobotClient(ros_client)
#     mobile_robot.client = ros_client
# ---------- end mobile_robot_2 ----------

robot = Data(mobile_robot_2.mobile_robot)
info = Python3Script(robot=robot)  # -> out, main_group_name
# ---------- info: Python ----------
if robot:
    robot.info()
    main_group_name = robot.main_group_name
# ---------- end info ----------
panel_5 = Panel(info.out)

# ----
# Import from JSON
panel_6 = Panel("260115_EXP4_3_move_last_anchors_estimated_realigned_vis_anchor")
import = Button()
toggle_2 = BooleanToggle(False)
path = Python3Script()  # -> out, DATA
# ---------- path: Python ----------
import os
import getpass

username = getpass.getuser()
USER_FOLDER = os.path.abspath(os.path.join("C:/Users/", username))
DATA = os.path.abspath(os.path.join(USER_FOLDER,"workspace/projects/spaicr/data/3rd_experiment"))

print(USER_FOLDER)
print(DATA)
# ---------- end path ----------
import_bcf = Python3Script(robot=robot, new=toggle_2, DATA=path.DATA, import=import, name=panel_6)  # -> out; inputs DATA: String, name: String
# ---------- import_bcf: Python ----------
import os
import json
from assembly_information_model.assembly import Assembly
from scriptcontext import sticky as st
from compas.geometry import Frame

def translate_to_frame(json_frame):
    compas_frame = Frame(json_frame["point"], json_frame["xaxis"], json_frame["yaxis"])
    return compas_frame

# name = "260113_EXP4_2_move_anchors_estimated3_realigned_correct_pick_32"
if _import:
    if not new:
        filename = name + "_BCF.json"
        PATH = os.path.join(DATA, filename)
        
        with open(PATH) as json_data:
            d = json.load(json_data)
            json_data.close()
            
            last_data = d[-1]
            
            # robot.motion_enabled = False # whether the mobile robot is moving
            # robot.is_aligned = False # whether the WCF_slam (okvis world) is aligned with WCF (rhino world)

            robot.WCF_slam = translate_to_frame(last_data["WCF_slam"]) # reference (okvis) world coordinate frame in WCF (WCF_slam) 
            robot.BCF_slam = translate_to_frame(last_data["BCF_slam"]) # (okvis) base coordinate frame in WCF_slam (BCF_slam)
            print(robot.BCF_slam)
            robot.BCF_gt = translate_to_frame(last_data["BCF_gt"])  # ground truth IsaacSim base coordinate frame in WCF (BCF_gt) 
                
            robot._frame_log = []
            for data in d:
                robot._frame_log.append(data)
            
            robot._update_BCF() # compute initial BCF
            # robot._record_state("init") # record initial state
# ---------- end import_bcf ----------

# ----
# Attach tool
list_3 = ValueList({"measurement tool": 0, "area gripper": 1, "parallel gripper": 2, "camera": 3}, selected="area gripper")
show = BooleanToggle(False)
path_2 = Python3Script()  # -> DATA
# ---------- path_2: Python ----------
import os

package_path = ghdoc.Path
DATA = os.path.abspath(os.path.join(ghdoc.Path,"../../../mobile_robot_control/data"))

print(package_path)
print(DATA)
# ---------- end path_2 ----------
tool = Python3Script(data_path=path_2, tool=list_3, show=show)  # -> tool, M, ee_plane; inputs data_path: String
# ---------- tool: Python ----------
import os, math
from compas.geometry import Frame, Rotation, Vector, Quaternion
from compas.datastructures import Mesh
from compas_rhino.conversions import mesh_to_rhino, frame_to_rhino_plane
from compas_fab.robots import Tool

tolerance = 0

if tool == 0:
    filename = 'measurement_tool_ur20_zaxis.stl'
    #ee_frame = Frame([0, 0, 0], [1, 0, 0], [0, 1, 0])
    ee_frame = Frame([0, 0, 0.122], [1, 0, 0], [0, 1, 0])

elif tool == 1:
    filename = 'area_gripper_extended_55mm.stl'
    ee_frame = Frame([0, 0, 0.145 + tolerance], [1, 0, 0], [0, 1, 0])

elif tool == 2:
    filename = 'parallel_gripper_ur20_zaxis.stl'
    ee_frame = Frame([0, 0, 0.166 + tolerance], [0, -1, 0], [1, 0, 0])

# elif tool == 3:
#     filename = 'long_drill_parallel_gripper_ur20_zaxis.stl'
#     ee_frame = Frame([0.31, -0.063, 0.111], [0, 0, 1], [0, -1, 0]) #Frame([0.20543, -0.065, 0.109], [0, 0, 1], [0, -1, 0])
#     ee_frame = ee_frame.transformed(Rotation.from_axis_and_angle(ee_frame.zaxis, math.radians(0), ee_frame.point))
elif tool == 3:
    filename = 'parallel_gripper_ur20_zaxis.stl'
    #ee_frame = Frame.from_quaternion(Quaternion(0, 0, 0.707106, 0.707106), [0.0175, 0.0572, 0.0850])
    #ee_frame = Frame.from_quaternion(Quaternion(0, 0, 0.707106, 0.707106), [0.0325, 0.0572, 0.0830])
    # adjustments according to gt
    #ee_frame = Frame([0.05, 0.059, 0.0830], [-1, 0, 0], [0, 0, 1])
    ee_frame = Frame([-0.0327, 0.0572, 0.0815], [-1, 0, 0], [0, 0, 1])
    #ee_frame = Frame([0.04, 0.059, 0.0830], [-1, 0, 0], [0, 0, 1])

data_path = os.path.join(data_path, "tool_geometry")
fullfilename = os.path.join(data_path, filename)

ee_mesh = Mesh.from_stl(fullfilename)

if show:
    M = mesh_to_rhino(ee_mesh)

tool = Tool(ee_mesh, ee_frame)
ee_plane = frame_to_rhino_plane(ee_frame)
print(ee_frame.quaternion.xyzw)
ee_framek = Frame([0.0110607,0.00809854,0.41498], [0,1,0], [1,0,0])
print(ee_framek.quaternion.xyzw)
# ---------- end tool ----------
remove = Button()
attach = Button()
mesh = Mesh(tool.M)
attach_tool = Python3Script(robot_type=list_2, robot=robot, tool=tool.tool, attach=attach, remove=remove)  # -> tool, M, ee_plane, bang
# ---------- attach_tool: Python ----------
if "husky" in robot_type:
    flange_name = "arm_0_flange"
else:
    flange_name = "robot_arm_flange"

print(robot.get_group_names_from_link_name(flange_name))

if attach:
    for planning_group in robot.get_group_names_from_link_name(flange_name):
        robot.attach_tool(tool, group=planning_group)

if remove:
    for planning_group in robot.get_group_names_from_link_name(flange_name):
        robot.detach_tool(group=planning_group)
# ---------- end attach_tool ----------

# ----
# Move mobile robot base
list_4 = ValueList({"isaac_BCF": isaac, "origin", "set_to_BCF", "set_to_RCF"}, selected="isaac_BCF")
angle = Slider(0, range=0..360)
origin = Point(Point(12.5, 6, 0))
plane = Python3Script(origin=origin, angle=angle)  # -> plane; inputs origin: Point3d
# ---------- plane: Python ----------
import Rhino.Geometry as rg
import math

plane = rg.Plane(origin, rg.Vector3d.XAxis, rg.Vector3d.YAxis)
plane.Rotate(math.radians(angle), rg.Vector3d.ZAxis)
# ---------- end plane ----------
set_frame = Python3Script(robot=robot, set_frame_to=list_4, target_BCF=plane, target_RCF=plane)  # -> bang; inputs target_BCF: Plane, target_RCF: Plane; disabled
# ---------- set_frame: Python ----------
from compas.geometry import Frame, Point, Vector, Transformation
from compas.datastructures import Mesh
from compas_fab.robots import CollisionMesh
from compas_rhino.conversions import plane_to_compas_frame

if set_frame_to == "set_to_BCF":
    BCF = plane_to_compas_frame(target_BCF)
elif set_frame_to == "set_to_RCF":
    RCF = plane_to_compas_frame(target_RCF)
    BCF = robot.transform_frame_from_RCF_to_BCF(RCF)
else:
    BCF = Frame.worldXY()

if robot and set_frame_to != "isaac_BCF":
    robot.BCF = BCF
# ---------- end set_frame ----------

# ----
# Planning scene
scene = Python3Script(robot=robot)  # -> scene
# ---------- scene: Python ----------
"""
Create a planning scene.

COMPAS FAB v0.28.0
"""

from ghpythonlib.componentbase import executingcomponent as component
from scriptcontext import sticky as st

from compas_fab.robots import PlanningScene


class PlanningSceneComponent(component):
    def RunScript(self, robot):
        key = "planning_scene"
        if robot:
            st[key] = PlanningScene(robot)
        return st.get(key, None)
# ---------- end scene ----------

# ----
# Attach collision mesh to scene
append = Button()
remove_2 = Button()
add = Button()
mesh_object = Mesh(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)
mesh_table = Mesh(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)
collision_mesh = Python3Script(scene=scene, mesh=mesh_table, identifier="table", add=add, append=append, remove=remove_2)  # -> ok, bang; inputs mesh: Mesh, identifier: String
# ---------- collision_mesh: Python ----------
"""
Add or remove a collision mesh from the planning scene.
"""

from compas_rhino.conversions import mesh_to_compas
from compas_fab.robots import CollisionMesh

ok = False
Message = ""

if (add and append) or (append and remove) or (add and remove):
    Message = "Use only one operation at a time\n(add, append or remove)"
    raise Exception(Message)

if scene and mesh and identifier:
    compas_mesh = mesh_to_compas(mesh)
    collision_mesh = CollisionMesh(compas_mesh, identifier)
    if add:
        scene.add_collision_mesh(collision_mesh)
        Message = "Added"
        ok = True
    if append:
        scene.append_collision_mesh(collision_mesh)
        Message = "Appended"
        ok = True
    if remove:
        scene.remove_collision_mesh(identifier)
        Message = "Removed"
        ok = True
# ---------- end collision_mesh ----------
panel_7 = Panel(collision_mesh.ok)

# ----
# Attach collision mesh to robot
panel_8 = Panel("attached_brick")
remove_3 = Button()
add_2 = Button()
mesh_2 = Mesh(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)
attached_collision_mesh = Python3Script(scene=scene, mesh=mesh_2, identifier=panel_8, link_name=panel_4, touch_links=panel_4, add=add_2, remove=remove_3)  # -> out, attached_collision_mesh, bang; inputs mesh: Mesh
# ---------- attached_collision_mesh: Python ----------
"""
Add an attached collision mesh to the robot.

COMPAS FAB v0.28.0
"""

from compas_rhino.conversions import mesh_to_compas
from ghpythonlib.componentbase import executingcomponent as component

from compas_fab.robots import AttachedCollisionMesh
from compas_fab.robots import CollisionMesh

from compas_ghpython import create_id
import Rhino

class AttachedCollisionMeshComponent(component):
    def RunScript(self,
            scene,
            mesh: Rhino.Geometry.Mesh,
            identifier,
            link_name,
            touch_links,
            add,
            remove):
        attached_collision_mesh = None
        if scene and mesh and identifier and link_name:
            compas_mesh = mesh_to_compas(mesh)
            collision_mesh = CollisionMesh(compas_mesh, identifier)
            attached_collision_mesh = AttachedCollisionMesh(collision_mesh, link_name, touch_links)
            if add:
                scene.add_attached_collision_mesh(attached_collision_mesh)
                scene.attach_collision_mesh_to_robot_end_effector(collision_mesh, group="ur20_and_liftkit")
                scene.attach_collision_mesh_to_robot_end_effector(collision_mesh, group="ur20")
            if remove:
                scene.remove_attached_collision_mesh(identifier)
                scene.remove_collision_mesh(identifier)
        return attached_collision_mesh
# ---------- end attached_collision_mesh ----------
panel_9 = Panel(attached_collision_mesh.attached_collision_mesh)

reset = Button()
reset_robot = Python3Script(robot=robot, reset=reset)  # -> out
# ---------- reset_robot: Python ----------
import os
from compas.geometry import Frame

if reset:
    # robot.BCF_slam = Frame([
    #         3.006913068852687,
    #         3.0160358483992233,
    #         -1.9073486328125e-05
    #     ],
    #     [
    #         0.9999999999989901,
    #         2.9783522909615563e-07,
    #         1.3896494410682697e-06
    #     ],
    #     [
    #         -2.978328823455311e-07,
    #         0.9999999999985297,
    #         -1.6887356034143998e-06
    #     ])

    robot.motion_enabled = False # whether the mobile robot is moving
    robot.is_aligned = False # whether the WCF_slam (okvis world) is aligned with WCF (rhino world)

    robot.WCF_slam = Frame.worldXY()  # reference (okvis) world coordinate frame in WCF (WCF_slam) 
    robot.BCF_slam = Frame.worldXY()  # (okvis) base coordinate frame in WCF_slam (BCF_slam)
    
    robot.BCF_gt = Frame.worldXY()  # ground truth IsaacSim base coordinate frame in WCF (BCF_gt) 
        
    robot._frame_log = []
    
    robot._update_BCF() # compute initial BCF
    robot._record_state("init") # record initial state


print(robot._frame_log)
# ---------- end reset_robot ----------

# ----
# Import Assembly
import_2 = Python3Script(new=toggle_2, DATA=path.DATA, import=import, name=panel_6)  # -> out, assembly; inputs DATA: String
# ---------- import_2: Python ----------
import os
import json
from assembly_information_model.assembly import Assembly
from scriptcontext import sticky as st

if _import:
    if new:
        DATA = os.path.join(DATA, "assembly")
        filename = "brick_bench_v2_2T.json"
    else:
        filename = name + "_bench.json"
    PATH = os.path.join(DATA, filename)
    print(PATH)
    assembly = Assembly.from_json(PATH)

    st['building_structure'] = assembly

assembly = st.get('building_structure')
# ---------- end import_2 ----------

# ----
# Configuration
# zero configuration
zero = Python3Script(robot=robot, group=info.main_group_name)  # -> out, configuration; inputs group: String
# ---------- zero: Python ----------
configuration = robot.zero_configuration(group)
# ---------- end zero ----------

number_slider = Slider(0, range=0..40)

# ----
# forward kinematics
number_slider_2 = Slider(180, range=-400..400)
forward_kinematics = Python3Script(
    robot=robot,
    lift=number_slider,
    j1=Slider(-54.5, range=-180..180),
    j2=Slider(-90, range=-360..360),
    j3=Slider(-90, range=-180..180),
    j4=Slider(214.4, range=-400..400),
    j5=Slider(94.3, range=-125..120),
    j6=number_slider_2)  # -> configuration
# ---------- forward_kinematics: Python ----------
import math

from compas_robots.model import Joint
from compas_robots import Configuration


if robot:
    joint_types = robot.get_configurable_joint_types()
    joint_names = robot.get_configurable_joint_names()
    print(joint_names)
    joint_values = [j1, j2, j3, j4, j5, j6]
    for i, joint_value in enumerate(joint_values):
        joint_values[i] = math.radians(joint_values[i])
    
    if len(robot.get_configurable_joints()) == 6:
        configuration = Configuration(joint_values, joint_types, joint_names)
    else:
        configuration = Configuration.from_prismatic_and_revolute_values([lift], joint_values)

    configuration = Configuration(joint_values, joint_types, joint_names)
    print (configuration)
# ---------- end forward_kinematics ----------

subscribe = Button()
unsubscribe = Button()
send = Button()
send_2 = Button()
get_tf_frames = Python3Script(robot=robot, subscribe=subscribe, unsubscribe=unsubscribe)  # -> pose_frame
# ---------- get_tf_frames: Python ----------
from compas_fab.backends.ros.messages import Header

# header = Header()
# header = header.msg.copy()
# header.pop("seq", None)
# print(header)


from roslibpy import Service, ServiceRequest
from compas.geometry import Point, Frame, Quaternion
from scriptcontext import sticky as st


# if not hasattr(st, "pose_frame"):
#     st["pose_frame"] = None

def _receive_base_frame_callback(message):
    pose_point = Point(
        message["translation"]["x"],
        message["translation"]["y"],
        message["translation"]["z"],
    )
    pose_quaternion = Quaternion(
        message["rotation"]["w"],
        message["rotation"]["x"],
        message["rotation"]["y"],
        message["rotation"]["z"],
    )
    st["pose_frame"] = Frame.from_quaternion(pose_quaternion, pose_point)

if subscribe:
    robot.mobile_client.tf_subscribe(
                    "robot_base_footprint", #"base_camera_imu_frame",
                    "gt_world",
                    _receive_base_frame_callback,
                    timeout=5,
                )

pose_frame = st["pose_frame"]
print(pose_frame)

if unsubscribe:
    robot.mobile_client.tf_unsubscribe(
                    "robot_base_footprint", #"base_camera_imu_frame",
                    "gt_world",
                )
# ---------- end get_tf_frames ----------
send_joint_values = Python3Script(robot=robot, config=forward_kinematics, send=send)  # -> out
# ---------- send_joint_values: Python ----------
import roslibpy
import time

def configuration_to_joint_state_msg(config):
    msg = {
        'name': config.joint_names,
        'position': config.joint_values,
    }
    return msg

def publish_one_time_joint_state(client, config):
    publisher = roslibpy.Topic(client, '/isaac_joint_command', 'sensor_msgs/JointState')
    publisher.publish(configuration_to_joint_state_msg(config))
    print("Published one JointState message.")
    time.sleep(0.5)
    # publisher.unadvertise()

print(config)

if send:
    publish_one_time_joint_state(robot.client, config)


# joint_names = ['robot_ewellix_lift_top_joint',
#                 'robot_arm_shoulder_pan_joint', 
#                'robot_arm_shoulder_lift_joint', 
#                'robot_arm_elbow_joint', 
#                'robot_arm_wrist_1_joint', 
#                'robot_arm_wrist_2_joint', 
#                'robot_arm_wrist_3_joint']
# joint_positions = [0.2, 0.0, 0.0, 0.0, 0.0, 5.0, 0.0]

# msg = {
#     'name': joint_names,
#     'position': joint_positions,
# }
# ---------- end send_joint_values ----------
send_nav_action = Python3Script(robot=robot, send=send_2)  # -> out
# ---------- send_nav_action: Python ----------
import roslibpy
import time


# Create the NavigateToPose action client
action_client = roslibpy.ActionClient(
    robot.mobile_client.ros_client,
    '/robot/navigate_to_pose',
    'nav2_msgs/action/NavigateToPose'
)

print(action_client)
# Create the goal message (same structure as the ROS 2 CLI)
goal = roslibpy.Goal(
    {
        'pose': {
            'header': {
                'frame_id': 'robot_map'
            },
            'pose': {
                'position': {'x': 3.0, 'y': 0.0, 'z': 0.0},
                'orientation': {'x': 0.0, 'y': 0.0, 'z': 0.0, 'w': 1.0}
            }
        }
    }
)

def result_callback(msg):
    print("Action result:" + msg)

def feedback_callback(msg):
    print(f"Action feedback: {msg['sequence']}")

def fail_callback(msg):
    print(f"Action failed: {msg}")

# goal_msg.on('feedback', feedback_callback)

if send:
    print('Sending goal...')
    action_client.send_goal(goal, result_callback, feedback_callback, fail_callback)

# # Wait for result (non-blocking versions also possible)
# result = goal_msg.wait(timeout=60)
# print('Result:', result)
# ---------- end send_nav_action ----------
panel_10 = Panel(send_nav_action)
panel_11 = Panel(send_joint_values)
panel_12 = Panel(get_tf_frames)

# ----
# analytical inverse kinematics
select_configuration = Slider(0, range=0..7)
plane_2 = Plane(Plane(origin=(0.8304488596, -0.4403621891, 0.5339687678), x=(-1, 0, 0), y=(0, 1, 0)))
analytic_inverse = Python3Script(robot=robot, lift=number_slider, plane=plane_2, idx=select_configuration)  # -> out, configuration; inputs plane: Plane, idx: Int32
# ---------- analytic_inverse: Python ----------
import Rhino.Geometry as rg
import math
from compas.geometry import Frame, Transformation, Rotation
from compas_robots import Configuration
from ur_fabrication_control.kinematics.ur_kinematics import inverse_kinematics
from ur_fabrication_control.kinematics.ur_params import ur_params
from compas_rhino.conversions import plane_to_compas_frame

# transform frame to robot coordinate system
frame_WCF = plane_to_compas_frame(plane)
frame_RCF = robot.from_WCF_to_RCF(frame_WCF)

if robot.attached_tool:
    tool0_RCF = robot.from_tcf_to_t0cf([frame_RCF])[0]
else:
    tool0_RCF = frame_RCF

# calculate solutions to frame
ur_params = ur_params["ur10e"] # get the parameters according to the robot model
# print ur_params
solutions = inverse_kinematics(tool0_RCF, ur_params)
# print solutions

if not len(solutions):
    joint_values = [0, 0, 0, 0, 0, 0]
else:
    joint_values = solutions[idx]

if len(robot.get_configurable_joints()) == 6:
    configuration = Configuration.from_revolute_values(joint_values)
else:
    configuration = Configuration.from_prismatic_and_revolute_values([lift], joint_values)

print(configuration)
# ---------- end analytic_inverse ----------

# ----
# inverse kinematics
list_5 = ValueList({"ur20", "ur20_and_liftkit"}, selected="ur20")
compute = Button()
inverse = Python3Script(robot=robot, plane=plane_2, start_configuration=forward_kinematics, group=list_5, compute=compute)  # -> out, configuration
# ---------- inverse: Python ----------
"""
Calculate the robot's inverse kinematic for a given plane.

COMPAS FAB v1.0.2
"""
from compas_robots import Configuration
from compas_rhino.conversions import plane_to_compas_frame
from ghpythonlib.componentbase import executingcomponent as component
from scriptcontext import sticky as st



class InverseKinematics(component):
    def RunScript(self, robot, plane, start_configuration, group, compute):

        key = "inverse_solution"
        configuration = None
        if robot and robot.client and robot.client.is_connected and plane and compute:
            frame = plane_to_compas_frame(plane)
            configuration = robot.inverse_kinematics(frame, start_configuration, group)
            st["inverse_solution"] = configuration
        configuration = st.get("inverse_solution", None)
        print(configuration)
        return configuration
# ---------- end inverse ----------

list_6 = ValueList({"0 zero_configuration": 0, "1 forward_kinematics": 1, "2 analytic_inverse_kinematics": 2, "3 inverse_kinematics": 3, "4 motion_planning": 4, "5 real_configuration": 5, "6 assembly": 6}, selected="2 analytic_inverse_kinematics")
show_robot_collision = BooleanToggle(False)
show_rcf = BooleanToggle(True)

# ----
# Building
# Structure
toggle_3 = GroupToggle(ToggleActive=True, ToggleVisible=False)  # disabled

snapshot_poses = Python3Script(
    snap_radius=Slider(0.4, range=0..1),
    snap_amount=Slider(12, range=1..12),
    snap_height=Slider(0, range=-0.5..1),
    cam_angle_y=Slider(50, range=0..90),
    cam_angle_z=Slider(30, range=0..90))  # -> out, snap_planes; inputs snap_amount: Int32
# ---------- snapshot_poses: Python ----------
from compas.geometry import Frame, Translation, Rotation, Vector
from compas_rhino.conversions import frame_to_rhino_plane
import math

snap_angle = math.radians(360 / snap_amount)
snap_frames = []
snap_frame = Frame([snap_radius, 0, 0], -Vector.Xaxis(), Vector.Yaxis())
snap_frame = snap_frame.transformed(Rotation.from_axis_and_angle(snap_frame.yaxis, math.radians(cam_angle_y), snap_frame.point))
snap_frame = snap_frame.transformed(Rotation.from_axis_and_angle(Vector.Zaxis(), math.radians(cam_angle_z), snap_frame.point))

for snap in range(snap_amount):
    R = Rotation.from_axis_and_angle(Vector.Zaxis(), snap_angle*snap)
    T = Translation.from_vector([0.275, 0, snap_height+1.03])
    snap_frames.append(snap_frame.transformed(T*R))

snap_planes = [frame_to_rhino_plane(f) for f in snap_frames]
# ---------- end snapshot_poses ----------

plane_3 = Plane(Plane(origin=(0.8304488596, -0.4403621891, 0.5339687678), x=(-1, 0, 0), y=(0, 1, 0)))

# ----
# State viewer
trigger = Trigger(Interval=1000, TimerInterval=1000, Target=fabrication_state)
fabrication_state = Python3Script()  # -> out, state, num_tasks, num_current_task, num_tasks_left, log_messages
# ---------- fabrication_state: Python ----------
from scriptcontext import sticky as st

fabrication = st["fabrication"]

if hasattr(fabrication, "task_thread"):
    if fabrication.task_thread.is_alive():
        state = "THREAD RUNNING"
    else:
        state = "THREAD STOPPED"
print(fabrication.current_task_key)
num_tasks = len(fabrication.tasks)
if fabrication.current_task_key is not None:
    num_current_task = fabrication.current_task_key-1
else:
    num_current_task = 0

num_tasks_left = num_tasks-num_current_task
log_messages = fabrication.log_messages

# assembly = st["assembly"]
# ---------- end fabrication_state ----------
state = Panel(fabrication_state.state)
num_tasks = Panel(fabrication_state.num_tasks)
num_current_task = Panel(fabrication_state.num_current_task)
num_tasks_left = Panel(fabrication_state.num_tasks_left)

list_7 = ValueList({"0 scene": 0, "1 object": 1}, selected="0 scene")

# ----
# Sep3
rb1 = Plane(Plane(origin=(0.6725231207, -0.4615428372, 1.041258148), x=(0.2156449847, -0.9755287641, -0.0429053724), y=(-0.6025398445, -0.09836045407, -0.7920043919)))  # disabled
rb2 = Plane(Plane(origin=(1.759539187, -0.2475634076, 0.9605897281), x=(0.5797825115, 0.8131602573, 0.05121167121), y=(0.3466076153, -0.189271475, -0.9187162074)))  # disabled
rb3 = Plane(Plane(origin=(1.630471757, 0.01747498572, 0.9343331252), x=(0.5375180751, 0.8407013145, 0.06554096975), y=(0.4056053512, -0.189622509, -0.8941630741)))  # disabled
rb4 = Plane(Plane(origin=(0.6221946774, 0.2532513394, 1.011211859), x=(-0.7940159923, -0.607788434, 0.011481442), y=(-0.252184849, 0.3121520066, -0.9159497403)))  # disabled
toggle_4 = GroupToggle(ToggleActive=True, ToggleVisible=False)  # disabled

# ----
# Import gt from JSON
import_3 = Button()
gt = Python3Script(import=import_3, in_rcf=Toggle(False))  # -> out, points, surfaces, boxes, midpoints, frames, keys
# ---------- gt: Python ----------
import os
import json
import time
from scriptcontext import sticky as st
from compas.geometry import Box, Frame, Transformation, Point, Polygon, Vector, midpoint_point_point, Translation
from compas.datastructures import Mesh
import compas
from compas_rhino.conversions import point_to_rhino, mesh_to_rhino, frame_to_rhino_plane, box_to_rhino

surfaces = []
midpoints = []
points = []
frames = []
keys = []
boxes = []

if not st.get('import_ground_truth'):
    st['import_ground_truth'] = {}

if import_:
    position_1 = "250123_tall_assembly_collection.json"
    position_2 = "250220_2ndposition_tall_assembly_collection_final.json" #"250205_2ndposition_tall_assembly_collection.json" #"241122_tall_assembly_collection.json" #"240930_collection.json"
    filename = position_2
    DATA = os.path.abspath(os.path.join(ghdoc.Path,"../../data/2nd_experiment/ground_truth"))
    PATH = os.path.join(DATA, filename)
    print(PATH)
    with open(PATH, 'r') as f:
        st['import_ground_truth'] = compas.data.json_load(f)

    filename = position_2
    DATA = os.path.abspath(os.path.join(ghdoc.Path,"../../data/2nd_experiment/ground_truth"))
    PATH = os.path.join(DATA, filename)
    print(PATH)
    with open(PATH, 'r') as f:
        st['import_ground_truth_2'] = compas.data.json_load(f)

# gt_1 = st.get('import_ground_truth')
# gt_2 = st.get('import_ground_truth_2')

# f1 = Frame(gt_1["10_0"]["a"], Vector.from_start_end(gt_1["10_0"]["d"], gt_1["10_0"]["a"]), Vector.from_start_end(gt_1["10_0"]["d"], gt_1["10_0"]["c"]))
# f2 = Frame(gt_2["10_0"]["a"], Vector.from_start_end(gt_2["10_0"]["d"], gt_2["10_0"]["a"]), Vector.from_start_end(gt_2["10_0"]["d"], gt_2["10_0"]["c"]))

# T = Transformation.from_frame_to_frame(f1, f2)
# print(T)
# Dimensions full brick
width = 0.115
length = 0.237
height = 0.05
brick_shape = Box(width, length, height, Frame([0, 0, 0], [1, 0, 0], [0, -1, 0]))

if show and st.get('import_ground_truth'):
    for key, brick in st['import_ground_truth'].items():
        print("brick", key, brick)
        if in_rcf:
            corners = ["a_rcf", "b_rcf", "c_rcf", "d_rcf"]
        else:
            corners = ["a", "b", "c", "d"]
        for c in corners:
            if brick.get(c):
                points.append(point_to_rhino(brick.get(c)))
        
        if all(c in brick.keys() for c in corners):
            # f1 = Frame(brick[corners[0]], Vector.from_start_end(brick[corners[0]], brick[corners[1]]), Vector.from_start_end(brick[corners[0]], brick[corners[3]]))
            # T1 = Translation.from_vector(-f1.zaxis*0.05)
            top_outline = Polygon([brick[corners[0]], brick[corners[1]], brick[corners[2]], brick[corners[3]], brick[corners[0]]])
            # bottom_outline = top_outline.transformed(T1)

            centroid = top_outline.centroid
            xaxis = -Vector.from_start_end(centroid, midpoint_point_point(brick[corners[2]], brick[corners[3]]))
            yaxis = -Vector.from_start_end(centroid, midpoint_point_point(brick[corners[1]], brick[corners[2]]))
            frame = Frame(centroid, xaxis, yaxis).transformed(Translation.from_vector(-Vector.Zaxis()*0.025))

            midpoints.append(point_to_rhino(centroid))
            top = mesh_to_rhino(Mesh.from_polygons([top_outline]))

            TS = Transformation.from_frame(frame)
            brick = brick_shape.transformed(TS)
            boxes.append(box_to_rhino(brick))

            surfaces.append(top)
            frames.append(frame)
            keys.append(key)
# ---------- end gt ----------
geo = Geometry(gt.boxes)
preview = CustomPreview(Geometry=geo, Material=ColourSwatch(SwatchColor=RGB(255, 255, 255)))
select = Python3Script(frames=gt.frames, key=Slider(26, range=0..37))  # -> frame, plane, cam; inputs frames: list, key: Int32
# ---------- select: Python ----------
from compas_rhino.conversions import frame_to_rhino_plane
from compas.geometry import Translation, Frame

frame = frames[key]

frame_T = frame.transformed(Translation.from_vector(-frame.zaxis*0))

plane = frame_to_rhino_plane(frame_T)
# ---------- end select ----------
toggle_5 = GroupToggle(ToggleActive=True, ToggleVisible=False)  # disabled

# ----
# Import assembly from JSON
import_4 = Button()
path_3 = Python3Script()  # -> out, DATA
# ---------- path_3: Python ----------
import os
import ghpythonlib.components as ghcomp
import getpass

username = getpass.getuser()
USER_FOLDER = os.path.abspath(os.path.join("C:/Users/", username))
DATA = os.path.abspath(os.path.join(USER_FOLDER,"workspace/spaicr/data"))

ghComp = ghenv.Component
ghDoc = ghComp.OnPingDocument()

# the full path of the gh file
path_gh_file = ghDoc.FilePath

# the directory of the gh file
#HERE = os.path.dirname(path_gh_file)
#DATA = os.path.join(HERE, 'data')

print(DATA)
# ---------- end path_3 ----------
list_8 = ValueList({"0", "1", "2", "3", "4", "5", "6", "7", "8", "9", "10"}, selected="0")
import_5 = Python3Script(DATA=path_3.DATA, import=import_4, key=list_8)  # -> out, assembly; inputs DATA: String
# ---------- import_5: Python ----------
import os
import json
from assembly_information_model.assembly import Assembly
from scriptcontext import sticky as st

if _import:
    filename = "assembly_t4_{}.json".format(str(key))
    filename = "assembly_01_14.json"
    PATH = os.path.join(DATA, filename)
    print(PATH)
    # the assembly has to be serialized such that it can be called from CPython
    assembly = Assembly.from_json(PATH)
    st['assembly' + str(key)] = assembly

assembly = st.get('assembly' + str(key))
# ---------- end import_5 ----------

# ----
# Sep9
rb3_2 = Plane(Plane(origin=(0.6568547254, 0.4375007435, 1.109219149), x=(-0.6582893217, -0.7515562877, -0.04264170936), y=(-0.4362003978, 0.4270095923, -0.7920808173)))  # disabled
rb4_2 = Plane(Plane(origin=(1.496733309, 0.6324813173, 1.111035557), x=(-0.7664190294, 0.6421464468, 0.01580544821), y=(0.3586363785, 0.4481966492, -0.8188404678)))  # disabled
rb2_2 = Plane(Plane(origin=(0.6658079924, -0.1494413242, 1.109172577), x=(0.1539875584, -0.9871416187, -0.04288655419), y=(-0.6075083574, -0.0603579657, -0.792016737)))  # disabled
rb6 = Plane(Plane(origin=(0.7657951008, -0.60312251, 1.049374498), x=(0.5278564158, -0.8491034691, -0.0197712675), y=(-0.511438773, -0.299185445, -0.8055547474)))  # disabled
rb1_2 = Plane(Plane(origin=(0.5553017609, -0.488327684, 1.109108209), x=(0.1792199632, -0.9828715477, -0.04293862417), y=(-0.6057400786, -0.07585086223, -0.7920388904)))  # disabled
rb5 = Plane(Plane(origin=(1.310175913, -0.886132943, 1.111396166), x=(0.8727928646, 0.4828136199, 0.07157949393), y=(0.3216861283, -0.4587182682, -0.8283088707)))  # disabled
toggle_6 = GroupToggle(ToggleActive=True, ToggleVisible=False)  # disabled

robot_transformations = Python3Script()  # -> out
# ---------- robot_transformations: Python ----------
# frame_BCF = frame_RCF.transformed(transformation_RCF_BCF)
transformation_RCF_BCF = [[    1.0000,   -0.0000,   -0.0000,    0.2750],
                          [    0.0000,    1.0000,    0.0000,    0.0000],
                          [    0.0000,   -0.0000,    1.0000,    1.0384],
                          [    0.0000,    0.0000,    0.0000,    1.0000]]

# frame_RCF = frame_BCF.transformed(transformation_BCF_RCF)

transformation_BCF_RCF = [[    1.0000,    0.0000,    0.0000,   -0.2750],
                          [   -0.0000,    1.0000,   -0.0000,    0.0000],
                          [    0.0000,   -0.0000,    1.0000,   -1.0384],
                          [   -0.0000,    0.0000,   -0.0000,    1.0000]]
# ---------- end robot_transformations ----------

list_9 = ValueList({"0", "1", "2", "3", "4", "5", "6", "7", "8", "9", "10"}, selected="3")
vis = Python3Script(assembly=import_5.assembly, key=list_9)  # -> a, part, frames; inputs key: Int32
# ---------- vis: Python ----------
from compas_rhino.conversions import mesh_to_rhino, box_to_rhino, frame_to_rhino, line_to_rhino, point_to_rhino
from compas.geometry import Line
from scriptcontext import sticky as st

#get parts datastructure
parts = [p for p in assembly.parts()]
frames = [p.frame for p in assembly.parts()]
print(frames)
a = [mesh_to_rhino(p.mesh) for p in parts]
part = mesh_to_rhino(assembly.part(key).mesh)
# ---------- end vis ----------
geo_2 = Geometry(vis.a)
geo_3 = Geometry(vis.part)
select_2 = Python3Script(frames=vis.frames, key=list_9)  # -> frame, plane; inputs frames: list, key: Int32
# ---------- select_2: Python ----------
from compas_rhino.conversions import frame_to_rhino_plane
from compas.geometry import Translation

frame = frames[key].transformed(Translation.from_vector(-frames[key].zaxis*0.025))
plane = frame_to_rhino_plane(frame)
# ---------- end select_2 ----------
preview_2 = CustomPreview(Geometry=geo_2, Material=ColourSwatch(SwatchColor=RGBA(157, 230, 142, 0)))
preview_3 = CustomPreview(Geometry=geo_3, Material=ColourSwatch(SwatchColor=RGBA(244, 54, 227, 81)))

preview_4 = CustomPreview(Geometry=geo, Material=ColourSwatch(SwatchColor=RGBA(94, 217, 78, 0)))

# ---- group: 250109
_10_0_pln_rcf = Plane(Plane(origin=(1.249353072, 0.8218130038, -0.100494795), x=(0.8958838116, 0.05365550675, 0.4410366001), y=(-0.2009069114, -0.8364638361, 0.5098673002)))
_10_5_pln_rcf = Plane(Plane(origin=(1.030308998, -0.7711951976, -0.1212952062), x=(0.9040809815, -0.3407009553, 0.2579930965), y=(-0.1858125318, -0.8570166281, -0.4806206426)))
_10_0_pln = Plane(Plane(origin=(1.524353072, 0.8218130038, 0.9378796731), x=(0.8958838116, 0.05365550675, 0.4410366001), y=(-0.2009069114, -0.8364638361, 0.5098673002)))
_10_5_pln = Plane(Plane(origin=(1.305308998, -0.7711951976, 0.9170792619), x=(0.9040809815, -0.3407009553, 0.2579930965), y=(-0.1858125318, -0.8570166281, -0.4806206426)))

# ---- group: 241211
_10_5_b_rcf = Plane(Plane(origin=(1.072426379, -0.7393369972, -0.1222586558), x=(0.9020825205, -0.3459640077, 0.257984557), y=(-0.1908615783, -0.8559719017, -0.480503862)))  # disabled
_10_0_a_rcf = Plane(Plane(origin=(1.248314603, 0.8592174798, -0.09981788728), x=(0.9229592987, -0.2891609087, 0.2540316944), y=(-0.3818373216, -0.7709371952, 0.5097608271)))  # disabled
_10_0_a = Plane(Plane(origin=(1.523314603, 0.8592174798, 0.9385565808), x=(0.9229592987, -0.2891609087, 0.2540316944), y=(-0.3818373216, -0.7709371952, 0.5097608271)))  # disabled
_10_5_b = Plane(Plane(origin=(1.347426379, -0.7393369972, 0.9161158123), x=(0.9020825205, -0.3459640077, 0.257984557), y=(-0.1908615783, -0.8559719017, -0.480503862)))  # disabled

# ----
layer5_3_b = Plane(Plane(origin=(1.262568425, -0.3891473191, 0.4937470816), x=(-0.5566856706, 0.7381072163, -0.3811807989), y=(0.6495216553, 0.6727981735, 0.3542093125)))
eef_in_rcf = Plane(Plane(origin=(0.9875599313, -0.3891491409, -0.5446252318), x=(-0.5566795772, 0.7381174959, -0.3811697923), y=(0.6495349316, 0.672786778, 0.354206612)))
layer5_0_a = Plane(Plane(origin=(1.434834839, 0.7030247203, 0.5055329928), x=(-0.9149025833, 0.1326851508, -0.3812452149), y=(-0.0120097434, 0.9350718669, 0.3542546679)))
eef_in_rcf_2 = Plane(Plane(origin=(1.159833806, 0.7030256763, -0.5328522422), x=(-0.9149043094, 0.1326892638, -0.3812396411), y=(-0.01200376459, 0.9350716089, 0.3542555516)))

# ----
# Collecting multi assemblies together
init = Button()
list_10 = ValueList({"0", "1", "2", "3", "4", "5", "6", "7", "8", "9", "10"}, selected="10")
multi_assemblies = Python3Script(robot=robot)  # -> a0, a1, a2, a3, a4, a7
# ---------- multi_assemblies: Python ----------
from compas_rhino.conversions import mesh_to_rhino, box_to_rhino, frame_to_rhino, line_to_rhino, point_to_rhino
from compas.geometry import Line
from scriptcontext import sticky as st


assembly = st.get('assembly0')
#get parts datastructure
parts = [p for p in assembly.parts()]
a0 = [mesh_to_rhino(robot.from_RCF_to_BCF(p.mesh)) for p in parts]

assembly = st.get('assembly1')
#get parts datastructure
parts = [p for p in assembly.parts()]
a1 = [mesh_to_rhino(robot.from_RCF_to_BCF(p.mesh)) for p in parts]

assembly = st.get('assembly2')
#get parts datastructure
parts = [p for p in assembly.parts()]
a2 = [mesh_to_rhino(robot.from_RCF_to_BCF(p.mesh)) for p in parts]

assembly = st.get('assembly3')
#get parts datastructure
parts = [p for p in assembly.parts()]
a3 = [mesh_to_rhino(robot.from_RCF_to_BCF(p.mesh)) for p in parts]

assembly = st.get('assembly4')
#get parts datastructure
parts = [p for p in assembly.parts()]
a4 = [mesh_to_rhino(robot.from_RCF_to_BCF(p.mesh)) for p in parts]

assembly = st.get('imported_assembly')
#get parts datastructure
parts = [p for p in assembly.parts()]
a7 = [mesh_to_rhino(robot.from_RCF_to_BCF(p.mesh)) for p in parts]
# ---------- end multi_assemblies ----------
assembly = Python3Script(init=init, key=list_10)  # -> assembly
# ---------- assembly: Python ----------
from assembly_information_model.assembly import Assembly
from scriptcontext import sticky as st

if init:
    assembly = Assembly()
    st['assembly' + str(key)] = assembly

assembly = st.get('assembly' + str(key))

# 5+ are after num of hypo is 16
# ---------- end assembly ----------
geo_4 = Geometry(multi_assemblies.a0)
geo_5 = Geometry(multi_assemblies.a1)
geo_6 = Geometry(multi_assemblies.a2)
geo_7 = Geometry(multi_assemblies.a3)
geo_8 = Geometry(multi_assemblies.a4)
geo_9 = Geometry(multi_assemblies.a7)
preview_5 = CustomPreview(Geometry=geo_4, Material=ColourSwatch(SwatchColor=RGBA(156, 230, 142, 216)))
preview_6 = CustomPreview(Geometry=geo_5, Material=ColourSwatch(SwatchColor=RGBA(244, 54, 227, 216)))
preview_7 = CustomPreview(Geometry=geo_6, Material=ColourSwatch(SwatchColor=RGBA(76, 73, 227, 216)))
preview_8 = CustomPreview(Geometry=geo_7, Material=ColourSwatch(SwatchColor=RGBA(53, 229, 227, 216)))
preview_9 = CustomPreview(Geometry=geo_8, Material=ColourSwatch(SwatchColor=RGBA(255, 227, 100, 216)))
preview_10 = CustomPreview(Geometry=geo_9, Material=ColourSwatch(SwatchColor=RGBA(216, 74, 100, 216)))

eef_in_rcf_3 = Plane(Plane(origin=(1.386764243, 0.7545720621, -0.6214604075), x=(0.9532208662, 0.3020439131, -0.01180909568), y=(0.3020418885, -0.953292562, -0.001997202496)))
_4_0_a = Plane(Plane(origin=(1.661768949, 0.7545726244, 0.4169147143), x=(0.9532182952, 0.302052347, -0.01180090315), y=(0.3020500466, -0.9532899305, -0.002019374149)))
eef_in_rcf_4 = Plane(Plane(origin=(1.124992634, -0.8479531035, -0.6294377801), x=(0.7382141583, -0.6744620304, -0.01186701154), y=(-0.6745254125, -0.7382490241, -0.001961224045)))
_4_5_b = Plane(Plane(origin=(1.400013436, -0.8479560781, 0.4089508534), x=(0.7382226411, -0.6744530164, -0.01185161875), y=(-0.6745164815, -0.7382571014, -0.001992095153)))

# ----
# Transform gt
import_6 = Button()  # disabled
toggle_7 = BooleanToggle(False)  # disabled
export = Button()  # disabled
gt_2 = Python3Script(import=import_6, in_rcf=toggle_7, p1=_4_0_a, p2=_4_5_b, export=export)  # -> out, points, surfaces, midpoints, frames, keys, GTF, GTF_new; disabled
# ---------- gt_2: Python ----------
import os
import json
import time
from scriptcontext import sticky as st
from compas.geometry import Frame, Transformation, Point, Polygon, Vector, midpoint_point_point
from compas.datastructures import Mesh
import compas
from compas_rhino.conversions import point_to_rhino, mesh_to_rhino, frame_to_rhino_plane, plane_to_compas_frame

surfaces = []
midpoints = []
points = []
frames = []
keys = []

if not st.get('import_ground_truth'):
    st['import_ground_truth'] = {}

# if import_:
#     filename = "240903_collection.json"
#     DATA = os.path.abspath(os.path.join(ghdoc.Path,"../../data/2nd_experiment/ground_truth"))
#     PATH = os.path.join(DATA, filename)
#     print(PATH)
#     with open(PATH, 'r') as f:
#         st['import_ground_truth'] = compas.data.json_load(f)

if st.get('import_ground_truth'):
    GTF = Frame(st['import_ground_truth']["4_0"]["a"], 
                    Vector.Zaxis(), 
                    Vector.from_start_end(st['import_ground_truth']["4_0"]["a"], st['import_ground_truth']["4_5"]["b"]))

    f1 = plane_to_compas_frame(p1)
    f2 = plane_to_compas_frame(p2)
    
    GTF_new = Frame(f1.point, 
                        Vector.Zaxis(), 
                        Vector.from_start_end(f1.point, f2.point))

    new_dict = {}
    T = Transformation.from_frame_to_frame(GTF, GTF_new)
    for brick_key, brick in st['import_ground_truth'].items():
        new_dict[brick_key] = {}
        for corner_key, corner in brick.items():
            new_dict[brick_key][corner_key] = corner.transformed(T)

    for key, brick in new_dict.items():
        if in_rcf:
            corners = ["a_rcf", "b_rcf", "c_rcf", "d_rcf"]
        else:
            corners = ["a", "b", "c", "d"]
        for c in corners:
            if brick.get(c):
                points.append(point_to_rhino(brick.get(c)))
        
        if all(c in brick.keys() for c in corners):
            top_outline = Polygon([brick[corners[0]], brick[corners[1]], brick[corners[2]], brick[corners[3]], brick[corners[0]]])
            centroid = top_outline.centroid
            xaxis = Vector.from_start_end(centroid, midpoint_point_point(brick[corners[2]], brick[corners[3]]))
            yaxis = Vector.from_start_end(centroid, midpoint_point_point(brick[corners[1]], brick[corners[2]]))
            frame = Frame(centroid, xaxis, yaxis)

            midpoints.append(point_to_rhino(centroid))
            top = mesh_to_rhino(Mesh.from_polygons([top_outline]))
            surfaces.append(top)
            frames.append(frame)
            keys.append(key)
    
    st['transformed_ground_truth'] = new_dict
    
    if export_:
        filename = "250129_2ndposition_tall_assembly_collection.json"
        DATA = os.path.abspath(os.path.join(ghdoc.Path,"../../data/2nd_experiment/ground_truth"))
        PATH = os.path.join(DATA, filename)
        with open(PATH, 'w') as f:
            compas.json_dump(new_dict, f)
# ---------- end gt_2 ----------
pt = Point(gt_2.midpoints)  # disabled
geo_10 = Geometry(gt_2.surfaces)  # disabled
_7_0_a = Plane(Plane(origin=(1.442313361, 0.6847685371, 0.6695935693), x=(0.408470063, 0.9127417788, -0.007392759592), y=(0.9127461765, -0.4085058249, -0.004172329636)))  # disabled
_7_4_b = Plane(Plane(origin=(1.292425298, -0.6919771575, 0.6561817162), x=(0.9965332346, 0.08286603063, -0.007398192745), y=(0.08283673692, -0.996554355, -0.004182415557)))  # disabled
toggle_8 = GroupToggle(ToggleActive=True, ToggleVisible=False)  # disabled
preview_11 = CustomPreview(
    Geometry=geo_10,
    Material={diffuse=RGB(221, 160, 221), emission=RGB(66, 48, 66), shine=0.5, specular=RGB(255, 255, 255), transparency=0})  # disabled

# ----
# Compare estimated to gt
compare = Python3Script(estimated_frame=select_2.frame, gt_frame=select.frame)  # -> out
# ---------- compare: Python ----------
from compas.geometry import Transformation, Translation, angle_vectors_xy

Tx = estimated_frame.point.x - gt_frame.point.x
Ty = estimated_frame.point.y - gt_frame.point.y
Tz = estimated_frame.point.z - gt_frame.point.z
print(Tx, Ty, Tz)

R = angle_vectors_xy(estimated_frame.yaxis, gt_frame.yaxis, deg=True)
print(R)
# ---------- end compare ----------
panel_13 = Panel(compare)

# ----
# Compare assembly to gt
compare_assembly_to_gt = Python3Script(robot=robot, gt_frames=gt.frames)  # -> out, gt_planes, brick_planes; inputs gt_frames: list
# ---------- compare_assembly_to_gt: Python ----------
from compas.geometry import Transformation, Translation, angle_vectors_xy, distance_point_point, Frame, Vector, angle_vectors_signed
from compas_rhino.conversions import mesh_to_rhino, frame_to_rhino_plane
import math

fine_tuned = {}

gt_planes = []
brick_planes = []

for p in assembly.parts():
    if assembly.graph.node_attribute(p.key, 'is_placed') is True:
        found_frame = assembly.graph.node_attribute(p.key, 'found_frame')
        initial_found_frame = assembly.graph.node_attribute(p.key, 'initial_found_frame')
        corrected_frame = assembly.graph.node_attribute(p.key, 'corrected_frame')

        brick_frame = found_frame #corrected_frame #initial_found_frame

        if brick_frame is not None:
            if robot:
                brick_frame =  robot.from_RCF_to_BCF(brick_frame)

            ground_truth_frame = None
            closest_distance = 0.1
            # Compare the pose to each pose in assembly by seeing the distance.
            for gt_frame in gt_frames:
                distance = distance_point_point(brick_frame.point, gt_frame.point)
                if distance < closest_distance:
                    print("For brick {}, a frame with distance {} m is found.".format(p.key, distance))
                    closest_distance = distance
                    ground_truth_frame = gt_frame

            if ground_truth_frame is not None:
                gt_planes.append(frame_to_rhino_plane(ground_truth_frame))
                brick_frame_in_gt = brick_frame.transformed(Transformation.from_change_of_basis(Frame.worldXY(), ground_truth_frame))
                flattened_brick_frame_in_gt = Frame([0,0,0], [brick_frame_in_gt.xaxis.x, brick_frame_in_gt.xaxis.y, 0], [brick_frame_in_gt.yaxis.x, brick_frame_in_gt.yaxis.y, 0])
                
                brick_planes.append(frame_to_rhino_plane(flattened_brick_frame_in_gt))

                Tx = brick_frame_in_gt.point.x
                Ty = brick_frame_in_gt.point.y
                Tz = brick_frame_in_gt.point.z

                R = angle_vectors_signed(flattened_brick_frame_in_gt.yaxis, Vector.Yaxis(), Vector.Zaxis(), deg=True)
                
                print(R)
                
                fine_tuned[p.key] = {"Tx":Tx,"Ty":Ty,"Tz":Tz,"R":R,"distance":closest_distance}
                # print(fine_tuned[p.key])

def getAverage(myList):
    if len(myList) > 0:
        return sum(myList) / len(myList)   # mean

def getStd(myList):
    var  = sum(pow(item-getAverage(myList),2) for item in myList) / len(myList)  # variance
    return math.sqrt(var)  # standard deviation


average_Tx = getAverage([abs(deviation["Tx"]) for key, deviation in fine_tuned.items()])
average_Ty = getAverage([abs(deviation["Ty"]) for key, deviation in fine_tuned.items()])
average_Tz = getAverage([abs(deviation["Tz"]) for key, deviation in fine_tuned.items()])
average_distance = getAverage([abs(deviation["distance"]) for key, deviation in fine_tuned.items()])
average_R = getAverage([abs(deviation["R"]) for key, deviation in fine_tuned.items()])

print(fine_tuned)
print("Average Tx: " + str(average_Tx))
print("Average Ty: " + str(average_Ty))
print("Average Tz: " + str(average_Tz))
print("Average Distance: " + str(average_distance))
print("Average R: " + str(average_R))
# ---------- end compare_assembly_to_gt ----------

bar_graph = BarGraph(BarColor=RGB(255, 0, 90))

# ----
# Assembly
# Models
date = Python3Script()  # -> date
# ---------- date: Python ----------
import time
date = (
    str(time.localtime().tm_year)[2:] +
    f"{time.localtime().tm_mon:02d}" +
    f"{time.localtime().tm_mday:02d}"
)

print(date)
# ---------- end date ----------
panel_14 = Panel("_EXP4_3_move_last_anchors_estimated_realigned_vis_anchor")
toggle_9 = BooleanToggle(True)
toggle_10 = BooleanToggle(False)
# Material
# Stack
toggle_11 = BooleanToggle(False)

# ----
# Transform
transform_assembly = Python3Script(assembly=import_2.assembly, transform=toggle_11)  # -> out, assembly
# ---------- transform_assembly: Python ----------
from compas.geometry import Frame, Transformation, Rotation, Translation
from compas_rhino.conversions import plane_to_compas_frame, point_to_rhino, frame_to_rhino

center_frame = Frame.worldXY()
# center_frame_new = plane_to_compas_frame(center_plane_new)

if transform:
    copy_assembly = assembly.copy()
    # T = Transformation.from_frame_to_frame(center_frame, Frame([11.9,7,0],[1,0,0],[0,1,0])) #stack T
    T = Transformation.from_frame_to_frame(center_frame, Frame([0,-0.15,0],[1,0,0],[0,1,0]))
    # assembly = assembly.transformed(T)

    # Here transform both the frame and planned frame of every brick.
    for key in copy_assembly.part_keys():
        p = copy_assembly.part(key)
        p.frame = p.frame.transformed(T)
        copy_assembly.graph.node_attribute(key, "planned_frame", p.frame)
        print(copy_assembly.graph.node_attribute(key, "planned_frame"))

    assembly = copy_assembly
# ---------- end transform_assembly ----------

# ----
# Import Assembly
import_7 = Python3Script(new=toggle_2, DATA=path.DATA, import=import, name=panel_6, fake=toggle_10)  # -> out, assembly; inputs DATA: String
# ---------- import_7: Python ----------
import os
import json
from assembly_information_model.assembly import Assembly
from scriptcontext import sticky as st

if _import:
    if new:
        if fake:
            DATA = os.path.join(DATA, "assembly")
            filename = "brick_stack.json"
            PATH = os.path.join(DATA, filename)
            assembly = Assembly.from_json(PATH)
        else:
            assembly = Assembly()
    else:
        filename = name + "_stack.json"
        PATH = os.path.join(DATA, filename)
        assembly = Assembly.from_json(PATH)
    
    st['material_stack'] = assembly

assembly = st.get('material_stack')
# ---------- end import_7 ----------

# ----
# Transform
transform_assembly_2 = Python3Script(assembly=import_7.assembly, transform=toggle_10)  # -> out, assembly
# ---------- transform_assembly_2: Python ----------
from compas.geometry import Frame, Transformation, Rotation, Translation
from compas_rhino.conversions import plane_to_compas_frame, point_to_rhino, frame_to_rhino

center_frame = Frame.worldXY()
# center_frame_new = plane_to_compas_frame(center_plane_new)

if transform:
    copy_assembly = assembly.copy()
    # stack_frame = Frame.from_quaternion([0.9659258262, 0,0,-0.2588190], [12.53473,8.91922,0.17])
    stack_frame = Frame.from_quaternion([0.9659258262, 0,0,-0.2588190], [15.7,10.15,0.17])

    T = Transformation.from_frame_to_frame(center_frame, stack_frame)
    

    # Here transform both the frame and planned frame of every brick.
    for key in copy_assembly.part_keys():
        p = copy_assembly.part(key)
        p.frame = p.frame.transformed(T)
        copy_assembly.graph.node_attribute(key, "planned_frame", p.frame)
        print(copy_assembly.graph.node_attribute(key, "planned_frame"))

    assembly = copy_assembly
# ---------- end transform_assembly_2 ----------

# ----
# Export to JSON
export_2 = Button()
# Create snapshots
panel_15 = Panel(date)
export_3 = Python3Script(
    DATA=path.DATA,
    building_structure=transform_assembly.assembly,
    material_stack=transform_assembly_2.assembly,
    export=export_2,
    name=panel_15,
    add=panel_14)  # -> out
# ---------- export_3: Python ----------
import os

if export:
    stack_filename = name + add + "_stack.json"
    PATH = os.path.join(DATA, stack_filename)
    
    # the assembly has to be serialized such that it can be called from CPython
    material_stack.to_json(PATH)

    bench_filename = name + add + "_bench.json"
    PATH = os.path.join(DATA, bench_filename)
    
    # the assembly has to be serialized such that it can be called from CPython
    building_structure.to_json(PATH)
# ---------- end export_3 ----------
exportbcflogs = Python3Script(DATA=path.DATA, robot=robot, export=export_2, name=panel_15, add=panel_14)  # -> out
# ---------- exportbcflogs: Python ----------
import os
from compas.geometry import Frame

print(robot._frame_log)

if export:
    filename = name + add + "_BCF.json"
    PATH = os.path.join(DATA, filename)
    
    robot.export_log(PATH)
# ---------- end exportbcflogs ----------

# ----
# Fabrication manager
list_11 = ValueList({"Receive BCF": "receive_bcf", "General snapshot": "general_snapshot", "Close-up snapshot": "closeup_snapshot", "Close-up for pick": "closeup_snapshot_pick", "Pick": "pick", "Place": "place", "Pick & Place": "pick_place", "Move Base": "move_base"}, selected="Pick")
number_slider_3 = Slider(314, range=0..360)
number_slider_4 = Slider(60, range=0..90)
pln = Plane(Plane(origin=(12.31996526, 7.883060218, 0.999496023), x=(0, 1, 0), y=(1, 0, 0)))
init_2 = Button()
snapshot_poses_2 = Python3Script(snap_radius=Slider(0.5, range=0..1), cam_angle_y=Slider(75, range=0..90), cam_angle_z=Slider(224, range=0..360))  # -> out, closeup_plane
# ---------- snapshot_poses_2: Python ----------
from compas.geometry import Frame, Translation, Rotation, Vector
from compas_rhino.conversions import frame_to_rhino_plane
import math


snap_frames = []
snap_frame = Frame([snap_radius+0.2, 0, 0], -Vector.Yaxis(), Vector.Zaxis())

snap_frame = snap_frame.transformed(Rotation.from_axis_and_angle(Vector.Yaxis(), math.radians(cam_angle_y)))
snap_frame = snap_frame.transformed(Rotation.from_axis_and_angle(Vector.Zaxis(), math.radians(cam_angle_z)))


closeup_plane = frame_to_rhino_plane(snap_frame)
# ---------- end snapshot_poses_2 ----------
fabrication = Python3Script(init=init_2)  # -> fabrication
# ---------- fabrication: Python ----------
from scriptcontext import sticky as st
from fabrication_manager.fabrication import FabricationManager
from assembly_information_model.assembly import Assembly
import os

server_ip = st["server_ip"]
server_port = st["server_port"]

if init_:
    path = os.path.abspath(os.path.join(ghdoc.Path,"../../data/2nd_experiment/fabrication_logs"))
    print(path)
    fabrication = FabricationManager((server_ip, server_port))
    fabrication.path = path
    st["fabrication"] = fabrication

fabrication = st["fabrication"]
# ---------- end fabrication ----------
generate_tasks = Python3Script(
    routine=list_11,
    fabrication=fabrication,
    robot=robot,
    plane_WCF=plane_3,
    snap_planes=snapshot_poses.snap_planes,
    closeup_plane=snapshot_poses_2.closeup_plane,
    config=forward_kinematics,
    material_stack=transform_assembly_2.assembly,
    building_structure=transform_assembly.assembly,
    rotList=c_ackerman.positions,
    velList=c_ackerman.velocities,
    timeInt=c_ackerman.timeIntervals)  # -> out, tasks, target_planes; inputs snap_planes: list of Plane, rotList: list, velList: list, timeInt: list of Double
# ---------- generate_tasks: Python ----------
import roslibpy
import time
from fabrication_manager.task import Task
from compas_robots import Configuration
from compas.geometry import Translation, Rotation, Frame, Box, Transformation, Point, Quaternion, Vector, distance_point_point
from compas.datastructures import Mesh
from compas_rhino.conversions import plane_to_compas_frame, frame_to_rhino_plane
import numpy as np
import math
from assembly_information_model import Part
import open3d
import random
from scipy.spatial.transform import Rotation as R
from mobile_robot_control.pointcloud_processing.icp import preprocess_point_cloud_icp, evaluate_local_registration, execute_icp_local_registration
from scriptcontext import sticky as st
from mobile_robot_control import ChangeToolFrameTask, PickBrickURTask, MoveLinearURdirectTask, MoveJointsURdirectTask

start_config = Configuration((0.000, 0.000, -1.571, -1.571, -1.571, 1.571, 3.141), (2, 0, 0, 0, 0, 0, 0),
                                ('robot_ewellix_lift_top_joint', 'robot_arm_shoulder_pan_joint', 'robot_arm_shoulder_lift_joint', 'robot_arm_elbow_joint', 'robot_arm_wrist_1_joint', 'robot_arm_wrist_2_joint', 'robot_arm_wrist_3_joint'))

target_planes = []
robot_address = st["ur_ip"]

def select_pick_brick(assembly, z_tol=0.01):
    available = list(assembly.graph.nodes_where({"available": True}))
    if not available:
        return None

    # --- estimate stack yaw (ignore 90°-rotated bricks) ---
    yaws = []
    for k in available:
        xaxis = assembly.part(k).frame.xaxis
        yaw = math.atan2(xaxis.y, xaxis.x)
        yaws.append(yaw % (math.pi / 2))

    stack_yaw = sorted(yaws)[len(yaws) // 2]  # median
    print(f"Estimated stack yaw: {math.degrees(stack_yaw):.2f}°")

    c = math.cos(-stack_yaw)
    s = math.sin(-stack_yaw)

    # --- rotate positions into stack frame ---
    bricks = []
    for k in available:
        p = assembly.part(k).frame.point
        rx = c * p.x - s * p.y
        rz = p.z
        bricks.append((k, rx, rz))

    # --- select top layer ---
    max_z = max(b[2] for b in bricks)
    top = [b for b in bricks if abs(b[2] - max_z) < z_tol]

    # --- select most right ---
    best = max(top, key=lambda b: b[1])

    return best[0]

def select_place_brick(assembly):
    available_nodes = assembly.graph.nodes_where({"built":False, "available":True})
    max_key = max(
        available_nodes,
        key=lambda n: assembly.graph.node_attribute(n, 'planned_frame').point.y
    )
    return max_key

if routine == "receive_bcf":
    tasks = [
                # ReceiveBCFslamTask(robot),
                ReceiveBCFgtTask(robot)]

elif routine == "general_snapshot":
    tasks = [ChangeToolFrameTask(robot, "gripper")]
    tasks.append(MotionPlanExecuteJoints(robot, start_config))
    first = True
    for snap_plane in snap_planes[0:1]: #[:5]
        frame_BCF = plane_to_compas_frame(snap_plane).transformed(Translation.from_vector([0,-0.05,0]))
        target_planes.append(frame_to_rhino_plane(robot.from_BCF_to_WCF(frame_BCF)))
        tasks.append(CleanBricksTask(robot))
        tasks.append(MotionPlanExecutePose(robot, frame_BCF, frame_in_WCF=False))
        if first:
            addition = 20
        else:
            addition = 0
        tasks.append(TriggerEstimationTask(robot, trigger=True, sleep=20+addition))
        tasks.append(TriggerEstimationTask(robot, trigger=False, sleep=0))
        first=False

    tasks.append(ScanAllBricksTask(robot, stack_assembly=material_stack, structure_assembly=building_structure, stack=False))
    tasks.append(TriggerEstimationTask(robot, trigger=False, cuda_off=True, sleep=0))
    tasks.append(MotionPlanExecuteJoints(robot, start_config))

elif routine == "closeup_snapshot":
    tasks = [ChangeToolFrameTask(robot, "camera")]
    tasks.append(MotionPlanExecuteJoints(robot, start_config))

    temporary_keys = list(building_structure.graph.nodes_where({"temporary":True}))
    print(temporary_keys)
    first = True

    for temporary_key in temporary_keys:
        estimated_frame_BCF = building_structure.graph.node_attribute(temporary_key, 'estimated_frame_BCF')
        closeup_snapshot = plane_to_compas_frame(closeup_plane)
        snapshot_frame_BCF = closeup_snapshot.transformed(Transformation.from_frame(estimated_frame_BCF))

        target_planes.append(frame_to_rhino_plane(robot.from_BCF_to_WCF(snapshot_frame_BCF)))
        # closeup_snapshot = Frame(point=Point(x=0.390, y=-0.298, z=-0.325), xaxis=Vector(x=-0.471, y=-0.879, z=0.076), yaxis=Vector(x=0.570, y=-0.238, z=0.786))
        # snapshot_frame_BCF = closeup_snapshot.transformed(Transformation.from_frame(estimated_frame_BCF))

        target_planes.append(frame_to_rhino_plane(robot.from_BCF_to_WCF(snapshot_frame_BCF)))

        tasks.append(CleanBricksTask(robot))
        tasks.append(MotionPlanExecutePose(robot, snapshot_frame_BCF, frame_in_WCF=False))
        if first:
            addition = 20
        else:
            addition = 0
        tasks.append(TriggerEstimationTask(robot, trigger=True, sleep=20+addition))
        tasks.append(ScanSingleBrickTask(robot, assembly=building_structure, brick_key_to_update=temporary_key))
        tasks.append(TriggerEstimationTask(robot, trigger=False, sleep=0))
        first = False

    tasks.append(TriggerEstimationTask(robot, trigger=False, cuda_off=True, sleep=0))
    tasks.append(MotionPlanExecuteJoints(robot, start_config))

elif routine in ["pick", "place", "pick_place"]:   
    pick_key = 70
    pick_RCF = robot.from_WCF_to_RCF(plane_to_compas_frame(plane_WCF))
    safe_pick_RCF = pick_RCF.transformed(Translation.from_vector([0,0,0.30]))

    target_planes.append(frame_to_rhino_plane(robot.from_RCF_to_WCF(pick_RCF)))
    target_planes.append(frame_to_rhino_plane(robot.from_RCF_to_WCF(safe_pick_RCF)))

    place_key = 2
    place_frame = robot.from_WCF_to_RCF(plane_to_compas_frame(plane_WCF))

    pick_tasks = [ChangeToolFrameTask(robot, "gripper"),
                MoveJointsURdirectTask(robot, robot_address, start_config),
                MoveLinearURdirectTask(robot, robot_address, safe_pick_RCF)]

    # place_planned_frame = place_frame.transformed(Translation.from_vector([0,0,0.038]))
    # mid_place_planned_frame = place_planned_frame.transformed(Translation.from_vector([0,0,0.15]))
    # safe_place_planned_frame = place_planned_frame.transformed(Translation.from_vector([0,0,0.5]))

    # target_planes.append(frame_to_rhino_plane((safe_place_planned_frame)))
    # target_planes.append(frame_to_rhino_plane((place_planned_frame)))


    # place_tasks = [ChangeToolFrameTask(robot, "gripper"),
    #             # MotionPlanExecuteJoints(robot, start_config),
    #             MotionPlanExecutePose(robot, safe_place_planned_frame, frame_in_WCF=True, tool_constraint=True),
    #             MotionPlanExecutePose(robot, mid_place_planned_frame, frame_in_WCF=True, tool_constraint=True),
    #             MotionPlanExecutePose(robot, place_planned_frame, frame_in_WCF=True, tool_constraint=True),
    #             GripperControlTask(robot, open_grip=True),
    #             MotionPlanExecutePose(robot, mid_place_planned_frame, frame_in_WCF=True, tool_constraint=True),
    #             MotionPlanExecutePose(robot, safe_place_planned_frame, frame_in_WCF=True, tool_constraint=True),
    #             GripperControlTask(robot, open_grip=False),
    #             UpdateAssemblyAttributes(material_stack, building_structure, pick_key, place_key)]

    if routine == "pick":
        tasks = pick_tasks
    elif routine == "place":
        tasks = place_tasks
    else:
        tasks =  pick_tasks + place_tasks

print(tasks)
# ---------- end generate_tasks ----------
next_task = Button()
reset_task = Button()
prev_task = Button()
pln_2 = Plane(generate_tasks.target_planes)
reset_2 = Button()
bang = Button()
start_fabrication = Button()
stop_fabrication = Button()
fabrication_manager = Python3Script(
    tasks=generate_tasks.tasks,
    fabrication=fabrication,
    set_tasks=Toggle(True),
    start=start_fabrication,
    stop=stop_fabrication,
    reset=reset_2,
    next_task=next_task,
    reset_task=reset_task,
    prev_task=prev_task)  # -> out, server; inputs tasks: list
# ---------- fabrication_manager: Python ----------
def task_state_set(state, t):
    t.is_completed = state
    t.is_running = False
    
if set_tasks:
    print("setting tasks")   
    fabrication.clear_tasks()
    fabrication.set_tasks(tasks)

if start:
    #if robot.is_connected(): #and arduino.is_connected():
    print("starting process")
    fabrication.start()

if stop:
    print("stopping process")
    fabrication.stop()
    
if reset:
    print("resetting process")
    fabrication.reset()

if next_task:
    t = fabrication.get_next_task()
    task_state_set(True, t)
    
if reset_task:
    t = fabrication.get_next_task()
    task_state_set(False, t)

if prev_task:
    t = fabrication.get_next_task()
    task_state_set(False, t)
    t = fabrication.tasks[fabrication.current_task_key-1]
    task_state_set(False, t)
    fabrication.get_next_task()
# ---------- end fabrication_manager ----------
data = Data(fabrication_state.log_messages)
panel_16 = Panel(fabrication_state.log_messages)
generate_tasks_2 = Python3Script(
    routine=list_11,
    fabrication=fabrication,
    robot=robot,
    plane_WCF=pln,
    snap_planes=snapshot_poses.snap_planes,
    closeup_plane=snapshot_poses_2.closeup_plane,
    config=forward_kinematics,
    material_stack=transform_assembly_2.assembly,
    building_structure=transform_assembly.assembly,
    rotList=c_ackerman.positions,
    velList=c_ackerman.velocities,
    timeInt=c_ackerman.timeIntervals)  # -> out, tasks, target_planes; inputs snap_planes: list of Plane, rotList: list, velList: list, timeInt: list of Double; disabled
# ---------- generate_tasks_2: Python ----------
import roslibpy
import time
from fabrication_manager.task import Task
from compas_robots import Configuration
from compas.geometry import Translation, Rotation, Frame, Box, Transformation, Point, Quaternion, Vector, distance_point_point
from compas.datastructures import Mesh
from compas_rhino.conversions import plane_to_compas_frame, frame_to_rhino_plane
import numpy as np
import math
from assembly_information_model import Part
import open3d
import random
from scipy.spatial.transform import Rotation as R
from mobile_robot_control.pointcloud_processing.icp import preprocess_point_cloud_icp, evaluate_local_registration, execute_icp_local_registration
from scriptcontext import sticky as st

start_config = Configuration((0.000, 0.000, -1.571, -1.571, -1.571, 1.571, 3.141), (2, 0, 0, 0, 0, 0, 0),
                                ('robot_ewellix_lift_top_joint', 'robot_arm_shoulder_pan_joint', 'robot_arm_shoulder_lift_joint', 'robot_arm_elbow_joint', 'robot_arm_wrist_1_joint', 'robot_arm_wrist_2_joint', 'robot_arm_wrist_3_joint'))
#Configuration((0.000, -5.694, -2.654, -2.008, -0.051, -4.711, -2.551), (2, 0, 0, 0, 0, 0, 0), ('robot_ewellix_lift_top_joint', 'robot_arm_shoulder_pan_joint', 'robot_arm_shoulder_lift_joint', 'robot_arm_elbow_joint', 'robot_arm_wrist_1_joint', 'robot_arm_wrist_2_joint', 'robot_arm_wrist_3_joint'))

# start_config = Configuration((0.000, 5.694, -1.571, -1.571, -1.571, 1.571, 3.141), (2, 0, 0, 0, 0, 0, 0), 
#                                 ('robot_ewellix_lift_top_joint', 'robot_arm_shoulder_pan_joint', 'robot_arm_shoulder_lift_joint', 'robot_arm_elbow_joint', 'robot_arm_wrist_1_joint', 'robot_arm_wrist_2_joint', 'robot_arm_wrist_3_joint'))

target_planes = []

all_zeros = [0,0,0,0]
rotation_values = [rot + all_zeros for rot in rotList]
velocity_values = [all_zeros + vel for vel in velList]

box = Box(0.1,0.1,0.1, Frame.worldXY())
a_mesh = box.to_mesh()

## Tasks ##

class SendNavigationActionTask(Task):
    def __init__(self, robot, target_frame = None, key=None):
        super(SendNavigationActionTask, self).__init__(key)
        self.robot = robot
        self.target_frame = target_frame
        self.result = None
        self.done = False
        self.success = False
        
    def _result_callback(self, msg):
        self.result = msg
        self.done = True
        self.success = True
        
    def _feedback_callback(self, msg):
        self.log(f"Distance remaining: {msg['distance_remaining']}")

    def _fail_callback(self, msg):
        self.result = msg
        self.done = True
        self.success = False
        
    def run(self, stop_thread):
        self.log("Sending target frame as navigation action.")

        action_name = '/robot/navigate_to_pose'
        if action_name not in self.robot.mobile_client.action_clients.keys():
            action_client = roslibpy.ActionClient(
                self.robot.mobile_client.ros_client,
                action_name,
                'nav2_msgs/action/NavigateToPose'
            )
        else:
            action_client = self.robot.mobile_client.action_clients[action_name]

        # Create the goal message
        goal = roslibpy.Goal(
            {
                'pose': {
                    'header': {
                        'frame_id': 'robot_map',
                        'stamp': {
                            'sec': int(time.time()),
                            'nanosec': 0
                        }
                    },
                    'pose': {
                        'position': {'x': 4.5, 'y': 0.0, 'z': 0.0},
                        'orientation': {'x': 0.0, 'y': 0.0, 'z': 0.0, 'w': 1.0}
                    }
                },
                'behavior_tree': ''
            }
        )

        # self.robot.mobile_client.topic_subscribe(
        #                         "/robot/navigate_to_pose/_action/status",
        #                         "action_msgs/msg/GoalStatusArray",
        #                         self._status_callback
        #                     )

        self.log('Sending goal...')
        goal_id = action_client.send_goal(goal, self._result_callback, self._feedback_callback, self._fail_callback)

        while not stop_thread():
            if self.success or self.done:
                break
            time.sleep(0.1)
        
        self.log(f"Action result: {self.result}")

        # self.robot.mobile_client.topic_unsubscribe(
        #     "/robot/navigate_to_pose/_action/status")

        self.is_completed = True
        return True

class TriggerEstimationTask(Task):
    def __init__(self, robot, trigger=True, cuda_off=False, sleep=0, key=None):
        super(TriggerEstimationTask, self).__init__(key)
        self.robot = robot
        self.trigger = trigger
        self.cuda_off = cuda_off
        self.sleep = sleep
        
    def run(self, stop_thread):
        self.log('Estimation is set to {}!'.format(self.trigger))
        if self.cuda_off:
            service_name = '/trigger_pose_complete'
        else:
            service_name = '/trigger_pose'

        while not stop_thread():
            if self.robot.mobile_client.is_service_available(service_name):
                result = self.robot.mobile_client.service_call(service_name, 'std_srvs/SetBool', {'data': self.trigger})
                success = result['success']
                message = result['message']
                self.log('Activation message: {}'.format(message))
                if success:
                    break
            else:
                self.log("Trigger for estimation service is not available.")
                break
            time.sleep(0.1)

        self.log("Sleeping for {} seconds...".format(str(self.sleep)))
        time.sleep(self.sleep)

        self.is_completed = True
        return True

class CleanBricksTask(Task):
    def __init__(self, robot, key=None):
        super(CleanBricksTask, self).__init__(key)
        self.robot = robot
        
    def run(self, stop_thread):
        self.log('CleanBricksTask')
        service_name = '/clean_bricks'

        while not stop_thread():
            if self.robot.mobile_client.is_service_available(service_name):
                result = self.robot.mobile_client.service_call(service_name, 'std_srvs/SetBool', {'data': True})
                success = result['success']
                message = result['message']
                self.log('Activation message: {}'.format(message))
                if success:
                    break
            else:
                self.log("Clean bricks service is not available.")
                break
            time.sleep(0.1)

        self.is_completed = True
        return True

class ScanBricksTask(Task):
    def __init__(self, robot, reference_frame_id="robot_arm_base", key=None):
        super(ScanBricksTask, self).__init__(key)
        self.robot = robot
        self.reference_frame_id = reference_frame_id

    def get_detected_bricks(self, stop_thread):
        self.log("Scanning bricks...")
        brick_dict = {}

        # Ask for estimated brick ids.
        while not stop_thread():
            self.log('Asking for the brick amount...')
            result = self.robot.mobile_client.service_call('/brick_amount', 'std_srvs/SetBool', {'data': True})
            if result['success']:
                brick_amount = int(result['message'])
                self.log("Brick amount is {}".format(brick_amount))
                break
            time.sleep(0.1)

        brick_list = [i for i in range(brick_amount)]

        # One by one get the frames of the bricks in the list.
        if len(brick_list) == 0:
            self.log('No bricks estimated.')
        else:
            for brick_id in brick_list:
                self.log('Receiving the frame for brick: {}'.format(brick_id))
                pose = None

                self.robot.mobile_client.clean_tf_frame()
                time.sleep(0.5)
                self.robot.mobile_client.tf_subscribe("brick_" + str(brick_id), self.reference_frame_id)

                time_limit = 10
                start_time = time.time()
                left_time = 10
                # Wait until pose is received.
                while not stop_thread() and left_time > 0:
                    if self.robot.mobile_client.tf_frame is not None:
                        pose = Frame(self.robot.mobile_client.tf_frame.point, 
                                        Vector(self.robot.mobile_client.tf_frame.xaxis.x,self.robot.mobile_client.tf_frame.xaxis.y),
                                        Vector(self.robot.mobile_client.tf_frame.yaxis.x, self.robot.mobile_client.tf_frame.yaxis.y)) # Correcting to the ground.
                        # Force brick frames to be same direction - xaxis to the robot.
                        if pose.xaxis.x > 0:
                            pose = pose.transformed(Rotation.from_axis_and_angle(pose.zaxis, math.radians(180), pose.point))
                        break
                    time.sleep(0.1)
                    left_time = time_limit - (time.time() - start_time)

                if pose is None:
                    self.log('For brick with id {}, could not get the frame.'.format(brick_id))
                else:
                    # Transform to BCF_slam.
                    pose = self.robot.from_RCF_to_BCF(pose)
                    brick_dict[brick_id] = pose
                    self.log('For brick with id {}, got the pose: {}'.format(brick_id, pose))
        
                self.robot.mobile_client.tf_unsubscribe("brick_" + str(brick_id), self.reference_frame_id)

        self.log("Scanning completed.")

        return brick_dict

    def run(self, stop_thread):
        brick_dict = self.get_detected_bricks(stop_thread)
        self.is_completed = True
        return True
        
class ScanAllBricksTask(ScanBricksTask):
    def __init__(self, robot, stack_assembly, structure_assembly, stack=True, key=None):
        super(ScanAllBricksTask, self).__init__(robot, key=key)
        self.stack_assembly = stack_assembly
        self.structure_assembly = structure_assembly
        self.stack = stack
        self.brick_shape = Box(xsize=0.24, ysize=0.115, zsize=0.05)

        # def check_brick_layer(self, pose):
        #     pose_BCF = self.robot.from_RCF_to_BCF(pose)
        #     layer_decimal = pose_BCF.point.z / 0.05
        #     if layer_decimal > (math.floor(layer_decimal) + 0.6):
        #         layer = math.floor(layer_decimal)
        #     else:
        #         layer = math.floor(layer_decimal) - 1
        #     return layer
    
    def find_next_available_key(self, assembly):
        s = set([p for p in assembly.part_keys()])
        i = 1
        while i in s:
            i += 1
        return i

    def run(self, stop_thread):
        time.sleep(2)
        brick_dict = self.get_detected_bricks(stop_thread)
        self.log("Registering all bricks...")

        if self.stack:
            assembly_target = self.stack_assembly
        else:
            assembly_target = self.structure_assembly

        # Make seperation if pose is in front of robot, belongs to "building structure", if behind, to "material stack".
        for brick_id, pose in brick_dict.items():
            # Decide assembly target
            # if pose.point.x > 0.4:
            #     stack = False
            #     assembly_target = self.structure_assembly
            #     self.log("This is a brick for the building structure.")
            # else:
            #     stack = True
            #     assembly_target = self.stack_assembly
            #     self.log("This is a brick for the material stack.")

            pose_BCF = pose
            pose = self.robot.from_BCF_to_WCF(pose) # Pre-alignment it is same with from_BCF_slam_to_WCF_slam() cause WCF_slam is World.XY()
            
            target_key = None
            # Compare the pose to each pose in assembly by seeing the distance.
            closest_distance = 0.05
            for key in assembly_target.graph.nodes():
                distance = distance_point_point(assembly_target.part(key).frame.point, pose.point)
                if distance < closest_distance:
                    self.log("Distance is {}".format(distance))
                    self.log("Brick {} is the same as id {}".format(key, brick_id))
                    closest_distance = distance
                    target_key = key
                    
            # Create a new element.
            if target_key is None:
                # Create *new* brick entry.
                key = self.find_next_available_key(assembly_target) #assembly_target.graph.number_of_nodes() + 2
                brick = Part()
                brick.shape = self.brick_shape
                brick.mesh = Mesh.from_shape(self.brick_shape)
                brick.frame = pose.copy()
                assembly_target.add_part(
                    brick,
                    key=key,
                    estimated_frame=pose.copy(),
                    estimated_frame_BCF=pose_BCF.copy(),
                    initial_estimated_frame=pose.copy(),
                    initial_estimated_frame_BCF=pose_BCF.copy(),
                )

                self.log("Creating a new brick key {} with frame {}".format(key, pose_BCF))

                if self.stack:
                    assembly_target.graph.node_attribute(key, 'available', True)
                    assembly_target.graph.node_attribute(key, 'built', True)
                else:
                    assembly_target.graph.node_attribute(key, 'available', False)
                    assembly_target.graph.node_attribute(key, 'built', True)
                    if not self.robot.is_aligned:
                        assembly_target.graph.node_attribute(key, 'temporary', True)

                # # Add a collision mesh.
                # if self.scene != None:
                #     pose_WCF = self.robot.from_RCF_to_BCF(pose)
                #     collision_mesh = CollisionMesh(brick.mesh.transformed(Transformation.from_frame(pose_WCF)), str(brick_key))
                #     self.scene.add_collision_mesh(collision_mesh)
                #     self.log("Added a collision mesh.")

            elif target_key is not None:
                self.log("Updating the pose of the brick key {}".format(target_key))
                # Update existing element.
                assembly_target.find_by_key(target_key).frame = pose.copy()
                assembly_target.graph.node_attribute(target_key, 'estimated_frame', pose.copy())
                assembly_target.graph.node_attribute(target_key, 'estimated_frame_BCF', pose_BCF.copy())
                assembly_target.graph.node_attribute(target_key, 'initial_estimated_frame', pose.copy())
                assembly_target.graph.node_attribute(target_key, 'initial_estimated_frame_BCF', pose_BCF.copy())

                # # Append a collision mesh.
                # if self.scene != None:
                #     pose_WCF = self.robot.from_RCF_to_BCF(pose)
                #     collision_mesh = CollisionMesh(self.assembly.find_by_key(brick_key).mesh.transformed(Transformation.from_frame(pose_WCF)), str(brick_key))
                #     self.scene.remove_collision_mesh(str(brick_key))
                #     self.scene.add_collision_mesh(collision_mesh)
                #     self.log('Updated collision mesh with key {}.'.format(brick_key))
                        
        self.log("Registered all bricks...")
        self.is_completed = True
        return True

class ScanSingleBrickAddNewTask(ScanBricksTask):
    def __init__(self, robot, assembly, brick_key_to_update, average=False, key=None):
        super(ScanSingleBrickAddNewTask, self).__init__(robot, key=key)
        self.assembly = assembly
        self.brick_key_to_update = brick_key_to_update
        self.average = average

        self.brick_shape = Box(xsize=0.24, ysize=0.115, zsize=0.05)

    def find_next_available_key(self, assembly):
        s = set([p for p in assembly.part_keys()])
        i = 1
        while i in s:
            i += 1
        return i

    def run(self, stop_thread):
        brick_dict = self.get_detected_bricks(stop_thread)

        self.log("Updating only the brick {}...".format(self.brick_key_to_update))

        for brick_id, pose in brick_dict.items():
            pose_BCF = pose
            pose = self.robot.from_BCF_to_WCF(pose) # Pre-alignment it is same with from_BCF_slam_to_WCF_slam() cause WCF_slam is World.XY()
            
            target_key = None
            # Compare the pose to each pose in assembly by seeing the distance.
            closest_distance = 0.1
            for key in self.assembly.graph.nodes():
                distance = distance_point_point(self.assembly.part(key).frame.point, pose.point)
                if distance < closest_distance:
                    self.log("Distance is {}".format(distance))
                    self.log("Brick {} is the same as id {}".format(key, brick_id))
                    closest_distance = distance
                    target_key = key
                    
            # Create a new element.
            if target_key is None:
                # Create *new* brick entry.
                key = self.find_next_available_key(self.assembly) #self.assembly.graph.number_of_nodes() + 3
                brick = Part()
                brick.shape = self.brick_shape
                brick.mesh = Mesh.from_shape(self.brick_shape)
                brick.frame = pose.copy()
                self.assembly.add_part(
                    brick,
                    key=key,
                    estimated_frame=pose.copy(),
                    estimated_frame_BCF=pose_BCF.copy(),
                    initial_estimated_frame=pose.copy(),
                    initial_estimated_frame_BCF=pose_BCF.copy(),
                    available=True,
                    built=True
                )

                self.log("Creating a new brick key {} with frame {}".format(key, pose_BCF))

            # dist = distance_point_point(self.assembly.part(self.brick_key_to_update).frame.point, pose.point)
            # if dist < closest_distance:
            #     closest_distance = dist
            #     target_key = brick_id

            elif target_key == self.brick_key_to_update:
                self.log("Updating the pose of the brick key {} with id {}".format(self.brick_key_to_update, brick_id))

                if self.average:
                    current_pose = self.assembly.part(self.brick_key_to_update).frame
                    # find average:
                    average_pose = average_frame(current_pose, pose)
                    pose = average_pose
                    pose_BCF = self.robot.from_WCF_to_BCF(pose)
                    self.log("I took average.")

                part = self.assembly.part(self.brick_key_to_update)
                part.frame = pose.copy()
                self.assembly.graph.node_attribute(self.brick_key_to_update, 'estimated_frame', pose.copy())
                self.assembly.graph.node_attribute(self.brick_key_to_update, 'estimated_frame_BCF', pose_BCF.copy())

                # # Append a collision mesh.
                # if self.scene != None:
                #     pose_WCF = self.robot.from_RCF_to_BCF(pose)
                #     collision_mesh = CollisionMesh(self.assembly.find_by_key(brick_key).mesh.transformed(Transformation.from_frame(pose_WCF)), str(brick_key))
                #     self.scene.remove_collision_mesh(str(brick_key))
                #     self.scene.add_collision_mesh(collision_mesh)
                #     self.log('Updated collision mesh with key {}.'.format(brick_key))
            else:
                self.log("Not updating existing bricks other than {}.".format(self.brick_key_to_update))
                
        self.is_completed = True
        return True

class ScanSingleBrickTask(ScanBricksTask):
    def __init__(self, robot, assembly, brick_key_to_update, frame_attribute=None, average=False, key=None):
        super(ScanSingleBrickTask, self).__init__(robot, key=key)
        self.assembly = assembly
        self.brick_key_to_update = brick_key_to_update
        self.frame_attribute = frame_attribute
        self.average = average

        self.brick_shape = Box(xsize=0.24, ysize=0.115, zsize=0.05)
    
    def slerp_quat(self, q1, q2, t):
        q1 = q1 / np.linalg.norm(q1)
        q2 = q2 / np.linalg.norm(q2)
        dot = np.dot(q1, q2)
        if dot < 0.0:
            q2 = -q2
            dot = -dot
        if dot > 0.9995:
            q = q1 + t * (q2 - q1)
            return q / np.linalg.norm(q)
        theta_0 = np.arccos(dot)
        theta = theta_0 * t
        q3 = q2 - q1 * dot
        q3 = q3 / np.linalg.norm(q3)
        return q1 * np.cos(theta) + q3 * np.sin(theta)

    def average_frame(self, frame_a, frame_b):
        # --- Average position ---
        p = Point(
            0.5 * (frame_a.point.x + frame_b.point.x),
            0.5 * (frame_a.point.y + frame_b.point.y),
            0.5 * (frame_a.point.z + frame_b.point.z),
        )

        # --- Average orientation via SLERP ---
        R_a = Rotation.from_frame(frame_a)
        R_b = Rotation.from_frame(frame_b)

        qa = np.array(R_a.quaternion)
        qb = np.array(R_b.quaternion)

        q_avg = self.slerp_quat(qa, qb, 0.5)
        R_avg = Rotation.from_quaternion(q_avg)

        # --- Build averaged frame ---
        avg_frame = Frame.from_rotation(R_avg)
        avg_frame.point = p
        return avg_frame

    def run(self, stop_thread):
        brick_dict = self.get_detected_bricks(stop_thread)

        self.log("Updating only the brick {}...".format(self.brick_key_to_update))

        # Compare the pose to each pose in assembly by seeing the distance.
        target_key = None
        closest_distance = 0.1

        for brick_id, pose in brick_dict.items():
            pose_BCF = pose
            pose = self.robot.from_BCF_to_WCF(pose) # Pre-alignment it is same with from_BCF_slam_to_WCF_slam() cause WCF_slam is World.XY()

            dist = distance_point_point(self.assembly.part(self.brick_key_to_update).frame.point, pose.point)
            if dist < closest_distance:
                closest_distance = dist
                target_key = brick_id

        if target_key is None:
            self.log(f"No match found for brick {self.brick_key_to_update}")
        # Update pose
        else:
            self.log("Updating the pose of the brick key {} with id {}".format(self.brick_key_to_update, target_key))
            pose_BCF = brick_dict[target_key]
            pose = self.robot.from_BCF_to_WCF(brick_dict[target_key])

            if self.average:
                if self.frame_attribute is not None:
                    current_pose = self.assembly.graph.node_attribute(self.brick_key_to_update, self.frame_attribute)
                else:
                    current_pose = self.assembly.part(self.brick_key_to_update).frame
                # find average:
                average_pose = self.average_frame(current_pose, pose)
                pose = average_pose
                pose_BCF = self.robot.from_WCF_to_BCF(pose)
            
            part = self.assembly.part(self.brick_key_to_update)
            part.frame = pose.copy()

            if self.frame_attribute is not None:
                self.assembly.graph.node_attribute(self.brick_key_to_update, self.frame_attribute, pose.copy())
                self.assembly.graph.node_attribute(self.brick_key_to_update, self.frame_attribute + '_BCF', pose_BCF.copy())

            # # Append a collision mesh.
            # if self.scene != None:
            #     pose_WCF = self.robot.from_RCF_to_BCF(pose)
            #     collision_mesh = CollisionMesh(self.assembly.find_by_key(brick_key).mesh.transformed(Transformation.from_frame(pose_WCF)), str(brick_key))
            #     self.scene.remove_collision_mesh(str(brick_key))
            #     self.scene.add_collision_mesh(collision_mesh)
            #     self.log('Updated collision mesh with key {}.'.format(brick_key))
                
        self.is_completed = True
        return True

class AlignmentTask(Task):
    def __init__(self, robot, structure_assembly, realignment=False, key=None):
        super(AlignmentTask, self).__init__(key)
        self.robot = robot
        self.structure_assembly = structure_assembly
        self.realignment = realignment

    def assembly_to_frames_and_points(self, assembly, key_list=[], attribute=None):
        frames = []
        points = []
        for key in key_list:
            if attribute is None:
                main_frame = assembly.part(key).frame
            else:
                main_frame = assembly.graph.node_attribute(key, attribute)
            frames.append(main_frame)
            points.append(main_frame.point)
            corners = assembly.part(key).shape.points
            for c in corners:
                points.append(c.transformed(Transformation.from_frame(main_frame)))
        return frames, points

    def slerp_quat(self, q1, q2, t):
        q1 = q1 / np.linalg.norm(q1)
        q2 = q2 / np.linalg.norm(q2)
        dot = np.dot(q1, q2)
        if dot < 0.0:
            q2 = -q2
            dot = -dot
        if dot > 0.9995:
            q = q1 + t * (q2 - q1)
            return q / np.linalg.norm(q)
        theta_0 = np.arccos(dot)
        theta = theta_0 * t
        q3 = q2 - q1 * dot
        q3 = q3 / np.linalg.norm(q3)
        return q1 * np.cos(theta) + q3 * np.sin(theta)

    def kabsch_wahba_alignment(self, frames_src, frames_tgt, w_orient=1.0):
        # if len(frames_src) != len(frames_tgt):
        #     self.log("Need ≥3 frame correspondences")
        #     return None, None, None

        positions_src, positions_tgt, quats_src, quats_tgt = [], [], [], []
        for f_src, f_tgt in zip(frames_src, frames_tgt):
            positions_src.append(f_src.point)
            positions_tgt.append(f_tgt.point)
            Rs = np.column_stack([f_src.xaxis, f_src.yaxis, f_src.zaxis])
            Rt = np.column_stack([f_tgt.xaxis, f_tgt.yaxis, f_tgt.zaxis])
            quats_src.append(R.from_matrix(Rs).as_quat())
            quats_tgt.append(R.from_matrix(Rt).as_quat())

        positions_src = np.array(positions_src)
        positions_tgt = np.array(positions_tgt)
        quats_src = np.array(quats_src)
        quats_tgt = np.array(quats_tgt)

        # 1. Position alignment
        Pc, Qc = positions_src - positions_src.mean(axis=0), positions_tgt - positions_tgt.mean(axis=0)
        H = Pc.T @ Qc
        U, _, Vt = np.linalg.svd(H)
        R_pos = Vt.T @ U.T
        if np.linalg.det(R_pos) < 0:
            Vt[-1, :] *= -1
            R_pos = Vt.T @ U.T

        # 2. Orientation alignment
        vec_src, vec_tgt = [], []
        for qs, qt in zip(quats_src, quats_tgt):
            Rs = R.from_quat(qs).as_matrix()
            Rt = R.from_quat(qt).as_matrix()
            vec_src.extend(Rs.T)
            vec_tgt.extend(Rt.T)
        vec_src, vec_tgt = np.array(vec_src), np.array(vec_tgt)
        R_orient, _ = R.align_vectors(vec_tgt, vec_src)
        
        # 3. Weighted blending
        q_pos = R.from_matrix(R_pos).as_quat()
        q_orient = R_orient.as_quat()
        q_blend = self.slerp_quat(q_pos, q_orient, np.clip(w_orient, 0.0, 1.0))
        R_combined = R.from_quat(q_blend).as_matrix()

        # 4. Translation
        t_opt = positions_tgt.mean(axis=0) - R_combined @ positions_src.mean(axis=0)

        # 5. Build 4x4 matrix
        T_mat = np.eye(4)
        T_mat[:3, :3] = R_combined
        T_mat[:3, 3] = t_opt
        
        # Convert numpy array to nested list before giving to COMPAS
        T = Transformation.from_matrix(T_mat.tolist())
        frame_result = Frame.from_transformation(T)

        self.log("Kabsch/Wahba algorithm gave the initial guess {}.".format(frame_result))
        return T, frame_result, T_mat

    def points_to_pointcloud(self, points):
        array = [[x,y,z] for x, y, z in iter(points)]
        pcd = open3d.geometry.PointCloud()
        pcd.points = open3d.utility.Vector3dVector(array)
        pcd.voxel_down_sample(0.0001)
        return pcd
    
    def icp_alignment(self, pcd_src, pcd_tgt, initial_guess, threshold=0.05):
        initial_guess_p = frame_to_rhino_plane(initial_guess)
        trans_init, evaluation = evaluate_local_registration(pcd_src, pcd_tgt, threshold, initial_guess_p)
        registration_icp = execute_icp_local_registration(pcd_src, pcd_tgt, threshold, trans_init)

        # print("Inlier Fitness: ", registration_icp.fitness)
        # print("Inlier RMSE: ", registration_icp.inlier_rmse)
        # print("Transformation: \n", registration_icp.transformation)

        # source_out = [rg.Point3d(*pt) for pt in pcd_src.points]
        # target_out = [rg.Point3d(*pt) for pt in target.points]
        T_ICP = Transformation.from_matrix(list(registration_icp.transformation))
        frame_result = Frame.worldXY().transformed(T_ICP)

        return T_ICP, frame_result

    def run(self, stop_thread):
        self.log("Computing transformation between OKVIS and Rhino worlds.")

        # Compute Tokvis_to_rhino via alignment. Source frames will be the estimated frames in BCF, target frames will be the planned frames in WCF. 
        # Result will give Tokvis_to_rhino.

        if self.realignment is False: # For the initial alignment between estimated and planned brick poses.
            temporary_keys = [127,128,129]  #[k for k in self.structure_assembly.graph.nodes_where({"temporary":True})]
            parts_keys = [p for p in self.structure_assembly.part_keys()]
            anchor_keys = [t for t in parts_keys if self.structure_assembly.graph.node_attribute(t, "anchor")]

            frames_src, points_src = self.assembly_to_frames_and_points(self.structure_assembly, temporary_keys) # temporary estimated ones
            frames_tgt, points_tgt = self.assembly_to_frames_and_points(self.structure_assembly, anchor_keys, "planned_frame") # built planned ones (in 2nd alignment, we might have to match them first and then select the keys...)

        else:
            self.log("Realignment.")

            parts_keys = [p for p in self.structure_assembly.part_keys()]
            anchor_keys = [t for t in parts_keys if self.structure_assembly.graph.node_attribute(t, "anchor")]

            frames_src, points_src = self.assembly_to_frames_and_points(self.structure_assembly, anchor_keys, "anchor_estimated_frame") # temporary estimated ones
            frames_tgt, points_tgt = self.assembly_to_frames_and_points(self.structure_assembly, anchor_keys, "planned_frame")  # built planned ones

            # final_parts = [t for t in parts_keys if self.structure_assembly.graph.node_attribute(t, "final_estimated_frame") is not None]
            # second_parts = [t for t in parts_keys if self.structure_assembly.graph.node_attribute(t, "second_estimated_frame") is not None]
            # shared_parts = [s for s in second_parts if s in final_parts]

            # frames_src, points_src = self.assembly_to_frames_and_points(self.structure_assembly, shared_parts, "second_estimated_frame_BCF")
            # frames_tgt, points_tgt = self.assembly_to_frames_and_points(self.structure_assembly, shared_parts, "final_estimated_frame")

            # # frames_src, points_src = self.assembly_to_frames_and_points(self.structure_assembly, second_parts, "second_estimated_frame_BCF")
            # # frames_tgt, points_tgt = self.assembly_to_frames_and_points(self.structure_assembly, second_parts, "planned_frame") 

        T, initial_guess, T_mat = self.kabsch_wahba_alignment(frames_src, frames_tgt)

        pcd_src = self.points_to_pointcloud(points_src)
        pcd_tgt = self.points_to_pointcloud(points_tgt)

        Tokvis_to_rhino, frame_result = self.icp_alignment(pcd_src, pcd_tgt, initial_guess)
        
        self.log("ICP computed Tokvisrhino is {}".format(Tokvis_to_rhino))
        WCF_slam = self.robot.WCF_slam
        self.robot.WCF_slam = WCF_slam.transformed(Tokvis_to_rhino)
        # self.robot.WCF_slam = Tokvis_to_rhino
        self.robot.is_aligned = True # Should be false once robot starts moving.
        self.robot._record_state("WCF_slam update")

        if self.realignment:
            #realignment
            anchor_keys = list(self.structure_assembly.graph.nodes_where({"anchor":True}))

            for a in anchor_keys:

                estimated_frame = self.structure_assembly.graph.node_attribute(a, 'anchor_estimated_frame').copy()
                estimated_frame_t = estimated_frame.transformed(Tokvis_to_rhino)
                self.structure_assembly.part(a).frame = estimated_frame_t
                self.structure_assembly.graph.node_attribute(a, 'estimated_frame', estimated_frame_t)

                estimated_frame = self.structure_assembly.graph.node_attribute(a, 'anchor_estimated_frame_BCF').copy()
                estimated_frame_t = estimated_frame.transformed(Tokvis_to_rhino)
                self.structure_assembly.graph.node_attribute(a, 'estimated_frame_BCF', estimated_frame_t)

        self.is_completed = True
        return True

class TransformAlignmentTask(Task):
    def __init__(self, robot, stack_assembly, structure_assembly, realignment=False, key=None):
        super(TransformAlignmentTask, self).__init__(key)
        self.robot = robot
        self.stack_assembly = stack_assembly
        self.structure_assembly = structure_assembly
        self.realignment = realignment

    def align_stack_from_WCF_slam_to_WCF(self):
        # Now transform all the estimated frames with Tokvisrhino, from WCF to WCF_slam then do comparison, 
        # add them to the found ones with the estimated_frame in WCF (WCFslam + BCFslam + estimated_frame_in_BCF)

        stack_keys = list(self.stack_assembly.part_keys())
        self.log(f"Applying WCF_slam→WCF transform to {len(stack_keys)} stack bricks")

        for k in stack_keys:
            # estimated_frame_in_WCF = T_okvis→rhino × estimated_frame_in_WCF_slam
            estimated_frame_in_WCF_slam = self.stack_assembly.graph.node_attribute(k, 'estimated_frame').copy()
            initial_estimated_frame_in_WCF_slam = self.stack_assembly.graph.node_attribute(k, 'initial_estimated_frame').copy()

            estimated_frame_in_WCF = estimated_frame_in_WCF_slam.transformed(self.robot.transformation_WCF_slam_WCF())
            initial_estimated_frame_in_WCF = initial_estimated_frame_in_WCF_slam.transformed(self.robot.transformation_WCF_slam_WCF())

            self.stack_assembly.part(k).frame = estimated_frame_in_WCF
            self.stack_assembly.graph.node_attribute(k, 'estimated_frame', estimated_frame_in_WCF)
            self.stack_assembly.graph.node_attribute(k, 'initial_estimated_frame', initial_estimated_frame_in_WCF)

            estimated_frame_in_BCF = self.stack_assembly.graph.node_attribute(k, 'estimated_frame_BCF').copy()
            initial_estimated_frame_in_BCF = self.stack_assembly.graph.node_attribute(k, 'initial_estimated_frame_BCF').copy()

            self.stack_assembly.graph.node_attribute(k, 'estimated_frame_BCF', estimated_frame_in_BCF)
            self.stack_assembly.graph.node_attribute(k, 'initial_estimated_frame_BCF', initial_estimated_frame_in_BCF)

    def align_structure_from_WCF_slam_to_WCF(self):
        # For the structure assembly:
        temporary_keys = [126,127,128,129] #list(self.structure_assembly.graph.nodes_where({"temporary":True}))
        self.log("Temporary keys are: {}".format(temporary_keys))

        for temporary_key in temporary_keys:
            # estimated_frame_in_WCF = T_okvis→rhino × estimated_frame_in_WCF_slam
            estimated_frame_in_WCF_slam = self.structure_assembly.graph.node_attribute(temporary_key, 'estimated_frame').copy()
            initial_estimated_frame_in_WCF_slam = self.structure_assembly.graph.node_attribute(temporary_key, 'initial_estimated_frame').copy()

            estimated_frame_in_WCF = estimated_frame_in_WCF_slam.transformed(self.robot.transformation_WCF_slam_WCF())
            initial_estimated_frame_in_WCF = initial_estimated_frame_in_WCF_slam.transformed(self.robot.transformation_WCF_slam_WCF())

            self.structure_assembly.part(temporary_key).frame = estimated_frame_in_WCF
            self.structure_assembly.graph.node_attribute(temporary_key, 'estimated_frame', estimated_frame_in_WCF)
            self.structure_assembly.graph.node_attribute(temporary_key, 'initial_estimated_frame', initial_estimated_frame_in_WCF)

            estimated_frame_in_BCF = self.structure_assembly.graph.node_attribute(temporary_key, 'estimated_frame_BCF').copy()
            initial_estimated_frame_in_BCF = self.structure_assembly.graph.node_attribute(temporary_key, 'initial_estimated_frame_BCF').copy()
            
            # Compare this frame to planned frames to match the keys:
            built_keys = [b for b in self.structure_assembly.graph.nodes_where({"anchor":True})]
            self.log("Anchor keys: {}".format(built_keys))
            target_key = None
            closest_distance = 0.1

            for built_key in built_keys:
                planned_frame_in_WCF = self.structure_assembly.graph.node_attribute(built_key, 'planned_frame')

                distance = distance_point_point(planned_frame_in_WCF.point, estimated_frame_in_WCF.point)
                self.log("Distance is {}".format(distance))
                if distance < closest_distance:
                    self.log("Temporary brick {} is the same as brick {}".format(temporary_key, built_key))
                    closest_distance = distance
                    target_key = built_key

            if target_key != None:
                self.log("Brick {} is being updated with the frame {}.".format(target_key, estimated_frame_in_WCF))
                # Add these frame attributes to the target key.
                self.structure_assembly.part(target_key).frame = estimated_frame_in_WCF
                self.structure_assembly.graph.node_attribute(target_key, 'estimated_frame', estimated_frame_in_WCF)
                self.structure_assembly.graph.node_attribute(target_key, 'initial_estimated_frame', initial_estimated_frame_in_WCF)

                self.structure_assembly.graph.node_attribute(target_key, 'estimated_frame_BCF', estimated_frame_in_BCF)
                self.structure_assembly.graph.node_attribute(target_key, 'initial_estimated_frame_BCF', initial_estimated_frame_in_BCF)

        # Delete the temporary brick.
        for temporary_key in temporary_keys:
            self.structure_assembly.graph.delete_node(temporary_key)

    def run(self, stop_thread):
        self.align_structure_from_WCF_slam_to_WCF()
        # self.align_stack_from_WCF_slam_to_WCF()

        self.is_completed = True
        return True

class ReceiveBCFgtTask(Task):
    def __init__(self, robot, fake=False, key=None):
        super(ReceiveBCFgtTask, self).__init__(key)
        self.robot = robot
        self.BCF_gt = None
        self.fake = fake
    
    def run(self, stop_thread):
        self.log("Subscribed to mobile base ground truth coordinate frame.")
        self.robot.mobile_client.clean_tf_frame()
        self.robot.mobile_client.tf_subscribe(
                    "robot_base_footprint",
                    "gt_world",
                )
        # Wait until pose is received.
        while not stop_thread():
            if self.robot.mobile_client.tf_frame is not None:
                self.BCF_gt = self.robot.mobile_client.tf_frame
                break
            time.sleep(0.1)

        # self.BCF_gt = Frame(point=Point(x=15.700, y=9.200, z=-0.000), xaxis=Vector(x=1.000, y=0.000, z=0.000), yaxis=Vector(x=-0.000, y=1.000, z=-0.000))
        if self.BCF_gt is None:
            self.log('Could not get the gt frame.')
        else:
            self.log('Got the gt frame: {}'.format(self.BCF_gt))
            self.robot.BCF_gt = self.BCF_gt
            if self.fake:
                self.robot.WCF_slam = self.BCF_gt
                self.robot.BCF_slam = Frame.worldXY()
            self.robot._record_state("BCF_gt update")

        self.robot.mobile_client.tf_unsubscribe(
                    "robot_base_footprint",
                    "gt_world",
                )
        self.log("Unsubscribed from mobile base ground truth coordinate frame.")

        self.is_completed = True
        return True

class ReceiveBCFslamTask(Task):
    def __init__(self, robot, key=None):
        super(ReceiveBCFslamTask, self).__init__(key)
        self.robot = robot
        self.BCF_slam = None
     
    def run(self, stop_thread):
        self.log("Subscribed to OKVIS mobile base coordinate frame.")
        self.robot.mobile_client.clean_tf_frame()
        self.robot.mobile_client.tf_subscribe(
                    "robot_base_footprint",
                    "robot_odom",
                )
        
        # Wait until pose is received.
        while not stop_thread():
            if self.robot.mobile_client.tf_frame is not None:
                self.BCF_slam = self.robot.mobile_client.tf_frame
                break
            time.sleep(0.1)

        if self.BCF_slam is None:
            self.log('Could not get the OKVIS frame.')
        else:
            # Note: BCF will be computed automatically via combination of BCF_slam + WCF_slam.
            self.log("BCFslam: {}".format(self.robot.BCF_slam))
            self.log("BCF: {}".format(self.robot.BCF))

            self.log('Got the OKVIS frame: {}'.format(self.BCF_slam))
            self.robot.BCF_slam = self.BCF_slam
            self.robot._update_BCF()
            self.log("BCF: {}".format(self.robot.BCF))
            self.robot._record_state("BCF_slam update")

        self.robot.mobile_client.tf_unsubscribe(
                    "robot_base_footprint",
                    "robot_odom"
                )

        self.log("Unsubscribed from OKVIS mobile base coordinate frame.")

        self.is_completed = True
        return True

class ReceiveBCFslamOnResetTask(Task):
    def __init__(self, robot, before=True, key=None):
        super(ReceiveBCFslamOnResetTask, self).__init__(key)
        self.robot = robot
        self.before = before
        self.BCF_slam = None
     
    def run(self, stop_thread):
        self.log("Subscribed to OKVIS mobile base coordinate frame.")
        self.robot.mobile_client.clean_tf_frame()
        self.robot.mobile_client.tf_subscribe(
                    "robot_base_footprint",
                    "robot_odom",
                )
        
        # Wait until pose is received.
        while not stop_thread():
            if self.robot.mobile_client.tf_frame is not None:
                self.BCF_slam = self.robot.mobile_client.tf_frame
                break
            time.sleep(0.1)

        if self.BCF_slam is None:
            self.log('Could not get the OKVIS frame.')
        else:
            # Note: BCF will be computed automatically via combination of BCF_slam + WCF_slam.
            self.log('Got the OKVIS frame: {}'.format(self.BCF_slam))

            if self.before:
                st["BCF_before"] = self.BCF_slam
                self.log("Temporary BCFslam is: {}".format(self.BCF_slam))
            else:
                BCF_before = st["BCF_before"]
                BCF_after = self.BCF_slam
                T_delta = Transformation.from_change_of_basis(Frame.worldXY(), BCF_before)
                F_delta = BCF_after.transformed(T_delta)
                BCF_old = self.robot.BCF_slam
                BCF_new = F_delta.transformed(Transformation.from_frame(BCF_old))
                self.robot.BCF_slam = BCF_new
                self.robot._update_BCF()
                self.log("BCF: {}".format(self.robot.BCF))
                self.robot._record_state("BCF_slam update")

        self.robot.mobile_client.tf_unsubscribe(
                    "robot_base_footprint",
                    "robot_odom"
                )

        self.log("Unsubscribed from OKVIS mobile base coordinate frame.")

        self.is_completed = True
        return True

class AddCollisionMeshes(Task):
    def __init__(self, robot, mesh, frame=Frame.worldXY(), mesh_id="tool_box", attached=True, key=None):
        super(AddCollisionMeshes, self).__init__(key)
        self.robot = robot
        # Convert inputs to lists if they're not already
        self.meshes = [mesh] if not isinstance(mesh, list) else mesh
        self.frames = [frame] if not isinstance(frame, list) else frame
        self.mesh_ids = [mesh_id] if not isinstance(mesh_id, list) else mesh_id
        # Validate list lengths
        if not (len(self.meshes) == len(self.frames) == len(self.mesh_ids)):
            raise ValueError("mesh, frame, and mesh_id must have the same length")
        self.attached = attached

    def compas_mesh_to_ros(self, mesh):
        """
        Convert COMPAS mesh vertices/faces to ROS Mesh format.
        - vertices: list of [x,y,z]
        - faces: list of [i,j,k]
        """
        vertices = [mesh.vertex_coordinates(i) for i in mesh.vertices()]
        faces = [mesh.face_vertices(f) for f in mesh.faces()]

        ros_vertices = []
        ros_triangles = []
        for v in vertices:
            ros_vertices.append({
                'x': float(v[0]),
                'y': float(v[1]),
                'z': float(v[2])
            })
        for f in faces:
            if len(f) == 3:
                ros_triangles.append({'vertex_indices': f})
            elif len(f) == 4:
                ros_triangles.append({'vertex_indices': [f[0], f[1], f[2]]})
                ros_triangles.append({'vertex_indices': [f[0], f[2], f[3]]})
            else:
                raise ValueError(f"Face with {len(f)} vertices not supported")
        return ros_vertices, ros_triangles

    def run(self, stop_thread):
        if self.attached:
            operation = "ATTACH"
            link_name = 'robot_arm_tool0'
        else:
            operation = "ADD"
            link_name = ''

        for mesh, frame, mesh_id in zip(self.meshes, self.frames, self.mesh_ids):
            vertices, triangles = self.compas_mesh_to_ros(mesh)
            pose = {
                'position': {
                    'x': frame.point.x,
                    'y': frame.point.y,
                    'z': frame.point.z
                },
                'orientation': {
                    'x': frame.quaternion.x,
                    'y': frame.quaternion.y,
                    'z': frame.quaternion.z,
                    'w': frame.quaternion.w
                }
            }
            msg = {
                'id': mesh_id,
                'operation': operation,
                'link_name': link_name,
                'vertices': vertices,
                'triangles': triangles,
                'pose': pose
            }

            self.log(f"Processing mesh {mesh_id}")
            while not stop_thread():
                if self.robot.mobile_client.is_service_available('/moveit/collision_mesh'):
                    result = self.robot.mobile_client.service_call(
                        '/moveit/collision_mesh',
                        'moveit_ros_interface/srv/CollisionMeshOp', 
                        msg
                    )
                    if result['success']:
                        break
                    self.log(f"Failed to add mesh {mesh_id}: {result['message']}")
                time.sleep(0.1)

        time.sleep(1)
        self.is_completed = True
        return True

class RemoveCollisionMesh(Task):
    def __init__(self, robot, frame=Frame.worldXY(), mesh_id="tool_box", key=None):
        super(RemoveCollisionMesh, self).__init__(key)
        self.robot = robot
        self.mesh_id = mesh_id
        self.frame = frame

    def run(self, stop_thread):
        pose = {'position' : {
                            'x' : self.frame.point.x,
                            'y' : self.frame.point.y,
                            'z' : self.frame.point.z},
                    'orientation' : {
                            'x' : self.frame.quaternion.x,
                            'y' : self.frame.quaternion.y,
                            'z' : self.frame.quaternion.z,
                            'w' : self.frame.quaternion.w}
                }
        msg = {
            'id': self.mesh_id,
            'operation': 'REMOVE',
            'link_name': '',      # not needed for REMOVE
            'vertices': [],       # not needed for REMOVE
            'triangles': [],      # not needed for REMOVE
            'pose': pose
        }
        self.log(f"Requesting removal of collision mesh: {self.mesh_id}")
        while not stop_thread():
            if self.robot.mobile_client.is_service_available('/moveit/collision_mesh'):
                self.log("Collision mesh service is available.")
                result = self.robot.mobile_client.service_call(
                    '/moveit/collision_mesh',
                    'moveit_ros_interface/srv/CollisionMeshOp',
                    msg
                )
                success = result['success']
                message = result['message']
                self.log(f"Service response: {success} - {message}")
                break
            else:
                self.log("Collision mesh service is not available.")
                break
            time.sleep(0.2)
        self.is_completed = True
        return True

class MoveMobileBaseTask(Task):
    def __init__(self, robot, velocity=1.0, right=True, linear=True, total_time=7, key=None):
        super(MoveMobileBaseTask, self).__init__(key)
        self.robot = robot
        self.linear = linear
        self.velocity = velocity
        self.right = right
        self.total_time = total_time
        # robot dimensions (meters)
        self.L = 0.959   # front-back - wheelbase
        self.W = 0.585   # left-right -trackwidth
    
    def compute_swerve_rotation(self, L, W, omega, x_p=0, y_p=0):
        """
        Compute wheel steering angles and wheel speeds
        for rotation about robot center.

        L: front-back distance
        W: left-right distance
        omega: angular velocity (rad/s)
        """

        # Wheel positions
        wheels = {
            "back_left":   (-L/2,  W/2),
            "front_left":  ( L/2,  W/2),
            "back_right":  (-L/2, -W/2),
            "front_right": ( L/2, -W/2),
        }

        angles = []
        speeds = []

        for (x, y) in wheels.values():
            # Velocity due to rotation
            dx = x - x_p
            dy = y - y_p

            v_x = -omega * dy
            v_y =  omega * dx


            angle = math.atan2(v_y, v_x)
            speed = math.sqrt(v_x**2 + v_y**2)

            angles.append(angle)
            speeds.append(speed)

        return angles, speeds

    def run(self, stop_thread):
        msg = {
            'data' : False
        }

        while not stop_thread():
            if self.robot.mobile_client.is_service_available('/fix_robot_service'):
                result = self.robot.mobile_client.service_call('/fix_robot_service', 'std_srvs/srv/SetBool', msg)
                success = result['success']
                message = result['message']
                self.log('Message: {}'.format(message))
                if success:
                    break
            else:
                self.log("Fix robot service is not available.")
                break
            time.sleep(0.1)
        
        if self.linear:
            if self.right:
                angle = math.radians(-90)
            else:
                angle = math.radians(90)
            position = [angle, angle, angle, angle]
            velocity = [self.velocity, self.velocity, self.velocity, self.velocity]
        else:
            if self.right:
                omega = self.velocity  # rad/s (positive = CCW)
            else:
                omega = -self.velocity
            position, velocity = self.compute_swerve_rotation(self.L, self.W, omega, x_p=2)

        client = self.robot.mobile_client.ros_client

        publisher = roslibpy.Topic(client, '/base_joint_commands', 'sensor_msgs/JointState')
        joint_names = ["robot_back_left_motor_wheel_joint", "robot_front_left_motor_wheel_joint", 
                         "robot_back_right_motor_wheel_joint",  "robot_front_right_motor_wheel_joint",]
        
        self.log("Position: {}, Velocity: {}, Total time: {}".format(str(position), str(velocity), str(self.total_time)))
        
        while not stop_thread():
            msg = {
                'header': {'stamp': {'secs': int(time.time()), 'nsecs': int((time.time() % 1) * 1e9)}},
                'name': joint_names,
                'position': position,
                'velocity': [0,0,0,0],
                }
            publisher.publish(msg)
            time.sleep(2)

            msg = {
                    'header': {'stamp': {'secs': int(time.time()), 'nsecs': int((time.time() % 1) * 1e9)}},
                    'name': joint_names,
                    'position': position,
                    'velocity': velocity
                }
            publisher.publish(msg)
            total_time = self.total_time #15 #.5m ->7 #6m -> 70 #1m -> 15 # 3m -> 40 # 0.4 -> 5
            time.sleep(total_time)

            msg = {
                'header': {'stamp': {'secs': int(time.time()), 'nsecs': int((time.time() % 1) * 1e9)}},
                'name': joint_names,
                'position': [0,0,0,0],
                'velocity': [0,0,0,0],
                }
            publisher.publish(msg)
            time.sleep(1)
            break
        
        msg = {
            'data' : True
        }
        while not stop_thread():
            if self.robot.mobile_client.is_service_available('/fix_robot_service'):
                result = self.robot.mobile_client.service_call('/fix_robot_service', 'std_srvs/srv/SetBool', msg)
                success = result['success']
                message = result['message']
                self.log('Message: {}'.format(message))
                if success:
                    break
            else:
                self.log("Fix robot service is not available.")
                break
            time.sleep(0.1)
            
        publisher.unadvertise()
        self.log("Arrived at target base frame.")
        
        self.is_completed = True
        return True

class SendMobileBaseJointStatesTask(Task):
    def __init__(self, robot, rotation_value_list=None, velocity_value_list=None, time_interval_list=None, key=None):
        super(SendMobileBaseJointStatesTask, self).__init__(key)
        self.robot = robot
        self.rotation_value_list = rotation_value_list
        self.velocity_value_list = velocity_value_list
        self.time_interval_list = time_interval_list
        
    def run(self, stop_thread):
        client = self.robot.mobile_client.ros_client

        publisher = roslibpy.Topic(client, '/base_joint_commands', 'sensor_msgs/JointState')
        joint_names = ["robot_front_left_motor_wheel_joint", "robot_front_right_motor_wheel_joint", 
                        "robot_back_left_motor_wheel_joint","robot_back_right_motor_wheel_joint", 
                        "robot_front_left_wheel_joint", "robot_front_right_wheel_joint",
                        "robot_back_left_wheel_joint", "robot_back_right_wheel_joint"]

        time_start = time.time()

        i = 0
        while client.is_connected:
            t = time.time() - time_start

            self.log("Position: {}, Velocity: {}".format(str(self.rotation_value_list[i]), str(self.velocity_value_list[i])))

            msg = {
                'header': {'stamp': {'secs': int(time.time()), 'nsecs': int((time.time() % 1) * 1e9)}},
                'name': joint_names,
                'position': self.rotation_value_list[i],
                'velocity': self.velocity_value_list[i]
            }
            publisher.publish(msg)
            # Calculate the time with velocity.
            time.sleep(self.time_interval_list[i]) #0.02*8
            i += 1
            if i == len(self.rotation_value_list):
                msg = {
                'header': {'stamp': {'secs': int(time.time()), 'nsecs': int((time.time() % 1) * 1e9)}},
                'name': joint_names,
                'position': [0,0,0,0,0,0,0,0],
                'velocity': [0,0,0,0,0,0,0,0],
                }
                publisher.publish(msg)
                break
            
        publisher.unadvertise()
        self.log("Arrived at target base frame.")
        
        self.is_completed = True
        return True

class MotionPlanExecutePose(Task):
    def __init__(self, robot, target_frame=None, frame_in_WCF=True, group="ur20", ee_link="robot_arm_tool0", execute=True, tool_constraint=False, key=None):
        super(MotionPlanExecutePose, self).__init__(key)
        self.robot = robot
        self.target_frame = target_frame
        self.frame_in_WCF = frame_in_WCF
        self.group = group
        self.ee_link = ee_link
        self.execute = execute
        self.tool_constraint = tool_constraint
    
    def run(self, stop_thread):
        if self.robot.attached_tool:
            self.target_frame = self.robot.from_tcf_to_t0cf([self.target_frame])[0]
            self.log("Attached tool.")

        if self.frame_in_WCF:
            frame_BCF = self.robot.from_WCF_to_BCF(self.target_frame)
        else:
            frame_BCF = self.target_frame

        if self.tool_constraint:
            path_constraints = {
            'name': 'keep_tool_in_xy_plane',
            'joint_constraints': [],
            'position_constraints': [],
            'orientation_constraints': [
                {
                    'header': {'frame_id': 'robot_base_footprint'},           # reference frame
                    'orientation': {'x': -0.705, 'y': 0.709, 'z': 0.0, 'w': 0.0},  # tool facing downward
                    'link_name': 'robot_arm_tool0',                # your EE link
                    'absolute_x_axis_tolerance': 3,              # allow slight tilt
                    'absolute_y_axis_tolerance': 3,
                    'absolute_z_axis_tolerance': 6.283,            # free rotation around Z
                    'weight': 1.0
                }
            ],
            'visibility_constraints': []
        }
        else:
            path_constraints = {
                'name': '',
                'joint_constraints': [],
                'position_constraints': [],
                'orientation_constraints': [],
                'visibility_constraints': []
            }

        msg = {
            'pose' : {
                'header' : {'frame_id' : 'robot_base_footprint'},
                'pose' : {
                    'position' : {
                            'x' : frame_BCF.point.x,
                            'y' : frame_BCF.point.y,
                            'z' : frame_BCF.point.z},
                    'orientation' : {
                            'x' : frame_BCF.quaternion.x,
                            'y' : frame_BCF.quaternion.y,
                            'z' : frame_BCF.quaternion.z,
                            'w' : frame_BCF.quaternion.w}
                }
            },
            'group' : self.group,
            'ee_link' : self.ee_link,
            'execute' : self.execute,
            'path_constraints': path_constraints
        }
        # self.log(msg)

        while not stop_thread():
            if self.robot.mobile_client.is_service_available('/moveit/plan_execute_pose'):
                self.log("Motion planning for pose service is available.")
                result = self.robot.mobile_client.service_call('/moveit/plan_execute_pose', 'moveit_ros_interface/srv/PlanExecutePose', msg)
                success = result['success']
                message = result['message']
                trajectory = result['trajectory']
                # self.log('Trajectory: {}'.format(trajectory))
                if success:
                    break
            else:
                self.log("Motion planning for pose service is not available.")
                break
            time.sleep(0.1)
        
        time.sleep(0.1)
        self.is_completed = True
        return True

class MotionPlanExecuteJoints(Task):
    def __init__(self, robot, configuration=None, group="ur20", execute=True, key=None):
        super(MotionPlanExecuteJoints, self).__init__(key)
        self.robot = robot
        self.configuration = configuration
        self.group = group
        self.execute = execute
    
    def run(self, stop_thread):
        msg = {
            'group' : self.group,
            'names' : self.configuration.joint_names,
            'positions' : self.configuration.joint_values,
            'execute' : self.execute
        }
        self.log(msg)

        while not stop_thread():
            if self.robot.mobile_client.is_service_available('/moveit/plan_execute_joints'):
                self.log("Motion planning for joints service is available.")
                result = self.robot.mobile_client.service_call('/moveit/plan_execute_joints', 'moveit_ros_interface/srv/PlanExecuteJoints', msg)
                success = result['success']
                message = result['message']
                trajectory = result['trajectory']
                #self.log('Trajectory: {}'.format(trajectory))
                if success:
                    break
            else:
                self.log("Motion planning for joints service is not available.")
                break
            time.sleep(0.1)
        
        time.sleep(1)
        self.is_completed = True
        return True

class GripperControlTask(Task):
    def __init__(self, robot, open_grip=True, key=None):
        super(GripperControlTask, self).__init__(key)
        self.robot = robot
        self.open_grip = open_grip
    
    def run(self, stop_thread):
        msg = {
            'data' : self.open_grip
        }

        time.sleep(1)
        while not stop_thread():
            if self.robot.mobile_client.is_service_available('/gripper_service'):
                result = self.robot.mobile_client.service_call('/gripper_service', 'std_srvs/srv/SetBool', msg)
                success = result['success']
                message = result['message']
                self.log('Message: {}'.format(message))
                if success:
                    break
            else:
                self.log("Gripper service is not available.")
                break
            time.sleep(0.1)
        time.sleep(1)
        self.is_completed = True
        return True

class ChangeToolFrameTask(Task):
    def __init__(self, robot, tool_name='gripper', key=None):
        super(ChangeToolFrameTask, self).__init__(key)
        self.robot = robot
        self.tool_name = tool_name
        gripper_frame = Frame([0, 0, 0.166], [0, -1, 0], [1, 0, 0])
        camera_frame = Frame([-0.0327, 0.0572, 0.0815], [-1, 0, 0], [0, 0, 1])
        if tool_name == 'gripper':
            self.tool_frame = gripper_frame
        else:
            self.tool_frame = camera_frame
        
    def run(self, stop_thread):
        self.log("ChangeToolTask")
        self.log('Changing the tool frame to {}.'.format(self.tool_name))
        self.robot.attached_tools['ur20'].frame = self.tool_frame
        self.robot.attached_tools['ur20_and_liftkit'].frame = self.tool_frame
        self.is_completed = True
        return True

class UpdateAssemblyAttributes(Task):
    def __init__(self, material_stack, building_structure, pick_key, place_key, key=None):
        super(UpdateAssemblyAttributes, self).__init__(key)
        self.material_stack = material_stack
        self.building_structure = building_structure
        self.pick_key = pick_key
        self.place_key = place_key
    
    def update_neighbor_availability(self, assembly, part_key=None):
        updated_keys = []
        # Determine which parts to check
        part_keys = (
            assembly.graph.neighbors_out(part_key)
            if part_key is not None
            else assembly.part_keys()
        )
        for key in part_keys:
            below = assembly.graph.neighbors_in(key)
            below_built = all(
                bool(assembly.graph.node_attribute(n, "built")) for n in below
            )

            if below_built and not assembly.graph.node_attribute(key, "available"):
                assembly.graph.node_attribute(key, "available", True)
                updated_keys.append(key)
        return updated_keys

    def run(self, stop_thread):
        # Change brick attributes:
        self.material_stack.graph.node_attribute(self.pick_key, "built", False)
        self.material_stack.graph.node_attribute(self.pick_key, "available", False)
        self.building_structure.graph.node_attribute(self.place_key, "built", True)
        self.building_structure.graph.node_attribute(self.place_key, "available", False)
        self.building_structure.graph.node_attribute(self.place_key, "pick_key", self.pick_key)
        self.update_neighbor_availability(self.building_structure, self.place_key)

        self.is_completed = True
        return True


def select_pick_brick(assembly, z_tol=0.01):
    available = list(assembly.graph.nodes_where({"available": True}))
    if not available:
        return None

    # --- estimate stack yaw (ignore 90°-rotated bricks) ---
    yaws = []
    for k in available:
        xaxis = assembly.part(k).frame.xaxis
        yaw = math.atan2(xaxis.y, xaxis.x)
        yaws.append(yaw % (math.pi / 2))

    stack_yaw = sorted(yaws)[len(yaws) // 2]  # median
    print(f"Estimated stack yaw: {math.degrees(stack_yaw):.2f}°")

    c = math.cos(-stack_yaw)
    s = math.sin(-stack_yaw)

    # --- rotate positions into stack frame ---
    bricks = []
    for k in available:
        p = assembly.part(k).frame.point
        rx = c * p.x - s * p.y
        rz = p.z
        bricks.append((k, rx, rz))

    # --- select top layer ---
    max_z = max(b[2] for b in bricks)
    top = [b for b in bricks if abs(b[2] - max_z) < z_tol]

    # --- select most right ---
    best = max(top, key=lambda b: b[1])

    return best[0]

def select_place_brick(assembly):
    available_nodes = assembly.graph.nodes_where({"built":False, "available":True})
    max_key = max(
        available_nodes,
        key=lambda n: assembly.graph.node_attribute(n, 'planned_frame').point.y
    )
    return max_key

def slerp_quat(q1, q2, t):
    q1 = q1 / np.linalg.norm(q1)
    q2 = q2 / np.linalg.norm(q2)
    dot = np.dot(q1, q2)
    if dot < 0.0:
        q2 = -q2
        dot = -dot
    if dot > 0.9995:
        q = q1 + t * (q2 - q1)
        return q / np.linalg.norm(q)
    theta_0 = np.arccos(dot)
    theta = theta_0 * t
    q3 = q2 - q1 * dot
    q3 = q3 / np.linalg.norm(q3)
    return q1 * np.cos(theta) + q3 * np.sin(theta)

def average_frame(frame_a, frame_b):
    # --- Average position ---
    p = Point(
        0.5 * (frame_a.point.x + frame_b.point.x),
        0.5 * (frame_a.point.y + frame_b.point.y),
        0.5 * (frame_a.point.z + frame_b.point.z),
    )

    # --- Average orientation via SLERP ---
    R_a = Rotation.from_frame(frame_a)
    R_b = Rotation.from_frame(frame_b)

    qa = np.array(R_a.quaternion)
    qb = np.array(R_b.quaternion)

    q_avg = slerp_quat(qa, qb, 0.5)
    R_avg = Rotation.from_quaternion(q_avg)

    # --- Build averaged frame ---
    avg_frame = Frame.from_rotation(R_avg)
    avg_frame.point = p
    return avg_frame

if routine == "receive_bcf":
    tasks = [
                # ReceiveBCFslamTask(robot),
                ReceiveBCFgtTask(robot)]

elif routine == "general_snapshot":
    tasks = [ChangeToolFrameTask(robot, "gripper")]
    # tasks.append(MotionPlanExecuteJoints(robot, start_config))
    # tasks = []
    first = True
    for snap_plane in snap_planes[0:1]: #[:5]
        frame_BCF = plane_to_compas_frame(snap_plane).transformed(Translation.from_vector([0,-0.05,0]))
        target_planes.append(frame_to_rhino_plane(robot.from_BCF_to_WCF(frame_BCF)))
        tasks.append(CleanBricksTask(robot))
        tasks.append(MotionPlanExecutePose(robot, frame_BCF, frame_in_WCF=False))
        # if first:
        #     addition = 20
        # else:
        #     addition = 0
        # tasks.append(TriggerEstimationTask(robot, trigger=True, sleep=20+addition))
        # tasks.append(TriggerEstimationTask(robot, trigger=False, sleep=0))
        # first=False

    # tasks.append(ScanAllBricksTask(robot, stack_assembly=material_stack, structure_assembly=building_structure, stack=False))
    # tasks.append(TriggerEstimationTask(robot, trigger=False, cuda_off=True, sleep=0))
    # tasks.append(MotionPlanExecuteJoints(robot, start_config))

elif routine == "closeup_snapshot":
    tasks = [ChangeToolFrameTask(robot, "camera")]
    tasks.append(MotionPlanExecuteJoints(robot, start_config))

    temporary_keys = list(building_structure.graph.nodes_where({"temporary":True}))
    print(temporary_keys)
    first = True

    for temporary_key in temporary_keys:
        estimated_frame_BCF = building_structure.graph.node_attribute(temporary_key, 'estimated_frame_BCF')
        closeup_snapshot = plane_to_compas_frame(closeup_plane)
        snapshot_frame_BCF = closeup_snapshot.transformed(Transformation.from_frame(estimated_frame_BCF))

        target_planes.append(frame_to_rhino_plane(robot.from_BCF_to_WCF(snapshot_frame_BCF)))
        # closeup_snapshot = Frame(point=Point(x=0.390, y=-0.298, z=-0.325), xaxis=Vector(x=-0.471, y=-0.879, z=0.076), yaxis=Vector(x=0.570, y=-0.238, z=0.786))
        # snapshot_frame_BCF = closeup_snapshot.transformed(Transformation.from_frame(estimated_frame_BCF))

        target_planes.append(frame_to_rhino_plane(robot.from_BCF_to_WCF(snapshot_frame_BCF)))

        tasks.append(CleanBricksTask(robot))
        tasks.append(MotionPlanExecutePose(robot, snapshot_frame_BCF, frame_in_WCF=False))
        if first:
            addition = 20
        else:
            addition = 0
        tasks.append(TriggerEstimationTask(robot, trigger=True, sleep=20+addition))
        tasks.append(ScanSingleBrickTask(robot, assembly=building_structure, brick_key_to_update=temporary_key))
        tasks.append(TriggerEstimationTask(robot, trigger=False, sleep=0))
        first = False

    tasks.append(TriggerEstimationTask(robot, trigger=False, cuda_off=True, sleep=0))
    tasks.append(MotionPlanExecuteJoints(robot, start_config))

elif routine == "alignment":
    tasks = []
    tasks.append(AlignmentTask(robot, structure_assembly=building_structure))
    # tasks.append(TransformAlignmentTask(robot, stack_assembly=material_stack, structure_assembly=building_structure))

elif routine == "gt_alignment":
    tasks = []
    tasks.append(ReceiveBCFgtTask(robot, fake=True))
    tasks.append(TransformAlignmentTask(robot, stack_assembly=material_stack, structure_assembly=building_structure))

elif routine == "general_snapshot_before_pick":
    tasks = [ChangeToolFrameTask(robot, "gripper")]
    tasks.append(MotionPlanExecuteJoints(robot, start_config))

    snap_frames = [plane_to_compas_frame(snap_plane) for snap_plane in snap_planes[2:3]]
    left_stack = True
    if left_stack:
        snap_frames = [s.transformed(Rotation.from_axis_and_angle(
                                                Vector.Zaxis(), math.radians(180), robot.RCF.point)) for s in snap_frames]
    first = True
    for frame_BCF in snap_frames: #[:5]
        target_planes.append(frame_to_rhino_plane(robot.from_BCF_to_WCF(frame_BCF)))
        tasks.append(MotionPlanExecutePose(robot, frame_BCF, frame_in_WCF=False))
        if first:
            addition = 20
        else:
            addition = 0
        tasks.append(TriggerEstimationTask(robot, trigger=True, sleep=20+addition))
        # tasks.append(TriggerEstimationTask(robot, trigger=False, sleep=0))
        first=False

    tasks.append(ScanAllBricksTask(robot, stack_assembly=material_stack, structure_assembly=building_structure))
    tasks.append(TriggerEstimationTask(robot, trigger=False, cuda_off=True, sleep=0))
    #tasks.append(MotionPlanExecuteJoints(robot, start_config))

elif routine == "closeup_snapshot_pick":
    pick_key = 70 #select_pick_brick(material_stack)
    print(pick_key)
    pick_estimated_frame_BCF = material_stack.graph.node_attribute(pick_key, 'estimated_frame_BCF')

    closeup_snapshot = Frame(point=Point(x=0.390, y=-0.298, z=-0.325), xaxis=Vector(x=-0.471, y=-0.879, z=0.076), yaxis=Vector(x=0.570, y=-0.238, z=0.786))
    planned_snapshot_frame_BCF = closeup_snapshot.transformed(Transformation.from_frame(pick_estimated_frame_BCF))
    planned_snapshot_frame_BCF = planned_snapshot_frame_BCF.transformed(Rotation.from_axis_and_angle(pick_estimated_frame_BCF.zaxis, math.radians(180), pick_estimated_frame_BCF.point))

    # closeup_snapshot = plane_to_compas_frame(closeup_plane)
    # planned_snapshot_frame_BCF = closeup_snapshot.transformed(Transformation.from_frame(pick_estimated_frame_BCF))
    # planned_snapshot_frame_BCF = planned_snapshot_frame_BCF.transformed(Rotation.from_axis_and_angle(pick_estimated_frame_BCF.zaxis, math.radians(0), pick_estimated_frame_BCF.point))

    target_planes.append(frame_to_rhino_plane(robot.from_BCF_to_WCF(planned_snapshot_frame_BCF)))

    tasks = [ChangeToolFrameTask(robot, "camera")]
    # tasks.append(MotionPlanExecuteJoints(robot, start_config))
    tasks.append(CleanBricksTask(robot))
    tasks.append(MotionPlanExecutePose(robot, planned_snapshot_frame_BCF, frame_in_WCF=False))
    tasks.append(TriggerEstimationTask(robot, trigger=True, sleep=40))
    tasks.append(ScanSingleBrickAddNewTask(robot, assembly=material_stack, brick_key_to_update=pick_key, average=True))
    tasks.append(TriggerEstimationTask(robot, trigger=False, sleep=0))

elif routine in ["pick", "place", "pick_place"]:   
    pick_key = 70
    print(pick_key)

    #pick_estimated_frame_BCF = material_stack.graph.node_attribute(pick_key, 'estimated_frame_BCF').transformed(Translation.from_vector([0,0,0.03]))
    pick_estimated_frame_BCF = robot.from_WCF_to_BCF(material_stack.part(pick_key).frame.transformed(Translation.from_vector([0,0,0.04])))
    mid_estimated_frame_BCF = pick_estimated_frame_BCF.transformed(Translation.from_vector([0,0,0.04]))
    safe_pick_estimated_frame_BCF = pick_estimated_frame_BCF.transformed(Translation.from_vector([0,0,0.15]))

    target_planes.append(frame_to_rhino_plane(robot.from_BCF_to_WCF(safe_pick_estimated_frame_BCF)))
    target_planes.append(frame_to_rhino_plane(robot.from_BCF_to_WCF(pick_estimated_frame_BCF)))

    front_frame_BCF = Frame([1, 0, 1], xaxis=Vector.Xaxis(), yaxis=-Vector.Yaxis())
    # target_planes.append(frame_to_rhino_plane(robot.from_BCF_to_WCF(front_frame_BCF)))

    place_key = select_place_brick(building_structure)
    print(place_key)

    place_planned_frame = building_structure.graph.node_attribute(place_key, 'planned_frame').transformed(
                                                                Translation.from_vector([0,0,0.038]))
    mid_place_planned_frame = place_planned_frame.transformed(Translation.from_vector([0,0,0.15]))
    safe_place_planned_frame = place_planned_frame.transformed(Translation.from_vector([0,0,0.5]))

    target_planes.append(frame_to_rhino_plane((safe_place_planned_frame)))
    target_planes.append(frame_to_rhino_plane((place_planned_frame)))

    pick_tasks = [ChangeToolFrameTask(robot, "gripper"),
                # MotionPlanExecuteJoints(robot, start_config),
                MotionPlanExecutePose(robot, safe_pick_estimated_frame_BCF, frame_in_WCF=False),
                GripperControlTask(robot, open_grip=True),
                MotionPlanExecutePose(robot, mid_estimated_frame_BCF, frame_in_WCF=False, tool_constraint=True),
                MotionPlanExecutePose(robot, pick_estimated_frame_BCF, frame_in_WCF=False, tool_constraint=True),
                GripperControlTask(robot, open_grip=False),
                MotionPlanExecutePose(robot, safe_pick_estimated_frame_BCF, frame_in_WCF=False, tool_constraint=True)]

    place_tasks = [ChangeToolFrameTask(robot, "gripper"),
                # MotionPlanExecuteJoints(robot, start_config),
                MotionPlanExecutePose(robot, safe_place_planned_frame, frame_in_WCF=True, tool_constraint=True),
                MotionPlanExecutePose(robot, mid_place_planned_frame, frame_in_WCF=True, tool_constraint=True),
                MotionPlanExecutePose(robot, place_planned_frame, frame_in_WCF=True, tool_constraint=True),
                GripperControlTask(robot, open_grip=True),
                MotionPlanExecutePose(robot, mid_place_planned_frame, frame_in_WCF=True, tool_constraint=True),
                MotionPlanExecutePose(robot, safe_place_planned_frame, frame_in_WCF=True, tool_constraint=True),
                GripperControlTask(robot, open_grip=False),
                UpdateAssemblyAttributes(material_stack, building_structure, pick_key, place_key)]

    if routine == "pick":
        tasks = pick_tasks
    elif routine == "place":
        tasks = place_tasks
    else:
        tasks =  pick_tasks + place_tasks

elif routine in ["closeup_for_later", "closeup_realignment"]:
    if routine == "closeup_for_later":
        frame_attribute = "final_estimated_frame"
    else:
        frame_attribute = "second_estimated_frame"
    parts_keys = [p for p in building_structure.part_keys()]
    parts_keys = [p for p in parts_keys if building_structure.graph.node_attribute(p, "built")]
    top_parts = [
    p for p in parts_keys
    if all(
        not building_structure.graph.node_attribute(n, "built")
        for n in building_structure.graph.neighbors_out(p)
    )
    ]
    tasks = [ChangeToolFrameTask(robot, "camera")]
    for p in top_parts:
        planned_frame_WCF = building_structure.graph.node_attribute(p, 'planned_frame')
        closeup_snapshot = plane_to_compas_frame(closeup_plane)
        # closeup_snapshot = Frame(point=Point(x=0.390, y=-0.298, z=-0.325), xaxis=Vector(x=-0.471, y=-0.879, z=0.076), yaxis=Vector(x=0.570, y=-0.238, z=0.786))
        planned_snapshot_frame_WCF = closeup_snapshot.transformed(Transformation.from_frame(planned_frame_WCF))
        planned_snapshot_frame_WCF = planned_snapshot_frame_WCF.transformed(Rotation.from_axis_and_angle(planned_frame_WCF.zaxis, math.radians(0), planned_frame_WCF.point))

        target_planes.append(frame_to_rhino_plane(planned_snapshot_frame_WCF))

        tasks.append(MotionPlanExecuteJoints(robot, start_config))
        tasks.append(CleanBricksTask(robot))
        tasks.append(MotionPlanExecutePose(robot, planned_snapshot_frame_WCF, frame_in_WCF=True))
        tasks.append(TriggerEstimationTask(robot, trigger=True, sleep=30))
        tasks.append(ScanSingleBrickTask(robot, assembly=building_structure, brick_key_to_update=p, frame_attribute=frame_attribute))
        tasks.append(TriggerEstimationTask(robot, trigger=False, sleep=0))

elif routine == "move_base":
    #tasks = [SendMobileBaseJointStatesTask(robot, rotation_values, velocity_values, timeInt)]
    # tasks = [SendNavigationActionTask(robot)]
    tasks = [
                ReceiveBCFslamOnResetTask(robot, before=True),
                MoveMobileBaseTask(robot, linear=False, total_time=16),
                ReceiveBCFslamOnResetTask(robot, before=False),
                # ReceiveBCFslamTask(robot,),
                ReceiveBCFgtTask(robot),
                ]

elif routine == "closeup_reanchor":
    frame_attribute = "anchor_estimated_frame"
    parts_keys = [p for p in building_structure.part_keys()]
    anchor_keys = [p for p in parts_keys if building_structure.graph.node_attribute(p, "anchor")]
    print(anchor_keys)
    tasks = [ChangeToolFrameTask(robot, "camera")]
    # tasks.append(MotionPlanExecuteJoints(robot, start_config))
    
    for p in anchor_keys:
        planned_frame_WCF = building_structure.graph.node_attribute(p, 'planned_frame')
        closeup_snapshot = plane_to_compas_frame(closeup_plane)
        # closeup_snapshot = Frame(point=Point(x=0.390, y=-0.298, z=-0.325), xaxis=Vector(x=-0.471, y=-0.879, z=0.076), yaxis=Vector(x=0.570, y=-0.238, z=0.786))
        planned_snapshot_frame_WCF = closeup_snapshot.transformed(Transformation.from_frame(planned_frame_WCF))
        planned_snapshot_frame_WCF = planned_snapshot_frame_WCF.transformed(Rotation.from_axis_and_angle(planned_frame_WCF.zaxis, math.radians(0), planned_frame_WCF.point))

        target_planes.append(frame_to_rhino_plane(planned_snapshot_frame_WCF))
        tasks.append(CleanBricksTask(robot))
        tasks.append(MotionPlanExecutePose(robot, planned_snapshot_frame_WCF, frame_in_WCF=True))
        tasks.append(TriggerEstimationTask(robot, trigger=True, sleep=30))
        tasks.append(ScanSingleBrickTask(robot, assembly=building_structure, brick_key_to_update=p, frame_attribute=frame_attribute, average=False))
        tasks.append(TriggerEstimationTask(robot, trigger=False, sleep=0))


elif routine == "realignment":
    tasks = []
    tasks.append(AlignmentTask(robot, structure_assembly=building_structure, realignment=True))

elif routine == "correct_last":
    p = 7
    frame_attribute = "estimated_frame"
    planned_frame_WCF = building_structure.graph.node_attribute(p, 'planned_frame')
    closeup_snapshot = plane_to_compas_frame(closeup_plane)
    # closeup_snapshot = Frame(point=Point(x=0.390, y=-0.298, z=-0.325), xaxis=Vector(x=-0.471, y=-0.879, z=0.076), yaxis=Vector(x=0.570, y=-0.238, z=0.786))
    planned_snapshot_frame_WCF = closeup_snapshot.transformed(Transformation.from_frame(planned_frame_WCF))
    planned_snapshot_frame_WCF = planned_snapshot_frame_WCF.transformed(Rotation.from_axis_and_angle(planned_frame_WCF.zaxis, math.radians(0), planned_frame_WCF.point))
    # target_planes.append(frame_to_rhino_plane(planned_snapshot_frame_WCF))

    # tasks = [ChangeToolFrameTask(robot, "camera")]
    # tasks.append(CleanBricksTask(robot))
    # tasks.append(MotionPlanExecutePose(robot, planned_snapshot_frame_WCF, frame_in_WCF=True))
    # tasks.append(TriggerEstimationTask(robot, trigger=True, sleep=30))
    # tasks.append(ScanSingleBrickTask(robot, assembly=building_structure, brick_key_to_update=p, frame_attribute=frame_attribute, average=True))
    # tasks.append(TriggerEstimationTask(robot, trigger=False, sleep=0))

    ########

    pick_estimated_frame_BCF = building_structure.graph.node_attribute(p, 'estimated_frame_BCF').transformed(Translation.from_vector([0,0,0.04]))
    mid_estimated_frame_BCF = pick_estimated_frame_BCF.transformed(Translation.from_vector([0,0,0.04]))
    safe_pick_estimated_frame_BCF = pick_estimated_frame_BCF.transformed(Translation.from_vector([0,0,0.15]))

    target_planes.append(frame_to_rhino_plane(robot.from_BCF_to_WCF(safe_pick_estimated_frame_BCF)))
    target_planes.append(frame_to_rhino_plane(robot.from_BCF_to_WCF(pick_estimated_frame_BCF)))
    
    estimated_frame = building_structure.graph.node_attribute(p, 'estimated_frame')
    planned_frame = building_structure.graph.node_attribute(p, 'planned_frame')

    av_frame = average_frame(planned_frame, estimated_frame)
    # building_structure.part(p).frame = av_frame

    print(av_frame)
    place_planned_frame = av_frame.transformed(Translation.from_vector([0,0,0.04]))
    mid_place_planned_frame = place_planned_frame.transformed(Translation.from_vector([0,0,0.04]))
    safe_place_planned_frame = place_planned_frame.transformed(Translation.from_vector([0,0,0.15]))

    target_planes.append(frame_to_rhino_plane((safe_place_planned_frame)))
    target_planes.append(frame_to_rhino_plane((place_planned_frame)))

    # tasks = [ChangeToolFrameTask(robot, "gripper"),
    #             MotionPlanExecutePose(robot, safe_pick_estimated_frame_BCF, frame_in_WCF=False),
    #             GripperControlTask(robot, open_grip=True),
    #             MotionPlanExecutePose(robot, mid_estimated_frame_BCF, frame_in_WCF=False, tool_constraint=True),
    #             MotionPlanExecutePose(robot, pick_estimated_frame_BCF, frame_in_WCF=False, tool_constraint=True),
    #             GripperControlTask(robot, open_grip=False),
    #             MotionPlanExecutePose(robot, safe_pick_estimated_frame_BCF, frame_in_WCF=False, tool_constraint=True)]

    tasks = [ChangeToolFrameTask(robot, "gripper"),
                MotionPlanExecutePose(robot, safe_place_planned_frame, frame_in_WCF=True, tool_constraint=False),
                MotionPlanExecutePose(robot, mid_place_planned_frame, frame_in_WCF=True, tool_constraint=True),
                MotionPlanExecutePose(robot, place_planned_frame, frame_in_WCF=True, tool_constraint=True),
                GripperControlTask(robot, open_grip=True),
                MotionPlanExecutePose(robot, mid_place_planned_frame, frame_in_WCF=True, tool_constraint=True),
                MotionPlanExecutePose(robot, safe_place_planned_frame, frame_in_WCF=True, tool_constraint=True),
                GripperControlTask(robot, open_grip=False)]

elif routine == "attach_meshes":
    if material_stack is not None:
        material_stack_t = material_stack.transformed(robot.transformation_WCF_BCF())
        meshes = []
        mesh_ids = []
        frames = []
        for key in material_stack_t.part_keys():
            part_mesh = material_stack_t.part(key).mesh
            meshes.append(part_mesh)
            vertices = [part_mesh.vertex_coordinates(i) for i in part_mesh.vertices()]
            mesh_id = "brick_"+str(key)
            mesh_ids.append(mesh_id)
            frames.append(Frame.worldXY())
        tasks = [AddCollisionMeshes(robot, meshes, frames, mesh_ids, attached=False)]

    # if assemblies[0] is not None:
    #     stack_assembly = assemblies[0]
    #     t_stack_assembly = stack_assembly.transformed(robot.transformation_WCF_BCF())
    #     tasks = []
    #     for key in t_stack_assembly.part_keys():
    #         part_mesh = t_stack_assembly.part(key).mesh
    #         vertices = [part_mesh.vertex_coordinates(i) for i in part_mesh.vertices()]
    #         tasks.append(AddCollisionMesh(robot, mesh=part_mesh, mesh_id="brick_"+str(key), attached=False))
    # tasks = [AddCollisionMesh(robot, mesh = a_mesh, mesh_id="thing", attached=False)]
    # tasks = [RemoveCollisionMesh(robot, mesh_id="thing")]

#target_plane = frame_to_rhino_plane(frame_WCF)

print(tasks)
# ---------- end generate_tasks_2 ----------
# ----
# Draw assembly
start = Button()
stop = Button()
step = Button()
back = Button()
reset_3 = Button()
full = Button()
list_12 = ValueList({"20", "50", "100", "500", "1000", "5000"}, selected="500")
list_13 = ValueList({"show all": "show_all", "show until key": "show_until_key"}, selected="show all")
counter = Python3Script(
    my_assembly=transform_assembly.assembly,
    start=start,
    stop=stop,
    step=step,
    step_back=back,
    reset=reset_3,
    full=full,
    interval=list_12)  # -> out, counter
# ---------- counter: Python ----------
from scriptcontext import sticky as st
import Grasshopper

def update_component(ghenv, delay):
    """Schedule an update of the Grasshopper component.

    After the specified delay, the GH component will be automatically updated.

    Parameters
    ----------
    ghenv : :class:`GhPython.Component.PythonEnvironment`
        The current GHPython environment.
    delay : :obj:`int`
        Time in milliseconds until the update is performed.

    Raises
    ------
    ValueError
        If the delay is less than zero.

    """
    if delay <= 0:
        raise ValueError("Delay must be greater than zero")

    ghcomp = ghenv.Component
    ghdoc = ghcomp.OnPingDocument()

    def callback(ghdoc):
        if ghdoc.SolutionState != Grasshopper.Kernel.GH_ProcessStep.Process:
            ghcomp.ExpireSolution(False)

    ghdoc.ScheduleSolution(delay, Grasshopper.Kernel.GH_Document.GH_ScheduleDelegate(callback))

L = range(my_assembly.graph.number_of_nodes())

# store data in component
guid = str(ghenv.Component.InstanceGuid)
counter_key = "counter_" + guid
running_key = "running_" + guid

if counter_key not in st:
    st[counter_key] = 0

if running_key not in st:
    st[running_key] = False
    

if st[running_key]:
    if st[counter_key] < len(L) - 1:
        st[counter_key] += 1
        update_component(ghenv, interval)
    else:
        st[counter_key] = 0
        st[running_key] = False
    
if start:
    st[running_key] = True

if stop:
    st[running_key] = False

if step:
    if st[counter_key] < len(L) - 1:
        st[counter_key] += 1

if step_back:
    if st[counter_key] > 0:
        st[counter_key] -= 1

if reset:
    st[counter_key] = 0
    st[running_key] = False

if full:
    st[counter_key] = len(L)-1

if len(L):
    item = L[st[counter_key]]


#st["visualisation_counter"] = st[counter_key]
counter = st[counter_key] +1
# ---------- end counter ----------
visualize = Python3Script(
    assembly=transform_assembly.assembly,
    robot=robot,
    show=list_13,
    highlight_current_part=Toggle(False),
    show_connections=Toggle(False),
    counter=counter.counter,
    bang_2=bang)  # -> out, parts_built, parts_not_built, parts_anchor, parts_frame, parts_keys, connections, connection_types, current_part_geometry, current_part_frame; inputs bang_2: list
# ---------- visualize: Python ----------
from compas_rhino.conversions import mesh_to_rhino, box_to_rhino, frame_to_rhino, line_to_rhino, point_to_rhino
from compas.geometry import Line, Transformation, Point, Vector, Frame, Translation, Rotation
import numpy as np

# assembly.graph.node_attribute(17, "anchor", False)
# assembly.graph.delete_node(129)
#print assembly
print(assembly)
def update_neighbor_availability(assembly, part_key=None):
    updated_keys = []
    # Determine which parts to check
    part_keys = (
        assembly.graph.neighbors_out(part_key)
        if part_key is not None
        else assembly.part_keys()
    )
    for key in part_keys:
        below = assembly.graph.neighbors_in(key)
        below_built = all(
            bool(assembly.graph.node_attribute(n, "built")) for n in below
        )

        if below_built and not assembly.graph.node_attribute(key, "available"):
            assembly.graph.node_attribute(key, "available", True)
            updated_keys.append(key)
    return updated_keys

#get parts datastructure
parts_keys = [p for p in assembly.part_keys()]
parts = [assembly.part(p) for p in parts_keys]
parts_all = []
parts_built = []
parts_not_built = []
parts_anchor = []
parts_frame = []

parts_keys = [p for p in assembly.part_keys()]

# Building new anchor bricks:
# new_anchors = [8,9,10,11]
# for a in new_anchors:
#     assembly.graph.node_attribute(a, "anchor", False) 
# new_anchors = [14,15,16,17]
# for a in new_anchors:
#     assembly.graph.node_attribute(a, "built", True)
#     assembly.graph.node_attribute(a, "available", False)
#     assembly.graph.node_attribute(a, "anchor", True) 
#     update_neighbor_availability(assembly, a)


# second_parts = [t for t in parts_keys if assembly.graph.node_attribute(t, "second_estimated_frame_BCF") is not None]
# final_parts = [t for t in parts_keys if assembly.graph.node_attribute(t, "final_estimated_frame_BCF") is not None]
# shared_parts = [s for s in second_parts if s in final_parts]

# print(shared_parts)

# def assembly_to_frames_and_points(assembly, key_list=[], attribute=None):
#     frames = []
#     points = []
#     for key in key_list:
#         if attribute is None:
#             main_frame = assembly.part(key).frame
#         else:
#             main_frame = assembly.graph.node_attribute(key, attribute)
#         frames.append(main_frame)
#         points.append(main_frame.point)
#         corners = assembly.part(key).shape.points
#         for c in corners:
#             points.append(c.transformed(Transformation.from_frame(main_frame)))
#     return frames, points

# frames_src, points_src = assembly_to_frames_and_points(assembly, new_anchors, "anchor_estimated_frame")
# frames_tgt, points_tgt = assembly_to_frames_and_points(assembly, new_anchors, "planned_frame") 


# def slerp_quat(q1, q2, t):
#     q1 = q1 / np.linalg.norm(q1)
#     q2 = q2 / np.linalg.norm(q2)
#     dot = np.dot(q1, q2)
#     if dot < 0.0:
#         q2 = -q2
#         dot = -dot
#     if dot > 0.9995:
#         q = q1 + t * (q2 - q1)
#         return q / np.linalg.norm(q)
#     theta_0 = np.arccos(dot)
#     theta = theta_0 * t
#     q3 = q2 - q1 * dot
#     q3 = q3 / np.linalg.norm(q3)
#     return q1 * np.cos(theta) + q3 * np.sin(theta)

# def average_frame(frame_a, frame_b):
#     # --- Average position ---
#     p = Point(
#         0.5 * (frame_a.point.x + frame_b.point.x),
#         0.5 * (frame_a.point.y + frame_b.point.y),
#         0.5 * (frame_a.point.z + frame_b.point.z),
#     )

#     # --- Average orientation via SLERP ---
#     R_a = Rotation.from_frame(frame_a)
#     R_b = Rotation.from_frame(frame_b)

#     qa = np.array(R_a.quaternion)
#     qb = np.array(R_b.quaternion)

#     q_avg = slerp_quat(qa, qb, 0.5)
#     R_avg = Rotation.from_quaternion(q_avg)

#     # --- Build averaged frame ---
#     avg_frame = Frame.from_rotation(R_avg)
#     avg_frame.point = p
#     return avg_frame
# print(frames_src[0], frames_tgt[0])
# print(average_frame(frames_src[0], frames_tgt[0]))
# second_parts = [t for t in parts_keys if assembly.graph.node_attribute(t, "second_estimated_frame") is not None]
# print("Top parts:{}".format(second_parts))
# final_parts = [t for t in parts_keys if assembly.graph.node_attribute(t, "final_estimated_frame") is not None]
# print("Top parts:{}".format(final_parts))

# shared_parts = [s for s in second_parts if s in final_parts]
# print(shared_parts)
assembly.graph.node_attribute(11, "anchor", True)

if show == "show_all":
    for key in parts_keys:
        p = assembly.part(key)
        p_frame = p.frame
        planned_frame = assembly.graph.node_attribute(key, "planned_frame")
        # print(planned_frame)
        if assembly.graph.node_attribute(key, "anchor"):
            parts_anchor.append(mesh_to_rhino(p.mesh.transformed(Transformation.from_frame((p_frame)))))
        elif assembly.graph.node_attribute(key, "built"):
            parts_built.append(mesh_to_rhino(p.mesh.transformed(Transformation.from_frame((p_frame)))))
            parts_frame.append(frame_to_rhino(p_frame))
        
        elif planned_frame is not None:
            parts_not_built.append(mesh_to_rhino(p.mesh.transformed(Transformation.from_frame((planned_frame)))))
   
if show == "show_until_key":
    for p in parts[0:counter]:
        p_frame = p.frame
        
        if assembly.graph.node_attribute(p.key, "built"):
            parts_built.append(mesh_to_rhino(p.mesh.transformed(Transformation.from_frame((p_frame)))))
        else:
            parts_not_built.append(mesh_to_rhino(p.mesh.transformed(Transformation.from_frame((p_frame)))))

        parts_frame.append(frame_to_rhino(p_frame))

key = counter

if highlight_current_part:
    current_part = assembly.part(key)
    # print(current_part.shape)
    current_part_geometry = mesh_to_rhino(current_part.mesh)
    current_part_frame = frame_to_rhino(current_part.frame)

if show_connections:
    connections = [line_to_rhino(Line(assembly.find_by_key(start).frame).point, robot.from_RCF_to_BCF(assembly.find_by_key(end).frame).point) for start, end in assembly.graph.edges()]
    connection_types = [assembly.graph.edge_attribute(t, "type") for t in assembly.graph.edges()]
    #extract points of the frame of the parts for visulization (+ converted to rhino point)
    parts_points = [point_to_rhino(p.frame.point) for p in assembly.parts()]

parts_keys = [p for p in parts_keys if assembly.graph.node_attribute(p, "built")]
# print(parts_keys)
# top_parts = [
#     p for p in parts_keys
#     if all(
#         not assembly.graph.node_attribute(n, "built")
#         for n in assembly.graph.neighbors_out(p)
#     )
# ]
# print(top_parts)
# ---------- end visualize ----------
panel_17 = Panel(visualize.out)
geo_11 = Geometry(visualize.parts_built)
geo_12 = Geometry(visualize.parts_not_built)
geo_13 = Geometry(visualize.parts_frame)
line = Line(visualize.connections)
preview_12 = CustomPreview(Geometry=geo_11, Material=ColourSwatch(SwatchColor=RGBA(252, 45, 45, 216)))
preview_13 = CustomPreview(Geometry=geo_12, Material=ColourSwatch(SwatchColor=RGBA(242, 145, 145, 155)))
preview_14 = CustomPreview(Geometry=geo_13, Material=ColourSwatch(SwatchColor=RGB(214, 166, 71)))
curve_preview = CustomCurvePreview(Curve=line, Linetype="Continuous", Colour=ColourSwatch(SwatchColor=RGB(255, 125, 157)))
py3_5 = Python3Script(planes=visualize.parts_frame, scale=Slider(0.1, range=0..1))  # -> P, V, C, W; inputs planes: list of Plane, scale: Double
# ---------- py3_5: Python ----------
from Rhino.Display import ColorRGBA
from ghpythonlib.components import ColourRGBf


red = ColourRGBf(255, 255, 0, 0)
green = ColourRGBf(255, 0, 255, 0)
blue = ColourRGBf(255, 0, 0, 255)

P = []
V = []
C = []

# scale = float(scale)

for plane in planes:
    if not plane:
        continue
    P += [plane.Origin] * 3
    V.append(plane.XAxis * scale)
    V.append(plane.YAxis * scale)
    V.append(plane.ZAxis * scale)
    C += [red, green, blue]

W = 3
# ---------- end py3_5 ----------
tag = TextTag(Location=visualize.parts_frame, Text=visualize.parts_keys)
vdisex = VectorDisplayEx(Point=py3_5.P, Vector=py3_5.V, Colour=py3_5.C, Width=py3_5.W)

# ----
# Draw assembly
start_2 = Button()
stop_2 = Button()
step_2 = Button()
back_2 = Button()
reset_4 = Button()
full_2 = Button()
list_14 = ValueList({"20", "50", "100", "500", "1000", "5000"}, selected="500")
list_15 = ValueList({"show all": "show_all", "show until key": "show_until_key"}, selected="show all")
counter_2 = Python3Script(
    my_assembly=transform_assembly_2.assembly,
    start=start_2,
    stop=stop_2,
    step=step_2,
    step_back=back_2,
    reset=reset_4,
    full=full_2,
    interval=list_14)  # -> out, counter; same code as counter
visualize_2 = Python3Script(
    assembly=transform_assembly_2.assembly,
    robot=robot,
    show=list_15,
    highlight_current_part=Toggle(False),
    show_connections=Toggle(False),
    counter=counter_2.counter,
    bang_2=bang)  # -> out, parts_not_available, parts_available, parts_frame, parts_keys, connections, connection_types, current_part_geometry, current_part_frame; inputs bang_2: list
# ---------- visualize_2: Python ----------
from compas_rhino.conversions import mesh_to_rhino, box_to_rhino, frame_to_rhino, line_to_rhino, point_to_rhino
from compas.geometry import Line, Transformation, Point, Vector, Frame, Translation

print(assembly)

s = set([p for p in assembly.part_keys()])
i = 1
while i in s:
    i += 1
# assembly.graph.delete_node(74)

#for p in assembly.parts():
#    layer = round(robot.from_RCF_to_BCF(p.frame).point.z/0.08)-1
#    assembly.graph.node_attribute(p.key, "layer", layer)

#get parts datastructure
parts_keys = [p for p in assembly.part_keys()]
parts = [assembly.part(p) for p in parts_keys]
parts_all = []
parts_not_available = []
parts_available = []
parts_frame = []

if show == "show_all":
    for key in parts_keys:
        p = assembly.part(key)
        p_frame = p.frame
        print(p_frame)
        
        if assembly.graph.node_attribute(p.key, "available"):
            parts_available.append(mesh_to_rhino(p.mesh.transformed(Transformation.from_frame((p_frame)))))
            parts_frame.append(frame_to_rhino(p_frame))
        else:
            parts_not_available.append(mesh_to_rhino(p.mesh.transformed(Transformation.from_frame((p_frame)))))

        
   
if show == "show_until_key":
    for p in parts[0:counter]:
        # if robot is None:
        p_frame = p.frame
        # else:
        #     p_frame = robot.from_RCF_to_WCF(p.frame)
        
        if assembly.graph.node_attribute(p.key, "available"):
            parts_available.append(mesh_to_rhino(p.mesh.transformed(Transformation.from_frame((p_frame)))))
        else:
            parts_not_available.append(mesh_to_rhino(p.mesh.transformed(Transformation.from_frame((p_frame)))))

        parts_frame.append(frame_to_rhino(p_frame))

key = counter

if highlight_current_part:
    current_part = assembly.part(key)
    current_part_geometry = mesh_to_rhino(current_part.mesh)
    current_part_frame = frame_to_rhino(current_part.frame)

if show_connections:
    connections = [line_to_rhino(Line(assembly.find_by_key(start).frame).point, robot.from_RCF_to_BCF(assembly.find_by_key(end).frame).point) for start, end in assembly.graph.edges()]
    connection_types = [assembly.graph.edge_attribute(t, "type") for t in assembly.graph.edges()]
    #extract points of the frame of the parts for visulization (+ converted to rhino point)
    parts_points = [point_to_rhino(p.frame.point) for p in assembly.parts()]

parts_keys = [p for p in parts_keys if assembly.graph.node_attribute(p, "available")]
# ---------- end visualize_2 ----------
panel_18 = Panel(visualize_2.out)
geo_14 = Geometry(visualize_2.parts_not_available)
geo_15 = Geometry(visualize_2.parts_available)
geo_16 = Geometry(visualize_2.parts_frame)
line_2 = Line(visualize_2.connections)
preview_15 = CustomPreview(Geometry=geo_14, Material=ColourSwatch(SwatchColor=RGBA(242, 204, 255, 160)))
preview_16 = CustomPreview(Geometry=geo_15, Material=ColourSwatch(SwatchColor=RGBA(210, 83, 252, 216)))
preview_17 = CustomPreview(Geometry=geo_16, Material=ColourSwatch(SwatchColor=RGB(214, 166, 71)))
curve_preview_2 = CustomCurvePreview(Curve=line_2, Linetype="Continuous", Colour=ColourSwatch(SwatchColor=RGB(255, 125, 157)))
tag_2 = TextTag(Location=visualize_2.parts_frame, Text=visualize_2.parts_keys)
py3_6 = Python3Script(planes=visualize_2.parts_frame, scale=Slider(0.1, range=0..1))  # -> P, V, C, W; inputs planes: list of Plane, scale: Double; same code as py3_5
vdisex_2 = VectorDisplayEx(Point=py3_6.P, Vector=py3_6.V, Colour=py3_6.C, Width=py3_6.W)

# ----
# real robot values
unsubscribe_2 = Button()
unsubscribe_3 = Button()
subscribe_2 = Button()
subscribe_3 = Button()
get_isaac_joint_states = Python3Script(robot=robot, subscribe=subscribe_2, unsubscribe=unsubscribe_2)
# ---------- get_isaac_joint_states: Python ----------
def _receive_joint_states(message):
    print(message)
    for key, joint_name in enumerate(message.get("name")):
        robot.mobile_client.current_joint_values[joint_name] = message.get("position")[key]

def isaac_joint_states_subscribe(m):
    m.topic_subscribe(
        "/isaac_joint_states", "sensor_msgs/JointState", _receive_joint_states
    )

def isaac_joint_states_unsubscribe(m):
    m.topic_unsubscribe("/isaac_joint_states")

if subscribe:
    isaac_joint_states_subscribe(robot.mobile_client)

if unsubscribe:
    isaac_joint_states_unsubscribe(robot.mobile_client)
# ---------- end get_isaac_joint_states ----------
get_isaac_bcf = Python3Script(robot=robot, subscribe=subscribe_3, unsubscribe=unsubscribe_3)
# ---------- get_isaac_bcf: Python ----------
from compas.geometry import Point, Quaternion, Frame

def _receive_BCF(message):
    print(message)
    pose_point = Point(
            message["position"]["x"],
            message["position"]["y"],
            message["position"]["z"],
        )
    pose_quaternion = Quaternion(
        message["orientation"]["w"],
        message["orientation"]["x"],
        message["orientation"]["y"],
        message["orientation"]["z"],
    )
    BCF = Frame.from_quaternion(pose_quaternion, pose_point)
    robot.BCF = BCF

def isaac_BCF_subscribe(m):
    m.topic_subscribe(
        "/isaac_base_frame", "geometry_msgs/Pose", _receive_BCF
    )

def isaac_BCF_unsubscribe(m):
    m.topic_unsubscribe("/isaac_base_frame")

if subscribe:
    isaac_BCF_subscribe(robot.mobile_client)

if unsubscribe:
    isaac_BCF_unsubscribe(robot.mobile_client)

print(robot.BCF)

robot.mobile_client.topic_unsubscribe(
            "/robot/navigate_to_pose/_action/status")
{'position': {'x': -0.0001697540283203125, 'y': 0.025540828704833984, 'z': -2.2113323211669922e-05}, 'orientation': {'x': 3.620515724480997e-08, 'y': 9.80362316552591e-07, 'z': -1.5274385406631945e-05, 'w': 0.9999999998828654}}
# ---------- end get_isaac_bcf ----------
trigger_2 = Trigger(Interval=5000, TimerInterval=5000, Target=[draw, visualize, visualize_2])  # disabled
draw = Python3Script(robot=robot, bang=bang)  # -> configuration
# ---------- draw: Python ----------
from compas_robots import Configuration

configuration = robot.mobile_client.get_current_configuration()
print(configuration)
# ---------- end draw ----------

panel_19 = Panel(counter.counter)
panel_20 = Panel(counter_2.counter)
item = ListItem(List=visualize_2.current_part_frame, Index=0, Wrap=True)  # -> Item, Item1
pln_3 = Plane(item.Item1)
pln_4 = Plane(visualize.current_part_frame)
geo_17 = Geometry(visualize.parts_anchor)
preview_18 = CustomPreview(Geometry=geo_17, Material=ColourSwatch(SwatchColor=RGB(126, 92, 230)))

# ----
# Visualisation
filter = StreamFilter(
    Gate=list_6,
    Stream0=zero.configuration,
    Stream1=forward_kinematics,
    Stream2=analytic_inverse.configuration,
    Stream3=inverse.configuration,
    Stream5=draw)
show_collision = BooleanToggle(False)
show_eef = BooleanToggle(True)
show_frames = BooleanToggle(False)
show_visual = BooleanToggle(True)
show_attached_collision = BooleanToggle(False)
show_bcf = BooleanToggle(True)
visualise = Python3Script(
    robot=robot,
    configuration=filter,
    show_frames=show_frames,
    show_visual_meshes=show_visual,
    show_robot_collision_meshes=show_robot_collision,
    show_collision_meshes=show_collision,
    show_attached_collision_meshes=show_attached_collision,
    show_BCF=show_bcf,
    show_RCF=show_rcf,
    show_EEF=show_eef,
    bang=[set_frame, attach_tool.bang, collision_mesh.bang, attached_collision_mesh.bang])  # -> out, joint_planes, visual_meshes, robot_collision_meshes, collision_meshes, attached_meshes, BCF, RCF, EEF, EEF_in_RCF; inputs bang: list
# ---------- visualise: Python ----------
from scriptcontext import sticky as st
import time
from compas_ghpython import create_id
from compas.geometry import Frame
from compas.geometry import Transformation
from compas_rhino.conversions import frame_to_rhino, mesh_to_compas, mesh_to_rhino, frame_to_rhino_plane
from compas.scene import SceneObject
from compas_fab.robots import PlanningScene
import Rhino.Geometry as rg
import ghpythonlib.components as ghcomp

robot.update(configuration)
print(configuration)

if show_visual_meshes == True:
    visual_meshes = robot.draw_visual()
    # orient the robot to its base plane:
    robot_BCF = frame_to_rhino_plane(robot.BCF) 
    init_robot_plane = rg.Plane.WorldXY
    #visual_meshes = ghcomp.Orient(visual_meshes, init_robot_plane, robot_BCF)[0]

if show_frames == True: 
    joint_frames = robot.model.transformed_frames(configuration)
    joint_planes = [frame_to_rhino(a) for a in joint_frames]

if show_BCF:
    BCF = frame_to_rhino(robot.BCF)

if show_RCF:
    RCF = frame_to_rhino(robot.from_BCF_to_WCF(robot.RCF))
    # RCF = frame_to_rhino(robot.get_base_frame(group="ur10e"))
    # print(robot.get_base_link_name(group="ur10e"))

if show_EEF:
    # EEF_in_RCF = frame_to_rhino(robot.from_BCF_to_RCF(robot.forward_kinematics(
    #     configuration, options=dict())))
    EEF = frame_to_rhino(robot.from_BCF_to_WCF(robot.forward_kinematics(
        configuration, options=dict())))
    print(EEF)


if show_robot_collision_meshes == True:
    robot_collision_meshes = robot.draw_collision()

cached_scene_key = "cached_scene"

if show_collision_meshes or show_attached_collision_meshes:
    cached_scene = st.get(cached_scene_key)
    if not cached_scene:
        cached_scene = {"time": 0}

    update_scene = True

    if update_scene:
        scene = PlanningScene(robot)
        scene = robot.client.get_planning_scene()

    if update_scene and show_collision_meshes:
        collision_meshes = []

        for co in scene.world.collision_objects:
            print(co)
            header = co.header
            frame_id = header.frame_id
            cms = co.to_collision_meshes()

            for cm in cms:
                if cm.frame != Frame.worldXY():
                    t = Transformation.from_frame(cm.frame)
                    mesh = cm.mesh.transformed(t)
                else:
                    mesh = cm.mesh
                collision_meshes.extend(SceneObject(item=mesh).draw())

        cached_scene["cm"] = collision_meshes

        collision_meshes = cached_scene.get("cm", [])

    if update_scene and show_attached_collision_meshes:
        attached_meshes = []

        for aco in scene.robot_state.attached_collision_objects:
            for acm in aco.to_attached_collision_meshes():
                print(acm)
                frame_id = aco.object["header"]["frame_id"]
                frame = robot.forward_kinematics(configuration, options=dict(link=frame_id))
                t = Transformation.from_frame(frame)

                # Local CM frame
                if acm.collision_mesh.frame and acm.collision_mesh.frame != Frame.worldXY():
                    t = t * Transformation.from_frame(acm.collision_mesh.frame)

                mesh = acm.collision_mesh.mesh.transformed(t)

                attached_meshes.extend(SceneObject(item=mesh).draw())

        cached_scene["acm"] = attached_meshes

        attached_meshes = cached_scene.get("acm", [])
    
    cached_scene["time"] = time.time()
    st[cached_scene_key] = cached_scene
# ---------- end visualise ----------
pln_5 = Plane(visualise.joint_planes)
mesh_3 = Mesh(visualise.collision_meshes)
mesh_4 = Mesh(visualise.visual_meshes)
py3_7 = Python3Script(planes=[visualise.RCF, visualise.BCF], scale=Slider(0.2, range=0..1))  # -> P, V, C, W; inputs planes: list of Plane, scale: Double; same code as py3_5
orient = Orient(Geometry=mesh_4, Source=PlaneXY(0, 0, 0), Target=visualise.BCF)  # -> Geometry, Transform
vdisex_3 = VectorDisplayEx(Point=py3_7.P, Vector=py3_7.V, Colour=py3_7.C, Width=py3_7.W)

mesh_5 = Mesh(visualise.robot_collision_meshes)
mesh_6 = Mesh(visualise.attached_meshes)
pln_6 = Plane(visualise.RCF)
eef_in_rcf_5 = Plane(visualise.EEF_in_RCF)
eef = Plane(visualise.EEF)
mcol = MeshColours(Mesh=orient.Geometry, Colours=ColourSwatch(SwatchColor=RGB(160, 147, 199)))
mcol_2 = MeshColours(Mesh=orient.Geometry, Colours=ColourSwatch(SwatchColor=RGB(212, 140, 140)))
filter_2 = StreamFilter(Gate=list_7, Stream0=mcol, Stream1=mcol_2)

preview_19 = CustomPreview(Geometry=filter_2, Material=ColourSwatch(SwatchColor=RGB(61, 61, 61)))

delete = Button()
list_16 = ValueList({"0", "1", "2", "3", "4", "5"}, selected="0")
list_17 = ValueList({"0", "1", "2", "3", "4", "5", "6", "7", "8", "9", "10", "11"}, selected="0")
list_18 = ValueList({"a", "b", "c", "d"}, selected="a")
undo = Button()
pln_7 = Plane(visualise.EEF)

# ----
# Save tf poses
list_19 = ValueList({"camera frame": "camera_color_optical_frame", "robot base frame": "robot_arm_base", "robot odom": "robot_odom"}, selected="robot base frame")
list_20 = ValueList({"marker_0 frame": "marker_0", "marker_1 frame": "marker_1", "marker_4 frame": "marker_4", "brick_0 frame": "global_brick_0", "brick_1 frame": "global_brick_1", "brick_11 frame": "global_brick_11", "camera frame": "camera_color_optical_frame", "tool frame": "robot_arm_tool0"}, selected="brick_11 frame")
subscribe_4 = Button()
save = Button()
unsubscribe_4 = Button()
print = Button()
get_tf_frame = Python3Script(
    robot=robot,
    target_frame=list_20,
    reference_frame=list_19,
    subscribe=subscribe_4,
    save=save,
    unsubscribe=unsubscribe_4,
    delete=delete,
    print=print)  # -> out, frame_RCF
# ---------- get_tf_frame: Python ----------
from scriptcontext import sticky as st
from compas.geometry import Frame, Transformation

if not st.get("tf_poses"):
    st["tf_poses"] = {}

if subscribe:
    robot.mobile_client.tf_subscribe(target_frame, reference_frame)

if save:
    if robot.mobile_client.tf_frame is not None:
        st['tf_poses'][target_frame] = robot.mobile_client.tf_frame

if unsubscribe:
    if robot.mobile_client.tf_frame is not None:
        robot.mobile_client.clean_tf_frame()
    robot.mobile_client.tf_unsubscribe(target_frame, reference_frame)
    
if delete:
    st['tf_poses'].pop(target_frame)

print(robot.mobile_client.tf_frame)
print(st["tf_poses"])

if st['tf_poses'].get(target_frame):
    frame_BCF = st['tf_poses'][target_frame]
    frame_RCF = frame_BCF.transformed(robot.transformation_RCF_BCF())
    print(frame_BCF)
    print(frame_RCF)
# ---------- end get_tf_frame ----------
rec = DataRecorder(get_tf_frame.out, DataLimit=-10, RecordData=True)
panel_21 = Panel(rec)

pln_8 = Plane(visualise.EEF_in_RCF)

# ----
# Save ground truth
print_2 = Button()  # disabled
export_4 = Button()  # disabled
save_2 = Button()  # disabled
import_8 = Button()  # disabled
visualize_3 = Python3Script(robot=robot, import=import_8)  # -> out, points, surfaces, midpoints; disabled
# ---------- visualize_3: Python ----------
import os
import json
import time
from scriptcontext import sticky as st
from compas.geometry import Frame, Transformation, Point, Polygon
from compas.datastructures import Mesh
import compas

surfaces = []
midpoints = []

if not st.get('1st_ground_truth'):
    st['1st_ground_truth'] = {}

if import_:
    filename = "240902_collection.json"
    DATA = os.path.abspath(os.path.join(ghdoc.Path,"../../data/2nd_experiment/ground_truth"))
    PATH = os.path.join(DATA, filename)
    print(PATH)
    with open(PATH, 'r') as f:
        st['ground_truth'] = compas.data.json_load(f)


if st.get('1st_ground_truth'):
    for id, brick in st['1st_ground_truth'].items():
        print("brick", id, brick)
        if len(brick) == 4:
            top_outline = Polygon([brick["a"], brick["b"], brick["c"], brick["d"], brick["a"]])
            centroid = top_outline.centroid
            midpoints.append(centroid)
            top = Mesh.from_polygons([top_outline])
            surfaces.append(top)
# ---------- end visualize_3 ----------
ground_truth = Python3Script(
    brick_id=list_16,
    layer=list_17,
    corner=list_18,
    ee=pln_7,
    ee_rcf=pln_8,
    save=save_2,
    export=export_4,
    undo=undo,
    print=print_2)  # -> out, surfaces, midpoints, points; disabled
# ---------- ground_truth: Python ----------
import os
import json
import time
from scriptcontext import sticky as st
from compas.geometry import Frame, Transformation, Point, Polygon, Translation, Vector
from compas.datastructures import Mesh
import compas
from compas_rhino.conversions import point_to_rhino, mesh_to_rhino

surfaces = []
midpoints = []
points = []

brick_name = layer + "_" + brick_id

if not st.get('import_ground_truth'):
    st['import_ground_truth'] = {}

if save:
    if not st['import_ground_truth'].get(brick_name):
        st['import_ground_truth'][brick_name] = {}
    ee_point = Point(ee.Origin.X, ee.Origin.Y, ee.Origin.Z).transformed(Translation.from_vector(-Vector.Zaxis()*0.24))
    ee_rcf_point = Point(ee_rcf.Origin.X, ee_rcf.Origin.Y, ee_rcf.Origin.Z).transformed(Translation.from_vector(-Vector.Zaxis()*0.24))
    st['import_ground_truth'][brick_name][corner] = ee_point
    st['import_ground_truth'][brick_name][corner + "_rcf"] = ee_rcf_point

#if delete:
#    st['ground_truth'][brick_name].pop(corner)

if export:
    filename = "250220_2ndposition_tall_assembly_collection_final.json"
    DATA = os.path.abspath(os.path.join(ghdoc.Path,"../../data/2nd_experiment/ground_truth"))
    PATH = os.path.join(DATA, filename)
    with open(PATH, 'w') as f:
        compas.json_dump(st['import_ground_truth'], f)

if print_:
    print(st['import_ground_truth'])

if st.get('import_ground_truth'):
    for id, brick in st['import_ground_truth'].items():
        print("brick", id, brick)
        corners = ["a", "b", "c", "d"]
        for c in corners:
            if brick.get(c):
                points.append(point_to_rhino(brick.get(c)))
        if brick.get("a") and brick.get("b") and brick.get("c") and brick.get("d"):
            top_outline = Polygon([brick["a"], brick["b"], brick["c"], brick["d"], brick["a"]])
            centroid = top_outline.centroid
            midpoints.append(centroid)
            top = mesh_to_rhino(Mesh.from_polygons([top_outline]))
            surfaces.append(top)
# ---------- end ground_truth ----------
rec_2 = DataRecorder(ground_truth.out, DataLimit=-10, RecordData=True)  # disabled
panel_22 = Panel(ground_truth.out)  # disabled
toggle_12 = GroupToggle(ToggleActive=True, ToggleVisible=False)  # disabled

# ----
# Export gt to JSON for training
panel_23 = Panel("sep19_rb_21")
export_5 = Button()
to_camera_pose = Python3Script(frames=gt.frames, keys=gt.keys, camera_frame=visualise.EEF, file_name=panel_23, export=export_5)  # -> c_planes; inputs frames: list, keys: list
# ---------- to_camera_pose: Python ----------
import os
import compas
from compas.geometry import Transformation, Frame, Translation, Vector, Point
from compas_rhino.conversions import plane_to_compas_frame, frame_to_rhino_plane

# From BCF camera frame is EEF.

# From RCF:
#camera_frame = Frame(point=Point(x=0.42184179355066004, y=0.7699380733076026, z=0.6683429499195039), xaxis=Vector(x=-0.6070598544593553, y=-0.7946561014303535, z=0.00011646157466549403), yaxis=Vector(x=0.0002331367323027621, y=-0.0003246555531120529, z=-0.9999999201230148))
print(camera_frame)
#T = Transformation.from_frame(plane_to_compas_frame(camera_frame)).inverted()
T = Transformation.from_change_of_basis(Frame.worldXY(), plane_to_compas_frame(camera_frame))

c_planes = []
c_dict = {}

for i, key in enumerate(keys):
    central_frame = frames[i].transformed(Translation.from_vector(frames[i].zaxis*0.025))
    #central_frame = c_frame.transformed(Translation.from_vector([-0.23,-0.01,-0.0]))
    frame_in_camera = central_frame.transformed(T)
    c_dict["brick_" + key] = {"position" : {
                                "x" : frame_in_camera.point.x,
                                "y" : frame_in_camera.point.y,
                                "z" : frame_in_camera.point.z},
                                "orientation" : {
                                    "x" : frame_in_camera.quaternion.x,
                                    "y" : frame_in_camera.quaternion.y,
                                    "z" : frame_in_camera.quaternion.z,
                                    "w" : frame_in_camera.quaternion.w,
                                }}
    c_planes.append(frame_to_rhino_plane(frame_in_camera))

"""if extra_plane:
    c_frame = plane_to_compas_frame(extra_plane).transformed(Translation.from_vector(frames[i].zaxis*0.025))
    central_frame = c_frame.transformed(Translation.from_vector([-0.23,-0.01,-0.0]))
    frame_in_camera = central_frame.transformed(T)
    c_dict["brick_4_3"] = {"position" : {
                                "x" : frame_in_camera.point.x,
                                "y" : frame_in_camera.point.y,
                                "z" : frame_in_camera.point.z},
                                "orientation" : {
                                    "x" : frame_in_camera.quaternion.x,
                                    "y" : frame_in_camera.quaternion.y,
                                    "z" : frame_in_camera.quaternion.z,
                                    "w" : frame_in_camera.quaternion.w,
                                }}
    c_planes.append(frame_to_rhino_plane(central_frame))"""

filename = "240903_collection_to_camera_{}.json".format(file_name)
print(filename)
if _export:
    DATA = os.path.abspath(os.path.join(ghdoc.Path,"../../data/2nd_experiment/ground_truth"))
    PATH = os.path.join(DATA, filename)
    with open(PATH, 'w') as f:
        compas.json_dump(c_dict, f)
# ---------- end to_camera_pose ----------
