# Grasshopper definition Realsense_D435i_tools.ghx (Grasshopper 1.0.7)

reload = Button()

# ---- group: Click to create new .ply file, when camera connected
button = Button()

# ---- group: Name of the .ply file
list = ValueList({"frame_00.ply", "frame_01.ply", "frame_02.ply", "frame_03.ply", "frame_04.ply", "frame_05.ply", "frame_06.ply", "frame_07.ply", "frame_08.ply", "frame_09.ply"}, selected="frame_00.ply")

# ---- group: Click to create new .ply file, when camera connected
button_2 = Button()

# ---- group: Toggle true to read .ply file
toggle = BooleanToggle(True)

# ---- group: Change the path to your directory
data = GhPythonScript()  # -> data
# ---------- data: Python ----------
__author__ = "Gido"
__version__ = "2020.01.14"

import rhinoscriptsyntax as rs

# Path to directory containing .ply files
data = "C:\Users\Gido\Documents"
# ---------- end data ----------

# ----
py = PythonScript(reload=reload)
# ---------- py: Python ----------
if reload:
    from compas_ghpython import unload_modules
    unload_modules('compas')
    unload_modules("compas_fab")
    unload_modules("fabrication_control")
    unload_modules("ur_fabrication_control")
    unload_modules("mobile_fabrication_control")
    unload_modules("compas_rrc")
    unload_modules("extruder_control")
# ---------- end py ----------
realsense_d435i = GhPythonScript(data=data, file=list, create=button, stop=button_2, read=toggle)  # -> out, a, points
# ---------- realsense_d435i: Python ----------
__author__ = "Gido Dielemans"
__version__ = "2021.06.09"

import os
from scriptcontext import sticky as st
from compas_ghpython.utilities import draw_points
from compas.files import PLY
from compas.rpc import Proxy

# create filepath
filepath = os.path.join(data, file)

# create a new file using RPC
if create:
    if "realsense" in st:
        realsense = st["realsense"]
    else:
        realsense = Proxy()
        # Locate script to execute with RPC
        realsense.package = 'mobile_fabrication_control.sensors.realsense_d435i_methods'
        st["realsense"] = realsense
    # Execute method from script using the Proxy
    realsense.export_to_ply(filepath)

if stop:
    realsense = st["realsense"]
    realsense.stop_server()

# read the .ply file
if read:
    # check if there is a file with the name at the location
    assert os.path.isfile(filepath)
    # in case of an AssertionError please confirm the filepath and ensure the file is present
    
    # read the .ply file
    ply = PLY(filepath)
    ply.read()
    vertices = ply.reader.vertices
    points = []
    # convert vertices in points to draw using draw_points
    for i, v in enumerate(vertices):
        if i == 0:
            print v
        points.append({'pos': [v['x'],-v['z'],v['y']]})
    points = draw_points(points)
# ---------- end realsense_d435i ----------

# ---- group: Preview
list_2 = ValueList({"dist_color": 0, "black": 1}, selected="dist_color")
colorize = Colorize(B=realsense_d435i.points)
filter = StreamFilter(Gate=list_2, Stream0=colorize, Stream1=ColourSwatch(SwatchColor=RGB(0, 0, 0)))
preview = CustomPreview(Geometry=realsense_d435i.points, Material=filter)

# ==== cluster Colorize
B = ClusterInput()
xy = XYPlane(Origin=Point(0, 0, 0))
dist = Distance(PointA=xy, PointB=B)
sort = SortList(Keys=dist, ValuesA=dist)  # -> Keys, ValuesA
item = ListItem(List=sort.ValuesA, Index=0, Wrap=True)  # -> Item1, Item
gradient = Gradient(
    LowerLimit=0,
    UpperLimit=item.Item1,
    Parameter=dist,
    stops=[0: RGB(234, 38, 0), 0.25: RGB(234, 126, 0), 0.5: RGB(254, 244, 84), 0.75: RGB(173, 203, 249), 1: RGB(75, 107, 169)])
C = ClusterOutput(gradient)
