# Grasshopper definition RobArch_mobile_cart_planning_multi.ghx (Grasshopper 1.0.7)

reload = Button()
panel = Panel("Unload libraries")
py = PythonScript(reload=reload)
# ---------- py: Python ----------
from compas_ghpython import unload_modules

if reload:
    unload_modules("mobile_robot_control")
# ---------- end py ----------

panel_2 = Panel("192.168.0.42")
list = ValueList({"ur10e", "ur10e_and_liftkit"}, selected="ur10e")
py_2 = PythonScript()  # -> ENVIRONMENT_NAME, HERE, DATA
# ---------- py_2: Python ----------
import os
import compas_bootstrapper

HERE = os.path.dirname(ghdoc.Path)
DATA = os.path.abspath(os.path.join(HERE, "..", "data"))
ENVIRONMENT_NAME = compas_bootstrapper.ENVIRONMENT_NAME
print(HERE)
print(DATA)
print(ENVIRONMENT_NAME)
# ---------- end py_2 ----------
panel_3 = Panel(py_2.ENVIRONMENT_NAME)
list_2 = ValueList({"ur10e", "ur10e_and_liftkit"}, selected="ur10e")
pln = Plane(Plane(origin=(0.5360066186, 0.2927160602, 1.371717371), x=(1, 0, 0), y=(0, -1, 0)))
pln_2 = Plane(Plane(origin=(-0.554938422, 0, 1.87426929), x=(1, 0, 0), y=(0, -1, 0)))
panel_4 = Panel("fixed marker dict")
list_3 = ValueList({"ur10e", "ur10e_and_liftkit"}, selected="ur10e_and_liftkit")

# ----
# 1) Load robot from ROS
connect = BooleanToggle(True)
load_robot = BooleanToggle(True)

ros = COMPASFABROSConnect(port="9090", connect=connect)  # -> ros_client, is_connected; inputs port: Int32, connect: Boolean
#   port ip: The ip address ROS. Defaults to 127.0.0.1.
#   port port: The port of ROS. Defaults to 9090.
#   port connect: If True, connects to ROS. If False, disconnects from ROS. Defaults to False.
#   port ros_client: The ROS client.
#   port is_connected: True if connection established.
# ---------- ros: Python ----------
"""
Connect or disconnect to ROS.

COMPAS FAB v1.0.2
"""

from ghpythonlib.componentbase import executingcomponent as component
from scriptcontext import sticky as st

from compas_fab.backends import RosClient
from compas_fab.ghpython.components import create_id


class ROSConnect(component):
    def RunScript(self, ip, port, connect):
        ros_client = None

        ip = ip or "127.0.0.1"
        port = port or 9090

        key = create_id(self, "ros_client")
        ros_client = st.get(key, None)

        if ros_client:
            st[key].close()
        if connect:
            st[key] = RosClient(ip, port)
            st[key].run(5)

        ros_client = st.get(key, None)
        is_connected = ros_client.is_connected if ros_client else False
        return (ros_client, is_connected)
# ---------- end ros ----------

robot = COMPASFABROSRobot(ros_client=ros.ros_client, load=load_robot)  # -> robot; inputs load: Boolean
#   port ros_client: The ROS client.
#   port load: If True, loads the robot from ROS. Defaults to False.
# ---------- robot: Python ----------
"""
Load robot directly from ROS.

COMPAS FAB v1.0.2
"""
from mobile_robot_control.mobile_robot import MobileRobot
from mobile_robot_control.mobile_robot_client import MobileRobotClient

from compas.scene import SceneObject
from ghpythonlib.componentbase import executingcomponent as component
from scriptcontext import sticky as st

from compas_fab.ghpython.components import create_id


class ROSRobot(component):
    def RunScript(self, ros_client, load):
        key = create_id(self, "robot")

        if ros_client and ros_client.is_connected and load:
            # Load URDF from ROS
            st[key] = ros_client.load_robot(load_geometry=True, precision=12)
            st[key].scene_object = SceneObject(st[key].model)
            mobile_robot = MobileRobot(st[key].model, st[key].scene_object, st[key].semantics, client=None)
            st[key] = mobile_robot
            
        mobile_robot = st.get(key, None)
        if mobile_robot:  # client sometimes need to be restarted, without needing to reload geometry
            mobile_robot.mobile_client = MobileRobotClient(ros_client)
            mobile_robot.client = ros_client
        return mobile_robot
# ---------- end robot ----------
robot_2 = Data(robot)
info = PythonScript(robot=robot_2)  # -> out, main_group_name
# ---------- info: Python ----------
if robot:
    robot.info()
    main_group_name = robot.main_group_name
# ---------- end info ----------
panel_5 = Panel(info.out)

# ----
# 3) Set lift height & get real joint states
subscribe = Button()
unsubscribe = Button()
l = Slider(0.278, range=0..0.72)
joint_states = GhPythonScript(robot=robot_2, subscribe=subscribe, unsubscribe=unsubscribe)
# ---------- joint_states: Python ----------
def _receive_joint_states(message):
    for key, joint_name in enumerate(message.get('name')):
        robot.mobile_client.current_joint_values[joint_name] = message.get('position')[key]


if subscribe:
    robot.mobile_client.topic_subscribe('/joint_states', 'sensor_msgs/JointState', _receive_joint_states)

if unsubscribe:
    robot.mobile_client.topic_unsubscribe('/joint_states')
# ---------- end joint_states ----------
set_lift = PythonScript(robot=robot_2, lift=l)  # -> bang
# ---------- set_lift: Python ----------
if robot:
    robot.lift_height = lift
    print(robot.RCF)
# ---------- end set_lift ----------
trigger = Trigger(Interval=2000, TimerInterval=2000, Target=draw)  # disabled
draw = GhPythonScript(robot=robot_2, redraw=set_lift)  # -> configuration
# ---------- draw: Python ----------
from compas_fab.robots.robot import Configuration

def get_current_ur10e_and_liftkit_config(client):
        joint_names_ordered = ['shoulder_pan_joint', 'shoulder_lift_joint', 'elbow_joint', 'wrist_1_joint', 'wrist_2_joint', 'wrist_3_joint']
        print(robot.mobile_client.current_joint_values)
        joint_values_ordered = [client.current_joint_values.get(joint_name, 0.0) for joint_name in joint_names_ordered]
        joint_types_ordered = [0, 0, 0, 0, 0, 0]
        #joint_types_ordered = [2, 0, 0, 0, 0, 0, 0]
        return Configuration(joint_values_ordered, joint_types_ordered)

configuration = get_current_ur10e_and_liftkit_config(robot.mobile_client)

def add_lift_to_configuration(conf):
    joint_values = conf.joint_values
    joint_values_new = [robot.lift_height] + joint_values
    joint_types = conf.joint_types
    joint_types_new = [2] + joint_types
    return Configuration(joint_values_new, joint_types_new)
    
configuration = add_lift_to_configuration(configuration)

print configuration
# ---------- end draw ----------

# ----
# 5) Get base frame to a fixed marker
export = Button()
list_4 = ValueList({"pose_0", "pose_1", "pose_2", "pose_3"}, selected="pose_0")
list_5 = ValueList({"marker_0 frame": "marker_0", "marker_1 frame": "marker_1", "marker_2 frame": "marker_2", "marker_3 frame": "marker_3", "marker_5 frame": "marker_5"}, selected="marker_0 frame")
data = GhPythonScript()  # -> PATH
# ---------- data: Python ----------
import os
import ghpythonlib.components as ghcomp
import time

ghComp = ghenv.Component
ghDoc = ghComp.OnPingDocument()

# the full path of the gh file
path_gh_file = ghDoc.FilePath

# the directory of the gh file
HERE = os.path.dirname(path_gh_file)
DATA = os.path.join(HERE, '..', 'data', 'marker_frames')
PATH = os.path.join(DATA, 'markers.json')

print(PATH)
# ---------- end data ----------
subscribe_2 = Button()
unsubscribe_2 = Button()
clean = Button()
print = Button()
get_tf_marker_frame = GhPythonScript(
    robot=robot_2,
    robot_pose=list_4,
    target_frame=list_5,
    subscribe=subscribe_2,
    unsubscribe=unsubscribe_2,
    clean_all=clean,
    print=print,
    PATH=data,
    export=export)  # -> out, bang, dict
# ---------- get_tf_marker_frame: Python ----------
from compas.geometry import Point, Quaternion, Frame
import json

reference_frame = "base"

def _receive_marker_frame_callback(message):
    """Marker frames are added to the dictionary in reference to RCF."""
    pose_point = Point(message['translation']['x'], message['translation']['y'], message['translation']['z'])
    pose_quaternion = Quaternion(message['rotation']['w'], message['rotation']['x'], message['rotation']['y'], message['rotation']['z'])
    pose_frame = Frame.from_quaternion(pose_quaternion, pose_point)
    if not robot.mobile_client.marker_frames.get(robot_pose):
        robot.mobile_client.marker_frames[robot_pose] = {}
    robot.mobile_client.marker_frames[robot_pose][target_frame] = pose_frame
    print(pose_frame)
    
def _receive_averaged_marker_frame_callback(message):
    """Marker frames are added to the dictionary in reference to RCF."""
    pose_point = Point(message['translation']['x'], message['translation']['y'], message['translation']['z'])
    pose_quaternion = Quaternion(message['rotation']['w'], message['rotation']['x'], message['rotation']['y'], message['rotation']['z'])
    pose_frame = Frame.from_quaternion(pose_quaternion, pose_point)
    if not robot.mobile_client.marker_frames.get(robot_pose):
        robot.mobile_client.marker_frames[robot_pose] = {}
        if not robot.mobile_client.marker_frames[robot_pose].get(target_frame):
            robot.mobile_client.marker_frames[robot_pose][target_frame] = [] # list since we want to have multiple
    # 5 frames are received per marker and average is taken.
    if len(robot.mobile_client.marker_frames[robot_pose][target_frame]) < 5:
        robot.mobile_client.marker_frames[robot_pose][target_frame].append(pose_frame)
        print(pose_frame)
    #else:
        #robot.mobile_client.tf_unsubscribe(target_frame, reference_frame, _receive_averaged_marker_frame_callback)

if subscribe:
    robot.mobile_client.tf_subscribe(target_frame, reference_frame, _receive_marker_frame_callback)

if unsubscribe:
    robot.mobile_client.tf_unsubscribe(target_frame, reference_frame, _receive_marker_frame_callback)

if export:
    with open(PATH, "w") as outfile:
        marker_data = {}
        for pose, markers in robot.mobile_client.marker_frames.items():
            marker_data[pose] = {}
            for marker, frame in markers.items():
                marker_data[pose][marker] = frame.to_data()
        json.dump(marker_data, outfile)

if clean_all:
    robot.mobile_client.marker_frames = {}

dict = robot.mobile_client.marker_frames
    
print "tf_clients: ", robot.mobile_client.tf_clients
print robot.mobile_client.marker_frames
# ---------- end get_tf_marker_frame ----------
visualise_markers = GhPythonScript(robot=robot_2, robot_pose=list_4, redraw=get_tf_marker_frame.bang)  # -> out, markers; inputs redraw: list
# ---------- visualise_markers: Python ----------
from scriptcontext import sticky as st
from compas.geometry import Frame, Point, Vector, Rotation
from compas_ghpython import draw_frame
import math

markers = []
if robot.mobile_client.marker_frames.get(robot_pose):
    for marker, frame in robot.mobile_client.marker_frames[robot_pose].items():
        #markers.append(draw_frame(frame)) # without BCF transformation
        markers.append(draw_frame(frame.transformed(robot.transformation_RCF_BCF())))
print(markers)
# ---------- end visualise_markers ----------
rec = DataRecorder(get_tf_marker_frame.out, DataLimit=-10, RecordData=True)
panel_6 = Panel(rec)
list_6 = ValueList({"marker_0 frame": "marker_0", "marker_1 frame": "marker_1", "marker_2 frame": "marker_2", "marker_3 frame": "marker_3", "marker_5 frame": "marker_5"}, selected="marker_0 frame")
fixed_marker_plane = Plane(Plane(origin=(2, 1, 0), x=(0, -0.1240347346, 0.9922778767), y=(-1, 0, 0)))
regenerate_base_plane = GhPythonScript(robot=robot_2, robot_pose=list_4, fix_to_marker=list_6, fixed_marker_0_plane=fixed_marker_plane)  # -> out, base_plane
# ---------- regenerate_base_plane: Python ----------
from scriptcontext import sticky as st
from compas.geometry import Transformation, Frame, Point
from compas_rhino.conversions import frame_to_rhino_plane

# fixed_marker_plane = fixed_marker_planes[fix_to_marker]
fixed_marker_plane = fixed_marker_0_plane
fixed_marker_frame = Frame(fixed_marker_plane.Origin, fixed_marker_plane.XAxis, fixed_marker_plane.YAxis)

if robot.mobile_client.marker_frames.get(robot_pose):
    marker_pose = robot.mobile_client.marker_frames[robot_pose][fix_to_marker]
    
    MCF_in_RCF = marker_pose #measured MCF in RCF 
    MCF_in_BCF = MCF_in_RCF.transformed(robot.transformation_RCF_BCF()) #measured MCF in BCF
        
    BCF_in_MCF = Frame.from_transformation(Transformation.from_frame(MCF_in_BCF).inverted()) #BCF in measured MCF
        
    transformation_FMCF_WCF = Transformation.from_change_of_basis(fixed_marker_frame, Frame.worldXY()) #T from fixed MCF to WCF
    BCF_in_WCF = BCF_in_MCF.transformed(transformation_FMCF_WCF) #BCF in WCF
        
    print BCF_in_WCF
        
    #mean_base_frame = ...
    base_plane = frame_to_rhino_plane(BCF_in_WCF)
# ---------- end regenerate_base_plane ----------
pln_3 = Plane(regenerate_base_plane.base_plane)

pln_4 = Plane(visualise_markers.markers)

# ----
# 2) Attach tool and robot table
robot_3 = Data(robot_2)
mesh = Mesh(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)
coll_object = GhPythonScript(robot=robot_3, mesh=mesh)  # inputs mesh: Mesh
# ---------- coll_object: Python ----------
from compas_fab.robots import PlanningScene
from compas_fab.robots import CollisionMesh
from compas_rhino.conversions import mesh_to_compas

if robot:
    scene = PlanningScene(robot)
    mesh = mesh_to_compas(mesh)
    cm = CollisionMesh(mesh, "table")
    scene.add_collision_mesh(cm)
# ---------- end coll_object ----------
point = Point(Point(-2.401017388e-11, -1.002982373e-11, 0.1049999967))
vakkum_gripper = Mesh(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)

xy = XYPlane(Origin=point)

tool = COMPASFABAttachedTool(robot=robot_2, visual_mesh=vakkum_gripper, tcf_plane=xy, group=list)  # -> robot; inputs visual_mesh: Mesh, collision_mesh: Mesh
#   port visual_mesh: A visual mesh for the tool.
#   port collision_mesh: A collision mesh for the tool.
#   port tcf_plane: The frame of the tool in tool0 frame.
#   port group: The planning group to which the tool should be attached.
#   port connected_to: The link to which the tool should be connected to.
# ---------- tool: Python ----------
"""
Attach a tool to the robot.

COMPAS FAB v1.0.2
"""

from compas.geometry import Frame
from compas_rhino.conversions import mesh_to_compas
from compas_rhino.conversions import plane_to_compas_frame
from ghpythonlib.componentbase import executingcomponent as component

from compas_fab.robots import Tool


class AttachToolComponent(component):
    def RunScript(self, robot, visual_mesh, collision_mesh, tcf_plane, group, connected_to):
        if robot and robot.client and robot.client.is_connected and visual_mesh:
            if not collision_mesh:
                collision_mesh = visual_mesh

            c_visual_mesh = mesh_to_compas(visual_mesh)
            c_collision_mesh = mesh_to_compas(collision_mesh)

            if not tcf_plane:
                frame = Frame.worldXY()
            else:
                frame = plane_to_compas_frame(tcf_plane)
            tool = Tool(c_visual_mesh, frame, c_collision_mesh, connected_to=connected_to)

            robot.attach_tool(tool, group)

        return robot
# ---------- end tool ----------
robot_4 = Data(tool)

# ----
# 3) Move mobile cart base
angle = Slider(0, range=0..360)
set_to_origin = BooleanToggle(True)
base_origin = Point(Point(-0.2293511899, 0.7609134138, 0))
base_plane = GhPythonScript(origin=base_origin, angle=angle)  # -> base_plane; inputs origin: Point3d
# ---------- base_plane: Python ----------
import Rhino.Geometry as rg
import math

base_plane = rg.Plane(origin, rg.Vector3d.XAxis, rg.Vector3d.YAxis)
base_plane.Rotate(math.radians(angle), rg.Vector3d.ZAxis)
# ---------- end base_plane ----------
set_base_frame = PythonScript(robot=robot_4, set_to_origin=set_to_origin, base_plane=base_plane)  # -> bang
# ---------- set_base_frame: Python ----------
from compas_ghpython import draw_frame
from compas.geometry import Frame, Point, Vector, Transformation
from compas.datastructures import Mesh
from compas_fab.robots import CollisionMesh

if set_to_origin:
    base_frame = Frame.worldXY()
else:
    base_frame = Frame(base_plane.Origin, base_plane.XAxis, base_plane.YAxis)

# Base_frame is BCF in WCF
if robot:
    robot.BCF = base_frame
# ---------- end set_base_frame ----------

# ---- group: forward kinematics
# 4) Configuration
l_2 = Slider(0, range=0..0.72)
a1 = Slider(0, range=-360..360)
a2 = Slider(-90, range=-360..360)
a3 = Slider(90, range=-360..360)
a4 = Slider(-90, range=-360..360)
a5 = Slider(-90, range=-360..360)
a6 = Slider(0, range=-360..360)
jp = GhPythonScript()  # -> joint_positions
# ---------- jp: Python ----------
import math

joint_positions = [0,0,-90,90,0,90,0]
joint_positions = [math.radians(a) for a in joint_positions]
#joint_positions = [-3.136, -0.328, -1.218, 3.129, 0.852, 0.008]
#joint_positions = [0] * 6



#joint_positions = [1.6239667567485938, 0.25439606475392273, 4.409424838594969-2*3.14, 3.1901607306255908, 1.5707963267948954, 0.053170429953696939]
#joint_positions = [1.598543436748912, 0.23021224965157744, 4.712232135219824-2*3.14, 6.0531299026928744, 4.7123889803846915, 0.027747109954015234]
#joint_positions = [-1.1373533430447322, 4.0117247163121572, 5.4083762087596021-2*3.14, 1.5754733624925168, 4.7123889803846879, 3.5750356373399574]
print joint_positions
# ---------- end jp ----------
forward_kinematics = PythonScript(robot=robot_4, set_joint_positions=Button(), joint_positions=jp, lift=l_2, a1=a1, a2=a2, a3=a3, a4=a4, a5=a5, a6=a6)  # -> full_configuration; inputs joint_positions: list
# ---------- forward_kinematics: Python ----------
import math
import Grasshopper
from compas_fab.robots.robot import Joint
from compas_fab.robots.robot import Configuration

if set_joint_positions:
    j = 0
    for i in range(ghenv.Component.Params.Input.Count):
        nslider = ghenv.Component.Params.Input[i].Sources[0]
        if nslider.GetType() == Grasshopper.Kernel.Special.GH_NumberSlider:
            nslider.TrySetSliderValue(math.degrees(joint_positions[j]))
            j += 1

if robot:
    joints = robot.get_configurable_joints()
    joint_types = [joint.type for joint in joints]
    joint_names = [joint.name for joint in joints]
    
    joint_positions = [a1, a2, a3, a4, a5, a6]
    joint_positions = [math.radians(position) for position in joint_positions]
    
    if len(joints) == 7:
        joint_positions = [lift] + joint_positions
    
    print joint_types, joint_names, joint_positions
    full_configuration = Configuration(joint_positions, joint_types, joint_names)
    
print(full_configuration)
# ---------- end forward_kinematics ----------
ik = COMPASFABInverseKinematics(robot=robot_4, plane=pln, start_configuration=forward_kinematics, group=list_2)  # -> configuration
#   port plane: The plane or frame to calculate the inverse kinematic for.
#   port start_configuration: If passed, calculates the inverse such that the joint positions differ the least from the start_configuration. Defaults to the zero configuration.
#   port group: The planning group used for calculation. Defaults to the robot's main planning group.
#   port configuration: The planning group's configuration.
# ---------- ik: Python ----------
"""
Calculate the robot's inverse kinematic for a given plane.

COMPAS FAB v1.0.2
"""

from compas_rhino.conversions import plane_to_compas_frame
from ghpythonlib.componentbase import executingcomponent as component
from compas_fab.robots.robot import Configuration


class InverseKinematics(component):
    def RunScript(self, robot, plane, start_configuration, group):
        configuration = None
        if robot and robot.client and robot.client.is_connected and plane:
            frame = plane_to_compas_frame(plane)
            frame_BCS = frame.transformed(robot.transformation_WCF_BCF())
            
            configuration = robot.inverse_kinematics(frame_BCS, start_configuration, group)
        return configuration
# ---------- end ik ----------
zero_config = COMPASFABZeroConfig(robot=robot_4, group=list_2)  # -> config
#   port group: If assigned, it will return the zero configuration for the given group, otherwise a full zero configuration.
#   port config: The zero configuration.
# ---------- zero_config: Python ----------
"""
Get a zero configuration for a robot.

COMPAS FAB v1.0.2
"""

from ghpythonlib.componentbase import executingcomponent as component


class ConfigZero(component):
    def RunScript(self, robot, group):
        if robot:
            return robot.zero_configuration(group)
            

        return None
# ---------- end zero_config ----------

# ---- group: inverse kinematics
plane = Plane(Plane(origin=(1.107006312, -0.006907311816, 0.920639), x=(-0.04967065867, 0.998765651, -1.429441465e-06), y=(0.998765651, 0.04967065867, 6.432016809e-07)))  # disabled
analytic_inverse = PythonScript(robot=robot_4, lift=l_2, plane_WCS=plane, idx=0)  # -> out, configuration; inputs plane_WCS: Plane, idx: Int32, bang: list; disabled
# ---------- analytic_inverse: Python ----------
import Rhino.Geometry as rg
import math
from compas.geometry import Frame, Transformation, Rotation
from compas_fab.robots.robot import Configuration
from ur_fabrication_control.kinematics.ur_kinematics import inverse_kinematics
from ur_fabrication_control.kinematics.ur_params import ur_params
from compas_ghpython import draw_frame

robot.lift_height = lift

frame_WCS = Frame(plane_WCS.Origin, plane_WCS.XAxis, plane_WCS.YAxis)

# transform frame to robot coordinate system
frame_RCS = frame_WCS.transformed(robot.transformation_WCF_RCF())

if robot.attached_tool:
    tool0_RCS = robot.from_tcf_to_t0cf([frame_RCS])[0]
else:
    tool0_RCS = frame_RCS

plane_tool0_RCS = draw_frame(tool0_RCS)
plane_RCS = draw_frame(frame_RCS)

# calculate solutions to frame
ur_params = ur_params["ur10e"] # get the parameters according to the robot model
print ur_params
solutions = inverse_kinematics(tool0_RCS, ur_params)
print solutions

if not len(solutions):
    joint_values = [0, 0, 0, 0, 0, 0, 0]
    configuration = Configuration.from_revolute_values(joint_values)
else:
    joint_values = [lift] + solutions[idx]
    configuration = [Configuration.from_revolute_values(joint_values)]

print(configuration)
# ---------- end analytic_inverse ----------

# ----
# 4) Plan "free" motion
number_slider = Slider(1, range=1..360)
number_slider_2 = Slider(1, range=1..360)
number_slider_3 = Slider(1, range=1..360)
constraints_from_target_configuration = ConstraintsFromTargetConfiguration(robot=robot_4, target_configuration=ik, group=list_2)  # -> constraints
#   port target_configuration: The target configuration.
#   port tolerance_above: The tolerances above the targeted joint value of each configurable joint, defining the upper bound in radians/meters to be achieved.
#   port tolerance_below: The tolerances below the targeted joint value of each configurable joint, defining the lower bound in radians/meters to be achieved.
#   port group: The planning group for which we specify the constraint. Defaults to the robot's main planning group.
#   port constraints: A list joint constraints in radians/meters.
# ---------- constraints_from_target_configuration: Python ----------
"""
Create joint constraints for each of the robot's configurable joints based on a given target configuration.

COMPAS FAB v0.27.0
"""
import math

from ghpythonlib.componentbase import executingcomponent as component
from compas_fab.robots.robot import Configuration


class ConstraintsFromTargetConfiguration(component):
    
    DEFAULT_TOLERANCE_METERS = .001
    DEFAULT_TOLERANCE_RADIANS = math.radians(1)

    def RunScript(self, robot, target_configuration, tolerance_above, tolerance_below, group):
        if robot and target_configuration:
            if group == "ur10e_and_liftkit":
                target_configuration = Configuration.from_prismatic_and_revolute_values([0], target_configuration.joint_values[1::])
            else:
                target_configuration = Configuration.from_revolute_values(target_configuration.revolute_values)
            tolerance_above = tolerance_above or self._generate_default_tolerances(robot.get_configurable_joints(group))
            tolerance_below = tolerance_below or self._generate_default_tolerances(robot.get_configurable_joints(group))

            
            constraints = robot.constraints_from_configuration(
                configuration=target_configuration,
                tolerances_above=tolerance_above,
                tolerances_below=tolerance_below,
                group=group
            )

            return constraints

    def _generate_default_tolerances(self, joints):
        return [
            self.DEFAULT_TOLERANCE_METERS if j.is_scalable()
            else self.DEFAULT_TOLERANCE_RADIANS
            for j in joints
        ]
# ---------- end constraints_from_target_configuration ----------
plan_motion = PlanMotion(
    robot=robot_4,
    goal_constraints=constraints_from_target_configuration,
    start_configuration=forward_kinematics,
    group=list_2,
    compute=Button())  # -> trajectory; inputs goal_constraints: list, attached_collision_meshes: list, path_constraints: list, compute: Boolean
#   port goal_constraints: The goal to be achieved, defined in a set of constraints. Constraints can be very specific, for example defining value domains for each joint, such that the goal configuration is included, or defining a volume in space, to which a specific robot link (e.g. the end-effector) is required to move to.
#   port start_configuration: The robot's full configuration, i.e. values for all configurable joints of the entire robot, at the starting position. Defaults to the all-zero configuration.
#   port group: The planning group used for calculation. Defaults to the robot's main planning group.
#   port attached_collision_meshes: A list of attached collision meshes to be included for planning.
#   port path_constraints: Optional constraints that can be imposed along the solution path. Note that path calculation won't work if the start_configuration violates these constraints. Defaults to None.
#   port planner_id: The name of the algorithm used for path planning. Defaults to 'RRTConnect'
#   port compute: If True, calculates a trajectory.
#   port trajectory: The calculated trajectory.
# ---------- plan_motion: Python ----------
"""
Calculate a motion path.

COMPAS FAB v0.27.0
"""
from ghpythonlib.componentbase import executingcomponent as component
from scriptcontext import sticky as st
from compas_fab.robots import JointConstraint
from compas_fab.ghpython.components import create_id


class PlanMotion(component):
    def RunScript(self, robot, goal_constraints, start_configuration, group, attached_collision_meshes, path_constraints, planner_id, compute):

        key = create_id(self, 'trajectory')
        
        path_constraints = list(path_constraints) if path_constraints else None
        
        attached_collision_meshes = list(attached_collision_meshes) if attached_collision_meshes else None
        planner_id = str(planner_id) if planner_id else 'RRTConnect'
        
        if robot and robot.client and robot.client.is_connected and start_configuration and goal_constraints and compute:
            st[key] = robot.plan_motion(goal_constraints,
                                        start_configuration=start_configuration,
                                        group=group,
                                        options=dict(
                                            attached_collision_meshes=attached_collision_meshes,
                                            path_constraints=path_constraints,
                                            planner_id=planner_id,
                                        ))

        trajectory = st.get(key, None)
        return trajectory
# ---------- end plan_motion ----------

trajectory_visualize = COMPASFABTrajectoryVisualize(robot=robot_4, group=list_2, trajectory=plan_motion)  # -> start_configuration, configurations, fraction, time, planes, P, V, A
#   port group: The planning group for which this trajectory was planned.
#   port trajectory: The calculated trajectory.
#   port start_configuration: The start configuration of the trajectory.
#   port configurations: The full configurations along the trajectory.
#   port fraction: Indicates the fraction of requested trajectory that was calculated, e.g. 1 means the full trajectory was found.
#   port time: The time which is needed to execute that trajectory at full speed.
#   port planes: The planes of the robot's end-effector.
#   port P: The positions along the trajectory
#   port V: The velocities along the trajectory
#   port A: The accelerations along the trajectory
# ---------- trajectory_visualize: Python ----------
"""
Visualizes a trajectory.

COMPAS FAB v1.0.2
"""

from compas_rhino.conversions import frame_to_rhino_plane
from compas_ghpython.sets import list_to_ghtree
from ghpythonlib.componentbase import executingcomponent as component


class TrajectoryVisualize(component):
    def RunScript(self, robot, group, trajectory):
        start_configuration = None
        configurations = []
        fraction = 0.0
        time = 0.0

        planes = []
        positions = []
        velocities = []
        accelerations = []

        if robot and trajectory:
            group = group or robot.main_group_name

            for c in trajectory.points:
                configurations.append(
                    robot.merge_group_with_full_configuration(c, trajectory.start_configuration, group)
                )
                frame = robot.forward_kinematics(c, group, options=dict(solver="model"))
                planes.append(frame_to_rhino_plane(frame))
                positions.append(c.positions)
                velocities.append(c.velocities)
                accelerations.append(c.accelerations)

            start_configuration = trajectory.start_configuration
            fraction = trajectory.fraction
            time = trajectory.time_from_start

        P = list_to_ghtree(list(zip(*positions)))
        V = list_to_ghtree(list(zip(*velocities)))
        A = list_to_ghtree(list(zip(*accelerations)))

        # return outputs if you have them; here I try it for you:
        return (start_configuration, configurations, fraction, time, planes, P, V, A)
# ---------- end trajectory_visualize ----------
planes = Plane(trajectory_visualize.planes)

python = GhPythonScript(configurations=trajectory_visualize.configurations)  # -> first_configuration, last_configuration, reversed_free_motion_configurations; inputs configurations: list
# ---------- python: Python ----------
import rhinoscriptsyntax as rs

if configurations:
    first_configuration = configurations[0]
    last_configuration = configurations[-1]
    reversed_free_motion_configurations = configurations[::-1]
# ---------- end python ----------

# ----
# Select
# Config
configuration = Slider(9, range=0..100)
item = ListItem(List=trajectory_visualize.configurations, Index=configuration, Wrap=True)

# ----
# 5) Visualization
list_7 = ValueList({"0 zero_configuration": 0, "1 forward_kinematics": 1, "2 inverse_kinematics": 2, "3 free_motion": 3, "4 real_configuration": 4}, selected="4 real_configuration")
filter = StreamFilter(Gate=list_7, Stream0=zero_config, Stream1=forward_kinematics, Stream2=ik, Stream3=item, Stream4=draw)
robot_visualize = COMPASFABRobotVisualize(
    robot=robot_2,
    group=list_3,
    configuration=filter,
    show_visual=Toggle(True),
    show_collision=Toggle(False),
    show_frames=Toggle(False),
    show_base_frame=Toggle(True),
    show_robot_frame=Toggle(True),
    show_end_effector_frame=Toggle(False),
    show_cm=Toggle(False),
    show_acm=Toggle(False),
    show_robot_reach=Toggle(False),
    redraw=set_base_frame)  # -> visual, collision, collision_meshes, attached_meshes, frames, base_frame, robot_frame, ee_frame, robot_reach; inputs show_visual: Boolean, show_collision: Boolean, show_frames: Boolean, show_base_frame: Boolean, show_end_effector_frame: Boolean, show_cm: Boolean, show_acm: Boolean
#   port group: The planning group used for end-effector and base visualization.
#   port configuration: The robot's full configuration.
#   port show_visual: Whether or not to show the robot's visual meshes.
#   port show_collision: Whether or not to show the robot's collision meshes.
#   port show_frames: Whether or not to show the robot's joint frames.
#   port show_base_frame: Whether or not to show the robot's base frame.
#   port show_end_effector_frame: Whether or not to show the robot's end-effector frame.
#   port show_cm: Whether or not to show the collision meshes (if any).
#   port show_acm: Whether or not to show the attached collision meshes (if any).
#   port visual: Rhino meshes of the robot's visual geometry (if any).
#   port collision: Rhino meshes of the robot's collision geometry (if any).
#   port collision_meshes: Rhino meshes of the scene's collision meshes (if any).
#   port attached_meshes: Rhino meshes of the scene's attached collision meshes (if any).
#   port frames: The robot's joint frames as Rhino planes (if any).
#   port base_frame: The robot's base frame as a Rhino plane (if any).
#   port ee_frame: The robot's end-effector frame as a Rhino plane (if any).
# ---------- robot_visualize: Python ----------
"""
Visualizes the robot.

COMPAS FAB v1.0.2
"""

import time
import Rhino.Geometry as rg 
import ghpythonlib.components as ghcomp
from compas.geometry import Frame
from compas.geometry import Transformation
from compas.geometry import Sphere
from compas.scene import SceneObject
from compas_ghpython import create_id
from compas_rhino.conversions import frame_to_rhino_plane, sphere_to_rhino
from ghpythonlib.componentbase import executingcomponent as component
from scriptcontext import sticky as st

from compas_fab.backends import BackendFeatureNotSupportedError
from compas_fab.robots import PlanningScene


class RobotVisualize(component):
    def RunScript(
        self,
        robot,
        group,
        configuration,
        show_visual,
        show_collision,
        show_frames,
        show_base_frame,
        show_robot_frame,
        show_end_effector_frame,
        show_cm,
        show_acm,
        show_robot_reach,
        redraw
    ):
        visual = None
        collision = None
        collision_meshes = None
        attached_meshes = None
        frames = None
        base_frame = None
        ee_frame = None
        robot_reach = None

        if robot:
            show_visual = True if show_visual is None else show_visual
            show_cm = True if show_cm is None else show_cm
            show_acm = True if show_acm is None else show_acm
            configuration = configuration or robot.zero_configuration()

            robot.update(configuration, visual=show_visual, collision=show_collision)
            compas_frames = robot.transformed_frames(configuration, group)

            if show_visual:
                visual = robot.scene_object.draw_visual()

            if show_visual:
                visual = robot.scene_object.draw_visual()
                # orient the robot to its base plane:
                robot_BCF = frame_to_rhino_plane(robot.BCF) 
                init_robot_plane = rg.Plane.WorldXY
                visual = ghcomp.Orient(visual, init_robot_plane, robot_BCF)[0]
                picking_frame = robot.to_world_coordinates(robot.PCF)
                
            if show_collision:
                collision = robot.scene_object.draw_collision()

            if show_base_frame:
                base_frame = compas_frames[0]
                base_frame = robot.BCF
                
            if show_robot_frame:
                base_frame = robot.RCF

            if show_end_effector_frame:
                options = dict(solver="model")
                if robot.attached_tool:
                    options["link"] = robot.attached_tool.connected_to

                ee_compas_frame = robot.forward_kinematics(configuration, group, options=options)
                ee_frame = frame_to_rhino_plane(ee_compas_frame)

            if show_frames:
                frames = []
                for compas_frame in compas_frames[1:]:
                    frame = frame_to_rhino_plane(compas_frame)
                    frames.append(frame)

            cached_scene_key = create_id(self, "cached_scene")
            
            if show_robot_reach:
                base_frame = compas_frames[0]
                geo_origin = Frame([base_frame.point.x, base_frame.point.y, base_frame.point.z+0.152], base_frame.xaxis, base_frame.yaxis)
                geo = Sphere.from_point_and_radius(geo_origin.point, 0.5)
                robot_reach = sphere_to_rhino(geo)

            if show_cm or show_acm:
                cached_scene = st.get(cached_scene_key)
                if not cached_scene:
                    cached_scene = {"time": 0}

                # expire cache if the component has not been executed in the last 2 seconds
                # this allows to slide through a list of configurations
                # without triggering refreshes of the scene in the middle of it
                if time.time() - cached_scene["time"] > 2:
                    update_scene = True
                else:
                    update_scene = False

                if update_scene:
                    scene = PlanningScene(robot)
                    try:
                        scene = robot.client.get_planning_scene()
                    except BackendFeatureNotSupportedError:
                        print(
                            "The selected backend does not support collision meshes. If you need collision mesh support, use a different backend."
                        )
                        scene = None
                        show_cm = False
                        show_acm = False

                if update_scene and show_cm:
                    collision_meshes = []

                    for co in scene.world.collision_objects:
                        header = co.header
                        frame_id = header.frame_id
                        cms = co.to_collision_meshes()

                        for cm in cms:
                            if cm.frame != Frame.worldXY():
                                t = Transformation.from_frame(cm.frame)
                                mesh = cm.mesh.transformed(t)
                            else:
                                mesh = cm.mesh

                            collision_meshes.extend(SceneObject(mesh).draw())

                        cached_scene["cm"] = collision_meshes

                collision_meshes = cached_scene.get("cm", [])

                if update_scene and show_acm:
                    attached_meshes = []

                    for aco in scene.robot_state.attached_collision_objects:
                        for acm in aco.to_attached_collision_meshes():
                            frame_id = aco.object["header"]["frame_id"]
                            frame = robot.forward_kinematics(configuration, options=dict(link=frame_id))
                            t = Transformation.from_frame(frame)

                            # Local CM frame
                            if acm.collision_mesh.frame and acm.collision_mesh.frame != Frame.worldXY():
                                t = t * Transformation.from_frame(acm.collision_mesh.frame)

                            mesh = acm.collision_mesh.mesh.transformed(t)

                            attached_meshes.extend(SceneObject(mesh).draw())

                    cached_scene["acm"] = attached_meshes

                attached_meshes = cached_scene.get("acm", [])

                cached_scene["time"] = time.time()
                st[cached_scene_key] = cached_scene

        return (
            visual,
            collision,
            collision_meshes,
            attached_meshes,
            frames,
            base_frame,
            ee_frame,
            robot_reach,
        )
# ---------- end robot_visualize ----------
mesh_2 = Mesh(robot_visualize.visual)
mesh_3 = Mesh(robot_visualize.collision_meshes)
geo = Geometry(robot_visualize.robot_reach)
draw_2 = GhPythonScript(frames=[robot_visualize.robot_frame, robot_visualize.base_frame], scale=Slider(0.1, range=0..1))  # -> P, V, C, W; inputs frames: list
# ---------- draw_2: Python ----------
from System.Drawing import Color
from compas_ghpython.utilities import draw_frame

red = Color.FromArgb(255, 0, 0)
green = Color.FromArgb(0, 255, 0)
blue = Color.FromArgb(0, 0, 255)

P = []
V = []
C = []

scale = float(scale)

for frame in frames:
    if not frame:
        continue
    plane = draw_frame(frame)
    P += [plane.Origin] * 3
    V.append(plane.XAxis * scale)
    V.append(plane.YAxis * scale)
    V.append(plane.ZAxis * scale)
    C += [red, green, blue]

W = 3
# ---------- end draw_2 ----------
vdisex = VectorDisplayEx(Point=draw_2.P, Vector=draw_2.V, Colour=draw_2.C, Width=draw_2.W)
