# Grasshopper definition RobArch_marker_tracking.ghx (Grasshopper 1.0.7)

reload = Button()
panel = Panel("Unload libraries")
py = PythonScript(reload=reload)
# ---------- py: Python ----------
from compas_ghpython import unload_modules

if reload:
    unload_modules("compas")
    unload_modules("compas_fab")
    unload_modules("roslibpy")
    unload_modules("fabrication_control")
    unload_modules("assembly_information_model")
    unload_modules("am_information_model")
    unload_modules("ur_fabrication_control")
    unload_modules("mobile_robot_control")
    unload_modules("extruder_control")
# ---------- end py ----------

# ----
# Planning scene
scene = PlanningScene()  # -> scene
#   port scene: A planning scene.
# ---------- scene: Python ----------
"""
Create a planning scene.

COMPAS FAB v0.27.0
"""
from ghpythonlib.componentbase import executingcomponent as component
from scriptcontext import sticky as st

from compas_fab.ghpython.components import create_id
from compas_fab.robots import PlanningScene


class PlanningSceneComponent(component):
    def RunScript(self, robot):
        key = create_id(self, 'planning_scene')
        if robot:
            st[key] = PlanningScene(robot)
        return st.get(key, None)
# ---------- end scene ----------

# ----
# ROS client
list = ValueList({"local": "127.0.0.1", "linux computer": "192.168.0.42", "linux workstation": "192.168.0.88", "linux eduroam": "10.181.95.254", "robot": "192.168.0.200"}, selected="linux workstation")
connect = BooleanToggle(True)
ros = ROSConnect(ip=list, port="9090", connect=connect)  # -> ros_client, is_connected; inputs port: Int32, connect: Boolean
#   port ip: The ip address ROS. Defaults to 127.0.0.1.
#   port port: The port of ROS. Defaults to 9090.
#   port connect: If True, connects to ROS. If False, disconnects from ROS. Defaults to False.
#   port ros_client: The ROS client.
#   port is_connected: True if connection established.
# ---------- ros: Python ----------
"""
Connect or disconnect to ROS.

COMPAS FAB v0.27.0
"""
from ghpythonlib.componentbase import executingcomponent as component
from scriptcontext import sticky as st

from compas_fab.backends import RosClient
from compas_fab.ghpython.components import create_id


class ROSConnect(component):
    def RunScript(self, ip, port, connect):
        ros_client = None

        ip = ip or '127.0.0.1'
        port = port or 9090

        key = create_id(self, 'ros_client')
        ros_client = st.get(key, None)

        if ros_client:
            st[key].close()
        if connect:
            st[key] = RosClient(ip, port)
            st[key].run(5)

        ros_client = st.get(key, None)
        is_connected = ros_client.is_connected if ros_client else False
        return (ros_client, is_connected)
# ---------- end ros ----------
panel_2 = Panel(ros.is_connected)

connect_2 = Button()

# ----
# Load robot from ROS
# Load robot from ROS
load = Button()
robot = ROSRobot(ros_client=ros.ros_client, load=load, connect=connect_2)  # -> out, mobile_robot; inputs load: Boolean
#   port ros_client: The ROS client.
#   port load: If True, loads the robot from ROS. Defaults to False.
# ---------- robot: Python ----------
"""
Load robot directly from ROS.

COMPAS FAB v0.27.0
"""
from mobile_robot_control.mobile_robot import MobileRobot
from mobile_robot_control.mobile_robot_client import MobileRobotClient

from compas_ghpython.artists import RobotModelArtist
from ghpythonlib.componentbase import executingcomponent as component
from scriptcontext import sticky as st

from compas_fab.ghpython.components import create_id


class ROSRobot(component):
    def RunScript(self, ros_client, prefix, load, connect):
        key = create_id(self, 'robot')

        if ros_client and ros_client.is_connected and load:
            # Load URDF from ROS
            robot = ros_client.load_robot(
                    load_geometry=True, 
                    urdf_param_name= '{}/robot_description'.format(prefix),
                    srdf_param_name= '{}/robot_description_semantic'.format(prefix),
                    precision='12f')
            robot.artist = RobotModelArtist(robot.model)
            mobile_robot = MobileRobot(model=robot.model, artist=robot.artist, semantics=robot.semantics, client=None)
            st[key] = mobile_robot
        
        if ros_client and ros_client.is_connected and connect:
            # client sometimes need to be restarted, without needing to reload geometry
            mobile_robot = st.get(key, None)
            if mobile_robot:  
                mobile_robot.mobile_client = MobileRobotClient(ros_client)
                mobile_robot.client = ros_client
        
        mobile_robot = st.get(key, None)
        return mobile_robot
# ---------- end robot ----------

rec = DataRecorder(robot.out, DataLimit=-10, RecordData=True)
panel_3 = Panel(rec)
set_to_origin = BooleanToggle(True)

# ----
# Attach to robot
remove = Button()
add = Button()
mesh = Mesh(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)
acm = AttachedCollisionMesh(
    scene=scene,
    mesh=mesh,
    identifier="elem",
    link_name="robot_arm_tool0",
    touch_links="robot_arm_tool0",
    add=add,
    remove=remove)  # -> attached_collision_mesh, bang; inputs mesh: Mesh, touch_links: list, add: Boolean, remove: Boolean
#   port scene: The planning scene.
#   port mesh: A collision mesh.
#   port identifier: The identifier of the collision mesh.
#   port link_name: The robot's link name to attach the mesh to.
#   port touch_links: Names of links that the robot is allowed to touch.
#   port add: If True, adds the collision mesh to the planning scene.
#   port remove: If True, removes the collision mesh from the planning scene.
#   port attached_collision_mesh: A collision mesh that is attached to a robot's link.
# ---------- acm: Python ----------
"""
Add an attached collision mesh to the robot.

COMPAS FAB v0.27.0
"""
from ghpythonlib.componentbase import executingcomponent as component

from compas_rhino.geometry import RhinoMesh
from compas_fab.robots import AttachedCollisionMesh
from compas_fab.robots import CollisionMesh

class AttachedCollisionMeshComponent(component):
    def RunScript(self, scene, mesh, identifier, link_name, touch_links, add, remove):
        attached_collision_mesh = None
        if scene and mesh and identifier and link_name:
            compas_mesh = RhinoMesh.from_geometry(mesh).to_compas()
            collision_mesh = CollisionMesh(compas_mesh, identifier)
            attached_collision_mesh = AttachedCollisionMesh(collision_mesh, link_name, touch_links)
            if add:
                scene.add_attached_collision_mesh(attached_collision_mesh)
            if remove:
                scene.remove_attached_collision_mesh(identifier)
                scene.remove_collision_mesh(identifier)
        return attached_collision_mesh
# ---------- end acm ----------

pln = Plane(Plane(origin=(0.4693641851, -0.4918458652, -0.5227422856), x=(0.87787645, 0.4546760905, 0.1503415821), y=(0.4721904909, -0.8741561698, -0.1135215011)))
robot_2 = Data(robot.mobile_robot)

# ----
# Attach tool
list_2 = ValueList({"measurement_tool": 0, "clay_extruder_7mm": 1, "area_gripper": 2, "area_gripper_435i": 3}, selected="measurement_tool")
show = BooleanToggle(True)
py_2 = PythonScript()  # -> DATA
# ---------- py_2: Python ----------
import os

#package_path = os.path.dirname(mobile_fabrication_control.__file__)
#DATA = os.path.abspath(os.path.join(package_path,"../../data"))

package_path = ghdoc.Path
# package_path = os.path.dirname(ur_fabrication_control.__file__)
#DATA = os.path.abspath(os.path.join(package_path,"../../data"))

# .stl files not stored in am_hackathon repo. but in mobile_fabrication_control
DATA = os.path.abspath(os.path.join(package_path,"../../../mobile_robot_control/data"))

print(package_path)
print(DATA)
# ---------- end py_2 ----------
tool = PythonScript(data_path=py_2, tool=list_2, show=show)  # -> tool, M, ee_plane
# ---------- tool: Python ----------
import os, math
from compas.geometry import Frame, Rotation
from compas.datastructures import Mesh
from compas_ghpython.artists import MeshArtist
from compas_fab.robots import Tool
from compas_ghpython.utilities import draw_frame

tolerance = 0

if tool == 0:
    filename = 'measurement_tool_zaxis.stl'
    ee_frame = Frame([0, 0, 0.109], [1, 0, 0], [0, 1, 0])

elif tool == 1:
    filename = 'clay_extruder_7mm.stl'
    # real frame:
    ee_frame = Frame([-0.000502, -0.105348, 0.0662,], [1, 0, 0], [0, 0, 1])
    
    # test frame:
    # ee_frame = Frame([0.0, 0.0, 0.1,], [1, 0, 0], [0, 1, 0])

elif tool == 2:
    filename = 'area_gripper_zaxis.stl'
    ee_frame = Frame([0, 0, 0.10219 + tolerance], [0, 1, 0], [-1, 0, 0])

elif tool == 3:
    filename = 'area_gripper_d435i_zaxis.stl'
    ee_frame = Frame([0, 0, 0.10219 + tolerance], [0, 1, 0], [-1, 0, 0])
#    ee_frame = Frame([0.054, 0, 0.065 + tolerance], [0, 1, 0], [-1, 0, 0])

data_path = os.path.join(data_path, "tool_geometry")
fullfilename = os.path.join(data_path, filename)
print fullfilename

ee_mesh = Mesh.from_stl(fullfilename)

if show:
    artist = MeshArtist(ee_mesh)
    M = artist.draw()

tool = Tool(ee_mesh, ee_frame)
ee_plane = draw_frame(ee_frame)
print(ee_frame.quaternion.xyzw)
ee_framek = Frame([0.0110607,0.00809854,0.41498], [0,1,0], [1,0,0])
print(ee_framek.quaternion.xyzw)
# ---------- end tool ----------
panel_4 = Panel("Attach a custom tool")
remove_2 = Button()
add_2 = Button()
attach_remove = PythonScript(robot=robot_2, tool=tool.tool, attach=add_2, remove=remove_2)  # -> out, bang
# ---------- attach_remove: Python ----------
if attach:
    robot.attach_tool(tool)
if remove:
    robot.detach_tool()
# ---------- end attach_remove ----------

# ----
# Move mobile robot base
angle = Slider(0, range=0..360)
base_origin = Point(Point(1, -1, 0))
base_plane = GhPythonScript(origin=base_origin, angle=angle)  # -> base_plane; inputs origin: Point3d
# ---------- base_plane: Python ----------
import Rhino.Geometry as rg
import math

base_plane = rg.Plane(origin, rg.Vector3d.XAxis, rg.Vector3d.YAxis)
base_plane.Rotate(math.radians(angle), rg.Vector3d.ZAxis)
# ---------- end base_plane ----------
set_base_frame = PythonScript(robot=robot_2, set_to_origin=set_to_origin, base_plane=base_plane)  # -> bang
# ---------- set_base_frame: Python ----------
from compas_ghpython import draw_frame
from compas.geometry import Frame, Point, Vector, Transformation
from compas.datastructures import Mesh
from compas_rhino.geometry import RhinoMesh
from compas_fab.robots import CollisionMesh

if set_to_origin:
    base_frame = Frame.worldXY()
else:
    base_frame = Frame(base_plane.Origin, base_plane.XAxis, base_plane.YAxis)


# Base_frame is BCF in WCF
if robot:
    robot.BCF = base_frame
    print(robot.BCF)
# ---------- end set_base_frame ----------

# ----
# Attach to scene
add_3 = Button()
remove_3 = Button()
mesh_2 = Mesh(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)
cm = CollisionMesh(scene=scene, mesh=mesh_2, identifier="scene_elem", add=add_3, append=set_base_frame, remove=remove_3)  # -> ok, bang; inputs mesh: Mesh, add: Boolean, append: Boolean, remove: Boolean
#   port scene: The planning scene.
#   port mesh: A collision mesh.
#   port identifier: The identifier of the collision mesh.
#   port add: If True, adds the collision mesh to the planning scene.
#   port append: If True, appends the collision mesh to the planning scene.
#   port remove: If True, removes the collision mesh from the planning scene.
#   port ok: True if the operation was successfully performed.
# ---------- cm: Python ----------
"""
Add or remove a collision mesh from the planning scene.

COMPAS FAB v0.27.0
"""
from compas_rhino.geometry import RhinoMesh
from ghpythonlib.componentbase import executingcomponent as component

from compas_fab.robots import CollisionMesh


class CollisionMeshComponent(component):
    def RunScript(self, scene, M, name, add, append, remove):
        ok = False
        self.Message = ""

        if (add and append) or (append and remove) or (add and remove):
            self.Message = "Use only one operation at a time\n(add, append or remove)"
            raise Exception(self.Message)

        if scene and M and name:
            mesh_WCS = RhinoMesh.from_geometry(M).to_compas()
            # transform to mobile robot base coordinate system
            mesh = mesh_WCS.transformed(scene.robot.transformation_WCF_BCF())
            collision_mesh = CollisionMesh(mesh, name)
            if add:
                scene.add_collision_mesh(collision_mesh)
                self.Message = "Added"
                ok = True
            if append:
                scene.append_collision_mesh(collision_mesh)
                self.Message = "Appended"
                ok = True
            if remove:
                scene.remove_collision_mesh(name)
                self.Message = "Removed"
                ok = True
        return ok
# ---------- end cm ----------
panel_5 = Panel(cm.ok)

# ----
# Set lift height / RCF
l = Slider(0, range=0..0.72)
set_lift = PythonScript(robot=robot_2, lift=l)  # -> bang
# ---------- set_lift: Python ----------
from compas_ghpython import draw_frame
from compas.geometry import Frame, Point, Vector, Transformation
from compas.datastructures import Mesh
from compas_rhino.geometry import RhinoMesh
from compas_fab.robots import CollisionMesh


if robot:
    robot.lift_height = lift
    print(robot.RCF)
# ---------- end set_lift ----------

info = PythonScript(robot=robot_2)  # -> out, main_group_name
# ---------- info: Python ----------
if robot:
    robot.info()
    main_group_name = robot.main_group_name
# ---------- end info ----------
panel_6 = Panel(info.out)

# ----
# Move Cartesian
number_slider = Slider(0.017, range=0..0.5)
radius = Slider(0, range=0..0.5)
movel = PythonScript(robot=robot_2, planes=pln, velocity=number_slider, radius=radius)  # -> urscript; inputs planes: list
# ---------- movel: Python ----------
import Rhino.Geometry as rg
from compas.geometry import Frame
from compas.geometry import Transformation, Rotation
from compas_ghpython import draw_frame

import math
from scriptcontext import sticky as st
from ur_fabrication_control.direct_control import URScript


# retrieve the current tool frame in axis angle format
if robot.attached_tool:
    tool_angle_axis = list(robot.attached_tool.frame.point) + list(robot.attached_tool.frame.axis_angle_vector)
else:
    tool0_frame = Frame([0, 0, 0], [1, 0, 0], [0, 1, 0])
    tool_angle_axis = list(tool0_frame.point) + list(tool0_frame.axis_angle_vector)

frames = []
for plane in planes:
    frame = Frame(plane.Origin, plane.XAxis, plane.YAxis)
    frames.append(frame)

urscript = URScript()
urscript.start()
for frame in frames:
    urscript.move_linear(frame, velocity, radius)
urscript.end()

urscript = urscript.generate()

print(urscript)
# ---------- end movel ----------
send = Button()
send_2 = GhPythonScript(urscript=movel, send=send)  # -> out; inputs send: Boolean
# ---------- send_2: Python ----------
from scriptcontext import sticky as st
from ur_fabrication_control.direct_control import send_script

ur_ip = st["ur_ip"]
ur_port = st["ur_port"]

if send:
    send_script(urscript, ur_ip, ur_port)
# ---------- end send_2 ----------

# ----
# Get base frame to a fixed marker
# Make a dict: marker_0 at Frame(...), marker_4 at Frame(...)
export = Button()
list_3 = ValueList({"pose_0", "pose_1", "pose_2", "pose_3"}, selected="pose_0")
list_4 = ValueList({"marker_0 frame": "marker_0", "marker_1 frame": "marker_1", "marker_2 frame": "marker_2", "marker_3 frame": "marker_3", "marker_5 frame": "marker_5"}, selected="marker_0 frame")
subscribe = Button()
unsubscribe = Button()
clean = Button()
print = Button()
data = GhPythonScript()  # -> PATH
# ---------- data: Python ----------
import os
import ghpythonlib.components as ghcomp
import time

ghComp = ghenv.Component
ghDoc = ghComp.OnPingDocument()

# the full path of the gh file
path_gh_file = ghDoc.FilePath

# the directory of the gh file
HERE = os.path.dirname(path_gh_file)
DATA = os.path.join(HERE, '..', 'data', 'marker_frames')
PATH = os.path.join(DATA, 'markers.json')

print(PATH)
# ---------- end data ----------
get_tf_marker_frame = GhPythonScript(
    robot=robot_2,
    robot_pose=list_3,
    target_frame=list_4,
    subscribe=subscribe,
    unsubscribe=unsubscribe,
    clean_all=clean,
    print=print,
    PATH=data,
    export=export)  # -> out, bang, dict
# ---------- get_tf_marker_frame: Python ----------
from compas.geometry import Point, Quaternion, Frame
import json

reference_frame = "base"

def _receive_marker_frame_callback(message):
    pose_point = Point(message['translation']['x'], message['translation']['y'], message['translation']['z'])
    pose_quaternion = Quaternion(message['rotation']['w'], message['rotation']['x'], message['rotation']['y'], message['rotation']['z'])
    pose_frame = Frame.from_quaternion(pose_quaternion, pose_point)
    if not robot.mobile_client.marker_frames.get(robot_pose):
        robot.mobile_client.marker_frames[robot_pose] = {}
    robot.mobile_client.marker_frames[robot_pose][target_frame] = pose_frame
    print(pose_frame)

if subscribe:
    robot.mobile_client.tf_subscribe(target_frame, reference_frame, _receive_marker_frame_callback)

if unsubscribe:
    robot.mobile_client.tf_unsubscribe(target_frame, reference_frame, _receive_marker_frame_callback)

if export:
    with open(PATH, "w") as outfile:
        marker_data = {}
        for pose, markers in robot.mobile_client.marker_frames.items():
            marker_data[pose] = {}
            for marker, frame in markers.items():
                marker_data[pose][marker] = frame.to_data()
        json.dump(marker_data, outfile)

if clean_all:
    robot.mobile_client.marker_frames = {}

dict = robot.mobile_client.marker_frames
    
print "tf_clients: ", robot.mobile_client.tf_clients
print robot.mobile_client.marker_frames
# ---------- end get_tf_marker_frame ----------
visualise_markers = GhPythonScript(robot=robot_2, robot_pose=list_3, redraw=[get_tf_marker_frame.bang, set_base_frame])  # -> out, markers; inputs redraw: list
# ---------- visualise_markers: Python ----------
from scriptcontext import sticky as st
from compas.geometry import Frame, Point, Vector, Rotation
from compas_ghpython import draw_frame
import math

markers = []
if robot.mobile_client.marker_frames.get(robot_pose):
    for marker, frame in robot.mobile_client.marker_frames[robot_pose].items():
        markers.append(draw_frame(frame))
        #markers.append(frame.transformed(robot.transformation_RCF_BCF()))
print(markers)
# ---------- end visualise_markers ----------
rec_2 = DataRecorder(get_tf_marker_frame.out, DataLimit=-10, RecordData=True)
panel_7 = Panel(rec_2)
list_5 = ValueList({"marker_0 frame": "marker_0", "marker_1 frame": "marker_1", "marker_2 frame": "marker_2", "marker_3 frame": "marker_3", "marker_5 frame": "marker_5"}, selected="marker_0 frame")
fixed_marker_plane = Plane(Plane(origin=(2, 1, 0), x=(0, -0.1240347346, 0.9922778767), y=(-1, 0, 0)))
regenerate_base_plane = GhPythonScript(robot=robot_2, robot_pose=list_3, fix_to_marker=list_5, fixed_marker_0_plane=fixed_marker_plane)  # -> out, base_frame
# ---------- regenerate_base_plane: Python ----------
from scriptcontext import sticky as st
from compas.geometry import Transformation, Frame, Point
from compas.artists import Artist

# fixed_marker_plane = fixed_marker_planes[fix_to_marker]
fixed_marker_plane = fixed_marker_0_plane
fixed_marker_frame = Frame(fixed_marker_plane.Origin, fixed_marker_plane.XAxis, fixed_marker_plane.YAxis)

if robot.mobile_client.marker_frames.get(robot_pose):
    marker_pose = robot.mobile_client.marker_frames[robot_pose][fix_to_marker]
    
    MCF_in_RCF = marker_pose #measured MCF in RCF 
    MCF_in_BCF = MCF_in_RCF.transformed(robot.transformation_RCF_BCF()) #measured MCF in BCF
        
    BCF_in_MCF = Frame.from_transformation(Transformation.from_frame(MCF_in_BCF).inverted()) #BCF in measured MCF
        
    transformation_FMCF_WCF = Transformation.from_change_of_basis(fixed_marker_frame, Frame.worldXY()) #T from fixed MCF to WCF
    BCF_in_WCF = BCF_in_MCF.transformed(transformation_FMCF_WCF) #BCF in WCF
        
    print BCF_in_WCF
        
    #mean_base_frame = ...
    base_frame = BCF_in_WCF
# ---------- end regenerate_base_plane ----------
draw = Draw(cg=regenerate_base_plane.base_frame)  # -> rg
#   port cg: The COMPAS geometry or datastructure to be drawn.
#   port rg: The Rhino geometry object.
# ---------- draw: Python ----------
"""
Draws COMPAS geometry in Grasshopper.
"""
from ghpythonlib.componentbase import executingcomponent as component

from compas.artists import Artist


class CompasToRhinoGeometry(component):
    def RunScript(self, cg):
        if not cg:
            return None

        return Artist(cg).draw()
# ---------- end draw ----------
pln_2 = Plane(draw)

# ----
# Configuration
l_2 = Slider(0, range=0..0.72)

# ---- group: forward kinematics
a1 = Slider(-37, range=-360..360)
a2 = Slider(-8, range=-360..360)
a3 = Slider(0, range=-360..360)
a6 = Slider(0, range=-360..360)
a4 = Slider(90, range=-360..360)
a5 = Slider(0, range=-360..360)
jp = GhPythonScript()  # -> joint_positions
# ---------- jp: Python ----------
import math

joint_positions = [0,-90,90,0,90,0]
joint_positions = [math.radians(a) for a in joint_positions]
#joint_positions = [-3.136, -0.328, -1.218, 3.129, 0.852, 0.008]
#joint_positions = [0] * 6



#joint_positions = [1.6239667567485938, 0.25439606475392273, 4.409424838594969-2*3.14, 3.1901607306255908, 1.5707963267948954, 0.053170429953696939]
#joint_positions = [1.598543436748912, 0.23021224965157744, 4.712232135219824-2*3.14, 6.0531299026928744, 4.7123889803846915, 0.027747109954015234]
#joint_positions = [-1.1373533430447322, 4.0117247163121572, 5.4083762087596021-2*3.14, 1.5754733624925168, 4.7123889803846879, 3.5750356373399574]
print joint_positions
# ---------- end jp ----------
forward_kinematics = PythonScript(robot=robot_2, set_joint_positions=Button(), joint_positions=jp, lift=l_2, a1=a1, a2=a2, a3=a3, a4=a4, a5=a5, a6=a6)  # -> full_configuration; inputs joint_positions: list
# ---------- forward_kinematics: Python ----------
import math
import Grasshopper
from compas.robots import Joint
from compas_fab.robots import Configuration

if set_joint_positions:
    j = 0
    for i in range(ghenv.Component.Params.Input.Count):
        nslider = ghenv.Component.Params.Input[i].Sources[0]
        if nslider.GetType() == Grasshopper.Kernel.Special.GH_NumberSlider:
            nslider.TrySetSliderValue(math.degrees(joint_positions[j]))
            j += 1

if robot:
    joint_types = robot.get_configurable_joint_types()
    joint_names = robot.get_configurable_joint_names()
    
    if len(joint_types) == 6:
        joint_positions = [a1, a2, a3, a4, a5, a6]
    else:
        joint_positions = [lift, a1, a2, a3, a4, a5, a6]
    
    for i, joint_type in enumerate(joint_types):
        if joint_type == Joint.REVOLUTE:
            joint_positions[i] = math.radians(joint_positions[i])
        else:
            joint_positions[i] = joint_positions[i]
    
    full_configuration = Configuration(joint_positions, joint_types, joint_names)
    
print(full_configuration)
# ---------- end forward_kinematics ----------

# ---- group: inverse kinematics
plane = Plane(Plane(origin=(1.107006312, -0.006907311816, 0.920639), x=(-0.04967065867, 0.998765651, -1.429441465e-06), y=(0.998765651, 0.04967065867, 6.432016809e-07)))
select_configuration = Slider(2, range=0..7)
# Block is red due to invalid inputs, though remains perfectly functional
inverse = PythonScript(robot=robot_2, plane_WCS=plane, idx=select_configuration)  # -> out, plane_tool0_RCS, plane_tcp_RCS, configuration; inputs plane_WCS: Plane, idx: Int32
# ---------- inverse: Python ----------
import Rhino.Geometry as rg
import math
from compas.geometry import Frame, Transformation, Rotation
from compas_fab.robots import Configuration
from ur_fabrication_control.kinematics.ur_kinematics import inverse_kinematics
from ur_fabrication_control.kinematics.ur_params import ur_params
from compas_ghpython import draw_frame

tcp_WCS = Frame(plane_WCS.Origin, plane_WCS.XAxis, plane_WCS.YAxis)

# transform frame to robot coordinate system
print tcp_WCS
print plane_WCS
tcp_RCS = robot.RCF_in_WCF.to_local_coordinates(tcp_WCS)

tool0_RCS = robot.from_tcf_to_t0cf([tcp_RCS])[0]
print tcp_RCS
print tool0_RCS
plane_tool0_RCS = draw_frame(tool0_RCS)
plane_tcp_RCS = draw_frame(tcp_RCS)
# calculate solutions to frame
ur_params = ur_params["ur10e"] # get the parameters according to the robot model
print ur_params
solutions = inverse_kinematics(tool0_RCS, ur_params)
print solutions

if not len(solutions):
    joint_values = [0,0,0,0,0,0]
    configuration = Configuration.from_revolute_values(joint_values)
else:
    joint_values = solutions[idx]
    #print joint_values
    
    ### ***** HACK ***** ##### TODO: CHECK!!!
    for i, v in enumerate(joint_values):
        if v > math.pi:
            v -= 2*math.pi
        if v < -math.pi:
            v += 2*math.pi
        joint_values[i] = v
    ### ***** HACK ***** ##### TODO: CHECK!!!
    configuration = [Configuration.from_revolute_values(joint_values)]

print(configuration)
# ---------- end inverse ----------

# ----
zero_config = ZeroConfig(robot=robot_2)  # -> config
#   port group: If assigned, it will return the zero configuration for the given group, otherwise a full zero configuration.
#   port config: The zero configuration.
# ---------- zero_config: Python ----------
"""
Get a zero configuration for a robot.

COMPAS FAB v0.28.0
"""
from ghpythonlib.componentbase import executingcomponent as component


class ConfigZero(component):
    def RunScript(self, robot, group):
        if robot:
            return robot.zero_configuration(group)

        return None
# ---------- end zero_config ----------
pln_3 = Plane(visualise_markers.markers)

# ----
# Current robot state
subscribe_2 = Button()
unsubscribe_2 = Button()
joint_states = GhPythonScript(robot=robot_2, subscribe=subscribe_2, unsubscribe=unsubscribe_2)
# ---------- joint_states: Python ----------
def _receive_joint_states(message):
    for key, joint_name in enumerate(message.get('name')):
        robot.mobile_client.current_joint_values[joint_name] = message.get('position')[key]


if subscribe:
    robot.mobile_client.topic_subscribe('/joint_states', 'sensor_msgs/JointState', _receive_joint_states)

if unsubscribe:
    robot.mobile_client.topic_unsubscribe('/joint_states')
# ---------- end joint_states ----------
trigger = Trigger(Interval=2000, TimerInterval=2000, Target=draw_2)
draw_2 = GhPythonScript(robot=robot_2)  # -> configuration
# ---------- draw_2: Python ----------
from compas_fab.robots import Configuration

def get_current_ur10e_and_liftkit_config(client):
        joint_names_ordered = ['shoulder_pan_joint', 'shoulder_lift_joint', 'elbow_joint', 'wrist_1_joint', 'wrist_2_joint', 'wrist_3_joint']
        print(robot.mobile_client.current_joint_values)
        joint_values_ordered = [client.current_joint_values.get(joint_name, 0.0) for joint_name in joint_names_ordered]
        #joint_values_ordered.insert(0, 0)
        joint_types_ordered = [0, 0, 0, 0, 0, 0]
        #joint_types_ordered = [2, 0, 0, 0, 0, 0, 0]
        return Configuration(joint_values_ordered, joint_types_ordered)

configuration = get_current_ur10e_and_liftkit_config(robot.mobile_client)
print configuration
# ---------- end draw_2 ----------

list_6 = ValueList({"0 forward_kinematics": 0, "1 inverse_kinematics": 1, "2 zero_configuration": 2, "3 real_configuration": 3}, selected="3 real_configuration")
filter = StreamFilter(Gate=list_6, Stream0=forward_kinematics, Stream1=inverse.configuration, Stream2=zero_config, Stream3=draw_2)

show_robot_frame = BooleanToggle(True)

# ----
# Visualisation
show_end_effector_frame = BooleanToggle(True)
show_base_frame = BooleanToggle(True)
show_collision = BooleanToggle(False)
show_frames = BooleanToggle(False)
show_visual = BooleanToggle(True)
show_acm = BooleanToggle(False)
list_7 = ValueList({"Zero": 0, "One": 1, "Two": 2, "Three": 3, "Four": 4, "Five": 5}, selected="Zero")
visualize = PythonScript(
    robot=robot_2,
    group=info.main_group_name,
    configuration=filter,
    redraw=attach_remove.bang,
    show_visual=show_visual,
    show_collision=show_collision,
    show_end_effector_frame=show_end_effector_frame,
    show_frames=show_frames,
    show_robot_frame=show_robot_frame,
    show_base_frame=show_base_frame,
    show_acm=show_acm)  # -> out, robot, visual, collision, attached_meshes, frames, ee_frame, tool0_frame, BCF, RCF; inputs redraw: list, attached_collision_meshes: list
# ---------- visualize: Python ----------
import rhinoscriptsyntax as rs
import Rhino.Geometry as rg
import math
import ghpythonlib.components as ghcomp
from compas.geometry import Vector
from compas.geometry import Point
from compas.geometry import Transformation, Rotation
from compas.geometry import Frame
from compas_ghpython.artists import MeshArtist
from compas_ghpython.utilities import draw_frame
from compas_fab.robots import Configuration
from ur_fabrication_control.kinematics.ur_kinematics import forward_kinematics
from ur_fabrication_control.kinematics.ur_params import ur_params



if robot and configuration:
    robot.update(configuration, visual=show_visual, collision=show_collision)
    

    if show_visual:
        visual = robot.artist.draw_visual()
        
        # Warning!!! Check the direction!
        visual = ghcomp.Rotate(visual, math.pi, rg.Plane.WorldXY)[0]
        
        robot_BCF = draw_frame(robot.BCF)
        init_robot_plane = rg.Plane.WorldXY
        visual = ghcomp.Orient(visual, init_robot_plane, robot_BCF)[0]
    
    if show_collision:
        collision = robot.artist.draw_collision()
    
    frames = robot.transformed_frames(configuration, group)
    
    if show_base_frame:
        BCF = robot.BCF
        
    if show_robot_frame:
        RCF = robot.RCF
        
    
    if show_end_effector_frame:    
        print robot
        ee_frame = robot.forward_kinematics(configuration, group)
        ee_frame = ee_frame.transformed(Rotation.from_axis_and_angle(Vector.Zaxis(), math.pi))
        print(ee_frame)
        print ee_frame
        if robot.attached_tool:
            tool0_frame = robot.from_tcf_to_t0cf([ee_frame])
        print("End-effector", ee_frame)
    
    if not show_frames:
        frames = None

    frame = robot.forward_kinematics(configuration, options=dict(solver='model'))
    
    if show_acm: # attached collision meshes
        M = []
        for acm in attached_collision_meshes:
            frame = robot.forward_kinematics(configuration, options=dict(solver='model', link_name=acm.link_name))
            T = Transformation.from_frame_to_frame(Frame.worldXY(), frame)
            mesh = acm.collision_mesh.mesh.transformed(T)
            M.append(MeshArtist(mesh).draw())
        attached_meshes = M
# ---------- end visualize ----------
geo = Geometry(visualize.collision)
geo_2 = Geometry(visualize.visual)
draw_3 = GhPythonScript(frames=[visualize.BCF, visualize.RCF, visualize.ee_frame, visualize.tool0_frame], scale=Slider(0.1, range=0..1))  # -> P, V, C, W; inputs frames: list
# ---------- draw_3: Python ----------
from System.Drawing import Color
from compas_ghpython.utilities import draw_frame

red = Color.FromArgb(255, 0, 0)
green = Color.FromArgb(0, 255, 0)
blue = Color.FromArgb(0, 0, 255)

P = []
V = []
C = []

scale = float(scale)

for frame in frames:
    if not frame:
        continue
    plane = draw_frame(frame)
    P += [plane.Origin] * 3
    V.append(plane.XAxis * scale)
    V.append(plane.YAxis * scale)
    V.append(plane.ZAxis * scale)
    C += [red, green, blue]

W = 3
# ---------- end draw_3 ----------
preview = CustomPreview(Geometry=geo_2, Shader=ColourSwatch(SwatchColor=RGB(105, 105, 105)))
preview_2 = CustomPreview(Geometry=visualize.attached_meshes, Shader=ColourSwatch(SwatchColor=RGB(255, 255, 255)))
vdisex = VectorDisplayEx(Point=draw_3.P, Vector=draw_3.V, Colour=draw_3.C, Width=draw_3.W)

data_2 = Data("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")
markers_measured = Plane([Plane(origin=(-0.1411526284, -0.9124233221, -0.7287163427), x=(0.007056867188, 0.01262337416, 0.9998954201), y=(-0.8046424248, 0.5937569083, -0.001817150926)), Plane(origin=(-0.1588768122, -0.8092909928, -0.7320349751), x=(-0.01954446101, 0.006498275909, 0.9997878707), y=(-0.803503313, 0.5949783726, -0.01957452513)), Plane(origin=(-0.09667481466, -0.8523786957, -0.7282498193), x=(-0.01096084335, 0.0003291486254, 0.999939874), y=(-0.8064102589, 0.5912874761, -0.00903410117)), Plane(origin=(-0.2057424383, -0.8711567917, -0.734225009), x=(-0.002631040703, 0.02160679194, 0.999763084), y=(-0.8065779039, 0.5909401442, -0.01489398867))])
panel_8 = Panel(data_2)
marker_rb = Plane(Plane(origin=(-0.1563068104, -0.7934886651, -0.7220499427), x=(0.910206069, -0.4133145219, -0.02638215228), y=(-0.3194642961, -0.7412122818, 0.5903786216)))
marker_lb = Plane(Plane(origin=(-0.09919228656, -0.8391039853, -0.722097354), x=(0.9102198753, -0.4132909607, -0.02627470848), y=(-0.3194363345, -0.741063018, 0.5905810965)))
marker_lt = Plane(Plane(origin=(-0.1453635577, -0.8960428403, -0.721312811), x=(0.9103348739, -0.4130498214, -0.0260818396), y=(-0.3193768544, -0.7411711913, 0.5904775102)))
marker_rt = Plane(Plane(origin=(-0.2023436399, -0.8504310716, -0.7212770786), x=(0.9102716179, -0.4131836125, -0.02617028813), y=(-0.3194712872, -0.7412103916, 0.5903772117)))
on_base = Plane(Plane(origin=(0.0461079828, -0.08878726616, -7.747082454e-05), x=(0.8844814013, 0.04069731485, -0.4647971378), y=(-0.1516416439, -0.9170317953, -0.3688597272)))

draw_4 = Draw(cg=visualize.ee_frame)  # -> rg; same code as draw
pln_4 = Plane(draw_4)
ext_ip = ValueList({"192.168.10.10", "192.168.10.20", "192.168.10.11", "192.168.10.12", "127.0.0.1", "192.168.10.111", "192.168.0.220", "192.168.0.30", "192.168.10.50", "0.0.0.0"}, selected="192.168.0.220")
ext_port = ValueList({"50003", "50004"}, selected="50004")

# ----
# IP Settings
# --> Set your IP address
# --> Set robot IP address
server_ip = ValueList({"192.168.10.44", "192.168.10.12", "192.168.10.11", "192.168.10.10", "192.168.10.2", "127.0.0.1", "192.168.10.111", "192.168.0.250", "192.168.0.30", "10.42.0.212", "10.42.0.133"}, selected="192.168.0.250")
ur_ip = ValueList({"192.168.10.10", "192.168.10.20", "192.168.10.11", "192.168.10.12", "127.0.0.1", "192.168.10.111", "192.168.0.210", "192.168.0.30"}, selected="192.168.0.210")
server_port = ValueList({"50002", "50003", "50005", "50006", "50007", "50008", "50009", "50010", "50011", "50012", "50013", "50014", "50015", "50016"}, selected="50005")
ur_port = ValueList({"30002"}, selected="30002")
globals = PythonScript(
    server_ip=server_ip,
    server_port=server_port,
    ur_ip=ur_ip,
    ur_port=ur_port,
    ext_ip=ext_ip,
    ext_port=ext_port,
    clear=Button())  # inputs server_port: Int32
# ---------- globals: Python ----------
from scriptcontext import sticky as st

st["server_ip"] = server_ip
st["server_port"] = server_port

st["ur_ip"] = ur_ip
st["ur_port"] = ur_port

st["ext_ip"] = ext_ip
st["ext_port"] = ext_port


if clear:
    st.clear()
# ---------- end globals ----------

# ----
# Check if UR robot
#  is available
ping = Button()
py_3 = PythonScript(ip=ur_ip, ping=ping)  # -> out, trigger
# ---------- py_3: Python ----------
from scriptcontext import sticky as st
from ur_fabrication_control.direct_control.utilities import is_available

guid = str(ghenv.Component.InstanceGuid)
txt_key = "txt_" + guid
if txt_key not in st:
    st[txt_key] = ""

if ping:
    
    available = is_available(ip)
    
    if available:
        st[txt_key] = "%s is up!" % ip
        trigger = True
    else:
        st[txt_key] = "%s is down!" % ip
        trigger = False

print(st[txt_key])
# ---------- end py_3 ----------
panel_9 = Panel(py_3.out)

list_8 = ValueList({"pose_0", "pose_1", "pose_2", "pose_3"}, selected="pose_0")
list_9 = ValueList({"marker_0 frame": "marker_0", "marker_1 frame": "marker_1", "marker_2 frame": "marker_2", "marker_3 frame": "marker_3", "marker_5 frame": "marker_5"}, selected="marker_0 frame")
list_10 = ValueList({"camera frame": "camera_color_optical_frame", "robot base frame": "base"}, selected="robot base frame")
subscribe_3 = Button()
save = Button()
unsubscribe_3 = Button()
clean_2 = Button()
print_2 = Button()
clean_3 = Button()
get_tf_marker_frame_2 = GhPythonScript(
    robot_pose=list_8,
    target_frame=list_9,
    reference_frame=list_10,
    subscribe=subscribe_3,
    save=save,
    unsubscribe=unsubscribe_3,
    clean=clean_2,
    print=print_2)  # -> out, bang, dict; disabled
# ---------- get_tf_marker_frame_2: Python ----------
from scriptcontext import sticky as st
from compas.geometry import Point, Quaternion, Frame

def _receive_marker_frame_callback(message):
    pose_point = Point(message['translation']['x'], message['translation']['y'], message['translation']['z'])
    pose_quaternion = Quaternion(message['rotation']['w'], message['rotation']['x'], message['rotation']['y'], message['rotation']['z'])
    pose_frame = Frame.from_quaternion(pose_quaternion, pose_point)
    if not robot.mobile_client.marker_frames.get(robot_pose):
        robot.mobile_client.marker_frames[robot_pose] = {}
    robot.mobile_client.marker_frames[robot_pose][target_frame] = pose_frame
    print(pose_frame)

if not st.get('marker_poses'):
    st['marker_poses'] = {}

if subscribe:
    robot.mobile_client.tf_subscribe(target_frame, reference_frame, _receive_marker_frame_callback)

if save:
    if robot.mobile_client.tf_frame is not None:
        if not st['marker_poses'].get(robot_pose):
            st['marker_poses'][robot_pose] = {}
        st['marker_poses'][robot_pose][target_frame] = robot.mobile_client.tf_frame

if unsubscribe:
    robot.mobile_client.tf_unsubscribe(target_frame, reference_frame)
    if robot.mobile_client.tf_frame is not None:
        robot.mobile_client.clean_tf_frame()

if clean:
    robot.mobile_client.clean_tf_frame()

if st.get('marker_poses'):
    dict = str(st['marker_poses'])
    print(dict)
    
print "tf_clients: ", robot.mobile_client.tf_clients
print "tf_frame: ", robot.mobile_client.tf_frame
print st['marker_poses']
print robot.mobile_client.marker_frames
# ---------- end get_tf_marker_frame_2 ----------
visualise_markers_2 = GhPythonScript(robot_pose=list_8)  # -> out, markers; inputs redraw: list; disabled
# ---------- visualise_markers_2: Python ----------
from scriptcontext import sticky as st
from compas.geometry import Frame, Point, Vector, Rotation
import math

markers = []
if len(st['marker_poses']):
    if st['marker_poses'].get(robot_pose):
        for marker, frame in st['marker_poses'][robot_pose].items():
            markers.append(frame)
            #markers.append(frame.transformed(robot.transformation_RCF_BCF()))

print(markers)
# ---------- end visualise_markers_2 ----------
clean_markers = GhPythonScript(clean=clean_3)  # -> out, bang; disabled
# ---------- clean_markers: Python ----------
from scriptcontext import sticky as st
from compas.geometry import Frame, Point, Vector


if clean and st.get('marker_poses'):
    st['marker_poses'] = {}
# ---------- end clean_markers ----------
rec_3 = DataRecorder(get_tf_marker_frame_2.out, DataLimit=-10, RecordData=True)
draw_5 = Draw(cg=visualise_markers_2.markers)  # -> rg; same code as draw
