# Grasshopper definition ex01_mobile_robot_model_pick_and_place_WIP.gh (Grasshopper 1.0.7)

reload = Button()
panel = Panel("Unload libraries")
py = PythonScript(reload=reload)
# ---------- py: Python ----------
from compas_ghpython import unload_modules

if reload:
    unload_modules("roslibpy")
    unload_modules("fabrication_control")
    unload_modules("assembly_information_model")
    unload_modules("am_information_model")
    unload_modules("ur_fabrication_control")
    unload_modules("mobile_robot_control")
    unload_modules("extruder_control")
# ---------- end py ----------

# ----
# Robot Model
# Load robot from local package
py_2 = PythonScript()  # -> mobile_robot_data_path, ur_data_path
# ---------- py_2: Python ----------
import os

"""
ASSUMING THE BELOW PACKAGES ARE STORED IN THE SAME LOCATION:
    ur_fabrication_control;
    rbvogui_common; and
    mobile_additive_manufacturing.
"""

repositories_path = os.path.abspath(os.path.join(ghdoc.Path,"../../../"))

assert os.path.exists(os.path.join(repositories_path, "ur_fabrication_control/data"))
assert os.path.exists(os.path.join(repositories_path, "mobile_robot_control/data/rbvogui_xl_lift_ur10e_description"))

ur_data_path = os.path.abspath(os.path.join(ghdoc.Path,"../../../ur_fabrication_control/data"))
mobile_robot_data_path = os.path.abspath(os.path.join(ghdoc.Path,"../../../mobile_robot_control/data"))
# ---------- end py_2 ----------
list = ValueList({"indoor", "outdoor"}, selected="outdoor")

# ----
# Load robot locally
py_3 = PythonScript(mobile_robot_data_path=py_2.mobile_robot_data_path, ur_data_path=py_2.ur_data_path, wheel_type=list)  # -> loaders, urdf_filename, srdf_filename
# ---------- py_3: Python ----------
import os
from compas.robots import LocalPackageMeshLoader

#loaders

ur_path = os.path.join(ur_data_path, "robot_description")
ur_packages = ["ur_e_description"]
ur_loaders = [LocalPackageMeshLoader(ur_path, pck) for pck in ur_packages]

mobile_robot_path = os.path.join(mobile_robot_data_path, "rbvogui_xl_lift_ur10e_description")
mobile_robot_packages = ["rbvogui_description", "ewellix_description", "robotnik_sensors"]
mobile_robot_loaders = [LocalPackageMeshLoader(mobile_robot_path, pck) for pck in mobile_robot_packages]

loaders = ur_loaders + mobile_robot_loaders

#files
if wheel_type=="indoor":
    urdf_filename = os.path.join(mobile_robot_data_path, r"rbvogui_xl_lift_ur10e_indoor.urdf")
if wheel_type == "outdoor":
    urdf_filename = os.path.join(mobile_robot_data_path, r"rbvogui_xl_lift_ur10e.urdf")
srdf_filename = os.path.join(mobile_robot_data_path, r"rbvogui.srdf")

assert os.path.isfile(urdf_filename)
assert os.path.isfile(srdf_filename)
# ---------- end py_3 ----------
load = Button()
units = ValueList({"m": 1, "cm": 100, "mm": 1000}, selected="m")
create = PythonScript(
    load=load,
    loaders=py_3.loaders,
    urdf_filename=py_3.urdf_filename,
    srdf_filename=py_3.srdf_filename,
    scale_factor=units,
    wheel_type=list)  # -> out, robot; inputs load: Boolean, loaders: list
# ---------- create: Python ----------
import os
from scriptcontext import sticky as st

import compas

from compas_ghpython import draw_frame
from compas.robots import RobotModel
from compas.robots import LocalPackageMeshLoader

from mobile_robot_control.mobile_robot import MobileRobot
from compas_fab.robots import RobotSemantics
from compas_fab.ghpython import RobotArtist

compas.PRECISION = '12f'

# store robot in component
guid = str(ghenv.Component.InstanceGuid)
robot_key = "robot"

if robot_key not in st:
    st[robot_key] = None

#print loaders
if load:
    model = RobotModel.from_urdf_file(urdf_filename)
    model.load_geometry(*loaders)
    artist = RobotArtist(model)
    semantics = RobotSemantics.from_srdf_file(srdf_filename, model)
    robot = MobileRobot(model, artist, semantics, client=None)
    
    st[robot_key] = robot

robot = st[robot_key]
robot.wheel_type = wheel_type
print(robot)

rcf = draw_frame(robot.get_RCF())
print(rcf)
# ---------- end create ----------

set_to_origin = BooleanToggle(False)
pln = Plane(Plane(origin=(-1, 0, 0), x=(-1, 0, 0), y=(0, 1, 0)))

robot = Data(create.robot)
info = PythonScript(robot=robot)  # -> out, main_group_name
# ---------- info: Python ----------
if robot:
    robot.info()
    main_group_name = robot.main_group_name
# ---------- end info ----------
panel_2 = Panel(info.out)

# ----
# Attach tool
list_2 = ValueList({"measurement_tool": 0, "clay_extruder_7mm": 1, "area_gripper": 2, "area_gripper_435i": 3}, selected="area_gripper_435i")
show = BooleanToggle(True)
py_4 = PythonScript()  # -> DATA
# ---------- py_4: Python ----------
import os

#package_path = os.path.dirname(mobile_fabrication_control.__file__)
#DATA = os.path.abspath(os.path.join(package_path,"../../data"))

package_path = ghdoc.Path
# package_path = os.path.dirname(ur_fabrication_control.__file__)
#DATA = os.path.abspath(os.path.join(package_path,"../../data"))

# .stl files not stored in am_hackathon repo. but in mobile_fabrication_control
DATA = os.path.abspath(os.path.join(package_path,"../../../mobile_robot_control/data"))

print(package_path)
print(DATA)
# ---------- end py_4 ----------
tool = PythonScript(data_path=py_4, tool=list_2, show=show)  # -> tool, M, ee_plane
# ---------- tool: Python ----------
import os, math
from compas.geometry import Frame, Rotation
from compas.datastructures import Mesh
from compas_ghpython.artists import MeshArtist
from compas_fab.robots import Tool
from compas_ghpython.utilities import draw_frame

tolerance = 0

if tool == 0:
    filename = 'measurement_tool_zaxis.stl'
    ee_frame = Frame([0, 0, 0.109], [1, 0, 0], [0, 1, 0])

elif tool == 1:
    filename = 'clay_extruder_7mm.stl'
    # real frame:
    ee_frame = Frame([-0.000502, -0.105348, 0.0662,], [1, 0, 0], [0, 0, 1])
    
    # test frame:
    # ee_frame = Frame([0.0, 0.0, 0.1,], [1, 0, 0], [0, 1, 0])

elif tool == 2:
    filename = 'area_gripper_zaxis.stl'
    ee_frame = Frame([0, 0, 0.10219 + tolerance], [0, 1, 0], [-1, 0, 0])

elif tool == 3:
    filename = 'area_gripper_d435i_zaxis.stl'
    ee_frame = Frame([0, 0, 0.10219 + tolerance], [0, 1, 0], [-1, 0, 0])
#    ee_frame = Frame([0.054, 0, 0.065 + tolerance], [0, 1, 0], [-1, 0, 0])

data_path = os.path.join(data_path, "tool_geometry")
fullfilename = os.path.join(data_path, filename)
print fullfilename

ee_mesh = Mesh.from_stl(fullfilename)

if show:
    artist = MeshArtist(ee_mesh)
    M = artist.draw()

tool = Tool(ee_mesh, ee_frame)
ee_plane = draw_frame(ee_frame)
print(ee_frame.quaternion.xyzw)
ee_framek = Frame([0.0110607,0.00809854,0.41498], [0,1,0], [1,0,0])
print(ee_framek.quaternion.xyzw)
# ---------- end tool ----------
panel_3 = Panel("Attach a custom tool")
remove = Button()
add = Button()
attach_remove = PythonScript(robot=robot, tool=tool.tool, attach=add, remove=remove)  # -> out, bang
# ---------- attach_remove: Python ----------
if attach:
    robot.attach_tool(tool)
if remove:
    robot.detach_tool()
# ---------- end attach_remove ----------

# ----
# Move mobile robot base
angle = Slider(0, range=0..360)
base_origin = Point(Point(1.765927588, 0.1701242407, 0))
base_plane = GhPythonScript(origin=base_origin, angle=angle)  # -> base_plane; inputs origin: Point3d
# ---------- base_plane: Python ----------
import Rhino.Geometry as rg
import math

base_plane = rg.Plane(origin, rg.Vector3d.XAxis, rg.Vector3d.YAxis)
base_plane.Rotate(math.radians(angle), rg.Vector3d.ZAxis)
# ---------- end base_plane ----------
set_base_frame = PythonScript(robot=robot, set_to_origin=set_to_origin, base_plane=base_plane)  # -> bang
# ---------- set_base_frame: Python ----------
from compas_ghpython import draw_frame
from compas.geometry import Frame, Point, Vector, Transformation
from compas.datastructures import Mesh
from compas_rhino.geometry import RhinoMesh
from compas_fab.robots import CollisionMesh

if set_to_origin:
    base_frame = Frame.worldXY()
else:
    base_frame = Frame(base_plane.Origin, base_plane.XAxis, base_plane.YAxis)

# Base_frame is BCF in WCF
if robot:
    robot.BCF = base_frame
# ---------- end set_base_frame ----------

python = GhPythonScript(robot=robot, picking_plane=pln)  # -> out
# ---------- python: Python ----------
from compas_ghpython import draw_frame
from compas.geometry import Frame, Point, Vector, Transformation
from compas.datastructures import Mesh
from compas_rhino.geometry import RhinoMesh
from compas_fab.robots import CollisionMesh

# Picking frame is PCF in BCF
if robot and picking_plane:
    robot.PCF = Frame(picking_plane.Origin, picking_plane.XAxis, picking_plane.YAxis)
# ---------- end python ----------
# Configuration
l = Slider(0, range=0..0.72)

# ---- group: forward kinematics
a1 = Slider(0, range=-360..360)
a2 = Slider(-90, range=-360..360)
a3 = Slider(90, range=-360..360)
a6 = Slider(0, range=-360..360)
a4 = Slider(0, range=-360..360)
a5 = Slider(90, range=-360..360)
jp = GhPythonScript()  # -> joint_positions
# ---------- jp: Python ----------
import math

joint_positions = [0,0,-90,90,0,90,0]
joint_positions = [math.radians(a) for a in joint_positions]
#joint_positions = [-3.136, -0.328, -1.218, 3.129, 0.852, 0.008]
#joint_positions = [0] * 6



#joint_positions = [1.6239667567485938, 0.25439606475392273, 4.409424838594969-2*3.14, 3.1901607306255908, 1.5707963267948954, 0.053170429953696939]
#joint_positions = [1.598543436748912, 0.23021224965157744, 4.712232135219824-2*3.14, 6.0531299026928744, 4.7123889803846915, 0.027747109954015234]
#joint_positions = [-1.1373533430447322, 4.0117247163121572, 5.4083762087596021-2*3.14, 1.5754733624925168, 4.7123889803846879, 3.5750356373399574]
print joint_positions
# ---------- end jp ----------
forward_kinematics = PythonScript(robot=robot, set_joint_positions=Button(), joint_positions=jp, lift=l, a1=a1, a2=a2, a3=a3, a4=a4, a5=a5, a6=a6)  # -> full_configuration; inputs joint_positions: list
# ---------- forward_kinematics: Python ----------
import math
import Grasshopper
from compas.robots import Joint
from compas_fab.robots import Configuration

if set_joint_positions:
    j = 0
    for i in range(ghenv.Component.Params.Input.Count):
        nslider = ghenv.Component.Params.Input[i].Sources[0]
        if nslider.GetType() == Grasshopper.Kernel.Special.GH_NumberSlider:
            nslider.TrySetSliderValue(math.degrees(joint_positions[j]))
            j += 1

if robot:
    joints = robot.get_configurable_joints()
    joint_types = [joint.type for joint in joints]
    joint_names = [joint.name for joint in joints]
    
    joint_positions = [a1, a2, a3, a4, a5, a6]
    joint_positions = [math.radians(position) for position in joint_positions]
    
    if len(joints) == 7:
        joint_positions = [lift] + joint_positions
    
    print joint_types, joint_names, joint_positions
    full_configuration = Configuration(joint_positions, joint_types, joint_names)
    
print(full_configuration)
# ---------- end forward_kinematics ----------

# ---- group: inverse kinematics
select_configuration = Slider(0, range=0..7)
plane = Plane(Plane(origin=(1.107006312, -0.006907311816, 0.920639), x=(-0.04967065867, 0.998765651, -1.429441465e-06), y=(0.998765651, 0.04967065867, 6.432016809e-07)))
analytic_inverse = PythonScript(robot=robot, lift=l, plane_WCS=plane, idx=select_configuration, bang=[attach_remove.bang, set_base_frame])  # -> out, configuration; inputs plane_WCS: Plane, idx: Int32, bang: list
# ---------- analytic_inverse: Python ----------
import Rhino.Geometry as rg
import math
from compas.geometry import Frame, Transformation, Rotation
from compas_fab.robots import Configuration
from ur_fabrication_control.kinematics.ur_kinematics import inverse_kinematics
from ur_fabrication_control.kinematics.ur_params import ur_params
from compas_ghpython import draw_frame

robot.lift_height = lift

frame_WCS = Frame(plane_WCS.Origin, plane_WCS.XAxis, plane_WCS.YAxis)

# transform frame to robot coordinate system
frame_RCS = frame_WCS.transformed(robot.transformation_WCF_RCF())

if robot.attached_tool:
    tool0_RCS = robot.from_tcf_to_t0cf([frame_RCS])[0]
else:
    tool0_RCS = frame_RCS

plane_tool0_RCS = draw_frame(tool0_RCS)
plane_RCS = draw_frame(frame_RCS)

# calculate solutions to frame
ur_params = ur_params["ur10e"] # get the parameters according to the robot model
print ur_params
solutions = inverse_kinematics(tool0_RCS, ur_params)
print solutions

if not len(solutions):
    joint_values = [0, 0, 0, 0, 0, 0, 0]
    configuration = Configuration.from_revolute_values(joint_values)
else:
    joint_values = [lift] + solutions[idx]
    configuration = [Configuration.from_revolute_values(joint_values)]

print(configuration)
# ---------- end analytic_inverse ----------

# ---- group: zero configuration
zero_config = ZeroConfig(robot=robot, group=info.main_group_name)  # -> config
#   port group: If assigned, it will return the zero configuration for the given group, otherwise a full zero configuration.
#   port config: The zero configuration.
# ---------- zero_config: Python ----------
"""
Get a zero configuration for a robot.

COMPAS FAB v0.27.0
"""
from ghpythonlib.componentbase import executingcomponent as component


class ConfigZero(component):
    def RunScript(self, robot, group):

        if robot:
            return robot.zero_configuration(group)

        return None
# ---------- end zero_config ----------

# ----
list_3 = ValueList({"0 zero_configuration": 0, "1 forward_kinematics": 1, "2 inverse_kinematics": 2}, selected="2 inverse_kinematics")
filter = StreamFilter(Gate=list_3, Stream0=zero_config, Stream1=forward_kinematics, Stream2=analytic_inverse.configuration)

# ----
# Visualisation
show_end_effector_frame = BooleanToggle(False)
show_base_frame = BooleanToggle(False)
show_collision = BooleanToggle(False)
show_frames = BooleanToggle(True)
show_visual = BooleanToggle(True)
show_acm = BooleanToggle(False)
show_cm = BooleanToggle(False)
robot_visualize = RobotVisualize(
    robot=robot,
    group=info.main_group_name,
    configuration=filter,
    show_visual=show_visual,
    show_collision=show_collision,
    show_frames=show_frames,
    show_base_frame=show_base_frame,
    show_end_effector_frame=show_end_effector_frame,
    show_cm=show_cm,
    show_acm=show_acm,
    redraw=[attach_remove.bang, set_base_frame])  # -> visual, collision, collision_meshes, attached_meshes, all_frames, base_frame, ee_frame, picking_frame; inputs show_visual: Boolean, show_collision: Boolean, show_frames: Boolean, show_base_frame: Boolean, show_end_effector_frame: Boolean, show_cm: Boolean, show_acm: Boolean, redraw: list
#   port group: The planning group used for end-effector and base visualization.
#   port configuration: The robot's full configuration.
#   port show_visual: Whether or not to show the robot's visual meshes.
#   port show_collision: Whether or not to show the robot's collision meshes.
#   port show_frames: Whether or not to show the robot's joint frames.
#   port show_base_frame: Whether or not to show the robot's base frame.
#   port show_end_effector_frame: Whether or not to show the robot's end-effector frame.
#   port show_cm: Whether or not to show the collision meshes (if any).
#   port show_acm: Whether or not to show the attached collision meshes (if any).
#   port visual: Rhino meshes of the robot's visual geometry (if any).
#   port collision: Rhino meshes of the robot's collision geometry (if any).
#   port collision_meshes: Rhino meshes of the scene's collision meshes (if any).
#   port attached_meshes: Rhino meshes of the scene's attached collision meshes (if any).
#   port all_frames: The robot's joint frames as Rhino planes (if any).
#   port base_frame: The robot's base frame as a Rhino plane (if any).
#   port ee_frame: The robot's end-effector frame as a Rhino plane (if any).
# ---------- robot_visualize: Python ----------
"""
Visualizes the robot.

COMPAS FAB v0.27.0
"""
import Rhino.Geometry as rg
import ghpythonlib.components as ghcomp
from compas.artists import Artist
from compas.geometry import Frame
from compas.geometry import Transformation
from compas_fab.robots import PlanningScene
from compas_ghpython.utilities import draw_frame
from ghpythonlib.componentbase import executingcomponent as component

class RobotVisualize(component):
    def RunScript(
        self,
        robot,
        group,
        configuration,
        show_visual,
        show_collision,
        show_frames,
        show_base_frame,
        show_end_effector_frame,
        show_cm,
        show_acm,
        redraw
    ):

        visual = None
        collision = None
        collision_meshes = None
        attached_meshes = None
        frames = None
        base_frame = None
        ee_frame = None
        all_frames = None

        if robot:
            show_visual = True if show_visual is None else show_visual
            show_cm = True if show_cm is None else show_cm
            show_acm = True if show_acm is None else show_acm
            configuration = configuration or robot.zero_configuration()

            robot.update(configuration, visual=show_visual, collision=show_collision)
            frames = robot.transformed_frames(configuration, group)

            if show_visual:
                visual = robot.artist.draw_visual()
                # orient the robot to its base plane:
                robot_BCF = draw_frame(robot.BCF) 
                init_robot_plane = rg.Plane.WorldXY
                visual = ghcomp.Orient(visual, init_robot_plane, robot_BCF)[0]
                picking_frame = robot.to_world_coordinates(robot.PCF)

            if show_collision:
                collision = robot.artist.draw_collision()

            if show_base_frame:
                base_frame = robot.BCF

            if show_end_effector_frame:
                ee_frame = robot.forward_kinematics(
                    configuration, group, options=dict(solver="model")
                )

            if show_frames:
                all_frames = [robot.to_world_coordinates(frame) for frame in frames]

            if show_cm or show_acm:
                scene = PlanningScene(robot)
                scene = robot.client.get_planning_scene()

                collision_meshes = []
                attached_meshes = []

                if show_cm:
                    for co in scene.world.collision_objects:
                        header = co.header
                        frame_id = header.frame_id
                        cms = co.to_collision_meshes()

                        for cm in cms:
                            if cm.frame != Frame.worldXY():
                                t = Transformation.from_frame(cm.frame)
                                mesh = cm.mesh.transformed(t)
                            else:
                                mesh = cm.mesh

                            collision_meshes.append(Artist(mesh).draw())

                if show_acm:
                    for aco in scene.robot_state.attached_collision_objects:
                        for acm in aco.to_attached_collision_meshes():
                            frame_id = aco.object["header"]["frame_id"]
                            frame = robot.forward_kinematics(
                                configuration, options=dict(link=frame_id)
                            )
                            t = Transformation.from_frame(frame)

                            # Local CM frame
                            if (
                                acm.collision_mesh.frame
                                and acm.collision_mesh.frame != Frame.worldXY()
                            ):
                                t = t * Transformation.from_frame(
                                    acm.collision_mesh.frame
                                )

                            mesh = acm.collision_mesh.mesh.transformed(t)

                            attached_meshes.append(Artist(mesh).draw())

        return (
            visual,
            collision,
            collision_meshes,
            attached_meshes,
            all_frames,
            base_frame,
            ee_frame,
            picking_frame
        )
# ---------- end robot_visualize ----------
geo = Geometry(robot_visualize.visual)
geo_2 = Geometry(robot_visualize.collision)
draw = GhPythonScript(frames=robot_visualize.picking_frame, scale=Slider(0.1, range=0..1))  # -> P, V, C, W; inputs frames: list
# ---------- draw: Python ----------
from System.Drawing import Color
from compas_ghpython.utilities import draw_frame

red = Color.FromArgb(255, 0, 0)
green = Color.FromArgb(0, 255, 0)
blue = Color.FromArgb(0, 0, 255)

P = []
V = []
C = []

scale = float(scale)

for frame in frames:
    if not frame:
        continue
    plane = draw_frame(frame)
    P += [plane.Origin] * 3
    V.append(plane.XAxis * scale)
    V.append(plane.YAxis * scale)
    V.append(plane.ZAxis * scale)
    C += [red, green, blue]

W = 3
# ---------- end draw ----------
preview = CustomPreview(Geometry=geo, Shader=ColourSwatch(SwatchColor=RGB(105, 105, 105)))
preview_2 = CustomPreview(Geometry=geo_2, Shader=ColourSwatch(SwatchColor=RGB(255, 255, 255)))
vdisex = VectorDisplayEx(Point=draw.P, Vector=draw.V, Colour=draw.C, Width=draw.W)
