# Grasshopper definition example_dualAckerman_solver.gh (Grasshopper 1.0.8)
# plug-ins: Human, Nautilus

# ---- group: RobotMesh and Plane / Front Left
pt = Point(<point referenced from the Rhino model>)
mesh = Mesh([<mesh referenced from the Rhino model> x2])
group = Group(Geometry=mesh)
xy = XYPlane(Origin=pt)

# ---- group: RobotMesh and Plane / Back Left
pt_2 = Point(<point referenced from the Rhino model>)
mesh_2 = Mesh([<mesh referenced from the Rhino model> x2])
xy_2 = XYPlane(Origin=pt_2)
group_2 = Group(Geometry=mesh_2)

# ---- group: RobotMesh and Plane / Mobile Robot Body
mesh_3 = Mesh([<mesh referenced from the Rhino model> x11])
group_3 = Group(Geometry=mesh_3)

# ---- group: RobotMesh and Plane / Robot Arm Plane
pt_3 = Point(<point referenced from the Rhino model>)
xy_3 = XYPlane(Origin=pt_3)

# ----
xy_4 = XYPlane(BasePlane=Point(0, 0, 0))

# ---- group: MobileRobotData
wheelbase = Panel("959")
trackwidth = Panel("585")
wheeldia = Panel("285")
linearvelocity = Panel("2.0")

# ----
radius_of_curvature = Panel("2000")
number_slider = Slider(0, range=0..1)
crv = Curve(<curve referenced from the Rhino model>)
crv_2 = Curve(crv)

# ---- group: RobotMesh and Plane / Front Right
pt_4 = Point(<point referenced from the Rhino model>)
mesh_4 = Mesh([<mesh referenced from the Rhino model> x2])
xy_5 = XYPlane(Origin=pt_4)
group_4 = Group(Geometry=mesh_4)

# ---- group: RobotMesh and Plane / BackRight
mesh_5 = Mesh([<mesh referenced from the Rhino model> x2])
pt_5 = Point(<point referenced from the Rhino model>)
xy_6 = XYPlane(Origin=pt_5)
group_5 = Group(Geometry=mesh_5)

# ----
# Make linear and angular velocity computation
c_linear_angular_velocity = CSharpScript(R=radius_of_curvature, T=trackwidth, WB=wheelbase, WD=wheeldia, V=linearvelocity)  # -> out, AV; inputs R: Double, T: Double, WB: Double, WD: Double, V: Double
# ---------- c_linear_angular_velocity: C# ----------
// Grasshopper Script Instance
#region Usings
using System;
using System.Linq;
using System.Collections;
using System.Collections.Generic;
using System.Drawing;

using Rhino;
using Rhino.Geometry;

using Grasshopper;
using Grasshopper.Kernel;
using Grasshopper.Kernel.Data;
using Grasshopper.Kernel.Types;
#endregion

public class Script_Instance : GH_ScriptInstance
{
    #region Notes
    /* 
      Members:
        RhinoDoc RhinoDocument
        GH_Document GrasshopperDocument
        IGH_Component Component
        int Iteration

      Methods (Virtual & overridable):
        Print(string text)
        Print(string format, params object[] args)
        Reflect(object obj)
        Reflect(object obj, string method_name)
    */
    #endregion

    private void RunScript(
		double R,
		double T,
		double WB,
		double WD,
		double V,
		ref object AV)
    {
        List<double> wheelVelocity = new List<double>();
        double av_fl = (V/R)*(Math.Sqrt((Math.Pow(R+T,2))+(Math.Pow(WB/2,2)))/WD);
        wheelVelocity.Add(av_fl);
        double av_fr = (V/R)*(Math.Sqrt((Math.Pow(R-T,2))+(Math.Pow(WB/2,2)))/WD);
        wheelVelocity.Add(av_fr);
        double av_rl = (V/R)*(Math.Sqrt((Math.Pow(R+T,2))+(Math.Pow(WB/2,2)))/WD);
        wheelVelocity.Add(av_rl);
        double av_rr = (V/R)*(Math.Sqrt((Math.Pow(R-T,2))+(Math.Pow(WB/2,2)))/WD);
        wheelVelocity.Add(av_rr);

        AV = wheelVelocity;
    }
}
# ---------- end c_linear_angular_velocity ----------

# ----
# Dual Ackerman Solver
c_ackerman = CSharpScript(c=crv_2, p=number_slider, wb=wheelbase, t=trackwidth)  # -> out, rotList; inputs c: Curve, p: Double, wb: Double, t: Double
#   port c: Path for the Mobile Robot
#   port wb: Wheelbase in mm of the Mobile Robot
#   port t: Track Width in mm for the Mobile Robot
# ---------- c_ackerman: C# ----------
// Grasshopper Script Instance
#region Usings
using System;
using System.Linq;
using System.Collections;
using System.Collections.Generic;
using System.Drawing;

using Rhino;
using Rhino.Geometry;

using Grasshopper;
using Grasshopper.Kernel;
using Grasshopper.Kernel.Data;
using Grasshopper.Kernel.Types;
#endregion

public class Script_Instance : GH_ScriptInstance
{
    #region Notes
    /* 
      Members:
        RhinoDoc RhinoDocument
        GH_Document GrasshopperDocument
        IGH_Component Component
        int Iteration

      Methods (Virtual & overridable):
        Print(string text)
        Print(string format, params object[] args)
        Reflect(object obj)
        Reflect(object obj, string method_name)
    */
    #endregion
    /*
    This component takes
    */

    private void RunScript(
		Curve c,
		double p,
		double wb,
		double t,
		ref object rotList)
    {
        // Make a List holder for angles for the 
        List<double> rotAngles = new List<double>();
        List<double> allZero = new List<double>{0,0,0,0};
        /*

        double lengthC = c.GetLength();
        double parameter = p*lengthC;
        */
        c.Domain = new Interval(0,1);
        Vector3d curvature = c.CurvatureAt(p);
        double curvatureLength = curvature.Length;
        Print(""+curvatureLength);


        if (curvatureLength == 0){
            Print("All wheel Zero");
            rotList = allZero;
        }
        else{
            
            /*
            Finding the radius of curvate at any given point of a curve
            It is the inverse of the Length of the Curvature Vector.
            */
            double RadCurvature = 1/curvatureLength;

            //Change the precision for faster computation
            double r = Math.Round(RadCurvature,3);
            Print("Radius of Curvature="+ r);

            /*
            Calculate the orientation of the front wheels
            As the wheel position is symmertric then the same values will be used
            for the back wheels too
            */
            double fLAngle = Math.Atan((wb/2)/(r+t/2));
            double fRAngle = Math.Atan((wb/2)/(r-t/2));

            /*
            Calculate the direction in which the wheel will turn based on the curvature of the path
            */
            //Create two vectors to store the tangent and the accelaration
            Vector3d tangent, accel;
            Vector3d[] derriv= c.DerivativeAt(p,2);
            //Compute the Vectors    
            tangent = derriv[1];
            tangent.Unitize();

            accel = derriv[2];
            accel.Unitize();

            // Create the vector whose sign of the Z-Component decides the rotation direction of the wheels
            Vector3d signVector = Vector3d.CrossProduct(tangent,accel);     

            double sign = Math.Sign(signVector.Z);

            // Apply the sign of rotation to the wheel angles
            double fL = sign * fLAngle;
            double fR = sign * fRAngle;
            double rL = -sign * fLAngle;
            double rR = -sign * fRAngle;
            
            rotAngles.Add(fL);
            rotAngles.Add(fR);
            rotAngles.Add(rL);
            rotAngles.Add(rR);
            
            rotList = rotAngles;
            
            
        }
        
        
    }
}
# ---------- end c_ackerman ----------
item = ListItem(List=c_ackerman.rotList, Index=0, Wrap=True)  # -> Item, Item1, Item2, Item3
robot_front_left_motor_wheel_joint = Panel(item.Item)
robot_front_right_motor_wheel_joint = Panel(item.Item1)
robot_back_left_motor_wheel_joint = Panel(item.Item2)
robot_back_right_motor_wheel_joint = Panel(item.Item3)

# ---- group: Dubins Curve from a PlugIn
pt_6 = Point(<point referenced from the Rhino model>)
pt_7 = Point(<point referenced from the Rhino model>)
pt_8 = Point(<point referenced from the Rhino model>)
pt_9 = Point(<point referenced from the Rhino model>)
vec2pt = Vector2Pt(PointA=pt_8, PointB=pt_9, Unitize=False)  # -> unitize(Vector), Length
vec2pt_2 = Vector2Pt(PointA=pt_6, PointB=pt_7, Unitize=False)  # -> unitize(Vector), Length
vdisex = VectorDisplayEx(Point=pt_6, Vector=expr("x*1000", vec2pt_2.Vector), Colour=RGB(0, 0, 0), Width=2)
vdisex_2 = VectorDisplayEx(Point=pt_8, Vector=expr("x*1000", vec2pt.Vector), Colour=RGB(0, 0, 0), Width=2)
list = ValueList({"LR": 0, "RL": 1, "RR": 2, "LL": 3, "Shortest": 4}, selected="Shortest")
dubinscsc = DubinsCSC(
    Point1=pt_6,
    Direction1=vec2pt_2.Vector,
    Radius=radius_of_curvature,
    Point2=pt_8,
    Direction2=vec2pt.Vector,
    Radius_2=radius_of_curvature)  # -> Shortest, CurveLR, CurveRL, CurveRR, CurveLL
filter = StreamFilter(
    Gate=list,
    Stream0=dubinscsc.CurveLR,
    Stream1=dubinscsc.CurveRL,
    Stream2=dubinscsc.CurveRR,
    Stream3=dubinscsc.CurveLL,
    Stream4=dubinscsc.Shortest)
previewlw = CustomPreviewLineweights(Geometry=filter, Shader=ColourSwatch(SwatchColor=RGB(0, 102, 255)), Thickness=3, Absolute=False)

# ----
entwine = Entwine(
    Branch00=xy,
    Branch01=group,
    Branch02=xy_5,
    Branch03=group_4,
    Branch04=xy_2,
    Branch05=group_2,
    Branch06=xy_6,
    Branch07=group_5,
    Branch08=group_3,
    Branch09=xy_3,
    FlattenInputs=True)
hframe = HorizontalFrame(Curve=reparameterize(crv_2), Parameter=number_slider)
panel = Panel(c_ackerman.out)
pflip = FlipPlane(Plane=hframe, ReverseX=False, ReverseY=Toggle(True), SwapAxes=Toggle(True))
orient = Orient(Geometry=entwine, Source=xy_4, Target=pflip)  # -> Geometry, Transform
bang = ExplodeTree(Data=orient.Geometry)  # -> Branch0, Branch1, Branch2, Branch3, Branch4, Branch5, Branch6, Branch7, Branch8, Branch9
pln = Plane(bang.Branch0)
grp = Group(bang.Branch1)
pln_2 = Plane(bang.Branch2)
grp_2 = Group(bang.Branch3)
pln_3 = Plane(bang.Branch4)
grp_3 = Group(bang.Branch5)
pln_4 = Plane(bang.Branch6)
grp_4 = Group(bang.Branch7)
grp_5 = Group(bang.Branch8)

# ---- group: Lines and Curves of Simulated Data
curvature = Curvature(Curve=reparameterize(crv_2), Parameter=number_slider)  # -> P, K, C
darc = DeconstructArc(Arc=curvature.C)  # -> BasePlane, Radius, Angle
expression = Expression(x=darc.Radius, y=trackwidth, Expression="x-(y/2)")
expression_2 = Expression(x=darc.Radius, y=trackwidth, Expression="x+(y/2)")
ln = Line(StartPoint=darc.BasePlane, EndPoint=pln)
ln_2 = Line(StartPoint=darc.BasePlane, EndPoint=pln_2)
ln_3 = Line(StartPoint=darc.BasePlane, EndPoint=pln_3)
ln_4 = Line(StartPoint=darc.BasePlane, EndPoint=pln_4)
panel_2 = Panel("""40
25""")
cir = Circle(Plane=darc.BasePlane, Radius=expression)
cir_2 = Circle(Plane=darc.BasePlane, Radius=expression_2)
dash = DashPattern(Curve=[ln, ln_2, ln_3, ln_4], Pattern=panel_2)  # -> Dashes, Gaps
ln_5 = Line(StartPoint=curvature.P, EndPoint=darc.BasePlane)
previewlw_2 = CustomPreviewLineweights(Geometry=ln_5, Shader=ColourSwatch(SwatchColor=RGB(255, 255, 255)), Thickness=2, Absolute=False)

# ---- group: Simulated Geometries
item_2 = ListItem(List=c_ackerman.rotList, Index=0, Wrap=True)  # -> Item, Item1, Item2, Item3
rotate = Rotate(Geometry=grp_2, Angle=item_2.Item1, Plane=pln_2)  # -> Geometry, Transform
rotate_2 = Rotate(Geometry=grp, Angle=item_2.Item, Plane=pln)  # -> Geometry, Transform
rotate_3 = Rotate(Geometry=grp_4, Angle=item_2.Item3, Plane=pln_4)  # -> Geometry, Transform
rotate_4 = Rotate(Geometry=grp_3, Angle=item_2.Item2, Plane=pln_3)  # -> Geometry, Transform
preview = CustomPreview(
    Geometry=[rotate_2.Geometry, rotate.Geometry, rotate_4.Geometry, rotate_3.Geometry],
    Material=ColourSwatch(SwatchColor=RGB(74, 74, 74)))
preview_2 = CustomPreview(Geometry=grp_5, Material=ColourSwatch(SwatchColor=RGB(156, 156, 156)))
