# Grasshopper definition example_mobile_robot_mapping_navigation.gh (Grasshopper 1.0.7)
# plug-ins: Volvox

get = Button()
get_map = GhPythonScript(get=get)  # -> out, robot_map
# ---------- get_map: Python ----------
import roslibpy
from roslibpy import Topic, Service
from compas_fab.backends import RosClient
import time
from scriptcontext import sticky as st

client = roslibpy.Ros(host='192.168.0.200', port=9090)

class RobotMap(object):
    def __init__(self, ros_client=None):
        self.occupancy_grid = None
        self.client = ros_client
        self.service = Service(self.client, '/robot/static_map', 'nav_msgs/GetMap')

    def get_from_ros(self):
        request = roslibpy.ServiceRequest()
        print('Trigerring Get Map service...')
        result = self.service.call(request)
        self.occupancy_grid = result['map']
        print('Service completed.')

if get:
    robot_map = RobotMap(client)
    robot_map.client.run()
    robot_map.get_from_ros()
    st['robot_map'] = robot_map

robot_map = st['robot_map']
# ---------- end get_map ----------
rec = DataRecorder(get_map.out, DataLimit=-10, RecordData=True)
panel = Panel(rec)
visualize = GhPythonScript(robot_map=get_map.robot_map)  # -> out, pointcloud, color_values
# ---------- visualize: Python ----------
from Rhino.Geometry import PointCloud, Point3d

# The map resolution [m/cell]
resolution = robot_map.occupancy_grid['info']['resolution']
# Map width [cells]
width = robot_map.occupancy_grid['info']['width']
# Map height [cells]
height = robot_map.occupancy_grid['info']['height']
# The origin of the map [m, m, rad].  This is the real-world pose of the cell (0,0) in the map.
origin = Point3d(robot_map.occupancy_grid['info']['origin']['position']['x'],robot_map.occupancy_grid['info']['origin']['position']['y'],robot_map.occupancy_grid['info']['origin']['position']['z'])
# Occupancy values.
occupancies = robot_map.occupancy_grid['data']

points = []
pointcloud = PointCloud()
color_values = []

for key, occupancy in enumerate(occupancies):
    if occupancy != -1:
        color_values.append(occupancy)
        point_y = (key % height) * resolution + origin.Y + (resolution / 2)
        point_x = (key // width) * resolution + origin.X + (resolution / 2)
        pointcloud.Add(Point3d(point_x, point_y, 0))
#        points.append(Point3d(point_x, point_y, 0))
# ---------- end visualize ----------
gradient = Gradient(LowerLimit=0, UpperLimit=100, Parameter=visualize.color_values, stops=[0: RGB(255, 255, 255), 1: RGB(0, 0, 0)])
clo = Cloud(visualize.pointcloud)
data = Data(["Grasshopper.Kernel.Types.GH_ObjectWrapper", "Grasshopper.Kernel.Types.GH_ObjectWrapper", "Grasshopper.Kernel.Types.GH_ObjectWrapper", "Grasshopper.Kernel.Types.GH_ObjectWrapper", "Grasshopper.Kernel.Types.GH_ObjectWrapper", "Grasshopper.Kernel.Types.GH_ObjectWrapper"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])
adddata = AddData()
preview = CustomPreview(Material=gradient)
