# Grasshopper definition am_model_clay_formwork.ghx (Grasshopper 1.0.7)

# ----
# Base Curve
number_slider = Slider(0.085, range=0..1)
base_curve = GhPythonScript(
    out_crc_dist=Slider(0.25, range=0..1),
    out_crc_radius=number_slider,
    inner_crc_dist=Slider(0.3, range=0..1),
    rebar_offset=Slider(0.23, range=0..1),
    rebar_size=Slider(0.006, range=0..0.01))  # -> out, base_crv, base_crv_tstart, rebar_crv
# ---------- base_curve: Python ----------
import math
import Rhino.Geometry as rg
import rhinoscriptsyntax as rs
import ghpythonlib.components as ghcomp
from compas.geometry import Frame
from compas.geometry import Vector

out_crc_pts = []
in_crc_pts = []
rb_crc_pts = []
for i in range(3):
    pt_outer_crc = [out_crc_dist*math.cos(i*2*math.pi/3), out_crc_dist*math.sin(i*2*math.pi/3),0]
    out_crc_pts.append(rg.Point3d(*pt_outer_crc))
    pt_inner_crc = [inner_crc_dist*math.cos(i*2*math.pi/3+(1/3)*math.pi), inner_crc_dist*math.sin(i*2*math.pi/3+(1/3)*math.pi),0]
    in_crc_pts.append(rg.Point3d(*pt_inner_crc))
    pt_rebar = [rebar_offset*math.cos(i*2*math.pi/3), rebar_offset*math.sin(i*2*math.pi/3),0]
    rb_crc_pts.append(rg.Point3d(*pt_rebar))

out_crcs = [rg.Circle(pt, out_crc_radius) for pt in out_crc_pts]
rebar_crv = [rg.Circle(pt, rebar_size/2) for pt in rb_crc_pts]

lines1= [rg.Line(out_crc_pts[i], in_crc_pts[i]) for i in range(len(out_crc_pts))]
lines2= [rg.Line(out_crc_pts[i], in_crc_pts[i-1]) for i in range(len(out_crc_pts))]

int_pts = ghcomp.CurveXLine(out_crcs, lines1)[0]
vecs = [rg.Line(in_crc_pts[i], int_pts[i*2]) for i in range(3)]
in_crcs = [rg.Circle(pt, vecs[0].Length) for pt in in_crc_pts]

lines = lines1+lines2
bsrf = ghcomp.BoundarySurfaces(lines)

split_out_crc = ghcomp.SplitwithBrep(out_crcs, bsrf)[0]
split_in_crc = ghcomp.SplitwithBrep(in_crcs, bsrf)[0]
split_out_crc_len = ghcomp.Length(split_out_crc)
split_in_crc_len = ghcomp.Length(split_in_crc)

out_crc_segs = ghcomp.SortList(split_out_crc_len, split_out_crc)[1]
in_crc_segs = ghcomp.SortList(split_in_crc_len, split_in_crc)[1]

crv_segs = []
for i in range(3):
    crv_segs.append(out_crc_segs[i+3])
    crv_segs.append(in_crc_segs[i])

base_crv_raw = ghcomp.JoinCurves(crv_segs, False)
base_crv = ghcomp.OffsetCurve(base_crv_raw, 0.01,corners=0)
base_crv_tstart = ghcomp.CurveClosestPoint(rg.Point3d(out_crc_dist+out_crc_radius,0,0), base_crv)[1]
# ---------- end base_curve ----------
crv = Curve(base_curve.rebar_crv)
crv_2 = Curve(base_curve.base_crv)
dam = DataDam(
    DataBase_crv=crv_2,
    DataBase_crv_tstart=base_curve.base_crv_tstart,
    DataRebar_crv=crv,
    BufferDelay=10000000,
    BufferMode=0)  # -> DataBase_crv, DataBase_crv_tstart, DataRebar_crv

# ----
# Segment width inputs
number_slider_2 = Slider(15, range=0..30)
expression = Expression(a=Slider(4, range=0..10), b=number_slider_2, Expression="a/b")
expression_2 = Expression(a=Slider(1, range=0..10), b=Slider(3, range=0..10), Expression="a/b")

# ----
# Offset input
number_slider_3 = Slider(0, range=-1..1)

# ----
# Silhouette
number_slider_4 = Slider(0.5, range=0..1)
pi = Pi(Factor=0.5)
pi_2 = Pi(Factor=1.5)
dom = ConstructDomain(DomainStart=number_slider_4, DomainEnd=Slider(1, range=0..10))
layers = GhPythonScript(
    base_crv=dam.DataBase_crv,
    rebar_crv=dam.DataRebar_crv,
    height=Slider(2, range=0..10),
    layer_height=Slider(0.005, range=0..0.01),
    phase=pi,
    wave_length=pi_2,
    domain=dom)  # -> out, base_crvs, rebar_crvs; inputs base_crv: Curve, rebar_crv: list of Curve
# ---------- layers: Python ----------
import math
import Rhino.Geometry as rg
import rhinoscriptsyntax as rs
import ghpythonlib.components as ghcomp
from compas.geometry import Frame
from compas.geometry import Vector

transformations = []
scaling = []
count = int(height/layer_height)
for i in range(count):
    transformations.append(rg.Vector3d(0,0,i*layer_height))
    scaling.append(math.sin(phase+i*(wave_length/count)))
dom_sin = ghcomp.ConstructDomain(-1,1)
dom_new = ghcomp.ConstructDomain(domain[0],domain[1])
rmscaling = ghcomp.RemapNumbers(scaling, dom_sin, dom_new)[0]

ncrvs = ghcomp.Move(base_crv, transformations)[0]
base_crvs = ghcomp.Scale(ncrvs, transformations, rmscaling)[0]

rb_transformations = [[t, t, t] for t in transformations]
rb_transformations = [t for tl in rb_transformations for t in tl]
rb_scaling = [[s, s, s] for s in rmscaling]
rb_scaling = [s for sub in rb_scaling for s in sub]
rbcrvs = [rebar_crv for i in range(count)]
rbcrvs = [crv for sub in rbcrvs for crv in sub]
rcrvs = ghcomp.Move(rbcrvs, rb_transformations)[0]
rebar_crvs = ghcomp.Scale(rcrvs, rb_transformations, rb_scaling)[0]
# ---------- end layers ----------
crv_3 = Curve(layers.rebar_crvs)
partition = PartitionList(List=crv_3, Size=3)
flip = FlipMatrix(Data=partition)
loft = Loft(Curves=flip, Options={Adjust=False, Closed=False, LoftEnds=0, LoftSimp=0, LoftType=0, Rebuild=10, Refit=0.01})

# ---- group: Visualise
back = Button()
reset = Button()
start = Button()
stop = Button()
step = Button()
full = Button()
list = ValueList({"20", "50", "100", "500", "1000", "5000"}, selected="20")

# ----
# Size offset integration
len = Length(Curve=layers.base_crvs)

# ----
# Segmentation
number_slider_5 = Slider(0.016, range=0..0.1)
number_slider_6 = Slider(50, range=0..100)
number_slider_7 = Slider(6, range=0..10)

dom_2 = ConstructDomain(DomainStart=0, DomainEnd=number_slider_6)
subset = SubList(List=len, Domain=dom_2, Wrap=True)  # -> List, Index
avr = Average(Input=subset.List)
expression_3 = Expression(u_val=number_slider_7, avg=avr, offset=number_slider_3, Expression="offset/(avg/(u_val/2))")
subtraction = Subtraction(A=expression_2, B=expression_3)
addition = Addition(A=expression, B=expression_3)

python = GhPythonScript(
    base_crvs=layers.base_crvs,
    seg_lrs=number_slider_6,
    start_t=dam.DataBase_crv_tstart,
    wave_length=number_slider_5,
    layer_width=Slider(0.006, range=0..0.1),
    u_val=number_slider_7,
    min_seg_width_0=subtraction,
    min_seg_width_1=addition)  # -> out, curve_segments, crvs_pars, crvs_pts, ond_segs, norm_segs; inputs base_crvs: list of Curve, u_val: Int32
# ---------- python: Python ----------
__author__ = "Gido"
__version__ = "2022.01.16"
import ghpythonlib.components as ghcomp
import Rhino.Geometry as rg
import rhinoscriptsyntax as rs
import math

crvs_pts = []
crvs_new = []
ond_segs = []
norm_segs = []

def segment_range(start, stop, step):
    count = 0
    while True:
        temp = float(start + count * step)
        if temp > stop:
            break
        yield temp
        count += 1 

def segment_range_loop(start, domain, div):
    step = (domain[1]-domain[0])/div
    count = 0
    while True:
        temp = float(start + count * step)
        if count == div:
            break
        if temp > domain[1]:
            temp -= domain[1]
            temp += domain[0]
        elif temp < domain[0]:
            temp += domain[1]
            temp -= domain[0]
        yield temp
        count += 1 

max_seg_width_0 = 1-min_seg_width_0
max_seg_width_1 = 1-min_seg_width_1

for key, crv in enumerate(base_crvs):
    new_par = start_t
    crv_len = ghcomp.Length(crv)
    crv_dom = ghcomp.CurveDomain(crv)[1]
    
    ### Create segmentation points
    m = key % (2*seg_lrs)
    if m < seg_lrs:
        crv_s0 = ((crv_len*min_seg_width_0)/(u_val/2))+((crv_len*(max_seg_width_1-min_seg_width_0))/(u_val/2)/seg_lrs)*m
    else:
        crv_s0 = ((crv_len*max_seg_width_1)/(u_val/2))-((crv_len*(max_seg_width_1-min_seg_width_0))/(u_val/2)/seg_lrs)*(m%seg_lrs)
    crv_s1 = (crv_len/(u_val/2))-crv_s0
    
    crv_inc_ts = []
    for i in range(u_val):
        if i == 0:
            inc_t = crv_s0/2
        elif i % 2 == 0:
            inc_t = crv_s0
        else:
            inc_t = crv_s1
        crv_inc_ts.append(inc_t)
    len_dom = ghcomp.ConstructDomain(0,crv_len)
    dpars = ghcomp.RemapNumbers(value = crv_inc_ts,
                                source = len_dom,
                                target = crv_dom)[0]
                                
    crv_pars = []
    for dpar in dpars:
        new_par += (dpar - crv_dom[0])
        if new_par > crv_dom[1]:
            new_par = new_par - crv_dom[1] + crv_dom[0]
        crv_pars.append(new_par)
    
    pts = ghcomp.EvaluateCurve(crv, crv_pars)[0]
    crvs_pts.extend(pts)
    
    ### Apply wave to crv globally
    crv_div = ghcomp.Round(crv_len/(wave_length*9))["nearest"]*9
    Ty = [math.sin(((j%4)*2*math.pi/4)+(key%2)*math.pi) for j in range(crv_div*4)]
    crv_range = segment_range_loop(crv_pars[0], crv_dom, (crv_div*4))
    crv_range = list(crv_range)
    crv_range = ghcomp.SortList(crv_range, crv_range)[1]
    crvpts, crvtans, crvangs = ghcomp.EvaluateCurve(crv, crv_range)
    new_pts = []
    vecs = ghcomp.CrossProduct(crvtans, rg.Vector3d.ZAxis, True)[0]
    nvec = []
    for i, vec in enumerate(vecs):
        nvec.append(rg.Vector3d(vec[0]*Ty[i]*layer_width,vec[1]*Ty[i]*layer_width,vec[2]))
    new_pts = ghcomp.Move(crvpts, nvec)[0]
    new_pts.append(new_pts[0])
    crvs_new.append(ghcomp.Interpolate(new_pts,3,False,0)[0])
    crv_new_dom = ghcomp.CurveDomain(crvs_new[key])[1]
    
    ### Segmentize the wavy curve
    cut_planes = ghcomp.PerpFrame(crv, crv_pars)
    new_crv_pars = []
    for cp in cut_planes:
        new_par = ghcomp.CurveXPlane(crvs_new[key], cp)[1]
        parpts = ghcomp.EvaluateCurve(crvs_new[key], new_par)[0]
        lvec = ghcomp.Vector2Pt(cp.Origin, parpts, False)[0]
        lvec_lens = ghcomp.VectorLength(lvec)
        if type(lvec_lens) == list:
            ind = lvec_lens.index(min(ghcomp.VectorLength(lvec)))
        else:
            new_par = [new_par]
            ind = 0
        new_crv_pars.append(new_par[ind])

    curve_segments = ghcomp.Shatter(crvs_new[key], new_crv_pars)
    print len(curve_segments)
    
    ### Combine segment cut at curve start (NO LONGER NECCESARY)
    if len(curve_segments) > 6:
        seg_lens = ghcomp.Length(curve_segments)
        new_segs = [0]*6
        min_len = min(seg_lens)
        shift = True
        
        if seg_lens.index(min_len) == 0:
            crv_cp6 = ghcomp.ControlPoints(curve_segments[6])[0]
            crv_cp0 = ghcomp.ControlPoints(curve_segments[0])[0]
            new_segs[5] = ghcomp.Interpolate(crv_cp6+crv_cp0,3,False,0)[0]
            shift = True
        elif seg_lens.index(min_len) == 6:
            crv_cp6 = ghcomp.ControlPoints(curve_segments[6])[0]
            crv_cp0 = ghcomp.ControlPoints(curve_segments[0])[0]
            new_segs[0] = ghcomp.Interpolate(crv_cp6+crv_cp0,3,False,0)[0]
            shift = True
        else:
            crv_cpn = ghcomp.ControlPoints(curve_segments[seg_lens.index(min_len)])[0]
            crv_cpn1 = ghcomp.ControlPoints(curve_segments[seg_lens.index(min_len)-1])[0]
            new_segs[seg_lens.index(min_len)] = ghcomp.Interpolate(crv_cpn+crv_cpn1,3,False,0)[0]
            shift = True
        
        for i in range(5):
            if seg_lens.index(min_len) == 6:
                new_segs[i+1] = curve_segments[i+1] 
            elif seg_lens.index(min_len) == 0:
                new_segs[i] = curve_segments[i+1] 
            else:
                if i >= seg_lens.index(min_len)-1:
                    k = i+1
                else:
                    k = i
                new_segs[k] = curve_segments[k]
    
    ### FOR 6 SEGMENTS
    else:
        new_segs = curve_segments
        if key != 0:
            seg0start = ghcomp.EndPoints(curve_segments[0])[0]
            segn1start = ghcomp.EndPoints(ond_segs[(key-1)*u_val])[0]
            dvec = ghcomp.Vector2Pt(seg0start, segn1start, False)
            if dvec.length > 0.025:
                shift = True
            else:
                shift = False
        else:
            shift = False
    new_segs = ghcomp.ShiftList(new_segs, -shift, True)
    ond_segs.extend(new_segs)

    new_norm_segs = ghcomp.Shatter(crv, crv_pars)
    if key != 0:
        seg0start = ghcomp.EndPoints(new_norm_segs[0])[0]
        segn1start = ghcomp.EndPoints(norm_segs[(key-1)*u_val])[0]
        dvec = ghcomp.Vector2Pt(seg0start, segn1start, False)
        if dvec.length > 0.025:
            shift = True
        else:
            shift = False
    else:
        shift = False
    new_norm_segs = ghcomp.ShiftList(new_norm_segs, -shift, True)
    norm_segs.extend(new_norm_segs)
#    segs_off = ghcomp.OffsetCurve(curve = segs_unw,
#                                  distance = 0.01,
#                                  corners = 0)

# ------------------------------------------------------------------------------------------------
#    crvs_segs.extend(segs_off)
#    di_crv = 0
#    for seg in curve_segments:
#        seg_off = ghcomp.OffsetCurve(curve = seg,
#                                     distance = 0.01,
#                                     corners = 0)
#        crvs_new.extend([seg, seg_off])
#        seg_len = ghcomp.Length(seg)
#        seg_div = ghcomp.Round(seg_len/wave_length)["nearest"]
##        Ty = [math.sin(((i%4)*2*math.pi/4)+(key%2)*math.pi) for i in range(1+seg_div*4)]
#        rp_seg, seg_dom = ghcomp.CurveDomain(seg)
#        seg_range = segment_range(seg_dom[0], seg_dom[1], (seg_dom[1]-seg_dom[0])/(seg_div*4))
#        segpts, segtans, segangs = ghcomp.EvaluateCurve(seg, seg_range)
#        new_pts = []
#        vecs = ghcomp.CrossProduct(segtans, rg.Vector3d.ZAxis, True)[0]
#        nvec = []
#        for i, vec in enumerate(vecs):
#            nvec.append(rg.Vector3d(vec[0]*Ty[di_crv+i]*layer_width,vec[1]*Ty[di_crv+i]*layer_width,vec[2]))
#        new_pts = ghcomp.Move(segpts, nvec)[0]
#        di_crv += seg_div
#        segs_new.append(ghcomp.Interpolate(new_pts, 3, False, 1)[0])
#    print di_crv
# ---------- end python ----------
pt = Point(python.crvs_pts)
crv_4 = Curve(python.ond_segs)

crv_5 = Curve(python.curve_segments)
crv_6 = Curve(python.norm_segs)
dam_2 = DataDam(DataA=crv_4, DataB=crv_6, BufferDelay=10000000, BufferMode=0)  # -> DataA, DataB

# ----
# AM Model
number_slider_8 = Slider(0.005, range=-1..1)
speed = Slider(8000, range=0..51200)
ind = Slider(5, range=0..30)
pt_2 = ConstructPoint(XCoordinate=0, YCoordinate=0, ZCoordinate=Slider(-0.02, range=-0.1..0.01))
list_2 = ValueList({"Full", "Segment"}, selected="Segment")
xy = XYPlane(Origin=pt_2)
ammodel = GhPythonScript(
    output=list_2,
    tangential_z=Toggle(False),
    rotation_z=Slider(5, range=-45..45),
    ond_segs=dam_2.DataA,
    norm_segs=dam_2.DataB,
    div_length=Slider(0.004, range=0..0.1),
    ind_current_seg=ind,
    trim_left=Slider(10, range=0..30),
    trim_right=Slider(4, range=0..30),
    offset_left_bot=Slider(0.005, range=-1..1),
    offset_right_bot=number_slider_8,
    fade_to_top=Toggle(True),
    ext_speed=speed,
    create=Toggle(True),
    cp=xy)  # -> out, current_seg, fab_norm_segs, fab_ond_segs, am_model; inputs ond_segs: list of Curve, norm_segs: list of Curve, ind_current_seg: Int32
# ---------- ammodel: Python ----------
__author__ = "Gido"
__version__ = "2022.01.27"
import math

from am_information_model import AMModel
from am_information_model import Layer
from am_information_model import Node

from compas.geometry import Frame
from compas.geometry import Transformation
from compas.geometry import Rotation
from compas.geometry import Vector

from scriptcontext import sticky as st
import rhinoscriptsyntax as rs
import Rhino.Geometry as rg
import ghpythonlib.components as ghcomp

if "am_model" not in st:
    st["am_model"] = None

hseq = [5,1,3,4,0,2]
vseq = [50]*3+[100]*21+[50]*3

ct = int(len(ond_segs)/len(hseq))
h_ond_segs = [[]]*ct
h_norm_segs = [[]]*ct
for u in range(ct):
    h_ond_segs[u] = ond_segs[u*len(hseq):(u+1)*len(hseq)]
    h_norm_segs[u] = norm_segs[u*len(hseq):(u+1)*len(hseq)]

h_ond_segs = map(list, zip(*h_ond_segs))
h_norm_segs = map(list, zip(*h_norm_segs))

fab_ond_segs = [[]]*len(vseq)
fab_norm_segs = [[]]*len(vseq)
for v in range(len(vseq)):
    hsind = hseq[v%6]
    vsind = int((v-v%6)/6)
    if vsind > 0:
        dom_start = 0
        for i in range(vsind):
            dom_start += vseq[i*6+v%6]
    else:
        dom_start = 0
    fab_ond_segs[v] = h_ond_segs[hsind][dom_start:dom_start+vseq[v]]
    fab_norm_segs[v] = h_norm_segs[hsind][dom_start:dom_start+vseq[v]]

current_seg = fab_ond_segs[ind_current_seg] + fab_norm_segs[ind_current_seg]

if create and output=="Segment":
    am_model = AMModel()
    fab_norm_seg = fab_norm_segs[ind_current_seg]
    fab_norm_mid = ghcomp.CurveMiddle(fab_norm_seg)
    if tangential_z:
        zvecs = ghcomp.Vector2Pt(fab_norm_mid[0:len(fab_norm_mid)-1], fab_norm_mid[1:len(fab_norm_mid)], True)[0]
        zvecs.append(zvecs[-1])
    else:
        zvecs = [rg.Vector3d.ZAxis]*len(fab_norm_seg)
    fab_seg = fab_ond_segs[ind_current_seg]
    for i, seg in enumerate(fab_seg):
#        seg_end_pts = ghcomp.EndPoints(fab_norm_seg[i])
#        seg_off_left_bot = ghcomp.OffsetCurve(fab_norm_seg[i], -offset_left_bot+(offset_left_bot/len(fab_seg))*i, corners=0)
#        seg_off_right_bot = ghcomp.OffsetCurve(fab_norm_seg[i], -offset_right_bot+(offset_right_bot/len(fab_seg))*i, corners=0)
#        seg_off_left_bot_end_pts = ghcomp.EndPoints(seg_off_left_bot) 
#        seg_off_right_bot_end_pts = ghcomp.EndPoints(seg_off_right_bot) 
#        vec_off_left = ghcomp.Vector2Pt(seg_end_pts[0], seg_off_left_bot_end_pts[0], False)[0]
#        vec_init = Vector.from_start_end(seg_end_pts[0], seg_end_pts[1])
#        vec_off_right = Vector.from_start_end(seg_off_left_bot_end_pts[0], seg_off_right_bot_end_pts[1])
#        angle_correction = vec_init.angle_signed(vec_off_right, Vector.Zaxis())
        
#        seg_off_left = ghcomp.Move(seg, vec_off_left)[0]
#        seg_corr = ghcomp.Rotate3D(seg_off_left, angle_correction, seg_off_left_bot_end_pts[0], rg.Vector3d.ZAxis)[0]
        
        mid_plane = ghcomp.PerpFrame(fab_norm_seg[i], ghcomp.CurveClosestPoint(fab_norm_mid[i], fab_norm_seg[i])[1])
        cvec = ghcomp.Vector2Pt(mid_plane.Origin, rg.Plane.WorldXY.Origin, True)[0]
        
        if cvec[0]/abs(cvec[0]) == mid_plane.XAxis[0]/abs(mid_plane.XAxis[0]):
            xvec = mid_plane.XAxis
        else:
            xvec = -mid_plane.XAxis
        
        seg_end_pts = ghcomp.EndPoints(fab_norm_seg[i])
        vec_init = Vector.from_start_end(seg_end_pts[0], seg_end_pts[1])
        
        if fade_to_top:
            offset_left = (-offset_left_bot+(offset_left_bot/len(fab_seg))*i)
            offset_right = (-offset_right_bot+(offset_right_bot/len(fab_seg))*i)
        else:
            offset_left = -offset_left_bot
            offset_right = -offset_right_bot
        
        seg_off_left = ghcomp.Move(seg, xvec*offset_left)[0]
        norm_seg_off_left = ghcomp.Move(fab_norm_seg[i], xvec*offset_left)[0]
        norm_seg_off_left_bot_end_pts = ghcomp.EndPoints(norm_seg_off_left)
        
        pt_off_right = ghcomp.Move(seg_end_pts[1], xvec*offset_right)[0]
        vec_off_right = Vector.from_start_end(norm_seg_off_left_bot_end_pts[0], pt_off_right)
        angle_correction = vec_init.angle_signed(vec_off_right, Vector.Zaxis())
        print angle_correction
        
        seg_corr = ghcomp.Rotate3D(seg_off_left, angle_correction, norm_seg_off_left_bot_end_pts[0], rg.Vector3d.ZAxis)[0]
        
        seg_pts = ghcomp.DivideLength(seg_corr, div_length)[0]
        seg_np = len(seg_pts)
        norm_seg_tans = ghcomp.DivideCurve(fab_norm_seg[i], seg_np-1, False)[1]
        norm_seg_tans = ghcomp.UnitVector(norm_seg_tans)
        yvecs = ghcomp.CrossProduct(norm_seg_tans, zvecs[i], True)[0]
        nyvecs = []
        print len(norm_seg_tans), seg_np
        for k, yvec in enumerate(yvecs):
            nyvec = ghcomp.Rotate3D(yvec, math.radians(rotation_z), seg_pts[k], norm_seg_tans[k])[0]
            nyvecs.append(nyvec)
        layer = Layer()
        layer.mid_frame = Frame(fab_norm_mid[i], xvec, -mid_plane.ZAxis)
        if i%2==1:
            seg_pts.reverse()
            norm_seg_tans.reverse()
            nyvecs.reverse()
        for k, pt in enumerate(seg_pts):
            if i%2==0 and (k < trim_left or k>len(seg_pts)-trim_right):
                pass
            elif i%2==1 and (k < trim_right or k>len(seg_pts)-trim_left):
                pass
            else:
                frame = Frame(pt, norm_seg_tans[k], nyvecs[k])
#                R = Rotation.from_axis_and_angle(frame.zaxis, math.pi/6, frame.point)
#                frame.transform(R)
                node = Node(frame, 0.003)
                if k == len(seg_pts)-trim_right:
                    node.ext_state = 0
                    node.air_state = 1
                else:
                    node.ext_state = 1
                    node.air_state = 1
                node.ext_speed = ext_speed
                layer.add_node(node)
        am_model.add_layer(layer)

if create and output=="Full":
    am_model = AMModel()
    for j, fab_seg in enumerate(fab_ond_segs):
        fab_norm_seg = fab_norm_segs[j]
        fab_norm_mid = ghcomp.CurveMiddle(fab_norm_seg)
        zvecs = ghcomp.Vector2Pt(fab_norm_mid[0:len(fab_norm_mid)-1], fab_norm_mid[1:len(fab_norm_mid)], True)[0]
        zvecs.append(zvecs[-1])
        for i, seg in enumerate(fab_seg):
            seg_len = ghcomp.Length(seg)
            seg_np = int(seg_len/0.002)
            seg_pts = ghcomp.DivideCurve(seg, seg_np, False)[0]
            norm_seg_tans = ghcomp.DivideCurve(fab_norm_seg[i], seg_np, False)[1]
            norm_seg_tans = ghcomp.UnitVector(norm_seg_tans)
            yvecs = ghcomp.CrossProduct(norm_seg_tans, zvecs[i], True)[0]
            layer = Layer()
            mid_plane = ghcomp.PerpFrame(fab_norm_seg[i], ghcomp.CurveClosestPoint(fab_norm_mid[i], fab_norm_seg[i])[1])
            cvec = ghcomp.Vector2Pt(mid_plane.Origin, rg.Plane.WorldXY.Origin, True)[0]
            if cvec[0]/abs(cvec[0]) == mid_plane.XAxis[0]/abs(mid_plane.XAxis[0]):
                xvec = mid_plane.XAxis
            else:
                xvec = -mid_plane.XAxis
            layer.mid_frame = Frame(fab_norm_mid[i], xvec, -mid_plane.ZAxis)
            for k, pt in enumerate(seg_pts):
                if k < trim_left or k>len(seg_pts)-trim_right:
                    pass
                else:
                    frame = Frame(pt, norm_seg_tans[k], yvecs[k])
    #                R = Rotation.from_axis_and_angle(frame.zaxis, -math.pi/3, frame.point)
    #                frame.transform(R)
                    node = Node(frame, 0.003)
                    if k == len(seg_pts)-trim_right:
                        node.ext_state = 0
                        node.air_state = 1
                    else:
                        node.ext_state = 1
                        node.air_state = 1
                    node.ext_speed = ext_speed
                    layer.add_node(node)
            am_model.add_layer(layer)

if cp is not None and create:
    cf = Frame(cp.Origin, cp.XAxis, cp.YAxis)
    of = Frame([0,0,0],[1,0,0], [0,1,0])
    T = Transformation.from_frame_to_frame(of,cf)
    am_model_tf = am_model.transformed(T)
    st["am_model"] = am_model_tf
    
am_model = st["am_model"]
# ---------- end ammodel ----------
crv_7 = Curve(ammodel.current_seg)

# ----
# Scan Model
number_slider_9 = Slider(0.015, range=-0.1..0.1)
list_3 = ValueList({"TOP", "BOT", "NUM"}, selected="NUM")
scanning = GhPythonScript(
    output=list_3,
    layer_number=Slider(90, range=0..100),
    cp=xy,
    norm_segs=ammodel.fab_norm_segs,
    ind_current_seg=ind,
    offset_dist=number_slider_9,
    rotation_z=Slider(5, range=-45..45),
    create=Toggle(True))  # -> out, scan_model; inputs layer_number: Int32, norm_segs: list, ind_current_seg: Int32
# ---------- scanning: Python ----------
__author__ = "Gido"
__version__ = "2022.02.04"

import math
import rhinoscriptsyntax as rs
import Rhino.Geometry as rg
import ghpythonlib.components as ghcomp
from scriptcontext import sticky as st
from compas.geometry import Frame
from compas.geometry import Vector
from compas.geometry import Transformation

from am_information_model import AMModel
from am_information_model import Layer
from am_information_model import Node

if "scan_model" not in st:
    st["scan_model"] = None

div_len = 0.01

if create and output=="TOP":
    top_crv = norm_segs[ind_current_seg][-1]
    top_crv = ghcomp.Orient(top_crv, rg.Plane.WorldXY, cp)[0]
    off_crv_pos = ghcomp.OffsetCurve(top_crv, -offset_dist, corners=0)
    off_crv_neg = ghcomp.OffsetCurve(top_crv, offset_dist, corners=0)
    pts1, tans1, pars1 = ghcomp.DivideLength(top_crv, div_len)
    pts2, tans2, pars2 = ghcomp.DivideLength(off_crv_pos, div_len)
    pts3, tans3, pars3 = ghcomp.DivideLength(off_crv_neg, div_len)
#    pts2.reverse()
    pts3.reverse()
    
#    tans2.reverse()
    tans3.reverse()
    
    pts = pts2
    tans = tans2

#    start, end = ghcomp.EndPoints(top_crv)
#    scan_line = ghcomp.Line(start,end)
#    pts, tans, pars = ghcomp.DivideLength(scan_line, 0.005)
    scan_frames = []
    for i, pt in enumerate(pts):
        xvec = ghcomp.CrossProduct(tans[i], -rg.Vector3d.ZAxis, True)[0]
        nxvec = ghcomp.Rotate3D(xvec, math.radians(rotation_z), pt, tans[i])[0]
        scan_frames.append(Frame(pt, nxvec, tans[i]))
    scan_model = AMModel()
    nodes = [Node(frame, 0.005) for frame in scan_frames]
    nodes.extend(list(reversed(nodes)))
    layer = Layer.from_nodes(nodes)
    scan_model.add_layer(layer)
    st["scan_model"] = scan_model
    
if create and output=="BOT":
    bot_crv = norm_segs[ind_current_seg-6][-1]
    bot_crv = ghcomp.Orient(bot_crv, rg.Plane.WorldXY, cp)[0]
    off_crv_pos = ghcomp.OffsetCurve(bot_crv, -offset_dist, corners=0)
    off_crv_neg = ghcomp.OffsetCurve(bot_crv, offset_dist, corners=0)
    pts1, tans1, pars1 = ghcomp.DivideLength(bot_crv, div_len)
    pts2, tans2, pars2 = ghcomp.DivideLength(off_crv_pos, div_len)
    pts3, tans3, pars3 = ghcomp.DivideLength(off_crv_neg, div_len)
    pts2.reverse()
    pts3.reverse()
    
    tans2.reverse()
    tans3.reverse()
    
#    pts =  pts2 + pts1
#    tans = tans2 + tans1
    pts =  pts2
    tans = tans2
    scan_frames = []
    for i, pt in enumerate(pts):
        xvec = ghcomp.CrossProduct(tans[i], -rg.Vector3d.ZAxis, True)[0]
        nxvec = ghcomp.Rotate3D(xvec, math.radians(rotation_z), pt, tans[i])[0]
        scan_frames.append(Frame(pt, nxvec, tans[i]))
    scan_model = AMModel()
    nodes = [Node(frame, 0.005) for frame in scan_frames]
    nodes.extend(list(reversed(nodes)))
    layer = Layer.from_nodes(nodes)
    scan_model.add_layer(layer)
    st["scan_model"] = scan_model

if create and output=="NUM":
    num_crv = norm_segs[ind_current_seg][layer_number]
    num_crv = ghcomp.Orient(num_crv, rg.Plane.WorldXY, cp)[0]
    off_crv_pos = ghcomp.OffsetCurve(num_crv, offset_dist, corners=0)
    off_crv_neg = ghcomp.OffsetCurve(num_crv, -offset_dist, corners=0)
    pts1, tans1, pars1 = ghcomp.DivideLength(num_crv, div_len)
    pts2, tans2, pars2 = ghcomp.DivideLength(off_crv_pos, div_len)
    pts3, tans3, pars3 = ghcomp.DivideLength(off_crv_neg, div_len)
#    pts2.reverse()
#    pts3.reverse()
#    
#    tans2.reverse()
#    tans3.reverse()
    
    pts = pts2
    tans = tans2

#    start, end = ghcomp.EndPoints(num_crv)
#    scan_line = ghcomp.Line(start,end)
#    pts, tans, pars = ghcomp.DivideLength(scan_line, 0.005)
    scan_frames = []
    for i, pt in enumerate(pts):
        xvec = ghcomp.CrossProduct(tans[i], -rg.Vector3d.ZAxis, True)[0]
        nxvec = ghcomp.Rotate3D(xvec, math.radians(rotation_z), pt, tans[i])[0]
        scan_frames.append(Frame(pt, nxvec, tans[i]))
    scan_model = AMModel()
    nodes = [Node(frame, 0.005) for frame in scan_frames]
    nodes.extend(list(reversed(nodes)))
    layer = Layer.from_nodes(nodes)
    scan_model.add_layer(layer)
    st["scan_model"] = scan_model

scan_model = st["scan_model"]
# ---------- end scanning ----------

# ---- group: Visualise
# AM_Model Visualization
# 1. Visualise the entire assembly.
# 2. Visualise the assembly process by setting a counter and a speed.
counter = CountThroughList(am_model=ammodel.am_model, start=start, stop=stop, step=step, step_back=back, reset=reset, full=full, interval=list)  # -> item, counter; inputs start: Boolean, stop: Boolean, step_back: Boolean
# ---------- counter: Python ----------
from scriptcontext import sticky as st
from compas_ghpython import update_component


L = list(am_model.layers())
# store data in component
guid = str(ghenv.Component.InstanceGuid)
counter_key = "counter_" + guid
running_key = "running_" + guid

if counter_key not in st:
    st[counter_key] = 0

if running_key not in st:
    st[running_key] = False
    

if st[running_key]:
    if st[counter_key] < len(L) - 1:
        st[counter_key] += 1
        update_component(ghenv, interval)
    else:
        st[counter_key] = 0
        st[running_key] = False
    
    
if start:
    st[running_key] = True

if stop:
    st[running_key] = False

if step:
    if st[counter_key] < len(L) - 1:
        st[counter_key] += 1

if step_back:
    if st[counter_key] < len(L) - 1:
        st[counter_key] -= 1

if reset:
    st[counter_key] = 0

if full:
    st[counter_key] = len(L)-1

if len(L):
    item = L[st[counter_key]]



#st["visualisation_counter"] = st[counter_key]
counter = st[counter_key]
# ---------- end counter ----------
show = BooleanToggle(False)
show_2 = BooleanToggle(True)
draw = PythonScript(am_model=ammodel.am_model, show_all=show, show_counter=show_2, counter=Slider(30, range=0..100))  # -> G, tool_planes_WCS, current_tool_plane, current_layer_planes; inputs counter: Int32
# ---------- draw: Python ----------
import os
import sys

import math

from compas_ghpython.artists import MeshArtist
from compas_ghpython import draw_frame

#from assembly_information_model.artist import AssemblyArtist


G = []

key_index = am_model.network.key_index()
keys = [key_index[key] for key in am_model.network.nodes()]
layers = [am_model.layer(key) for key in keys] 

tool_planes_WCS = [draw_frame(layer.node(0).frame) for layer in layers]

current_tool_plane = tool_planes_WCS[counter]
current_layer_planes = [draw_frame(frame) for frame in layers[counter].path]

if show_all and not show_counter:
    for layer in layers:
        for key, node in layer.nodes():
            plane = draw_frame(node.frame)
            G.append(plane)

if show_counter:
    for layer in layers[0:counter+1]:
        for key, node in layer.nodes():
            plane = draw_frame(node.frame)
            G.append(plane)
# ---------- end draw ----------
idx = Panel(counter.counter)
pln = Plane(draw.current_tool_plane)
pln_2 = Plane(draw.current_layer_planes)
pln_3 = Plane(draw.tool_planes_WCS)  # disabled
geo = Geometry(draw.G)
preview = CustomPreview(Geometry=geo, Shader=ColourSwatch(SwatchColor=RGBA(255, 186, 220, 146)))

# ----
pline = PolyLine(Vertices=pln_2, Closed=False)
