# Grasshopper definition cooperative_extrusion_sketch.ghx (Grasshopper 1.0.7)

reload = Button()
panel = Panel("Unload libraries")
py = PythonScript(reload=reload)
# ---------- py: Python ----------
from compas_ghpython import unload_modules

if reload:
    unload_modules("compas")
    unload_modules("compas_fab")
    unload_modules("roslibpy")
    unload_modules("fabrication_control")
    unload_modules("assembly_information_model")
    unload_modules("am_information_model")
    unload_modules("ur_fabrication_control")
    unload_modules("mobile_robot_control")
    unload_modules("extruder_control")
# ---------- end py ----------

py_2 = PythonScript()  # -> repositories_path, rbvogui_data_path, ur_data_path
# ---------- py_2: Python ----------
import os

"""
ASSUMING THE BELOW PACKAGES ARE STORED IN THE SAME LOCATION:
    ur_fabrication_control;
    rbvogui_common; and
    mobile_additive_manufacturing.
"""

repositories_path = os.path.abspath(os.path.join(ghdoc.Path,"../../../"))

assert os.path.exists(os.path.join(repositories_path, "ur_fabrication_control/data"))
assert os.path.exists(os.path.join(repositories_path, "rbvogui_common/rbvogui_description"))
assert os.path.exists(os.path.join(repositories_path, "mobile_robot_control"))

ur_data_path = os.path.abspath(os.path.join(ghdoc.Path,"../../../ur_fabrication_control/data"))
rbvogui_data_path = os.path.abspath(os.path.join(repositories_path, "rbvogui_common"))
# ---------- end py_2 ----------
list = ValueList({"indoor", "outdoor"}, selected="indoor")
list_2 = ValueList({"default", "measured", "initial"}, selected="default")
toggle = BooleanToggle(True)

# ----
# Load robot from local package
python = GhPythonScript(choice=list_2, vertical_axis_height=Slider(0, range=0..0.72), vertical_axis_correction=Slider(0, range=-0.1..0.1))  # -> out, ur_base_frame_rhino_local_tf, ur_base_plane
# ---------- python: Python ----------
import rhinoscriptsyntax as rs
from compas.geometry import Frame
from compas.geometry import Translation
from compas_ghpython.utilities import draw_frame

if choice=="measured":
    ur_base_frame_rhino_local_tf = Frame(ur_base_plane_rhino_local_tf.Origin, 
                                         ur_base_plane_rhino_local_tf.XAxis, 
                                         ur_base_plane_rhino_local_tf.YAxis)
    T = Translation.from_vector(ur_base_frame_rhino_local_tf.zaxis*(vertical_axis_height+vertical_axis_correction))
    ur_base_frame_rhino_local_tf = ur_base_frame_rhino_local_tf.transformed(T)
elif choice=="initial":
    ur_base_frame_rhino_local_tf = Frame(ur_base_plane_init.Origin, 
                                         ur_base_plane_init.XAxis, 
                                         ur_base_plane_init.YAxis)
    T = Translation.from_vector(ur_base_frame_rhino_local_tf.zaxis*(vertical_axis_height+vertical_axis_correction))
    ur_base_frame_rhino_local_tf = ur_base_frame_rhino_local_tf.transformed(T)

elif choice =="default":
    ur_base_frame_rhino_local_tf = Frame([0.275, 0.0, 1.105], [-0.707, 0.707, 0.0], [-0.707, -0.707,0.0])
    T = Translation.from_vector(ur_base_frame_rhino_local_tf.zaxis*(vertical_axis_height+vertical_axis_correction))
    ur_base_frame_rhino_local_tf = ur_base_frame_rhino_local_tf.transformed(T)


ur_base_plane = draw_frame(ur_base_frame_rhino_local_tf)
# ---------- end python ----------

# ----
# Robot Model
py_3 = PythonScript(
    repositories_path=py_2.repositories_path,
    rbvogui_data_path=py_2.rbvogui_data_path,
    ur_data_path=py_2.ur_data_path,
    wheel_type=list)  # -> loaders, urdf_filename, srdf_filename
# ---------- py_3: Python ----------
import os
from compas.robots import LocalPackageMeshLoader

#loaders

ur_path = os.path.join(ur_data_path, "robot_description")
ur_packages = ["ur_description", "ur_e_description", "ur_end_effectors", "ur_setups"]
ur_loaders = [LocalPackageMeshLoader(ur_path, pck) for pck in ur_packages]

rbvogui_packages = ["rbvogui_description"]
rbvogui_loaders = [LocalPackageMeshLoader(rbvogui_data_path, pck) for pck in rbvogui_packages]

ewellix_packages = ["ewellix_description"]
ewellix_loaders = [LocalPackageMeshLoader(repositories_path, pck) for pck in ewellix_packages]

sensors_packages = ["robotnik_sensors"]
sensors_loaders = [LocalPackageMeshLoader(repositories_path, pck) for pck in sensors_packages]

loaders = ur_loaders + rbvogui_loaders + ewellix_loaders + sensors_loaders

#files
if wheel_type=="indoor":
    urdf_filename = os.path.join(repositories_path, r"mobile_robot_control\data\rbvogui_xl_lift_ur10e_indoor.urdf")
if wheel_type == "outdoor":
    urdf_filename = os.path.join(repositories_path, r"mobile_robot_control\data\rbvogui_xl_lift_ur10e.urdf")
srdf_filename = os.path.join(repositories_path, r"mobile_robot_control\data\rbvogui.srdf")

assert os.path.isfile(urdf_filename)
assert os.path.isfile(srdf_filename)
# ---------- end py_3 ----------
units = ValueList({"m": 1, "cm": 100, "mm": 1000}, selected="m")
load = Button()
create = PythonScript(
    load=load,
    ur_base_frame_rhino_local_tf=python.ur_base_frame_rhino_local_tf,
    loaders=py_3.loaders,
    urdf_filename=py_3.urdf_filename,
    srdf_filename=py_3.srdf_filename,
    scale_factor=units,
    wheel_type=list)  # -> out, robot, rcf; inputs load: Boolean, loaders: list
# ---------- create: Python ----------
import os
from scriptcontext import sticky as st

import compas

from compas_ghpython import draw_frame
from compas.robots import RobotModel
from compas.robots import LocalPackageMeshLoader

from mobile_robot_control.mobile_robot import MobileRobot
from compas_fab.robots import RobotSemantics
from compas_fab.ghpython import RobotArtist

compas.PRECISION = '12f'

# store robot in component
guid = str(ghenv.Component.InstanceGuid)
robot_key = "robot"

if robot_key not in st:
    st[robot_key] = None

#print loaders
if load:
    model = RobotModel.from_urdf_file(urdf_filename)
    
    model.load_geometry(*loaders)
    artist = RobotArtist(model)
    semantics = RobotSemantics.from_srdf_file(srdf_filename, model)
    robot = MobileRobot(model, artist, semantics, client=None)
    
    st[robot_key] = robot

robot = st[robot_key]
robot.wheel_type = wheel_type
print(robot)
rcf = draw_frame(robot.get_RCF())
print(rcf)
# ---------- end create ----------
robot = Data(create.robot)

# ----
# Tool
list_3 = ValueList({"measurement_tool": 0, "clay_extruder_7mm": 1}, selected="clay_extruder_7mm")
show = BooleanToggle(True)
py_4 = PythonScript()  # -> DATA
# ---------- py_4: Python ----------
import os

#package_path = os.path.dirname(mobile_fabrication_control.__file__)
#DATA = os.path.abspath(os.path.join(package_path,"../../data"))

package_path = ghdoc.Path
# package_path = os.path.dirname(ur_fabrication_control.__file__)
#DATA = os.path.abspath(os.path.join(package_path,"../../data"))

# .stl files not stored in am_hackathon repo. but in mobile_fabrication_control
DATA = os.path.abspath(os.path.join(package_path,"../../../extruder_control/data"))

print(package_path)
print(DATA)
# ---------- end py_4 ----------
tool = PythonScript(data_path=py_4, tool=list_3, show=show)  # -> tool, M, ee_plane
# ---------- tool: Python ----------
import os, math
from compas.geometry import Frame, Rotation
from compas.datastructures import Mesh
from compas_ghpython.artists import MeshArtist
from compas_fab.robots import Tool
from compas_ghpython.utilities import draw_frame

tolerance = 0

if tool == 0:
    filename = 'measurement_tool_zaxis.stl'
    ee_frame = Frame([0, 0, 0.109], [1, 0, 0], [0, 1, 0])

elif tool == 3:
    filename = 'clay_extruder_7mm.stl'
    # real frame:
    ee_frame = Frame([-0.000502, -0.105348, 0.0662,], [1, 0, 0], [0, 0, 1])
    
    # test frame:
    # ee_frame = Frame([0.0, 0.0, 0.1,], [1, 0, 0], [0, 1, 0])

elif tool == 1:
    filename = 'clay_extruder_v21_7mm.stl'
    ee_frame = Frame([0, 0, 0.33821], [1, 0, 0], [0, 1, 0])


data_path = os.path.join(data_path, "tool_geometry")
fullfilename = os.path.join(data_path, filename)
print fullfilename

ee_mesh = Mesh.from_stl(fullfilename)

if show:
    artist = MeshArtist(ee_mesh)
    M = artist.draw()

tool = Tool(ee_mesh, ee_frame)
ee_plane = draw_frame(ee_frame)
print(ee_frame.quaternion.xyzw)
ee_framek = Frame([0.0110607,0.00809854,0.41498], [0,1,0], [1,0,0])
print(ee_framek.quaternion.xyzw)
# ---------- end tool ----------
panel_2 = Panel("Attach a custom tool")
remove = Button()
add = Button()
attach_remove = PythonScript(robot=robot, tool=tool.tool, attach=add, remove=remove)  # -> out, bang
# ---------- attach_remove: Python ----------
if attach:
    robot.attach_tool(tool)
if remove:
    robot.detach_tool()
# ---------- end attach_remove ----------

pln = Plane(create.rcf)

# ----
# Info
info = PythonScript(robot=robot)  # -> out, main_group_name
# ---------- info: Python ----------
if robot:
    robot.info()
    main_group_name = robot.main_group_name
# ---------- end info ----------
panel_3 = Panel(info.out)

# ----
# Configuration
l = Slider(0, range=0..0.72)

# ---- group: forward kinematics
a6 = Slider(0, range=-360..360)
a1 = Slider(0, range=-360..360)
a2 = Slider(-90, range=-360..360)
a3 = Slider(90, range=-360..360)
a4 = Slider(0, range=-360..360)
a5 = Slider(90, range=-360..360)
jp = GhPythonScript()  # -> joint_positions
# ---------- jp: Python ----------
import math

joint_positions = [0,-90,90,0,90,0]
joint_positions = [math.radians(a) for a in joint_positions]
#joint_positions = [-3.136, -0.328, -1.218, 3.129, 0.852, 0.008]
#joint_positions = [0] * 6



#joint_positions = [1.6239667567485938, 0.25439606475392273, 4.409424838594969-2*3.14, 3.1901607306255908, 1.5707963267948954, 0.053170429953696939]
#joint_positions = [1.598543436748912, 0.23021224965157744, 4.712232135219824-2*3.14, 6.0531299026928744, 4.7123889803846915, 0.027747109954015234]
#joint_positions = [-1.1373533430447322, 4.0117247163121572, 5.4083762087596021-2*3.14, 1.5754733624925168, 4.7123889803846879, 3.5750356373399574]
print joint_positions
# ---------- end jp ----------
forward_kinematics = PythonScript(robot=robot, set_joint_positions=Button(), joint_positions=jp, lift=l, a1=a1, a2=a2, a3=a3, a4=a4, a5=a5, a6=a6)  # -> full_configuration; inputs joint_positions: list
# ---------- forward_kinematics: Python ----------
import math
import Grasshopper
from compas.robots import Joint
from compas_fab.robots import Configuration

if set_joint_positions:
    j = 0
    for i in range(ghenv.Component.Params.Input.Count):
        nslider = ghenv.Component.Params.Input[i].Sources[0]
        if nslider.GetType() == Grasshopper.Kernel.Special.GH_NumberSlider:
            nslider.TrySetSliderValue(math.degrees(joint_positions[j]))
            j += 1

if robot:
    joint_positions = [lift, a1, a2, a3, a4, a5, a6]
    joint_types = robot.get_configurable_joint_types()
    joint_names = robot.get_configurable_joint_names()
#    joint_types = [type for type in joint_types if type == Joint.REVOLUTE]
    
    for i, joint_type in enumerate(joint_types):
        if joint_type == Joint.REVOLUTE:
            joint_positions[i] = math.radians(joint_positions[i])
        else:
            joint_positions[i] = joint_positions[i]
    
    full_configuration = Configuration(joint_positions, joint_types, joint_names)
    
print(full_configuration)
# ---------- end forward_kinematics ----------

# ----
crv = Curve([<curve referenced from the Rhino model> x201])
divide = DivideCurve(Curve=crv, Count=Slider(10, range=0..1000), Kinks=False)  # -> Points, Tangents, Parameters
number_slider = Slider(0.2, range=0..1)

# ---- group: Range model
Z = UnitZ(Factor=expr("-x", Slider(0.2, range=0..1)))
move = Move(Geometry=pln, Motion=Z)  # -> Geometry, Transform
number_slider_2 = Slider(1.4, range=0..10)
number_slider_3 = Slider(0.6, range=0..1)
Z_2 = UnitZ(Factor=number_slider_3)
move_2 = Move(Geometry=move.Geometry, Motion=Z_2)  # -> Geometry, Transform
sph = Sphere(Base=move.Geometry, Radius=number_slider_2)
cyl = Cylinder(Base=move.Geometry, Radius=number_slider_2, Length=number_slider_3)
sph_2 = Sphere(Base=move_2.Geometry, Radius=number_slider_2)
sunion = SolidUnion(Breps=[sph, cyl, sph_2])

# ----
neg = Negative(Value=number_slider)
merge = Merge(Data1=number_slider, Data2=number_slider)
merge_2 = Merge(Data1=neg, Data2=neg)
entwine = Entwine(Branch00=merge, Branch01=merge_2, FlattenInputs=True)  # -> flatten(Result)
repeat = RepeatData(Data=entwine, Length=400)
partition = PartitionList(List=repeat, Size=Slider(2, range=0..10))
number_slider_4 = Slider(26, range=0..100)
number_slider_5 = Slider(0.01, range=0..0.01)
Z_3 = UnitZ(Factor=1)
yz = YZPlane(Origin="1.18,0,0")
pcx = CurvePlane(Curve=crv, Plane=yz)  # -> Points, ParamsC, ParamsP
addition = Addition(A=pcx.ParamsC, B=partition)
shatter = Shatter(Curve=graft(crv), Parameters=addition)
item = ListItem(List=shatter, Index=0, Wrap=True)  # -> Item, Item1
item_2 = ListItem(List=flatten(item.Item1), Index=number_slider_4, Wrap=True)
split = SplitList(List=flatten(item.Item1), Index=number_slider_4)  # -> ListA, ListB
split_2 = SplitList(List=flatten(item.Item), Index=number_slider_4)  # -> ListA, ListB
preview = CustomPreview(Geometry=[split_2.ListB, split.ListB], Shader=ColourSwatch(SwatchColor=RGB(131, 131, 132)))
pipe = Pipe(Curve=split.ListA, Radius=number_slider_5, Caps=0)
pipe_2 = Pipe(Curve=split_2.ListA, Radius=number_slider_5, Caps=0)
divide_2 = DivideCurve(Curve=item_2, Count=10, Kinks=False)  # -> Points, Tangents, Parameters
preview_2 = CustomPreview(Geometry=pipe, Shader=ColourSwatch(SwatchColor=RGB(255, 0, 0)))
preview_3 = CustomPreview(Geometry=pipe_2, Shader=ColourSwatch(SwatchColor=RGB(0, 255, 0)))
xprod = CrossProduct(VectorA=divide_2.Tangents, VectorB=Z_3, Unitize=False)  # -> Vector, Length
pl = ConstructPlane(Origin=divide_2.Points, XAxis=divide_2.Tangents, YAxis=xprod.Vector)
item_3 = ListItem(List=pl, Index=Slider(2, range=0..10), Wrap=True)

# ---- group: inverse kinematics
select_configuration = Slider(0, range=0..7)
plane = Plane(Plane(origin=(1.107006312, -0.006907311816, 0.920639), x=(-0.04967065867, 0.998765651, -1.429441465e-06), y=(0.998765651, 0.04967065867, 6.432016809e-07)))
# Block is red due to invalid inputs, though remains perfectly functional
inverse = PythonScript(bang=Button(), robot=robot, group=info.main_group_name, plane_WCS=item_3, idx=select_configuration)  # -> out, plane_tool0_RCS, plane_tcp_RCS, configuration; inputs plane_WCS: Plane, idx: Int32
# ---------- inverse: Python ----------
import Rhino.Geometry as rg
import math
from compas.geometry import Frame, Transformation, Rotation
from compas_fab.robots import Configuration
from ur_fabrication_control.kinematics.ur_kinematics import inverse_kinematics
from ur_fabrication_control.kinematics.ur_params import ur_params
from compas_ghpython import draw_frame

tcp_WCS = Frame(plane_WCS.Origin, plane_WCS.XAxis, plane_WCS.YAxis)

# transform frame to robot coordinate system
tcp_RCS = robot.RCF.to_local_coordinates(tcp_WCS)

if robot.attached_tool:
    tool0_RCS = robot.from_tcf_to_t0cf([tcp_RCS])[0]
else:
    tool0_RCS = tcp_RCS
print tcp_RCS
print tool0_RCS
plane_tool0_RCS = draw_frame(tool0_RCS)
plane_tcp_RCS = draw_frame(tcp_RCS)
# calculate solutions to frame
ur_params = ur_params["ur10e"] # get the parameters according to the robot model
print ur_params
solutions = inverse_kinematics(tool0_RCS, ur_params)
print solutions

if not len(solutions):
    joint_values = [0,0,0,0,0,0]
    configuration = Configuration.from_revolute_values(joint_values)
else:
    joint_values = solutions[idx]
    #print joint_values
    
    ### ***** HACK ***** ##### TODO: CHECK!!!
    for i, v in enumerate(joint_values):
        if v > math.pi:
            v -= 2*math.pi
        if v < -math.pi:
            v += 2*math.pi
        joint_values[i] = v
    ### ***** HACK ***** ##### TODO: CHECK!!!
    configuration = [Configuration.from_revolute_values(joint_values)]

print(configuration)
# ---------- end inverse ----------

# ----
list_4 = ValueList({"0 forward_kinematics": 0, "1 inverse_kinematics": 1}, selected="1 inverse_kinematics")
filter = StreamFilter(Gate=list_4, Stream0=forward_kinematics, Stream1=inverse.configuration)

# ----
# Visualisation
show_end_effector_frame = BooleanToggle(True)
show_base_frame = BooleanToggle(True)
show_collision = BooleanToggle(False)
show_frames = BooleanToggle(True)
show_visual = BooleanToggle(True)
show_acm = BooleanToggle(False)
list_5 = ValueList({"Zero": 0, "One": 1, "Two": 2, "Three": 3, "Four": 4, "Five": 5}, selected="Zero")
visualize = PythonScript(
    robot=robot,
    tool=tool.tool,
    group=info.main_group_name,
    configuration=filter,
    redraw=attach_remove.bang,
    show_visual=show_visual,
    show_collision=show_collision,
    show_end_effector_frame=show_end_effector_frame,
    show_frames=show_frames,
    show_base_frame=show_base_frame,
    show_acm=show_acm,
    station=list_5)  # -> out, robot, visual, collision, attached_meshes, frames, ee_frame, tool0_frame, base_frame, base_pt; inputs redraw: list, attached_collision_meshes: list, station_pts: list
# ---------- visualize: Python ----------
import rhinoscriptsyntax as rs
import Rhino.Geometry as rg
import ghpythonlib.components as ghcomp
from compas.geometry import Vector
from compas.geometry import Point
from compas.geometry import Transformation
from compas.geometry import Frame
from compas_ghpython.artists import MeshArtist
from compas_ghpython.utilities import draw_frame
from compas_fab.robots import Configuration
from ur_fabrication_control.kinematics.ur_kinematics import forward_kinematics
from ur_fabrication_control.kinematics.ur_params import ur_params

print(configuration)

if robot and configuration:
    robot.update(configuration, visual=show_visual, collision=show_collision)
    ur_params = ur_params[robot.main_group_name]
    print(ur_params)
    if show_visual:
        visual = robot.artist.draw_visual()
#        robot_RCF = draw_frame(robot.RCF)
#        init_robot_plane = rg.Plane(rg.Point3d(0.275, 0.0, 1.105), rg.Vector3d(-0.707, 0.707, 0.0), rg.Vector3d(-0.707, -0.707,0.0))
#        visual = ghcomp.Orient(visual, init_robot_plane, robot_RCF)[0]
        
    if show_collision:
        collision = robot.artist.draw_collision()
    
    frames = robot.transformed_frames(configuration, group)

    if show_base_frame:
        base_frame = frames[0]

    if show_end_effector_frame:
#        tool0_frame = forward_kinematics(configuration.revolute_values, ur_params)
        ee_frame = robot.forward_kinematics(configuration, group)
        print ee_frame
        if robot.attached_tool:
            tool0_frame = robot.from_tcf_to_t0cf([ee_frame])
        print("End-effector", ee_frame)
    
    if not show_frames:
        frames = None

#    frame = forward_kinematics(configuration.revolute_values, ur_params)
    frame = robot.forward_kinematics(configuration, options=dict(solver='model'))
    #robot.artist.update_tool(visual=visual, collision=collision, transformation=Transformation.from_frame_to_frame(Frame.worldXY(), tool0_frame))
    
    if show_acm:
        M = []
        for acm in attached_collision_meshes:
            frame = robot.forward_kinematics(configuration, options=dict(solver='model', link_name=acm.link_name))
            T = Transformation.from_frame_to_frame(Frame.worldXY(), frame)
            mesh = acm.collision_mesh.mesh.transformed(T)
            M.append(MeshArtist(mesh).draw())
        attached_meshes = M
# ---------- end visualize ----------
geo = Geometry(visualize.visual)
geo_2 = Geometry(visualize.collision)
draw = GhPythonScript(frames=[visualize.frames, visualize.ee_frame, visualize.base_frame], scale=Slider(0.1, range=0..1))  # -> P, V, C, W; inputs frames: list
# ---------- draw: Python ----------
from System.Drawing import Color
from compas_ghpython.utilities import draw_frame

red = Color.FromArgb(255, 0, 0)
green = Color.FromArgb(0, 255, 0)
blue = Color.FromArgb(0, 0, 255)

P = []
V = []
C = []

scale = float(scale)

for frame in frames:
    if not frame:
        continue
    plane = draw_frame(frame)
    P += [plane.Origin] * 3
    V.append(plane.XAxis * scale)
    V.append(plane.YAxis * scale)
    V.append(plane.ZAxis * scale)
    C += [red, green, blue]

W = 3
# ---------- end draw ----------
colour_swatch = ColourSwatch(SwatchColor=RGB(105, 105, 105))
preview_4 = CustomPreview(Geometry=geo, Shader=colour_swatch)
preview_5 = CustomPreview(Geometry=visualize.attached_meshes, Shader=ColourSwatch(SwatchColor=RGB(255, 255, 255)))
vdisex = VectorDisplayEx(Point=draw.P, Vector=draw.V, Colour=draw.C, Width=draw.W)

entwine_2 = Entwine(Branch00=geo, Branch01=sunion, FlattenInputs=True)
panel_4 = Panel(visualize.visual)
mirror = Mirror(Geometry=entwine_2, Plane=yz)  # -> Geometry, Transform
Y = UnitY(Factor=Slider(0, range=0..1))
move_3 = Move(Geometry=mirror.Geometry, Motion=Y)  # -> Geometry, Transform
merge_3 = Merge(Data1=entwine_2, Data2=move_3.Geometry)
bang = ExplodeTree(Data=merge_3)  # -> Branch0, Branch1
item_4 = ListItem(List=bang.Branch1, Index=0, Wrap=True)  # -> Item, Item1
geo_3 = Geometry(bang.Branch0)
sint = SolidIntersection(BrepsA=item_4.Item, BrepsB=item_4.Item1)
preview_6 = CustomPreview(Geometry=geo_3, Shader=colour_swatch)
