# Grasshopper definition ex01_robot_to_marker.ghx (Grasshopper 1.0.7)

reload = Button()
panel = Panel("Unload libraries")
py = PythonScript(reload=reload)
# ---------- py: Python ----------
from compas_ghpython import unload_modules

if reload:
    unload_modules("compas")
    unload_modules("compas_fab")
    unload_modules("roslibpy")
    unload_modules("fabrication_control")
    unload_modules("assembly_information_model")
    unload_modules("am_information_model")
    unload_modules("ur_fabrication_control")
    unload_modules("mobile_robot_control")
    unload_modules("extruder_control")
# ---------- end py ----------

# ----
# Load robot from local package
py_2 = PythonScript()  # -> repositories_path, rbvogui_data_path, ur_data_path
# ---------- py_2: Python ----------
import os

"""
ASSUMING THE BELOW PACKAGES ARE STORED IN THE SAME LOCATION:
    ur_fabrication_control;
    rbvogui_common; and
    mobile_additive_manufacturing.
"""

repositories_path = os.path.abspath(os.path.join(ghdoc.Path,"../../../"))

assert os.path.exists(os.path.join(repositories_path, "ur_fabrication_control/data"))
assert os.path.exists(os.path.join(repositories_path, "rbvogui_common/rbvogui_description"))
assert os.path.exists(os.path.join(repositories_path, "mobile_robot_control"))

ur_data_path = os.path.abspath(os.path.join(ghdoc.Path,"../../../ur_fabrication_control/data"))
rbvogui_data_path = os.path.abspath(os.path.join(repositories_path, "rbvogui_common"))
# ---------- end py_2 ----------
list = ValueList({"ur3.urdf", "ur3_rot.urdf", "ur5.urdf", "ur10.urdf", "ur3e.urdf", "ur5e.urdf", "ur10e.urdf", "ur10e_rot.urdf"}, selected="ur10e_rot.urdf")
list_2 = ValueList({"ur3.srdf", "ur5.srdf", "ur10.srdf", "ur3e.srdf", "ur5e.srdf", "ur10e.srdf"}, selected="ur10e.srdf")

# ----
# Robot Model
list_3 = ValueList({"ur_description", "ur_e_description", "ur_setups"}, selected="ur_e_description")
py_3 = PythonScript(
    repositories_path=py_2.repositories_path,
    rbvogui_data_path=py_2.rbvogui_data_path,
    ur_data_path=py_2.ur_data_path,
    package=list_3,
    urdf_name=list,
    srdf_name=list_2)  # -> loaders, urdf_filename, srdf_filename
# ---------- py_3: Python ----------
import os
from compas.robots import LocalPackageMeshLoader

#loaders

ur_path = os.path.join(ur_data_path, "robot_description")
ur_packages = ["ur_description", "ur_e_description", "ur_end_effectors", "ur_setups"]
ur_loaders = [LocalPackageMeshLoader(ur_path, pck) for pck in ur_packages]

rbvogui_packages = ["rbvogui_description"]
rbvogui_loaders = [LocalPackageMeshLoader(rbvogui_data_path, pck) for pck in rbvogui_packages]

ewellix_packages = ["ewellix_description"]
ewellix_loaders = [LocalPackageMeshLoader(repositories_path, pck) for pck in ewellix_packages]

sensors_packages = ["robotnik_sensors"]
sensors_loaders = [LocalPackageMeshLoader(repositories_path, pck) for pck in sensors_packages]

loaders = ur_loaders + rbvogui_loaders + ewellix_loaders + sensors_loaders

#files
urdf_filename = os.path.join(repositories_path, r"mobile_robot_control\data\rbvogui_xl_lift_ur10e.urdf")
srdf_filename = os.path.join(repositories_path, r"mobile_robot_control\data\rbvogui.srdf")

assert os.path.isfile(urdf_filename)
assert os.path.isfile(srdf_filename)
# ---------- end py_3 ----------
units = ValueList({"m": 1, "cm": 100, "mm": 1000}, selected="m")
load = Button()
create = PythonScript(load=load, loaders=py_3.loaders, urdf_filename=py_3.urdf_filename, srdf_filename=py_3.srdf_filename, scale_factor=units)  # -> out, robot; inputs load: Boolean, loaders: list
# ---------- create: Python ----------
import os
from scriptcontext import sticky as st

import compas

from compas_ghpython import draw_frame
from compas.robots import RobotModel
from compas.robots import LocalPackageMeshLoader

from mobile_robot_control.mobile_robot import MobileRobot
from mobile_robot_control.mobile_robot_client import MobileRobotClient
from compas_fab.robots import RobotSemantics
from compas_fab.ghpython import RobotArtist

compas.PRECISION = '12f'

# store robot in component
guid = str(ghenv.Component.InstanceGuid)
robot_key = "robot"

if robot_key not in st:
    st[robot_key] = None

#print loaders
if load:
    model = RobotModel.from_urdf_file(urdf_filename)
    model.load_geometry(*loaders)
    artist = RobotArtist(model)
    semantics = RobotSemantics.from_srdf_file(srdf_filename, model)
    robot = MobileRobot(model, artist, semantics)
    
    st[robot_key] = robot

robot = st[robot_key]
print(robot)

if robot:
    robot.scale(scale_factor)
# ---------- end create ----------
robot = Data(create.robot)

# ----
# Tool
list_4 = ValueList({"measurement_tool": 0, "clay_extruder_7mm": 1, "area_gripper": 2, "area_gripper_435i": 3}, selected="measurement_tool")
show = BooleanToggle(True)
py_4 = PythonScript()  # -> DATA
# ---------- py_4: Python ----------
import os

#package_path = os.path.dirname(mobile_fabrication_control.__file__)
#DATA = os.path.abspath(os.path.join(package_path,"../../data"))

package_path = ghdoc.Path
# package_path = os.path.dirname(ur_fabrication_control.__file__)
#DATA = os.path.abspath(os.path.join(package_path,"../../data"))

# .stl files not stored in am_hackathon repo. but in mobile_fabrication_control
DATA = os.path.abspath(os.path.join(package_path,"../../../mobile_robot_control/data"))

print(package_path)
print(DATA)
# ---------- end py_4 ----------
tool = PythonScript(data_path=py_4, tool=list_4, show=show)  # -> tool, M, ee_plane
# ---------- tool: Python ----------
import os, math
from compas.geometry import Frame, Rotation
from compas.datastructures import Mesh
from compas_ghpython.artists import MeshArtist
from compas_fab.robots import Tool
from compas_ghpython.utilities import draw_frame

tolerance = 0

if tool == 0:
    filename = 'measurement_tool_zaxis.stl'
    ee_frame = Frame([0, 0, 0.109], [1, 0, 0], [0, 1, 0])

elif tool == 1:
    filename = 'clay_extruder_7mm.stl'
    # real frame:
    ee_frame = Frame([-0.000502, -0.105348, 0.0662,], [1, 0, 0], [0, 0, 1])
    
    # test frame:
    # ee_frame = Frame([0.0, 0.0, 0.1,], [1, 0, 0], [0, 1, 0])

elif tool == 2:
    filename = 'area_gripper_zaxis.stl'
    ee_frame = Frame([0, 0, 0.10219 + tolerance], [0, 1, 0], [-1, 0, 0])

elif tool == 3:
    filename = 'area_gripper_d435i_zaxis.stl'
    ee_frame = Frame([0, 0, 0.10219 + tolerance], [0, 1, 0], [-1, 0, 0])
#    ee_frame = Frame([0.054, 0, 0.065 + tolerance], [0, 1, 0], [-1, 0, 0])


data_path = os.path.join(data_path, "tool_geometry")
fullfilename = os.path.join(data_path, filename)
print fullfilename

ee_mesh = Mesh.from_stl(fullfilename)

if show:
    artist = MeshArtist(ee_mesh)
    M = artist.draw()

tool = Tool(ee_mesh, ee_frame)
ee_plane = draw_frame(ee_frame)
print(ee_frame.quaternion.xyzw)
ee_framek = Frame([0.0110607,0.00809854,0.41498], [0,1,0], [1,0,0])
print(ee_framek.quaternion.xyzw)
# ---------- end tool ----------
panel_2 = Panel("Attach a custom tool")
remove = Button()
add = Button()
attach_remove = PythonScript(robot=robot, tool=tool.tool, attach=add, remove=remove)  # -> out, bang
# ---------- attach_remove: Python ----------
if attach:
    robot.attach_tool(tool)
if remove:
    robot.detach_tool()
# ---------- end attach_remove ----------

list_5 = ValueList({"local": "127.0.0.1", "linux computer": "192.168.0.42"}, selected="linux computer")

# ----
# ROS client
disconnect = Button()
connect = Button()
connect_2 = PythonScript(robot=robot, ip=list_5, connect=connect, disconnect=disconnect)  # -> out, robot
# ---------- connect_2: Python ----------
import sys
import scriptcontext as sc
from compas_fab.backends import RosClient
from mobile_robot_control.mobile_robot_client import MobileRobotClient as Client

if robot:
    if connect:
        robot.mobile_client = Client(host=ip, port=9090)
        robot.mobile_client.connect()
    
    if disconnect:
        robot.mobile_client.disconnect()
    
    print('ROS connected: {}'.format(robot.mobile_client.ros_client.is_connected))
# ---------- end connect_2 ----------
is_connected = Panel(connect_2.out)

# ----
# Get base frame to 1 fixed marker from multiple positions
list_6 = ValueList({"snapshot_0", "snapshot_1", "snapshot_2"}, selected="snapshot_1")
snapshot_configuration = GhPythonScript(snapshot=list_6)  # -> out, configuration
# ---------- snapshot_configuration: Python ----------
from compas_fab.robots import Configuration

snapshot_configurations = {"snapshot_0" : Configuration((0.785, -1.047, 2.094, 3.142, -1.571, -1.571), (0, 0, 0, 0, 0, 0)),
                            "snapshot_1" : Configuration((1.296, -0.791, 1.716, -2.344, -2.045, 0.322), (0, 0, 0, 0, 0, 0)),
                            "snapshot_2" : Configuration((-0.082, -0.837, 1.763, -2.183, -1.179, 2.437), (0, 0, 0, 0, 0, 0))}

configuration = snapshot_configurations[snapshot]
# ---------- end snapshot_configuration ----------
list_7 = ValueList({"marker_0 frame": "marker_0", "marker_1 frame": "marker_1"}, selected="marker_1 frame")
list_8 = ValueList({"camera frame": "camera_color_optical_frame", "robot base frame": "base"}, selected="robot base frame")
subscribe = Button()
save = Button()
unsubscribe = Button()
print = Button()
get_tf_frame = GhPythonScript(
    robot=connect_2.robot,
    snapshot=list_6,
    target_frame=list_7,
    reference_frame=list_8,
    subscribe=subscribe,
    save=save,
    unsubscribe=unsubscribe,
    print=print)  # -> out, bang
# ---------- get_tf_frame: Python ----------
from scriptcontext import sticky as st

if not st.get('snapshot_marker_poses'):
    st['snapshot_marker_poses'] = {}

if subscribe:
    robot.mobile_client.tf_subscribe(target_frame, reference_frame)

if save:
    if robot.mobile_client.tf_frame is not None:
        st['snapshot_marker_poses'][snapshot] = robot.mobile_client.tf_frame

if unsubscribe:
    if robot.mobile_client.tf_frame is not None:
        robot.mobile_client.clean_tf_frame()
    robot.mobile_client.tf_unsubscribe(target_frame, reference_frame)

print "tf_clients: ", robot.mobile_client.tf_clients
print "tf_frame: ", robot.mobile_client.tf_frame
print st['snapshot_marker_poses']
# ---------- end get_tf_frame ----------
rec = DataRecorder(get_tf_frame.out, DataLimit=-10, RecordData=True)
panel_3 = Panel(rec)
fixed_marker_plane = Plane(Plane(origin=(0, 0, 0), x=(0, 0, 1), y=(0, 1, 0)))
regenerate_base_plane = GhPythonScript(robot=robot, redraw=get_tf_frame.bang, fixed_marker_plane=fixed_marker_plane)  # -> out, base_plane
# ---------- regenerate_base_plane: Python ----------
from scriptcontext import sticky as st
from compas.geometry import Transformation, Frame, Point
from compas.artists import Artist

fixed_marker_frame = Frame(fixed_marker_plane.Origin, fixed_marker_plane.XAxis, fixed_marker_plane.YAxis) 
snapshot_robot_poses = []

if len(st['snapshot_marker_poses']):
    for snapshot, marker_pose in st['snapshot_marker_poses']:
        MCF_in_RCF = marker_pose #measured MCF in RCF 
        MCF_in_BCF = MCF_in_RCF.transformed(robot.transformation_RCF_BCF()) #measured MCF in BCF
        robot.MCF = robot.to_world_coordinates(MCF_in_BCF) #measured MCF in WCF necessary???????
        
        BCF_in_MCF = Frame.from_transformation(Transformation.from_frame(MCF_in_BCF).inverted()) #BCF in measured MCF
        
        transformation_FMCF_WCF = Transformation.from_change_of_basis(fixed_marker_frame, Frame.worldXY()) #T from fixed MCF to WCF
        BCF_in_WCF = BCF_in_MCF.transformed(transformation_FMCF_WCF) #BCF in WCF
        
        print BCF_in_WCF
        snapshot_robot_poses.append(BCF_in_WCF)
        
    #mean_base_frame = ...
    #base_plane = Artist(app_base_frame).draw()
# ---------- end regenerate_base_plane ----------

clean = Button()
list_9 = ValueList({"marker_0", "marker_1", "marker_2", "marker_3", "marker_4"}, selected="marker_0")
fixed_marker_plane_2 = Plane(Plane(origin=(0, 0, 0), x=(0, 0, 1), y=(0, 1, 0)))
list_10 = ValueList({"all": 0, "selected": 1}, selected="selected")

# ----
# Info
info = PythonScript(robot=robot)  # -> out, main_group_name
# ---------- info: Python ----------
if robot:
    robot.info()
    main_group_name = robot.main_group_name
# ---------- end info ----------
panel_4 = Panel(info.out)

# ----
# Stop
stop = Button()
stop_2 = PythonScript(stop=stop)
# ---------- stop_2: Python ----------
from scriptcontext import sticky as st
from ur_fabrication_control.direct_control.common import send_stop

ur_ip = st["ur_ip"]
ur_port = st["ur_port"]

if stop:
    send_stop(ur_ip, ur_port)
# ---------- end stop_2 ----------

# ----
# Configuration
l = Slider(0, range=0..0.72)

# ---- group: forward kinematics
a6 = Slider(0, range=-360..360)
a1 = Slider(45, range=-360..360)
a2 = Slider(-45, range=-360..360)
a3 = Slider(112, range=-360..360)
a4 = Slider(0, range=-360..360)
a5 = Slider(0, range=-360..360)
jp = GhPythonScript()  # -> joint_positions
# ---------- jp: Python ----------
import math

joint_positions = [0,-90,90,0,90,0]
joint_positions = [math.radians(a) for a in joint_positions]
#joint_positions = [-3.136, -0.328, -1.218, 3.129, 0.852, 0.008]
#joint_positions = [0] * 6



#joint_positions = [1.6239667567485938, 0.25439606475392273, 4.409424838594969-2*3.14, 3.1901607306255908, 1.5707963267948954, 0.053170429953696939]
#joint_positions = [1.598543436748912, 0.23021224965157744, 4.712232135219824-2*3.14, 6.0531299026928744, 4.7123889803846915, 0.027747109954015234]
#joint_positions = [-1.1373533430447322, 4.0117247163121572, 5.4083762087596021-2*3.14, 1.5754733624925168, 4.7123889803846879, 3.5750356373399574]
print joint_positions
# ---------- end jp ----------
forward_kinematics = PythonScript(robot=robot, set_joint_positions=Button(), joint_positions=jp, lift=l, a1=a1, a2=a2, a3=a3, a4=a4, a5=a5, a6=a6)  # -> full_configuration; inputs joint_positions: list
# ---------- forward_kinematics: Python ----------
import math
import Grasshopper
from compas.robots import Joint
from compas_fab.robots import Configuration

if set_joint_positions:
    j = 0
    for i in range(ghenv.Component.Params.Input.Count):
        nslider = ghenv.Component.Params.Input[i].Sources[0]
        if nslider.GetType() == Grasshopper.Kernel.Special.GH_NumberSlider:
            nslider.TrySetSliderValue(math.degrees(joint_positions[j]))
            j += 1

if robot:
    joint_positions = [lift, a1, a2, a3, a4, a5, a6]
    joint_types = robot.get_configurable_joint_types()
    joint_names = robot.get_configurable_joint_names()
#    joint_types = [type for type in joint_types if type == Joint.REVOLUTE]
    
    for i, joint_type in enumerate(joint_types):
        if joint_type == Joint.REVOLUTE:
            joint_positions[i] = math.radians(joint_positions[i])
        else:
            joint_positions[i] = joint_positions[i]
    
    full_configuration = Configuration(joint_positions, joint_types, joint_names)
    
print(full_configuration)
# ---------- end forward_kinematics ----------

# ----
x_axis = Curve(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)
y_axis = Curve(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)
plane = PythonScript(plane_axes=[x_axis, y_axis])  # -> plane; inputs plane_axes: list of Curve
# ---------- plane: Python ----------
import Rhino.Geometry as rg

x_axis, y_axis = plane_axes

x_axis = rg.Line(x_axis.PointAtStart, x_axis.PointAtEnd)
y_axis = rg.Line(y_axis.PointAtStart, y_axis.PointAtEnd)

if x_axis.From.DistanceTo(y_axis.From) < 0.01:
    origin = x_axis.From
    xvec = x_axis.Direction
    yvec = y_axis.Direction
elif x_axis.To.DistanceTo(y_axis.To) < 0.01:
    origin = x_axis.To
    xvec = -x_axis.Direction
    yvec = -y_axis.Direction
elif x_axis.From.DistanceTo(y_axis.To) < 0.01:
    origin = x_axis.From
    xvec = x_axis.Direction
    yvec = -y_axis.Direction
elif x_axis.To.DistanceTo(y_axis.From) < 0.01:
    origin = x_axis.To
    xvec = -x_axis.Direction
    yvec = y_axis.Direction

plane = rg.Plane(origin, xvec, yvec)
# ---------- end plane ----------
pln = Plane(Plane(origin=(1, 0, 1), x=(1, 0, 0), y=(0, -1, 0)))

# ---- group: inverse kinematics
select_configuration = Slider(2, range=0..7)
plane_2 = Plane(Plane(origin=(0, 0, 0.03), x=(1, 0, 0), y=(0, -1, 0)))
inverse = PythonScript(robot=robot, group=info.main_group_name, plane_WCS=pln, idx=select_configuration)  # -> out, plane_tool0_RCS, plane_tcp_RCS, configuration; inputs plane_WCS: Plane, idx: Int32
# ---------- inverse: Python ----------
import Rhino.Geometry as rg
import math
from compas.geometry import Frame, Transformation, Rotation
from compas_fab.robots import Configuration
from ur_fabrication_control.kinematics.ur_kinematics import inverse_kinematics
from ur_fabrication_control.kinematics.ur_params import ur_params
from compas_ghpython import draw_frame

tcp_WCS = Frame(plane_WCS.Origin, plane_WCS.XAxis, plane_WCS.YAxis)

# transform frame to robot coordinate system
print tcp_WCS
print plane_WCS
#tcp_RCS = robot.RCF_in_WCF.to_local_coordinates(tcp_WCS)
tcp_BCS = robot.to_local_coordinates(tcp_WCS)
#tcp_BCS = tcp_WCS.transformed(robot.transformation_WCF_BCF())
tcp_RCS = tcp_BCS.transformed(robot.transformation_RCF_BCF().inverse())

tool0_RCS = robot.from_tcf_to_t0cf([tcp_RCS])[0]
print tcp_RCS
print tool0_RCS
plane_tool0_RCS = draw_frame(tool0_RCS)
plane_tcp_RCS = draw_frame(tcp_RCS)
# calculate solutions to frame
ur_params = ur_params["ur10e"] # get the parameters according to the robot model
print ur_params
solutions = inverse_kinematics(tool0_RCS, ur_params)
print solutions

if not len(solutions):
    joint_values = [0,0,0,0,0,0]
    configuration = Configuration.from_revolute_values(joint_values)
else:
    joint_values = solutions[idx]
    #print joint_values
    
    ### ***** HACK ***** ##### TODO: CHECK!!!
    for i, v in enumerate(joint_values):
        if v > math.pi:
            v -= 2*math.pi
        if v < -math.pi:
            v += 2*math.pi
        joint_values[i] = v
    ### ***** HACK ***** ##### TODO: CHECK!!!
    configuration = [Configuration.from_revolute_values(joint_values)]

print(configuration)
# ---------- end inverse ----------

# ----
# Block is red due to invalid inputs, though remains perfectly functional
pln_2 = Plane(plane)
pt = Point([<point referenced from the Rhino model> x3])
pln_3 = Plane(Plane(origin=(-0.2441749832, 0.934703875, 0.3613320444), x=(0.7360565545, 0.6769044114, -0.00460069641), y=(-0.6768256016, 0.73605039, 0.01170163659)))

list_11 = ValueList({"0 forward_kinematics": 0, "1 inverse_kinematics": 1}, selected="0 forward_kinematics")
filter = StreamFilter(Gate=list_11, Stream0=forward_kinematics, Stream1=inverse.configuration)

# ----
# Get Pose Joint
get = Button()
pose = PythonScript(robot=robot, get=get)  # -> out, configuration, pose_joints
# ---------- pose: Python ----------
from scriptcontext import sticky as st
from ur_fabrication_control.direct_control.common import get_current_pose_joints
from compas_fab.robots import Configuration


robot = st["robot"]

server_ip= st["server_ip"]
server_port = st["server_port"]
ur_port = st["ur_port"]
ur_ip = st["ur_ip"]
print ur_ip

guid = str(ghenv.Component.InstanceGuid)
pose_joints_key = "pose_joints" + guid

# retrieve the current tool frame in axis angle format
if robot.attached_tool:
    tool_angle_axis = list(robot.attached_tool.frame.point) + list(robot.attached_tool.frame.axis_angle_vector)
else:
    tool0_frame = Frame([0, 0, 0], [1, 0, 0], [0, 1, 0])
    tool_angle_axis = list(tool0_frame.point) + list(tool0_frame.axis_angle_vector)

print(tool_angle_axis)

# send script to the robot to receive the current joint configuration
if get:
    st[pose_joints_key] = get_current_pose_joints(server_ip, server_port, ur_ip, ur_port, tool_angle_axis)

print(st[pose_joints_key])
configuration = Configuration.from_revolute_values(st[pose_joints_key])
pose_joints = configuration.joint_values
"""
if pose_joints_key not in st:
    configuration = Configuration.from_revolute_values([0,0,0,0,0,0])
else:
    configuration = Configuration.from_revolute_values(st[pose_joints_key])

pose_joints = configuration.values
"""
# ---------- end pose ----------
panel_5 = Panel(pose.pose_joints)

ext_ip = ValueList({"192.168.10.10", "192.168.10.20", "192.168.10.11", "192.168.10.12", "127.0.0.1", "192.168.10.111", "192.168.0.220", "192.168.0.30", "192.168.10.50", "0.0.0.0"}, selected="192.168.0.220")
ext_port = ValueList({"50003", "50004"}, selected="50004")

# ----
# IP Settings
# --> Set your IP address
# --> Set robot IP address
server_ip = ValueList({"192.168.10.44", "192.168.10.12", "192.168.10.11", "192.168.10.10", "192.168.10.2", "127.0.0.1", "192.168.10.111", "192.168.0.250", "192.168.0.30", "10.42.0.212", "10.42.0.133"}, selected="192.168.0.250")
ur_ip = ValueList({"192.168.10.10", "192.168.10.20", "192.168.10.11", "192.168.10.12", "127.0.0.1", "192.168.10.111", "192.168.0.210", "192.168.0.30"}, selected="192.168.0.210")
server_port = ValueList({"50002", "50003", "50005", "50006", "50007", "50008", "50009", "50010", "50011", "50012", "50013", "50014", "50015", "50016"}, selected="50006")
ur_port = ValueList({"30002"}, selected="30002")
globals = PythonScript(
    server_ip=server_ip,
    server_port=server_port,
    ur_ip=ur_ip,
    ur_port=ur_port,
    ext_ip=ext_ip,
    ext_port=ext_port,
    clear=Button())  # inputs server_port: Int32
# ---------- globals: Python ----------
from scriptcontext import sticky as st

st["server_ip"] = server_ip
st["server_port"] = server_port

st["ur_ip"] = ur_ip
st["ur_port"] = ur_port

st["ext_ip"] = ext_ip
st["ext_port"] = ext_port


if clear:
    st.clear()
# ---------- end globals ----------

# ----
# Check if UR robot
#  is available
ping = Button()
py_5 = PythonScript(ip=ur_ip, ping=ping)  # -> out, trigger
# ---------- py_5: Python ----------
from scriptcontext import sticky as st
from ur_fabrication_control.direct_control.utilities import is_available

guid = str(ghenv.Component.InstanceGuid)
txt_key = "txt_" + guid
if txt_key not in st:
    st[txt_key] = ""

if ping:
    
    available = is_available(ip)
    
    if available:
        st[txt_key] = "%s is up!" % ip
        trigger = True
    else:
        st[txt_key] = "%s is down!" % ip
        trigger = False

print(st[txt_key])
# ---------- end py_5 ----------
panel_6 = Panel(py_5.out)

# ----
# Get close step_by_step to marker_0
list_12 = ValueList({"marker_0 frame": "marker_0", "marker_1 frame": "marker_1", "marker_2 frame": "marker_2", "marker_3 frame": "marker_3", "marker_4 frame": "marker_4"}, selected="marker_0 frame")
list_13 = ValueList({"camera frame": "camera_color_optical_frame", "robot base frame": "base"}, selected="robot base frame")
unsubscribe_2 = Button()
subscribe_2 = Button()
save_2 = Button()
print_2 = Button()
get_marker_frames = GhPythonScript(
    robot=connect_2.robot,
    target_frame=list_12,
    reference_frame=list_13,
    subscribe=subscribe_2,
    save=save_2,
    unsubscribe=unsubscribe_2,
    print=print_2)  # -> out, bang
# ---------- get_marker_frames: Python ----------
from scriptcontext import sticky as st

if not st.get('marker_poses'):
    st['marker_poses'] = {}

if subscribe:
    robot.mobile_client.tf_subscribe(target_frame, reference_frame)

if save:
    if robot.mobile_client.tf_frame is not None:
        if not st['marker_poses'].get(target_frame):
            st['marker_poses'][target_frame] = []
            st['marker_poses'][target_frame].append(robot.mobile_client.tf_frame)
        else:
            st['marker_poses'][target_frame].append(robot.mobile_client.tf_frame)

if unsubscribe:
    if robot.mobile_client.tf_frame is not None:
        robot.mobile_client.clean_tf_frame()
    robot.mobile_client.tf_unsubscribe(target_frame, reference_frame)

print "tf_clients: ", robot.mobile_client.tf_clients
print "tf_frame: ", robot.mobile_client.tf_frame
print st['marker_poses']
# ---------- end get_marker_frames ----------
rec_2 = DataRecorder(get_marker_frames.out, DataLimit=-10, RecordData=True)
panel_7 = Panel(rec_2)
list_14 = ValueList({"go to pose_1": 0, "go to pose_2": 1, "go to marker_pose": 2}, selected="go to pose_2")
number_slider = Slider(0.016, range=0..0.2)
radius = Slider(0.01, range=0..0.1)
send = Button()

clean_marker_values = GhPythonScript(option=list_10, target_frame=list_12, value=Slider(0, range=0..3), clean=clean)  # -> out
# ---------- clean_marker_values: Python ----------
from scriptcontext import sticky as st

if st['marker_poses'].get(target_frame):
    if option == 0 and clean:
        st['marker_poses'][target_frame] = []
    elif option == 1 and clean:
        st['marker_poses'][target_frame].pop(value)
else:
    print('No marker poses.')
# ---------- end clean_marker_values ----------

# ----
# Pick brick up with force mode
send_2 = Button()
generate_ur_script = PythonScript(robot=robot, routine=list_14, plane_WCF=pln, velocity=number_slider, radius=radius)  # -> out, frame_RCF, urscript; inputs plane_WCF: Plane
# ---------- generate_ur_script: Python ----------
from ur_fabrication_control.direct_control import URScript
from ur_fabrication_control.direct_control.mixins import AreaGripMixins
import math
from scriptcontext import sticky as st
import Rhino.Geometry as rg
from compas.artists import Artist
from compas.geometry import Frame, Transformation, Translation, Vector, Rotation, Point
from compas_fab.robots import Configuration

class URScript_RSRD(URScript, AreaGripMixins):
    pass

tool_angle_axis = list(robot.attached_tool.frame.point) + list(robot.attached_tool.frame.axis_angle_vector)

# go to pose 1
if routine == 0:
    pose_1_frame = Frame(st['marker_poses']['marker_0'][0].point, st['marker_poses']['marker_0'][0].zaxis, st['marker_poses']['marker_0'][0].yaxis).transformed(Translation.from_vector(Vector.Zaxis()*0.3)) #rotate them too
    pose_1_frame.transform(Translation.from_vector(-pose_1_frame.yaxis*0.1))
    pose_1_frame.transform(Rotation.from_axis_and_angle(pose_1_frame.xaxis, math.radians(-20), pose_1_frame.point))
    pose_1_frame.transform(Rotation.from_axis_and_angle(pose_1_frame.yaxis, math.radians(-20), pose_1_frame.point))
    print pose_1_frame
    commands = URScript_RSRD()
    commands.start()
    commands.set_tcp(tool_angle_axis)
    commands.move_linear(pose_1_frame, velocity, radius)
    commands.end() 

# go to pose 2
if routine == 1:
    pose_2_frame = Frame(st['marker_poses']['marker_0'][0].point, st['marker_poses']['marker_0'][0].zaxis, st['marker_poses']['marker_0'][0].yaxis).transformed(Translation.from_vector(Vector.Zaxis()*0.1))
    pose_2_frame.transform(Translation.from_vector(-pose_2_frame.xaxis*0.12)*Translation.from_vector(pose_2_frame.yaxis*0.05))
    pose_2_frame.transform(Rotation.from_axis_and_angle(pose_2_frame.xaxis, math.radians(20), pose_2_frame.point))
    pose_2_frame.transform(Rotation.from_axis_and_angle(pose_2_frame.yaxis, math.radians(20), pose_2_frame.point))
    print pose_2_frame
    commands = URScript_RSRD()
    commands.start()
    commands.set_tcp(tool_angle_axis)
    commands.move_linear(pose_2_frame, velocity, radius)
    commands.end()

# go to marker frame
if routine == 2:
    # To set plane:
    #frame_WCF = Frame(plane_WCF.Origin, plane_WCF.XAxis, plane_WCF.YAxis)
    #frame_BCF = frame_WCF.transformed(robot.transformation_WCF_BCF())
    #frame_RCF = frame_BCF.transformed(robot.transformation_BCF_RCF())
    
    # To marker frame:
    marker_frame = Frame(st['marker_poses']['marker_0'][0].point, st['marker_poses']['marker_0'][0].zaxis, st['marker_poses']['marker_0'][0].yaxis)
    marker_frame_safe = marker_frame.transformed(Translation.from_vector(Vector.Zaxis()*0.1))
    frame_RCF = marker_frame_safe.transformed(Translation.from_vector(marker_frame_safe.yaxis*0.087))
    
    commands = URScript_RSRD()
    commands.start()
    commands.set_tcp(tool_angle_axis)
    commands.set_payload(1.140)
    
    commands.move_linear(frame_RCF, velocity, radius)
    commands.add_line("\tsleep({})".format(2.0))
    commands.get_force()
    
    commands.force_mode_in_z(10.0, 0.025)
    commands.stop_by_force(10.0)
    commands.end_force_mode()
    
    commands.areagrip_on()
    commands.add_line("\tsleep({})".format(2.0))
    
    commands.move_linear(frame_RCF, velocity, radius)
    commands.add_line("\tsleep({})".format(2.0))
    commands.areagrip_off()
    
    commands.end() 

urscript = commands.generate()

print(urscript)
# ---------- end generate_ur_script ----------
draw = Draw(cg=generate_ur_script.frame_RCF)  # -> rg
#   port cg: The COMPAS geometry or datastructure to be drawn.
#   port rg: The Rhino geometry object.
# ---------- draw: Python ----------
"""
Draws COMPAS geometry in Grasshopper.
"""
from ghpythonlib.componentbase import executingcomponent as component

from compas.artists import Artist


class CompasToRhinoGeometry(component):
    def RunScript(self, cg):
        if not cg:
            return None

        return Artist(cg).draw()
# ---------- end draw ----------
send_3 = GhPythonScript(urscript=generate_ur_script.urscript, send=send_2)  # -> out; inputs send: Boolean
# ---------- send_3: Python ----------
from scriptcontext import sticky as st
from ur_fabrication_control.direct_control import send_script

ur_ip = st["ur_ip"]
ur_port = st["ur_port"]

print urscript
if send:
    send_script(urscript, ur_ip, ur_port)
# ---------- end send_3 ----------

# ----
# Get base frame to multiple fixed markers
# Calculate Basis - Point fitting method via RPC
list_15 = ValueList({"marker_0 frame": "marker_0", "marker_1 frame": "marker_1", "marker_2 frame": "marker_2", "marker_3 frame": "marker_3", "marker_4 frame": "marker_4"}, selected="marker_0 frame")
list_16 = ValueList({"camera frame": "camera_color_optical_frame", "robot base frame": "base"}, selected="robot base frame")
unsubscribe_3 = Button()
subscribe_3 = Button()
save_3 = Button()
print_3 = Button()
get_marker_frames_2 = GhPythonScript(
    robot=connect_2.robot,
    target_frame=list_15,
    reference_frame=list_16,
    subscribe=subscribe_3,
    save=save_3,
    unsubscribe=unsubscribe_3,
    print=print_3)  # -> out, bang
# ---------- get_marker_frames_2: Python ----------
from scriptcontext import sticky as st

if not st.get('marker_poses'):
    st['marker_poses'] = {}

if subscribe:
    robot.mobile_client.tf_subscribe(target_frame, reference_frame)

if save:
    if robot.mobile_client.tf_frame is not None:
        st['marker_poses'][target_frame] = robot.mobile_client.tf_frame

if unsubscribe:
    if robot.mobile_client.tf_frame is not None:
        robot.mobile_client.clean_tf_frame()
    robot.mobile_client.tf_unsubscribe(target_frame, reference_frame)

print "tf_clients: ", robot.mobile_client.tf_clients
print "tf_frame: ", robot.mobile_client.tf_frame
print st['marker_poses']
# ---------- end get_marker_frames_2 ----------
rec_3 = DataRecorder(get_marker_frames_2.out, DataLimit=-10, RecordData=True)
panel_8 = Panel(rec_3)

regenerate_base_plane_2 = GhPythonScript(
    robot=robot,
    redraw=get_marker_frames_2.bang,
    fixed_marker=list_9,
    set_to_fixed_marker=Toggle(False),
    fixed_marker_plane=fixed_marker_plane_2)  # -> out, base_plane, robot_plane, bang
# ---------- regenerate_base_plane_2: Python ----------
from scriptcontext import sticky as st
from compas.geometry import Transformation, Frame, Point
from compas.artists import Artist

fixed_marker_frame = Frame(fixed_marker_plane.Origin, fixed_marker_plane.XAxis, fixed_marker_plane.YAxis) 

if set_to_fixed_marker and st['marker_poses'].get(fixed_marker):
    MCF_in_RCF = st['marker_poses'][fixed_marker] #measured MCF in RCF
    MCF_in_BCF = MCF_in_RCF.transformed(robot.transformation_RCF_BCF()) #measured MCF in BCF
    
    BCF_in_MCF = Frame.from_transformation(Transformation.from_frame(MCF_in_BCF).inverted()) #BCF in measured MCF
    
    transformation_FMCF_WCF = Transformation.from_change_of_basis(fixed_marker_frame, Frame.worldXY()) #T from fixed MCF to WCF
    BCF_in_WCF = BCF_in_MCF.transformed(transformation_FMCF_WCF) #BCF in WCF
    
    robot.BCF = BCF_in_WCF
    robot_plane = Artist(robot.to_world_coordinates(robot.RCF)).draw()
    base_plane = Artist(BCF_in_WCF).draw()
# ---------- end regenerate_base_plane_2 ----------
generated_base_plane = Plane(regenerate_base_plane_2.base_plane)

# ----
# Base
set_base_frame = PythonScript(robot=robot, generated_base_plane=generated_base_plane)  # -> bang
# ---------- set_base_frame: Python ----------
from compas_ghpython import draw_frame
from compas.geometry import Frame, Point, Vector, Transformation
from compas.datastructures import Mesh
from compas_rhino.geometry import RhinoMesh
from compas_fab.robots import CollisionMesh

if generated_base_plane:
    base_frame = Frame(generated_base_plane.Origin, generated_base_plane.XAxis, generated_base_plane.YAxis)
else:
    base_frame = Frame.worldXY()

# Base_frame is BCF in WCF
if robot:
    robot.BCF = base_frame
    print(robot.BCF)
# ---------- end set_base_frame ----------

# ----
# Pick 'n place brick from marker_0 to marker_1
list_17 = ValueList({"pick & place within marker": 0, "go to safe pick plane": 1, "go to place plane": 2}, selected="pick & place within marker")
radius_2 = Slider(0.01, range=0..0.1)
send_4 = Button()
generate_ur_script_2 = PythonScript(
    robot=connect_2.robot,
    bang=regenerate_base_plane_2.bang,
    routine=list_17,
    velocity=Slider(0.016, range=0..0.2),
    radius=radius_2)  # -> out, picking_plane, picking_plane_safe, placing_plane, placing_plane_safe, urscript; inputs routine: Int32
# ---------- generate_ur_script_2: Python ----------
from ur_fabrication_control.direct_control import URScript
from ur_fabrication_control.direct_control.mixins import AreaGripMixins
import math
from scriptcontext import sticky as st
import Rhino.Geometry as rg
from compas.artists import Artist
from compas.geometry import Frame, Transformation, Translation, Vector, Rotation

class URScript_RSRD(URScript, AreaGripMixins):
    pass

tool_angle_axis = list(robot.attached_tool.frame.point) + list(robot.attached_tool.frame.axis_angle_vector)
sleep = 3.0

def from_RCF_to_WCF(point_in_RCF):
    point_in_BCF = point_in_RCF.transformed(robot.transformation_RCF_BCF()) #measured point in BCF
    point_in_WCF = point_in_BCF.transformed(robot.transformation_BCF_WCF()) #measured point in WCF
    return point_in_WCF

brick_height = 0.054

picking_frame = Frame(st['marker_poses']['marker_0'].point, st['marker_poses']['marker_0'].yaxis, -st['marker_poses']['marker_0'].zaxis)
placing_frame = Frame(st['marker_poses']['marker_1'].point, st['marker_poses']['marker_1'].yaxis, -st['marker_poses']['marker_1'].zaxis).transformed(Translation.from_vector(Vector.Zaxis()*brick_height))
picking_frame_safe = picking_frame.transformed(Translation.from_vector(Vector.Zaxis()*0.2))
placing_frame_safe = placing_frame.transformed(Translation.from_vector(Vector.Zaxis()*0.2))

picking_plane = Artist(from_RCF_to_WCF(picking_frame)).draw()
placing_plane = Artist(from_RCF_to_WCF(placing_frame)).draw()
picking_plane_safe = Artist(from_RCF_to_WCF(picking_frame_safe)).draw()
placing_plane_safe = Artist(from_RCF_to_WCF(placing_frame_safe)).draw()

# pick & place within marker
if routine == 0:
    commands = URScript_RSRD()
    commands.start()
    commands.set_tcp(tool_angle_axis)
    commands.move_linear(picking_frame_safe, velocity, radius)
    commands.move_linear(picking_frame, velocity, radius)
    commands.areagrip_on()
    commands.add_line("\tsleep({})".format(2.0))
    commands.move_linear(picking_frame_safe, velocity, radius)
    commands.move_linear(placing_frame_safe, velocity, radius)  
    commands.move_linear(placing_frame, velocity, radius=0)  
    commands.add_line("\tsleep({})".format(0.5))
    commands.areagrip_off()  
    commands.add_line("\tsleep({})".format(0.5))
    commands.move_linear(placing_frame_safe, velocity, radius)
    commands.end() 

# go to pick plane safe
if routine == 1:
    commands = URScript_RSRD()
    commands.start()
    commands.set_tcp(tool_angle_axis)
    commands.move_linear(picking_frame_safe, velocity, radius)
    commands.end() 

# go to placing frame
if routine == 2:
    commands = URScript_RSRD()
    commands.start()
    commands.set_tcp(tool_angle_axis)
    commands.move_linear(placing_frame_safe, velocity, radius)
    commands.move_linear(placing_frame, velocity, radius=0)
    commands.end()  

urscript = commands.generate()

print(urscript)
# ---------- end generate_ur_script_2 ----------
send_5 = GhPythonScript(urscript=generate_ur_script_2.urscript, send=send_4)  # -> out; inputs send: Boolean; same code as send_3
pln_4 = Plane(generate_ur_script_2.picking_plane)
pln_5 = Plane(generate_ur_script_2.picking_plane_safe)
pln_6 = Plane(generate_ur_script_2.placing_plane_safe)
pln_7 = Plane(generate_ur_script_2.placing_plane)

transform_measured_points = GhPythonScript(robot=connect_2.robot, bang=regenerate_base_plane_2.bang)  # -> out, pts_measured_marker_poses, pts_marker_poses
# ---------- transform_measured_points: Python ----------
import ghpythonlib.components as ghcomp
import Rhino.Geometry as rg
from scriptcontext import sticky as st
from compas.geometry import Transformation, Frame, Point
from compas_rhino.conversions import RhinoPoint
import math as m
import sys
from compas.rpc import Proxy # for calling the numpy function in CPython

pts_measured_marker_poses = []
pts_marker_poses = []

def from_RCF_to_WCF(point_in_RCF):
    point_in_BCF = point_in_RCF.transformed(robot.transformation_RCF_BCF()) #measured point in BCF
    point_in_WCF = point_in_BCF.transformed(robot.transformation_BCF_WCF()) #measured point in WCF
    return point_in_WCF

assert st['measured_marker_poses'].keys() == st['marker_poses'].keys()

for key in st['measured_marker_poses'].keys():
    pts_measured_marker_poses.append(from_RCF_to_WCF(RhinoPoint.from_geometry(st['measured_marker_poses'][key]).to_compas()))
    pts_marker_poses.append(from_RCF_to_WCF(st['marker_poses'][key].point))

print pts_measured_marker_poses
print pts_marker_poses
# ---------- end transform_measured_points ----------

generate_ur_script_3 = PythonScript(robot=connect_2.robot, bang=regenerate_base_plane_2.bang, routine=list_14, velocity=number_slider, radius=radius)  # -> out, urscript; inputs routine: Int32
# ---------- generate_ur_script_3: Python ----------
from ur_fabrication_control.direct_control import URScript
from ur_fabrication_control.direct_control.mixins import AreaGripMixins
import math
from scriptcontext import sticky as st
import Rhino.Geometry as rg
from compas.artists import Artist
from compas.geometry import Frame, Transformation, Translation, Vector, Rotation, Point

class URScript_RSRD(URScript, AreaGripMixins):
    pass

tool_angle_axis = list(robot.attached_tool.frame.point) + list(robot.attached_tool.frame.axis_angle_vector)
sleep = 3.0

def from_RCF_to_WCF(point_in_RCF):
    point_in_BCF = point_in_RCF.transformed(robot.transformation_RCF_BCF()) #measured point in BCF
    point_in_WCF = point_in_BCF.transformed(robot.transformation_BCF_WCF()) #measured point in WCF
    return point_in_WCF

brick_height = 0.054

#picking_plane = Artist(from_RCF_to_WCF(picking_frame)).draw()

# go to pose 1
if routine == 0:
    pose_1_frame = Frame(st['marker_poses']['marker_0'][0].point, st['marker_poses']['marker_0'][0].yaxis, -st['marker_poses']['marker_0'][0].zaxis).transformed(Translation.from_vector(Vector.Zaxis()*0.4)) #rotate them too
    pose_1_frame.transform(Translation.from_vector(pose_1_frame.yaxis*0.05))
    pose_1_frame.transform(Rotation.from_axis_and_angle(pose_1_frame.xaxis, math.radians(-20), pose_1_frame.point))
    print pose_1_frame
    commands = URScript_RSRD()
    commands.start()
    commands.set_tcp(tool_angle_axis)
    commands.move_linear(pose_1_frame, velocity, radius)
    commands.end() 

# go to pose 2
if routine == 1:
    pose_2_frame = Frame(st['marker_poses']['marker_0'][1].point, st['marker_poses']['marker_0'][1].yaxis, -st['marker_poses']['marker_0'][1].zaxis).transformed(Translation.from_vector(Vector.Zaxis()*0.2))
    pose_2_frame.transform(Translation.from_vector(pose_2_frame.yaxis*0.1))
    pose_2_frame.transform(Rotation.from_axis_and_angle(pose_2_frame.xaxis, math.radians(20), pose_2_frame.point))
    print pose_2_frame
    commands = URScript_RSRD()
    commands.start()
    commands.set_tcp(tool_angle_axis)
    commands.move_linear(pose_2_frame, velocity, radius)
    commands.end()

# go to marker frame
if routine == 2:
    marker_frame = Frame(st['marker_poses']['marker_0'][2].point, st['marker_poses']['marker_0'][2].yaxis, -st['marker_poses']['marker_0'][2].zaxis)
    marker_frame_safe = marker_frame.transformed(Translation.from_vector(Vector.Zaxis()*0.1))
    print marker_frame
    commands = URScript_RSRD()
    commands.start()
    commands.set_tcp(tool_angle_axis)
    commands.move_linear(marker_frame_safe, velocity, radius)
    commands.move_linear(marker_frame, velocity, radius=0)
#    commands.areagrip_on()
#    commands.add_line("\tsleep({})".format(2.0))
#    commands.move_linear(marker_frame_safe, velocity, radius)
#    commands.move_linear(marker_frame, velocity, radius=0)
#    commands.areagrip_off()  
#    commands.add_line("\tsleep({})".format(0.5))
#    commands.move_linear(marker_frame_safe, velocity, radius)
    commands.end()  

urscript = commands.generate()

print(urscript)
# ---------- end generate_ur_script_3 ----------
send_6 = GhPythonScript(urscript=generate_ur_script_3.urscript, send=send)  # -> out; inputs send: Boolean; same code as send_3

draw_2 = Draw(cg=transform_measured_points.pts_marker_poses)  # -> rg; same code as draw
draw_3 = Draw(cg=transform_measured_points.pts_measured_marker_poses)  # -> rg; same code as draw

calc_base = PythonScript(poses=transform_measured_points.pts_measured_marker_poses, pts_cad=pt, base_plane_init_guess=pln_3, calc=Toggle(True))  # -> out, pts_mtip_init_guess, pts_mtip_fit, base_plane_fit; inputs poses: list, pts_cad: list of Point3d, base_plane_init_guess: Plane
# ---------- calc_base: Python ----------
import ghpythonlib.components as ghcomp
import Rhino.Geometry as rg
from scriptcontext import sticky as st
from compas.geometry import Frame
import math as m
import sys
from compas.rpc import Proxy # for calling the numpy function in CPython

#icp_func = Proxy('ur_fabrication_control.optimisation.icp', python = 'C://Users//doerf//.conda//envs//rsrd_22//python.exe') #C:\Users\doerf\.conda\envs\rsrd_22
#print icp_func._python
print poses

if len(poses):
    
    # get points from poses
    pts_mtip = [rg.Point3d(p[0], p[1], p[2]) for p in poses]
    
    T_W_R_init_guess = rg.Transform.PlaneToPlane(rg.Plane.WorldXY, base_plane_init_guess)
    pts_mtip_init_guess = [ghcomp.Transform(pt, T_W_R_init_guess) for pt in pts_mtip]
    
    # format Rhino transformation
    T_W_R_init_guess_flattened = [float(f) for f in T_W_R_init_guess.ToFloatArray(True)]
    T_W_R_init_guess_list = [T_W_R_init_guess_flattened[i:(i + 4)] for i in range(0, len(T_W_R_init_guess_flattened), 4)]  

    # format ptsA and ptsB
    dataB = [list(pt) for pt in pts_cad]
    dataA = [list(pt) for pt in pts_mtip]
    
    # call the function
    max_iterations = 100
    
    if calc:
        icp_func = Proxy('ur_fabrication_control.optimisation.icp', python = 'C://ProgramData//Anaconda3//envs//afab1//python.exe')
        #icp_func = Proxy('ur_fabrication_control.optimisation.icp', python = 'C://Users//doerf//.conda//envs//rsrd_22//python.exe') #C:\Users\doerf\.conda\envs\rsrd_22
        
        
        print icp_func._python

        transformation, distances = icp_func.icp(dataA, dataB, init_guess=T_W_R_init_guess_list, max_iterations=max_iterations, tolerance=0.000001)
        
        print "distances", distances
        
        # format result
        T = rg.Transform.Identity
        for i in range(4):
            for j in range(4):
                code = "T.M%i%i = %f" % (i, j, transformation[i][j])
                print code
                exec(code)
        #print T
        
        # now transform the points with the transformation calculated
        pts_mtip_fit = [ghcomp.Transform(pt, T) for pt in pts_mtip]
        base_plane_fit = ghcomp.Transform(rg.Plane.WorldXY, T)
        
        
        #f = Frame(base_plane_fit)
        #print f.get_pose_quaternion()
        
        # correct the zvalue
        #base_plane_fit = ghcomp.Transform(base_plane_fit, rg.Transform.Translation(0,0,-3))
# ---------- end calc_base ----------
pt_2 = Point(calc_base.pts_mtip_fit)
pt_3 = Point(calc_base.pts_mtip_init_guess)
pln_8 = Plane(calc_base.base_plane_fit)

# ----
# Visualisation
show_end_effector_frame = BooleanToggle(True)
show_base_frame = BooleanToggle(True)
show_collision = BooleanToggle(False)
show_frames = BooleanToggle(False)
show_visual = BooleanToggle(True)
show_acm = BooleanToggle(False)
list_18 = ValueList({"Zero": 0, "One": 1, "Two": 2, "Three": 3, "Four": 4, "Five": 5}, selected="Zero")
visualize = PythonScript(
    robot=robot,
    tool=tool.tool,
    group=info.main_group_name,
    configuration=filter,
    redraw=[attach_remove.bang, set_base_frame],
    show_visual=show_visual,
    show_collision=show_collision,
    show_end_effector_frame=show_end_effector_frame,
    show_frames=show_frames,
    show_robot_frames=show_base_frame,
    show_acm=show_acm,
    station=list_18)  # -> out, robot, visual, collision, attached_meshes, frames, ee_frame, tool0_frame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; inputs redraw: list, attached_collision_meshes: list, station_pts: list
# ---------- visualize: Python ----------
import rhinoscriptsyntax as rs
import Rhino.Geometry as rg
import ghpythonlib.components as ghcomp
from compas.geometry import Vector
from compas.geometry import Point
from compas.geometry import Transformation
from compas.geometry import Frame
from compas_ghpython.artists import MeshArtist
from compas_ghpython.utilities import draw_frame
from compas_fab.robots import Configuration
from ur_fabrication_control.kinematics.ur_kinematics import forward_kinematics
from ur_fabrication_control.kinematics.ur_params import ur_params

print(configuration)

if robot and configuration:
    robot.update(configuration, visual=show_visual, collision=show_collision)
    
    ur_params = ur_params[robot.main_group_name]
    
    print(ur_params)
    if show_visual:
        visual = robot.artist.draw_visual()
        robot_BCF = draw_frame(robot.BCF) 
#        init_robot_plane = rg.Plane(rg.Point3d(0.275, 0.0, 1.105), rg.Vector3d(-0.707, 0.707, 0.0), rg.Vector3d(-0.707, -0.707,0.0))
        init_robot_plane = rg.Plane.WorldXY
        visual = ghcomp.Orient(visual, init_robot_plane, robot_BCF)[0]
    
    if show_collision:
        collision = robot.artist.draw_collision()
    
    frames = robot.transformed_frames(configuration, group)
    
    if show_robot_frames:
        base_frame = robot.BCF
        robot_frame = robot.to_world_coordinates(robot.RCF)
    
    if show_end_effector_frame:    
#        tool0_frame = forward_kinematics(configuration.revolute_values, ur_params)
        print robot
        ee_frame = robot.forward_kinematics(configuration, group)
        print ee_frame
        if robot.attached_tool:
            tool0_frame = robot.from_tcf_to_t0cf([ee_frame])
        print("End-effector", ee_frame)
    
    if not show_frames:
        frames = None

    frame = robot.forward_kinematics(configuration, options=dict(solver='model'))
    
    if show_acm: # attached collision meshes
        M = []
        for acm in attached_collision_meshes:
            frame = robot.forward_kinematics(configuration, options=dict(solver='model', link_name=acm.link_name))
            T = Transformation.from_frame_to_frame(Frame.worldXY(), frame)
            mesh = acm.collision_mesh.mesh.transformed(T)
            M.append(MeshArtist(mesh).draw())
        attached_meshes = M
# ---------- end visualize ----------
geo = Geometry(visualize.collision)
geo_2 = Geometry(visualize.visual)
draw_4 = GhPythonScript(frames=[visualize.base_frame, visualize.robot_frame], scale=Slider(0.1, range=0..1))  # -> P, V, C, W; inputs frames: list
# ---------- draw_4: Python ----------
from System.Drawing import Color
from compas_ghpython.utilities import draw_frame

red = Color.FromArgb(255, 0, 0)
green = Color.FromArgb(0, 255, 0)
blue = Color.FromArgb(0, 0, 255)

P = []
V = []
C = []

scale = float(scale)

for frame in frames:
    if not frame:
        continue
    plane = draw_frame(frame)
    P += [plane.Origin] * 3
    V.append(plane.XAxis * scale)
    V.append(plane.YAxis * scale)
    V.append(plane.ZAxis * scale)
    C += [red, green, blue]

W = 3
# ---------- end draw_4 ----------
preview = CustomPreview(Geometry=geo_2, Shader=ColourSwatch(SwatchColor=RGB(105, 105, 105)))
preview_2 = CustomPreview(Geometry=visualize.attached_meshes, Shader=ColourSwatch(SwatchColor=RGB(255, 255, 255)))
vdisex = VectorDisplayEx(Point=draw_4.P, Vector=draw_4.V, Colour=draw_4.C, Width=draw_4.W)

# ----
# Move Joints
idx = Slider(0, range=0..100)
list_19 = ValueList({"send all positions": 0, "send only one position": 1, "send snapshot position": 2}, selected="send only one position")
send_7 = Button()

# ----
# Direct UR Control
config = GhPythonScript(config=inverse.configuration)  # -> out, joint_configs
# ---------- config: Python ----------
from compas_fab.robots import Configuration

#values=[-0.785, -1.571, 1.571, -1.571, -1.571, -1.571]
#((-0.785, -1.571, 1.571, -1.571, -1.571, -1.571), (0, 0, 0, 0, 0, 0))
joint_configs = [config]
# ---------- end config ----------

item = ListItem(List=config.joint_configs, Index=idx, Wrap=True)
filter_2 = StreamFilter(Gate=list_19, Stream0=config.joint_configs, Stream1=item, Stream2=snapshot_configuration.configuration)
movej = PythonScript(joint_configurations=filter_2, velocity=Slider(0.04, range=0..0.5))  # -> urscript, values; inputs joint_configurations: list
# ---------- movej: Python ----------
from ur_fabrication_control.direct_control import URScript
import math

urscript = URScript()
urscript.start()
for jc in joint_configurations:
    urscript.move_joint(jc, velocity)
urscript.end()

urscript = urscript.generate()

print(urscript)
# ---------- end movej ----------
send_8 = GhPythonScript(urscript=movej.urscript, send=send_7)  # -> out; inputs send: Boolean
# ---------- send_8: Python ----------
from scriptcontext import sticky as st
from ur_fabrication_control.direct_control import send_script

ur_ip = st["ur_ip"]
ur_port = st["ur_port"]

print urscript

if send:
    send_script(urscript, ur_ip, ur_port)
# ---------- end send_8 ----------

# ----
# Get Pose Cartesian
get_2 = Button()
pose_2 = PythonScript(robot=robot, get=get_2)  # -> out, pose_cartesian_meter
# ---------- pose_2: Python ----------
from scriptcontext import sticky as st
#from ur_fabrication_control.online_control.ur_direct import get_current_pose_cartesian

from ur_fabrication_control.direct_control.common import get_current_pose_cartesian
from compas.geometry import Frame
from compas_ghpython import draw_frame


server_ip = st["server_ip"]
server_port = st["server_port"]
ur_port = st["ur_port"]
ur_ip = st["ur_ip"]
pose_cartesian_meter = []
print ur_ip

# retrieve the current tool frame in axis angle format
if robot.attached_tool:
    print ("attached")
    tool_angle_axis = list(robot.attached_tool.frame.point) + list(robot.attached_tool.frame.axis_angle_vector)
    
else:
    tool0_frame = Frame([0, 0, 0], [1, 0, 0], [0, 1, 0])
    tool_angle_axis = list(tool0_frame.point) + list(tool0_frame.axis_angle_vector)

print(tool_angle_axis)

guid = str(ghenv.Component.InstanceGuid)
pose_cartesian_key = "pose_cartesian" + guid


if get:
    print ("getting pose")
    st[pose_cartesian_key] = get_current_pose_cartesian(tool_angle_axis, server_ip, server_port, ur_ip, ur_port, send=True)
#    st[pose_cartesian_key] = get_current_pose_cartesian(server_ip, server_port, ur_ip, tool_angle_axis)
    

if pose_cartesian_key not in st:
    pose_cartesian_mm = []
    pose_cartesian_meter = []
else:
    pose_cartesian = st[pose_cartesian_key]

for i in pose_cartesian:
    new_c = i / 1000
    pose_cartesian_meter.append(new_c)

print (pose_cartesian_meter)
# ---------- end pose_2 ----------

rec_4 = DataRecorder(pose_2.out, DataLimit=-10, RecordData=True)

panel_9 = Panel(rec_4)

# ----
# Save tool measured poses
list_20 = ValueList({"marker_0 frame": "marker_0", "marker_1 frame": "marker_1", "marker_2 frame": "marker_2", "marker_3 frame": "marker_3", "marker_4 frame": "marker_4"}, selected="marker_0 frame")
list_21 = ValueList({"camera frame": "camera_color_optical_frame", "robot base frame": "base"}, selected="robot base frame")
save_4 = Button()
get_marker_poses = GhPythonScript(pose=pose_2.pose_cartesian_meter, target_frame=list_20, reference_frame=list_21, save=save_4)  # -> out; inputs pose: list
# ---------- get_marker_poses: Python ----------
from scriptcontext import sticky as st
import Rhino.Geometry as rg

if not st.get('measured_marker_poses'):
    st['measured_marker_poses'] = {}

if save:
    if len(pose):
        pose_point = rg.Point3d.Multiply(rg.Point3d(pose[0], pose[1], pose[2]), 1000)
        st['measured_marker_poses'][target_frame] = pose_point

print st['measured_marker_poses']
# ---------- end get_marker_poses ----------

panel_10 = Panel(get_marker_poses)
