# Grasshopper definition ex03_robotic_disassembly.ghx (Grasshopper 1.0.7)

reload = Button()
panel = Panel("Unload libraries")
py = PythonScript(reload=reload)
# ---------- py: Python ----------
from compas_ghpython import unload_modules

if reload:
    unload_modules("roslibpy")
    unload_modules("fabrication_manager")
    unload_modules("assembly_information_model")
    unload_modules("am_information_model")
    unload_modules("ur_fabrication_control")
    unload_modules("mobile_robot_control")
    unload_modules("extruder_control")
# ---------- end py ----------

generated_base_plane = Plane()

# ----
# IP Settings
# --> Set your IP address
# --> Set robot IP address
server_ip = ValueList({"192.168.10.44", "192.168.10.12", "192.168.10.11", "192.168.10.10", "192.168.10.2", "127.0.0.1", "192.168.10.111", "192.168.0.250", "192.168.0.30", "10.42.0.212", "10.42.0.133"}, selected="192.168.0.250")
ext_ip = ValueList({"192.168.10.10", "192.168.10.20", "192.168.10.11", "192.168.10.12", "127.0.0.1", "192.168.10.111", "192.168.0.220", "192.168.0.30", "192.168.10.50", "0.0.0.0"}, selected="192.168.0.220")
ur_ip = ValueList({"192.168.10.10", "192.168.10.20", "192.168.10.11", "192.168.10.12", "127.0.0.1", "192.168.10.111", "192.168.0.210", "192.168.0.30"}, selected="192.168.0.210")
server_port = ValueList({"50002", "50003", "50005", "50006", "50007", "50008", "50009", "50010", "50011", "50012", "50013", "50014", "50015", "50016", "50017", "50018", "50019"}, selected="50017")
ext_port = ValueList({"50003", "50004"}, selected="50004")
ur_port = ValueList({"30002"}, selected="30002")
globals = PythonScript(
    server_ip=server_ip,
    server_port=server_port,
    ur_ip=ur_ip,
    ur_port=ur_port,
    ext_ip=ext_ip,
    ext_port=ext_port,
    clear=Button())  # inputs server_port: Int32
# ---------- globals: Python ----------
from scriptcontext import sticky as st

st["server_ip"] = server_ip
st["server_port"] = server_port

st["ur_ip"] = ur_ip
st["ur_port"] = ur_port

st["ext_ip"] = ext_ip
st["ext_port"] = ext_port


if clear:
    st.clear()
# ---------- end globals ----------

# ----
# Check if UR robot
#  is available
ping = Button()
py_2 = PythonScript(ip=ur_ip, ping=ping)  # -> out, trigger
# ---------- py_2: Python ----------
from scriptcontext import sticky as st
from ur_fabrication_control.direct_control.utilities import is_available

guid = str(ghenv.Component.InstanceGuid)
txt_key = "txt_" + guid
if txt_key not in st:
    st[txt_key] = ""

if ping:
    
    available = is_available(ip)
    
    if available:
        st[txt_key] = "%s is up!" % ip
        trigger = True
    else:
        st[txt_key] = "%s is down!" % ip
        trigger = False

print(st[txt_key])
# ---------- end py_2 ----------
panel_2 = Panel(py_2.out)

list = ValueList({"local": "127.0.0.1", "linux computer": "192.168.0.42"}, selected="linux computer")

# ----
# State viewer
trigger = Trigger(Interval=100, TimerInterval=100, Target=fabrication_state)
fabrication_state = PythonScript()  # -> out, state, num_tasks, num_current_task, num_tasks_left, log_messages
# ---------- fabrication_state: Python ----------
from scriptcontext import sticky as st

fabrication = st["fabrication"]

if hasattr(fabrication, "task_thread"):
    if fabrication.task_thread.is_alive():
        state = "THREAD RUNNING"
    else:
        state = "THREAD STOPPED"

num_tasks = len(fabrication.tasks)
if fabrication.current_task_key is not None:
    num_current_task = fabrication.current_task_key+1
else:
    num_current_task = 0
num_tasks_left = num_tasks-num_current_task
log_messages = fabrication.log_messages
# ---------- end fabrication_state ----------
state = Panel(fabrication_state.state)
num_tasks = Panel(fabrication_state.num_tasks)
num_current_task = Panel(fabrication_state.num_current_task)
num_tasks_left = Panel(fabrication_state.num_tasks_left)
log_messages = Panel(fabrication_state.log_messages)

# ----
# Stop
stop = Button()
stop_2 = PythonScript(stop=stop)
# ---------- stop_2: Python ----------
from scriptcontext import sticky as st
from ur_fabrication_control.direct_control.common import send_stop

ur_ip = st["ur_ip"]
ur_port = st["ur_port"]

if stop:
    send_stop(ur_ip, ur_port)
# ---------- end stop_2 ----------

# ----
# Configuration
l = Slider(0, range=0..0.72)
x_axis = Curve(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)
y_axis = Curve(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)
plane = PythonScript(plane_axes=[x_axis, y_axis])  # -> plane; inputs plane_axes: list of Curve
# ---------- plane: Python ----------
import Rhino.Geometry as rg

x_axis, y_axis = plane_axes

x_axis = rg.Line(x_axis.PointAtStart, x_axis.PointAtEnd)
y_axis = rg.Line(y_axis.PointAtStart, y_axis.PointAtEnd)

if x_axis.From.DistanceTo(y_axis.From) < 0.01:
    origin = x_axis.From
    xvec = x_axis.Direction
    yvec = y_axis.Direction
elif x_axis.To.DistanceTo(y_axis.To) < 0.01:
    origin = x_axis.To
    xvec = -x_axis.Direction
    yvec = -y_axis.Direction
elif x_axis.From.DistanceTo(y_axis.To) < 0.01:
    origin = x_axis.From
    xvec = x_axis.Direction
    yvec = -y_axis.Direction
elif x_axis.To.DistanceTo(y_axis.From) < 0.01:
    origin = x_axis.To
    xvec = -x_axis.Direction
    yvec = y_axis.Direction

plane = rg.Plane(origin, xvec, yvec)
# ---------- end plane ----------

# ----
# Area Gripper Switch
suction = BooleanToggle(False)
blow_off = BooleanToggle(False)
digital_out = PythonScript(suction=suction, blow_off=blow_off)  # -> urscript
# ---------- digital_out: Python ----------
from ur_fabrication_control.direct_control import URScript
from ur_fabrication_control.direct_control.mixins import AreaGripMixins

class URScript_AreaGrip(URScript, AreaGripMixins):
    pass

urscript = URScript_AreaGrip()
urscript.start()

if suction == True and blow_off == False:
    urscript.areagrip_on()
elif blow_off == True:
    urscript.areagrip_blowoff()
elif suction == False and blow_off == False:
    urscript.areagrip_off()

urscript.end()
urscript = urscript.generate()
print(urscript)
# ---------- end digital_out ----------
send = Button()
send_2 = GhPythonScript(urscript=digital_out, send=send)  # -> out; inputs send: Boolean
# ---------- send_2: Python ----------
from scriptcontext import sticky as st
from ur_fabrication_control.direct_control import send_script

ur_ip = st["ur_ip"]
ur_port = st["ur_port"]

if send:
    send_script(urscript, ur_ip, ur_port)
# ---------- end send_2 ----------

# ----
# Block is red due to invalid inputs, though remains perfectly functional
pln = Plane(plane)
pln_2 = Plane(Plane(origin=(1.169466192, 0, 1.192625429), x=(0, 1, 0), y=(0.9806906575, 0, -0.1955654221)))
# Load robot from local package
# Not working for what reason???
py_3 = PythonScript()  # -> repositories_path, rbvogui_data_path, ur_data_path
# ---------- py_3: Python ----------
import os

"""
ASSUMING THE BELOW PACKAGES ARE STORED IN THE SAME LOCATION:
    ur_fabrication_control;
    rbvogui_common; and
    mobile_additive_manufacturing.
"""

repositories_path = os.path.abspath(os.path.join(ghdoc.Path,"../../../"))

assert os.path.exists(os.path.join(repositories_path, "ur_fabrication_control/data"))
assert os.path.exists(os.path.join(repositories_path, "rbvogui_common/rbvogui_description"))
assert os.path.exists(os.path.join(repositories_path, "mobile_robot_control"))

ur_data_path = os.path.abspath(os.path.join(ghdoc.Path,"../../../ur_fabrication_control/data"))
rbvogui_data_path = os.path.abspath(os.path.join(repositories_path, "rbvogui_common"))
# ---------- end py_3 ----------

# ----
# Robot Model
py_4 = PythonScript(repositories_path=py_3.repositories_path, rbvogui_data_path=py_3.rbvogui_data_path, ur_data_path=py_3.ur_data_path)  # -> loaders, urdf_filename, srdf_filename
# ---------- py_4: Python ----------
import os
from compas.robots import LocalPackageMeshLoader

#loaders

ur_path = os.path.join(ur_data_path, "robot_description")
ur_packages = ["ur_description", "ur_e_description", "ur_end_effectors", "ur_setups"]
ur_loaders = [LocalPackageMeshLoader(ur_path, pck) for pck in ur_packages]

rbvogui_packages = ["rbvogui_description"]
rbvogui_loaders = [LocalPackageMeshLoader(rbvogui_data_path, pck) for pck in rbvogui_packages]

ewellix_packages = ["ewellix_description"]
ewellix_loaders = [LocalPackageMeshLoader(repositories_path, pck) for pck in ewellix_packages]

sensors_packages = ["robotnik_sensors"]
sensors_loaders = [LocalPackageMeshLoader(repositories_path, pck) for pck in sensors_packages]

loaders = ur_loaders + rbvogui_loaders + ewellix_loaders + sensors_loaders

#files
urdf_filename = os.path.join(repositories_path, r"mobile_robot_control\data\rbvogui_xl_lift_ur10e.urdf")
srdf_filename = os.path.join(repositories_path, r"mobile_robot_control\data\rbvogui.srdf")

assert os.path.isfile(urdf_filename)
assert os.path.isfile(srdf_filename)
# ---------- end py_4 ----------
units = ValueList({"m": 1, "cm": 100, "mm": 1000}, selected="m")
load = Button()
create = PythonScript(load=load, loaders=py_4.loaders, urdf_filename=py_4.urdf_filename, srdf_filename=py_4.srdf_filename, scale_factor=units)  # -> out, robot; inputs load: Boolean, loaders: list
# ---------- create: Python ----------
import os
from scriptcontext import sticky as st

import compas

from compas_ghpython import draw_frame
from compas.robots import RobotModel
from compas.robots import LocalPackageMeshLoader

from mobile_robot_control.mobile_robot import MobileRobot
from mobile_robot_control.mobile_robot_client import MobileRobotClient
from compas_fab.robots import RobotSemantics
from compas_fab.ghpython import RobotArtist

compas.PRECISION = '12f'

# store robot in component
guid = str(ghenv.Component.InstanceGuid)
robot_key = "robot"

if robot_key not in st:
    st[robot_key] = None

#print loaders
if load:
    model = RobotModel.from_urdf_file(urdf_filename)
    model.load_geometry(*loaders)
    artist = RobotArtist(model)
    semantics = RobotSemantics.from_srdf_file(srdf_filename, model)
    robot = MobileRobot(model, artist, semantics)
    
    st[robot_key] = robot

robot = st[robot_key]
print(robot)

if robot:
    robot.scale(scale_factor)
# ---------- end create ----------

# ----
# Get frames
list_2 = ValueList({"marker_0", "marker_1", "marker_2", "marker_3", "marker_4", "marker_5", "brick_0"}, selected="brick_0")
print = Button()
list_3 = ValueList({"camera frame": "camera_color_optical_frame", "robot base frame": "base"}, selected="robot base frame")
unsubscribe = Button()
subscribe = Button()
save = Button()
clean = Button()
list_4 = ValueList({"all": 0, "selected": 1}, selected="selected")
clean_marker_values = GhPythonScript(option=list_4, target_frame=list_2, value=Slider(0, range=0..3), clean=clean)  # -> out
# ---------- clean_marker_values: Python ----------
from scriptcontext import sticky as st

if st['marker_poses'].get(target_frame):
    if option == 0 and clean:
        st['marker_poses'][target_frame] = []
    elif option == 1 and clean:
        st['marker_poses'][target_frame].pop(value)
else:
    print('No marker poses.')
# ---------- end clean_marker_values ----------

# ----
# Fabrication manager
# 3>
button = Button()
start_fabrication = Button()
stop_fabrication = Button()
next_task = Button()
reset_task = Button()
prev_task = Button()
set_tasks = Button()
reset = Button()
init = Button()

# ----
# Load robot from local package
py_5 = PythonScript()  # -> repositories_path, rbvogui_data_path, ur_data_path; same code as py_3
list_5 = ValueList({"indoor", "outdoor"}, selected="outdoor")

# ----
# Robot Model
py_6 = PythonScript(
    repositories_path=py_5.repositories_path,
    rbvogui_data_path=py_5.rbvogui_data_path,
    ur_data_path=py_5.ur_data_path,
    wheel_type=list_5)  # -> loaders, urdf_filename, srdf_filename
# ---------- py_6: Python ----------
import os
from compas.robots import LocalPackageMeshLoader

#loaders

ur_path = os.path.join(ur_data_path, "robot_description")
ur_packages = ["ur_description", "ur_e_description", "ur_end_effectors", "ur_setups"]
ur_loaders = [LocalPackageMeshLoader(ur_path, pck) for pck in ur_packages]

rbvogui_packages = ["rbvogui_description"]
rbvogui_loaders = [LocalPackageMeshLoader(rbvogui_data_path, pck) for pck in rbvogui_packages]

ewellix_packages = ["ewellix_description"]
ewellix_loaders = [LocalPackageMeshLoader(repositories_path, pck) for pck in ewellix_packages]

sensors_packages = ["robotnik_sensors"]
sensors_loaders = [LocalPackageMeshLoader(repositories_path, pck) for pck in sensors_packages]

loaders = ur_loaders + rbvogui_loaders + ewellix_loaders + sensors_loaders

#files
if wheel_type=="indoor":
    urdf_filename = os.path.join(repositories_path, r"mobile_robot_control\data\rbvogui_xl_lift_ur10e_indoor.urdf")
if wheel_type == "outdoor":
    urdf_filename = os.path.join(repositories_path, r"mobile_robot_control\data\rbvogui_xl_lift_ur10e.urdf")
srdf_filename = os.path.join(repositories_path, r"mobile_robot_control\data\rbvogui.srdf")

assert os.path.isfile(urdf_filename)
assert os.path.isfile(srdf_filename)
# ---------- end py_6 ----------
load_2 = Button()
units_2 = ValueList({"m": 1, "cm": 100, "mm": 1000}, selected="m")
create_2 = PythonScript(
    load=load_2,
    loaders=py_6.loaders,
    urdf_filename=py_6.urdf_filename,
    srdf_filename=py_6.srdf_filename,
    scale_factor=units_2,
    wheel_type=list_5)  # -> out, robot, rcf; inputs load: Boolean, loaders: list
# ---------- create_2: Python ----------
import os
from scriptcontext import sticky as st

import compas

from compas_ghpython import draw_frame
from compas.robots import RobotModel
from compas.robots import LocalPackageMeshLoader

from mobile_robot_control.mobile_robot import MobileRobot
from compas_fab.robots import RobotSemantics
from compas_fab.ghpython import RobotArtist

compas.PRECISION = '12f'

# store robot in component
guid = str(ghenv.Component.InstanceGuid)
robot_key = "robot"

if robot_key not in st:
    st[robot_key] = None

#print loaders
if load:
    model = RobotModel.from_urdf_file(urdf_filename)
    model.load_geometry(*loaders)
    artist = RobotArtist(model)
    semantics = RobotSemantics.from_srdf_file(srdf_filename, model)
    robot = MobileRobot(model, artist, semantics, client=None)
    
    st[robot_key] = robot

robot = st[robot_key]
robot.wheel_type = wheel_type
print(robot)

rcf = draw_frame(robot.get_RCF())
print(rcf)
# ---------- end create_2 ----------

robot = Data(create_2.robot)
pln_3 = Plane(create_2.rcf)

# ----
# Tool
list_6 = ValueList({"measurement_tool": 0, "clay_extruder_7mm": 1, "area_gripper": 2, "area_gripper_435i": 3}, selected="area_gripper_435i")
show = BooleanToggle(True)
py_7 = PythonScript()  # -> DATA
# ---------- py_7: Python ----------
import os

#package_path = os.path.dirname(mobile_fabrication_control.__file__)
#DATA = os.path.abspath(os.path.join(package_path,"../../data"))

package_path = ghdoc.Path
# package_path = os.path.dirname(ur_fabrication_control.__file__)
#DATA = os.path.abspath(os.path.join(package_path,"../../data"))

# .stl files not stored in am_hackathon repo. but in mobile_fabrication_control
DATA = os.path.abspath(os.path.join(package_path,"../../../mobile_robot_control/data"))

print(package_path)
print(DATA)
# ---------- end py_7 ----------
tool = PythonScript(data_path=py_7, tool=list_6, show=show)  # -> tool, M, ee_plane
# ---------- tool: Python ----------
import os, math
from compas.geometry import Frame, Rotation
from compas.datastructures import Mesh
from compas_ghpython.artists import MeshArtist
from compas_fab.robots import Tool
from compas_ghpython.utilities import draw_frame

tolerance = 0

if tool == 0:
    filename = 'measurement_tool_zaxis.stl'
    ee_frame = Frame([0, 0, 0.109], [1, 0, 0], [0, 1, 0])

elif tool == 1:
    filename = 'clay_extruder_7mm.stl'
    # real frame:
    ee_frame = Frame([-0.000502, -0.105348, 0.0662,], [1, 0, 0], [0, 0, 1])
    
    # test frame:
    # ee_frame = Frame([0.0, 0.0, 0.1,], [1, 0, 0], [0, 1, 0])

elif tool == 2:
    filename = 'area_gripper_zaxis.stl'
    ee_frame = Frame([0, 0, 0.10219 + tolerance], [0, 1, 0], [-1, 0, 0])

elif tool == 3:
    filename = 'area_gripper_d435i_zaxis.stl'
    ee_frame = Frame([0, 0, 0.10219 + tolerance], [0, 1, 0], [-1, 0, 0])
#    ee_frame = Frame([0.054, 0, 0.065 + tolerance], [0, 1, 0], [-1, 0, 0])


data_path = os.path.join(data_path, "tool_geometry")
fullfilename = os.path.join(data_path, filename)
print fullfilename

ee_mesh = Mesh.from_stl(fullfilename)

if show:
    artist = MeshArtist(ee_mesh)
    M = artist.draw()

tool = Tool(ee_mesh, ee_frame)
ee_plane = draw_frame(ee_frame)
print(ee_frame.quaternion.xyzw)
ee_framek = Frame([0.0110607,0.00809854,0.41498], [0,1,0], [1,0,0])
print(ee_framek.quaternion.xyzw)
# ---------- end tool ----------
panel_3 = Panel("Attach a custom tool")
remove = Button()
add = Button()
attach_remove = PythonScript(robot=robot, tool=tool.tool, attach=add, remove=remove)  # -> out, bang
# ---------- attach_remove: Python ----------
if attach:
    robot.attach_tool(tool)
if remove:
    robot.detach_tool()
# ---------- end attach_remove ----------

# ----
# Base
set_base_frame = PythonScript(robot=robot, generated_base_plane=generated_base_plane)  # -> bang
# ---------- set_base_frame: Python ----------
from compas_ghpython import draw_frame
from compas.geometry import Frame, Point, Vector, Transformation
from compas.datastructures import Mesh
from compas_rhino.geometry import RhinoMesh
from compas_fab.robots import CollisionMesh

if generated_base_plane:
    base_frame = Frame(generated_base_plane.Origin, generated_base_plane.XAxis, generated_base_plane.YAxis)
else:
    base_frame = Frame.worldXY()

# Base_frame is BCF in WCF
if robot:
    robot.BCF = base_frame
    print(robot.BCF)
# ---------- end set_base_frame ----------

tasks = GhPythonScript(create=button, robot=robot)  # -> tasks
# ---------- tasks: Python ----------
import time
from scriptcontext import sticky as st
from fabrication_manager.task import Task
from ur_fabrication_control.direct_control.fabrication_process import URTask
from mobile_robot_control import MobileRobotGetMarkerPoseTask, MobileRobotHomeConfigurationTask, MobileRobotMarkerSnapshotTask, MobileRobotPickPlaceTask

ur_ip = st['ur_ip']
ur_port = st['ur_port']
robot_address = (ur_ip, ur_port)

if create:
    task0 = MobileRobotHomeConfigurationTask(robot, robot_address, velocity=0.06, key=0)
    task1 = MobileRobotGetMarkerPoseTask(robot, marker_id='marker_1', key=1)
    
    task2 = MobileRobotMarkerSnapshotTask(robot, robot_address, routine=0, marker_id='marker_1', key=2)
    task3 = MobileRobotGetMarkerPoseTask(robot, marker_id='marker_1', key=3)
    task4 = MobileRobotMarkerSnapshotTask(robot, robot_address, routine=1, marker_id='marker_1', key=4)
    task5 = MobileRobotGetMarkerPoseTask(robot, marker_id='marker_1', key=5)
    
    #brick 1
    task6 = MobileRobotHomeConfigurationTask(robot, robot_address, velocity=0.06, key=6)
    task7 = MobileRobotGetMarkerPoseTask(robot, marker_id='marker_0', key=7)
    
    task8 = MobileRobotMarkerSnapshotTask(robot, robot_address, routine=0, marker_id='marker_0', key=8)
    task9 = MobileRobotGetMarkerPoseTask(robot, marker_id='marker_0', key=9)
    task10 = MobileRobotMarkerSnapshotTask(robot, robot_address, routine=1, marker_id='marker_0', key=10)
    task11 = MobileRobotGetMarkerPoseTask(robot, marker_id='marker_0', key=11)
    
    task12 = MobileRobotPickPlaceTask(robot, robot_address, brick_no=1, marker_id='marker_0', target_marker_id='marker_1', key=12)
    
    #brick 2
    task13 = MobileRobotHomeConfigurationTask(robot, robot_address, velocity=0.06, key=13)
    task14 = MobileRobotGetMarkerPoseTask(robot, marker_id='marker_2', key=14)
    
    task15 = MobileRobotMarkerSnapshotTask(robot, robot_address, routine=0, marker_id='marker_2', key=15)
    task16 = MobileRobotGetMarkerPoseTask(robot, marker_id='marker_2', key=16)
    task17 = MobileRobotMarkerSnapshotTask(robot, robot_address, routine=1, marker_id='marker_2', key=17)
    task18 = MobileRobotGetMarkerPoseTask(robot, marker_id='marker_2', key=18)
    
    task19 = MobileRobotPickPlaceTask(robot, robot_address, brick_no=2, marker_id='marker_2', target_marker_id='marker_1', key=19)
    
    #brick 3
    task20 = MobileRobotHomeConfigurationTask(robot, robot_address, velocity=0.06, key=20)
    task21 = MobileRobotGetMarkerPoseTask(robot, marker_id='marker_3', key=21)
    
    task22 = MobileRobotMarkerSnapshotTask(robot, robot_address, routine=0, marker_id='marker_3', key=22)
    task23 = MobileRobotGetMarkerPoseTask(robot, marker_id='marker_3', key=23)
    task24 = MobileRobotMarkerSnapshotTask(robot, robot_address, routine=1, marker_id='marker_3', key=24)
    task25 = MobileRobotGetMarkerPoseTask(robot, marker_id='marker_3', key=25)
    
    task26 = MobileRobotPickPlaceTask(robot, robot_address, brick_no=3, marker_id='marker_3', target_marker_id='marker_1', key=26)
    

tasks = [task0, task1, task2, task3, task4, task5, task6, task7, task8, task9, task10, task11, task12, task13, task14, task15, task16, task17, task18, task19, task20, task21, task22, task23, task24, task25, task26]
# ---------- end tasks ----------
fabricationmanager = PythonScript(
    tasks=tasks,
    init=init,
    parallelize=Toggle(False),
    set_tasks=set_tasks,
    start=start_fabrication,
    stop=stop_fabrication,
    reset=reset,
    next_task=next_task,
    reset_task=reset_task,
    prev_task=prev_task)  # -> out, server; inputs tasks: list
# ---------- fabricationmanager: Python ----------
from scriptcontext import sticky as st
from fabrication_manager.fabrication import FabricationManager

server_ip = st["server_ip"]
server_port = st["server_port"]

if init:
    fabrication = FabricationManager((server_ip,server_port))
    fabrication.parallelize = parallelize
    st["fabrication"] = fabrication

fabrication = st["fabrication"]

if set_tasks:
    print "setting tasks"    
    fabrication.clear_tasks()
    fabrication.set_tasks(tasks)

if start:
    #if robot.is_connected(): #and arduino.is_connected():
    print "starting process"
    fabrication.start()

if stop:
    print "stopping process"
    fabrication.stop()
    
if reset:
    print "resetting process"
    fabrication.reset()

if next_task:
    t = fabrication.get_next_task()
    task_state_set(True, t)
    
if reset_task:
    t = fabrication.get_next_task()
    task_state_set(False, t)

if prev_task:
    t = fabrication.get_next_task()
    task_state_set(False, t)
    t = fabrication.tasks[fabrication.current_task_key-1]
    task_state_set(False, t)
    fabrication.get_next_task()

def task_state_set(state, t):
    t.is_completed = state
    t.is_running = False
# ---------- end fabricationmanager ----------

# ----
# ROS client
disconnect = Button()
connect = Button()
connect_2 = PythonScript(robot=robot, ip=list, connect=connect, disconnect=disconnect)  # -> out, robot
# ---------- connect_2: Python ----------
import sys
import scriptcontext as sc
from compas_fab.backends import RosClient
from mobile_robot_control.mobile_robot_client import MobileRobotClient as Client

if robot:
    if connect:
        robot.mobile_client = Client(host=ip, port=9090)
        robot.client = robot.mobile_client.ros_client
        robot.mobile_client.connect()
    
    if disconnect:
        robot.mobile_client.disconnect()
    
    print('ROS connected: {}'.format(robot.mobile_client.ros_client.is_connected))
# ---------- end connect_2 ----------
is_connected = Panel(connect_2.out)

get_marker_frames = GhPythonScript(
    robot=connect_2.robot,
    target_frame=list_2,
    reference_frame=list_3,
    subscribe=subscribe,
    save=save,
    unsubscribe=unsubscribe,
    print=print)  # -> out, bang
# ---------- get_marker_frames: Python ----------
from scriptcontext import sticky as st

if not st.get('marker_poses'):
    st['marker_poses'] = {}

if subscribe:
    robot.mobile_client.tf_subscribe(target_frame, reference_frame)
#    for marker in st['marker_poses'].keys():
#        robot.mobile_client.tf_subscribe(marker, reference_frame)

if save:
    if robot.mobile_client.tf_frame is not None:
        if not st['marker_poses'].get(target_frame):
            st['marker_poses'][target_frame] = []
            st['marker_poses'][target_frame].append(robot.mobile_client.tf_frame)
        else:
            st['marker_poses'][target_frame].append(robot.mobile_client.tf_frame)

if unsubscribe:
    if robot.mobile_client.tf_frame is not None:
        robot.mobile_client.clean_tf_frame()
    robot.mobile_client.tf_unsubscribe(target_frame, reference_frame)

print "tf_clients: ", robot.mobile_client.tf_clients
print "tf_frame: ", robot.mobile_client.tf_frame
print st['marker_poses']
# ---------- end get_marker_frames ----------
rec = DataRecorder(get_marker_frames.out, DataLimit=-10, RecordData=True)
panel_4 = Panel(rec)

# ----
# Info
info = PythonScript(robot=robot)  # -> out, main_group_name
# ---------- info: Python ----------
if robot:
    robot.info()
    main_group_name = robot.main_group_name
# ---------- end info ----------
panel_5 = Panel(info.out)

python = GhPythonScript(robot=robot)  # -> out
# ---------- python: Python ----------
print "tf_clients: ", robot.mobile_client.tf_clients
print "tf_frame: ", robot.mobile_client.tf_frame
print "marker_frames: ",robot.mobile_client.marker_frames
# ---------- end python ----------

# ----
# Pick and place with force mode
radius = Slider(0.01, range=0..0.1)
list_7 = ValueList({"go to place pose_1": 0, "go to place pose_2": 1, "go to pick up pose_1": 2, "go to pick up pose_2": 3, "pick and place": 4, "pick and place for brick": 5, "home": 6}, selected="pick and place for brick")
send_3 = Button()
list_8 = ValueList({"marker_0", "marker_2", "marker_3", "marker_4", "brick_0"}, selected="brick_0")
generate_ur_script = PythonScript(robot=robot, target_frame=list_8, routine=list_7, plane_WCF=pln_2, velocity=Slider(0.016, range=0..0.2), radius=radius)  # -> out, frame_RCF, urscript; inputs plane_WCF: Plane
# ---------- generate_ur_script: Python ----------
from ur_fabrication_control.direct_control import URScript
from ur_fabrication_control.direct_control.mixins import AreaGripMixins
import math
from scriptcontext import sticky as st
import Rhino.Geometry as rg
from compas.artists import Artist
from compas.geometry import Frame, Transformation, Translation, Vector, Rotation, Point
from compas_fab.robots import Configuration

class URScript_RSRD(URScript, AreaGripMixins):
    pass

tool_angle_axis = list(robot.attached_tool.frame.point) + list(robot.attached_tool.frame.axis_angle_vector)

# for the pick up
if routine == 0 or routine == 1:
    target_frame = 'marker_1'

# go to pose 1
if routine == 0 or routine == 2:
    pose_1_frame = Frame(st['marker_poses'][target_frame][-1].point, st['marker_poses'][target_frame][-1].zaxis, st['marker_poses'][target_frame][-1].yaxis).transformed(Translation.from_vector(Vector.Zaxis()*0.3)) #rotate them too
    pose_1_frame.transform(Translation.from_vector(-pose_1_frame.yaxis*0.1))
    pose_1_frame.transform(Rotation.from_axis_and_angle(pose_1_frame.xaxis, math.radians(-20), pose_1_frame.point))
    pose_1_frame.transform(Rotation.from_axis_and_angle(pose_1_frame.yaxis, math.radians(-20), pose_1_frame.point))
    print pose_1_frame
    commands = URScript_RSRD()
    commands.start()
    commands.set_tcp(tool_angle_axis)
    commands.move_linear(pose_1_frame, velocity, radius)
    commands.end() 

# go to pose 2
if routine == 1 or routine == 3:
    pose_2_frame = Frame(st['marker_poses'][target_frame][-1].point, st['marker_poses'][target_frame][-1].zaxis, st['marker_poses'][target_frame][-1].yaxis).transformed(Translation.from_vector(Vector.Zaxis()*0.1))
    pose_2_frame.transform(Translation.from_vector(-pose_2_frame.xaxis*0.1)*Translation.from_vector(pose_2_frame.yaxis*0.1))
    pose_2_frame.transform(Rotation.from_axis_and_angle(pose_2_frame.xaxis, math.radians(20), pose_2_frame.point))
    pose_2_frame.transform(Rotation.from_axis_and_angle(pose_2_frame.yaxis, math.radians(20), pose_2_frame.point))
    print pose_2_frame
    commands = URScript_RSRD()
    commands.start()
    commands.set_tcp(tool_angle_axis)
    commands.move_linear(pose_2_frame, velocity, radius)
    commands.end()

# pick up from marker frame
if routine == 4:
    # To set plane:
    #frame_WCF = Frame(plane_WCF.Origin, plane_WCF.XAxis, plane_WCF.YAxis)
    #frame_BCF = frame_WCF.transformed(robot.transformation_WCF_BCF())
    #frame_RCF = frame_BCF.transformed(robot.transformation_BCF_RCF())
    
    # To marker frame:
    brick_frame = Frame(st['marker_poses'][target_frame][-1].point, st['marker_poses'][target_frame][-1].yaxis, -st['marker_poses'][target_frame][-1].zaxis)
    brick_frame_safe = brick_frame.transformed(Translation.from_vector(Vector.Zaxis()*0.1))
    brick_frame_RCF = brick_frame_safe.transformed(Translation.from_vector(brick_frame_safe.xaxis*0.087))
    
    place_frame = Frame(st['marker_poses']['marker_1'][-1].point, st['marker_poses']['marker_1'][-1].yaxis, -st['marker_poses']['marker_1'][-1].zaxis)
    place_frame_RCF = place_frame.transformed(Translation.from_vector(Vector.Zaxis()*0.15))
    
    commands = URScript_RSRD()
    commands.start()
    commands.set_tcp(tool_angle_axis)
    commands.set_payload(1.140)
    
    commands.move_linear(brick_frame_RCF, velocity, radius)
    commands.add_line("\tsleep({})".format(2.0))
    commands.get_force()
    
    commands.force_mode_in_z(10.0, 0.025)
    commands.stop_by_force(10.0)
    commands.end_force_mode()
    
    commands.areagrip_on()
    commands.add_line("\tsleep({})".format(2.0))
    
    commands.set_payload(3.510)
    commands.move_linear(brick_frame_RCF, velocity, radius)
    
    commands.move_linear(place_frame_RCF, velocity, radius)
    commands.add_line("\tsleep({})".format(2.0))
    commands.get_force()
    
    commands.force_mode_in_z(10.0, 0.025)
    commands.stop_by_force(10.0)
    commands.end_force_mode()
    
    commands.areagrip_off()
    commands.add_line("\tsleep({})".format(2.0))
    commands.set_payload(1.140)
    
    commands.move_linear(place_frame_RCF, velocity, radius)
    
    commands.end()

# pick up for brick
if routine == 5:
    # To set plane:
    #frame_WCF = Frame(plane_WCF.Origin, plane_WCF.XAxis, plane_WCF.YAxis)
    #frame_BCF = frame_WCF.transformed(robot.transformation_WCF_BCF())
    #frame_RCF = frame_BCF.transformed(robot.transformation_BCF_RCF())
    
    # To marker frame:
    brick_frame = Frame(st['marker_poses'][target_frame][-1].point, st['marker_poses'][target_frame][-1].xaxis, st['marker_poses'][target_frame][-1].zaxis)
    brick_frame_safe = brick_frame.transformed(Translation.from_vector(Vector.Zaxis()*0.25))
    brick_frame_RCF = brick_frame_safe #.transformed(Translation.from_vector(brick_frame_safe.xaxis*0.087))
    
    place_frame_RCF = brick_frame_RCF.transformed(Translation.from_vector(brick_frame_safe.xaxis*0.50)) # brick frame translated by 30cm
    
    commands = URScript_RSRD()
    commands.start()
    commands.set_tcp(tool_angle_axis)
    commands.set_payload(1.140)
    
    commands.move_linear(brick_frame_RCF, velocity, radius)
    commands.add_line("\tsleep({})".format(2.0))
    commands.get_force()
    
    commands.force_mode_in_z(10.0, 0.025)
    commands.stop_by_force(15.0)
    commands.end_force_mode()
    
    commands.areagrip_on()
    commands.add_line("\tsleep({})".format(2.0))
    
    commands.set_payload(3.510)
    commands.move_linear(brick_frame_RCF, velocity, radius)
    
    commands.move_linear(place_frame_RCF, velocity, radius)
    commands.add_line("\tsleep({})".format(2.0))
    commands.get_force()
    
    commands.force_mode_in_z(10.0, 0.025)
    commands.stop_by_force(15.0)
    commands.end_force_mode()
    
    commands.areagrip_off()
    commands.add_line("\tsleep({})".format(2.0))
    commands.set_payload(1.140)
    
    commands.move_linear(place_frame_RCF, velocity, radius)
    
    commands.end()
    
if routine == 6:
    home = Configuration((1.4645407835589808, -0.0593598645976563, -0.04910737672914678, -2.645515581170553, -1.01190692583193, -2.8092520872699183), (0.0, 0.0, 0.0, 0.0, 0.0, 0.0), ("elbow_joint", "shoulder_lift_joint", "shoulder_pan_joint", "wrist_1_joint", "wrist_2_joint", "wrist_3_joint"))
    
    commands = URScript_RSRD()
    commands.start()
    commands.set_tcp(tool_angle_axis)
    commands.set_payload(1.140)
    commands.move_joint(home, velocity)
    
    commands.end()
    
urscript = commands.generate()

print(urscript)
# ---------- end generate_ur_script ----------
draw = Draw(cg=generate_ur_script.frame_RCF)  # -> rg
#   port cg: The COMPAS geometry or datastructure to be drawn.
#   port rg: The Rhino geometry object.
# ---------- draw: Python ----------
"""
Draws COMPAS geometry in Grasshopper.
"""
from ghpythonlib.componentbase import executingcomponent as component

from compas.artists import Artist


class CompasToRhinoGeometry(component):
    def RunScript(self, cg):
        if not cg:
            return None

        return Artist(cg).draw()
# ---------- end draw ----------
send_4 = GhPythonScript(urscript=generate_ur_script.urscript, send=send_3)  # -> out; inputs send: Boolean
# ---------- send_4: Python ----------
from scriptcontext import sticky as st
from ur_fabrication_control.direct_control import send_script

ur_ip = st["ur_ip"]
ur_port = st["ur_port"]

print urscript
if send:
    send_script(urscript, ur_ip, ur_port)
# ---------- end send_4 ----------

# ---- group: forward kinematics
a6 = Slider(0, range=-360..360)
a1 = Slider(45, range=-360..360)
a2 = Slider(-45, range=-360..360)
a3 = Slider(90, range=-360..360)
a4 = Slider(-135, range=-360..360)
a5 = Slider(-90, range=-360..360)
jp = GhPythonScript()  # -> joint_positions
# ---------- jp: Python ----------
import math

joint_positions = [0,-90,90,0,90,0]
joint_positions = [math.radians(a) for a in joint_positions]
#joint_positions = [-3.136, -0.328, -1.218, 3.129, 0.852, 0.008]
#joint_positions = [0] * 6



#joint_positions = [1.6239667567485938, 0.25439606475392273, 4.409424838594969-2*3.14, 3.1901607306255908, 1.5707963267948954, 0.053170429953696939]
#joint_positions = [1.598543436748912, 0.23021224965157744, 4.712232135219824-2*3.14, 6.0531299026928744, 4.7123889803846915, 0.027747109954015234]
#joint_positions = [-1.1373533430447322, 4.0117247163121572, 5.4083762087596021-2*3.14, 1.5754733624925168, 4.7123889803846879, 3.5750356373399574]
print joint_positions
# ---------- end jp ----------
forward_kinematics = PythonScript(robot=robot, set_joint_positions=Button(), joint_positions=jp, lift=l, a1=a1, a2=a2, a3=a3, a4=a4, a5=a5, a6=a6)  # -> full_configuration; inputs joint_positions: list
# ---------- forward_kinematics: Python ----------
import math
import Grasshopper
from compas.robots import Joint
from compas_fab.robots import Configuration

if set_joint_positions:
    j = 0
    for i in range(ghenv.Component.Params.Input.Count):
        nslider = ghenv.Component.Params.Input[i].Sources[0]
        if nslider.GetType() == Grasshopper.Kernel.Special.GH_NumberSlider:
            nslider.TrySetSliderValue(math.degrees(joint_positions[j]))
            j += 1

if robot:
    joint_positions = [lift, a1, a2, a3, a4, a5, a6]
    joint_types = robot.get_configurable_joint_types()
    joint_names = robot.get_configurable_joint_names()
#    joint_types = [type for type in joint_types if type == Joint.REVOLUTE]
    
    for i, joint_type in enumerate(joint_types):
        if joint_type == Joint.REVOLUTE:
            joint_positions[i] = math.radians(joint_positions[i])
        else:
            joint_positions[i] = joint_positions[i]
    
    full_configuration = Configuration(joint_positions, joint_types, joint_names)
    
print(full_configuration)
# ---------- end forward_kinematics ----------

# ---- group: inverse kinematics
select_configuration = Slider(2, range=0..7)
inverse = PythonScript(robot=robot, bang=attach_remove.bang, group=info.main_group_name, plane_WCS=pln_2, idx=select_configuration)  # -> out, plane_tool0_RCS, plane_tcp_RCS, configuration; inputs plane_WCS: Plane, idx: Int32
# ---------- inverse: Python ----------
import Rhino.Geometry as rg
import math
from compas.geometry import Frame, Transformation, Rotation
from compas_fab.robots import Configuration
from ur_fabrication_control.kinematics.ur_kinematics import inverse_kinematics
from ur_fabrication_control.kinematics.ur_params import ur_params
from compas_ghpython import draw_frame

tcp_WCS = Frame(plane_WCS.Origin, plane_WCS.XAxis, plane_WCS.YAxis)

# transform frame to robot coordinate system
print tcp_WCS
print plane_WCS
tcp_RCS = robot.RCF.to_local_coordinates(tcp_WCS)

if robot.attached_tool:
    tool0_RCS = robot.from_tcf_to_t0cf([tcp_RCS])[0]
else:
    tool0_RCS = tcp_RCS

print tcp_RCS
print tool0_RCS
plane_tool0_RCS = draw_frame(tool0_RCS)
plane_tcp_RCS = draw_frame(tcp_RCS)
# calculate solutions to frame
ur_params = ur_params["ur10e"] # get the parameters according to the robot model
print ur_params
solutions = inverse_kinematics(tool0_RCS, ur_params)
print solutions

if not len(solutions):
    joint_values = [0,0,0,0,0,0]
    configuration = Configuration.from_revolute_values(joint_values)
else:
    joint_values = solutions[idx]
    #print joint_values
    
    ### ***** HACK ***** ##### TODO: CHECK!!!
#    for i, v in enumerate(joint_values):
#        if v > math.pi:
#            v -= 2*math.pi
#        if v < -math.pi:
#            v += 2*math.pi
#        joint_values[i] = v
    ### ***** HACK ***** ##### TODO: CHECK!!!
    configuration = [Configuration.from_revolute_values(joint_values)]

print(configuration)
# ---------- end inverse ----------

# ----
list_9 = ValueList({"0 forward_kinematics": 0, "1 inverse_kinematics": 1}, selected="0 forward_kinematics")
filter = StreamFilter(Gate=list_9, Stream0=forward_kinematics, Stream1=inverse.configuration)

# ----
# Get Pose Joint
get = Button()
pose = PythonScript(robot=robot, get=get)  # -> out, configuration, pose_joints
# ---------- pose: Python ----------
from scriptcontext import sticky as st
from ur_fabrication_control.direct_control.common import get_current_pose_joints
from compas_fab.robots import Configuration

server_ip= st["server_ip"]
server_port = st["server_port"]
ur_port = st["ur_port"]
ur_ip = st["ur_ip"]
print ur_ip

guid = str(ghenv.Component.InstanceGuid)
pose_joints_key = "pose_joints" + guid

# retrieve the current tool frame in axis angle format
if robot.attached_tool:
    tool_angle_axis = list(robot.attached_tool.frame.point) + list(robot.attached_tool.frame.axis_angle_vector)
else:
    tool0_frame = Frame([0, 0, 0], [1, 0, 0], [0, 1, 0])
    tool_angle_axis = list(tool0_frame.point) + list(tool0_frame.axis_angle_vector)

print(tool_angle_axis)

# send script to the robot to receive the current joint configuration
if get:
    st[pose_joints_key] = get_current_pose_joints(server_ip, server_port, ur_ip, ur_port, tool_angle_axis)

print(st[pose_joints_key])
configuration = Configuration.from_revolute_values(st[pose_joints_key])
pose_joints = configuration.joint_values
"""
if pose_joints_key not in st:
    configuration = Configuration.from_revolute_values([0,0,0,0,0,0])
else:
    configuration = Configuration.from_revolute_values(st[pose_joints_key])

pose_joints = configuration.values
"""
# ---------- end pose ----------
panel_6 = Panel(pose.pose_joints)

# ----
# Visualisation
show_end_effector_frame = BooleanToggle(True)
show_base_frame = BooleanToggle(True)
show_collision = BooleanToggle(False)
show_frames = BooleanToggle(False)
show_visual = BooleanToggle(True)
show_acm = BooleanToggle(False)
list_10 = ValueList({"Zero": 0, "One": 1, "Two": 2, "Three": 3, "Four": 4, "Five": 5}, selected="Zero")
visualize = PythonScript(
    robot=robot,
    tool=tool.tool,
    group=info.main_group_name,
    configuration=filter,
    redraw=[attach_remove.bang, set_base_frame],
    show_visual=show_visual,
    show_collision=show_collision,
    show_end_effector_frame=show_end_effector_frame,
    show_frames=show_frames,
    show_robot_frames=show_base_frame,
    show_acm=show_acm,
    station=list_10)  # -> out, robot, visual, collision, attached_meshes, frames, ee_frame, tool0_frame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; inputs redraw: list, attached_collision_meshes: list, station_pts: list
# ---------- visualize: Python ----------
import rhinoscriptsyntax as rs
import Rhino.Geometry as rg
import ghpythonlib.components as ghcomp
from compas.geometry import Vector
from compas.geometry import Point
from compas.geometry import Transformation
from compas.geometry import Frame
from compas_ghpython.artists import MeshArtist
from compas_ghpython.utilities import draw_frame
from compas_fab.robots import Configuration
from ur_fabrication_control.kinematics.ur_kinematics import forward_kinematics
from ur_fabrication_control.kinematics.ur_params import ur_params

print(configuration)

if robot and configuration:
    robot.update(configuration, visual=show_visual, collision=show_collision)
    
    ur_params = ur_params[robot.main_group_name]
    
    print(ur_params)
    if show_visual:
        visual = robot.artist.draw_visual()
        robot_BCF = draw_frame(robot.BCF) 
#        init_robot_plane = rg.Plane(rg.Point3d(0.275, 0.0, 1.105), rg.Vector3d(-0.707, 0.707, 0.0), rg.Vector3d(-0.707, -0.707,0.0))
        init_robot_plane = rg.Plane.WorldXY
#        visual = ghcomp.Orient(visual, init_robot_plane, robot_BCF)[0]
    
    if show_collision:
        collision = robot.artist.draw_collision()
    
    frames = robot.transformed_frames(configuration, group)
    
    if show_robot_frames:
        base_frame = robot.BCF
        robot_frame = robot.to_world_coordinates(robot.RCF)
    
    if show_end_effector_frame:    
#        tool0_frame = forward_kinematics(configuration.revolute_values, ur_params)
        print robot
        ee_frame = robot.forward_kinematics(configuration, group)
        print ee_frame
        if robot.attached_tool:
            tool0_frame = robot.from_tcf_to_t0cf([ee_frame])
        print("End-effector", ee_frame)
    
    if not show_frames:
        frames = None

    frame = robot.forward_kinematics(configuration, options=dict(solver='model'))
    
    if show_acm: # attached collision meshes
        M = []
        for acm in attached_collision_meshes:
            frame = robot.forward_kinematics(configuration, options=dict(solver='model', link_name=acm.link_name))
            T = Transformation.from_frame_to_frame(Frame.worldXY(), frame)
            mesh = acm.collision_mesh.mesh.transformed(T)
            M.append(MeshArtist(mesh).draw())
        attached_meshes = M
# ---------- end visualize ----------
geo = Geometry(visualize.collision)
geo_2 = Geometry(visualize.visual)
draw_2 = GhPythonScript(frames=visualize.ee_frame, scale=Slider(0.1, range=0..1))  # -> P, V, C, W; inputs frames: list
# ---------- draw_2: Python ----------
from System.Drawing import Color
from compas_ghpython.utilities import draw_frame

red = Color.FromArgb(255, 0, 0)
green = Color.FromArgb(0, 255, 0)
blue = Color.FromArgb(0, 0, 255)

P = []
V = []
C = []

scale = float(scale)

for frame in frames:
    if not frame:
        continue
    plane = draw_frame(frame)
    P += [plane.Origin] * 3
    V.append(plane.XAxis * scale)
    V.append(plane.YAxis * scale)
    V.append(plane.ZAxis * scale)
    C += [red, green, blue]

W = 3
# ---------- end draw_2 ----------
preview = CustomPreview(Geometry=geo_2, Shader=ColourSwatch(SwatchColor=RGB(105, 105, 105)))
preview_2 = CustomPreview(Geometry=visualize.attached_meshes, Shader=ColourSwatch(SwatchColor=RGB(255, 255, 255)))
vdisex = VectorDisplayEx(Point=draw_2.P, Vector=draw_2.V, Colour=draw_2.C, Width=draw_2.W)

# ----
# Move Joints
idx = Slider(0, range=0..100)
list_11 = ValueList({"send all positions": 0, "send only one position": 1, "send snapshot position": 2}, selected="send only one position")
send_5 = Button()

# ----
# Direct UR Control
config = GhPythonScript(config=inverse.configuration)  # -> out, joint_configs
# ---------- config: Python ----------
from compas_fab.robots import Configuration

#values=[-0.785, -1.571, 1.571, -1.571, -1.571, -1.571]
#((-0.785, -1.571, 1.571, -1.571, -1.571, -1.571), (0, 0, 0, 0, 0, 0))
joint_configs = [config]
# ---------- end config ----------

item = ListItem(List=config.joint_configs, Index=idx, Wrap=True)
filter_2 = StreamFilter(Gate=list_11, Stream0=config.joint_configs, Stream1=item)
movej = PythonScript(joint_configurations=filter_2, velocity=Slider(0.04, range=0..0.5))  # -> urscript, values; inputs joint_configurations: list
# ---------- movej: Python ----------
from ur_fabrication_control.direct_control import URScript
import math

urscript = URScript()
urscript.start()
for jc in joint_configurations:
    urscript.move_joint(jc, velocity)
urscript.end()

urscript = urscript.generate()

print(urscript)
# ---------- end movej ----------
send_6 = GhPythonScript(urscript=movej.urscript, send=send_5)  # -> out; inputs send: Boolean
# ---------- send_6: Python ----------
from scriptcontext import sticky as st
from ur_fabrication_control.direct_control import send_script

ur_ip = st["ur_ip"]
ur_port = st["ur_port"]

print urscript

if send:
    send_script(urscript, ur_ip, ur_port)
# ---------- end send_6 ----------

# ----
# Get Pose Cartesian
get_2 = Button()
pose_2 = PythonScript(robot=robot, get=get_2)  # -> out, pose_cartesian_meter
# ---------- pose_2: Python ----------
from scriptcontext import sticky as st
#from ur_fabrication_control.online_control.ur_direct import get_current_pose_cartesian

from ur_fabrication_control.direct_control.common import get_current_pose_cartesian
from compas.geometry import Frame
from compas_ghpython import draw_frame


server_ip = st["server_ip"]
server_port = st["server_port"]
ur_port = st["ur_port"]
ur_ip = st["ur_ip"]
pose_cartesian_meter = []
print ur_ip

# retrieve the current tool frame in axis angle format
if robot.attached_tool:
    print ("attached")
    tool_angle_axis = list(robot.attached_tool.frame.point) + list(robot.attached_tool.frame.axis_angle_vector)
    
else:
    tool0_frame = Frame([0, 0, 0], [1, 0, 0], [0, 1, 0])
    tool_angle_axis = list(tool0_frame.point) + list(tool0_frame.axis_angle_vector)

print(tool_angle_axis)

guid = str(ghenv.Component.InstanceGuid)
pose_cartesian_key = "pose_cartesian" + guid


if get:
    print ("getting pose")
    st[pose_cartesian_key] = get_current_pose_cartesian(tool_angle_axis, server_ip, server_port, ur_ip, ur_port, send=True)
#    st[pose_cartesian_key] = get_current_pose_cartesian(server_ip, server_port, ur_ip, tool_angle_axis)
    

if pose_cartesian_key not in st:
    pose_cartesian_mm = []
    pose_cartesian_meter = []
else:
    pose_cartesian = st[pose_cartesian_key]

for i in pose_cartesian:
    new_c = i / 1000
    pose_cartesian_meter.append(new_c)

print (pose_cartesian_meter)
# ---------- end pose_2 ----------

rec_2 = DataRecorder(pose_2.out, DataLimit=-10, RecordData=True)

panel_7 = Panel(rec_2)

# ----
# Save tool measured poses
list_12 = ValueList({"marker_0 frame": "marker_0", "marker_1 frame": "marker_1", "marker_2 frame": "marker_2", "marker_3 frame": "marker_3", "marker_4 frame": "marker_4"}, selected="marker_0 frame")
list_13 = ValueList({"camera frame": "camera_color_optical_frame", "robot base frame": "base"}, selected="robot base frame")
save_2 = Button()
get_marker_poses = GhPythonScript(pose=pose_2.pose_cartesian_meter, target_frame=list_12, reference_frame=list_13, save=save_2)  # -> out; inputs pose: list
# ---------- get_marker_poses: Python ----------
from scriptcontext import sticky as st
import Rhino.Geometry as rg

if not st.get('measured_marker_poses'):
    st['measured_marker_poses'] = {}

if save:
    if len(pose):
        pose_point = rg.Point3d.Multiply(rg.Point3d(pose[0], pose[1], pose[2]), 1000)
        st['measured_marker_poses'][target_frame] = pose_point

print st['measured_marker_poses']
# ---------- end get_marker_poses ----------

panel_8 = Panel(get_marker_poses)
