# Grasshopper definition mobile_robot_workspace_ROS.ghx (Grasshopper 1.0.7)

py = PythonScript()  # -> repositories_path, rbvogui_data_path, ur_data_path
# ---------- py: Python ----------
import os

"""
ASSUMING THE BELOW PACKAGES ARE STORED IN THE SAME LOCATION:
    ur_fabrication_control;
    rbvogui_common; and
    mobile_additive_manufacturing.
"""

repositories_path = os.path.abspath(os.path.join(ghdoc.Path,"../../../"))

assert os.path.exists(os.path.join(repositories_path, "ur_fabrication_control/data"))
assert os.path.exists(os.path.join(repositories_path, "rbvogui_common/rbvogui_description"))
assert os.path.exists(os.path.join(repositories_path, "mobile_fabrication_control"))

ur_data_path = os.path.abspath(os.path.join(ghdoc.Path,"../../../ur_fabrication_control/data"))
rbvogui_data_path = os.path.abspath(os.path.join(repositories_path, "rbvogui_common"))
# ---------- end py ----------
list = ValueList({"ur_description", "ur_e_description", "ur_setups"}, selected="ur_e_description")
list_2 = ValueList({"ur3.urdf", "ur3_rot.urdf", "ur5.urdf", "ur10.urdf", "ur3e.urdf", "ur5e.urdf", "ur10e.urdf", "ur10e_rot.urdf"}, selected="ur10e_rot.urdf")
list_3 = ValueList({"ur3.srdf", "ur5.srdf", "ur10.srdf", "ur3e.srdf", "ur5e.srdf", "ur10e.srdf"}, selected="ur10e.srdf")
py_2 = PythonScript(
    repositories_path=py.repositories_path,
    rbvogui_data_path=py.rbvogui_data_path,
    ur_data_path=py.ur_data_path,
    package=list,
    urdf_name=list_2,
    srdf_name=list_3)  # -> loaders, urdf_filename, srdf_filename
# ---------- py_2: Python ----------
import os
from compas.robots import LocalPackageMeshLoader

#loaders

ur_path = os.path.join(ur_data_path, "robot_description")
ur_packages = ["ur_description", "ur_e_description", "ur_end_effectors", "ur_setups"]
ur_loaders = [LocalPackageMeshLoader(ur_path, pck) for pck in ur_packages]

rbvogui_packages = ["rbvogui_description"]
rbvogui_loaders = [LocalPackageMeshLoader(rbvogui_data_path, pck) for pck in rbvogui_packages]

ewellix_packages = ["ewellix_description"]
ewellix_loaders = [LocalPackageMeshLoader(repositories_path, pck) for pck in ewellix_packages]

sensors_packages = ["robotnik_sensors"]
sensors_loaders = [LocalPackageMeshLoader(repositories_path, pck) for pck in sensors_packages]

loaders = ur_loaders + rbvogui_loaders + ewellix_loaders + sensors_loaders

#files
urdf_filename = os.path.join(repositories_path, r"mobile_fabrication_control\data\rbvogui_xl_lift_ur10e.urdf")
srdf_filename = os.path.join(repositories_path, r"mobile_fabrication_control\data\rbvogui.srdf")

assert os.path.isfile(urdf_filename)
assert os.path.isfile(srdf_filename)
# ---------- end py_2 ----------

# ---- group: ROS client
# Robot
disconnect = Button()
connect = Button()
connect_2 = PythonScript(ip="192.168.10.12", connect=connect, disconnect=disconnect)  # -> out, ros_client
# ---------- connect_2: Python ----------
import sys
import scriptcontext as sc
from compas_fab.backends import RosClient

key = 'rosclient_%s' % str(ghenv.Component.InstanceGuid)
previous_client = sc.sticky.get(key, None)

if previous_client and (connect or disconnect):
    previous_client.close()

if connect:
    ros_client = RosClient(ip, 9090)
    sc.sticky[key] = ros_client
    ros_client.run(5)

ros_client = sc.sticky.get(key, None)
print('ROS connected: {}'.format(ros_client.is_connected if ros_client else 'False'))
# ---------- end connect_2 ----------
is_connected = Panel(connect_2.out)

# ----
# Load robot from ROS
units = ValueList({"m": 1, "cm": 100, "mm": 1000}, selected="m")
load = Button()
create = PythonScript(ros_client=connect_2.ros_client, scale_factor=units, load=Toggle(True), loaders=py_2.loaders)  # -> robot; inputs loaders: list
# ---------- create: Python ----------
import os
from scriptcontext import sticky as st
import compas
from compas_fab.backends import RosClient
from compas_fab.robots import Robot
from compas_ghpython.artists import RobotModelArtist

# Set high precision to import meshes defined in meters
compas.PRECISION = '24f'

# store robot in component
guid = str(ghenv.Component.InstanceGuid)
robot_key = "robot_" + guid

if robot_key not in st:
    st[robot_key] = None

if ros_client and ros_client.is_connected and load:
    robot = ros_client.load_robot(load_geometry=False, 
                                  urdf_param_name='/robot/robot_description', 
                                  srdf_param_name='/robot/robot_description_semantic')
    robot.model.load_geometry(*loaders)
    robot.artist = RobotModelArtist(robot.model)
    robot.scale(scale_factor)
    st[robot_key] = robot

robot = st[robot_key]
if robot:
    robot.client = ros_client
# ---------- end create ----------
robot = Data(create)

reload = Button()
plate = Brep(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)
py_3 = PythonScript(reload=reload)
# ---------- py_3: Python ----------
from compas_rhino.utilities.misc import get_tolerance
from compas_rhino.utilities.misc import unload_modules

from compas_ghpython import unload_modules
unload_modules("compas")
unload_modules("compas_fab")
unload_modules("roslibpy")
# ---------- end py_3 ----------

# ----
# Info
info = PythonScript(robot=robot)  # -> out, main_group_name
# ---------- info: Python ----------
if robot:
    robot.info()
    main_group_name = robot.main_group_name
# ---------- end info ----------
panel = Panel(info.out)

# ----
# Cartesian path
number_slider = Slider(20, range=0..210)
crv = Curve(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)
divide = DivideCurve(Curve=crv, Count=number_slider, Kinks=False)  # -> Points, Tangents, Parameters
Y = UnitY(Factor=1)
Z = UnitZ(Factor=Slider(-1, range=-2..-1))
pl = ConstructPlane(Origin=divide.Points, XAxis=Z, YAxis=Y)
item = ListItem(List=pl, Index=Slider(0, range=0..20), Wrap=True)
item_2 = ListItem(List=pl, Index=number_slider, Wrap=True)
first_plane = Plane(item)
last_plane = Plane(item_2)

planes = Plane(pl)
list_4 = ValueList({"don't use attached collision mesh": 0, "use attached collision mesh": 1}, selected="use attached collision mesh")

# ----
# Attach an collision object
# Select link name to attach
yz = YZPlane(Origin=Point(0, 0, 0))
cone = Cone(Base=yz, Radius=0.035, Length=0.1)  # -> Cone, Tip
mesh = Mesh(cone.Cone)
mesh_2 = PythonScript(mesh=mesh)  # -> compas_mesh
# ---------- mesh_2: Python ----------
from compas_rhino.geometry import RhinoMesh

compas_mesh = RhinoMesh.from_geometry(mesh).to_compas()
# ---------- end mesh_2 ----------
py_4 = PythonScript(robot=robot, idx=Slider(7, range=0..7))  # -> link_name; inputs idx: Int32
# ---------- py_4: Python ----------
if robot:
    link_names = robot.get_link_names()
    link_name = link_names[idx]
# ---------- end py_4 ----------
panel_2 = Panel(py_4)
remove = Button()
scale = BooleanToggle(False)
add = Button()

# ----
# Planning scene
# Have a look at the backend here:
# http://localhost:8080/vnc.html?resize=scale&autoconnect=true
# or
# http://YOUR_IP:8080/vnc.html?resize=scale&autoconnect=true
# (if you use docker toolbox)
# Pass collision objects to planning scene
scene = PythonScript(robot=robot)  # -> scene
# ---------- scene: Python ----------
from scriptcontext import sticky as st

from compas_fab.robots import PlanningScene

# store scene in component
guid = str(ghenv.Component.InstanceGuid)
scene_key = "scene_" + guid

if scene_key not in st:
    st[scene_key] = None

if robot:
    st[scene_key] = PlanningScene(robot)

scene = st[scene_key]
# ---------- end scene ----------

panel_3 = Panel("Define an obstacle")
box = Brep(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)
mesh_3 = Mesh(plate)
preview = CustomPreview(Geometry=mesh_3, Shader=ColourSwatch(SwatchColor=RGB(106, 158, 148)))
mesh_4 = PythonScript(mesh=mesh_3)  # -> compas_mesh; same code as mesh_2
remove_2 = Button()
scale_2 = BooleanToggle(False)
add_2 = Button()
collision = PythonScript(scene=scene, compas_mesh=mesh_4, scale=scale_2, id="box", add=add_2, remove=remove_2)  # -> out
# ---------- collision: Python ----------
from compas_fab.robots import CollisionMesh

cm = CollisionMesh(compas_mesh, id)

if scene:
    if add:
        scene.add_collision_mesh(cm, scale)
    if remove:
        scene.remove_collision_mesh(id)
# ---------- end collision ----------
panel_4 = Panel(collision)

attached = PythonScript(scene=scene, compas_mesh=mesh_2, scale=scale, id="tip", link_name=py_4, add=add, remove=remove)  # -> acm; inputs touch_links: list
# ---------- attached: Python ----------
from compas_fab.robots import CollisionMesh
from compas_fab.robots import AttachedCollisionMesh

cm = CollisionMesh(compas_mesh, id)
acm = AttachedCollisionMesh(cm, link_name, touch_links)

if scene:
    if add:
        scene.add_attached_collision_mesh(acm, scale)
    if remove:
        scene.remove_attached_collision_mesh(id)
        scene.remove_collision_mesh(id)
# ---------- end attached ----------

acms = Data(attached)

filter = StreamFilter(Gate=list_4, Stream1=attached)

# ---- group: plan motion
# Plan motion
# If you specify the tolerance vector with [360, 1, 1], it means that
#     the frame's y-axis and z-axis are allowed to rotate about the x-axis by an
#     angle of 360 degrees, whereas the x-axis can only change 1 degree.
number_slider_2 = Slider(1, range=1..360)
py_5 = PythonScript(robot=robot)  # -> configuration
# ---------- py_5: Python ----------
from compas_fab.robots import Configuration

if robot:
    types = robot.get_configurable_joint_types()
    values = [0] * len(types)

    configuration = Configuration(values, types)
    print configuration
# ---------- end py_5 ----------
list_5 = ValueList({"don't use attached collision mesh": 0, "use attached collision mesh": 1}, selected="use attached collision mesh")
list_6 = ValueList({"0", "1"}, selected="0")
filter_2 = StreamFilter(Gate=list_5, Stream1=acms)
list_7 = ValueList({"RRT", "RRT*": "RRTStar", "EST", "PRM": "RPM", "PRM*": "RPMStar", "SPARS"}, selected="RRT")
panel_5 = Panel("positions")
panel_6 = Panel("velocities")
panel_7 = Panel("accelerations")
start = Button()
reset = Button()
step = Button()

# ----
# Configuration
# TODO Example:
# Add path constraints
main_planning_group = Text(info.main_group_name)
compute = Button()

# ---- group: inverse kinematics
pt = Point(Point(0.6237035489, 0.01745815642, 0.3717161546))
py_6 = PythonScript(robot=robot)  # -> configuration
# ---------- py_6: Python ----------
from compas_fab.robots import Configuration

if robot:
    types = robot.get_configurable_joint_types()
    values = [0] * len(types)
    values = [-0.042, 4.295, -4.110, -3.327, 4.755, 0.]

    configuration = Configuration(values, types)
    print configuration
# ---------- end py_6 ----------
Y_2 = UnitY(Factor=1)
Z_2 = UnitZ(Factor=Slider(-1, range=-2..-1))
pl_2 = ConstructPlane(Origin=pt, XAxis=Z_2, YAxis=Y_2)
ik = PythonScript(robot=robot, group=main_planning_group, start_configuration=py_6, plane=pl_2)  # -> out, configuration
# ---------- ik: Python ----------
import scriptcontext as sc
import logging

from compas.geometry import Frame

from compas_fab.backends.ros import RosError
from compas_fab.robots import Configuration

LOGGER = logging.getLogger('roslibpy')

if robot:
    if robot.client:
        if robot.client.is_connected:
            frame = Frame(plane.Origin, plane.XAxis, plane.YAxis)
            configuration = robot.inverse_kinematics(frame, start_configuration, group)
            print(configuration)
        else:
            print("Robot is not connected")
# ---------- end ik ----------
panel_8 = Panel(ik.out)

# ---- group: forward kinematics
a1 = Slider(0, range=-360..360)
a5 = Slider(0, range=-360..360)
a6 = Slider(0, range=-360..360)
a2 = Slider(0, range=-360..360)
a4 = Slider(0, range=-360..360)
a3 = Slider(0, range=-360..360)
set_joint_positions = BooleanToggle(False)
jp = GhPythonScript()  # -> joint_positions
# ---------- jp: Python ----------
import math
joint_positions = [-3.136, -0.328, -1.218, 3.129, 0.852, 0.008]
joint_positions = [0] * 6
print joint_positions
# ---------- end jp ----------
forward_kinematics = PythonScript(
    robot=robot,
    group=main_planning_group,
    set_joint_positions=set_joint_positions,
    joint_positions=jp,
    a1=a1,
    a2=a2,
    a3=a3,
    a4=a4,
    a5=a5,
    a6=a6)  # -> configuration; inputs joint_positions: list
# ---------- forward_kinematics: Python ----------
import math
import Grasshopper
from compas_fab.robots import Configuration

if set_joint_positions:

    j = 0
    for i in range(ghenv.Component.Params.Input.Count):
        nslider = ghenv.Component.Params.Input[i].Sources[0]
        if nslider.GetType() == Grasshopper.Kernel.Special.GH_NumberSlider:
            nslider.TrySetSliderValue(math.degrees(joint_positions[j]))
            j += 1

if robot:
    joint_positions = [a1, a2, a3, a4, a5, a6]
    joint_positions = [math.radians(a) for a in joint_positions]
    types = robot.get_configurable_joint_types(group)
    configuration = Configuration(joint_positions, types)
    print configuration
# ---------- end forward_kinematics ----------

# ---- group: cartesian motion
# Plan cartesian motion
py_7 = PythonScript(robot=robot)  # -> configuration; same code as py_5
start_configuration = Data(ik.configuration)
list_8 = ValueList({"0", "1"}, selected="0")
avoid_collisions = BooleanToggle(True)
compute_2 = BooleanToggle(True)
filter_3 = StreamFilter(Gate=list_8, Stream0=start_configuration, Stream1=py_7)
plan_cartesian_motion = PythonScript(
    robot=robot,
    start_configuration=filter_3,
    planes=planes,
    max_step=Slider(0.01, range=0..0.01),
    avoid_collisions=avoid_collisions,
    compute=compute_2,
    acm=filter)  # -> out, robot, group, trajectory; inputs planes: list, avoid_collisions: Boolean, acm: list
# ---------- plan_cartesian_motion: Python ----------
import logging
import scriptcontext as sc
from compas.geometry import Frame

guid = str(ghenv.Component.InstanceGuid)
response_key = "response_" + guid
if response_key not in sc.sticky:
    sc.sticky[response_key] = None

if robot:
    if robot.client:
        if robot.client.is_connected:
            if start_configuration and compute:
                frames = [Frame(plane.Origin, plane.XAxis, plane.YAxis) for plane in planes]
                options = {'max_step':float(max_step), 'avoid_collisions':bool(avoid_collisions), 'attached_collision_meshes':list(acm)}
                response = robot.plan_cartesian_motion(frames, start_configuration=start_configuration, group=group, options=options)
                sc.sticky[response_key] = response
        else:
            print("Robot is not connected")
            sc.sticky[response_key] = None

trajectory = sc.sticky[response_key]
# ---------- end plan_cartesian_motion ----------
vis = PythonScript(trajectory=plan_cartesian_motion.trajectory)  # -> P, V, A, time
# ---------- vis: Python ----------
from compas_ghpython import list_to_ghtree

if trajectory:

    positions = []
    velocities = []
    accelerations = []
    time_from_start = []

    for p in trajectory.points:
        positions.append(p.positions)
        velocities.append(p.velocities)
        accelerations.append(p.accelerations)
        time_from_start.append(p.time_from_start.seconds)

    P = list_to_ghtree(list(zip(*positions)))
    V = list_to_ghtree(list(zip(*velocities)))
    A = list_to_ghtree(list(zip(*accelerations)))
    time = time_from_start[-1]
# ---------- end vis ----------
py_8 = PythonScript(robot=plan_cartesian_motion.robot, group=plan_cartesian_motion.group, trajectory=plan_cartesian_motion.trajectory)  # -> start_configuration, configurations, full_configurations, frames, planes, fraction
# ---------- py_8: Python ----------
from compas_ghpython import draw_frame

joint_positions = []

if trajectory:
    configurations = trajectory.points
    start_configuration = trajectory.start_configuration
    fraction = trajectory.fraction
    time = trajectory.time_from_start
    full_configurations = [robot.merge_group_with_full_configuration(c, trajectory.start_configuration, group) for c in configurations]
    frames = [robot.forward_kinematics(c, group, options=dict(solver='model')) for c in full_configurations]
    planes = [draw_frame(frame) for frame in frames]
    P = [plane.Origin for plane in planes]
# ---------- end py_8 ----------
panel_9 = Panel(plan_cartesian_motion.out)
prismatic = QuickGraph(vis.P, SortOrder=0)
fraction = Panel(py_8.fraction)
graph = QuickGraph(vis.V, SortOrder=0)
graph_2 = QuickGraph(vis.A, SortOrder=0)
pline = PolyLine(Vertices=py_8.planes, Closed=False)
start_2 = Button()
reset_2 = Button()
step_2 = Button()
counter = CountThroughList(L=py_8.full_configurations, start=start_2, step=step_2, reset=reset_2)  # -> item; inputs L: list, start: Boolean
# ---------- counter: Python ----------
from scriptcontext import sticky as st
from compas_ghpython.utilities import update_component


interval = 1

# store data in component
guid = str(ghenv.Component.InstanceGuid)
counter_key = "counter_" + guid
running_key = "running_" + guid

if counter_key not in st:
    st[counter_key] = 0

if running_key not in st:
    st[running_key] = False

if start:
    st[running_key] = True

if step:
    if st[counter_key] < len(L) - 1:
        st[counter_key] += 1
    
if len(L):
    item = L[st[counter_key]]

if st[running_key]:
    if st[counter_key] < len(L) - 1:
        st[counter_key] += 1
        update_component(ghenv, interval)
    else:
        st[counter_key] = 0
        st[running_key] = False
# ---------- end counter ----------
preview_2 = CustomPreview(Geometry=pline, Material=ColourSwatch(SwatchColor=RGB(59, 137, 161)))

# ----
time_s = Panel(vis.time)

# ---- group: forward kinematics
fk = PythonScript(robot=robot, group=main_planning_group, configuration=ik.configuration)  # -> out, frame_WCF
# ---------- fk: Python ----------
if robot:
    configuration = robot.get_group_configuration(group, configuration)
    frame_WCF = robot.forward_kinematics(configuration, group, options=dict(solver='model'))
    
    print frame_WCF
# ---------- end fk ----------
panel_13 = Panel(fk.out)

# ---- group: plan motion (continued)
python = PythonScript(
    robot=robot,
    group=main_planning_group,
    goal_plane=last_plane,
    tolerance_position=Slider(0.001, range=0..0.001),
    tolerance_xaxis_deg=Slider(360, range=1..360),
    tolerance_yaxis_deg=Slider(1, range=1..360),
    tolerance_zaxis_deg=number_slider_2)  # -> goal_constraints
# ---------- python: Python ----------
import math
from compas.geometry import Frame

frame = Frame(goal_plane.Origin, goal_plane.XAxis, goal_plane.YAxis)

tolerances_axes = [math.radians(tolerance_xaxis_deg), math.radians(tolerance_yaxis_deg), math.radians(tolerance_zaxis_deg)]

if robot:
    goal_constraints = robot.constraints_from_frame(frame, tolerance_position, tolerances_axes, group)
# ---------- end python ----------
start_configuration_2 = Data(ik.configuration)
filter_4 = StreamFilter(Gate=list_6, Stream0=start_configuration_2, Stream1=py_5)

# ----
plan_motion = PythonScript(robot=robot, start_configuration=filter_4, goal_constraints=python, planner_id=list_7, acm=filter_2, compute=compute)  # -> out, robot, group, trajectory; inputs goal_constraints: list, path_constraints: list, acm: list
# ---------- plan_motion: Python ----------
import logging
from scriptcontext import sticky as st
import math
from compas.geometry import Frame

from compas_fab.robots import Configuration

from compas_ghpython.utilities import update_component

guid = str(ghenv.Component.InstanceGuid)
response_key = "response_" + guid
if response_key not in st:
    st[response_key] = None

LOGGER = logging.getLogger('roslibpy')
data = dict(requesting_solution=False)

path_constraints = list(path_constraints)
if not len(path_constraints):
    path_constraints = None

if robot and robot.client and robot.client.is_connected and start_configuration and compute:
    options = dict(planner_id=str(planner_id),
                   path_constraints=path_constraints,
                   attached_collision_meshes=list(acm))
    st[response_key] = robot.plan_motion(goal_constraints,
                                         start_configuration,
                                         group,
                                         options)

trajectory = st[response_key]
# ---------- end plan_motion ----------
py_9 = PythonScript(robot=plan_motion.robot, group=plan_motion.group, trajectory=plan_motion.trajectory)  # -> start_configuration, configurations, full_configurations, frames, planes; same code as py_8
panel_14 = Panel(plan_motion.out)

# ---- group: plan motion (continued)
vis_2 = PythonScript(trajectory=plan_motion.trajectory)  # -> P, V, A, time
# ---------- vis_2: Python ----------
from compas_ghpython import list_to_ghtree

if trajectory:

    positions = []
    velocities = []
    accelerations = []
    time_from_start = []

    for p in trajectory.points:
        positions.append(p.positions)
        velocities.append(p.velocities)
        accelerations.append(p.accelerations)
        time_from_start.append(p.time_from_start.seconds)

    P = list_to_ghtree(list(zip(*positions)))
    V = list_to_ghtree(list(zip(*velocities)))
    A = list_to_ghtree(list(zip(*accelerations)))

    time = time_from_start[-1]
    print time
# ---------- end vis_2 ----------
time_s_2 = Panel(vis_2.time)
prismatic_2 = QuickGraph(vis_2.P, SortOrder=0)
graph_3 = QuickGraph(vis_2.V, SortOrder=0)
graph_4 = QuickGraph(vis_2.A, SortOrder=0)
pline_2 = PolyLine(Vertices=py_9.planes, Closed=False)
counter_2 = CountThroughList(L=py_9.full_configurations, start=start, step=step, reset=reset)  # -> item; inputs L: list, start: Boolean; same code as counter
preview_3 = CustomPreview(Geometry=pline_2, Material=ColourSwatch(SwatchColor=RGB(139, 59, 161)))

# ----
# Visualisation
# Select configuration input: from fk, ik, path, or from real robot
list_9 = ValueList({"0 forward_kinematics": 0, "1 inverse_kinematics": 1, "2 cartesian path": 2, "3 kinematic path": 3}, selected="0 forward_kinematics")
filter_5 = StreamFilter(Gate=list_9, Stream0=forward_kinematics, Stream1=ik.configuration, Stream2=counter, Stream3=counter_2)
show_end_effector_frame = BooleanToggle(True)
show_base_frame = BooleanToggle(True)
show_collision = BooleanToggle(False)
show_frames = BooleanToggle(False)
show_visual = BooleanToggle(True)
show_acm = BooleanToggle(True)
visualize = PythonScript(
    robot=robot,
    group=main_planning_group,
    configuration=filter_5,
    attached_collision_meshes=acms,
    show_visual=show_visual,
    show_collision=show_collision,
    show_frames=show_frames,
    show_base_frame=show_base_frame,
    show_end_effector_frame=show_end_effector_frame,
    show_acm=show_acm)  # -> out, visual, collision, attached_meshes, frames, ee_frame, base_frame; inputs attached_collision_meshes: list
# ---------- visualize: Python ----------
from compas.geometry import Vector
from compas.geometry import Point
from compas.geometry import Transformation
from compas.geometry import Frame
from compas_ghpython.artists import MeshArtist
from compas_fab.robots import Configuration

if robot and configuration:
    
    robot.update(configuration, visual=show_visual, collision=show_collision)

    if show_visual:
        visual = robot.artist.draw_visual()

    if show_collision:
        collision = robot.artist.draw_collision()
    
    frames = robot.transformed_frames(configuration, group)

    if show_base_frame:
        base_frame = frames[0]

    if show_end_effector_frame:
        ee_frame = robot.forward_kinematics(configuration, group)
        print("End-effector", ee_frame)
    
    if not show_frames:
        frames = None
    
    if show_acm:
        M = []
        for acm in attached_collision_meshes:
            frame = robot.forward_kinematics(configuration, options=dict(solver='model', link_name=acm.link_name))
            T = Transformation.from_frame_to_frame(Frame.worldXY(), frame)
            mesh = acm.collision_mesh.mesh.transformed(T)
            M.append(MeshArtist(mesh).draw())
        attached_meshes = M
# ---------- end visualize ----------
geo = Geometry(visualize.visual)
geo_2 = Geometry(visualize.collision)
panel_15 = Panel(visualize.out)
draw = GhPythonScript(frames=[visualize.frames, visualize.ee_frame, visualize.base_frame], scale=Slider(0.1, range=0..1))  # -> P, V, C, W; inputs frames: list
# ---------- draw: Python ----------
from System.Drawing import Color
from compas_ghpython.utilities import draw_frame

red = Color.FromArgb(255, 0, 0)
green = Color.FromArgb(0, 255, 0)
blue = Color.FromArgb(0, 0, 255)

P = []
V = []
C = []

scale = float(scale)

for frame in frames:
    if not frame:
        continue
    plane = draw_frame(frame)
    P += [plane.Origin] * 3
    V.append(plane.XAxis * scale)
    V.append(plane.YAxis * scale)
    V.append(plane.ZAxis * scale)
    C += [red, green, blue]

W = 3
# ---------- end draw ----------
preview_4 = CustomPreview(Geometry=geo, Shader=ColourSwatch(SwatchColor=RGB(105, 105, 105)))
vdisex = VectorDisplayEx(Point=draw.P, Vector=draw.V, Colour=draw.C, Width=draw.W)
preview_5 = CustomPreview(Geometry=visualize.attached_meshes, Shader=ColourSwatch(SwatchColor=RGB(255, 255, 255)))
