# Grasshopper definition mobile_robot_workspace_bjoern.ghx (Grasshopper 1.0.7)

# ----
# 1.
# Settings
bang = Button()
panel = Panel("Unload libraries")
unload = PythonScript(bang=bang)
# ---------- unload: Python ----------
from compas_rhino.utilities.misc import get_tolerance
from compas_rhino.utilities.misc import unload_modules

unload_modules("compas")
unload_modules("compas_fab")
unload_modules("ur_fabrication_control")
unload_modules("mobile_fabrication_control")
unload_modules("am_information_model")
unload_modules("src")
# ---------- end unload ----------

# ---- group: general parameters
num_layers = Slider(50, range=0..100)  # disabled
thickness = Slider(0.005, range=0..0.01)  # disabled
number_slider = Slider(35, range=0..100)  # disabled
radius = Slider(0.15, range=0..300)  # disabled

# ---- group: Radius_manipulator
# 3.
division = Division(A=1, B=num_layers)  # disabled
series = Series(Start=0, Step=division, Count=num_layers)  # disabled
graph = GraphMapper(
    series,
    x0=0,
    x1=1,
    y0=0,
    y1=1,
    container_name="Sine Summation",
    Equation0_px=[0, 0.3991093338],
    Equation0_py=[0, 0.1094774604],
    Equation1_px=[0.9992451072, 0],
    Equation1_py=[0.605002284, 0.4067921638])  # disabled
multiplication = Multiplication(A=radius, B=graph)  # disabled

# ----
ext_ip = ValueList({"192.168.10.10", "192.168.10.20", "192.168.10.11", "192.168.10.12", "127.0.0.1", "192.168.10.111", "192.168.0.220", "192.168.0.30", "192.168.10.50"}, selected="192.168.0.220")
ext_port = ValueList({"50003", "50004"}, selected="50004")

# ----
# --> Set your IP address
# --> Set robot IP address
server_ip = ValueList({"192.168.10.44", "192.168.10.12", "192.168.10.11", "192.168.10.10", "192.168.10.2", "127.0.0.1", "192.168.10.111", "192.168.0.250", "192.168.0.30", "10.42.0.212", "10.42.0.133"}, selected="192.168.0.250")
ur_ip = ValueList({"192.168.10.10", "192.168.10.20", "192.168.10.11", "192.168.10.12", "127.0.0.1", "192.168.10.111", "192.168.0.210", "192.168.0.30"}, selected="192.168.0.210")
server_port = ValueList({"50002", "50003", "50004", "50005"}, selected="50005")
ur_port = ValueList({"30002"}, selected="30002")
globals = PythonScript(
    server_address=server_ip,
    server_port=server_port,
    ur_ip=ur_ip,
    ur_port=ur_port,
    ext_ip=ext_ip,
    ext_port=ext_port,
    clear=Button())  # inputs server_port: Int32
# ---------- globals: Python ----------
from scriptcontext import sticky as st

st["server_address"] = server_address
st["server_port"] = server_port

st["ur_ip"] = ur_ip
st["ur_port"] = ur_port

st["ext_ip"] = ext_ip
st["ext_port"] = ext_port


if clear:
    st.clear()
# ---------- end globals ----------

# ----
# Check if UR robot
#  is available
ping = Button()
py = PythonScript(ip=ur_ip, ping=ping)  # -> out, trigger
# ---------- py: Python ----------
from scriptcontext import sticky as st
from ur_fabrication_control.direct_control.utilities import is_available

guid = str(ghenv.Component.InstanceGuid)
txt_key = "txt_" + guid
if txt_key not in st:
    st[txt_key] = ""

if ping:
    
    available = is_available(ip)
    
    if available:
        st[txt_key] = "%s is up!" % ip
        trigger = True
    else:
        st[txt_key] = "%s is down!" % ip
        trigger = False

print(st[txt_key])
# ---------- end py ----------
panel_2 = Panel(py.out)

# ---- group: Morphing tools
number_slider_2 = Slider(0.004, range=0..0.1)  # disabled
number_slider_3 = Slider(3, range=0..100)  # disabled
number_slider_4 = Slider(1, range=0..100)  # disabled
number_slider_5 = Slider(1, range=0..10)  # disabled
number_slider_6 = Slider(0, range=0..6.283185)  # disabled
freq_morph = GhPythonScript(
    frequency=number_slider_3,
    amplitude=number_slider_2,
    shift=number_slider_6,
    num_pts=number_slider,
    num_layers=num_layers)  # -> out, morph_normal; inputs num_pts: Int32, num_layers: Int32; disabled
# ---------- freq_morph: Python ----------
import rhinoscriptsyntax as rs
import math

def frequency_morph(freq, amp, shft, num):
    wave_length = 2*math.pi*freq
    wave_int = wave_length/(num-1)
    v_morph = []
    for n, a in zip(range(num), amp):
        npt = wave_int*n + shft
        v_morph.append(math.sin(npt)*a)
    return v_morph

morph_normal = []
for n in range(num_layers):
    if isinstance(amplitude, float):
        amp = [amplitude for n in range(num_pts)]
    else:
        amp = amplitude
    morph_normal.append(frequency_morph(frequency, amp, shift, num_pts))

morph_normal_0 = morph_normal[0]
# ---------- end freq_morph ----------
rot_morph = GhPythonScript(increment=number_slider_4, multiplier=number_slider_5, num_layers=num_layers)  # -> out, morph_rotation; inputs increment: Int32, num_layers: Int32; disabled
# ---------- rot_morph: Python ----------
import rhinoscriptsyntax as rs
import math

def rotation_morph(inc, mult, num):
    r_morph = []
    for n in range(num):
        if n == 0:
            nr = 0
            cmltv_mult = 1
        else:
            nr = r_morph[n-1]+inc[n-1]*cmltv_mult
            cmltv_mult *= mult[n-1]
        print nr
        r_morph.append(nr)
    return [math.radians(r) for r in r_morph]

if isinstance(multiplier, float):
    mltplr = [multiplier for n in range(num_layers)]
if isinstance(increment, int):
    incr = [increment for n in range(num_layers)]

morph_rotation = rotation_morph(incr, mltplr, num_layers)
# ---------- end rot_morph ----------

# ---- group: Primitive geometry
series_2 = Series(Start=thickness, Step=thickness, Count=num_layers)  # disabled
pln = Plane(Plane(origin=(-0.1027526412, 0.7659956521, 0.7677421356), x=(-1, 0, 0), y=(0, 1, 0)))  # disabled
_2d_circle = GhPythonScript(cp=pln, radii=multiplication, height=series_2, num_pts=number_slider, num_layers=num_layers)  # -> out, circle_planes, circle_normals, circle_frames; inputs radii: list, height: list, num_pts: Int32, num_layers: Int32; disabled
# ---------- _2d_circle: Python ----------
import Rhino.Geometry as rg
import math
from compas.geometry import Frame
from compas.geometry import Point
from compas.geometry import Translation
from compas.geometry import Transformation
from compas.geometry import Vector

from compas_ghpython import draw_frame

cf = Frame(cp.Origin, cp.XAxis, cp.YAxis)

def circle_2d(cfc, radius, h, num_pts):
    frames = []
    normals = []
    if height.index(h)>0:
        dh = h-height[height.index(h)-1]
    else:
        dh = h
    angle_red = math.radians((dh*360)/(2*math.pi*radius))
    for n in range(num_pts):
        theta = (((2*math.pi)-angle_red)/(num_pts-1))*n
        x = math.cos(theta)*radius
        y = math.sin(theta)*radius
        circle_frame = Frame(Point(x,y,h), Vector.Xaxis(), Vector.Yaxis())
        T = Translation.from_frame(circle_frame)
        n_frame = cfc.transformed(T)
        frames.append(n_frame)
        cfc_shift_z = cfc.transformed(Translation.from_vector(Vector.Zaxis()*h))
        n_normal = Vector.from_start_end(cfc_shift_z.point, n_frame.point)
        n_normal.unitize()
        normals.append(n_normal)
    return frames, normals

circle_frames = []
circle_normals = []
circle_planes = []
if isinstance(cp, rg.Plane):
    cf = [cf for n in range(num_layers)]
if isinstance(num_pts, int):
    num_pts = [num_pts for n in range(num_layers)]
if isinstance(height, float):
    height = [height for n in range(num_layers)]
if isinstance(radii, float):
    radii = [radii for n in range(num_layers)]
    
for n in range(num_layers):
    frames, normals = circle_2d(cf[n], radii[n], height[n], num_pts[n])
    circle_frames.append(frames)
    circle_normals.append(normals)
    circle_planes.append([draw_frame(frame) for frame in circle_frames[n]])
# ---------- end _2d_circle ----------

# ---- group: ROS client
# 2.
disconnect = Button()
connect = Button()
connect_2 = PythonScript(ip="10.42.0.190", connect=connect, disconnect=disconnect)  # -> out, ros_client
# ---------- connect_2: Python ----------
import sys
import scriptcontext as sc
from compas_fab.backends import RosClient

key = 'rosclient_%s' % str(ghenv.Component.InstanceGuid)
previous_client = sc.sticky.get(key, None)

if previous_client and (connect or disconnect):
    previous_client.close()

if connect:
    ros_client = RosClient(ip, 9090)
    sc.sticky[key] = ros_client
    ros_client.run(5)

ros_client = sc.sticky.get(key, None)
print('ROS connected: {}'.format(ros_client.is_connected if ros_client else 'False'))
# ---------- end connect_2 ----------
is_connected = Panel(connect_2.out)

# ----
py_2 = PythonScript()  # -> repositories_path, rbvogui_data_path, ur_data_path
# ---------- py_2: Python ----------
import os

"""
ASSUMING THE BELOW PACKAGES ARE STORED IN THE SAME LOCATION:
    ur_fabrication_control;
    rbvogui_common; and
    mobile_additive_manufacturing.
"""

repositories_path = os.path.abspath(os.path.join(ghdoc.Path,"../../../"))

assert os.path.exists(os.path.join(repositories_path, "ur_fabrication_control/data"))
assert os.path.exists(os.path.join(repositories_path, "rbvogui_common/rbvogui_description"))
assert os.path.exists(os.path.join(repositories_path, "mobile_fabrication_control"))

ur_data_path = os.path.abspath(os.path.join(ghdoc.Path,"../../../ur_fabrication_control/data"))
rbvogui_data_path = os.path.abspath(os.path.join(repositories_path, "rbvogui_common"))
# ---------- end py_2 ----------
list = ValueList({"ur3.urdf", "ur3_rot.urdf", "ur5.urdf", "ur10.urdf", "ur3e.urdf", "ur5e.urdf", "ur10e.urdf", "ur10e_rot.urdf"}, selected="ur10e_rot.urdf")
list_2 = ValueList({"ur3.srdf", "ur5.srdf", "ur10.srdf", "ur3e.srdf", "ur5e.srdf", "ur10e.srdf"}, selected="ur10e.srdf")

# ----
# Robot Model
# Load Model
list_3 = ValueList({"ur_description", "ur_e_description", "ur_setups"}, selected="ur_e_description")
py_3 = PythonScript(
    repositories_path=py_2.repositories_path,
    rbvogui_data_path=py_2.rbvogui_data_path,
    ur_data_path=py_2.ur_data_path,
    package=list_3,
    urdf_name=list,
    srdf_name=list_2)  # -> loaders, urdf_filename, srdf_filename
# ---------- py_3: Python ----------
import os
from compas.robots import LocalPackageMeshLoader

#loaders

ur_path = os.path.join(ur_data_path, "robot_description")
ur_packages = ["ur_description", "ur_e_description", "ur_end_effectors", "ur_setups"]
ur_loaders = [LocalPackageMeshLoader(ur_path, pck) for pck in ur_packages]

rbvogui_packages = ["rbvogui_description"]
rbvogui_loaders = [LocalPackageMeshLoader(rbvogui_data_path, pck) for pck in rbvogui_packages]

ewellix_packages = ["ewellix_description"]
ewellix_loaders = [LocalPackageMeshLoader(repositories_path, pck) for pck in ewellix_packages]

sensors_packages = ["robotnik_sensors"]
sensors_loaders = [LocalPackageMeshLoader(repositories_path, pck) for pck in sensors_packages]

loaders = ur_loaders + rbvogui_loaders + ewellix_loaders + sensors_loaders

#files
urdf_filename = os.path.join(repositories_path, r"mobile_fabrication_control\data\rbvogui_xl_lift_ur10e.urdf")
srdf_filename = os.path.join(repositories_path, r"mobile_fabrication_control\data\rbvogui.srdf")

assert os.path.isfile(urdf_filename)
assert os.path.isfile(srdf_filename)
# ---------- end py_3 ----------
units = ValueList({"m": 1, "cm": 100, "mm": 1000}, selected="m")
load = Button()
create = PythonScript(
    load=load,
    ros_client=connect_2.ros_client,
    loaders=py_3.loaders,
    urdf_filename=py_3.urdf_filename,
    srdf_filename=py_3.srdf_filename,
    scale_factor=units)  # -> out, robot, rcf; inputs load: Boolean, loaders: list
# ---------- create: Python ----------
import os
from scriptcontext import sticky as st

import compas

from compas_ghpython import draw_frame
from compas.robots import RobotModel
from compas.robots import LocalPackageMeshLoader

from compas_fab.robots import Robot
from compas_fab.robots import RobotSemantics
from compas_fab.ghpython import RobotArtist

compas.PRECISION = '12f'

# store robot in component
guid = str(ghenv.Component.InstanceGuid)
robot_key = "robot"

if robot_key not in st:
    st[robot_key] = None

#print loaders
if load:
    model = RobotModel.from_urdf_file(urdf_filename)
    
    model.load_geometry(*loaders)
    artist = RobotArtist(model)
    semantics = RobotSemantics.from_srdf_file(srdf_filename, model)
    robot = Robot(model, artist, semantics, client=None)
    
    st[robot_key] = robot

robot = st[robot_key]
print(robot)
rcf = draw_frame(robot.get_RCF())
print(rcf)

if robot:
    robot.scale(scale_factor)
    robot.client = ros_client
# ---------- end create ----------
robot = Data(create.robot)

list_4 = ValueList({"nozzle", "scanner"}, selected="scanner")
py_4 = PythonScript()  # -> DATA
# ---------- py_4: Python ----------
import os

#package_path = os.path.dirname(mobile_fabrication_control.__file__)
#DATA = os.path.abspath(os.path.join(package_path,"../../data"))

package_path = ghdoc.Path
# package_path = os.path.dirname(ur_fabrication_control.__file__)
#DATA = os.path.abspath(os.path.join(package_path,"../../data"))

# .stl files not stored in am_hackathon repo. but in mobile_fabrication_control
DATA = os.path.abspath(os.path.join(package_path,"../../../mobile_fabrication_control/data"))

print(package_path)
print(DATA)
# ---------- end py_4 ----------

# ----
# Tool
list_5 = ValueList({"measurement_tool": 0, "clay_extruder_7mm": 1, "clay_extruder_7mm_with_2d_laser": 2, "clay_extruder_v2_7mm": 3}, selected="clay_extruder_7mm_with_2d_laser")
show = BooleanToggle(False)
panel_3 = Panel("Attach a custom tool")
python = PythonScript(data_path=py_4, tool=list_5, tcp_frame=list_4, show=show)  # -> tool, M
# ---------- python: Python ----------
import os, math
from compas.geometry import Frame, Rotation
from compas.datastructures import Mesh
from compas_ghpython.artists import MeshArtist
from compas_fab.robots import Tool

tolerance = 0

if tool == 0:
    filename = 'measurement_tool_zaxis.stl'
    ee_frame = Frame([0, 0, 0.109], [1, 0, 0], [0, 1, 0])

elif tool == 1:
    filename = 'clay_extruder_7mm.stl'
    # real frame:
    ee_frame = Frame([-0.000502, -0.105348, 0.0662,], [1, 0, 0], [0, 0, 1])
    
    # test frame:
    # ee_frame = Frame([0.0, 0.0, 0.1,], [1, 0, 0], [0, 1, 0])
elif tool == 2:
    filename = 'clay_extruder_7mm_with_2d_laser.stl'
    # non-rotated frame:
    if tcp_frame == "nozzle":
        ee_frame = Frame([-0.0012, -0.0019, 0.3429,], [1, 0, 0], [0, 1, 0])
    elif tcp_frame == "scanner":
        ee_frame = Frame([0.0520, -0.0019, 0.3737,], [1, 0, 0], [0, 1, 0])

elif tool == 3:
    filename = 'clay_extruder_v2_7mm.stl'
    ee_frame = Frame([0, 0, 0.31976626739], [1, 0, 0], [0, 1, 0])


data_path = os.path.join(data_path, "tool_geometry")
fullfilename = os.path.join(data_path, filename)
print fullfilename

ee_mesh = Mesh.from_stl(fullfilename)

#R = Rotation.from_axis_and_angle(ee_frame.zaxis, math.radians(180), point=ee_frame.point)
#ee_frame.transform(R)

if show:
    artist = MeshArtist(ee_mesh)
    M = artist.draw()

tool = Tool(ee_mesh, ee_frame)
# ---------- end python ----------
py_5 = PythonScript(robot=robot, tool=python.tool, attach=Toggle(True))  # -> a
# ---------- py_5: Python ----------
if attach:
    robot.attach_tool(tool, group = "ur10e")
else:
    robot.detach_tool()
# ---------- end py_5 ----------

# ---- group: Combining primitive and morphs to AM Model
number_slider_7 = Slider(0.001, range=0..0.1)  # disabled
am_model = GhPythonScript(
    cp=pln,
    layer_frame_normals=_2d_circle.circle_normals,
    layer_frames=_2d_circle.circle_frames,
    max_radius=number_slider_7,
    morph_normal=freq_morph.morph_normal,
    morph_rotation=rot_morph.morph_rotation)  # -> out, am_model, planes, curves; inputs layer_frame_normals: list, layer_frames: list, morph_normal: list, morph_rotation: list; disabled
# ---------- am_model: Python ----------
import rhinoscriptsyntax as rs
import math

from compas.geometry import Frame
from compas.geometry import Translation
from compas.geometry import Rotation
from compas.geometry import Vector

from compas_ghpython import draw_frame

from am_information_model import Layer
from am_information_model import Node
from am_information_model import AMModel

am_model = AMModel()

cf = Frame(cp.Origin, cp.XAxis, cp.YAxis)

def layer_nodes(frames, radius):
    nodes = []
    for i, frame in enumerate(frames):
        node = Node(frame.copy(), radius)
        nodes.append(node)
    return nodes

def morph_normals(nodes, normals, morphs):
    for node, normal, morph in zip(nodes, normals, morphs):
        T = Translation.from_vector(normal.scaled(morph))
        node.transform(T)

def morph_rotations(nodes, morph):
    for node in nodes:
        R = Rotation.from_axis_and_angle(Vector.Zaxis(), morph, cf.point)
        node.transform(R)

for frames, normals, mn, mr in zip(layer_frames, layer_frame_normals, morph_normal, morph_rotation):
    nodes = layer_nodes(frames, max_radius)
    morph_normals(nodes, normals, mn)
    morph_rotations(nodes, mr)
    layer = Layer.from_nodes(nodes)
    am_model.add_layer(layer)

from compas.geometry import Polyline
from compas_ghpython.artists import PolylineArtist

planes = []
points = []
for key, layer in am_model.layers():
    for key, node in layer.nodes():
        planes.append(draw_frame(node.frame))
        points.append(node.frame.point)

polyline = Polyline(points)
artist = PolylineArtist(polyline)
curves = artist.draw()
# ---------- end am_model ----------

# ----
crv = Curve(am_model.curves)  # disabled
number_slider_8 = Slider(0.001, range=0..0.1)

# ----
# AM_information_model
fillet = Fillet(Curve=crv, Radius=number_slider_7)  # disabled
len = Length(Curve=fillet)  # disabled
path_length = Panel(len)  # disabled

pln_2 = Plane(create.rcf)
crv_2 = Curve(<curve referenced from the Rhino model>)
crv_3 = Curve([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])
crv_4 = Curve(<curve referenced from the Rhino model>)

# ----
# Info
info = PythonScript(robot=robot)  # -> out, main_group_name
# ---------- info: Python ----------
if robot:
    robot.info()
    main_group_name = robot.main_group_name
# ---------- end info ----------
panel_4 = Panel(info.out)

am_model_2 = GhPythonScript(
    crv=crv_2,
    outer_crv=crv_4,
    scan_width=Slider(0.05, range=0..0.1),
    max_radius=number_slider_8,
    num_layers=Slider(20, range=0..100),
    layer_height=Slider(0.004, range=0..0.01))  # -> out, am_model, planes, curves; inputs crv: Curve, outer_crv: Curve, num_layers: Int32
# ---------- am_model_2: Python ----------
import rhinoscriptsyntax as rs
import Rhino.Geometry as rg
import math
import ghpythonlib.components as ghcomp

from compas.geometry import Frame
from compas.geometry import Translation
from compas.geometry import Rotation
from compas.geometry import Vector
from compas.geometry import Line

from compas_ghpython import draw_frame

from am_information_model import Layer
from am_information_model import Node
from am_information_model import AMModel

am_model = AMModel()
scan_model = AMModel()

def layer_nodes(frames, radius):
    nodes = []
    for i, frame in enumerate(frames):
        node = Node(frame.copy(), radius)
        nodes.append(node)
    return nodes

pts = ghcomp.ControlPoints(crv)[0]
print pts

layers_frames = []
for n in range(num_layers):
    z_inc = (n+1)*layer_height
    frames = []
    for pt in pts:
        new_pt= [pt.X, pt.Y, pt.Z+z_inc]
        frames.append(Frame(new_pt, [1,0,0], [0,-1,0]))
    nodes = layer_nodes(frames, max_radius)
    layer = Layer.from_nodes(nodes)
    am_model.add_layer(layer)

### SCANNING ###

pts_out = ghcomp.ControlPoints(outer_crv)[0]
ln1 = Line(pts_out[0], pts_out[3])
vec1 = rg.Vector3d(pts_out[3]-pts_out[0])
vec1.Unitize()
pt01 = pts_out[0] + rg.Vector3d(0,0,num_layers*layer_height)
pt02 = pts_out[1] + rg.Vector3d(0,0,num_layers*layer_height)

num_ln_y = ghcomp.Round(ln1.length/scan_width)[2]
rest_y = ln1.length%scan_width
frames_scan = []
for n in range(num_ln_y):
    rely_inc = n*scan_width + (rest_y)/2
    pt1 = pt01+vec1*rely_inc
    pt2 = pt02+vec1*rely_inc
    if n%2==0:
        frames_scan.append(Frame(pt1, [1,0,0], [0,-1,0]))
        frames_scan.append(Frame(pt2, [1,0,0], [0,-1,0]))
    else:
        frames_scan.append(Frame(pt2, [1,0,0], [0,-1,0]))
        frames_scan.append(Frame(pt1, [1,0,0], [0,-1,0]))
scan_nodes = layer_nodes(frames_scan, max_radius)
scan_layer = Layer.from_nodes(scan_nodes)
am_model.add_layer(scan_layer)

from compas.geometry import Polyline
from compas_ghpython.artists import PolylineArtist

planes = []
points = []
for key, layer in am_model.layers():
    for key, node in layer.nodes():
        planes.append(draw_frame(node.frame))
        points.append(node.frame.point)

polyline = Polyline(points)
artist = PolylineArtist(polyline)
curves = artist.draw()
# ---------- end am_model_2 ----------
pln_3 = Plane(am_model_2.planes)
crv_5 = Curve(am_model_2.curves)
fillet_2 = Fillet(Curve=crv_5, Radius=number_slider_8)

# ---- group: inverse kinematics
# Configuration
number_slider_9 = Slider(-1, range=-2..-1)
pt = Point(Point(0.6237035489, 0.01745815642, 0.3717161546))
py_6 = PythonScript()  # -> configuration
# ---------- py_6: Python ----------
from compas_fab.robots import Configuration

if robot:
    types = robot.get_configurable_joint_types()
    values = [0] * len(types)
    values = [-0.042, 4.295, -4.110, -3.327, 4.755, 0.]

    configuration = Configuration(values, types)
    print configuration
# ---------- end py_6 ----------
Y = UnitY(Factor=1)
Z = UnitZ(Factor=number_slider_9)
pl = ConstructPlane(Origin=pt, XAxis=Z, YAxis=Y)
ik = PythonScript(start_configuration=py_6, plane=pl)  # -> out, configuration
# ---------- ik: Python ----------
import scriptcontext as sc
import logging

from compas.geometry import Frame

from compas_fab.backends.ros import RosError
from compas_fab.robots import Configuration

LOGGER = logging.getLogger('roslibpy')

if robot:
    if robot.client:
        if robot.client.is_connected:
            frame = Frame(plane.Origin, plane.XAxis, plane.YAxis)
            configuration = robot.inverse_kinematics(frame, start_configuration, group)
            print(configuration)
        else:
            print("Robot is not connected")
# ---------- end ik ----------
panel_5 = Panel(ik.out)

# ----
len_2 = Length(Curve=fillet_2)

# ---- group: Visualise
back = Button()
reset = Button()
start = Button()
stop = Button()
step = Button()
full = Button()
list_6 = ValueList({"20", "50", "100", "500", "1000", "5000"}, selected="20")

# ---- group: forward kinematics
a1 = Slider(-135, range=-360..360)
a2 = Slider(-65, range=-360..360)
a3 = Slider(125, range=-360..360)
a4 = Slider(-150, range=-360..360)
a5 = Slider(-90, range=-360..360)
a6 = Slider(-270, range=-360..360)
jp = GhPythonScript()  # -> joint_positions
# ---------- jp: Python ----------
import math

joint_positions = [0,-90,90,0,90,0]
joint_positions = [math.radians(a) for a in joint_positions]
#joint_positions = [-3.136, -0.328, -1.218, 3.129, 0.852, 0.008]
#joint_positions = [0] * 6



#joint_positions = [1.6239667567485938, 0.25439606475392273, 4.409424838594969-2*3.14, 3.1901607306255908, 1.5707963267948954, 0.053170429953696939]
#joint_positions = [1.598543436748912, 0.23021224965157744, 4.712232135219824-2*3.14, 6.0531299026928744, 4.7123889803846915, 0.027747109954015234]
#joint_positions = [-1.1373533430447322, 4.0117247163121572, 5.4083762087596021-2*3.14, 1.5754733624925168, 4.7123889803846879, 3.5750356373399574]
print joint_positions
# ---------- end jp ----------
forward_kinematics = PythonScript(robot=robot, set_joint_positions=Button(), joint_positions=jp, a1=a1, a2=a2, a3=a3, a4=a4, a5=a5, a6=a6)  # -> full_configuration; inputs joint_positions: list
# ---------- forward_kinematics: Python ----------
import math
import Grasshopper
from compas.robots import Joint
from compas_fab.robots import Configuration

if set_joint_positions:

    j = 0
    for i in range(ghenv.Component.Params.Input.Count):
        nslider = ghenv.Component.Params.Input[i].Sources[0]
        if nslider.GetType() == Grasshopper.Kernel.Special.GH_NumberSlider:
            nslider.TrySetSliderValue(math.degrees(joint_positions[j]))
            j += 1

if robot:
    joint_positions = [a1, a2, a3, a4, a5, a6]
    joint_types = robot.get_configurable_joint_types()
    for i, joint_type in enumerate(joint_types):
        if joint_type == Joint.REVOLUTE:
            joint_positions[i] = math.radians(joint_positions[i])
    full_configuration = Configuration(joint_positions, joint_types)
    
print(full_configuration)
# ---------- end forward_kinematics ----------

# ----
plane_nr = Slider(3, range=0..20)  # disabled

# ---- group: Visualise
# 1. Visualise the entire assembly.
# 2. Visualise the assembly process by setting a counter and a speed.
counter = CountThroughList(am_model=am_model_2.am_model, start=start, stop=stop, step=step, step_back=back, reset=reset, full=full, interval=list_6)  # -> item, counter; inputs start: Boolean, stop: Boolean, step_back: Boolean
# ---------- counter: Python ----------
from scriptcontext import sticky as st
from compas_ghpython import update_component


L = list(am_model.layers())
# store data in component
guid = str(ghenv.Component.InstanceGuid)
counter_key = "counter_" + guid
running_key = "running_" + guid

if counter_key not in st:
    st[counter_key] = 0

if running_key not in st:
    st[running_key] = False
    

if st[running_key]:
    if st[counter_key] < len(L) - 1:
        st[counter_key] += 1
        update_component(ghenv, interval)
    else:
        st[counter_key] = 0
        st[running_key] = False
    
    
if start:
    st[running_key] = True

if stop:
    st[running_key] = False

if step:
    if st[counter_key] < len(L) - 1:
        st[counter_key] += 1

if step_back:
    if st[counter_key] < len(L) - 1:
        st[counter_key] -= 1

if reset:
    st[counter_key] = 0

if full:
    st[counter_key] = len(L)-1

if len(L):
    item = L[st[counter_key]]



#st["visualisation_counter"] = st[counter_key]
counter = st[counter_key]
# ---------- end counter ----------
show_2 = BooleanToggle(True)
show_3 = BooleanToggle(True)
idx = Panel(counter.counter)
draw = PythonScript(am_model=am_model_2.am_model, show_all=show_2, show_counter=show_3, counter=idx)  # -> G, tool_planes_WCS, current_tool_plane, current_layer_planes; inputs counter: Int32
# ---------- draw: Python ----------
import os
import sys

import math

from compas_ghpython.artists import MeshArtist
from compas_ghpython import draw_frame

#from assembly_information_model.artist import AssemblyArtist


G = []

key_index = am_model.network.key_index()
keys = [key_index[key] for key in am_model.network.nodes()]
layers = [am_model.layer(key) for key in keys] 

tool_planes_WCS = [draw_frame(layer.node(0).frame) for layer in layers]

current_tool_plane = tool_planes_WCS[counter]
current_layer_planes = [draw_frame(frame) for frame in layers[counter].path]

if show_all and not show_counter:
    for layer in layers:
        for key, node in layer.nodes():
            plane = draw_frame(node.frame)
            G.append(plane)

if show_counter:
    for layer in layers[0:counter+1]:
        for key, node in layer.nodes():
            plane = draw_frame(node.frame)
            G.append(plane)
# ---------- end draw ----------
pln_4 = Plane(draw.current_tool_plane)
pln_5 = Plane(draw.current_layer_planes)
geo = Geometry(draw.G)
pln_6 = Plane(draw.tool_planes_WCS)
preview = CustomPreview(Geometry=geo, Shader=ColourSwatch(SwatchColor=RGBA(255, 186, 220, 146)))

# ---- group: inverse kinematics
select_configuration = Slider(0, range=0..7)  # disabled
inverse = PythonScript(robot=robot, planes_WCS=pln_5, plane_nr=plane_nr, idx=select_configuration)  # -> out, plane_tool0_RCS, plane_tcp_RCS, configuration; inputs planes_WCS: list of Plane, plane_nr: Int32, idx: Int32; disabled
# ---------- inverse: Python ----------
import Rhino.Geometry as rg
import math
from compas.geometry import Frame, Transformation, Rotation
from compas_fab.robots import Configuration
from ur_fabrication_control.kinematics.ur_kinematics import inverse_kinematics
from ur_fabrication_control.kinematics.ur_params import ur_params
from compas_ghpython import draw_frame

plane_WCS = planes_WCS[plane_nr]

tcp_WCS = Frame(plane_WCS.Origin, plane_WCS.XAxis, plane_WCS.YAxis)

# transform frame to robot coordinate system
tcp_RCS = robot.to_local_coordinates(tcp_WCS)
tool0_RCS = robot.from_tcf_to_t0cf([tcp_RCS])[0]

print tcp_RCS
print tool0_RCS
plane_tool0_RCS = draw_frame(tool0_RCS)
plane_tcp_RCS = draw_frame(tcp_RCS)
# calculate solutions to frame
ur_params = ur_params[robot.name] # get the parameters according to the robot model
solutions = inverse_kinematics(tool0_RCS, ur_params)

if not len(solutions):
    joint_values = [0,0,0,0,0,0]
    configuration = Configuration.from_revolute_values(joint_values)
else:
    joint_values = solutions[idx]
    #print joint_values
    
    ### ***** HACK ***** ##### TODO: CHECK!!!
    for i, v in enumerate(joint_values):
        if v > math.pi:
            v -= 2*math.pi
        if v < -math.pi:
            v += 2*math.pi
        joint_values[i] = v
    ### ***** HACK ***** ##### TODO: CHECK!!!
    
    configuration = [Configuration.from_revolute_values(joint_values)]

print(configuration)
# ---------- end inverse ----------

# ----
list_7 = ValueList({"Zero": 0, "One": 1, "Two": 2, "Three": 3, "Four": 4, "Five": 5}, selected="Zero")
pln_7 = Plane(pln_4)

# ---- group: inverse kinematics
select_configuration_2 = Slider(0, range=0..7)
inverse_2 = PythonScript(robot=robot, group=info.main_group_name, plane_WCS=pln_7, idx=select_configuration_2)  # -> out, plane_tool0_RCS, plane_tcp_RCS, configuration; inputs plane_WCS: Plane, idx: Int32
# ---------- inverse_2: Python ----------
import Rhino.Geometry as rg
import math
from compas.geometry import Frame, Transformation, Rotation
from compas_fab.robots import Configuration
from ur_fabrication_control.kinematics.ur_kinematics import inverse_kinematics
from ur_fabrication_control.kinematics.ur_params import ur_params
from compas_ghpython import draw_frame

tcp_WCS = Frame(plane_WCS.Origin, plane_WCS.XAxis, plane_WCS.YAxis)

# transform frame to robot coordinate system
print tcp_WCS
print plane_WCS
tcp_RCS = robot.to_local_coordinates(tcp_WCS)
tool0_RCS = robot.from_tcf_to_t0cf([tcp_RCS])[0]
tool0_RCS_rot = Frame(tool0_RCS.point, tool0_RCS.zaxis, tool0_RCS.yaxis)
print tcp_RCS
print tool0_RCS
plane_tool0_RCS = draw_frame(tool0_RCS)
plane_tcp_RCS = draw_frame(tcp_RCS)
# calculate solutions to frame
ur_params = ur_params[robot.name] # get the parameters according to the robot model
print ur_params
solutions = inverse_kinematics(tool0_RCS, ur_params)
print solutions

if not len(solutions):
    joint_values = [0,0,0,0,0,0]
    configuration = Configuration.from_revolute_values(joint_values)
else:
    joint_values = solutions[idx]
    #print joint_values
    
    ### ***** HACK ***** ##### TODO: CHECK!!!
    for i, v in enumerate(joint_values):
        if v > math.pi:
            v -= 2*math.pi
        if v < -math.pi:
            v += 2*math.pi
        joint_values[i] = v
    ### ***** HACK ***** ##### TODO: CHECK!!!
    configuration = [Configuration.from_revolute_values(joint_values)]

print(configuration)
# ---------- end inverse_2 ----------

# ----
# 4.
list_8 = ValueList({"0 forward_kinematics": 0, "1 inverse_kinematics": 1, "2 inverse_kinematics": 2}, selected="0 forward_kinematics")
filter = StreamFilter(Gate=list_8, Stream0=forward_kinematics, Stream1=inverse_2.configuration, Stream2=inverse.configuration)

orient = OrientDirection(PointA=Point(0, 0, 0), DirectionA=Vector(0, 0, 1), PointB=Point(0, 0, 0), DirectionB=Vector(0, 0, 1))  # -> Geometry, Transform
vdisex = VectorDisplayEx(
    Point=Tree({0;0;0;0}: [Point(0, 0, 0.17), Point(-0.3372254511, -0.6818760647, 0.8976473325), Point(-0.3372254511, -0.6818760647, 0.8976473325), Point(-0.3372254511, -0.6818760647, 0.8976473325)], {0;0;0;1}: [Point(0, 0, 0.17)], {0;0;0;2}: [Point(0, 0, 0.17)], {0;0;0;3}: [Point(-0.3373714227, -0.6841185394, 1.240547333)], {0;0;0;4}: [Point(-0.3373714227, -0.6841185394, 1.240547333)], {0;0;0;5}: [Point(-0.3373714227, -0.6841185394, 1.240547333)]),
    Vector=Tree({0;0;0;0}: [Vector(0.1, 0, 0), Vector(0.08090169943, -0.05877852525, -1.49241286e-11), Vector(-0.05877852525, -0.08090169943, -2.483792175e-11), Vector(2.525490447e-12, 2.88664835e-11, -0.1)], {0;0;0;1}: [Vector(0, 0.1, 0)], {0;0;0;2}: [Vector(0, 0, 0.1)], {0;0;0;3}: [Vector(0.08090169943, -0.05877852525, -1.49241286e-11)], {0;0;0;4}: [Vector(-0.05877852525, -0.08090169943, -2.483792175e-11)], {0;0;0;5}: [Vector(2.525490447e-12, 2.88664835e-11, -0.1)]),
    Colour=Tree({0;0;0;0}: [RGB(255, 0, 0), RGB(255, 0, 0), RGB(0, 255, 0), RGB(0, 0, 255)], {0;0;0;1}: [RGB(0, 255, 0)], {0;0;0;2}: [RGB(0, 0, 255)], {0;0;0;3}: [RGB(255, 0, 0)], {0;0;0;4}: [RGB(0, 255, 0)], {0;0;0;5}: [RGB(0, 0, 255)]),
    Width=Tree({0;0}: [3], {0;0;0}: [3]))

bang_2 = Button()
unload_2 = PythonScript(bang=bang_2)
# ---------- unload_2: Python ----------
from compas_rhino.utilities.misc import get_tolerance
from compas_rhino.utilities.misc import unload_modules

unload_modules("compas")
unload_modules("compas_fab")
unload_modules("ur_fabrication_control")
unload_modules("mobile_additive_manufacturing")
unload_modules("am_information_model")
# ---------- end unload_2 ----------

pln_8 = Plane(Plane(origin=(-0.5193615461, -0.1322267064, 1.012570635), x=(1, 0, 0), y=(0, -1, 0)))
revise_task = Button()
undo_task = Button()

# ---- group: Only needs to be created once
overwrite = Button()
# 5.
create_2 = Button()
fabrication = GhPythonScript(create=create_2, overwrite=overwrite)  # -> out, fabrication
# ---------- fabrication: Python ----------
__author__ = "Gido"
__version__ = "2020.01.14"

from scriptcontext import sticky as st
from ur_fabrication_control.direct_control.fabrication_process import Fabrication

server_ip = st["server_address"]
server_port = st["server_port"]

fabrication_key = "fabrication"

if fabrication_key not in st:
    st[fabrication_key] = None

if overwrite and st[fabrication_key] != None:
    fabrication = st[fabrication_key]
    if hasattr(fabrication, 'task_thread') and hasattr(fabrication, 'listen_thread'):
        fabrication._join_threads()

if (create and st[fabrication_key] == None) or overwrite:
    fabrication = Fabrication()
    fabrication.set_feedback_server(server_ip, server_port)
    
    st[fabrication_key] = fabrication

fabrication = st[fabrication_key]
# ---------- end fabrication ----------

# ----
skip_task = Button()

# ----
# Continuous fabrication
ur_speed = Slider(0.05, range=0..1)
ext_speed = Slider(1600, range=0..4000)
ext_accel = Slider(4000, range=0..4000)
include_extruder = BooleanToggle(False)
Z_2 = UnitZ(Factor=Slider(0.12, range=0..1))
create_tasks = Button()
pln_9 = Plane(Plane(origin=(-0.3061465842, -0.7688289271, 0.8082900413), x=(1, 0, 0), y=(0, -1, 0)))
send_data = Button()
start_2 = Button()
stop_2 = Button()
move = Move(Geometry=pln_8, Motion=Z_2)  # -> Geometry, Transform
continuous_operation_multiple_layers = GhPythonScript(
    fabrication=fabrication.fabrication,
    am_model=am_model_2.am_model,
    am_safety_plane=move.Geometry,
    robot=create.robot,
    ur_speed=ur_speed,
    ext_speed=ext_speed,
    ext_maxspeed=ext_accel,
    create_tasks=create_tasks,
    send_extruder_data=send_data,
    include_extruder=include_extruder,
    start=start_2,
    stop=stop_2,
    skip_task=skip_task,
    undo_task=undo_task,
    revise_task=revise_task)  # -> out, msgs, states, tasks, exit_msgs, current_task, task_key_current, fabrication
# ---------- continuous_operation_multiple_layers: Python ----------
import time
from scriptcontext import sticky as st

import sys, os
am_hackathon_path = os.path.abspath(os.path.join(ghdoc.Path,"../../src"))
if am_hackathon_path not in sys.path:
    sys.path.append(am_hackathon_path)

from compas.geometry import Frame
from compas.geometry import Translation
from compas.geometry import Transformation
from compas.geometry import Vector
from compas_ghpython import update_component
from mobile_fabrication_control.extruder_control.extruderclient import ExtruderClient
from mobile_fabrication_control.extruder_control import URScript_Extrusion
from mobile_fabrication_control.extruder_control import set_extruder_data
from ur_fabrication_control.direct_control import URScript
from ur_fabrication_control.direct_control.mixins.airpick_mixins import AirpickMixins
from ur_fabrication_control.direct_control.fabrication_process import Fabrication

ur_ip = st["ur_ip"]
ur_port = st["ur_port"]
server_ip = st["server_address"]
server_port = st["server_port"]
ext_ip = st["ext_ip"]
ext_port = st["ext_port"]


def create_tasks_from_am_model(am_model):
    for key, layer in am_model.layers():
        exit_message = "Layer{}_completed".format(key)
        layer_urscript = get_layer_ur_script(layer, key, exit_message)
        fabrication.add_task(layer_urscript, exit_message)

def get_frames_in_RCS(frames):
    return [robot.to_local_coordinates(frame) for frame in frames]

def get_layer_ur_script(layer, layer_number, exit_message):
    ur_script = URScript_Extrusion(ur_ip=ur_ip, ur_port=ur_port, ext_ip=ext_ip, ext_port=ext_port)
    tool_angle_axis = list(robot.attached_tool.frame.point) + list(robot.attached_tool.frame.axis_angle_vector)
    
    ur_script.start()
    ur_script.set_tcp(tool_angle_axis)
    RCS_frames = get_frames_in_RCS([node.frame for key, node in layer.nodes()])
    first = False
    
    ur_script.socket_open(server_ip, server_port, "Feedbackserver") # BS: Opening socket at the beginning of the loop
    
    for key, node in layer.nodes():
        node_message = "[Nodal Information Relay]:L_" + str(layer_number) + "_N_" + str(key) # BS: Standardized message to send to AM Information Model (message should contain layer and nodal information and be easy to post-process)
        if key in [0,1] and node.is_constructed == False:
            ur_script.move_linear(robot.to_local_coordinates(node.frame), velocity=ur_speed, radius=node.radius)
            ur_script.socket_send_line_string(node_message, socket_name="Feedbackserver") # BS: Send the string "node_message" to the socket
        elif key == layer.number_of_nodes() and include_extruder and node.is_constructed == False:
            ur_script.move_process(robot.to_local_coordinates(node.frame), ur_speed, node.radius)
            node.extruder_state = 0 # BS: This is the key of the last node of the layer, therefore extruder_state must be zero. I think?
            ur_script.socket_send_line_string(node_message, socket_name="Feedbackserver") # BS: Send the string "node_message" to the socket
        elif node.is_constructed == False:
            ur_script.move_process(robot.to_local_coordinates(node.frame), ur_speed, node.radius)
            ur_script.socket_send_line_string(node_message, socket_name="Feedbackserver") # BS: Send the string "node_message" to the socket
    # Signify ready
    ur_script.socket_send_line_string(exit_message, socket_name="Feedbackserver")
    ur_script.socket_close(name="Feedbackserver")# BS: Closing socket at the end of the loop
    #Finalize script
    ur_script.end()
    ur_script.generate()
    return ur_script

def get_stop_ur_script(safety_plane):
    safety_frame_WCS = Frame(safety_plane.Origin, safety_plane.XAxis, safety_plane.YAxis)
    safety_frame_RCS = robot.to_local_coordinates(safety_frame_WCS)
    
    ur_script = URScript_Extrusion(ur_ip=ur_ip, ur_port=ur_port, ext_ip=ext_ip, ext_port=ext_port)
    tool_angle_axis = list(robot.attached_tool.frame.point) + list(robot.attached_tool.frame.axis_angle_vector)
    
    ur_script.start()
    ur_script.set_tcp(tool_angle_axis)
    if include_extruder:
        toggle_extrusion(ur_script, 0)
    ur_script.move_linear(safety_frame_RCS, velocity=ur_speed, radius=0)
    ur_script.end()
    ur_script.generate()
    return ur_script

def toggle_extrusion(ur_script, state):
    ur_script.open_socket_extruder()
    if state==1:
        ur_script.toggle_fan(state=state)
    ur_script.toggle_air(state=state)
    ur_script.set_extruder_data(state=state, max_speed=ext_maxspeed, speed=ext_speed)
    ur_script.close_socket_extruder()

# BS: Added new function for direct extruder control which listens to messages.
# BS: Function is simply a copy from the direct extruder control component
def direct_extruder_control(motor_state, max_speed, speed, wait_for_response):
    ec.connect()
    time.sleep(0.2)
    ec.send_motordata(motor_state, max_speed, speed, wait_for_response)
    time.sleep(0.2)
    ec.close()

if create_tasks:
    fabrication.current_task = 0
    fabrication.clear_tasks()
    fabrication.stop_task = get_stop_ur_script(am_safety_plane)
    create_tasks_from_am_model(am_model)

# BS: New button added, "revise task"
if revise_task:
    layer_exit_message = fabrication.tasks[fabrication.get_next_task()]["exit_message"]
    layer_key = int(layer_exit_message.split("_")[0][5:]) # BS: Assuming the convention of "Layer{}_completed".format(key) is followed
    fabrication.tasks[fabrication.get_next_task()]["task"] = get_layer_ur_script(am_model.layer(layer_key),layer_key, layer_exit_message)

if send_extruder_data:
    set_extruder_data(ur_ip, ur_port, ext_ip, ext_port, 0, ext_maxspeed, ext_speed)

if stop:
    fabrication.stop()

if start:
    fabrication.start()

if skip_task:
    skip_key = fabrication.get_next_task()
    fabrication.tasks[skip_key]["state"] = "completed"
    fabrication.current_task+=1

if undo_task:
    undo_key = fabrication.get_next_task()-1
    fabrication.tasks[undo_key]["state"] = "waiting"
    if fabrication.current_task != 0:
        fabrication.current_task-=1

try:
    fab = fabrication
except NameError:
    fabrication = None
else:
    task_dict = fabrication.tasks.values()
    if fabrication.tasks_available():
        if fabrication.current_task == None:
            task_key_current = fabrication.get_next_task()
        else:
            task_key_current = fabrication.current_task
        current_task = task_dict[task_key_current]["task"].script
    tasks = []
    states = []
    exit_msgs = []
    for task in task_dict:
        tasks.append(task["task"])
        states.append(task["state"])
        exit_msgs.append(task["exit_message"])
    msgs = fabrication.server.msgs.values()
    
    # BS: Updating the am_model by reacting to the appropriate server message(s)
    if len(msgs) != 0:
        if msgs[-1].split(":")[0] == "[Nodal Information Relay]": # BS: Grabbing last entry in the last - very hacky. Don't like it. Other options? len(msgs) parameter compared to a continuously updated variable?
            
            info = msgs[-1].split(":")[1].split("_")
            layer = int(info[1])
            node = int(info[-1])
            
            motor_state = am_model.layer(layer).node(node).extruder_state
            speed = am_model.layer(layer).node(node).extruder_speed
            direct_extruder_control(motor_state, 4000, speed, False)
            
            am_model.layer(layer).node(node).is_constructed = True
            am_model.layer(layer).node(node).extruder_state = 0 # BS: If it's been constructed, state should now be 0
            
        elif msgs[-1].split("_")[0][:5] == "Layer":
            layer = int(msgs[-1].split("_")[0][5:])
            am_model.layer(layer).is_constructed = True
# ---------- end continuous_operation_multiple_layers ----------
timer = Timer(Interval=1000, TimerInterval=1000, Target=continuous_operation_multiple_layers)
states = Panel(continuous_operation_multiple_layers.states)
current_task = Panel(continuous_operation_multiple_layers.current_task)
server_messages = Panel(continuous_operation_multiple_layers.msgs)
tasks = Panel(continuous_operation_multiple_layers.tasks)
exit_message = Panel(continuous_operation_multiple_layers.exit_msgs)

# ----
# Stop
stop_3 = Button()
stop_4 = PythonScript(stop=stop_3)
# ---------- stop_4: Python ----------
from scriptcontext import sticky as st
from ur_fabrication_control.direct_control.common import send_stop

ur_ip = st["ur_ip"]
ur_port = st["ur_port"]

if stop:
    send_stop(ur_ip, ur_port)
# ---------- end stop_4 ----------

idx_2 = Panel(continuous_operation_multiple_layers.task_key_current)
pln_10 = Plane(Plane(origin=(-0.1900949049, -0.9105972636, 0.811), x=(0.9647395495, -0.2630295254, 0.009647297695), y=(-0.2626507223, -0.9644363868, -0.02961509418)))

# ----
# Set Digital Out
number = Slider(7, range=0..10)
value = BooleanToggle(True)
digital_out = PythonScript(number=number, value=value)  # -> urscript; inputs number: Int32, value: Boolean
# ---------- digital_out: Python ----------
from ur_fabrication_control.direct_control import URScript

urscript = URScript()
urscript.start()
urscript.add_line("\tset_digital_out({}, {})".format(number, value))
urscript.end()
urscript = urscript.generate()

print(urscript)
# ---------- end digital_out ----------
send = Button()
send_2 = GhPythonScript(urscript=digital_out, send=send)  # -> out; inputs send: Boolean
# ---------- send_2: Python ----------
from scriptcontext import sticky as st
from ur_fabrication_control.direct_control import send_script

ur_ip = st["ur_ip"]
ur_port = st["ur_port"]

if send:
    send_script(urscript, ur_ip, ur_port)
# ---------- end send_2 ----------

toggle = BooleanToggle(True)

# ----
# Get Pose Cartesian
get = Button()
pose = PythonScript(get=get)  # -> pose_cartesian, frame_WCS, plane_WCS
# ---------- pose: Python ----------
from scriptcontext import sticky as st
from ur_fabrication_control.direct_control.common import get_current_pose_cartesian
from compas.geometry import Frame
from compas_ghpython import draw_frame

robot = st["robot"]

server_address = st["server_address"]
server_port = st["server_port"]
ur_port = st["ur_port"]
ur_ip = st["ur_ip"]

# retrieve the current tool frame in axis angle format
if robot.attached_tool:
    tool_angle_axis = list(robot.attached_tool.frame.point) + list(robot.attached_tool.frame.axis_angle_vector)
else:
    tool0_frame = Frame([0, 0, 0], [1, 0, 0], [0, 1, 0])
    tool_angle_axis = list(tool0_frame.point) + list(tool0_frame.axis_angle_vector)

print(tool_angle_axis)

guid = str(ghenv.Component.InstanceGuid)
pose_cartesian_key = "pose_cartesian" + guid


if get:
    st[pose_cartesian_key] = get_current_pose_cartesian(tool_angle_axis, server_address, server_port, ur_ip, ur_port, send=True)

if pose_cartesian_key not in st:
    pose_cartesian = []
else:
    pose_cartesian = st[pose_cartesian_key]

print(pose_cartesian)

# get frame and plane of the current pose cartesian in world coordinates for visualization
if pose_cartesian:
    frame_RCS = Frame.from_axis_angle_vector(axis_angle_vector=pose_cartesian[3:], point=pose_cartesian[:3])
    frame_WCS = robot.to_world_coordinates(frame_RCS)
    plane_WCS  = draw_frame(frame_WCS)
    print frame_RCS
    print frame_WCS
# ---------- end pose ----------
draw_2 = GhPythonScript(frames=pose.frame_WCS, scale=Slider(0.1, range=0..1))  # -> P, V, W; inputs frames: list
# ---------- draw_2: Python ----------
from System.Drawing import Color
from compas_ghpython.utilities import draw_frame

red = Color.FromArgb(255, 0, 0)
green = Color.FromArgb(0, 255, 0)
blue = Color.FromArgb(0, 0, 255)

P = []
V = []
C = []

scale = float(scale)

for frame in frames:
    if not frame:
        continue
    plane = draw_frame(frame)
    P += [plane.Origin] * 3
    V.append(plane.XAxis * scale)
    V.append(plane.YAxis * scale)
    V.append(plane.ZAxis * scale)
    C += [red, green, blue]

W = 3
# ---------- end draw_2 ----------
vdisex_2 = VectorDisplayEx(Point=draw_2.P, Vector=draw_2.V, Colour=RGB(0, 0, 0), Width=draw_2.W)
panel_7 = Panel(pose.pose_cartesian)

# ----
# Move Cartesian
add = Button()
crv_6 = Curve(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)
list_9 = ValueList({"send all positions": 0, "send only one position": 1, "from inverse": 2}, selected="from inverse")
clear = Button()
idx_3 = Slider(0, range=0..100)
hframes = HorizontalFrames(Curve=crv_6, Count=10)  # -> Frames, Parameters
rec_car = PythonScript(msg=pose.plane_WCS, rec=add, clear=clear)  # -> rec
# ---------- rec_car: Python ----------
from scriptcontext import sticky as st

guid = str(ghenv.Component.InstanceGuid)
recorded_key =  "recorded_" + guid
just_cleared_key = "just_cleared_" + guid


if recorded_key not in st:
    st[recorded_key] = []

if just_cleared_key not in st:
    st[just_cleared_key] = False

if clear:
    st[recorded_key] = []
    st[just_cleared_key] = True
else:
    if len(msg):
        if msg != [None] and not st[just_cleared_key] and rec:
            st[recorded_key].append(msg)
    st[just_cleared_key] = False
        


rec = st[recorded_key]

print rec
# ---------- end rec_car ----------
item = ListItem(List=hframes.Frames, Index=idx_3, Wrap=True)
filter_2 = StreamFilter(Gate=list_9, Stream0=hframes.Frames, Stream1=item, Stream2=rec_car)
radius_2 = Slider(0.5, range=0..0.5)
movel = PythonScript(planes_WCS=pln_5, velocity=Slider(0.1, range=0..0.5), radius=radius_2)  # -> urscript; inputs planes_WCS: list
# ---------- movel: Python ----------
import Rhino.Geometry as rg
from compas.geometry import Frame
from compas.geometry import Transformation, Rotation
from compas_ghpython import draw_frame
from compas_fab.robots import robot
from ur_fabrication_control import direct_control 
import math

from scriptcontext import sticky as st
from ur_fabrication_control.direct_control import URScript

robot = st["robot"]

# retrieve the current tool frame in axis angle format
if robot.attached_tool:
    tool_angle_axis = list(robot.attached_tool.frame.point) + list(robot.attached_tool.frame.axis_angle_vector)
else:
    tool0_frame = Frame([0, 0, 0], [1, 0, 0], [0, 1, 0])
    tool_angle_axis = list(tool0_frame.point) + list(tool0_frame.axis_angle_vector)

print(tool_angle_axis)

frames_RCS = []
for plane_WCS in planes_WCS:
    frame_WCS = Frame(plane_WCS.Origin, plane_WCS.XAxis, plane_WCS.YAxis)
    frame_RCS = robot.to_local_coordinates(frame_WCS)
    frames_RCS.append(frame_RCS)

urscript = URScript()
urscript.start()
urscript.set_tcp(tool_angle_axis)
urscript.moves_linear(frames_RCS, velocity, radius)
urscript.end()

urscript = urscript.generate()

print(urscript)
# ---------- end movel ----------
send_3 = Button()
send_4 = GhPythonScript(urscript=movel, send=send_3)  # -> out; inputs send: Boolean; same code as send_2

# ----
# Move Circular
clear_2 = Button()
list_10 = ValueList({"send all positions": 0, "send only one position": 1, "from inverse": 2}, selected="from inverse")
add_2 = Button()
idx_4 = Slider(0, range=0..100)
crv_7 = Curve(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)
hframes_2 = HorizontalFrames(Curve=crv_7, Count=10)  # -> Frames, Parameters
rec_viacar = PythonScript(msg=pose.plane_WCS, rec=add_2, clear=clear_2)  # -> rec; same code as rec_car
item_2 = ListItem(List=hframes_2.Frames, Index=idx_4, Wrap=True)
filter_3 = StreamFilter(Gate=list_10, Stream0=hframes_2.Frames, Stream1=item_2, Stream2=rec_car)
filter_4 = StreamFilter(Gate=list_10, Stream0=hframes_2.Frames, Stream1=item_2, Stream2=rec_viacar)
radius_3 = Slider(0.5, range=0..0.5)
movec = PythonScript(planes_WCS=filter_3, planes_via_WCS=filter_4, velocity=Slider(0.075, range=0..0.5), radius=radius_3)  # -> urscript; inputs planes_WCS: list, planes_via_WCS: list
# ---------- movec: Python ----------
import Rhino.Geometry as rg
from compas.geometry import Frame
from compas.geometry import Transformation, Rotation
from compas_ghpython import draw_frame
from compas_fab.robots import robot
from ur_fabrication_control import direct_control 
import math

from scriptcontext import sticky as st
from ur_fabrication_control.direct_control import URScript

robot = st["robot"]

# retrieve the current tool frame in axis angle format
if robot.attached_tool:
    tool_angle_axis = list(robot.attached_tool.frame.point) + list(robot.attached_tool.frame.axis_angle_vector)
else:
    tool0_frame = Frame([0, 0, 0], [1, 0, 0], [0, 1, 0])
    tool_angle_axis = list(tool0_frame.point) + list(tool0_frame.axis_angle_vector)

frames_RCS = []
for plane_WCS in planes_WCS:
    frame_WCS = Frame(plane_WCS.Origin, plane_WCS.XAxis, plane_WCS.YAxis)
    frame_RCS = robot.to_local_coordinates(frame_WCS)
    frames_RCS.append(frame_RCS)

frames_via_RCS = []
for plane_WCS in planes_via_WCS:
    frame_WCS = Frame(plane_WCS.Origin, plane_WCS.XAxis, plane_WCS.YAxis)
    frame_RCS = robot.to_local_coordinates(frame_WCS)
    frames_via_RCS.append(frame_RCS)

urscript = URScript()
urscript.start()
urscript.moves_circular(frames_via_RCS, frames_RCS, velocity, radius)
urscript.end()

urscript = urscript.generate()

print(urscript)
# ---------- end movec ----------
send_5 = Button()
send_6 = GhPythonScript(urscript=movec, send=send_5)  # -> out; inputs send: Boolean; same code as send_2

# ----
# Move Process
list_11 = ValueList({"send all positions": 0, "send only one position": 1, "from inverse": 2}, selected="from inverse")
idx_5 = Slider(0, range=0..100)
crv_8 = Curve(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)
hframes_3 = HorizontalFrames(Curve=crv_8, Count=10)  # -> Frames, Parameters
item_3 = ListItem(List=hframes_3.Frames, Index=idx_5, Wrap=True)
filter_5 = StreamFilter(Gate=list_11, Stream0=hframes_3.Frames, Stream1=item_3, Stream2=rec_car)
radius_4 = Slider(0.5, range=0..0.5)
movep = PythonScript(planes_WCS=filter_5, velocity=Slider(0.075, range=0..0.5), radius=radius_4)  # -> urscript; inputs planes_WCS: list
# ---------- movep: Python ----------
import Rhino.Geometry as rg
from compas.geometry import Frame
from compas.geometry import Transformation, Rotation
from compas_ghpython import draw_frame
from compas_fab.robots import robot
from ur_fabrication_control import direct_control 
import math

from scriptcontext import sticky as st
from ur_fabrication_control.direct_control import URScript

robot = st["robot"]

# retrieve the current tool frame in axis angle format
if robot.attached_tool:
    tool_angle_axis = list(robot.attached_tool.frame.point) + list(robot.attached_tool.frame.axis_angle_vector)
else:
    tool0_frame = Frame([0, 0, 0], [1, 0, 0], [0, 1, 0])
    tool_angle_axis = list(tool0_frame.point) + list(tool0_frame.axis_angle_vector)

frames_RCS = []
for plane_WCS in planes_WCS:
    frame_WCS = Frame(plane_WCS.Origin, plane_WCS.XAxis, plane_WCS.YAxis)
    frame_RCS = robot.to_local_coordinates(frame_WCS)
    frames_RCS.append(frame_RCS)

urscript = URScript()
urscript.start()
urscript.moves_process(frames_RCS, velocity, radius)
urscript.end()

urscript = urscript.generate()

print(urscript)
# ---------- end movep ----------
send_7 = Button()
send_8 = GhPythonScript(urscript=movep, send=send_7)  # -> out; inputs send: Boolean; same code as send_2

# ----
# Get Pose Joint
get_2 = Button()
pose_2 = PythonScript(get=get_2)  # -> configuration, pose_joints
# ---------- pose_2: Python ----------
from scriptcontext import sticky as st
from ur_fabrication_control.direct_control.common import get_current_pose_joints
from compas_fab.robots import Configuration


robot = st["robot"]

server_address = st["server_address"]
server_port = st["server_port"]
ur_port = st["ur_port"]
ur_ip = st["ur_ip"]


guid = str(ghenv.Component.InstanceGuid)
pose_joints_key = "pose_joints" + guid


# send script to the robot to receive the current joint configuration
if get:
    st[pose_joints_key] = get_current_pose_joints(server_address, server_port, ur_ip, ur_port, send=True)

if pose_joints_key not in st:
    configuration = Configuration.from_revolute_values([0,0,0,0,0,0])
else:
    configuration = Configuration.from_revolute_values(st[pose_joints_key])

pose_joints = configuration.values
# ---------- end pose_2 ----------
panel_8 = Panel(pose_2.pose_joints)

panel_9 = Panel(pose_2.configuration)

# ----
# Stop Extruder
stop_5 = Button()
stop_6 = PythonScript(stop=stop_5)
# ---------- stop_6: Python ----------
import time
from scriptcontext import sticky as st
from mobile_fabrication_control.extruder_control.extruderclient import ExtruderClient

ext_ip = st["ext_ip"]
ext_port = st["ext_port"]

ec = ExtruderClient(ext_ip, ext_port)
wait_for_response = False

if stop:
    ec.connect()
    time.sleep(0.2)
    ec.send_stop(wait_for_response)
    time.sleep(0.2)
    ec.close()
# ---------- end stop_6 ----------

# ----
# Set Extruder data
speed = Slider(8000, range=0..51200)
# Direct extruder control
max_speed = Slider(17000, range=0..51200)
send_9 = Button()
value_2 = BooleanToggle(True)
extruder_data = PythonScript(motor_state=value_2, max_speed=max_speed, speed=speed, send=send_9)  # -> urscript; inputs motor_state: Boolean
# ---------- extruder_data: Python ----------
import time
from scriptcontext import sticky as st
from mobile_fabrication_control.extruder_control.extruderclient import ExtruderClient

ext_ip = st["ext_ip"]
ext_port = st["ext_port"]

ec = ExtruderClient(ext_ip, ext_port)
wait_for_response = False

if send:
    ec.connect()
    time.sleep(0.2)
    ec.send_motordata(motor_state, max_speed, speed, wait_for_response)
    time.sleep(0.2)
    ec.close()
# ---------- end extruder_data ----------

# ----
# Set Extruder data
acceleration = Slider(200, range=0..1000)
max_speed_2 = Slider(450, range=0..1000)
speed_2 = Slider(300, range=0..1000)
# Extruder control through UR
number_2 = Slider(0, range=0..10)
value_3 = BooleanToggle(True)
send_10 = Button()
extruder_data_2 = PythonScript(motor_id=number_2, motor_state=value_3, max_speed=max_speed_2, speed=speed_2, acceleration=acceleration, send=send_10)  # -> urscript; inputs motor_id: Int32, motor_state: Boolean
# ---------- extruder_data_2: Python ----------
from scriptcontext import sticky as st
from mobile_additive_manufacturing.control.urscript_extrusion import set_extruder_data

ur_ip = st["ur_ip"]
ur_port = st["ur_port"]
ext_ip = st["ext_ip"]
ext_port = st["ext_port"]

if send:
    set_extruder_data(ur_ip, ur_port, ext_ip, ext_port, motor_id, motor_state, max_speed, speed, acceleration)
# ---------- end extruder_data_2 ----------

# ----
# Get Extruder Info
# Only visible on UR Teach Pad
send_11 = Button()
get_info = PythonScript(send=send_11)  # -> info
# ---------- get_info: Python ----------
from scriptcontext import sticky as st
from mobile_additive_manufacturing.control.urscript_extrusion import get_extruder_info

ur_ip = st["ur_ip"]
ur_port = st["ur_port"]
ext_ip = st["ext_ip"]
ext_port = st["ext_port"]

if send:
    get_extruder_info(ur_ip, ur_port, ext_ip, ext_port)
# ---------- end get_info ----------

# ----
# Toggle Extruder
value_4 = BooleanToggle(True)
send_12 = Button()
extruder_state = PythonScript(state=value_4, send=send_12)  # -> urscript; inputs state: Boolean
# ---------- extruder_state: Python ----------
import time
from scriptcontext import sticky as st
from mobile_fabrication_control.extruder_control.extruderclient import ExtruderClient

ext_ip = st["ext_ip"]
ext_port = st["ext_port"]

ec = ExtruderClient(ext_ip, ext_port)
wait_for_response = False

if send:
    ec.connect()
    time.sleep(0.2)
    ec.send_motorstate(int(state), wait_for_response)
    time.sleep(0.2)
    ec.close()
# ---------- end extruder_state ----------

pi = Pi(Factor=0.25)
xy = XYPlane(Origin=Point(0, 0, 0))

# ----
# Toggle Extruder
value_5 = BooleanToggle(True)
send_13 = Button()
extruder_state_2 = PythonScript(state=value_5, send=send_13)  # -> urscript; inputs state: Boolean
# ---------- extruder_state_2: Python ----------
from scriptcontext import sticky as st
from mobile_additive_manufacturing.control.urscript_extrusion import toggle_extruder

ur_ip = st["ur_ip"]
ur_port = st["ur_port"]
ext_ip = st["ext_ip"]
ext_port = st["ext_port"]

if send:
    toggle_extruder(ur_ip, ur_port, ext_ip, ext_port, state)
# ---------- end extruder_state_2 ----------

rotate = Rotate(Geometry=xy, Angle=pi, Plane=PlaneXY(0, 0, 0))  # -> Geometry, Transform
orient_2 = Orient(Geometry=pose.plane_WCS, Source=PlaneXY(0, 0, 0), Target=rotate.Geometry)  # -> Geometry, Transform
pln_11 = Plane(pose.plane_WCS)

# ----
# Calculate Basis - 3-Point Method
# Measure basis:
# 1. Clear the recorded poses
# 2. Move robot to origin and press "get pose"
# 3. Move robot to point in positive x-axis and press "get pose"
# 4. Move robot to an other point in your basis and press "get pose"
# (The further away these positions are, the better)
# 
# 5. Alternatively change the order in the component calc base
# 6. Copy output into base component (TODO: check if it has to be inverted)
list_12 = ValueList({"o, pos.x-axis, xy pl": 0, "o, pos.y-axis, xy pl": 1}, selected="o, pos.x-axis, xy pl")
clear_3 = Button()
rec = PythonScript(msg=pose.pose_cartesian, rec=get, clear=clear_3)  # -> rec; inputs msg: list; same code as rec_car
calc_base = PythonScript(poses=rec, input_type=list_12)  # -> out, base_plane; inputs poses: list
# ---------- calc_base: Python ----------
import Rhino.Geometry as rg
import math


if len(poses) > 2:
    
    O = poses[0]
    P1 = poses[1]
    P2 = poses[2]
    
    if input_type == 0:
        # origin, pt on positive x-axis, pt in xy plane
        origin = rg.Point3d(O[0], O[1], O[2])
        pt_on_xaxis = rg.Point3d(P1[0], P1[1], P1[2])
        pt_in_xyplane = rg.Point3d(P2[0], P2[1], P2[2])
        
        xaxis = pt_on_xaxis - origin
        xaxis.Unitize()
        
        v = pt_in_xyplane - origin
        zaxis = rg.Vector3d.CrossProduct(v, xaxis)
        zaxis.Unitize()
        
        # zaxis must look up!
        if math.acos(rg.Vector3d.ZAxis * zaxis) > math.acos(rg.Vector3d.ZAxis * -zaxis):
            zaxis = -zaxis
        
        yaxis = rg.Vector3d.CrossProduct(zaxis, xaxis)
    
    elif input_type == 1:
        # origin, pt on positive y-axis, pt in xy plane
        origin = rg.Point3d(O[0], O[1], O[2])
        pt_on_yaxis = rg.Point3d(P1[0], P1[1], P1[2])
        pt_in_xyplane = rg.Point3d(P2[0], P2[1], P2[2])
        
        yaxis = pt_on_yaxis - origin
        yaxis.Unitize()
        
        v = pt_in_xyplane - origin
        zaxis = rg.Vector3d.CrossProduct(v, yaxis)
        zaxis.Unitize()
        
        # zaxis must look up!
        if math.acos(rg.Vector3d.ZAxis * zaxis) > math.acos(rg.Vector3d.ZAxis * -zaxis):
            zaxis = -zaxis
        
        xaxis = rg.Vector3d.CrossProduct(yaxis, zaxis)
        
        
    print "Copy the following into base component:"
    print " "
    print "origin = [%.2f, %.2f, %.2f]" % tuple(list(origin))
    print "xaxis = [%.5f, %.5f, %.5f]" % tuple(list(xaxis))
    print "yaxis = [%.5f, %.5f, %.5f]" % tuple(list(yaxis))
    

#print rg.Vector3d.CrossProduct(rg.Vector3d.YAxis, rg.Vector3d.ZAxis)
#print rg.Vector3d.CrossProduct(rg.Vector3d.ZAxis, rg.Vector3d.XAxis)

    base_plane = rg.Plane(origin, xaxis, xaxis)
# ---------- end calc_base ----------
panel_10 = Panel(rec)
panel_11 = Panel(calc_base.out)

# ----
# Direct UR Control
config = GhPythonScript()  # -> out, joint_configs
# ---------- config: Python ----------
from compas_fab.robots import Configuration

values=[-0.737876, -1.64531, 1.740348, -0.367801, -0.37385, -0.110741]
joint_configs = [Configuration.from_revolute_values(values)]
# ---------- end config ----------
pln_12 = Plane(calc_base.base_plane)

# ----
# Move Joints
clear_4 = Button()
add_3 = Button()
idx_6 = Slider(0, range=0..100)
list_13 = ValueList({"send all positions": 0, "send only one position": 1, "from inverse": 2}, selected="from inverse")
rec_joints = PythonScript(msg=pose_2.configuration, rec=add_3, clear=clear_4)  # -> rec
# ---------- rec_joints: Python ----------
from scriptcontext import sticky as st

guid = str(ghenv.Component.InstanceGuid)
recorded_key =  "recorded_" + guid
just_cleared_key = "just_cleared_" + guid


if recorded_key not in st:
    st[recorded_key] = []

if just_cleared_key not in st:
    st[just_cleared_key] = False

if clear:
    st[recorded_key] = []
    st[just_cleared_key] = True
else:
    if msg != [None] and not st[just_cleared_key] and rec:
        st[recorded_key].append(msg)
    st[just_cleared_key] = False
        


rec = st[recorded_key]

print rec
# ---------- end rec_joints ----------
item_4 = ListItem(List=config.joint_configs, Index=idx_6, Wrap=True)
filter_6 = StreamFilter(Gate=list_13, Stream0=config.joint_configs, Stream1=item_4, Stream2=rec_joints)
movej = PythonScript(joint_configurations=forward_kinematics, velocity=Slider(0.1, range=0..0.5))  # -> urscript, values; inputs joint_configurations: list
# ---------- movej: Python ----------
from ur_fabrication_control.direct_control import URScript
import math


"""
for c in joint_configurations:
    for i,v in enumerate(c.values):
        #print v
        if v>math.pi:
            v-=2*math.pi
        if v<-math.pi:
            v+=2*math.pi
        c.values[i]=v
print joint_configurations
values = joint_configurations[0].values
print([math.degrees(v) for v in values])
"""

#joint_config = ["movej({}, v={})".format(c.values, velocity/10) for c in joint_configurations]

urscript = URScript()
urscript.start()
for jc in joint_configurations:
    urscript.move_joint(jc, velocity)
urscript.end()

urscript = urscript.generate()

print(urscript)
# ---------- end movej ----------
send_14 = Button()
send_15 = GhPythonScript(urscript=movej.urscript, send=send_14)  # -> out; inputs send: Boolean; same code as send_2

# ----
# Calculate Basis - Point fitting method via RPC
toggle_2 = BooleanToggle(False)
plane_init_guess = Plane(Plane(origin=(0, 0, 0), x=(0, -1, 0), y=(1, 0, 0)))
pt_2 = Point([<point referenced from the Rhino model> x3])
calc_base_2 = PythonScript(poses=rec, pts_cad=pt_2, base_plane_init_guess=plane_init_guess, calc=toggle_2)  # -> out, pts_mtip_init_guess, pts_mtip_fit, base_plane_fit; inputs poses: list, pts_cad: list of Point3d, base_plane_init_guess: Plane
# ---------- calc_base_2: Python ----------
import ghpythonlib.components as ghcomp
import Rhino.Geometry as rg
from scriptcontext import sticky as st
from compas.geometry import Frame
import math as m
import sys
from compas.rpc import Proxy # for calling the numpy function in CPython


if len(poses):
    
    # get points from poses
    pts_mtip = [rg.Point3d(p[0], p[1], p[2]) for p in poses]
    
    T_W_R_init_guess = rg.Transform.PlaneToPlane(rg.Plane.WorldXY, base_plane_init_guess)
    pts_mtip_init_guess = [ghcomp.Transform(pt, T_W_R_init_guess) for pt in pts_mtip]
    
    # format Rhino transformation
    T_W_R_init_guess_flattened = [float(f) for f in T_W_R_init_guess.ToFloatArray(True)]
    T_W_R_init_guess_list = [T_W_R_init_guess_flattened[i:(i + 4)] for i in range(0, len(T_W_R_init_guess_flattened), 4)]  

    # format ptsA and ptsB
    dataB = [list(pt) for pt in pts_cad]
    dataA = [list(pt) for pt in pts_mtip]
    
    # call the function
    max_iterations = 100
    
    if calc:
        icp_func = Proxy('ur_fabrication_control.optimisation.icp', python = 'C://Users//kathrind//anaconda3//envs//ur_fab//python.exe')
        
        print icp_func._python

        transformation, distances = icp_func.icp(dataA, dataB, init_guess=T_W_R_init_guess_list, max_iterations=max_iterations, tolerance=0.000001)
        
        print "distances", distances
        
        # format result
        T = rg.Transform.Identity
        for i in range(4):
            for j in range(4):
                code = "T.M%i%i = %f" % (i, j, transformation[i][j])
                print code
                exec(code)
        #print T
        
        # now transform the points with the transformation calculated
        pts_mtip_fit = [ghcomp.Transform(pt, T) for pt in pts_mtip]
        base_plane_fit = ghcomp.Transform(rg.Plane.WorldXY, T)
        
        
        #f = Frame(base_plane_fit)
        #print f.get_pose_quaternion()
        
        # correct the zvalue
        #base_plane_fit = ghcomp.Transform(base_plane_fit, rg.Transform.Translation(0,0,-3))
# ---------- end calc_base_2 ----------
pt_3 = Point(calc_base_2.pts_mtip_init_guess)
pt_4 = Point(calc_base_2.pts_mtip_fit)
pln_13 = Plane(calc_base_2.base_plane_fit)

# ----
# Toggle Extruder and Air
max_speed_3 = Slider(17000, range=0..51200)
speed_3 = Slider(15000, range=0..51200)
value_6 = BooleanToggle(False)
send_16 = Button()
list_14 = ValueList({"8"}, selected="8")
extruder_data_3 = PythonScript(state=value_6, max_speed=max_speed_3, speed=speed_3, pin=list_14, send=send_16)  # -> urscript; inputs state: Boolean
# ---------- extruder_data_3: Python ----------
import time
from scriptcontext import sticky as st
from mobile_fabrication_control.extruder_control.extruderclient import ExtruderClient

ext_ip = st["ext_ip"]
ext_port = st["ext_port"]

ec = ExtruderClient(ext_ip, ext_port)
wait_for_response = False

if send:
    ec.connect()
    time.sleep(0.2)
    ec.send_motordata(int(state), max_speed, speed, wait_for_response)
    ec.send_set_do(pin, int(state), wait_for_response)
    time.sleep(0.2)
    ec.close()
# ---------- end extruder_data_3 ----------

# ----
# Stop Extruder
stop_7 = Button()
stop_8 = PythonScript(stop=stop_7)
# ---------- stop_8: Python ----------
from scriptcontext import sticky as st
from mobile_additive_manufacturing.control.urscript_extrusion import stop_extruder

ur_ip = st["ur_ip"]
ur_port = st["ur_port"]
ext_ip = st["ext_ip"]
ext_port = st["ext_port"]

if stop:
    stop_extruder(ur_ip, ur_port, ext_ip, ext_port)
# ---------- end stop_8 ----------

# ----
# Toggle air
value_7 = BooleanToggle(True)
send_17 = Button()
list_15 = ValueList({"8"}, selected="8")
digital_out_2 = PythonScript(pin=list_15, state=value_7, send=send_17)  # -> urscript; inputs pin: Int32, state: Boolean
# ---------- digital_out_2: Python ----------
import time
from scriptcontext import sticky as st
from mobile_fabrication_control.extruder_control.extruderclient import ExtruderClient

ext_ip = st["ext_ip"]
ext_port = st["ext_port"]

ec = ExtruderClient(ext_ip, ext_port)
wait_for_response = False

if send:
    ec.connect()
    time.sleep(0.2)
    ec.send_set_do(pin, int(state), wait_for_response)
    time.sleep(0.2)
    ec.close()
# ---------- end digital_out_2 ----------

list_16 = ValueList({"30", "32", "34"}, selected="30")

# ----
# Set Extruder Digital Out
value_8 = BooleanToggle(True)
send_18 = Button()
digital_out_3 = PythonScript(pin=list_16, state=value_8, send=send_18)  # -> urscript; inputs pin: Int32, state: Boolean
# ---------- digital_out_3: Python ----------
from scriptcontext import sticky as st
from mobile_additive_manufacturing.control.urscript_extrusion import set_extruder_digital_out

ur_ip = st["ur_ip"]
ur_port = st["ur_port"]
ext_ip = st["ext_ip"]
ext_port = st["ext_port"]

if send:
    set_extruder_digital_out(ur_ip, ur_port, ext_ip, ext_port, pin, state)
# ---------- end digital_out_3 ----------

list_17 = ValueList({"30", "32", "34"}, selected="34")

# ----
# Toggle fan
value_9 = BooleanToggle(True)
send_19 = Button()
digital_out_4 = PythonScript(pin=list_17, state=value_9, send=send_19)  # -> urscript; inputs pin: Int32, state: Boolean
# ---------- digital_out_4: Python ----------
from scriptcontext import sticky as st
from mobile_additive_manufacturing.control.urscript_extrusion import toggle_fan

ur_ip = st["ur_ip"]
ur_port = st["ur_port"]
ext_ip = st["ext_ip"]
ext_port = st["ext_port"]

if send:
    toggle_fan(ur_ip, ur_port, ext_ip, ext_port, pin, state)
# ---------- end digital_out_4 ----------

list_18 = ValueList({"30", "32", "34"}, selected="32")

# ----
# Toggle air
value_10 = BooleanToggle(True)
send_20 = Button()
digital_out_5 = PythonScript(pin=list_18, state=value_10, send=send_20)  # -> urscript; inputs pin: Int32, state: Boolean
# ---------- digital_out_5: Python ----------
from scriptcontext import sticky as st
from mobile_additive_manufacturing.control.urscript_extrusion import toggle_air

ur_ip = st["ur_ip"]
ur_port = st["ur_port"]
ext_ip = st["ext_ip"]
ext_port = st["ext_port"]

if send:
    toggle_air(ur_ip, ur_port, ext_ip, ext_port, pin, state)
# ---------- end digital_out_5 ----------

# ---- group: Getting perpendicular vectors to curve at six "base points"
crv_9 = Curve(<curve referenced from the Rhino model>)
cp = ControlPoints(Curve=crv_9)  # -> Points, Weights, Knots
equals = Equality(FirstNumber=cp.Weights, SecondNumber=1)  # -> Equality, Inequality
cull = CullPattern(List=cp.Points, CullPattern=equals.Equality)
pt_5 = Point(cull)
panel_12 = Panel("""0
0
1""")
cull_2 = CullPattern(List=pt_5, CullPattern=panel_12)
crv_cp = CurveClosestPoint(Point=cull_2, Curve=crv_9)  # -> Point, Parameter, Distance
pframe = PerpFrame(Curve=crv_9, Parameter=crv_cp.Parameter)
deplane = DeconstructPlane(Plane=pframe)  # -> Origin, XAxis, YAxis, ZAxis

# ---- group: Translating these "base points" at a distance "L"
L = Slider(0.9, range=0..2)
multiplication_2 = Multiplication(A=deplane.XAxis, B=L)
pt_6 = Point(cull_2)
move_2 = Move(Geometry=pt_6, Motion=expr("-x", multiplication_2))  # -> Geometry, Transform
move_3 = Move(Geometry=pframe, Motion=expr("-x", multiplication_2))  # -> Geometry, Transform
points = PointList(Points=move_2.Geometry, Size=0.05)

# ----
# Visualisation
show_end_effector_frame = BooleanToggle(True)
show_base_frame = BooleanToggle(True)
show_collision = BooleanToggle(False)
show_frames = BooleanToggle(False)
show_visual = BooleanToggle(True)
show_acm = BooleanToggle(False)
visualize = PythonScript(
    robot=robot,
    tool=python.tool,
    group=info.main_group_name,
    configuration=filter,
    redraw=py_5,
    show_visual=show_visual,
    show_collision=show_collision,
    show_end_effector_frame=show_end_effector_frame,
    show_frames=show_frames,
    show_base_frame=show_base_frame,
    show_acm=show_acm,
    station=list_7,
    station_pts=move_2.Geometry)  # -> out, robot, visual, collision, attached_meshes, frames, ee_frame, tool0_frame, base_frame, base_pt; inputs redraw: list, attached_collision_meshes: list, station_pts: list
# ---------- visualize: Python ----------
import rhinoscriptsyntax as rs
import Rhino.Geometry
from compas.geometry import Vector
from compas.geometry import Point
from compas.geometry import Transformation
from compas.geometry import Frame
from compas_ghpython.artists import MeshArtist
from compas_fab.robots import Configuration
from ur_fabrication_control.kinematics.ur_kinematics import forward_kinematics
from ur_fabrication_control.kinematics.ur_params import ur_params

print(configuration)

if robot and configuration:
    
    robot.update(configuration, visual=show_visual, collision=show_collision)
    ur_params = ur_params[robot.main_group_name]
    print(ur_params)
    if show_visual:
        # Transformation 1: Transformation from WCF to Mobile base coordinate frame
        t1 = robot.transformation_WCF_RCF()
        t1_translation = t1.translation
        t1_rotation = t1.rotation
        
        # Transformation 2: Transfomation from Mobile Base coordinate frame to UR base frame
        # ??
        
        # Transformation 3: Transformation between UR and Model
        station_pt = station_pts[station]
        
        
        visual = robot.artist.draw_visual()
        
    if show_collision:
        collision = robot.artist.draw_collision()
    
    frames = robot.transformed_frames(configuration, group)

    if show_base_frame:
        base_frame = frames[0]

    if show_end_effector_frame:
#        tool0_frame = forward_kinematics(configuration.revolute_values, ur_params)
        tool0_frame = robot.forward_kinematics(configuration, group)
        print tool0_frame
        ee_frame = robot.from_t0cf_to_tcf([tool0_frame])
        print("End-effector", ee_frame)
    
    if not show_frames:
        frames = None

#    frame = forward_kinematics(configuration.revolute_values, ur_params)
    frame = robot.forward_kinematics(configuration, options=dict(solver='model', link_name=robot.attached_tool.link_name))
    #robot.artist.update_tool(visual=visual, collision=collision, transformation=Transformation.from_frame_to_frame(Frame.worldXY(), tool0_frame))
    
    if show_acm:
        M = []
        for acm in attached_collision_meshes:
            frame = robot.forward_kinematics(configuration, options=dict(solver='model', link_name=acm.link_name))
            T = Transformation.from_frame_to_frame(Frame.worldXY(), frame)
            mesh = acm.collision_mesh.mesh.transformed(T)
            M.append(MeshArtist(mesh).draw())
        attached_meshes = M
# ---------- end visualize ----------
geo_2 = Geometry(visualize.visual)
geo_3 = Geometry(visualize.collision)
draw_3 = GhPythonScript(
    frames=[visualize.frames, visualize.ee_frame, visualize.base_frame, visualize.tool0_frame],
    scale=Slider(0.1, range=0..1))  # -> P, V, C, W; inputs frames: list; same code as draw_2
vdisex_3 = VectorDisplayEx(Point=draw_3.P, Vector=draw_3.V, Colour=draw_3.C, Width=draw_3.W)
preview_2 = CustomPreview(Geometry=geo_2, Shader=ColourSwatch(SwatchColor=RGB(105, 105, 105)))
preview_3 = CustomPreview(Geometry=visualize.attached_meshes, Shader=ColourSwatch(SwatchColor=RGB(255, 255, 255)))

multiplication_3 = Multiplication(A=deplane.XAxis, B=L)

entwine = Entwine(Branch00=move_2.Geometry, Branch01=deplane.XAxis, FlattenInputs=True)
list_19 = ValueList({"Zero": 0, "One": 1, "Two": 2, "Three": 3, "Four": 4, "Five": 5}, selected="Four")
item_5 = ListItem(List=entwine, Index=list_19, Wrap=True)
X = UnitX(Factor=expr("-x", 1))
bang_3 = ExplodeTree(Data=item_5)  # -> Branch0, Branch1
orient_3 = OrientDirection(Geometry=geo_2, PointA=Point(0, 0, 0), DirectionA=X, PointB=bang_3.Branch0, DirectionB=bang_3.Branch1)  # -> Geometry, Transform

# ---- group: Getting perpendicular vectors to curve at six "base points" (continued)
vdis = VectorDisplay(Anchor=crv_cp.Point, Vector=expr("(-x)*0.9", multiplication_3))

# ----
pt_7 = Point(visualize.base_pt)
