# Grasshopper definition mobile_robot_workspace_clay_formwork_v1.0.ghx (Grasshopper 1.0.7)

# ----
# 1.
# Settings
bang = Button()
panel = Panel("Unload libraries")
unload = PythonScript(bang=bang)
# ---------- unload: Python ----------
from compas_rhino.utilities.misc import get_tolerance
from compas_rhino.utilities.misc import unload_modules

unload_modules("compas")
unload_modules("compas_fab")
unload_modules("extrusion_control")
unload_modules("fabrication_control")
unload_modules("ur_fabrication_control")
unload_modules("mobile_fabrication_control")
unload_modules("am_information_model")
unload_modules("src")
# ---------- end unload ----------

# ----
# Base Curve
number_slider = Slider(0.085, range=0..1)
base_curve = GhPythonScript(
    out_crc_dist=Slider(0.25, range=0..1),
    out_crc_radius=number_slider,
    inner_crc_dist=Slider(0.3, range=0..1),
    rebar_offset=Slider(0.23, range=0..1),
    rebar_size=Slider(0.006, range=0..0.01))  # -> out, base_crv, base_crv_tstart, rebar_crv
# ---------- base_curve: Python ----------
import math
import Rhino.Geometry as rg
import rhinoscriptsyntax as rs
import ghpythonlib.components as ghcomp
from compas.geometry import Frame
from compas.geometry import Vector

out_crc_pts = []
in_crc_pts = []
rb_crc_pts = []
for i in range(3):
    pt_outer_crc = [out_crc_dist*math.cos(i*2*math.pi/3), out_crc_dist*math.sin(i*2*math.pi/3),0]
    out_crc_pts.append(rg.Point3d(*pt_outer_crc))
    pt_inner_crc = [inner_crc_dist*math.cos(i*2*math.pi/3+(1/3)*math.pi), inner_crc_dist*math.sin(i*2*math.pi/3+(1/3)*math.pi),0]
    in_crc_pts.append(rg.Point3d(*pt_inner_crc))
    pt_rebar = [rebar_offset*math.cos(i*2*math.pi/3), rebar_offset*math.sin(i*2*math.pi/3),0]
    rb_crc_pts.append(rg.Point3d(*pt_rebar))

out_crcs = [rg.Circle(pt, out_crc_radius) for pt in out_crc_pts]
rebar_crv = [rg.Circle(pt, rebar_size/2) for pt in rb_crc_pts]

lines1= [rg.Line(out_crc_pts[i], in_crc_pts[i]) for i in range(len(out_crc_pts))]
lines2= [rg.Line(out_crc_pts[i], in_crc_pts[i-1]) for i in range(len(out_crc_pts))]

int_pts = ghcomp.CurveXLine(out_crcs, lines1)[0]
vecs = [rg.Line(in_crc_pts[i], int_pts[i*2]) for i in range(3)]
in_crcs = [rg.Circle(pt, vecs[0].Length) for pt in in_crc_pts]

lines = lines1+lines2
bsrf = ghcomp.BoundarySurfaces(lines)

split_out_crc = ghcomp.SplitwithBrep(out_crcs, bsrf)[0]
split_in_crc = ghcomp.SplitwithBrep(in_crcs, bsrf)[0]
split_out_crc_len = ghcomp.Length(split_out_crc)
split_in_crc_len = ghcomp.Length(split_in_crc)

out_crc_segs = ghcomp.SortList(split_out_crc_len, split_out_crc)[1]
in_crc_segs = ghcomp.SortList(split_in_crc_len, split_in_crc)[1]

crv_segs = []
for i in range(3):
    crv_segs.append(out_crc_segs[i+3])
    crv_segs.append(in_crc_segs[i])

base_crv_raw = ghcomp.JoinCurves(crv_segs, False)
base_crv = ghcomp.OffsetCurve(base_crv_raw, 0.01,corners=0)
base_crv_tstart = ghcomp.CurveClosestPoint(rg.Point3d(out_crc_dist+out_crc_radius,0,0), base_crv)[1]
# ---------- end base_curve ----------
crv = Curve(base_curve.rebar_crv)
crv_2 = Curve(base_curve.base_crv)
dam = DataDam(
    DataBase_crv=crv_2,
    DataBase_crv_tstart=base_curve.base_crv_tstart,
    DataRebar_crv=crv,
    BufferDelay=10000000,
    BufferMode=0)  # -> DataBase_crv, DataBase_crv_tstart, DataRebar_crv

# ----
# Segment width inputs
number_slider_2 = Slider(1, range=0..10)
expression = Expression(a=Slider(4, range=0..10), b=Slider(15, range=0..30), Expression="a/b")
expression_2 = Expression(a=number_slider_2, b=Slider(3, range=0..10), Expression="a/b")

# ----
# Offset input
number_slider_3 = Slider(0, range=-1..1)

ext_ip = ValueList({"192.168.10.10", "192.168.10.20", "192.168.10.11", "192.168.10.12", "127.0.0.1", "192.168.10.111", "192.168.0.220", "192.168.0.30", "192.168.10.50", "0.0.0.0"}, selected="192.168.0.220")
ext_port = ValueList({"50003", "50004"}, selected="50004")

# ----
# --> Set your IP address
# --> Set robot IP address
server_ip = ValueList({"192.168.10.44", "192.168.10.12", "192.168.10.11", "192.168.10.10", "192.168.10.2", "127.0.0.1", "192.168.10.111", "192.168.0.250", "192.168.0.30", "10.42.0.212", "10.42.0.133"}, selected="127.0.0.1")
ur_ip = ValueList({"192.168.10.10", "192.168.10.20", "192.168.10.11", "192.168.10.12", "127.0.0.1", "192.168.10.111", "192.168.0.210", "192.168.0.30"}, selected="192.168.0.210")
server_port = ValueList({"50002", "50003", "50004", "50005"}, selected="50005")
ur_port = ValueList({"30002"}, selected="30002")
globals = PythonScript(
    server_address=server_ip,
    server_port=server_port,
    ur_ip=ur_ip,
    ur_port=ur_port,
    ext_ip=ext_ip,
    ext_port=ext_port,
    clear=Button())  # inputs server_port: Int32
# ---------- globals: Python ----------
from scriptcontext import sticky as st

st["server_address"] = server_address
st["server_port"] = server_port

st["ur_ip"] = ur_ip
st["ur_port"] = ur_port

st["ext_ip"] = ext_ip
st["ext_port"] = ext_port


if clear:
    st.clear()
# ---------- end globals ----------

# ----
# Check if UR robot
#  is available
ping = Button()
py = PythonScript(ip=ur_ip, ping=ping)  # -> out, trigger
# ---------- py: Python ----------
from scriptcontext import sticky as st
from ur_fabrication_control.direct_control.utilities import is_available

guid = str(ghenv.Component.InstanceGuid)
txt_key = "txt_" + guid
if txt_key not in st:
    st[txt_key] = ""

if ping:
    
    available = is_available(ip)
    
    if available:
        st[txt_key] = "%s is up!" % ip
        trigger = True
    else:
        st[txt_key] = "%s is down!" % ip
        trigger = False

print(st[txt_key])
# ---------- end py ----------
panel_2 = Panel(py.out)

# ---- group: ROS client
disconnect = Button()
connect = Button()
connect_2 = PythonScript(ip="192.168.0.40", connect=connect, disconnect=disconnect)  # -> out, ros_client
# ---------- connect_2: Python ----------
import sys
import scriptcontext as sc
from compas_fab.backends import RosClient

key = 'rosclient_%s' % str(ghenv.Component.InstanceGuid)
previous_client = sc.sticky.get(key, None)

if previous_client and (connect or disconnect):
    previous_client.close()

if connect:
    ros_client = RosClient(ip, 9090)
    sc.sticky[key] = ros_client
    ros_client.run(5)

ros_client = sc.sticky.get(key, None)
print('ROS connected: {}'.format(ros_client.is_connected if ros_client else 'False'))
# ---------- end connect_2 ----------
is_connected = Panel(connect_2.out)

# ----
# Silhouette
number_slider_4 = Slider(0.5, range=0..1)
pi = Pi(Factor=0.5)
pi_2 = Pi(Factor=1.5)
dom = ConstructDomain(DomainStart=number_slider_4, DomainEnd=Slider(1, range=0..10))
layers = GhPythonScript(
    base_crv=dam.DataBase_crv,
    rebar_crv=dam.DataRebar_crv,
    height=Slider(2, range=0..10),
    layer_height=Slider(0.005, range=0..0.01),
    phase=pi,
    wave_length=pi_2,
    domain=dom)  # -> out, base_crvs, rebar_crvs; inputs base_crv: Curve, rebar_crv: list of Curve
# ---------- layers: Python ----------
import math
import Rhino.Geometry as rg
import rhinoscriptsyntax as rs
import ghpythonlib.components as ghcomp
from compas.geometry import Frame
from compas.geometry import Vector

transformations = []
scaling = []
count = int(height/layer_height)
for i in range(count):
    transformations.append(rg.Vector3d(0,0,i*layer_height))
    scaling.append(math.sin(phase+i*(wave_length/count)))
dom_sin = ghcomp.ConstructDomain(-1,1)
dom_new = ghcomp.ConstructDomain(domain[0],domain[1])
rmscaling = ghcomp.RemapNumbers(scaling, dom_sin, dom_new)[0]

ncrvs = ghcomp.Move(base_crv, transformations)[0]
base_crvs = ghcomp.Scale(ncrvs, transformations, rmscaling)[0]

rb_transformations = [[t, t, t] for t in transformations]
rb_transformations = [t for tl in rb_transformations for t in tl]
rb_scaling = [[s, s, s] for s in rmscaling]
rb_scaling = [s for sub in rb_scaling for s in sub]
rbcrvs = [rebar_crv for i in range(count)]
rbcrvs = [crv for sub in rbcrvs for crv in sub]
rcrvs = ghcomp.Move(rbcrvs, rb_transformations)[0]
rebar_crvs = ghcomp.Scale(rcrvs, rb_transformations, rb_scaling)[0]
# ---------- end layers ----------
crv_3 = Curve(layers.rebar_crvs)
partition = PartitionList(List=crv_3, Size=3)
flip = FlipMatrix(Data=partition)
loft = Loft(Curves=flip, Options={Adjust=False, Closed=False, LoftEnds=0, LoftSimp=0, LoftType=0, Rebuild=10, Refit=0.01})

# ----
# 2.
py_2 = PythonScript()  # -> repositories_path, rbvogui_data_path, ur_data_path
# ---------- py_2: Python ----------
import os

"""
ASSUMING THE BELOW PACKAGES ARE STORED IN THE SAME LOCATION:
    ur_fabrication_control;
    rbvogui_common; and
    mobile_additive_manufacturing.
"""

repositories_path = os.path.abspath(os.path.join(ghdoc.Path,"../../../"))

assert os.path.exists(os.path.join(repositories_path, "ur_fabrication_control/data"))
assert os.path.exists(os.path.join(repositories_path, "rbvogui_common/rbvogui_description"))
assert os.path.exists(os.path.join(repositories_path, "mobile_fabrication_control"))

ur_data_path = os.path.abspath(os.path.join(ghdoc.Path,"../../../ur_fabrication_control/data"))
rbvogui_data_path = os.path.abspath(os.path.join(repositories_path, "rbvogui_common"))
# ---------- end py_2 ----------
list = ValueList({"ur3.urdf", "ur3_rot.urdf", "ur5.urdf", "ur10.urdf", "ur3e.urdf", "ur5e.urdf", "ur10e.urdf", "ur10e_rot.urdf"}, selected="ur10e_rot.urdf")
list_2 = ValueList({"ur3.srdf", "ur5.srdf", "ur10.srdf", "ur3e.srdf", "ur5e.srdf", "ur10e.srdf"}, selected="ur10e.srdf")
list_3 = ValueList({"nozzle", "scanner"}, selected="nozzle")
py_3 = PythonScript()  # -> DATA
# ---------- py_3: Python ----------
import os

#package_path = os.path.dirname(mobile_fabrication_control.__file__)
#DATA = os.path.abspath(os.path.join(package_path,"../../data"))

package_path = ghdoc.Path
# package_path = os.path.dirname(ur_fabrication_control.__file__)
#DATA = os.path.abspath(os.path.join(package_path,"../../data"))

# .stl files not stored in am_hackathon repo. but in mobile_fabrication_control
DATA = os.path.abspath(os.path.join(package_path,"../../../mobile_fabrication_control/data"))

print(package_path)
print(DATA)
# ---------- end py_3 ----------

# ----
# Subscribe to topics
# 09.02.2022
toggle = BooleanToggle(True)
# 07.02.2022
subscriber = GhPythonScript(
    ros_client=connect_2.ros_client,
    subscribe_to_robot_lift_topic=toggle,
    subscribe_to_robotnik_base_topic=toggle,
    subscribe_to_static_tf_topic=toggle,
    subscribe_to_battery_data=toggle)  # -> out
# ---------- subscriber: Python ----------
import time
import logging
import datetime
import Grasshopper
from roslibpy import Topic
from scriptcontext import sticky

LOGGER = logging.getLogger('roslibpy')

robot_lift_pos = 'listener_robot_lift_pos'
robot_base_footprint = 'listener_robot_base_footprint'
tf_static = 'listener_tf_static'
robot_battery_data = 'listener_robot_battery_data'

if subscribe_to_robot_lift_topic:
    if ros_client and ros_client.is_connected:
        print("subscribed to /robot/ewellix_driver/lift/pos topic")
        listener = Topic(ros_client, '/robot/ewellix_driver/lift/pos', 'std_msgs/Float64')
        sticky[robot_lift_pos] = listener
    else:
        sticky[robot_lift_pos] = None
        print("NOT subscribed to /robot/ewellix_driver/lift/pos topic")
else:
    sticky[robot_lift_pos] = None

if subscribe_to_robotnik_base_topic:
    if ros_client and ros_client.is_connected:
        print("subscribed to /robot/robotnik_base_control/odom topic")
        listener = Topic(ros_client, '/robot/robotnik_base_control/odom', 'nav_msgs/Odometry')
        sticky[robot_base_footprint] = listener
    else:
        sticky[robot_base_footprint] = None
        print("NOT subscribed to /robot/robotnik_base_control/odom topic")
else:
    sticky[robot_base_footprint] = None

if subscribe_to_static_tf_topic:
    if ros_client and ros_client.is_connected:
        print("subscribed to /tf_static topic")
        listener = Topic(ros_client, '/tf_static', 'tf2_msgs/TFMessage')
        sticky[tf_static] = listener
        #print sticky[tf_static]
    else:
        sticky[tf_static] = None
        print("NOT subscribed to /tf_static topic")
else:
    sticky[tf_static] = None
    
if subscribe_to_battery_data:
    if ros_client and ros_client.is_connected:
        print("subscribed to /robot/battery_estimator/data topic")
        listener = Topic(ros_client, '/robot/battery_estimator/data', '/robotnik_msgs/BatteryStatus')
        sticky[robot_battery_data] = listener
        #print sticky[robot_battery_data]
    else:
        sticky[robot_battery_data] = None
        print("NOT subscribed to /robot/battery_estimator/data topic")
else:
    sticky[robot_battery_data] = None
# ---------- end subscriber ----------
panel_3 = Panel(subscriber)

# ----
# Listen to topics
start_timer = Button()
stop_timer = Button()
bang_2 = Button()
listener = GhPythonScript(bang=bang_2, start_timer=start_timer, stop_timer=stop_timer)  # -> out, map_frame_ros, ur_base_frame_ros, mobile_base_frame_ros, map_plane_ros, ur_base_plane_ros, mobile_base_plane_ros, vertical_lift_pos
# ---------- listener: Python ----------
from scriptcontext import sticky
from compas_ghpython.utilities import update_component
from compas.geometry import Frame, Transformation, Translation, Point, Rotation, Vector, Quaternion
from compas_ghpython import draw_frame
import Rhino.Geometry as rg
import math

guid = str(ghenv.Component.InstanceGuid)
timer_running_key = "timer_running_" + guid
counter_key = "counter_" + guid

robot_lift_length = 0.533

if stop_timer or timer_running_key not in sticky:
    sticky[timer_running_key] = False
    sticky[counter_key] = 0

if start_timer:
    sticky[timer_running_key] = True
    sticky[counter_key] = 0
    

if sticky[timer_running_key]:
    update_component(ghenv, 1000)
    
    sticky[counter_key] += 1
    print(sticky[counter_key])


def receive_message_tf_static(message):
    #sticky['message'] = str(datetime.datetime.now()) + ': ' + str(message)
    #print("receiving")
    sticky['ros_msg_tf_static'] = message
    
def receive_message_robot_footprint(message):
    #sticky['message'] = str(datetime.datetime.now()) + ': ' + str(message)
    #print("receiving")
    sticky['ros_msg_robot_footprint'] = message

def receive_message_robot_lift_pos(message):
    #sticky['message'] = str(datetime.datetime.now()) + ': ' + str(message)
    #print("receiving")
    sticky['ros_msg_robot_lift_pos'] = message
    
def receive_message_robot_battery_data(message):
    #sticky['message'] = str(datetime.datetime.now()) + ': ' + str(message)
    #print("receiving")
    sticky['ros_msg_robot_battery_data'] = message


if 'listener_robot_base_footprint' in sticky:
    if sticky['listener_robot_base_footprint']:
    
        listener_robot_base_footprint = sticky['listener_robot_base_footprint']
        listener_robot_base_footprint.subscribe(receive_message_robot_footprint)
    
        if 'ros_msg_robot_footprint' in sticky and sticky['ros_msg_robot_footprint']:
            #bang = True
            
            ros_msg_robot_footprint = sticky['ros_msg_robot_footprint']
            if len(ros_msg_robot_footprint):
                robot_base_footprint = ros_msg_robot_footprint
                p = robot_base_footprint['pose']['pose']
                #print('robot_base_footprint', p)
                mobile_base_frame_ros = Frame.from_quaternion([p['orientation']['w'],p['orientation']['x'], p['orientation']['y'], p['orientation']['z']], point = [p['position']['x'], p['position']['y'], p['position']['z']])
                mobile_base_plane_ros = draw_frame(mobile_base_frame_ros)
                print('++ Listening to ROS MSG ROBOT BASE FOOTPRINT')
                
        else:
            bang = False
            print('NOT receiving ROS MSG ROBOT BASE FOOTPRINT')
    else:
        print('NOT receiving ROS MSG ROBOT BASE FOOTPRINT')


if 'listener_tf_static' in sticky:
    if sticky['listener_tf_static']:
    
        listener_tf_static = sticky['listener_tf_static']
        listener_tf_static.subscribe(receive_message_tf_static)
    
        if 'ros_msg_tf_static' in sticky and sticky['ros_msg_tf_static']:
            #bang = True
            
            ros_msg_tf_static = sticky['ros_msg_tf_static']
            if len(ros_msg_tf_static and ros_msg_tf_static['transforms']):
                
                ### First static transformation from mobile robot base frame to mobile robot base link
                tf0 = ros_msg_tf_static['transforms'][0]
                t0 = tf0['transform']
                #print('robot_base frame to robot_base_link', t0)
                x1, y1, z1 = t0['translation']['x'], t0['translation']['y'], t0['translation']['z']
                
                ## Second static transformation from mobile robot base link to ewellix base link
                tf1 = ros_msg_tf_static['transforms'][2]
                t1 = tf1['transform']
                #print('robot_base_link to ewellix_base_link', t1)
                x2, y2, z2 = t1['translation']['x'], t1['translation']['y'], t1['translation']['z']
                
                print('++ Listening to ROS MSG TF STATIC')

                ## Translations in x, y, z axis from the received static transformations
                T1 = Translation.from_vector(mobile_base_frame_ros.xaxis*(x1+x2))
                T2 = Translation.from_vector(mobile_base_frame_ros.yaxis*(y1+y2))
                T3 = Translation.from_vector(mobile_base_frame_ros.zaxis*(z1+z2))

                T_rbl_ebl = T1*T2*T3
                
                ewellix_base_frame_ros = mobile_base_frame_ros.transformed(T_rbl_ebl)
                ewellix_base_plane_ros = draw_frame(ewellix_base_frame_ros)
        else:
            bang = False
            print('NOT receiving ROS MSG TF STATIC')
    else:
        print('NOT receiving ROS MSG TF STATIC')


if 'listener_robot_lift_pos' in sticky:
    if sticky['listener_robot_lift_pos']:
    
        listener_robot_lift_pos = sticky['listener_robot_lift_pos']
        listener_robot_lift_pos.subscribe(receive_message_robot_lift_pos)
    
        if 'ros_msg_robot_lift_pos' in sticky and sticky['ros_msg_robot_lift_pos']:
            #bang = True
            
            ros_msg_robot_lift_pos = sticky['ros_msg_robot_lift_pos']
            if len(ros_msg_robot_lift_pos):
                vertical_lift_pos = ros_msg_robot_lift_pos['data']
                T_ebl_etl = Transformation.from_frame(Frame.from_quaternion([1.0,0.0,0.0,0.0], point=[0.0,0.0,robot_lift_length + vertical_lift_pos]))
                T_static = T_rbl_ebl*T_ebl_etl
                ur_base_frame_ros = ewellix_base_frame_ros.transformed(T_ebl_etl)
                R = Rotation.from_axis_and_angle(ur_base_frame_ros.zaxis, math.radians(135), point=ur_base_frame_ros.point)
                ur_base_frame_ros.transform(R)
                #print(ur_base_frame_ros)
                ur_base_plane_ros = draw_frame(ur_base_frame_ros)
                print('++ Listening to ROS MSG ROBOT LIFT POSITION')
                
        else:
            bang = False
            print('NOT receiving ROS MSG ROBOT LIFT POSITION')
    else:
        print('NOT receiving ROS MSG ROBOT LIFT POSITION')



if 'listener_robot_battery_data' in sticky:
    if sticky['listener_robot_battery_data']:
    
        listener_robot_battery_data = sticky['listener_robot_battery_data']
        listener_robot_battery_data.subscribe(receive_message_robot_battery_data)
    
        if 'ros_msg_robot_battery_data' in sticky and sticky['ros_msg_robot_battery_data']:
            #bang = True
            
            ros_msg_robot_battery_data = sticky['ros_msg_robot_battery_data']
            if len(ros_msg_robot_battery_data):
                robot_battery_data = ros_msg_robot_battery_data

                print('robot_battery_data')

                print('++ Listening to ROS MSG ROBOT BATTERY DATA')
                
        else:
            bang = False
            print('NOT receiving ROS MSG ROBOT BATTERY DATA')
    else:
        print('NOT receiving ROS MSG ROBOT BATTERY DATA')


#### TO DO: get map_frame_ros from rostopic '/tf ... robot_map_frame' ####

map_frame_ros = Frame.from_quaternion([0.92316, 0.0, 0.0, 0.38441], point=[0.81933, -0.19651, 0.0])
map_plane_ros = draw_frame(map_frame_ros)
# ---------- end listener ----------
panel_4 = Panel(listener.out)
panel_5 = Panel(listener.vertical_lift_pos)
draw = GhPythonScript(scale=Slider(0.1, range=0..1))  # -> P, V, C, W; inputs frames: list
# ---------- draw: Python ----------
from System.Drawing import Color
from compas_ghpython.utilities import draw_frame

red = Color.FromArgb(255, 0, 0)
green = Color.FromArgb(0, 255, 0)
blue = Color.FromArgb(0, 0, 255)

P = []
V = []
C = []

scale = float(scale)

for frame in frames:
    if not frame:
        continue
    plane = draw_frame(frame)
    P += [plane.Origin] * 3
    V.append(plane.XAxis * scale)
    V.append(plane.YAxis * scale)
    V.append(plane.ZAxis * scale)
    C += [red, green, blue]

W = 3
# ---------- end draw ----------
vdisex = VectorDisplayEx(Point=draw.P, Vector=draw.V, Colour=draw.C, Width=draw.W)

# ----
# Rebar crossmembers
partition_2 = PartitionList(List=layers.rebar_crvs, Size=3)  # disabled
panel_6 = Panel("""99
199
299
399""")  # disabled
area = Area(Geometry=partition_2)  # -> Area, Centroid; disabled
flip_2 = FlipMatrix(Data=area.Centroid)  # disabled
number_slider_5 = Slider(0.0004, range=0..0.01)  # disabled
branch = TreeBranch(Tree=simplify(area.Centroid), Path=panel_6, MaintainPaths=True)  # disabled
item = ListItem(List=branch, Index=0, Wrap=True)  # disabled
yz = YZPlane(Origin=item)  # disabled
pline = PolyLine(Vertices=branch, Closed=True)  # disabled
cir = Circle(Plane=flatten(yz), Radius=number_slider_5)  # disabled
pipe = Pipe(Curve=pline, Radius=flatten(cir), Caps=0)  # disabled

pln = Plane(listener.map_plane_ros)
pln_2 = Plane(listener.mobile_base_plane_ros)
pln_3 = Plane(listener.ur_base_plane_ros)

# ----
# Global Localization
map_plane_rhino = Plane(Plane(origin=(1.179122663, 0.2715298688, -0.1655349322), x=(-0.2396713481, -0.9708409462, 0.00504995646), y=(0.9708540501, -0.2396693923, 0.0009979146029)))

# ---- group: Visualise
back = Button()
reset = Button()
start = Button()
stop = Button()
step = Button()
full = Button()
list_4 = ValueList({"20", "50", "100", "500", "1000", "5000"}, selected="20")

back_2 = Button()
reset_2 = Button()
start_2 = Button()
stop_2 = Button()
step_2 = Button()
full_2 = Button()
list_5 = ValueList({"20", "50", "100", "500", "1000", "5000"}, selected="20")

# ----
# Transform Map
# Locate ROS robot_map frame in reference to the workpiece in Rhino.
# 
# + This transformation is necessary when a new map was created in ROS.
# + Internalise robot_map_wcp in 'T_global' section below!
# Calculate Basis - Point fitting method via RPC
base_plane_fit = Plane(Plane(origin=(-0.57309, -0.921459, 0.903867), x=(-0.9686743385, -0.2478080866, -0.01616100565), y=(0.2480255025, -0.9686636238, -0.01319598746)))
transform_map = GhPythonScript(map_frame_ros=listener.map_frame_ros, base_plane_fit=base_plane_fit, ur_base_frame_ros=listener.ur_base_frame_ros)  # -> out, map_plane_rhino
# ---------- transform_map: Python ----------
from compas.geometry import Frame, Transformation
from compas_ghpython import draw_frame


ur_base_frame_rhino = Frame(base_plane_fit.Origin, base_plane_fit.XAxis, base_plane_fit.YAxis)

if map_frame_ros and ur_base_frame_ros:
    T_map = Transformation.from_frame_to_frame(ur_base_frame_ros, ur_base_frame_rhino)
    map_frame_rhino = map_frame_ros.transformed(T_map)
    map_plane_rhino = draw_frame(map_frame_rhino)
# ---------- end transform_map ----------
map_plane_rhino_2 = Plane(transform_map.map_plane_rhino)

# ----
# T_global
# Transform from ROS to Rhino
ros_to_rhino = GhPythonScript(
    map_plane_rhino=map_plane_rhino,
    map_frame_ros=listener.map_frame_ros,
    ur_base_frame_ros=listener.ur_base_frame_ros,
    mobile_base_frame_ros=listener.mobile_base_frame_ros)  # -> out, T_global, ur_base_frame_rhino_global_tf, mobile_base_frame_rhino_global_tf, ur_base_plane_rhino_global_tf, mobile_base_plane_rhino_global_tf
# ---------- ros_to_rhino: Python ----------
from compas.geometry import Frame, Transformation
from compas_ghpython import draw_frame


if map_frame_ros:
    
    if map_plane_rhino:
        map_frame_rhino = Frame(map_plane_rhino.Origin, map_plane_rhino.XAxis, map_plane_rhino.YAxis)
        
        T_global = Transformation.from_frame_to_frame(map_frame_ros, map_frame_rhino)
        
        print('++ RCF received from ROS')
        print(T_global)
    
    else:
        print('++ NO WCF provided')
    
else:
    print('++ NOT receiving RCF')


if ur_base_frame_ros:
    ur_base_frame_rhino_global_tf = ur_base_frame_ros.transformed(T_global)
    mobile_base_frame_rhino_global_tf = mobile_base_frame_ros.transformed(T_global)
    
    ur_base_plane_rhino_global_tf = draw_frame(ur_base_frame_rhino_global_tf)
    mobile_base_plane_rhino_global_tf = draw_frame(mobile_base_frame_rhino_global_tf)

else:
    print('NO ROS Base Coordinate Frame received')
# ---------- end ros_to_rhino ----------
panel_7 = Panel(ros_to_rhino.out)
pln_4 = Plane(ros_to_rhino.ur_base_plane_rhino_global_tf)
pln_5 = Plane(ros_to_rhino.mobile_base_plane_rhino_global_tf)
t_global = Data(ros_to_rhino.T_global)

plane_nr = Slider(0, range=0..200)
list_6 = ValueList({"Zero": 0, "One": 1, "Two": 2, "Three": 3, "Four": 4, "Five": 5}, selected="Zero")
ur_base_frame_rhino_global_tf = Data(ros_to_rhino.ur_base_frame_rhino_global_tf)

# ----
# T_local
# Transfrom from global to local
base_plane_fit_2 = Plane(Plane(origin=(-0.57309, -0.921459, 0.903867), x=(-0.9686743385, -0.2478080866, -0.01616100565), y=(0.2480255025, -0.9686636238, -0.01319598746)))
init_guess = Plane(pln_4)
t_local = GhPythonScript(init_guess=base_plane_fit_2, base_plane_fit=base_plane_fit_2, add=Toggle(True))  # -> out, T_local
# ---------- t_local: Python ----------
import rhinoscriptsyntax as rs
from compas.geometry import Transformation, Frame
from compas_ghpython import draw_frame



if add:
    if base_plane_fit and init_guess:
        init_guess_frame = Frame(init_guess.Origin, init_guess.XAxis, init_guess.YAxis)
        base_frame_fit = Frame(base_plane_fit.Origin, base_plane_fit.XAxis, base_plane_fit.YAxis)
        
        T_local = Transformation.from_frame_to_frame(init_guess_frame, base_frame_fit)
else:
    T_local = None
print(T_local)
# ---------- end t_local ----------

python = GhPythonScript(ur_base_plane_rhino_local_tf=base_plane_fit_2)  # -> out, ur_base_frame_rhino_local_tf
# ---------- python: Python ----------
__author__ = "Gido"
__version__ = "2022.04.11"

import rhinoscriptsyntax as rs
from compas.geometry import Frame

ur_base_frame_rhino_local_tf = Frame(ur_base_plane_rhino_local_tf.Origin, 
                                     ur_base_plane_rhino_local_tf.XAxis, 
                                     ur_base_plane_rhino_local_tf.YAxis)
# ---------- end python ----------

# ----
# Robot Model
# Load Model
list_7 = ValueList({"ur_description", "ur_e_description", "ur_setups"}, selected="ur_e_description")
py_4 = PythonScript(
    repositories_path=py_2.repositories_path,
    rbvogui_data_path=py_2.rbvogui_data_path,
    ur_data_path=py_2.ur_data_path,
    package=list_7,
    urdf_name=list,
    srdf_name=list_2)  # -> loaders, urdf_filename, srdf_filename
# ---------- py_4: Python ----------
import os
from compas.robots import LocalPackageMeshLoader

#loaders

ur_path = os.path.join(ur_data_path, "robot_description")
ur_packages = ["ur_description", "ur_e_description", "ur_end_effectors", "ur_setups"]
ur_loaders = [LocalPackageMeshLoader(ur_path, pck) for pck in ur_packages]

rbvogui_packages = ["rbvogui_description"]
rbvogui_loaders = [LocalPackageMeshLoader(rbvogui_data_path, pck) for pck in rbvogui_packages]

ewellix_packages = ["ewellix_description"]
ewellix_loaders = [LocalPackageMeshLoader(repositories_path, pck) for pck in ewellix_packages]

sensors_packages = ["robotnik_sensors"]
sensors_loaders = [LocalPackageMeshLoader(repositories_path, pck) for pck in sensors_packages]

loaders = ur_loaders + rbvogui_loaders + ewellix_loaders + sensors_loaders

#files
urdf_filename = os.path.join(repositories_path, r"mobile_fabrication_control\data\rbvogui_xl_lift_ur10e.urdf")
srdf_filename = os.path.join(repositories_path, r"mobile_fabrication_control\data\rbvogui.srdf")

assert os.path.isfile(urdf_filename)
assert os.path.isfile(srdf_filename)
# ---------- end py_4 ----------
units = ValueList({"m": 1, "cm": 100, "mm": 1000}, selected="m")
load = Button()
create = PythonScript(
    load=load,
    ur_base_frame_rhino_local_tf=python.ur_base_frame_rhino_local_tf,
    loaders=py_4.loaders,
    urdf_filename=py_4.urdf_filename,
    srdf_filename=py_4.srdf_filename,
    scale_factor=units)  # -> out, robot, rcf; inputs load: Boolean, loaders: list
# ---------- create: Python ----------
import os
from scriptcontext import sticky as st

import compas

from compas_ghpython import draw_frame
from compas.robots import RobotModel
from compas.robots import LocalPackageMeshLoader

from compas_fab.robots import Robot
from compas_fab.robots import RobotSemantics
from compas_fab.ghpython import RobotArtist

compas.PRECISION = '12f'

# store robot in component
guid = str(ghenv.Component.InstanceGuid)
robot_key = "robot"

if robot_key not in st:
    st[robot_key] = None

#print loaders
if load:
    model = RobotModel.from_urdf_file(urdf_filename)
    
    model.load_geometry(*loaders)
    artist = RobotArtist(model)
    semantics = RobotSemantics.from_srdf_file(srdf_filename, model)
    robot = Robot(model, artist, semantics, client=None)
    
    st[robot_key] = robot

robot = st[robot_key]
print(robot)
rcf = draw_frame(robot.get_RCF())
print(rcf)

if robot:
    robot.scale(scale_factor)
    robot.RCF_in_WCF = ur_base_frame_rhino_local_tf
# ---------- end create ----------
robot = Data(create.robot)

# ----
# Tool
list_8 = ValueList({"measurement_tool": 0, "clay_extruder_7mm": 1, "clay_extruder_7mm_with_2d_laser": 2, "clay_extruder_v2_7mm": 3}, selected="clay_extruder_7mm_with_2d_laser")
show = BooleanToggle(False)
panel_8 = Panel("Attach a custom tool")
python_2 = PythonScript(data_path=py_3, tool=list_8, tcp_frame=list_3, show=show)  # -> tool, M
# ---------- python_2: Python ----------
import os, math
from compas.geometry import Frame, Rotation
from compas.datastructures import Mesh
from compas_ghpython.artists import MeshArtist
from compas_fab.robots import Tool

tolerance = 0

if tool == 0:
    filename = 'measurement_tool_zaxis.stl'
    ee_frame = Frame([0, 0, 0.109], [1, 0, 0], [0, 1, 0])

elif tool == 1:
    filename = 'clay_extruder_7mm.stl'
    # real frame:
    ee_frame = Frame([-0.000502, -0.105348, 0.0662,], [1, 0, 0], [0, 0, 1])
    
    # test frame:
    # ee_frame = Frame([0.0, 0.0, 0.1,], [1, 0, 0], [0, 1, 0])
elif tool == 2:
    filename = 'clay_extruder_7mm_with_2d_laser.stl'
    # non-rotated frame:
    if tcp_frame == "nozzle":
        ee_frame = Frame([-0.0013, -0.0053, 0.3441,], [1, 0, 0], [0, 1, 0])
    elif tcp_frame == "scanner":
        # Original frame
#        ee_frame = Frame([-0.0493, -0.0063, 0.3949,], [-1, 0, 0], [0, -1, 0])
        # Raised frame
        ee_frame = Frame([-0.0493, -0.0063, 0.4200,], [-1, 0, 0], [0, -1, 0])

elif tool == 3:
    filename = 'clay_extruder_v2_7mm.stl'
    ee_frame = Frame([0, 0, 0.31976626739], [1, 0, 0], [0, 1, 0])


data_path = os.path.join(data_path, "tool_geometry")
fullfilename = os.path.join(data_path, filename)
print fullfilename

ee_mesh = Mesh.from_stl(fullfilename)

#R = Rotation.from_axis_and_angle(ee_frame.zaxis, math.radians(180), point=ee_frame.point)
#ee_frame.transform(R)

if show:
    artist = MeshArtist(ee_mesh)
    M = artist.draw()

tool = Tool(ee_mesh, ee_frame)
# ---------- end python_2 ----------
py_5 = PythonScript(robot=robot, tool=python_2.tool, attach=Toggle(True))  # -> a
# ---------- py_5: Python ----------
if attach:
    robot.attach_tool(tool, group = "ur10e")
else:
    robot.detach_tool()
# ---------- end py_5 ----------

pln_6 = Plane(create.rcf)

# ----
# Info
info = PythonScript(robot=robot)  # -> out, main_group_name
# ---------- info: Python ----------
if robot:
    robot.info()
    main_group_name = robot.main_group_name
# ---------- end info ----------
panel_9 = Panel(info.out)

# ---- group: forward kinematics
# Configuration
a1 = Slider(45, range=-360..360)
a2 = Slider(-45, range=-360..360)
a3 = Slider(135, range=-360..360)
a5 = Slider(-90, range=-360..360)
a6 = Slider(0, range=-360..360)
a4 = Slider(-180, range=-360..360)
jp = GhPythonScript()  # -> joint_positions
# ---------- jp: Python ----------
import math

joint_positions = [0,-90,90,0,90,0]
joint_positions = [math.radians(a) for a in joint_positions]
#joint_positions = [-3.136, -0.328, -1.218, 3.129, 0.852, 0.008]
#joint_positions = [0] * 6



#joint_positions = [1.6239667567485938, 0.25439606475392273, 4.409424838594969-2*3.14, 3.1901607306255908, 1.5707963267948954, 0.053170429953696939]
#joint_positions = [1.598543436748912, 0.23021224965157744, 4.712232135219824-2*3.14, 6.0531299026928744, 4.7123889803846915, 0.027747109954015234]
#joint_positions = [-1.1373533430447322, 4.0117247163121572, 5.4083762087596021-2*3.14, 1.5754733624925168, 4.7123889803846879, 3.5750356373399574]
print joint_positions
# ---------- end jp ----------
forward_kinematics = PythonScript(robot=robot, set_joint_positions=Button(), joint_positions=jp, a1=a1, a2=a2, a3=a3, a4=a4, a5=a5, a6=a6)  # -> full_configuration; inputs joint_positions: list
# ---------- forward_kinematics: Python ----------
import math
import Grasshopper
from compas.robots import Joint
from compas_fab.robots import Configuration

if set_joint_positions:

    j = 0
    for i in range(ghenv.Component.Params.Input.Count):
        nslider = ghenv.Component.Params.Input[i].Sources[0]
        if nslider.GetType() == Grasshopper.Kernel.Special.GH_NumberSlider:
            nslider.TrySetSliderValue(math.degrees(joint_positions[j]))
            j += 1

if robot:
    joint_positions = [a1, a2, a3, a4, a5, a6]
    joint_types = robot.get_configurable_joint_types()
    for i, joint_type in enumerate(joint_types):
        if joint_type == Joint.REVOLUTE:
            joint_positions[i] = math.radians(joint_positions[i])
    full_configuration = Configuration(joint_positions, joint_types)
    
print(full_configuration)
# ---------- end forward_kinematics ----------

# ----
t_local_2 = Data(t_local.T_local)

pt = Point(<point referenced from the Rhino model>)
crv_4 = Curve(<curve referenced from the Rhino model>)
crv_5 = Curve(<curve referenced from the Rhino model>)
init_gues = ConstructPlane(Origin=pt, XAxis=crv_4, YAxis=crv_5)

# ----
# Local Localization
transformations = GhPythonScript(
    T_local=t_local_2,
    ur_base_frame_rhino_global_tf=ros_to_rhino.ur_base_frame_rhino_global_tf,
    mobile_base_frame_rhino_global_tf=ros_to_rhino.mobile_base_frame_rhino_global_tf)  # -> out, ur_base_plane_rhino_local_tf, ur_base_frame_rhino_local_tf, mobile_base_plane_rhino_local_tf, mobile_base_frame_rhino_local_tf
# ---------- transformations: Python ----------
import rhinoscriptsyntax as rs
from compas.geometry import Frame, Transformation
from compas_ghpython import draw_frame



if T_local:
    ur_base_frame_rhino_local_tf = ur_base_frame_rhino_global_tf.transformed(T_local)
    mobile_base_frame_rhino_local_tf = mobile_base_frame_rhino_global_tf.transformed(T_local)
    
    ur_base_plane_rhino_local_tf = draw_frame(ur_base_frame_rhino_local_tf)
    mobile_base_plane_rhino_local_tf = draw_frame(mobile_base_frame_rhino_local_tf)
    
    print(ur_base_plane_rhino_local_tf)
else:
    ur_base_frame_rhino_local_tf = ur_base_frame_rhino_global_tf
    mobile_base_frame_rhino_local_tf = mobile_base_frame_rhino_global_tf
    
    ur_base_plane_rhino_local_tf = draw_frame(ur_base_frame_rhino_local_tf)
    mobile_base_plane_rhino_local_tf = draw_frame(mobile_base_frame_rhino_local_tf)
# ---------- end transformations ----------
panel_10 = Panel(transformations.out)

scanning_output = GhPythonScript(ur_base_frame=ur_base_frame_rhino_global_tf)  # -> out, re_base_plane, T_local
# ---------- scanning_output: Python ----------
__author__ = "Gido"
__version__ = "2022.02.10"

import rhinoscriptsyntax as rs

from compas.geometry import Frame
from compas.geometry import Transformation
from compas_ghpython import draw_frame

prev_base_frame = Frame(prev_base_plane.Origin, prev_base_plane.XAxis, prev_base_plane.YAxis) 

#tf = [[0.945400031870859, -0.160800912665015, -0.283481650596079, 0],
#[0.0555949228193740,	0.936629257070037,	-0.345882695949276,	0],
#[0.321135460974473,	0.311237371288426,	0.894429043814088,	0],
#[0.281231045722961,	0.376236051321030,	0.274430662393570,	1]]

tf = [[0.976861156885151,	0.183979568810034,	-0.109058692590178,	0],
[-0.191947227683851,	0.979071617657779,	-0.0676389627468168,	0],
[0.0943320833729906,	0.0870073890968771,	0.991731401282150,	0],
[0.189357310533524,	-0.0450175069272518,	0.129362806677818,	1]]

T_ICP = Transformation.from_matrix(tf)
T_ICP.invert()

re_base_frame = prev_base_frame.transformed(T_ICP)
re_base_plane = draw_frame(re_base_frame)

T_local = Transformation.from_frame_to_frame(ur_base_frame, re_base_frame)
# ---------- end scanning_output ----------
pln_7 = Plane(scanning_output.re_base_plane)

bang_3 = Button()
unload_2 = PythonScript(bang=bang_3)
# ---------- unload_2: Python ----------
from compas_rhino.utilities.misc import get_tolerance
from compas_rhino.utilities.misc import unload_modules

unload_modules("compas")
unload_modules("compas_fab")
unload_modules("ur_fabrication_control")
unload_modules("mobile_additive_manufacturing")
unload_modules("am_information_model")
# ---------- end unload_2 ----------

# ---- group: Only needs to be created once
overwrite = Button()
# 5.
create_2 = Button()
fabrication = GhPythonScript(create=create_2, overwrite=overwrite)  # -> out, fabrication
# ---------- fabrication: Python ----------
__author__ = "Gido"
__version__ = "2020.01.14"

from scriptcontext import sticky as st
from fabrication_control.fabrication.fabrication_server import Fabrication_with_server

server_ip = st["server_address"]
server_port = st["server_port"]
ext_ip = st["ext_ip"]
ext_port = st["ext_port"]

fabrication_key = "fabrication"

if fabrication_key not in st:
    st[fabrication_key] = None

if overwrite and st[fabrication_key] != None:
    fabrication = st[fabrication_key]
    fabrication.close()

if (create and st[fabrication_key] == None) or overwrite:
    fabrication = Fabrication_with_server()
    fabrication.set_feedback_server(server_ip, server_port)
    
    st[fabrication_key] = fabrication

fabrication = st[fabrication_key]
# ---------- end fabrication ----------

# ----
revise_task = Button()
undo_task = Button()
skip_task = Button()

# ----
# Stop
stop_3 = Button()
stop_4 = PythonScript(stop=stop_3)
# ---------- stop_4: Python ----------
from scriptcontext import sticky as st
from ur_fabrication_control.direct_control.common import send_stop

ur_ip = st["ur_ip"]
ur_port = st["ur_port"]

if stop:
    send_stop(ur_ip, ur_port)
# ---------- end stop_4 ----------

ur_base_plane_rhino_local_tf = Plane(transformations.ur_base_plane_rhino_local_tf)
ur_base_frame_rhino_local_tf = Data(transformations.ur_base_frame_rhino_local_tf)
pln_8 = Plane(transformations.mobile_base_plane_rhino_local_tf)

# ----
# Set Digital Out
number = Slider(7, range=0..10)
value = BooleanToggle(True)
digital_out = PythonScript(number=number, value=value)  # -> urscript; inputs number: Int32, value: Boolean
# ---------- digital_out: Python ----------
from ur_fabrication_control.direct_control import URScript

urscript = URScript()
urscript.start()
urscript.add_line("\tset_digital_out({}, {})".format(number, value))
urscript.end()
urscript = urscript.generate()

print(urscript)
# ---------- end digital_out ----------
send = Button()
send_2 = GhPythonScript(urscript=digital_out, send=send)  # -> out; inputs send: Boolean
# ---------- send_2: Python ----------
from scriptcontext import sticky as st
from ur_fabrication_control.direct_control import send_script

ur_ip = st["ur_ip"]
ur_port = st["ur_port"]

if send:
    send_script(urscript, ur_ip, ur_port)
# ---------- end send_2 ----------

# ----
# Labels
number_slider_6 = Slider(0.1, range=0..1)
pt_2 = Point([Point(0.298708097, 0.5173776006, 0), Point(-0.597416194, 0, 0), Point(0.298708097, -0.5173776006, 0), Point(0.597416194, 0, 0), Point(-0.298708097, 0.5173776006, 0), Point(-0.298708097, -0.5173776006, 0)])
python_3 = GhPythonScript(pts=pt_2)  # -> out, pts, labels; inputs pts: list
# ---------- python_3: Python ----------
import rhinoscriptsyntax as rs

labels = ['A','B','C','D','E','F']
# ---------- end python_3 ----------
tag = TextTag3D(Location=python_3.pts, Text=python_3.labels, Size=number_slider_6, Colour=RGB(0, 0, 0), Justification=5)

# ----
# Get Pose Joint
get = Button()
pose = PythonScript(get=get)  # -> configuration, pose_joints
# ---------- pose: Python ----------
from scriptcontext import sticky as st
from ur_fabrication_control.direct_control.common import get_current_pose_joints
from compas_fab.robots import Configuration


robot = st["robot"]

server_address = st["server_address"]
server_port = st["server_port"]
ur_port = st["ur_port"]
ur_ip = st["ur_ip"]


guid = str(ghenv.Component.InstanceGuid)
pose_joints_key = "pose_joints" + guid


# send script to the robot to receive the current joint configuration
if get:
    st[pose_joints_key] = get_current_pose_joints(server_address, server_port, ur_ip, ur_port, send=True)

if pose_joints_key not in st:
    configuration = Configuration.from_revolute_values([0,0,0,0,0,0])
else:
    configuration = Configuration.from_revolute_values(st[pose_joints_key])

pose_joints = configuration.values
# ---------- end pose ----------
panel_12 = Panel(pose.pose_joints)

# ----
# Tool
list_9 = ValueList({"measurement_tool": 0}, selected="measurement_tool")
show_2 = BooleanToggle(False)
list_10 = ValueList({"nozzle", "scanner"}, selected="nozzle")
py_6 = PythonScript()  # -> DATA; same code as py_3
python_4 = PythonScript(data_path=py_6, tool=list_9, tcp_frame=list_10, show=show_2)  # -> tool, M
# ---------- python_4: Python ----------
import os, math
from compas.geometry import Frame, Rotation
from compas.datastructures import Mesh
from compas_ghpython.artists import MeshArtist
from compas_fab.robots import Tool

tolerance = 0

if tool == 0:
    filename = 'measurement_tool_zaxis.stl'
    ee_frame = Frame([0, 0, 0.109], [1, 0, 0], [0, 1, 0])

data_path = os.path.join(data_path, "tool_geometry")
fullfilename = os.path.join(data_path, filename)
print fullfilename

ee_mesh = Mesh.from_stl(fullfilename)

#R = Rotation.from_axis_and_angle(ee_frame.zaxis, math.radians(180), point=ee_frame.point)
#ee_frame.transform(R)

if show:
    artist = MeshArtist(ee_mesh)
    M = artist.draw()

tool = Tool(ee_mesh, ee_frame)
# ---------- end python_4 ----------

# ----
# Get Pose Cartesian
get_2 = Button()
pose_2 = PythonScript(get=get_2, tool=python_4.tool, from_robot=Toggle(False))  # -> pose_cartesian, frame_WCS, plane_WCS
# ---------- pose_2: Python ----------
from scriptcontext import sticky as st
from ur_fabrication_control.direct_control.common import get_current_pose_cartesian
from compas.geometry import Frame
from compas_ghpython import draw_frame

robot = st["robot"]

server_address = st["server_address"]
server_port = st["server_port"]
ur_port = st["ur_port"]
ur_ip = st["ur_ip"]

# retrieve the current tool frame in axis angle format
if from_robot:
    if robot.attached_tool:
        tool_angle_axis = list(robot.attached_tool.frame.point) + list(robot.attached_tool.frame.axis_angle_vector)
    else:
        tool0_frame = Frame([0, 0, 0], [1, 0, 0], [0, 1, 0])
        tool_angle_axis = list(tool0_frame.point) + list(tool0_frame.axis_angle_vector)
else:
    tool_angle_axis = list(tool.frame.point) + list(tool.frame.axis_angle_vector)

print(tool_angle_axis)

guid = str(ghenv.Component.InstanceGuid)
pose_cartesian_key = "pose_cartesian" + guid


if get:
    st[pose_cartesian_key] = get_current_pose_cartesian(tool_angle_axis, server_address, server_port, ur_ip, ur_port, send=True)

if pose_cartesian_key not in st:
    pose_cartesian = []
else:
    pose_cartesian = st[pose_cartesian_key]

print(pose_cartesian)

# get frame and plane of the current pose cartesian in world coordinates for visualization
if pose_cartesian:
    frame_RCS = Frame.from_axis_angle_vector(axis_angle_vector=pose_cartesian[3:], point=pose_cartesian[:3])
    frame_WCS = robot.to_world_coordinates(frame_RCS)
    plane_WCS  = draw_frame(frame_WCS)
    print frame_RCS
    print frame_WCS
# ---------- end pose_2 ----------
draw_2 = GhPythonScript(frames=pose_2.frame_WCS, scale=Slider(0.1, range=0..1))  # -> P, V, W; inputs frames: list; same code as draw
vdisex_2 = VectorDisplayEx(Point=draw_2.P, Vector=draw_2.V, Colour=RGB(0, 0, 0), Width=draw_2.W)
panel_14 = Panel(pose_2.pose_cartesian)

# ----
# Move Cartesian
add = Button()
list_11 = ValueList({"send all positions": 0, "send only one position": 1, "from inverse": 2}, selected="send all positions")
crv_6 = Curve(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)
clear = Button()
idx = Slider(0, range=0..100)
hframes = HorizontalFrames(Curve=crv_6, Count=10)  # -> Frames, Parameters
rec_car = PythonScript(msg=pose_2.plane_WCS, rec=add, clear=clear)  # -> rec
# ---------- rec_car: Python ----------
from scriptcontext import sticky as st

guid = str(ghenv.Component.InstanceGuid)
recorded_key =  "recorded_" + guid
just_cleared_key = "just_cleared_" + guid


if recorded_key not in st:
    st[recorded_key] = []

if just_cleared_key not in st:
    st[just_cleared_key] = False

if clear:
    st[recorded_key] = []
    st[just_cleared_key] = True
else:
    if len(msg):
        if msg != [None] and not st[just_cleared_key] and rec:
            st[recorded_key].append(msg)
    st[just_cleared_key] = False
        


rec = st[recorded_key]

print rec
# ---------- end rec_car ----------
item_2 = ListItem(List=hframes.Frames, Index=idx, Wrap=True)
filter = StreamFilter(Gate=list_11, Stream0=hframes.Frames, Stream1=item_2, Stream2=rec_car)
radius = Slider(0.5, range=0..0.5)
movel = PythonScript(planes_WCS=filter, velocity=Slider(0.05, range=0..0.5), radius=radius)  # -> urscript; inputs planes_WCS: list
# ---------- movel: Python ----------
import Rhino.Geometry as rg
from compas.geometry import Frame
from compas.geometry import Transformation, Rotation
from compas_ghpython import draw_frame
from compas_fab.robots import robot
from ur_fabrication_control import direct_control 
import math

from scriptcontext import sticky as st
from ur_fabrication_control.direct_control import URScript

robot = st["robot"]

# retrieve the current tool frame in axis angle format
if robot.attached_tool:
    tool_angle_axis = list(robot.attached_tool.frame.point) + list(robot.attached_tool.frame.axis_angle_vector)
else:
    tool0_frame = Frame([0, 0, 0], [1, 0, 0], [0, 1, 0])
    tool_angle_axis = list(tool0_frame.point) + list(tool0_frame.axis_angle_vector)

print(tool_angle_axis)

frames_RCS = []
for plane_WCS in planes_WCS:
    frame_WCS = Frame(plane_WCS.Origin, plane_WCS.XAxis, plane_WCS.YAxis)
    frame_RCS = robot.to_local_coordinates(frame_WCS)
    frames_RCS.append(frame_RCS)

urscript = URScript()
urscript.start()
urscript.set_tcp(tool_angle_axis)
urscript.moves_linear(frames_RCS, velocity, radius)
urscript.end()

urscript = urscript.generate()

print(urscript)
# ---------- end movel ----------
send_3 = Button()
send_4 = GhPythonScript(urscript=movel, send=send_3)  # -> out; inputs send: Boolean; same code as send_2

# ----
# Move Circular
clear_2 = Button()
list_12 = ValueList({"send all positions": 0, "send only one position": 1, "from inverse": 2}, selected="from inverse")
add_2 = Button()
idx_2 = Slider(0, range=0..100)
crv_7 = Curve(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)
hframes_2 = HorizontalFrames(Curve=crv_7, Count=10)  # -> Frames, Parameters
rec_viacar = PythonScript(msg=pose_2.plane_WCS, rec=add_2, clear=clear_2)  # -> rec; same code as rec_car
item_3 = ListItem(List=hframes_2.Frames, Index=idx_2, Wrap=True)
filter_2 = StreamFilter(Gate=list_12, Stream0=hframes_2.Frames, Stream1=item_3, Stream2=rec_car)
filter_3 = StreamFilter(Gate=list_12, Stream0=hframes_2.Frames, Stream1=item_3, Stream2=rec_viacar)
radius_2 = Slider(0.5, range=0..0.5)
movec = PythonScript(planes_WCS=filter_2, planes_via_WCS=filter_3, velocity=Slider(0.075, range=0..0.5), radius=radius_2)  # -> urscript; inputs planes_WCS: list, planes_via_WCS: list
# ---------- movec: Python ----------
import Rhino.Geometry as rg
from compas.geometry import Frame
from compas.geometry import Transformation, Rotation
from compas_ghpython import draw_frame
from compas_fab.robots import robot
from ur_fabrication_control import direct_control 
import math

from scriptcontext import sticky as st
from ur_fabrication_control.direct_control import URScript

robot = st["robot"]

# retrieve the current tool frame in axis angle format
if robot.attached_tool:
    tool_angle_axis = list(robot.attached_tool.frame.point) + list(robot.attached_tool.frame.axis_angle_vector)
else:
    tool0_frame = Frame([0, 0, 0], [1, 0, 0], [0, 1, 0])
    tool_angle_axis = list(tool0_frame.point) + list(tool0_frame.axis_angle_vector)

frames_RCS = []
for plane_WCS in planes_WCS:
    frame_WCS = Frame(plane_WCS.Origin, plane_WCS.XAxis, plane_WCS.YAxis)
    frame_RCS = robot.to_local_coordinates(frame_WCS)
    frames_RCS.append(frame_RCS)

frames_via_RCS = []
for plane_WCS in planes_via_WCS:
    frame_WCS = Frame(plane_WCS.Origin, plane_WCS.XAxis, plane_WCS.YAxis)
    frame_RCS = robot.to_local_coordinates(frame_WCS)
    frames_via_RCS.append(frame_RCS)

urscript = URScript()
urscript.start()
urscript.moves_circular(frames_via_RCS, frames_RCS, velocity, radius)
urscript.end()

urscript = urscript.generate()

print(urscript)
# ---------- end movec ----------
send_5 = Button()
send_6 = GhPythonScript(urscript=movec, send=send_5)  # -> out; inputs send: Boolean; same code as send_2

# ----
# Move Process
list_13 = ValueList({"send all positions": 0, "send only one position": 1, "from inverse": 2}, selected="send all positions")
idx_3 = Slider(0, range=0..100)
crv_8 = Curve(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)
hframes_3 = HorizontalFrames(Curve=crv_8, Count=10)  # -> Frames, Parameters
item_4 = ListItem(List=hframes_3.Frames, Index=idx_3, Wrap=True)
filter_4 = StreamFilter(Gate=list_13, Stream0=hframes_3.Frames, Stream1=item_4, Stream2=rec_car)
radius_3 = Slider(0.5, range=0..0.5)
movep = PythonScript(planes_WCS=filter_4, velocity=Slider(0.075, range=0..0.5), radius=radius_3)  # -> urscript; inputs planes_WCS: list
# ---------- movep: Python ----------
import Rhino.Geometry as rg
from compas.geometry import Frame
from compas.geometry import Transformation, Rotation
from compas_ghpython import draw_frame
from compas_fab.robots import robot
from ur_fabrication_control import direct_control 
import math

from scriptcontext import sticky as st
from ur_fabrication_control.direct_control import URScript

robot = st["robot"]

# retrieve the current tool frame in axis angle format
if robot.attached_tool:
    tool_angle_axis = list(robot.attached_tool.frame.point) + list(robot.attached_tool.frame.axis_angle_vector)
else:
    tool0_frame = Frame([0, 0, 0], [1, 0, 0], [0, 1, 0])
    tool_angle_axis = list(tool0_frame.point) + list(tool0_frame.axis_angle_vector)

frames_RCS = []
for plane_WCS in planes_WCS:
    frame_WCS = Frame(plane_WCS.Origin, plane_WCS.XAxis, plane_WCS.YAxis)
    frame_RCS = robot.to_local_coordinates(frame_WCS)
    frames_RCS.append(frame_RCS)

urscript = URScript()
urscript.start()
urscript.moves_process(frames_RCS, velocity, radius)
urscript.end()

urscript = urscript.generate()

print(urscript)
# ---------- end movep ----------
send_7 = Button()
send_8 = GhPythonScript(urscript=movep, send=send_7)  # -> out; inputs send: Boolean; same code as send_2

panel_15 = Panel(pose.configuration)
number_slider_7 = Slider(0, range=0..10)  # disabled
number_slider_8 = Slider(0, range=0..10)  # disabled

# ----
# Stop Extruder
stop_5 = Button()
stop_6 = PythonScript(stop=stop_5)
# ---------- stop_6: Python ----------
import time
from scriptcontext import sticky as st
from mobile_fabrication_control.extruder_control.extruderclient import ExtruderClient

ext_ip = st["ext_ip"]
ext_port = st["ext_port"]

ec = ExtruderClient(ext_ip, ext_port)
wait_for_response = False

if stop:
    ec.connect()
    time.sleep(0.2)
    ec.send_stop(wait_for_response)
    time.sleep(0.2)
    ec.close()
# ---------- end stop_6 ----------

# ----
# Set Extruder data
speed = Slider(12000, range=0..51200)
# Direct extruder control
max_speed = Slider(17000, range=0..51200)
send_9 = Button()
value_2 = BooleanToggle(True)
extruder_data = PythonScript(motor_state=value_2, max_speed=max_speed, speed=speed, send=send_9)  # -> urscript; inputs motor_state: Boolean
# ---------- extruder_data: Python ----------
import time
from scriptcontext import sticky as st
from mobile_fabrication_control.extruder_control.extruderclient import ExtruderClient

ext_ip = st["ext_ip"]
ext_port = st["ext_port"]

ec = ExtruderClient(ext_ip, ext_port)
wait_for_response = False

if send:
    ec.connect()
    time.sleep(0.2)
    ec.send_motordata(motor_state, max_speed, speed, wait_for_response)
    time.sleep(0.2)
    ec.close()
# ---------- end extruder_data ----------

# ----
# Set Extruder data
acceleration = Slider(200, range=0..1000)
max_speed_2 = Slider(450, range=0..1000)
speed_2 = Slider(300, range=0..1000)
# Extruder control through UR
number_2 = Slider(0, range=0..10)
value_3 = BooleanToggle(True)
send_10 = Button()
extruder_data_2 = PythonScript(motor_id=number_2, motor_state=value_3, max_speed=max_speed_2, speed=speed_2, acceleration=acceleration, send=send_10)  # -> urscript; inputs motor_id: Int32, motor_state: Boolean
# ---------- extruder_data_2: Python ----------
from scriptcontext import sticky as st
from mobile_additive_manufacturing.control.urscript_extrusion import set_extruder_data

ur_ip = st["ur_ip"]
ur_port = st["ur_port"]
ext_ip = st["ext_ip"]
ext_port = st["ext_port"]

if send:
    set_extruder_data(ur_ip, ur_port, ext_ip, ext_port, motor_id, motor_state, max_speed, speed, acceleration)
# ---------- end extruder_data_2 ----------

# ----
# Get Extruder Info
# Only visible on UR Teach Pad
send_11 = Button()
get_info = PythonScript(send=send_11)  # -> info
# ---------- get_info: Python ----------
from scriptcontext import sticky as st
from mobile_additive_manufacturing.control.urscript_extrusion import get_extruder_info

ur_ip = st["ur_ip"]
ur_port = st["ur_port"]
ext_ip = st["ext_ip"]
ext_port = st["ext_port"]

if send:
    get_extruder_info(ur_ip, ur_port, ext_ip, ext_port)
# ---------- end get_info ----------

# ----
# Toggle Extruder
value_4 = BooleanToggle(True)
send_12 = Button()
extruder_state = PythonScript(state=value_4, send=send_12)  # -> urscript; inputs state: Boolean
# ---------- extruder_state: Python ----------
import time
from scriptcontext import sticky as st
from mobile_fabrication_control.extruder_control.extruderclient import ExtruderClient

ext_ip = st["ext_ip"]
ext_port = st["ext_port"]

ec = ExtruderClient(ext_ip, ext_port)
wait_for_response = False

if send:
    ec.connect()
    time.sleep(0.2)
    ec.send_motorstate(int(state), wait_for_response)
    time.sleep(0.2)
    ec.close()
# ---------- end extruder_state ----------

# ----
# Toggle Extruder
value_5 = BooleanToggle(True)
send_13 = Button()
extruder_state_2 = PythonScript(state=value_5, send=send_13)  # -> urscript; inputs state: Boolean
# ---------- extruder_state_2: Python ----------
from scriptcontext import sticky as st
from mobile_additive_manufacturing.control.urscript_extrusion import toggle_extruder

ur_ip = st["ur_ip"]
ur_port = st["ur_port"]
ext_ip = st["ext_ip"]
ext_port = st["ext_port"]

if send:
    toggle_extruder(ur_ip, ur_port, ext_ip, ext_port, state)
# ---------- end extruder_state_2 ----------

# ----
# Calculate Basis - 3-Point Method
# Measure basis:
# 1. Clear the recorded poses
# 2. Move robot to origin and press "get pose"
# 3. Move robot to point in positive x-axis and press "get pose"
# 4. Move robot to an other point in your basis and press "get pose"
# (The further away these positions are, the better)
# 
# 5. Alternatively change the order in the component calc base
# 6. Copy output into base component (TODO: check if it has to be inverted)
list_14 = ValueList({"o, pos.x-axis, xy pl": 0, "o, pos.y-axis, xy pl": 1}, selected="o, pos.x-axis, xy pl")
clear_3 = Button()
rec = PythonScript(msg=pose_2.pose_cartesian, rec=get_2, clear=clear_3)  # -> rec; inputs msg: list; same code as rec_car
calc_base = PythonScript(poses=rec, input_type=list_14)  # -> out, base_plane; inputs poses: list
# ---------- calc_base: Python ----------
import Rhino.Geometry as rg
import math


if len(poses) > 2:
    
    O = poses[0]
    P1 = poses[1]
    P2 = poses[2]
    
    if input_type == 0:
        # origin, pt on positive x-axis, pt in xy plane
        origin = rg.Point3d(O[0], O[1], O[2])
        pt_on_xaxis = rg.Point3d(P1[0], P1[1], P1[2])
        pt_in_xyplane = rg.Point3d(P2[0], P2[1], P2[2])
        
        xaxis = pt_on_xaxis - origin
        xaxis.Unitize()
        
        v = pt_in_xyplane - origin
        zaxis = rg.Vector3d.CrossProduct(v, xaxis)
        zaxis.Unitize()
        
        # zaxis must look up!
        if math.acos(rg.Vector3d.ZAxis * zaxis) > math.acos(rg.Vector3d.ZAxis * -zaxis):
            zaxis = -zaxis
        
        yaxis = rg.Vector3d.CrossProduct(zaxis, xaxis)
    
    elif input_type == 1:
        # origin, pt on positive y-axis, pt in xy plane
        origin = rg.Point3d(O[0], O[1], O[2])
        pt_on_yaxis = rg.Point3d(P1[0], P1[1], P1[2])
        pt_in_xyplane = rg.Point3d(P2[0], P2[1], P2[2])
        
        yaxis = pt_on_yaxis - origin
        yaxis.Unitize()
        
        v = pt_in_xyplane - origin
        zaxis = rg.Vector3d.CrossProduct(v, yaxis)
        zaxis.Unitize()
        
        # zaxis must look up!
        if math.acos(rg.Vector3d.ZAxis * zaxis) > math.acos(rg.Vector3d.ZAxis * -zaxis):
            zaxis = -zaxis
        
        xaxis = rg.Vector3d.CrossProduct(yaxis, zaxis)
        
        
    print "Copy the following into base component:"
    print " "
    print "origin = [%.2f, %.2f, %.2f]" % tuple(list(origin))
    print "xaxis = [%.5f, %.5f, %.5f]" % tuple(list(xaxis))
    print "yaxis = [%.5f, %.5f, %.5f]" % tuple(list(yaxis))
    

#print rg.Vector3d.CrossProduct(rg.Vector3d.YAxis, rg.Vector3d.ZAxis)
#print rg.Vector3d.CrossProduct(rg.Vector3d.ZAxis, rg.Vector3d.XAxis)

    base_plane = rg.Plane(origin, xaxis, xaxis)
# ---------- end calc_base ----------
panel_16 = Panel(rec)
panel_17 = Panel(calc_base.out)

# ----
# T_local
# Local Transformation (relative to workpiece)
# Calculate Basis - Point fitting method via RPC
d_00b = Point([Point(0.270908022, -0.2158758971, 0), Point(0.320908022, -0.1292733567, 0), Point(0.372408022, 0.04007274016, 0), Point(0.322408022, 0.1266752805, 0), Point(0.272408022, 0.2132778209, 0)])
b_00 = Point([Point(-0.220908022, 0.3024784375, 0), Point(-0.270908022, 0.2158758971, 0), Point(-0.320908022, 0.1292733567, 0), Point(-0.370908022, 0.04267081637, 0), Point(-0.372408022, -0.04007274016, 0), Point(-0.322408022, -0.1266752805, 0), Point(-0.272408022, -0.2132778209, 0), Point(-0.222408022, -0.2998803613, 0)])
a_00 = Point([Point(-0.1485, 0.3425511777, 0), Point(-0.0485, 0.3425511777, 0), Point(0.0515, 0.3425511777, 0), Point(0.1515, 0.3425511777, 0), Point(0.222408022, 0.2998803613, 0), Point(0.272408022, 0.2132778209, 0), Point(0.322408022, 0.1266752805, 0), Point(0.372408022, 0.04007274016, 0)])
c_00 = Point([Point(-0.1515, -0.3425511777, 0), Point(-0.0515, -0.3425511777, 0), Point(0.0485, -0.3425511777, 0), Point(0.1485, -0.3425511777, 0), Point(0.220908022, -0.3024784375, 0), Point(0.270908022, -0.2158758971, 0), Point(0.320908022, -0.1292733567, 0), Point(0.370908022, -0.04267081637, 0)])
d_00a = Point([Point(0.270908022, -0.2158758971, 0), Point(0.320908022, -0.1292733567, 0), Point(0.370908022, -0.04267081637, 0), Point(0.372408022, 0.04007274016, 0), Point(0.322408022, 0.1266752805, 0), Point(0.272408022, 0.2132778209, 0)])
e_00 = Point([Point(0.0515, 0.3425511777, 0), Point(-0.0485, 0.3425511777, 0), Point(-0.1485, 0.3425511777, 0), Point(-0.220908022, 0.3024784375, 0), Point(-0.270908022, 0.2158758971, 0), Point(-0.320908022, 0.1292733567, 0)])
f_00 = Point([Point(-0.372408022, -0.04007274016, 0), Point(-0.322408022, -0.1266752805, 0), Point(-0.272408022, -0.2132778209, 0), Point(-0.222408022, -0.2998803613, 0), Point(-0.1515, -0.3425511777, 0), Point(-0.0515, -0.3425511777, 0), Point(0.0485, -0.3425511777, 0), Point(0.1485, -0.3425511777, 0)])
init_guess_2 = Plane(pln_4)
calc_base_2 = PythonScript(poses=rec, base_plane_init_guess=init_guess_2, calc=Toggle(False))  # -> out, pts_mtip_init_guess, pts_mtip_fit, base_plane_fit; inputs poses: list, pts_cad: list of Point3d, base_plane_init_guess: Plane
# ---------- calc_base_2: Python ----------
import ghpythonlib.components as ghcomp
import Rhino.Geometry as rg
from scriptcontext import sticky as st
from compas.geometry import Frame
import math as m
import sys
from compas.rpc import Proxy # for calling the numpy function in CPython

#poses = [[-0.38248900000000002, -0.65991, -0.92396800000000001, 1.43926, -2.33921, -0.356576], [-0.40332200000000001, -0.561226, -0.92589100000000002, 1.39317, -2.5024600000000001, -0.45355000000000001], [-0.42333500000000002, -0.46363100000000002, -0.92523200000000005, 1.32002, -2.7929300000000001, -0.42181200000000002], [-0.44414100000000001, -0.364207, -0.92577699999999996, -1.1245799999999999, 2.7569599999999999, 0.54737599999999997], [-0.49800100000000003, -0.303369, -0.92580499999999999, -0.97646200000000005, 2.8092899999999998, 0.66510199999999997], [-0.59415899999999999, -0.27221099999999998, -0.92597399999999996, 0.74782499999999996, -2.8146399999999998, -0.69757899999999995], [-0.69017399999999995, -0.24166299999999999, -0.924068, 0.51681200000000005, -2.6232899999999999, -0.79130500000000004], [-0.78496699999999997, -0.21047299999999999, -0.92393599999999998, 0.396513, -2.6047699999999998, -0.78313699999999997]]

if len(poses):
    
    # get points from poses
    pts_mtip = [rg.Point3d(p[0], p[1], p[2]) for p in poses]
    
    T_W_R_init_guess = rg.Transform.PlaneToPlane(rg.Plane.WorldXY, base_plane_init_guess)
    pts_mtip_init_guess = [ghcomp.Transform(pt, T_W_R_init_guess) for pt in pts_mtip]
    
    # format Rhino transformation
    T_W_R_init_guess_flattened = [float(f) for f in T_W_R_init_guess.ToFloatArray(True)]
    T_W_R_init_guess_list = [T_W_R_init_guess_flattened[i:(i + 4)] for i in range(0, len(T_W_R_init_guess_flattened), 4)]  

    # format ptsA and ptsB
    dataB = [list(pt) for pt in pts_cad]
    dataA = [list(pt) for pt in pts_mtip]
    
    # call the function
    max_iterations = 1000
    
    if calc:
        icp_func = Proxy('ur_fabrication_control.optimisation.icp', python = 'C://ProgramData//Anaconda3//envs//mam21//python.exe')
        
        print icp_func._python

        transformation, distances = icp_func.icp(dataA, dataB, init_guess=T_W_R_init_guess_list, max_iterations=max_iterations, tolerance=0.000001)
        
        print "distances", distances
        
        # format result
        T = rg.Transform.Identity
        for i in range(4):
            for j in range(4):
                code = "T.M%i%i = %f" % (i, j, transformation[i][j])
                print code
                exec(code)
        #print T
        
        # now transform the points with the transformation calculated
        pts_mtip_fit = [ghcomp.Transform(pt, T) for pt in pts_mtip]
        base_plane_fit = ghcomp.Transform(rg.Plane.WorldXY, T)
        
        
        #f = Frame(base_plane_fit)
        #print f.get_pose_quaternion()
        
        # correct the zvalue
        #base_plane_fit = ghcomp.Transform(base_plane_fit, rg.Transform.Translation(0,0,-3))
# ---------- end calc_base_2 ----------
panel_18 = Panel(calc_base_2.out)
pt_3 = Point(calc_base_2.pts_mtip_init_guess)
pln_9 = Plane(calc_base_2.base_plane_fit)

section_points = Point(a_00)

# ----
# Direct UR Control
config = GhPythonScript()  # -> out, joint_configs
# ---------- config: Python ----------
from compas_fab.robots import Configuration

values=[-0.737876, -1.64531, 1.740348, -0.367801, -0.37385, -0.110741]
joint_configs = [Configuration.from_revolute_values(values)]
# ---------- end config ----------
pln_10 = Plane(calc_base.base_plane)

# ----
# Move Joints
clear_4 = Button()
add_3 = Button()
idx_4 = Slider(0, range=0..100)
list_15 = ValueList({"send all positions": 0, "send only one position": 1, "from inverse": 2}, selected="from inverse")
rec_joints = PythonScript(msg=pose.configuration, rec=add_3, clear=clear_4)  # -> rec
# ---------- rec_joints: Python ----------
from scriptcontext import sticky as st

guid = str(ghenv.Component.InstanceGuid)
recorded_key =  "recorded_" + guid
just_cleared_key = "just_cleared_" + guid


if recorded_key not in st:
    st[recorded_key] = []

if just_cleared_key not in st:
    st[just_cleared_key] = False

if clear:
    st[recorded_key] = []
    st[just_cleared_key] = True
else:
    if msg != [None] and not st[just_cleared_key] and rec:
        st[recorded_key].append(msg)
    st[just_cleared_key] = False
        


rec = st[recorded_key]

print rec
# ---------- end rec_joints ----------
item_5 = ListItem(List=config.joint_configs, Index=idx_4, Wrap=True)
filter_5 = StreamFilter(Gate=list_15, Stream0=config.joint_configs, Stream1=item_5, Stream2=rec_joints)
movej = PythonScript(joint_configurations=forward_kinematics, velocity=Slider(0.1, range=0..0.5))  # -> urscript, values; inputs joint_configurations: list
# ---------- movej: Python ----------
from ur_fabrication_control.direct_control import URScript
import math


"""
for c in joint_configurations:
    for i,v in enumerate(c.values):
        #print v
        if v>math.pi:
            v-=2*math.pi
        if v<-math.pi:
            v+=2*math.pi
        c.values[i]=v
print joint_configurations
values = joint_configurations[0].values
print([math.degrees(v) for v in values])
"""

#joint_config = ["movej({}, v={})".format(c.values, velocity/10) for c in joint_configurations]

urscript = URScript()
urscript.start()
for jc in joint_configurations:
    urscript.move_joint(jc, velocity)
urscript.end()

urscript = urscript.generate()

print(urscript)
# ---------- end movej ----------
send_14 = Button()
send_15 = GhPythonScript(urscript=movej.urscript, send=send_14)  # -> out; inputs send: Boolean; same code as send_2

pt_4 = Point(calc_base_2.pts_mtip_fit)

# ----
# Fabrication Data Record
add_4 = Button()
ur_base_plane_fit = Plane(Plane(origin=(0.586046, -0.830465, 0.927117), x=(-0.1740749409, -0.9847276658, 0.003055998963), y=(0.9847265004, -0.1740623089, 0.004003999145)))
ur_base_plane = Plane(Plane(origin=(0.577686147, -0.9211299713, 0.9165088743), x=(-0.1799735024, -0.9835716499, -0.01401242339), y=(0.9836099426, -0.1801032964, 0.008618783048)))
list_16 = ValueList({"A", "B", "C", "D", "E", "F"}, selected="E")
ur_roscp = Plane(Plane(origin=(-1.871807435, -4.291410429, 1.086838298), x=(-0.4735157802, -0.8807853348, 0), y=(0.8807853348, -0.4735157802, 0)))
pt_5 = Point(e_00)
python_5 = GhPythonScript(
    segment=list_16,
    layer=Slider(0, range=0..20),
    pts_cad=pt_5,
    ur_ros_plane=ur_roscp,
    ur_rhino_plane=ur_base_plane,
    ur_base_measured=ur_base_plane_fit,
    T_global=t_global,
    T_local=t_local.T_local,
    add=add_4,
    show_record=Toggle(True))  # -> out, point_record; inputs layer: Int32, pts_cad: list
# ---------- python_5: Python ----------
import rhinoscriptsyntax as rs
import os
from compas.geometry import Frame

repositories_path = os.path.abspath(os.path.join(ghdoc.Path,"../../../"))
filepath = os.path.abspath(os.path.join(ghdoc.Path,"../../../mobile_fabrication_control/data/fab_data_record.txt"))

fab_data_record = {}
points_list =[]


segment_id = '{0}{1}{2}'.format(segment, '_0', str(layer))
print segment_id

#print(T_global)
if pts_cad and ur_ros_plane and ur_rhino_plane and T_global:
    
    for p in pts_cad:
        pt = rs.coerce3dpoint(p)
        points_list.append([pt.X, pt.Y, pt.Z])
    
    fab_data_record['points_cad'] = points_list
    fab_data_record['ur_ros_plane'] = Frame(ur_ros_plane.Origin, ur_ros_plane.XAxis, ur_ros_plane.YAxis)
    fab_data_record['ur_rhino_plane'] = Frame(ur_rhino_plane.Origin, ur_rhino_plane.XAxis, ur_rhino_plane.YAxis)
    fab_data_record['ur_base_measured'] = Frame(ur_base_measured.Origin, ur_base_measured.XAxis, ur_base_measured.YAxis)
    fab_data_record['T_global'] = T_global
    fab_data_record['T_local'] = T_local
    fab_data_record['segment_id'] = segment_id
    
    if add:
        f = open(filepath, "a")
        f.write((str(fab_data_record) + "\n" + "\n"))
        f.close()
    
if show_record:
    f = open(filepath, "r")
    point_record=f.read()
# ---------- end python_5 ----------
point_record = Panel(python_5.point_record)
segment_id = Panel(python_5.out)

# ----
# Calculate Basis - Point fitting method via RPC
plane_init_guess = Plane(Plane(origin=(0, 0, 0), x=(0, -1, 0), y=(1, 0, 0)))
pt_6 = Point([<point referenced from the Rhino model> x3])
calc_base_3 = PythonScript(poses=rec, pts_cad=pt_6, base_plane_init_guess=plane_init_guess, calc=Toggle(False))  # -> out, pts_mtip_init_guess, pts_mtip_fit, base_plane_fit; inputs poses: list, pts_cad: list of Point3d, base_plane_init_guess: Plane
# ---------- calc_base_3: Python ----------
import ghpythonlib.components as ghcomp
import Rhino.Geometry as rg
from scriptcontext import sticky as st
from compas.geometry import Frame
import math as m
import sys
from compas.rpc import Proxy # for calling the numpy function in CPython


if len(poses):
    
    # get points from poses
    pts_mtip = [rg.Point3d(p[0], p[1], p[2]) for p in poses]
    
    T_W_R_init_guess = rg.Transform.PlaneToPlane(rg.Plane.WorldXY, base_plane_init_guess)
    pts_mtip_init_guess = [ghcomp.Transform(pt, T_W_R_init_guess) for pt in pts_mtip]
    
    # format Rhino transformation
    T_W_R_init_guess_flattened = [float(f) for f in T_W_R_init_guess.ToFloatArray(True)]
    T_W_R_init_guess_list = [T_W_R_init_guess_flattened[i:(i + 4)] for i in range(0, len(T_W_R_init_guess_flattened), 4)]  

    # format ptsA and ptsB
    dataB = [list(pt) for pt in pts_cad]
    dataA = [list(pt) for pt in pts_mtip]
    
    # call the function
    max_iterations = 100
    
    if calc:
        icp_func = Proxy('ur_fabrication_control.optimisation.icp', python = 'C://Users//kathrind//anaconda3//envs//ur_fab//python.exe')
        
        print icp_func._python

        transformation, distances = icp_func.icp(dataA, dataB, init_guess=T_W_R_init_guess_list, max_iterations=max_iterations, tolerance=0.000001)
        
        print "distances", distances
        
        # format result
        T = rg.Transform.Identity
        for i in range(4):
            for j in range(4):
                code = "T.M%i%i = %f" % (i, j, transformation[i][j])
                print code
                exec(code)
        #print T
        
        # now transform the points with the transformation calculated
        pts_mtip_fit = [ghcomp.Transform(pt, T) for pt in pts_mtip]
        base_plane_fit = ghcomp.Transform(rg.Plane.WorldXY, T)
        
        
        #f = Frame(base_plane_fit)
        #print f.get_pose_quaternion()
        
        # correct the zvalue
        #base_plane_fit = ghcomp.Transform(base_plane_fit, rg.Transform.Translation(0,0,-3))
# ---------- end calc_base_3 ----------
pt_7 = Point(calc_base_3.pts_mtip_init_guess)
pt_8 = Point(calc_base_3.pts_mtip_fit)
pln_11 = Plane(calc_base_3.base_plane_fit)

# ----
# Toggle Extruder and Air
max_speed_3 = Slider(16000, range=0..16000)
speed_3 = Slider(1000, range=0..16000)
send_16 = Button()
value_6 = BooleanToggle(False)
list_17 = ValueList({"8"}, selected="8")
extruder_data_3 = PythonScript(state=value_6, max_speed=max_speed_3, speed=speed_3, pin=list_17, send=send_16)  # -> urscript; inputs state: Boolean
# ---------- extruder_data_3: Python ----------
import time
from scriptcontext import sticky as st
from mobile_fabrication_control.extruder_control.extruderclient import ExtruderClient

ext_ip = st["ext_ip"]
ext_port = st["ext_port"]

ec = ExtruderClient(ext_ip, ext_port)
wait_for_response = False

if send:
    ec.connect()
    time.sleep(0.2)
    ec.send_motordata(int(state), max_speed, speed, wait_for_response)
    ec.send_set_do(pin, int(state), wait_for_response)
    time.sleep(0.2)
    ec.close()
# ---------- end extruder_data_3 ----------

# ----
# Toggle Extruder and Air
max_speed_4 = Slider(24000, range=0..24000)
speed_4 = Slider(1000, range=0..16000)
value_7 = BooleanToggle(True)
send_17 = Button()
list_18 = ValueList({"8"}, selected="8")
extruder_data_4 = PythonScript(state=value_7, max_speed=max_speed_4, speed=speed_4, pin=list_18, send=send_17)  # -> urscript; inputs state: Boolean; same code as extruder_data_3

# ----
# Stop Extruder
stop_7 = Button()
stop_8 = PythonScript(stop=stop_7)
# ---------- stop_8: Python ----------
from scriptcontext import sticky as st
from mobile_additive_manufacturing.control.urscript_extrusion import stop_extruder

ur_ip = st["ur_ip"]
ur_port = st["ur_port"]
ext_ip = st["ext_ip"]
ext_port = st["ext_port"]

if stop:
    stop_extruder(ur_ip, ur_port, ext_ip, ext_port)
# ---------- end stop_8 ----------

# ----
# Toggle air
value_8 = BooleanToggle(True)
send_18 = Button()
list_19 = ValueList({"8"}, selected="8")
digital_out_2 = PythonScript(pin=list_19, state=value_8, send=send_18)  # -> urscript; inputs pin: Int32, state: Boolean
# ---------- digital_out_2: Python ----------
import time
from scriptcontext import sticky as st
from mobile_fabrication_control.extruder_control.extruderclient import ExtruderClient

ext_ip = st["ext_ip"]
ext_port = st["ext_port"]

ec = ExtruderClient(ext_ip, ext_port)
wait_for_response = False

if send:
    ec.connect()
    time.sleep(0.2)
    ec.send_set_do(pin, int(state), wait_for_response)
    time.sleep(0.2)
    ec.close()
# ---------- end digital_out_2 ----------

list_20 = ValueList({"30", "32", "34"}, selected="30")

# ----
# Set Extruder Digital Out
value_9 = BooleanToggle(True)
send_19 = Button()
digital_out_3 = PythonScript(pin=list_20, state=value_9, send=send_19)  # -> urscript; inputs pin: Int32, state: Boolean
# ---------- digital_out_3: Python ----------
from scriptcontext import sticky as st
from mobile_additive_manufacturing.control.urscript_extrusion import set_extruder_digital_out

ur_ip = st["ur_ip"]
ur_port = st["ur_port"]
ext_ip = st["ext_ip"]
ext_port = st["ext_port"]

if send:
    set_extruder_digital_out(ur_ip, ur_port, ext_ip, ext_port, pin, state)
# ---------- end digital_out_3 ----------

list_21 = ValueList({"30", "32", "34"}, selected="34")

# ----
# Toggle fan
value_10 = BooleanToggle(True)
send_20 = Button()
digital_out_4 = PythonScript(pin=list_21, state=value_10, send=send_20)  # -> urscript; inputs pin: Int32, state: Boolean
# ---------- digital_out_4: Python ----------
from scriptcontext import sticky as st
from mobile_additive_manufacturing.control.urscript_extrusion import toggle_fan

ur_ip = st["ur_ip"]
ur_port = st["ur_port"]
ext_ip = st["ext_ip"]
ext_port = st["ext_port"]

if send:
    toggle_fan(ur_ip, ur_port, ext_ip, ext_port, pin, state)
# ---------- end digital_out_4 ----------

list_22 = ValueList({"30", "32", "34"}, selected="32")

# ----
# Toggle air
value_11 = BooleanToggle(True)
send_21 = Button()
digital_out_5 = PythonScript(pin=list_22, state=value_11, send=send_21)  # -> urscript; inputs pin: Int32, state: Boolean
# ---------- digital_out_5: Python ----------
from scriptcontext import sticky as st
from mobile_additive_manufacturing.control.urscript_extrusion import toggle_air

ur_ip = st["ur_ip"]
ur_port = st["ur_port"]
ext_ip = st["ext_ip"]
ext_port = st["ext_port"]

if send:
    toggle_air(ur_ip, ur_port, ext_ip, ext_port, pin, state)
# ---------- end digital_out_5 ----------

toggle_2 = BooleanToggle(False)

# ----
# Size offset integration
len = Length(Curve=layers.base_crvs)

# ----
# Segmentation
number_slider_9 = Slider(0.016, range=0..0.1)
number_slider_10 = Slider(50, range=0..100)
number_slider_11 = Slider(6, range=0..10)

dom_2 = ConstructDomain(DomainStart=0, DomainEnd=number_slider_10)
subset = SubList(List=len, Domain=dom_2, Wrap=True)  # -> List, Index
avr = Average(Input=subset.List)
expression_3 = Expression(u_val=number_slider_11, avg=avr, offset=number_slider_3, Expression="offset/(avg/(u_val/2))")
subtraction = Subtraction(A=expression_2, B=expression_3)
addition = Addition(A=expression, B=expression_3)

python_6 = GhPythonScript(
    base_crvs=layers.base_crvs,
    seg_lrs=number_slider_10,
    start_t=dam.DataBase_crv_tstart,
    wave_length=number_slider_9,
    layer_width=Slider(0.006, range=0..0.1),
    u_val=number_slider_11,
    min_seg_width_0=subtraction,
    min_seg_width_1=addition)  # -> out, curve_segments, crvs_pars, crvs_pts, ond_segs, norm_segs; inputs base_crvs: list of Curve, u_val: Int32
# ---------- python_6: Python ----------
__author__ = "Gido"
__version__ = "2022.01.16"
import ghpythonlib.components as ghcomp
import Rhino.Geometry as rg
import rhinoscriptsyntax as rs
import math

crvs_pts = []
crvs_new = []
ond_segs = []
norm_segs = []

def segment_range(start, stop, step):
    count = 0
    while True:
        temp = float(start + count * step)
        if temp > stop:
            break
        yield temp
        count += 1 

def segment_range_loop(start, domain, div):
    step = (domain[1]-domain[0])/div
    count = 0
    while True:
        temp = float(start + count * step)
        if count == div:
            break
        if temp > domain[1]:
            temp -= domain[1]
            temp += domain[0]
        elif temp < domain[0]:
            temp += domain[1]
            temp -= domain[0]
        yield temp
        count += 1 

max_seg_width_0 = 1-min_seg_width_0
max_seg_width_1 = 1-min_seg_width_1

for key, crv in enumerate(base_crvs):
    new_par = start_t
    crv_len = ghcomp.Length(crv)
    crv_dom = ghcomp.CurveDomain(crv)[1]
    
    ### Create segmentation points
    m = key % (2*seg_lrs)
    if m < seg_lrs:
        crv_s0 = ((crv_len*min_seg_width_0)/(u_val/2))+((crv_len*(max_seg_width_1-min_seg_width_0))/(u_val/2)/seg_lrs)*m
    else:
        crv_s0 = ((crv_len*max_seg_width_1)/(u_val/2))-((crv_len*(max_seg_width_1-min_seg_width_0))/(u_val/2)/seg_lrs)*(m%seg_lrs)
    crv_s1 = (crv_len/(u_val/2))-crv_s0
    
    crv_inc_ts = []
    for i in range(u_val):
        if i == 0:
            inc_t = crv_s0/2
        elif i % 2 == 0:
            inc_t = crv_s0
        else:
            inc_t = crv_s1
        crv_inc_ts.append(inc_t)
    len_dom = ghcomp.ConstructDomain(0,crv_len)
    dpars = ghcomp.RemapNumbers(value = crv_inc_ts,
                                source = len_dom,
                                target = crv_dom)[0]
                                
    crv_pars = []
    for dpar in dpars:
        new_par += (dpar - crv_dom[0])
        if new_par > crv_dom[1]:
            new_par = new_par - crv_dom[1] + crv_dom[0]
        crv_pars.append(new_par)
    
    pts = ghcomp.EvaluateCurve(crv, crv_pars)[0]
    crvs_pts.extend(pts)
    
    ### Apply wave to crv globally
    crv_div = ghcomp.Round(crv_len/(wave_length*9))["nearest"]*9
    Ty = [math.sin(((j%4)*2*math.pi/4)+(key%2)*math.pi) for j in range(crv_div*4)]
    crv_range = segment_range_loop(crv_pars[0], crv_dom, (crv_div*4))
    crv_range = list(crv_range)
    crv_range = ghcomp.SortList(crv_range, crv_range)[1]
    crvpts, crvtans, crvangs = ghcomp.EvaluateCurve(crv, crv_range)
    new_pts = []
    vecs = ghcomp.CrossProduct(crvtans, rg.Vector3d.ZAxis, True)[0]
    nvec = []
    for i, vec in enumerate(vecs):
        nvec.append(rg.Vector3d(vec[0]*Ty[i]*layer_width,vec[1]*Ty[i]*layer_width,vec[2]))
    new_pts = ghcomp.Move(crvpts, nvec)[0]
    new_pts.append(new_pts[0])
    crvs_new.append(ghcomp.Interpolate(new_pts,3,False,0)[0])
    crv_new_dom = ghcomp.CurveDomain(crvs_new[key])[1]
    
    ### Segmentize the wavy curve
    cut_planes = ghcomp.PerpFrame(crv, crv_pars)
    new_crv_pars = []
    for cp in cut_planes:
        new_par = ghcomp.CurveXPlane(crvs_new[key], cp)[1]
        parpts = ghcomp.EvaluateCurve(crvs_new[key], new_par)[0]
        lvec = ghcomp.Vector2Pt(cp.Origin, parpts, False)[0]
        lvec_lens = ghcomp.VectorLength(lvec)
        if type(lvec_lens) == list:
            ind = lvec_lens.index(min(ghcomp.VectorLength(lvec)))
        else:
            new_par = [new_par]
            ind = 0
        new_crv_pars.append(new_par[ind])

    curve_segments = ghcomp.Shatter(crvs_new[key], new_crv_pars)
    print len(curve_segments)
    
    ### Combine segment cut at curve start (NO LONGER NECCESARY)
    if len(curve_segments) > 6:
        seg_lens = ghcomp.Length(curve_segments)
        new_segs = [0]*6
        min_len = min(seg_lens)
        shift = True
        
        if seg_lens.index(min_len) == 0:
            crv_cp6 = ghcomp.ControlPoints(curve_segments[6])[0]
            crv_cp0 = ghcomp.ControlPoints(curve_segments[0])[0]
            new_segs[5] = ghcomp.Interpolate(crv_cp6+crv_cp0,3,False,0)[0]
            shift = True
        elif seg_lens.index(min_len) == 6:
            crv_cp6 = ghcomp.ControlPoints(curve_segments[6])[0]
            crv_cp0 = ghcomp.ControlPoints(curve_segments[0])[0]
            new_segs[0] = ghcomp.Interpolate(crv_cp6+crv_cp0,3,False,0)[0]
            shift = True
        else:
            crv_cpn = ghcomp.ControlPoints(curve_segments[seg_lens.index(min_len)])[0]
            crv_cpn1 = ghcomp.ControlPoints(curve_segments[seg_lens.index(min_len)-1])[0]
            new_segs[seg_lens.index(min_len)] = ghcomp.Interpolate(crv_cpn+crv_cpn1,3,False,0)[0]
            shift = True
        
        for i in range(5):
            if seg_lens.index(min_len) == 6:
                new_segs[i+1] = curve_segments[i+1] 
            elif seg_lens.index(min_len) == 0:
                new_segs[i] = curve_segments[i+1] 
            else:
                if i >= seg_lens.index(min_len)-1:
                    k = i+1
                else:
                    k = i
                new_segs[k] = curve_segments[k]
    
    ### FOR 6 SEGMENTS
    else:
        new_segs = curve_segments
        if key != 0:
            seg0start = ghcomp.EndPoints(curve_segments[0])[0]
            segn1start = ghcomp.EndPoints(ond_segs[(key-1)*u_val])[0]
            dvec = ghcomp.Vector2Pt(seg0start, segn1start, False)
            if dvec.length > 0.025:
                shift = True
            else:
                shift = False
        else:
            shift = False
    new_segs = ghcomp.ShiftList(new_segs, -shift, True)
    ond_segs.extend(new_segs)

    new_norm_segs = ghcomp.Shatter(crv, crv_pars)
    if key != 0:
        seg0start = ghcomp.EndPoints(new_norm_segs[0])[0]
        segn1start = ghcomp.EndPoints(norm_segs[(key-1)*u_val])[0]
        dvec = ghcomp.Vector2Pt(seg0start, segn1start, False)
        if dvec.length > 0.025:
            shift = True
        else:
            shift = False
    else:
        shift = False
    new_norm_segs = ghcomp.ShiftList(new_norm_segs, -shift, True)
    norm_segs.extend(new_norm_segs)
#    segs_off = ghcomp.OffsetCurve(curve = segs_unw,
#                                  distance = 0.01,
#                                  corners = 0)

# ------------------------------------------------------------------------------------------------
#    crvs_segs.extend(segs_off)
#    di_crv = 0
#    for seg in curve_segments:
#        seg_off = ghcomp.OffsetCurve(curve = seg,
#                                     distance = 0.01,
#                                     corners = 0)
#        crvs_new.extend([seg, seg_off])
#        seg_len = ghcomp.Length(seg)
#        seg_div = ghcomp.Round(seg_len/wave_length)["nearest"]
##        Ty = [math.sin(((i%4)*2*math.pi/4)+(key%2)*math.pi) for i in range(1+seg_div*4)]
#        rp_seg, seg_dom = ghcomp.CurveDomain(seg)
#        seg_range = segment_range(seg_dom[0], seg_dom[1], (seg_dom[1]-seg_dom[0])/(seg_div*4))
#        segpts, segtans, segangs = ghcomp.EvaluateCurve(seg, seg_range)
#        new_pts = []
#        vecs = ghcomp.CrossProduct(segtans, rg.Vector3d.ZAxis, True)[0]
#        nvec = []
#        for i, vec in enumerate(vecs):
#            nvec.append(rg.Vector3d(vec[0]*Ty[di_crv+i]*layer_width,vec[1]*Ty[di_crv+i]*layer_width,vec[2]))
#        new_pts = ghcomp.Move(segpts, nvec)[0]
#        di_crv += seg_div
#        segs_new.append(ghcomp.Interpolate(new_pts, 3, False, 1)[0])
#    print di_crv
# ---------- end python_6 ----------
pt_9 = Point(python_6.crvs_pts)
crv_9 = Curve(python_6.ond_segs)

crv_10 = Curve(python_6.curve_segments)
crv_11 = Curve(python_6.norm_segs)
dam_2 = DataDam(DataA=crv_9, DataB=crv_11, BufferDelay=10000000, BufferMode=0)  # -> DataA, DataB

# ----
# AM Model
number_slider_12 = Slider(0.005, range=-1..1)
speed_5 = Slider(8000, range=0..51200)
ind = Slider(5, range=0..30)
pt_10 = ConstructPoint(XCoordinate=0, YCoordinate=0, ZCoordinate=Slider(-0.02, range=-0.1..0.01))
list_23 = ValueList({"Full", "Segment"}, selected="Segment")
xy = XYPlane(Origin=pt_10)
ammodel = GhPythonScript(
    output=list_23,
    tangential_z=Toggle(False),
    rotation_z=Slider(5, range=-45..45),
    ond_segs=dam_2.DataA,
    norm_segs=dam_2.DataB,
    div_length=Slider(0.004, range=0..0.1),
    ind_current_seg=ind,
    trim_left=Slider(10, range=0..30),
    trim_right=Slider(4, range=0..30),
    offset_left_bot=Slider(0.005, range=-1..1),
    offset_right_bot=number_slider_12,
    fade_to_top=Toggle(True),
    ext_speed=speed_5,
    create=Toggle(True),
    cp=xy)  # -> out, current_seg, fab_norm_segs, fab_ond_segs, am_model; inputs ond_segs: list of Curve, norm_segs: list of Curve, ind_current_seg: Int32
# ---------- ammodel: Python ----------
__author__ = "Gido"
__version__ = "2022.01.27"
import math

from am_information_model import AMModel
from am_information_model import Layer
from am_information_model import Node

from compas.geometry import Frame
from compas.geometry import Transformation
from compas.geometry import Rotation
from compas.geometry import Vector

from scriptcontext import sticky as st
import rhinoscriptsyntax as rs
import Rhino.Geometry as rg
import ghpythonlib.components as ghcomp

if "am_model" not in st:
    st["am_model"] = None

hseq = [5,1,3,4,0,2]
vseq = [50]*3+[100]*21+[50]*3

ct = int(len(ond_segs)/len(hseq))
h_ond_segs = [[]]*ct
h_norm_segs = [[]]*ct
for u in range(ct):
    h_ond_segs[u] = ond_segs[u*len(hseq):(u+1)*len(hseq)]
    h_norm_segs[u] = norm_segs[u*len(hseq):(u+1)*len(hseq)]

h_ond_segs = map(list, zip(*h_ond_segs))
h_norm_segs = map(list, zip(*h_norm_segs))

fab_ond_segs = [[]]*len(vseq)
fab_norm_segs = [[]]*len(vseq)
for v in range(len(vseq)):
    hsind = hseq[v%6]
    vsind = int((v-v%6)/6)
    if vsind > 0:
        dom_start = 0
        for i in range(vsind):
            dom_start += vseq[i*6+v%6]
    else:
        dom_start = 0
    fab_ond_segs[v] = h_ond_segs[hsind][dom_start:dom_start+vseq[v]]
    fab_norm_segs[v] = h_norm_segs[hsind][dom_start:dom_start+vseq[v]]

current_seg = fab_ond_segs[ind_current_seg] + fab_norm_segs[ind_current_seg]

if create and output=="Segment":
    am_model = AMModel()
    fab_norm_seg = fab_norm_segs[ind_current_seg]
    fab_norm_mid = ghcomp.CurveMiddle(fab_norm_seg)
    if tangential_z:
        zvecs = ghcomp.Vector2Pt(fab_norm_mid[0:len(fab_norm_mid)-1], fab_norm_mid[1:len(fab_norm_mid)], True)[0]
        zvecs.append(zvecs[-1])
    else:
        zvecs = [rg.Vector3d.ZAxis]*len(fab_norm_seg)
    fab_seg = fab_ond_segs[ind_current_seg]
    for i, seg in enumerate(fab_seg):
#        seg_end_pts = ghcomp.EndPoints(fab_norm_seg[i])
#        seg_off_left_bot = ghcomp.OffsetCurve(fab_norm_seg[i], -offset_left_bot+(offset_left_bot/len(fab_seg))*i, corners=0)
#        seg_off_right_bot = ghcomp.OffsetCurve(fab_norm_seg[i], -offset_right_bot+(offset_right_bot/len(fab_seg))*i, corners=0)
#        seg_off_left_bot_end_pts = ghcomp.EndPoints(seg_off_left_bot) 
#        seg_off_right_bot_end_pts = ghcomp.EndPoints(seg_off_right_bot) 
#        vec_off_left = ghcomp.Vector2Pt(seg_end_pts[0], seg_off_left_bot_end_pts[0], False)[0]
#        vec_init = Vector.from_start_end(seg_end_pts[0], seg_end_pts[1])
#        vec_off_right = Vector.from_start_end(seg_off_left_bot_end_pts[0], seg_off_right_bot_end_pts[1])
#        angle_correction = vec_init.angle_signed(vec_off_right, Vector.Zaxis())
        
#        seg_off_left = ghcomp.Move(seg, vec_off_left)[0]
#        seg_corr = ghcomp.Rotate3D(seg_off_left, angle_correction, seg_off_left_bot_end_pts[0], rg.Vector3d.ZAxis)[0]
        
        mid_plane = ghcomp.PerpFrame(fab_norm_seg[i], ghcomp.CurveClosestPoint(fab_norm_mid[i], fab_norm_seg[i])[1])
        cvec = ghcomp.Vector2Pt(mid_plane.Origin, rg.Plane.WorldXY.Origin, True)[0]
        
        if cvec[0]/abs(cvec[0]) == mid_plane.XAxis[0]/abs(mid_plane.XAxis[0]):
            xvec = mid_plane.XAxis
        else:
            xvec = -mid_plane.XAxis
        
        seg_end_pts = ghcomp.EndPoints(fab_norm_seg[i])
        vec_init = Vector.from_start_end(seg_end_pts[0], seg_end_pts[1])
        
        if fade_to_top:
            offset_left = (-offset_left_bot+(offset_left_bot/len(fab_seg))*i)
            offset_right = (-offset_right_bot+(offset_right_bot/len(fab_seg))*i)
        else:
            offset_left = -offset_left_bot
            offset_right = -offset_right_bot
        
        seg_off_left = ghcomp.Move(seg, xvec*offset_left)[0]
        norm_seg_off_left = ghcomp.Move(fab_norm_seg[i], xvec*offset_left)[0]
        norm_seg_off_left_bot_end_pts = ghcomp.EndPoints(norm_seg_off_left)
        
        pt_off_right = ghcomp.Move(seg_end_pts[1], xvec*offset_right)[0]
        vec_off_right = Vector.from_start_end(norm_seg_off_left_bot_end_pts[0], pt_off_right)
        angle_correction = vec_init.angle_signed(vec_off_right, Vector.Zaxis())
        print angle_correction
        
        seg_corr = ghcomp.Rotate3D(seg_off_left, angle_correction, norm_seg_off_left_bot_end_pts[0], rg.Vector3d.ZAxis)[0]
        
        seg_pts = ghcomp.DivideLength(seg_corr, div_length)[0]
        seg_np = len(seg_pts)
        norm_seg_tans = ghcomp.DivideCurve(fab_norm_seg[i], seg_np-1, False)[1]
        norm_seg_tans = ghcomp.UnitVector(norm_seg_tans)
        yvecs = ghcomp.CrossProduct(norm_seg_tans, zvecs[i], True)[0]
        nyvecs = []
        print len(norm_seg_tans), seg_np
        for k, yvec in enumerate(yvecs):
            nyvec = ghcomp.Rotate3D(yvec, math.radians(rotation_z), seg_pts[k], norm_seg_tans[k])[0]
            nyvecs.append(nyvec)
        layer = Layer()
        layer.mid_frame = Frame(fab_norm_mid[i], xvec, -mid_plane.ZAxis)
        if i%2==1:
            seg_pts.reverse()
            norm_seg_tans.reverse()
            nyvecs.reverse()
        for k, pt in enumerate(seg_pts):
            if i%2==0 and (k < trim_left or k>len(seg_pts)-trim_right):
                pass
            elif i%2==1 and (k < trim_right or k>len(seg_pts)-trim_left):
                pass
            else:
                frame = Frame(pt, norm_seg_tans[k], nyvecs[k])
#                R = Rotation.from_axis_and_angle(frame.zaxis, math.pi/6, frame.point)
#                frame.transform(R)
                node = Node(frame, 0.003)
                if k == len(seg_pts)-trim_right:
                    node.ext_state = 0
                    node.air_state = 1
                else:
                    node.ext_state = 1
                    node.air_state = 1
                node.ext_speed = ext_speed
                layer.add_node(node)
        am_model.add_layer(layer)

if create and output=="Full":
    am_model = AMModel()
    for j, fab_seg in enumerate(fab_ond_segs):
        fab_norm_seg = fab_norm_segs[j]
        fab_norm_mid = ghcomp.CurveMiddle(fab_norm_seg)
        zvecs = ghcomp.Vector2Pt(fab_norm_mid[0:len(fab_norm_mid)-1], fab_norm_mid[1:len(fab_norm_mid)], True)[0]
        zvecs.append(zvecs[-1])
        for i, seg in enumerate(fab_seg):
            seg_len = ghcomp.Length(seg)
            seg_np = int(seg_len/0.002)
            seg_pts = ghcomp.DivideCurve(seg, seg_np, False)[0]
            norm_seg_tans = ghcomp.DivideCurve(fab_norm_seg[i], seg_np, False)[1]
            norm_seg_tans = ghcomp.UnitVector(norm_seg_tans)
            yvecs = ghcomp.CrossProduct(norm_seg_tans, zvecs[i], True)[0]
            layer = Layer()
            mid_plane = ghcomp.PerpFrame(fab_norm_seg[i], ghcomp.CurveClosestPoint(fab_norm_mid[i], fab_norm_seg[i])[1])
            cvec = ghcomp.Vector2Pt(mid_plane.Origin, rg.Plane.WorldXY.Origin, True)[0]
            if cvec[0]/abs(cvec[0]) == mid_plane.XAxis[0]/abs(mid_plane.XAxis[0]):
                xvec = mid_plane.XAxis
            else:
                xvec = -mid_plane.XAxis
            layer.mid_frame = Frame(fab_norm_mid[i], xvec, -mid_plane.ZAxis)
            for k, pt in enumerate(seg_pts):
                if k < trim_left or k>len(seg_pts)-trim_right:
                    pass
                else:
                    frame = Frame(pt, norm_seg_tans[k], yvecs[k])
    #                R = Rotation.from_axis_and_angle(frame.zaxis, -math.pi/3, frame.point)
    #                frame.transform(R)
                    node = Node(frame, 0.003)
                    if k == len(seg_pts)-trim_right:
                        node.ext_state = 0
                        node.air_state = 1
                    else:
                        node.ext_state = 1
                        node.air_state = 1
                    node.ext_speed = ext_speed
                    layer.add_node(node)
            am_model.add_layer(layer)

if cp is not None and create:
    cf = Frame(cp.Origin, cp.XAxis, cp.YAxis)
    of = Frame([0,0,0],[1,0,0], [0,1,0])
    T = Transformation.from_frame_to_frame(of,cf)
    am_model_tf = am_model.transformed(T)
    st["am_model"] = am_model_tf
    
am_model = st["am_model"]
# ---------- end ammodel ----------
crv_12 = Curve(ammodel.current_seg)

# ----
# Scan Model
number_slider_13 = Slider(0.015, range=-0.1..0.1)
list_24 = ValueList({"TOP", "BOT", "NUM"}, selected="NUM")
scanning = GhPythonScript(
    output=list_24,
    layer_number=Slider(90, range=0..100),
    cp=xy,
    norm_segs=ammodel.fab_norm_segs,
    ind_current_seg=ind,
    offset_dist=number_slider_13,
    rotation_z=Slider(5, range=-45..45),
    create=Toggle(True))  # -> out, scan_model; inputs layer_number: Int32, norm_segs: list, ind_current_seg: Int32
# ---------- scanning: Python ----------
__author__ = "Gido"
__version__ = "2022.02.04"

import math
import rhinoscriptsyntax as rs
import Rhino.Geometry as rg
import ghpythonlib.components as ghcomp
from scriptcontext import sticky as st
from compas.geometry import Frame
from compas.geometry import Vector
from compas.geometry import Transformation

from am_information_model import AMModel
from am_information_model import Layer
from am_information_model import Node

if "scan_model" not in st:
    st["scan_model"] = None

div_len = 0.01

if create and output=="TOP":
    top_crv = norm_segs[ind_current_seg][-1]
    top_crv = ghcomp.Orient(top_crv, rg.Plane.WorldXY, cp)[0]
    off_crv_pos = ghcomp.OffsetCurve(top_crv, -offset_dist, corners=0)
    off_crv_neg = ghcomp.OffsetCurve(top_crv, offset_dist, corners=0)
    pts1, tans1, pars1 = ghcomp.DivideLength(top_crv, div_len)
    pts2, tans2, pars2 = ghcomp.DivideLength(off_crv_pos, div_len)
    pts3, tans3, pars3 = ghcomp.DivideLength(off_crv_neg, div_len)
#    pts2.reverse()
    pts3.reverse()
    
#    tans2.reverse()
    tans3.reverse()
    
    pts = pts2
    tans = tans2

#    start, end = ghcomp.EndPoints(top_crv)
#    scan_line = ghcomp.Line(start,end)
#    pts, tans, pars = ghcomp.DivideLength(scan_line, 0.005)
    scan_frames = []
    for i, pt in enumerate(pts):
        xvec = ghcomp.CrossProduct(tans[i], -rg.Vector3d.ZAxis, True)[0]
        nxvec = ghcomp.Rotate3D(xvec, math.radians(rotation_z), pt, tans[i])[0]
        scan_frames.append(Frame(pt, nxvec, tans[i]))
    scan_model = AMModel()
    nodes = [Node(frame, 0.005) for frame in scan_frames]
    nodes.extend(list(reversed(nodes)))
    layer = Layer.from_nodes(nodes)
    scan_model.add_layer(layer)
    st["scan_model"] = scan_model
    
if create and output=="BOT":
    bot_crv = norm_segs[ind_current_seg-6][-1]
    bot_crv = ghcomp.Orient(bot_crv, rg.Plane.WorldXY, cp)[0]
    off_crv_pos = ghcomp.OffsetCurve(bot_crv, -offset_dist, corners=0)
    off_crv_neg = ghcomp.OffsetCurve(bot_crv, offset_dist, corners=0)
    pts1, tans1, pars1 = ghcomp.DivideLength(bot_crv, div_len)
    pts2, tans2, pars2 = ghcomp.DivideLength(off_crv_pos, div_len)
    pts3, tans3, pars3 = ghcomp.DivideLength(off_crv_neg, div_len)
    pts2.reverse()
    pts3.reverse()
    
    tans2.reverse()
    tans3.reverse()
    
#    pts =  pts2 + pts1
#    tans = tans2 + tans1
    pts =  pts2
    tans = tans2
    scan_frames = []
    for i, pt in enumerate(pts):
        xvec = ghcomp.CrossProduct(tans[i], -rg.Vector3d.ZAxis, True)[0]
        nxvec = ghcomp.Rotate3D(xvec, math.radians(rotation_z), pt, tans[i])[0]
        scan_frames.append(Frame(pt, nxvec, tans[i]))
    scan_model = AMModel()
    nodes = [Node(frame, 0.005) for frame in scan_frames]
    nodes.extend(list(reversed(nodes)))
    layer = Layer.from_nodes(nodes)
    scan_model.add_layer(layer)
    st["scan_model"] = scan_model

if create and output=="NUM":
    num_crv = norm_segs[ind_current_seg][layer_number]
    num_crv = ghcomp.Orient(num_crv, rg.Plane.WorldXY, cp)[0]
    off_crv_pos = ghcomp.OffsetCurve(num_crv, offset_dist, corners=0)
    off_crv_neg = ghcomp.OffsetCurve(num_crv, -offset_dist, corners=0)
    pts1, tans1, pars1 = ghcomp.DivideLength(num_crv, div_len)
    pts2, tans2, pars2 = ghcomp.DivideLength(off_crv_pos, div_len)
    pts3, tans3, pars3 = ghcomp.DivideLength(off_crv_neg, div_len)
#    pts2.reverse()
#    pts3.reverse()
#    
#    tans2.reverse()
#    tans3.reverse()
    
    pts = pts2
    tans = tans2

#    start, end = ghcomp.EndPoints(num_crv)
#    scan_line = ghcomp.Line(start,end)
#    pts, tans, pars = ghcomp.DivideLength(scan_line, 0.005)
    scan_frames = []
    for i, pt in enumerate(pts):
        xvec = ghcomp.CrossProduct(tans[i], -rg.Vector3d.ZAxis, True)[0]
        nxvec = ghcomp.Rotate3D(xvec, math.radians(rotation_z), pt, tans[i])[0]
        scan_frames.append(Frame(pt, nxvec, tans[i]))
    scan_model = AMModel()
    nodes = [Node(frame, 0.005) for frame in scan_frames]
    nodes.extend(list(reversed(nodes)))
    layer = Layer.from_nodes(nodes)
    scan_model.add_layer(layer)
    st["scan_model"] = scan_model

scan_model = st["scan_model"]
# ---------- end scanning ----------

# ---- group: Visualise
# AM_Model Visualization
# 1. Visualise the entire assembly.
# 2. Visualise the assembly process by setting a counter and a speed.
counter = CountThroughList(am_model=ammodel.am_model, start=start, stop=stop, step=step, step_back=back, reset=reset, full=full, interval=list_4)  # -> item, counter; inputs start: Boolean, stop: Boolean, step_back: Boolean
# ---------- counter: Python ----------
from scriptcontext import sticky as st
from compas_ghpython import update_component


L = list(am_model.layers())
# store data in component
guid = str(ghenv.Component.InstanceGuid)
counter_key = "counter_" + guid
running_key = "running_" + guid

if counter_key not in st:
    st[counter_key] = 0

if running_key not in st:
    st[running_key] = False
    

if st[running_key]:
    if st[counter_key] < len(L) - 1:
        st[counter_key] += 1
        update_component(ghenv, interval)
    else:
        st[counter_key] = 0
        st[running_key] = False
    
    
if start:
    st[running_key] = True

if stop:
    st[running_key] = False

if step:
    if st[counter_key] < len(L) - 1:
        st[counter_key] += 1

if step_back:
    if st[counter_key] < len(L) - 1:
        st[counter_key] -= 1

if reset:
    st[counter_key] = 0

if full:
    st[counter_key] = len(L)-1

if len(L):
    item = L[st[counter_key]]



#st["visualisation_counter"] = st[counter_key]
counter = st[counter_key]
# ---------- end counter ----------
show_3 = BooleanToggle(False)
show_4 = BooleanToggle(True)
draw_3 = PythonScript(am_model=ammodel.am_model, show_all=show_3, show_counter=show_4, counter=Slider(30, range=0..100))  # -> G, tool_planes_WCS, current_tool_plane, current_layer_planes; inputs counter: Int32
# ---------- draw_3: Python ----------
import os
import sys

import math

from compas_ghpython.artists import MeshArtist
from compas_ghpython import draw_frame

#from assembly_information_model.artist import AssemblyArtist


G = []

key_index = am_model.network.key_index()
keys = [key_index[key] for key in am_model.network.nodes()]
layers = [am_model.layer(key) for key in keys] 

tool_planes_WCS = [draw_frame(layer.node(0).frame) for layer in layers]

current_tool_plane = tool_planes_WCS[counter]
current_layer_planes = [draw_frame(frame) for frame in layers[counter].path]

if show_all and not show_counter:
    for layer in layers:
        for key, node in layer.nodes():
            plane = draw_frame(node.frame)
            G.append(plane)

if show_counter:
    for layer in layers[0:counter+1]:
        for key, node in layer.nodes():
            plane = draw_frame(node.frame)
            G.append(plane)
# ---------- end draw_3 ----------
idx_5 = Panel(counter.counter)
pln_12 = Plane(draw_3.current_tool_plane)
pln_13 = Plane(draw_3.current_layer_planes)
pln_14 = Plane(draw_3.tool_planes_WCS)  # disabled
geo = Geometry(draw_3.G)
preview = CustomPreview(Geometry=geo, Shader=ColourSwatch(SwatchColor=RGBA(255, 186, 220, 146)))

# ---- group: inverse kinematics
select_configuration = Slider(2, range=0..7)
inverse = PythonScript(robot=robot, group=info.main_group_name, plane_WCS=pln_12, idx=select_configuration)  # -> out, plane_tool0_RCS, plane_tcp_RCS, configuration; inputs plane_WCS: Plane, idx: Int32
# ---------- inverse: Python ----------
import Rhino.Geometry as rg
import math
from compas.geometry import Frame, Transformation, Rotation
from compas_fab.robots import Configuration
from ur_fabrication_control.kinematics.ur_kinematics import inverse_kinematics
from ur_fabrication_control.kinematics.ur_params import ur_params
from compas_ghpython import draw_frame

tcp_WCS = Frame(plane_WCS.Origin, plane_WCS.XAxis, plane_WCS.YAxis)

# transform frame to robot coordinate system
print tcp_WCS
print plane_WCS
tcp_RCS = robot.RCF_in_WCF.to_local_coordinates(tcp_WCS)
tool0_RCS = robot.from_tcf_to_t0cf([tcp_RCS])[0]
tool0_RCS_rot = Frame(tool0_RCS.point, tool0_RCS.zaxis, tool0_RCS.yaxis)
print tcp_RCS
print tool0_RCS
plane_tool0_RCS = draw_frame(tool0_RCS)
plane_tcp_RCS = draw_frame(tcp_RCS)
# calculate solutions to frame
ur_params = ur_params["ur10e"] # get the parameters according to the robot model
print ur_params
solutions = inverse_kinematics(tool0_RCS, ur_params)
print solutions

if not len(solutions):
    joint_values = [0,0,0,0,0,0]
    configuration = Configuration.from_revolute_values(joint_values)
else:
    joint_values = solutions[idx]
    #print joint_values
    
    ### ***** HACK ***** ##### TODO: CHECK!!!
    for i, v in enumerate(joint_values):
        if v > math.pi:
            v -= 2*math.pi
        if v < -math.pi:
            v += 2*math.pi
        joint_values[i] = v
    ### ***** HACK ***** ##### TODO: CHECK!!!
    configuration = [Configuration.from_revolute_values(joint_values)]

print(configuration)
# ---------- end inverse ----------

select_configuration_2 = Slider(2, range=0..7)
inverse_2 = PythonScript(robot=robot, planes_WCS=pln_13, plane_nr=plane_nr, idx=select_configuration_2)  # -> out, plane_tool0_RCS, plane_tcp_RCS, configuration; inputs planes_WCS: list of Plane, plane_nr: Int32, idx: Int32
# ---------- inverse_2: Python ----------
import Rhino.Geometry as rg
import math
from compas.geometry import Frame, Transformation, Rotation
from compas_fab.robots import Configuration
from ur_fabrication_control.kinematics.ur_kinematics import inverse_kinematics
from ur_fabrication_control.kinematics.ur_params import ur_params
from compas_ghpython import draw_frame

plane_WCS = planes_WCS[plane_nr]
tcp_WCS = Frame(plane_WCS.Origin, plane_WCS.XAxis, plane_WCS.YAxis)

# transform frame to robot coordinate system
tcp_RCS = robot.RCF_in_WCF.to_local_coordinates(tcp_WCS)
tool0_RCS = robot.from_tcf_to_t0cf([tcp_RCS])[0]

print tcp_RCS
print tool0_RCS
plane_tool0_RCS = draw_frame(tool0_RCS)
plane_tcp_RCS = draw_frame(tcp_RCS)
# calculate solutions to frame
ur_params = ur_params["ur10e"] # get the parameters according to the robot model
solutions = inverse_kinematics(tool0_RCS, ur_params)

if not len(solutions):
    joint_values = [0,0,0,0,0,0]
    configuration = Configuration.from_revolute_values(joint_values)
else:
    joint_values = solutions[idx]
    #print joint_values
    
    ### ***** HACK ***** ##### TODO: CHECK!!!
    for i, v in enumerate(joint_values):
        if v > math.pi:
            v -= 2*math.pi
        if v < -math.pi:
            v += 2*math.pi
        joint_values[i] = v
    ### ***** HACK ***** ##### TODO: CHECK!!!
    
    configuration = [Configuration.from_revolute_values(joint_values)]

print(configuration)
# ---------- end inverse_2 ----------

# ----
# 4.
list_25 = ValueList({"0 forward_kinematics": 0, "1 inverse_kinematics": 1, "2 inverse_kinematics": 2}, selected="2 inverse_kinematics")
filter_6 = StreamFilter(Gate=list_25, Stream0=forward_kinematics, Stream1=inverse.configuration, Stream2=inverse_2.configuration)

# ----
# Visualisation
show_end_effector_frame = BooleanToggle(True)
show_base_frame = BooleanToggle(True)
show_collision = BooleanToggle(False)
show_frames = BooleanToggle(False)
show_visual = BooleanToggle(True)
show_acm = BooleanToggle(False)
visualize = PythonScript(
    robot=robot,
    tool=python_2.tool,
    group=info.main_group_name,
    configuration=filter_6,
    redraw=py_5,
    show_visual=show_visual,
    show_collision=show_collision,
    show_end_effector_frame=show_end_effector_frame,
    show_frames=show_frames,
    show_base_frame=show_base_frame,
    show_acm=show_acm,
    station=list_6)  # -> out, robot, visual, collision, attached_meshes, frames, ee_frame, tool0_frame, base_frame, base_pt; inputs redraw: list, attached_collision_meshes: list, station_pts: list
# ---------- visualize: Python ----------
import rhinoscriptsyntax as rs
import Rhino.Geometry as rg
import ghpythonlib.components as ghcomp
from compas.geometry import Vector
from compas.geometry import Point
from compas.geometry import Transformation
from compas.geometry import Frame
from compas_ghpython.artists import MeshArtist
from compas_ghpython.utilities import draw_frame
from compas_fab.robots import Configuration
from ur_fabrication_control.kinematics.ur_kinematics import forward_kinematics
from ur_fabrication_control.kinematics.ur_params import ur_params

print(configuration)

if robot and configuration:
    
    robot.update(configuration, visual=show_visual, collision=show_collision)
    ur_params = ur_params[robot.main_group_name]
    print(ur_params)
    if show_visual:
        visual = robot.artist.draw_visual()
        robot_RCF = draw_frame(robot.RCF_in_WCF)
        init_robot_plane = rg.Plane(rg.Point3d(0.207, 0.0, 1.215), rg.Vector3d(-0.707, 0.707, 0.0), rg.Vector3d(-0.707, -0.707,0.0))
        visual = ghcomp.Orient(visual, init_robot_plane, robot_RCF)[0]
        
    if show_collision:
        collision = robot.artist.draw_collision()
    
    frames = robot.transformed_frames(configuration, group)

    if show_base_frame:
        base_frame = frames[0]

    if show_end_effector_frame:
#        tool0_frame = forward_kinematics(configuration.revolute_values, ur_params)
        tool0_frame = robot.forward_kinematics(configuration, group)
        print tool0_frame
        ee_frame = robot.from_t0cf_to_tcf([tool0_frame])
        print("End-effector", ee_frame)
    
    if not show_frames:
        frames = None

#    frame = forward_kinematics(configuration.revolute_values, ur_params)
    frame = robot.forward_kinematics(configuration, options=dict(solver='model', link_name=robot.attached_tool.link_name))
    #robot.artist.update_tool(visual=visual, collision=collision, transformation=Transformation.from_frame_to_frame(Frame.worldXY(), tool0_frame))
    
    if show_acm:
        M = []
        for acm in attached_collision_meshes:
            frame = robot.forward_kinematics(configuration, options=dict(solver='model', link_name=acm.link_name))
            T = Transformation.from_frame_to_frame(Frame.worldXY(), frame)
            mesh = acm.collision_mesh.mesh.transformed(T)
            M.append(MeshArtist(mesh).draw())
        attached_meshes = M
# ---------- end visualize ----------
geo_2 = Geometry(visualize.visual)
geo_3 = Geometry(visualize.collision)
draw_4 = GhPythonScript(
    frames=[visualize.frames, visualize.ee_frame, visualize.base_frame, visualize.tool0_frame],
    scale=Slider(0.1, range=0..1))  # -> P, V, C, W; inputs frames: list; same code as draw
preview_2 = CustomPreview(Geometry=geo_2, Shader=ColourSwatch(SwatchColor=RGB(105, 105, 105)))
preview_3 = CustomPreview(Geometry=visualize.attached_meshes, Shader=ColourSwatch(SwatchColor=RGB(255, 255, 255)))
vdisex_3 = VectorDisplayEx(Point=draw_4.P, Vector=draw_4.V, Colour=draw_4.C, Width=draw_4.W)

# ---- group: Visualise
# Scan_Model Visualization
# 1. Visualise the entire assembly.
# 2. Visualise the assembly process by setting a counter and a speed.
counter_2 = CountThroughList(
    am_model=scanning.scan_model,
    start=start_2,
    stop=stop_2,
    step=step_2,
    step_back=back_2,
    reset=reset_2,
    full=full_2,
    interval=list_5)  # -> item, counter; inputs start: Boolean, stop: Boolean, step_back: Boolean; same code as counter
show_5 = BooleanToggle(True)
show_6 = BooleanToggle(True)
idx_6 = Panel(counter_2.counter)
draw_5 = PythonScript(am_model=scanning.scan_model, show_all=show_5, show_counter=show_6, counter=idx_6)  # -> G, tool_planes_WCS, current_tool_plane, current_layer_planes; inputs counter: Int32; same code as draw_3
pln_15 = Plane(draw_5.current_tool_plane)
pln_16 = Plane(draw_5.current_layer_planes)
geo_4 = Geometry(draw_5.G)
pln_17 = Plane(draw_5.tool_planes_WCS)
preview_4 = CustomPreview(Geometry=geo_4, Shader=ColourSwatch(SwatchColor=RGBA(255, 186, 220, 146)))

# ----
# Continuous fabrication
ur_speed = Slider(0.012, range=0..1)
Z = UnitZ(Factor=Slider(0.8, range=0..1))
create_tasks = Button()
start_3 = Button()
stop_9 = Button()
move = Move(Motion=Z)  # -> Geometry, Transform
timer = Timer(Interval=1000, TimerInterval=1000, Target=continuous_operation_multiple_layers)
continuous_operation_multiple_layers = GhPythonScript(
    fabrication=fabrication.fabrication,
    am_model=ammodel.am_model,
    am_safety_plane=move.Geometry,
    robot=create.robot,
    ur_speed=ur_speed,
    create_tasks=create_tasks,
    start=start_3,
    stop=stop_9,
    skip_task=skip_task,
    undo_task=undo_task,
    revise_task=revise_task)  # -> out, msgs, states, tasks, exit_msgs, current_task, task_key_current, fabrication
# ---------- continuous_operation_multiple_layers: Python ----------
import time
from scriptcontext import sticky as st

import sys, os
import math

from compas.geometry import Frame
from compas.geometry import Rotation
from compas.geometry import Vector
from compas_ghpython import update_component
from extruder_control.extruderclient import ExtruderClient
from ur_fabrication_control.direct_control import URScript

ur_ip = st["ur_ip"]
ur_port = st["ur_port"]
server_ip = st["server_address"]
server_port = st["server_port"]
ext_ip = st["ext_ip"]
ext_port = st["ext_port"]

ec = ExtruderClient(ext_ip, ext_port)

def create_tasks_from_am_model(am_model):
    fabrication.am_model = am_model.copy()
    for key, layer in fabrication.am_model.layers():
        exit_message = "Layer{}_completed".format(key)
        layer_urscript = get_layer_ur_script(layer, key, exit_message)
        fabrication.add_task(layer_urscript, exit_message)

def get_frames_in_RCS(frames):
    return [robot.RCF_in_WCF.to_local_coordinates(frame) for frame in frames]

def limit_frames_rotation(frames, lnum, init_rot = -30, init_rot_frames=15):
    lfrs = []
    veca2ds = []
    yvec2ds = []
    for i, frame in enumerate(frames):
        new_frame = frame.copy()
        if lnum%2 == 0:
            if i<init_rot_frames:
                R = Rotation.from_axis_and_angle(new_frame.zaxis, math.radians(init_rot)*math.cos(i*(math.pi/(2*init_rot_frames))), new_frame.point)
            elif i>len(frames)-init_rot_frames:
                R = Rotation.from_axis_and_angle(new_frame.zaxis, 0, new_frame.point)
            else:
                R = Rotation.from_axis_and_angle(new_frame.zaxis, math.radians(30), new_frame.point)
        else:
            if i<init_rot_frames:
                R = Rotation.from_axis_and_angle(new_frame.zaxis, 0, new_frame.point)
            elif i>len(frames)-init_rot_frames:
                R = Rotation.from_axis_and_angle(new_frame.zaxis, math.radians(init_rot)*math.cos((math.pi/2)-(i-(len(frames)-init_rot_frames))*(math.pi/(2*init_rot_frames))), new_frame.point)
            else:
                R = Rotation.from_axis_and_angle(new_frame.zaxis, math.radians(30), new_frame.point)
        new_frame.transform(R)
        veca3d = Vector.from_start_end(frame.point, Frame.worldXY().point)
        veca2d = Vector(veca3d.x, veca3d.y, 0)
        yvec2d = Vector(new_frame.yaxis[0], new_frame.yaxis[1], 0)
        anglea = yvec2d.angle_signed(veca2d, Vector.Zaxis())
        print anglea
        if anglea > math.pi/2:
            R = Rotation.from_axis_and_angle(frame.zaxis, math.pi/2-anglea, frame.point)
            new_frame.transform(R)
        elif anglea < -math.pi/2:
            R = Rotation.from_axis_and_angle(frame.zaxis, -math.pi/2-anglea, frame.point)
            new_frame.transform(R)
        lfrs.append(new_frame)
#        veca2dartist = VectorArtist(veca2d)
#        yvec2dartist = VectorArtist(yvec2d)
#        veca2ds.append(veca2dartist.draw()[0])
#        yvec2ds.append(yvec2dartist.draw()[0])
    return lfrs

def get_layer_ur_script(layer, layer_number, exit_message):
    ur_script = URScript(ur_ip=ur_ip, ur_port=ur_port)
    tool_angle_axis = list(robot.attached_tool.frame.point) + list(robot.attached_tool.frame.axis_angle_vector)
    
    ur_script.start()
    ur_script.set_tcp(tool_angle_axis)
    RCS_frames = get_frames_in_RCS([node.frame for key, node in layer.nodes()])
    RCS_frames = limit_frames_rotation(RCS_frames, layer_number)
    radii = [node.radius for key, node in layer.nodes()]
    
    ur_script.socket_open(server_ip, server_port, "Feedbackserver")
    
    if layer_number == 0:
        ur_script.move_linear(RCS_frames[0], ur_speed, 0.0)
    else:
        ur_script.move_linear(RCS_frames[0], ur_speed/3, 0.0)
    node_msg = {"LAYER":layer_number, "NODE":0}
    ur_script.socket_send_line_string(str(node_msg), socket_name="Feedbackserver")
    for key, RCS_frame in enumerate(RCS_frames[1:len(RCS_frames)]):
        ur_script.move_process(RCS_frame, ur_speed, radii[key])
        node_msg = {"LAYER":layer_number, "NODE":key}
        ur_script.socket_send_line_string(str(node_msg), socket_name="Feedbackserver")
#    ur_script.socket_open(server_ip, server_port, "Feedbackserver") # BS: Opening socket at the beginning of the loop
#    for key, node in layer.nodes():
#        node_message = "[Nodal Information Relay]:L_" + str(layer_number) + "_N_" + str(key) # BS: Standardized message to send to AM Information Model (message should contain layer and nodal information and be easy to post-process)
#        if key in [0,1] and node.is_constructed == False:
#            ur_script.move_linear(robot.to_local_coordinates(node.frame), velocity=ur_speed, radius=node.radius)
##            ur_script.move_linear(node.frame, velocity=ur_speed, radius=node.radius)
#            ur_script.socket_send_line_string(node_message, socket_name="Feedbackserver") # BS: Send the string "node_message" to the socket
#        elif key == layer.number_of_nodes() and include_extruder and node.is_constructed == False:
#            ur_script.move_process(robot.to_local_coordinates(node.frame), ur_speed, node.radius)
##            ur_script.move_process(node.frame, ur_speed, node.radius)
#            node.extruder_state = 0 # BS: This is the key of the last node of the layer, therefore extruder_state must be zero. I think?
#            ur_script.socket_send_line_string(node_message, socket_name="Feedbackserver") # BS: Send the string "node_message" to the socket
#        elif node.is_constructed == False:
#            ur_script.move_process(robot.to_local_coordinates(node.frame), ur_speed, node.radius)
##            ur_script.move_process(node.frame, ur_speed, node.radius)
#            ur_script.socket_send_line_string(node_message, socket_name="Feedbackserver") # BS: Send the string "node_message" to the socket
    ur_script.socket_close(name="Feedbackserver")# BS: Closing socket at the end of the loop
    # Signify ready
    ur_script.socket_open(server_ip, server_port, "Feedbackserver")
    ur_script.socket_send_line_string(exit_message, socket_name="Feedbackserver")
    ur_script.socket_close(name="Feedbackserver")# BS: Closing socket at the end of the loop
    #Finalize script
    ur_script.end()
    ur_script.generate()
    return ur_script

def get_stop_ur_script(safety_plane):
    safety_frame_WCS = Frame(safety_plane.Origin, safety_plane.XAxis, safety_plane.YAxis)
    safety_frame_RCS = ur_frame_local.to_local_coordinates(safety_frame_WCS)
#    safety_frame_RCS = safety_frame_WCS
    ur_script = URScript(ur_ip=ur_ip, ur_port=ur_port)
    tool_angle_axis = list(robot.attached_tool.frame.point) + list(robot.attached_tool.frame.axis_angle_vector)
    ur_script.start()
    ur_script.set_tcp(tool_angle_axis)
    ur_script.move_linear(safety_frame_RCS, velocity=ur_speed, radius=0)
    ur_script.end()
    ur_script.generate()
    return ur_script

if create_tasks:
    fabrication.current_task = 0
    fabrication.clear_tasks()
    fabrication.stop_task = get_stop_ur_script(am_safety_plane)
    create_tasks_from_am_model(am_model)

# BS: New button added, "revise task"
if revise_task:
    layer_exit_message = fabrication.tasks[fabrication.get_next_task()]["exit_message"]
    layer_key = int(layer_exit_message.split("_")[0][5:]) # BS: Assuming the convention of "Layer{}_completed".format(key) is followed
    fabrication.tasks[fabrication.get_next_task()]["task"] = get_layer_ur_script(am_model.layer(layer_key),layer_key, layer_exit_message)

if stop:
    fabrication.stop()

if start:
    fabrication.start()

if skip_task:
    skip_key = fabrication.get_next_task()
    fabrication.tasks[skip_key]["state"] = "completed"
    fabrication.current_task+=1

if undo_task:
    undo_key = fabrication.get_next_task()-1
    fabrication.tasks[undo_key]["state"] = "waiting"
    if fabrication.current_task != 0:
        fabrication.current_task-=1

try:
    fab = fabrication
except NameError:
    fabrication = None
else:
    task_dict = fabrication.tasks.values()
    if fabrication.tasks_available():
        if fabrication.current_task == None:
            task_key_current = fabrication.get_next_task()
        else:
            task_key_current = fabrication.current_task
        current_task = task_dict[task_key_current]["task"].script
    tasks = []
    states = []
    exit_msgs = []
    for task in task_dict:
        tasks.append(task["task"])
        states.append(task["state"])
        exit_msgs.append(task["exit_message"])
    msgs = fabrication.server.msgs.values()
#    # BS: Updating the am_model by reacting to the appropriate server message(s)
#    if len(msgs) != 0:
#        if isinstance(msgs[-1], String()):
#            if msgs[-1].split(":")[0] == "[Nodal Information Relay]": # BS: Grabbing last entry in the last - very hacky. Don't like it. Other options? len(msgs) parameter compared to a continuously updated variable?
#                
#                info = msgs[-1].split(":")[1].split("_")
#                layer = int(info[1])
#                node = int(info[-1])
#                
#                motor_state = am_model.layer(layer).node(node).extruder_state
#                speed = am_model.layer(layer).node(node).extruder_speed
#                direct_extruder_control(motor_state, 4000, speed, False)
#                
#                am_model.layer(layer).node(node).is_constructed = True
#                am_model.layer(layer).node(node).extruder_state = 0 # BS: If it's been constructed, state should now be 0
#                
#            elif msgs[-1].split("_")[0][:5] == "Layer":
#                layer = int(msgs[-1].split("_")[0][5:])
#                am_model.layer(layer).is_constructed = True
# ---------- end continuous_operation_multiple_layers ----------
states = Panel(continuous_operation_multiple_layers.states)
server_messages = Panel(continuous_operation_multiple_layers.msgs)
current_task = Panel(continuous_operation_multiple_layers.current_task)
tasks = Panel(continuous_operation_multiple_layers.tasks)
exit_message = Panel(continuous_operation_multiple_layers.exit_msgs)

# ----
# Mobile Base Movement
number_slider_14 = Slider(0.4, range=0..1)  # disabled
mobile_base_frames = GhPythonScript(am_model=ammodel.am_model, fab_norm_segs=ammodel.fab_norm_segs, offset=number_slider_14, seg_layers=number_slider_10)  # -> out, planes, rb_frames; inputs fab_norm_segs: list; disabled
# ---------- mobile_base_frames: Python ----------
import rhinoscriptsyntax as rs
from compas_ghpython.utilities import draw_frame
from compas.geometry import Frame
import ghpythonlib.components as ghcomp
import Rhino.Geometry as rg

count = 0
for sub in fab_norm_segs:
    for i in sub:
        count+=1 
rest = count - seg_layers*6
num = int(rest/(seg_layers*2))
seg = [seg_layers]*3+[seg_layers*2]*num+[seg_layers]*3

k = 0
planes = []
rb_frames = []

### ONLY VALID FOR FULL AMMODEL
#for i, s in enumerate(seg[0:6]):
#    layer = am_model.layer(key=k, data=False)
#    mframe = layer.mid_frame
#    new_pt = mframe.point + mframe.xaxis*-offset
#    new_pt = [new_pt[0], new_pt[1], 0.0]
#    frame = Frame(new_pt, mframe.xaxis, mframe.yaxis)
#    k += s
#    rb_frames.append(frame)
#    planes.append(draw_frame(frame))

### VALID FOR BOTH SEGMENT AND FULL AMMODEL
for i, s in enumerate(seg[0:6]):
    fab_seg = fab_norm_segs[i][0]
    seg_mid = ghcomp.CurveMiddle(fab_seg)
    mid_plane = ghcomp.PerpFrame(fab_seg, ghcomp.CurveClosestPoint(seg_mid, fab_seg)[1])
    cvec = ghcomp.Vector2Pt(mid_plane.Origin, rg.Plane.WorldXY.Origin, True)[0]
    if cvec[0]/abs(cvec[0]) == mid_plane.XAxis[0]/abs(mid_plane.XAxis[0]):
        xvec = mid_plane.XAxis
    else:
        xvec = -mid_plane.XAxis
    mframe = Frame(seg_mid, xvec, -mid_plane.ZAxis)
    new_pt = mframe.point + mframe.xaxis*-offset
    new_pt = [new_pt[0], new_pt[1], 0.0]
    frame = Frame(new_pt, mframe.xaxis, mframe.yaxis)
    k += s
    rb_frames.append(frame)
    planes.append(draw_frame(frame))
    
for i, s in enumerate(seg[6:len(seg)]):
    rb_frames.append(rb_frames[i%6])
    planes.append(draw_frame(rb_frames[i%6]))
# ---------- end mobile_base_frames ----------
toggle_3 = BooleanToggle(True)  # disabled
button = Button()  # disabled
button_2 = Button()  # disabled
move_sequence = GhPythonScript(
    rb_frames=mobile_base_frames.rb_frames,
    current_frame=transformations.mobile_base_frame_rhino_local_tf,
    counter=ind,
    use_current=toggle_3,
    send=button)  # -> out, tplanes; inputs rb_frames: list, counter: Int32; disabled
# ---------- move_sequence: Python ----------
__author__ = "Gido"
__version__ = "2022.01.29"

import Rhino.Geometry as rg
import ghpythonlib.components as ghcomp
import scriptcontext as sc
import rhinoscriptsyntax as rs
import math
import time
from compas.geometry import Frame
from compas.geometry import Vector
from mobile_fabrication_control import MobileBaseControl
from compas_ghpython import draw_frame

traverse_pts = ghcomp.PolarArray(rg.Point3d(1.5,0,0), rg.Plane.WorldXY,6, math.pi*2)[0]
traverse_xvecs = ghcomp.Vector2Pt(traverse_pts, rg.Point3d(0,0,0), True)[0]
traverse_yvecs = ghcomp.CrossProduct(traverse_xvecs, rg.Vector3d.ZAxis, True)[0]
traverse_frames = []
for i,pt in enumerate(traverse_pts):
    frame = Frame(pt, traverse_xvecs[i], -traverse_yvecs[i])
    traverse_frames.append(frame)


seq = [1,3,5,0,2,4]
nvia = [4,3,3,2,3,3]
mframes = []

if counter == 0:
    nseq = seq[0]
    mframes.append(current_frame)
    mframes.append(traverse_frames[nseq])
elif use_current:
    nseq = seq[(counter-1)%6]
    mframes.append(current_frame)
    for n in range(nvia[counter%6]):
        k = (nseq+n)%6
        mframes.append(traverse_frames[k])
else:
    nseq = seq[(counter-1)%6]
    mframes.append(rb_frames[counter-1])
    for n in range(nvia[counter%6]):
        k = (nseq+n)%6
        mframes.append(traverse_frames[k])

mframes.append(rb_frames[counter])
tplanes = [draw_frame(mframe) for mframe in mframes]
if not sc.escape_test():
    if send:
        mb = MobileBaseControl(host="192.168.0.40", port=9090)
        mb.connect()
        mb.robot_frame = mframes[0]
        for mframe in mframes[1:len(mframes)]:
            mb.move_to_frame(mframe, vel=0.1, orient=True)
            time.sleep(1)
        mb.disconnect()
# ---------- end move_sequence ----------
movement_correction = GhPythonScript(rb_frames=mobile_base_frames.rb_frames, current_frame=ur_base_frame_rhino_local_tf, counter=ind, send=button_2)  # -> out, tplanes; inputs rb_frames: list, counter: Int32; disabled
# ---------- movement_correction: Python ----------
__author__ = "Gido"
__version__ = "2022.01.29"

import Rhino.Geometry as rg
import ghpythonlib.components as ghcomp
import scriptcontext as sc
import rhinoscriptsyntax as rs
import math
import time
from compas.geometry import Frame
from compas.geometry import Vector
from mobile_fabrication_control import MobileBaseControl
from compas_ghpython import draw_frame

mframes = []

mframes.append(current_frame)
mframes.append(rb_frames[counter])

tplanes = [draw_frame(mframe) for mframe in mframes]
if not sc.escape_test():
    if send:
        mb = MobileBaseControl(host="192.168.0.40", port=9090)
        mb.connect()
        mb.robot_frame = mframes[0]
        for mframe in mframes[1:len(mframes)]:
            mb.move_to_frame(mframe, vel=0.1, orient=True)
            time.sleep(1)
        mb.disconnect()
# ---------- end movement_correction ----------

# ----
# Layer Scanning
ur_speed_2 = Slider(0.01, range=0..1)
send_22 = Button()
scanning_2 = GhPythonScript(robot=create.robot, ur_speed=ur_speed_2, scan_model=scanning.scan_model, send=send_22)  # -> out, script
# ---------- scanning_2: Python ----------
import time
from scriptcontext import sticky as st
import rhinoscriptsyntax as rs

import sys, os
from compas.geometry import Frame

from mobile_fabrication_control.extruder_control import URScript_Extrusion

ur_ip = st["ur_ip"]
ur_port = st["ur_port"]

def get_layer_ur_script(layer):
    ur_script = URScript_Extrusion(ur_ip, ur_port)
    tool_angle_axis = list(robot.attached_tool.frame.point) + list(robot.attached_tool.frame.axis_angle_vector)
    
    ur_script.start()
    ur_script.set_tcp(tool_angle_axis)
    RCS_frames = get_frames_in_RCS([node.frame for key, node in layer.nodes()])
    radii = [node.radius for key, node in layer.nodes()]
    for i, frame in enumerate(RCS_frames):
        if i < 2:
            ur_script.move_linear(frame, ur_speed, radii[i])
        elif i == int(len(RCS_frames)/2):
            pass
        elif i == int(len(RCS_frames)/2)+1:
            ur_script.move_linear(frame, ur_speed, radii[i])
        else:
            ur_script.move_process(frame, ur_speed, radii[i])
    ur_script.end()
    ur_script.generate()
    print(ur_script.script)
    return ur_script

def get_frames_in_RCS(frames):
    return [robot.RCF_in_WCF.to_local_coordinates(frame) for frame in frames]

for key, layer in scan_model.layers():
    ur_script = get_layer_ur_script(layer)

if send:
    ur_script.send_script()
# ---------- end scanning_2 ----------

idx_7 = Panel(continuous_operation_multiple_layers.task_key_current)
python_7 = GhPythonScript(fabrication=continuous_operation_multiple_layers.fabrication, layer_key=number_slider_7, node_key=number_slider_8)  # -> out, a; disabled
# ---------- python_7: Python ----------
__author__ = "Gido"
__version__ = "2022.02.22"

import rhinoscriptsyntax as rs

am_model = fabrication.am_model
layer = am_model.layer(layer_key)
node = layer.node(node_key)
print(node.air_state)
# ---------- end python_7 ----------
python_8 = GhPythonScript(robot=robot, am_model=ammodel.am_model)  # -> out, planes, veca2ds, yvec2ds
# ---------- python_8: Python ----------
__author__ = "Gido"
__version__ = "2022.02.10"

import rhinoscriptsyntax as rs

import math
from compas.geometry import Frame
from compas.geometry import Translation
from compas.geometry import Transformation
from compas.geometry import Rotation
from compas.geometry import Vector
from compas_ghpython import draw_frame
from compas_ghpython.artists import VectorArtist

def limit_frames_rotation(frames, lnum, init_rot = -30, init_rot_frames=15):
    lfrs = []
    veca2ds = []
    yvec2ds = []
    for i, frame in enumerate(frames):
        new_frame = frame.copy()
        if lnum%2 == 0:
            if i<init_rot_frames:
                R = Rotation.from_axis_and_angle(new_frame.zaxis, math.radians(init_rot)*math.cos(i*(math.pi/(2*init_rot_frames))), new_frame.point)
            elif i>len(frames)-init_rot_frames:
                R = Rotation.from_axis_and_angle(new_frame.zaxis, 0, new_frame.point)
            else:
                R = Rotation.from_axis_and_angle(new_frame.zaxis, math.radians(30), new_frame.point)
        else:
            if i<init_rot_frames:
                R = Rotation.from_axis_and_angle(new_frame.zaxis, 0, new_frame.point)
            elif i>len(frames)-init_rot_frames:
                R = Rotation.from_axis_and_angle(new_frame.zaxis, math.radians(init_rot)*math.cos((math.pi/2)-(i-(len(frames)-init_rot_frames))*(math.pi/(2*init_rot_frames))), new_frame.point)
            else:
                R = Rotation.from_axis_and_angle(new_frame.zaxis, math.radians(30), new_frame.point)
        new_frame.transform(R)
        veca3d = Vector.from_start_end(frame.point, Frame.worldXY().point)
        veca2d = Vector(veca3d.x, veca3d.y, 0)
        yvec2d = Vector(new_frame.yaxis[0], new_frame.yaxis[1], 0)
        anglea = yvec2d.angle_signed(veca2d, Vector.Zaxis())
        print anglea
        if anglea > math.pi/2:
            R = Rotation.from_axis_and_angle(frame.zaxis, math.pi/2-anglea, frame.point)
            new_frame.transform(R)
        elif anglea < -math.pi/2:
            R = Rotation.from_axis_and_angle(frame.zaxis, -math.pi/2-anglea, frame.point)
            new_frame.transform(R)
        lfrs.append(new_frame)
        veca2dartist = VectorArtist(veca2d)
        yvec2dartist = VectorArtist(yvec2d)
        veca2ds.append(veca2dartist.draw()[0])
        yvec2ds.append(yvec2dartist.draw()[0])
    return lfrs, veca2ds, yvec2ds
        
def get_frames_in_RCS(frames):
    return [robot.RCF_in_WCF.to_local_coordinates(frame) for frame in frames]
    

ln = 31
layer = am_model.layer(ln)
rcs = get_frames_in_RCS([node.frame for key, node in layer.nodes()])
frames = [node.frame for key, node in layer.nodes()]
lfrs, veca2ds, yvec2ds = limit_frames_rotation(rcs, ln)

planes = [draw_frame(lrf) for lrf in lfrs]
# ---------- end python_8 ----------
vdisex_4 = VectorDisplayEx(Point=python_8.planes, Vector=python_8.veca2ds, Colour=RGB(0, 0, 0), Width=2)
vdisex_5 = VectorDisplayEx(Point=python_8.planes, Vector=python_8.yvec2ds, Colour=RGB(0, 0, 0), Width=2)
