# Grasshopper definition mobile_robot_workspace_clay_formwork_v2.0.ghx (Grasshopper 1.0.7)

# ----
# Settings
bang = Button()
panel = Panel("Unload libraries")
unload = PythonScript(bang=bang)
# ---------- unload: Python ----------
from compas_rhino.utilities.misc import get_tolerance
from compas_rhino.utilities.misc import unload_modules

unload_modules("compas")
unload_modules("compas_fab")
unload_modules("extrusion_control")
unload_modules("fabrication_control")
unload_modules("ur_fabrication_control")
unload_modules("mobile_fabrication_control")
unload_modules("am_information_model")
unload_modules("src")
# ---------- end unload ----------

ext_ip = ValueList({"192.168.10.10", "192.168.10.20", "192.168.10.11", "192.168.10.12", "127.0.0.1", "192.168.10.111", "192.168.0.220", "192.168.0.30", "192.168.10.50", "0.0.0.0"}, selected="192.168.0.220")
ext_port = ValueList({"50003", "50004"}, selected="50004")

# ----
# --> Set your IP address
# --> Set robot IP address
server_ip = ValueList({"192.168.10.44", "192.168.10.12", "192.168.10.11", "192.168.10.10", "192.168.10.2", "127.0.0.1", "192.168.10.111", "192.168.0.250", "192.168.0.30", "10.42.0.212", "10.42.0.133"}, selected="127.0.0.1")
ur_ip = ValueList({"192.168.10.10", "192.168.10.20", "192.168.10.11", "192.168.10.12", "127.0.0.1", "192.168.10.111", "192.168.0.210", "192.168.0.30"}, selected="192.168.0.210")
server_port = ValueList({"50002", "50003", "50004", "50005"}, selected="50005")
ur_port = ValueList({"30002"}, selected="30002")
globals = PythonScript(
    server_address=server_ip,
    server_port=server_port,
    ur_ip=ur_ip,
    ur_port=ur_port,
    ext_ip=ext_ip,
    ext_port=ext_port,
    clear=Button())  # inputs server_port: Int32
# ---------- globals: Python ----------
from scriptcontext import sticky as st

st["server_address"] = server_address
st["server_port"] = server_port

st["ur_ip"] = ur_ip
st["ur_port"] = ur_port

st["ext_ip"] = ext_ip
st["ext_port"] = ext_port


if clear:
    st.clear()
# ---------- end globals ----------

# ----
# Check if UR robot
#  is available
ping = Button()
py = PythonScript(ip=ur_ip, ping=ping)  # -> out, trigger
# ---------- py: Python ----------
from scriptcontext import sticky as st
from ur_fabrication_control.direct_control.utilities import is_available

guid = str(ghenv.Component.InstanceGuid)
txt_key = "txt_" + guid
if txt_key not in st:
    st[txt_key] = ""

if ping:
    
    available = is_available(ip)
    
    if available:
        st[txt_key] = "%s is up!" % ip
        trigger = True
    else:
        st[txt_key] = "%s is down!" % ip
        trigger = False

print(st[txt_key])
# ---------- end py ----------
panel_2 = Panel(py.out)

# ----
# Base Curve
number_slider = Slider(0.085, range=0..1)
base_curve = GhPythonScript(
    out_crc_dist=Slider(0.25, range=0..1),
    out_crc_radius=number_slider,
    inner_crc_dist=Slider(0.3, range=0..1),
    rebar_offset=Slider(0.23, range=0..1),
    rebar_size=Slider(0.006, range=0..0.01))  # -> out, base_crv, base_crv_tstart, rebar_crv
# ---------- base_curve: Python ----------
import math
import Rhino.Geometry as rg
import rhinoscriptsyntax as rs
import ghpythonlib.components as ghcomp
from compas.geometry import Frame
from compas.geometry import Vector

out_crc_pts = []
in_crc_pts = []
rb_crc_pts = []
for i in range(3):
    pt_outer_crc = [out_crc_dist*math.cos(i*2*math.pi/3), out_crc_dist*math.sin(i*2*math.pi/3),0]
    out_crc_pts.append(rg.Point3d(*pt_outer_crc))
    pt_inner_crc = [inner_crc_dist*math.cos(i*2*math.pi/3+(1/3)*math.pi), inner_crc_dist*math.sin(i*2*math.pi/3+(1/3)*math.pi),0]
    in_crc_pts.append(rg.Point3d(*pt_inner_crc))
    pt_rebar = [rebar_offset*math.cos(i*2*math.pi/3), rebar_offset*math.sin(i*2*math.pi/3),0]
    rb_crc_pts.append(rg.Point3d(*pt_rebar))

out_crcs = [rg.Circle(pt, out_crc_radius) for pt in out_crc_pts]
rebar_crv = [rg.Circle(pt, rebar_size/2) for pt in rb_crc_pts]

lines1= [rg.Line(out_crc_pts[i], in_crc_pts[i]) for i in range(len(out_crc_pts))]
lines2= [rg.Line(out_crc_pts[i], in_crc_pts[i-1]) for i in range(len(out_crc_pts))]

int_pts = ghcomp.CurveXLine(out_crcs, lines1)[0]
vecs = [rg.Line(in_crc_pts[i], int_pts[i*2]) for i in range(3)]
in_crcs = [rg.Circle(pt, vecs[0].Length) for pt in in_crc_pts]

lines = lines1+lines2
bsrf = ghcomp.BoundarySurfaces(lines)

split_out_crc = ghcomp.SplitwithBrep(out_crcs, bsrf)[0]
split_in_crc = ghcomp.SplitwithBrep(in_crcs, bsrf)[0]
split_out_crc_len = ghcomp.Length(split_out_crc)
split_in_crc_len = ghcomp.Length(split_in_crc)

out_crc_segs = ghcomp.SortList(split_out_crc_len, split_out_crc)[1]
in_crc_segs = ghcomp.SortList(split_in_crc_len, split_in_crc)[1]

crv_segs = []
for i in range(3):
    crv_segs.append(out_crc_segs[i+3])
    crv_segs.append(in_crc_segs[i])

base_crv_raw = ghcomp.JoinCurves(crv_segs, False)
base_crv = ghcomp.OffsetCurve(base_crv_raw, 0.01,corners=0)
base_crv_tstart = ghcomp.CurveClosestPoint(rg.Point3d(out_crc_dist+out_crc_radius,0,0), base_crv)[1]
# ---------- end base_curve ----------
crv = Curve(base_curve.rebar_crv)
crv_2 = Curve(base_curve.base_crv)
dam = DataDam(
    DataBase_crv=crv_2,
    DataBase_crv_tstart=base_curve.base_crv_tstart,
    DataRebar_crv=crv,
    BufferDelay=10000000,
    BufferMode=0)  # -> DataBase_crv, DataBase_crv_tstart, DataRebar_crv

# ----
# Segment width inputs
number_slider_2 = Slider(1, range=0..10)
expression = Expression(a=number_slider_2, b=Slider(3, range=0..10), Expression="a/b")
expression_2 = Expression(a=Slider(4, range=0..10), b=Slider(15, range=0..30), Expression="a/b")

# ----
# Offset input
number_slider_3 = Slider(0, range=-1..1)

# ----
# DESIGN ENVIRONMENT
reload = Button()
py_2 = PythonScript(reload=reload)
# ---------- py_2: Python ----------
from compas_rhino.utilities.misc import get_tolerance
from compas_rhino.utilities.misc import unload_modules

from compas_ghpython import unload_modules

if reload:
    unload_modules("compas")
    unload_modules("compas_fab")
    unload_modules("roslibpy")
    unload_modules("fabrication_control")
    unload_modules("assembly_information_model")
    unload_modules("am_information_model")
    unload_modules("ur_fabrication_control")
# ---------- end py_2 ----------

# ----
# Silhouette
number_slider_4 = Slider(0.5, range=0..1)
number_slider_5 = Slider(0.005, range=0..0.01)
pi = Pi(Factor=0.5)
pi_2 = Pi(Factor=1.5)
dom = ConstructDomain(DomainStart=number_slider_4, DomainEnd=Slider(1, range=0..10))
layers = GhPythonScript(
    base_crv=dam.DataBase_crv,
    rebar_crv=dam.DataRebar_crv,
    height=Slider(2, range=0..10),
    layer_height=number_slider_5,
    phase=pi,
    wave_length=pi_2,
    domain=dom)  # -> out, base_crvs, rebar_crvs; inputs base_crv: Curve, rebar_crv: list of Curve
# ---------- layers: Python ----------
import math
import Rhino.Geometry as rg
import rhinoscriptsyntax as rs
import ghpythonlib.components as ghcomp
from compas.geometry import Frame
from compas.geometry import Vector

transformations = []
scaling = []
count = int(height/layer_height)
for i in range(count):
    transformations.append(rg.Vector3d(0,0,i*layer_height))
    scaling.append(math.sin(phase+i*(wave_length/count)))
dom_sin = ghcomp.ConstructDomain(-1,1)
dom_new = ghcomp.ConstructDomain(domain[0],domain[1])
rmscaling = ghcomp.RemapNumbers(scaling, dom_sin, dom_new)[0]

ncrvs = ghcomp.Move(base_crv, transformations)[0]
base_crvs = ghcomp.Scale(ncrvs, transformations, rmscaling)[0]

rb_transformations = [[t, t, t] for t in transformations]
rb_transformations = [t for tl in rb_transformations for t in tl]
rb_scaling = [[s, s, s] for s in rmscaling]
rb_scaling = [s for sub in rb_scaling for s in sub]
rbcrvs = [rebar_crv for i in range(count)]
rbcrvs = [crv for sub in rbcrvs for crv in sub]
rcrvs = ghcomp.Move(rbcrvs, rb_transformations)[0]
rebar_crvs = ghcomp.Scale(rcrvs, rb_transformations, rb_scaling)[0]
# ---------- end layers ----------
crv_3 = Curve(layers.rebar_crvs)
partition = PartitionList(List=crv_3, Size=3)
flip = FlipMatrix(Data=partition)
loft = Loft(Curves=flip, Options={Adjust=False, Closed=False, LoftEnds=0, LoftSimp=0, LoftType=0, Rebuild=10, Refit=0.01})

crv_4 = Curve(<curve referenced from the Rhino model>)

# ----
# Curve
# Predefine an element and its dimensions
# Visualise the defined element
number_slider_6 = Slider(0.2, range=0..1)
show = BooleanToggle(False)
layer_def = GhPythonScript(crv=crv_4, div_length=number_slider_6)  # -> out, layer; inputs crv: Curve
# ---------- layer_def: Python ----------
import rhinoscriptsyntax as rs
import os
import sys
import json

from compas.geometry import Frame
from compas.geometry import Line
from compas.geometry import Vector

from am_information_model.model import Node
from am_information_model.model import Layer

def _radius_between_frames(from_frame, via_frame, to_frame, max_radius):
        in_line = Line(from_frame.point, via_frame.point)
        out_line = Line(via_frame.point, to_frame.point)
        r = min(max_radius, in_line.length/2, out_line.length/2)
        return r

# nodes
print crv
pts = rs.DivideCurveLength(crv, div_length)
max_r = div_length/2
nodes = []
frames = [Frame([pt.X, pt.Y, pt.Z], [0, -1, 0], [-1, 0, 0]) for pt in pts]

for i,frame in enumerate(frames):
    r = _radius_between_frames(frames[max(0,i-1)], frame, frames[min(i+1, len(frames)-1)], max_r)
    nodes.append(Node(frame, radius=r))
layer = Layer.from_nodes(nodes)
# ---------- end layer_def ----------
draw = PythonScript(layer=layer_def.layer, show=show)  # -> M, F, S
# ---------- draw: Python ----------
from compas.geometry import Transformation
from compas.geometry import Frame
from compas.datastructures import mesh_transformed
from compas_ghpython.artists import MeshArtist
from compas_ghpython import draw_frame

if show:
    F = [draw_frame(node.frame) for key, node in layer.nodes()]
# ---------- end draw ----------

# ----
# SERVER
# 1>
button = Button()
feedbackserver = GhPythonScript(create=button, clear=Button(), close=Button())  # -> server
# ---------- feedbackserver: Python ----------
__author__ = "Gido"
__version__ = "2022.05.16"

import rhinoscriptsyntax as rs
from scriptcontext import sticky as st
from fabrication_control.communication import TCPFeedbackServer

server_ip = st["server_ip"]
server_port = st["server_port"]

server = TCPFeedbackServer(server_ip, server_port)

if clear:
    server.clear()
    
if close:
    server.shutdown()
# ---------- end feedbackserver ----------

degree = Slider(15, range=0..20)
line_ab_tangent_to_ond = BooleanToggle(True)
line_ab = ValueList({"straight cut": 0, "sloped cut": 1}, selected="straight cut")

# ----
# AM Model
number_slider_7 = Slider(0.006, range=0..0.01)
cp = Plane(PlaneXY(0, 0, 0))
generate_assembly = GhPythonScript(centerplane=cp, layer=layer_def.layer, layer_height=number_slider_7)  # -> am_model, planes
# ---------- generate_assembly: Python ----------
import Rhino.Geometry as rg
import math
from scriptcontext import sticky as st


from compas.geometry import Frame
from compas.geometry import Transformation
from compas.geometry import Rotation
from compas.geometry import Translation
from compas.geometry import Point

from compas_ghpython import draw_frame

from am_information_model.model import AMModel
from am_information_model.model import Layer

import Rhino.Geometry as rg


# initialize an empty assembly class
am_model = AMModel()

cp = centerplane
cf = Frame(cp.Origin, cp.XAxis, cp.YAxis)

for i in range(25): # loop through the number of layers i
    T = Translation.from_vector([0,0,layer_height*i])
    cft = cf.transformed(T) #transforms the origin plane

    T1 = Transformation.from_frame_to_frame(cf, cft)
    # create new instances of the element
    new_layer = layer.transformed(T) #returns a deep copy of the initial element at the new location of the frame
    print(new_layer.node(0).frame)
    am_model.add_layer(new_layer)
# ---------- end generate_assembly ----------
pln = Plane(generate_assembly.planes)

# ----
# TASKS
robot_speed = Slider(0.25, range=0..1)
# 2>
button_2 = Button()
tasks = GhPythonScript(create=button_2, server=feedbackserver, robot_speed=robot_speed, am_model=generate_assembly.am_model)  # -> tasks
# ---------- tasks: Python ----------
import time
from scriptcontext import sticky as st
from fabrication_control.task import Task
from ur_fabrication_control.direct_control.fabrication_process import URTask
from ur_fabrication_control.direct_control import URScript

ur_ip = st["ur_ip"]
ur_port = st["ur_port"]
server_ip = st["server_ip"]
server_port = st["server_port"]

def create_tasks_from_am_model(am_model):
    tasks = []
    for key, layer in am_model.layers():
        req_msg = "Layer{}_completed".format(key)
        urscript = urscript_from_layer(layer, key, req_msg)
        new_task = URTask(server, urscript, req_msg, key)
        tasks.append(new_task)
    return tasks

def get_frames_in_RCS(frames):
    return [robot.to_local_coordinates(frame) for frame in frames]

def urscript_from_layer(layer, layer_number, exit_message):
    ur_script = URScript(ur_ip=ur_ip, ur_port=ur_port)
    tool_angle_axis = list(robot.attached_tool.frame.point) + list(robot.attached_tool.frame.axis_angle_vector)
    ur_script.start()
    ur_script.set_tcp(tool_angle_axis)
    RCS_frames = get_frames_in_RCS([node.frame for key, node in layer.nodes()])
    radii = [node.radius for key, node in layer.nodes()]
    ur_script.add_line("textmsg(\">> TASK {}.\")".format(layer_number))
    # Initialize first movement (with accelleration)
    ur_script.socket_open(server_ip, server_port, "Feedbackserver")
    ur_script.move_linear(RCS_frames[0], robot_speed, 0.0)
    node_msg = {"LAYER":layer_number, "NODE":0}
    ur_script.socket_send_line_string(str(node_msg), socket_name="Feedbackserver")
    # Send all next frames of the layer (constant speed, no accelleration)
    for key, RCS_frame in enumerate(RCS_frames[1:len(RCS_frames)]):
        ur_script.move_process(RCS_frame, robot_speed, radii[key])
        node_msg = {"LAYER":layer_number, "NODE":key}
        ur_script.socket_send_line_string(str(node_msg), socket_name="Feedbackserver")
    ur_script.socket_close(name="Feedbackserver")# BS: Closing socket at the end of the loop
    # Signify ready
    ur_script.socket_open(server_ip, server_port, "Feedbackserver")
    ur_script.socket_send_line_string(exit_message, socket_name="Feedbackserver")
    ur_script.socket_close(name="Feedbackserver")# BS: Closing socket at the end of the loop
    #Finalize script
    ur_script.end()
    ur_script.generate()
    return ur_script

if create:
    st["tasks"] = create_tasks_from_am_model(am_model)

tasks = st["tasks"]
# ---------- end tasks ----------

list = ValueList({"20", "50", "100", "500", "1000", "5000"}, selected="50")
back = Button()
reset = Button()
start = Button()
stop = Button()
step = Button()
full = Button()

# ----
# Draw
counter = CountThroughList(
    am_model=generate_assembly.am_model,
    start=start,
    stop=stop,
    step=step,
    step_back=back,
    reset=reset,
    full=full,
    interval=list)  # -> item, counter; inputs start: Boolean, stop: Boolean, step_back: Boolean
# ---------- counter: Python ----------
from scriptcontext import sticky as st
from compas_ghpython import update_component


L = list(am_model.layers())
# store data in component
guid = str(ghenv.Component.InstanceGuid)
counter_key = "counter_" + guid
running_key = "running_" + guid

if counter_key not in st:
    st[counter_key] = 0

if running_key not in st:
    st[running_key] = False
    

if st[running_key]:
    if st[counter_key] < len(L) - 1:
        st[counter_key] += 1
        update_component(ghenv, interval)
    else:
        st[counter_key] = 0
        st[running_key] = False
    
    
if start:
    st[running_key] = True

if stop:
    st[running_key] = False

if step:
    if st[counter_key] < len(L) - 1:
        st[counter_key] += 1

if step_back:
    if st[counter_key] < len(L) - 1:
        st[counter_key] -= 1

if reset:
    st[counter_key] = 0

if full:
    st[counter_key] = len(L)-1

if len(L):
    item = L[st[counter_key]]



#st["visualisation_counter"] = st[counter_key]
counter = st[counter_key]
# ---------- end counter ----------
show_2 = BooleanToggle(True)
show_3 = BooleanToggle(False)
idx = Panel(counter.counter)
draw_2 = PythonScript(am_model=generate_assembly.am_model, show_all=show_2, show_counter=show_3, counter=idx)  # -> G, tool_planes_WCS, current_tool_plane, current_tool_planes; inputs counter: Int32
# ---------- draw_2: Python ----------
import os
import sys

import math

from compas_ghpython.artists import MeshArtist
from compas_ghpython import draw_frame


G = []

key_index = am_model.network.key_index()
keys = [key_index[key] for key in am_model.network.nodes()]
layers = [am_model.layer(key) for key in keys]
#print elements
#print([(e.gripping_frame) for e in elements])

start_planes_WCS = [draw_frame(l.node(0).frame) for l in layers]

current_tool_plane = start_planes_WCS[counter]
current_tool_planes = [draw_frame(node.frame) for key, node in am_model.layer(counter).nodes()]

if show_all and not show_counter:
    for layer in layers:
        for key, node in layer.nodes():
            plane = draw_frame(node.frame) 
            G.append(plane)

if show_counter:
    for layer in layers[0:counter+1]:
        for key, node in layer.nodes():
            plane = draw_frame(node.frame) 
            G.append(plane)

    tool_planes_WCS = [draw_frame(l.node(0).tool_frame) for l in layers[0:counter+1]]
# ---------- end draw_2 ----------
geo = Geometry(draw_2.G)
pln_2 = Plane(draw_2.tool_planes_WCS)
pln_3 = Plane(draw_2.current_tool_plane)
pln_4 = Plane(draw_2.current_tool_planes)
preview = CustomPreview(Geometry=geo, Shader=ColourSwatch(SwatchColor=RGBA(255, 227, 227, 233)))
preview_2 = CustomPreview(Geometry=[pln_2, pln_3], Shader=ColourSwatch(SwatchColor=RGBA(209, 27, 27, 178)))

# ----
# FABRICATION STATE  VIEWER
trigger = Trigger(Interval=100, TimerInterval=100, Target=fabrication_state)
fabrication_state = PythonScript()  # -> out, state, num_tasks, num_current_task, num_tasks_left, log_messages
# ---------- fabrication_state: Python ----------
from scriptcontext import sticky as st

fabrication = st["fabrication"]

if hasattr(fabrication, "task_thread"):
    if fabrication.task_thread.is_alive():
        state = "THREAD RUNNING"
    else:
        state = "THREAD STOPPED"
else:
    state = "THREAD NOT STARTED"

num_tasks = len(fabrication.tasks)
if fabrication.current_task_key is not None:
    num_current_task = fabrication.current_task_key
else:
    num_current_task = 0
num_tasks_left = num_tasks-num_current_task
log_messages = fabrication.log_messages
# ---------- end fabrication_state ----------
state = Panel(fabrication_state.state)
num_tasks = Panel(fabrication_state.num_tasks)
num_current_task = Panel(fabrication_state.num_current_task)
log_messages = Panel(fabrication_state.log_messages)

# ----
# CONTROL ENVIRONMENT
# FABRICATION MANAGER
# 3>
# 4>
start_fabrication = Button()
stop_fabrication = Button()
reset_fabrication = Button()
set_tasks = Button()
init = Button()
fabrication = PythonScript(
    server=feedbackserver,
    tasks=tasks,
    init=init,
    parallelize=Toggle(False),
    set_tasks=set_tasks,
    start=start_fabrication,
    stop=stop_fabrication,
    reset=reset_fabrication)  # -> out, server
# ---------- fabrication: Python ----------
from scriptcontext import sticky as st
from fabrication_control.fabrication import Fabrication

if init:
    fabrication = Fabrication(server)
    fabrication.parallelize = parallelize
    st["fabrication"] = fabrication

fabrication = st["fabrication"]

if set_tasks:
    print "setting tasks"    
    fabrication.clear_tasks()
    fabrication.set_tasks(tasks)

if start:
    #if robot.is_connected(): #and arduino.is_connected():
    print "starting process"
    fabrication.start()

if stop:
    print "stopping process"
    fabrication.stop()
    
if reset:
    print "resetting process"
    fabrication.reset()

server = fabrication.server
# ---------- end fabrication ----------
num_tasks_left = Panel(fabrication_state.num_tasks_left)

# ----
# SERVER STATE  VIEWER
trigger_2 = Trigger(Interval=100, TimerInterval=100, Target=server_state)
server_state = GhPythonScript(server=fabrication.server)  # -> out, msgs, server_state, processing_state
# ---------- server_state: Python ----------
__author__ = "Gido"
__version__ = "2022.05.17"

import rhinoscriptsyntax as rs

msgs = server.msgs.values()
if hasattr(server, "server_thread"):
    if server.server_thread.is_alive():
        server_state = "RUNNING"
    else:
        server_state = "HALTED"
else:
    server_state = "NOT RUNNING"

if hasattr(server, "process_thread"):
    if server.process_thread.is_alive():
        processing_state = "RUNNING"
    else:
        processing_state = "HALTED"
else:
    processing_state = "NOT RUNNING"

if start:
    server.start()

if stop:
    server.shutdown()
# ---------- end server_state ----------
server_state_2 = Panel(server_state.server_state)
processing_state = Panel(server_state.processing_state)
server_messages = Panel(server_state.msgs)

# ---- group: ROS client
disconnect = Button()
connect = Button()
connect_2 = PythonScript(ip="192.168.0.40", connect=connect, disconnect=disconnect)  # -> out, ros_client
# ---------- connect_2: Python ----------
import sys
import scriptcontext as sc
from compas_fab.backends import RosClient

key = 'rosclient_%s' % str(ghenv.Component.InstanceGuid)
previous_client = sc.sticky.get(key, None)

if previous_client and (connect or disconnect):
    previous_client.close()

if connect:
    ros_client = RosClient(ip, 9090)
    sc.sticky[key] = ros_client
    ros_client.run(5)

ros_client = sc.sticky.get(key, None)
print('ROS connected: {}'.format(ros_client.is_connected if ros_client else 'False'))
# ---------- end connect_2 ----------
is_connected = Panel(connect_2.out)

# ----
# Subscribe to topics
toggle = BooleanToggle(True)
# 09.02.2022
subscriber = GhPythonScript(
    ros_client=connect_2.ros_client,
    subscribe_to_robot_lift_topic=toggle,
    subscribe_to_robotnik_base_topic=toggle,
    subscribe_to_static_tf_topic=toggle,
    subscribe_to_battery_data=toggle)  # -> out
# ---------- subscriber: Python ----------
import time
import logging
import datetime
import Grasshopper
from roslibpy import Topic
from scriptcontext import sticky

LOGGER = logging.getLogger('roslibpy')

robot_lift_pos = 'listener_robot_lift_pos'
robot_base_footprint = 'listener_robot_base_footprint'
tf_static = 'listener_tf_static'
robot_battery_data = 'listener_robot_battery_data'

if subscribe_to_robot_lift_topic:
    if ros_client and ros_client.is_connected:
        print("subscribed to /robot/ewellix_driver/lift/pos topic")
        listener = Topic(ros_client, '/robot/ewellix_driver/lift/pos', 'std_msgs/Float64')
        sticky[robot_lift_pos] = listener
    else:
        sticky[robot_lift_pos] = None
        print("NOT subscribed to /robot/ewellix_driver/lift/pos topic")
else:
    sticky[robot_lift_pos] = None

if subscribe_to_robotnik_base_topic:
    if ros_client and ros_client.is_connected:
        print("subscribed to /robot/robotnik_base_control/odom topic")
        listener = Topic(ros_client, '/robot/robotnik_base_control/odom', 'nav_msgs/Odometry')
        sticky[robot_base_footprint] = listener
    else:
        sticky[robot_base_footprint] = None
        print("NOT subscribed to /robot/robotnik_base_control/odom topic")
else:
    sticky[robot_base_footprint] = None

if subscribe_to_static_tf_topic:
    if ros_client and ros_client.is_connected:
        print("subscribed to /tf_static topic")
        listener = Topic(ros_client, '/tf_static', 'tf2_msgs/TFMessage')
        sticky[tf_static] = listener
        #print sticky[tf_static]
    else:
        sticky[tf_static] = None
        print("NOT subscribed to /tf_static topic")
else:
    sticky[tf_static] = None
    
if subscribe_to_battery_data:
    if ros_client and ros_client.is_connected:
        print("subscribed to /robot/battery_estimator/data topic")
        listener = Topic(ros_client, '/robot/battery_estimator/data', '/robotnik_msgs/BatteryStatus')
        sticky[robot_battery_data] = listener
        #print sticky[robot_battery_data]
    else:
        sticky[robot_battery_data] = None
        print("NOT subscribed to /robot/battery_estimator/data topic")
else:
    sticky[robot_battery_data] = None
# ---------- end subscriber ----------
panel_3 = Panel(subscriber)

# ----
# Listen to topics
start_timer = Button()
stop_timer = Button()
bang_2 = Button()
listener = GhPythonScript(bang=bang_2, start_timer=start_timer, stop_timer=stop_timer)  # -> out, map_frame_ros, ur_base_frame_ros, mobile_base_frame_ros, map_plane_ros, ur_base_plane_ros, mobile_base_plane_ros, vertical_lift_pos
# ---------- listener: Python ----------
from scriptcontext import sticky
from compas_ghpython.utilities import update_component
from compas.geometry import Frame, Transformation, Translation, Point, Rotation, Vector, Quaternion
from compas_ghpython import draw_frame
import Rhino.Geometry as rg
import math

guid = str(ghenv.Component.InstanceGuid)
timer_running_key = "timer_running_" + guid
counter_key = "counter_" + guid

robot_lift_length = 0.533

if stop_timer or timer_running_key not in sticky:
    sticky[timer_running_key] = False
    sticky[counter_key] = 0

if start_timer:
    sticky[timer_running_key] = True
    sticky[counter_key] = 0
    

if sticky[timer_running_key]:
    update_component(ghenv, 1000)
    
    sticky[counter_key] += 1
    print(sticky[counter_key])


def receive_message_tf_static(message):
    #sticky['message'] = str(datetime.datetime.now()) + ': ' + str(message)
    #print("receiving")
    sticky['ros_msg_tf_static'] = message
    
def receive_message_robot_footprint(message):
    #sticky['message'] = str(datetime.datetime.now()) + ': ' + str(message)
    #print("receiving")
    sticky['ros_msg_robot_footprint'] = message

def receive_message_robot_lift_pos(message):
    #sticky['message'] = str(datetime.datetime.now()) + ': ' + str(message)
    #print("receiving")
    sticky['ros_msg_robot_lift_pos'] = message
    
def receive_message_robot_battery_data(message):
    #sticky['message'] = str(datetime.datetime.now()) + ': ' + str(message)
    #print("receiving")
    sticky['ros_msg_robot_battery_data'] = message


if 'listener_robot_base_footprint' in sticky:
    if sticky['listener_robot_base_footprint']:
    
        listener_robot_base_footprint = sticky['listener_robot_base_footprint']
        listener_robot_base_footprint.subscribe(receive_message_robot_footprint)
    
        if 'ros_msg_robot_footprint' in sticky and sticky['ros_msg_robot_footprint']:
            #bang = True
            
            ros_msg_robot_footprint = sticky['ros_msg_robot_footprint']
            if len(ros_msg_robot_footprint):
                robot_base_footprint = ros_msg_robot_footprint
                p = robot_base_footprint['pose']['pose']
                #print('robot_base_footprint', p)
                mobile_base_frame_ros = Frame.from_quaternion([p['orientation']['w'],p['orientation']['x'], p['orientation']['y'], p['orientation']['z']], point = [p['position']['x'], p['position']['y'], p['position']['z']])
                mobile_base_plane_ros = draw_frame(mobile_base_frame_ros)
                print('++ Listening to ROS MSG ROBOT BASE FOOTPRINT')
                
        else:
            bang = False
            print('NOT receiving ROS MSG ROBOT BASE FOOTPRINT')
    else:
        print('NOT receiving ROS MSG ROBOT BASE FOOTPRINT')


if 'listener_tf_static' in sticky:
    if sticky['listener_tf_static']:
    
        listener_tf_static = sticky['listener_tf_static']
        listener_tf_static.subscribe(receive_message_tf_static)
    
        if 'ros_msg_tf_static' in sticky and sticky['ros_msg_tf_static']:
            #bang = True
            
            ros_msg_tf_static = sticky['ros_msg_tf_static']
            if len(ros_msg_tf_static and ros_msg_tf_static['transforms']):
                
                ### First static transformation from mobile robot base frame to mobile robot base link
                tf0 = ros_msg_tf_static['transforms'][0]
                t0 = tf0['transform']
                #print('robot_base frame to robot_base_link', t0)
                x1, y1, z1 = t0['translation']['x'], t0['translation']['y'], t0['translation']['z']
                
                ## Second static transformation from mobile robot base link to ewellix base link
                tf1 = ros_msg_tf_static['transforms'][2]
                t1 = tf1['transform']
                #print('robot_base_link to ewellix_base_link', t1)
                x2, y2, z2 = t1['translation']['x'], t1['translation']['y'], t1['translation']['z']
                
                print('++ Listening to ROS MSG TF STATIC')

                ## Translations in x, y, z axis from the received static transformations
                T1 = Translation.from_vector(mobile_base_frame_ros.xaxis*(x1+x2))
                T2 = Translation.from_vector(mobile_base_frame_ros.yaxis*(y1+y2))
                T3 = Translation.from_vector(mobile_base_frame_ros.zaxis*(z1+z2))

                T_rbl_ebl = T1*T2*T3
                
                ewellix_base_frame_ros = mobile_base_frame_ros.transformed(T_rbl_ebl)
                ewellix_base_plane_ros = draw_frame(ewellix_base_frame_ros)
        else:
            bang = False
            print('NOT receiving ROS MSG TF STATIC')
    else:
        print('NOT receiving ROS MSG TF STATIC')


if 'listener_robot_lift_pos' in sticky:
    if sticky['listener_robot_lift_pos']:
    
        listener_robot_lift_pos = sticky['listener_robot_lift_pos']
        listener_robot_lift_pos.subscribe(receive_message_robot_lift_pos)
    
        if 'ros_msg_robot_lift_pos' in sticky and sticky['ros_msg_robot_lift_pos']:
            #bang = True
            
            ros_msg_robot_lift_pos = sticky['ros_msg_robot_lift_pos']
            if len(ros_msg_robot_lift_pos):
                vertical_lift_pos = ros_msg_robot_lift_pos['data']
                T_ebl_etl = Transformation.from_frame(Frame.from_quaternion([1.0,0.0,0.0,0.0], point=[0.0,0.0,robot_lift_length + vertical_lift_pos]))
                T_static = T_rbl_ebl*T_ebl_etl
                ur_base_frame_ros = ewellix_base_frame_ros.transformed(T_ebl_etl)
                R = Rotation.from_axis_and_angle(ur_base_frame_ros.zaxis, math.radians(135), point=ur_base_frame_ros.point)
                ur_base_frame_ros.transform(R)
                #print(ur_base_frame_ros)
                ur_base_plane_ros = draw_frame(ur_base_frame_ros)
                print('++ Listening to ROS MSG ROBOT LIFT POSITION')
                
        else:
            bang = False
            print('NOT receiving ROS MSG ROBOT LIFT POSITION')
    else:
        print('NOT receiving ROS MSG ROBOT LIFT POSITION')



if 'listener_robot_battery_data' in sticky:
    if sticky['listener_robot_battery_data']:
    
        listener_robot_battery_data = sticky['listener_robot_battery_data']
        listener_robot_battery_data.subscribe(receive_message_robot_battery_data)
    
        if 'ros_msg_robot_battery_data' in sticky and sticky['ros_msg_robot_battery_data']:
            #bang = True
            
            ros_msg_robot_battery_data = sticky['ros_msg_robot_battery_data']
            if len(ros_msg_robot_battery_data):
                robot_battery_data = ros_msg_robot_battery_data

                print('robot_battery_data')

                print('++ Listening to ROS MSG ROBOT BATTERY DATA')
                
        else:
            bang = False
            print('NOT receiving ROS MSG ROBOT BATTERY DATA')
    else:
        print('NOT receiving ROS MSG ROBOT BATTERY DATA')


#### TO DO: get map_frame_ros from rostopic '/tf ... robot_map_frame' ####

map_frame_ros = Frame.from_quaternion([0.92316, 0.0, 0.0, 0.38441], point=[0.81933, -0.19651, 0.0])
map_plane_ros = draw_frame(map_frame_ros)
# ---------- end listener ----------
panel_4 = Panel(listener.out)
panel_5 = Panel(listener.vertical_lift_pos)
draw_3 = GhPythonScript(scale=Slider(0.1, range=0..1))  # -> P, V, C, W; inputs frames: list
# ---------- draw_3: Python ----------
from System.Drawing import Color
from compas_ghpython.utilities import draw_frame

red = Color.FromArgb(255, 0, 0)
green = Color.FromArgb(0, 255, 0)
blue = Color.FromArgb(0, 0, 255)

P = []
V = []
C = []

scale = float(scale)

for frame in frames:
    if not frame:
        continue
    plane = draw_frame(frame)
    P += [plane.Origin] * 3
    V.append(plane.XAxis * scale)
    V.append(plane.YAxis * scale)
    V.append(plane.ZAxis * scale)
    C += [red, green, blue]

W = 3
# ---------- end draw_3 ----------
vdisex = VectorDisplayEx(Point=draw_3.P, Vector=draw_3.V, Colour=draw_3.C, Width=draw_3.W)

pln_5 = Plane(listener.map_plane_ros)
pln_6 = Plane(listener.mobile_base_plane_ros)
pln_7 = Plane(listener.ur_base_plane_ros)

# ----
# Global Localization
map_plane_rhino = Plane(Plane(origin=(1.179122663, 0.2715298688, -0.1655349322), x=(-0.2396713481, -0.9708409462, 0.00504995646), y=(0.9708540501, -0.2396693923, 0.0009979146029)))

# ----
# Transform Map
# Locate ROS robot_map frame in reference to the workpiece in Rhino.
# 
# + This transformation is necessary when a new map was created in ROS.
# + Internalise robot_map_wcp in 'T_global' section below!
# Calculate Basis - Point fitting method via RPC
base_plane_fit = Plane(Plane(origin=(-0.57309, -0.921459, 0.903867), x=(-0.9686743385, -0.2478080866, -0.01616100565), y=(0.2480255025, -0.9686636238, -0.01319598746)))
transform_map = GhPythonScript(map_frame_ros=listener.map_frame_ros, base_plane_fit=base_plane_fit, ur_base_frame_ros=listener.ur_base_frame_ros)  # -> out, map_plane_rhino
# ---------- transform_map: Python ----------
from compas.geometry import Frame, Transformation
from compas_ghpython import draw_frame


ur_base_frame_rhino = Frame(base_plane_fit.Origin, base_plane_fit.XAxis, base_plane_fit.YAxis)

if map_frame_ros and ur_base_frame_ros:
    T_map = Transformation.from_frame_to_frame(ur_base_frame_ros, ur_base_frame_rhino)
    map_frame_rhino = map_frame_ros.transformed(T_map)
    map_plane_rhino = draw_frame(map_frame_rhino)
# ---------- end transform_map ----------
map_plane_rhino_2 = Plane(transform_map.map_plane_rhino)

# ----
# T_global
# Transform from ROS to Rhino
ros_to_rhino = GhPythonScript(
    map_plane_rhino=map_plane_rhino,
    map_frame_ros=listener.map_frame_ros,
    ur_base_frame_ros=listener.ur_base_frame_ros,
    mobile_base_frame_ros=listener.mobile_base_frame_ros)  # -> out, T_global, ur_base_frame_rhino_global_tf, mobile_base_frame_rhino_global_tf, ur_base_plane_rhino_global_tf, mobile_base_plane_rhino_global_tf
# ---------- ros_to_rhino: Python ----------
from compas.geometry import Frame, Transformation
from compas_ghpython import draw_frame


if map_frame_ros:
    
    if map_plane_rhino:
        map_frame_rhino = Frame(map_plane_rhino.Origin, map_plane_rhino.XAxis, map_plane_rhino.YAxis)
        
        T_global = Transformation.from_frame_to_frame(map_frame_ros, map_frame_rhino)
        
        print('++ RCF received from ROS')
        print(T_global)
    
    else:
        print('++ NO WCF provided')
    
else:
    print('++ NOT receiving RCF')


if ur_base_frame_ros:
    ur_base_frame_rhino_global_tf = ur_base_frame_ros.transformed(T_global)
    mobile_base_frame_rhino_global_tf = mobile_base_frame_ros.transformed(T_global)
    
    ur_base_plane_rhino_global_tf = draw_frame(ur_base_frame_rhino_global_tf)
    mobile_base_plane_rhino_global_tf = draw_frame(mobile_base_frame_rhino_global_tf)

else:
    print('NO ROS Base Coordinate Frame received')
# ---------- end ros_to_rhino ----------
panel_6 = Panel(ros_to_rhino.out)
pln_8 = Plane(ros_to_rhino.ur_base_plane_rhino_global_tf)
pln_9 = Plane(ros_to_rhino.mobile_base_plane_rhino_global_tf)
t_global = Data(ros_to_rhino.T_global)

ur_base_frame_rhino_global_tf = Data(ros_to_rhino.ur_base_frame_rhino_global_tf)

# ----
# T_local
# Local Transformation (relative to workpiece)
# Calculate Basis - Point fitting method via RPC
d_00b = Point([Point(0.270908022, -0.2158758971, 0), Point(0.320908022, -0.1292733567, 0), Point(0.372408022, 0.04007274016, 0), Point(0.322408022, 0.1266752805, 0), Point(0.272408022, 0.2132778209, 0)])
b_00 = Point([Point(-0.220908022, 0.3024784375, 0), Point(-0.270908022, 0.2158758971, 0), Point(-0.320908022, 0.1292733567, 0), Point(-0.370908022, 0.04267081637, 0), Point(-0.372408022, -0.04007274016, 0), Point(-0.322408022, -0.1266752805, 0), Point(-0.272408022, -0.2132778209, 0), Point(-0.222408022, -0.2998803613, 0)])
a_00 = Point([Point(-0.1485, 0.3425511777, 0), Point(-0.0485, 0.3425511777, 0), Point(0.0515, 0.3425511777, 0), Point(0.1515, 0.3425511777, 0), Point(0.222408022, 0.2998803613, 0), Point(0.272408022, 0.2132778209, 0), Point(0.322408022, 0.1266752805, 0), Point(0.372408022, 0.04007274016, 0)])
c_00 = Point([Point(-0.1515, -0.3425511777, 0), Point(-0.0515, -0.3425511777, 0), Point(0.0485, -0.3425511777, 0), Point(0.1485, -0.3425511777, 0), Point(0.220908022, -0.3024784375, 0), Point(0.270908022, -0.2158758971, 0), Point(0.320908022, -0.1292733567, 0), Point(0.370908022, -0.04267081637, 0)])
d_00a = Point([Point(0.270908022, -0.2158758971, 0), Point(0.320908022, -0.1292733567, 0), Point(0.370908022, -0.04267081637, 0), Point(0.372408022, 0.04007274016, 0), Point(0.322408022, 0.1266752805, 0), Point(0.272408022, 0.2132778209, 0)])
e_00 = Point([Point(0.0515, 0.3425511777, 0), Point(-0.0485, 0.3425511777, 0), Point(-0.1485, 0.3425511777, 0), Point(-0.220908022, 0.3024784375, 0), Point(-0.270908022, 0.2158758971, 0), Point(-0.320908022, 0.1292733567, 0)])
f_00 = Point([Point(-0.372408022, -0.04007274016, 0), Point(-0.322408022, -0.1266752805, 0), Point(-0.272408022, -0.2132778209, 0), Point(-0.222408022, -0.2998803613, 0), Point(-0.1515, -0.3425511777, 0), Point(-0.0515, -0.3425511777, 0), Point(0.0485, -0.3425511777, 0), Point(0.1485, -0.3425511777, 0)])
init_guess = Plane(pln_8)
calc_base = PythonScript(base_plane_init_guess=init_guess, calc=Toggle(False))  # -> out, pts_mtip_init_guess, pts_mtip_fit, base_plane_fit; inputs poses: list, pts_cad: list of Point3d, base_plane_init_guess: Plane
# ---------- calc_base: Python ----------
import ghpythonlib.components as ghcomp
import Rhino.Geometry as rg
from scriptcontext import sticky as st
from compas.geometry import Frame
import math as m
import sys
from compas.rpc import Proxy # for calling the numpy function in CPython

#poses = [[-0.38248900000000002, -0.65991, -0.92396800000000001, 1.43926, -2.33921, -0.356576], [-0.40332200000000001, -0.561226, -0.92589100000000002, 1.39317, -2.5024600000000001, -0.45355000000000001], [-0.42333500000000002, -0.46363100000000002, -0.92523200000000005, 1.32002, -2.7929300000000001, -0.42181200000000002], [-0.44414100000000001, -0.364207, -0.92577699999999996, -1.1245799999999999, 2.7569599999999999, 0.54737599999999997], [-0.49800100000000003, -0.303369, -0.92580499999999999, -0.97646200000000005, 2.8092899999999998, 0.66510199999999997], [-0.59415899999999999, -0.27221099999999998, -0.92597399999999996, 0.74782499999999996, -2.8146399999999998, -0.69757899999999995], [-0.69017399999999995, -0.24166299999999999, -0.924068, 0.51681200000000005, -2.6232899999999999, -0.79130500000000004], [-0.78496699999999997, -0.21047299999999999, -0.92393599999999998, 0.396513, -2.6047699999999998, -0.78313699999999997]]

if len(poses):
    
    # get points from poses
    pts_mtip = [rg.Point3d(p[0], p[1], p[2]) for p in poses]
    
    T_W_R_init_guess = rg.Transform.PlaneToPlane(rg.Plane.WorldXY, base_plane_init_guess)
    pts_mtip_init_guess = [ghcomp.Transform(pt, T_W_R_init_guess) for pt in pts_mtip]
    
    # format Rhino transformation
    T_W_R_init_guess_flattened = [float(f) for f in T_W_R_init_guess.ToFloatArray(True)]
    T_W_R_init_guess_list = [T_W_R_init_guess_flattened[i:(i + 4)] for i in range(0, len(T_W_R_init_guess_flattened), 4)]  

    # format ptsA and ptsB
    dataB = [list(pt) for pt in pts_cad]
    dataA = [list(pt) for pt in pts_mtip]
    
    # call the function
    max_iterations = 1000
    
    if calc:
        icp_func = Proxy('ur_fabrication_control.optimisation.icp', python = 'C://ProgramData//Anaconda3//envs//mam21//python.exe')
        
        print icp_func._python

        transformation, distances = icp_func.icp(dataA, dataB, init_guess=T_W_R_init_guess_list, max_iterations=max_iterations, tolerance=0.000001)
        
        print "distances", distances
        
        # format result
        T = rg.Transform.Identity
        for i in range(4):
            for j in range(4):
                code = "T.M%i%i = %f" % (i, j, transformation[i][j])
                print code
                exec(code)
        #print T
        
        # now transform the points with the transformation calculated
        pts_mtip_fit = [ghcomp.Transform(pt, T) for pt in pts_mtip]
        base_plane_fit = ghcomp.Transform(rg.Plane.WorldXY, T)
        
        
        #f = Frame(base_plane_fit)
        #print f.get_pose_quaternion()
        
        # correct the zvalue
        #base_plane_fit = ghcomp.Transform(base_plane_fit, rg.Transform.Translation(0,0,-3))
# ---------- end calc_base ----------
panel_7 = Panel(calc_base.out)
pt = Point(calc_base.pts_mtip_init_guess)
pln_10 = Plane(calc_base.base_plane_fit)

# ----
# T_local
# Transfrom from global to local
base_plane_fit_2 = Plane(Plane(origin=(-0.57309, -0.921459, 0.903867), x=(-0.9686743385, -0.2478080866, -0.01616100565), y=(0.2480255025, -0.9686636238, -0.01319598746)))
init_guess_2 = Plane(pln_8)
t_local = GhPythonScript(init_guess=base_plane_fit_2, base_plane_fit=base_plane_fit_2, add=Toggle(True))  # -> out, T_local
# ---------- t_local: Python ----------
import rhinoscriptsyntax as rs
from compas.geometry import Transformation, Frame
from compas_ghpython import draw_frame



if add:
    if base_plane_fit and init_guess:
        init_guess_frame = Frame(init_guess.Origin, init_guess.XAxis, init_guess.YAxis)
        base_frame_fit = Frame(base_plane_fit.Origin, base_plane_fit.XAxis, base_plane_fit.YAxis)
        
        T_local = Transformation.from_frame_to_frame(init_guess_frame, base_frame_fit)
else:
    T_local = None
print(T_local)
# ---------- end t_local ----------

python = GhPythonScript(ur_base_plane_rhino_local_tf=base_plane_fit_2)  # -> out, ur_base_frame_rhino_local_tf
# ---------- python: Python ----------
__author__ = "Gido"
__version__ = "2022.04.11"

import rhinoscriptsyntax as rs
from compas.geometry import Frame

ur_base_frame_rhino_local_tf = Frame(ur_base_plane_rhino_local_tf.Origin, 
                                     ur_base_plane_rhino_local_tf.XAxis, 
                                     ur_base_plane_rhino_local_tf.YAxis)
# ---------- end python ----------
t_local_2 = Data(t_local.T_local)

pt_2 = Point(<point referenced from the Rhino model>)
crv_5 = Curve(<curve referenced from the Rhino model>)
crv_6 = Curve(<curve referenced from the Rhino model>)
init_gues = ConstructPlane(Origin=pt_2, XAxis=crv_5, YAxis=crv_6)

section_points = Point(a_00)

# ----
# Local Localization
transformations = GhPythonScript(
    T_local=t_local_2,
    ur_base_frame_rhino_global_tf=ros_to_rhino.ur_base_frame_rhino_global_tf,
    mobile_base_frame_rhino_global_tf=ros_to_rhino.mobile_base_frame_rhino_global_tf)  # -> out, ur_base_plane_rhino_local_tf, ur_base_frame_rhino_local_tf, mobile_base_plane_rhino_local_tf, mobile_base_frame_rhino_local_tf
# ---------- transformations: Python ----------
import rhinoscriptsyntax as rs
from compas.geometry import Frame, Transformation
from compas_ghpython import draw_frame



if T_local:
    ur_base_frame_rhino_local_tf = ur_base_frame_rhino_global_tf.transformed(T_local)
    mobile_base_frame_rhino_local_tf = mobile_base_frame_rhino_global_tf.transformed(T_local)
    
    ur_base_plane_rhino_local_tf = draw_frame(ur_base_frame_rhino_local_tf)
    mobile_base_plane_rhino_local_tf = draw_frame(mobile_base_frame_rhino_local_tf)
    
    print(ur_base_plane_rhino_local_tf)
else:
    ur_base_frame_rhino_local_tf = ur_base_frame_rhino_global_tf
    mobile_base_frame_rhino_local_tf = mobile_base_frame_rhino_global_tf
    
    ur_base_plane_rhino_local_tf = draw_frame(ur_base_frame_rhino_local_tf)
    mobile_base_plane_rhino_local_tf = draw_frame(mobile_base_frame_rhino_local_tf)
# ---------- end transformations ----------
panel_8 = Panel(transformations.out)

scanning_output = GhPythonScript(ur_base_frame=ur_base_frame_rhino_global_tf)  # -> out, re_base_plane, T_local
# ---------- scanning_output: Python ----------
__author__ = "Gido"
__version__ = "2022.02.10"

import rhinoscriptsyntax as rs

from compas.geometry import Frame
from compas.geometry import Transformation
from compas_ghpython import draw_frame

prev_base_frame = Frame(prev_base_plane.Origin, prev_base_plane.XAxis, prev_base_plane.YAxis) 

#tf = [[0.945400031870859, -0.160800912665015, -0.283481650596079, 0],
#[0.0555949228193740,	0.936629257070037,	-0.345882695949276,	0],
#[0.321135460974473,	0.311237371288426,	0.894429043814088,	0],
#[0.281231045722961,	0.376236051321030,	0.274430662393570,	1]]

tf = [[0.976861156885151,	0.183979568810034,	-0.109058692590178,	0],
[-0.191947227683851,	0.979071617657779,	-0.0676389627468168,	0],
[0.0943320833729906,	0.0870073890968771,	0.991731401282150,	0],
[0.189357310533524,	-0.0450175069272518,	0.129362806677818,	1]]

T_ICP = Transformation.from_matrix(tf)
T_ICP.invert()

re_base_frame = prev_base_frame.transformed(T_ICP)
re_base_plane = draw_frame(re_base_frame)

T_local = Transformation.from_frame_to_frame(ur_base_frame, re_base_frame)
# ---------- end scanning_output ----------
pln_11 = Plane(scanning_output.re_base_plane)
ur_base_plane_rhino_local_tf = Plane(transformations.ur_base_plane_rhino_local_tf)
ur_base_frame_rhino_local_tf = Data(transformations.ur_base_frame_rhino_local_tf)
pln_12 = Plane(transformations.mobile_base_plane_rhino_local_tf)
pt_3 = Point(calc_base.pts_mtip_fit)

# ----
# Labels
number_slider_8 = Slider(0.1, range=0..1)
pt_4 = Point([Point(0.298708097, 0.5173776006, 0), Point(-0.597416194, 0, 0), Point(0.298708097, -0.5173776006, 0), Point(0.597416194, 0, 0), Point(-0.298708097, 0.5173776006, 0), Point(-0.298708097, -0.5173776006, 0)])
python_2 = GhPythonScript(pts=pt_4)  # -> out, pts, labels; inputs pts: list
# ---------- python_2: Python ----------
import rhinoscriptsyntax as rs

labels = ['A','B','C','D','E','F']
# ---------- end python_2 ----------
tag = TextTag3D(Location=python_2.pts, Text=python_2.labels, Size=number_slider_8, Colour=RGB(0, 0, 0), Justification=5)

# ----
# Fabrication Data Record
add = Button()
ur_base_plane_fit = Plane(Plane(origin=(0.586046, -0.830465, 0.927117), x=(-0.1740749409, -0.9847276658, 0.003055998963), y=(0.9847265004, -0.1740623089, 0.004003999145)))
ur_base_plane = Plane(Plane(origin=(0.577686147, -0.9211299713, 0.9165088743), x=(-0.1799735024, -0.9835716499, -0.01401242339), y=(0.9836099426, -0.1801032964, 0.008618783048)))
list_2 = ValueList({"A", "B", "C", "D", "E", "F"}, selected="E")
ur_roscp = Plane(Plane(origin=(-1.871807435, -4.291410429, 1.086838298), x=(-0.4735157802, -0.8807853348, 0), y=(0.8807853348, -0.4735157802, 0)))
pt_5 = Point(e_00)
python_3 = GhPythonScript(
    segment=list_2,
    layer=Slider(0, range=0..20),
    pts_cad=pt_5,
    ur_ros_plane=ur_roscp,
    ur_rhino_plane=ur_base_plane,
    ur_base_measured=ur_base_plane_fit,
    T_global=t_global,
    T_local=t_local.T_local,
    add=add,
    show_record=Toggle(True))  # -> out, point_record; inputs layer: Int32, pts_cad: list
# ---------- python_3: Python ----------
import rhinoscriptsyntax as rs
import os
from compas.geometry import Frame

repositories_path = os.path.abspath(os.path.join(ghdoc.Path,"../../../"))
filepath = os.path.abspath(os.path.join(ghdoc.Path,"../../../mobile_fabrication_control/data/fab_data_record.txt"))

fab_data_record = {}
points_list =[]


segment_id = '{0}{1}{2}'.format(segment, '_0', str(layer))
print segment_id

#print(T_global)
if pts_cad and ur_ros_plane and ur_rhino_plane and T_global:
    
    for p in pts_cad:
        pt = rs.coerce3dpoint(p)
        points_list.append([pt.X, pt.Y, pt.Z])
    
    fab_data_record['points_cad'] = points_list
    fab_data_record['ur_ros_plane'] = Frame(ur_ros_plane.Origin, ur_ros_plane.XAxis, ur_ros_plane.YAxis)
    fab_data_record['ur_rhino_plane'] = Frame(ur_rhino_plane.Origin, ur_rhino_plane.XAxis, ur_rhino_plane.YAxis)
    fab_data_record['ur_base_measured'] = Frame(ur_base_measured.Origin, ur_base_measured.XAxis, ur_base_measured.YAxis)
    fab_data_record['T_global'] = T_global
    fab_data_record['T_local'] = T_local
    fab_data_record['segment_id'] = segment_id
    
    if add:
        f = open(filepath, "a")
        f.write((str(fab_data_record) + "\n" + "\n"))
        f.close()
    
if show_record:
    f = open(filepath, "r")
    point_record=f.read()
# ---------- end python_3 ----------
point_record = Panel(python_3.point_record)
segment_id = Panel(python_3.out)

# ----
# SIMULATION ENVIRONMENT
py_3 = PythonScript()  # -> repositories_path, rbvogui_data_path, ur_data_path
# ---------- py_3: Python ----------
import os

"""
ASSUMING THE BELOW PACKAGES ARE STORED IN THE SAME LOCATION:
    ur_fabrication_control;
    rbvogui_common; and
    mobile_additive_manufacturing.
"""

repositories_path = os.path.abspath(os.path.join(ghdoc.Path,"../../../"))

assert os.path.exists(os.path.join(repositories_path, "ur_fabrication_control/data"))
assert os.path.exists(os.path.join(repositories_path, "rbvogui_common/rbvogui_description"))
assert os.path.exists(os.path.join(repositories_path, "mobile_fabrication_control"))

ur_data_path = os.path.abspath(os.path.join(ghdoc.Path,"../../../ur_fabrication_control/data"))
rbvogui_data_path = os.path.abspath(os.path.join(repositories_path, "rbvogui_common"))
# ---------- end py_3 ----------
list_3 = ValueList({"ur3.urdf", "ur3_rot.urdf", "ur5.urdf", "ur10.urdf", "ur3e.urdf", "ur5e.urdf", "ur10e.urdf", "ur10e_rot.urdf"}, selected="ur10e_rot.urdf")
list_4 = ValueList({"ur3.srdf", "ur5.srdf", "ur10.srdf", "ur3e.srdf", "ur5e.srdf", "ur10e.srdf"}, selected="ur10e.srdf")
list_5 = ValueList({"nozzle", "scanner"}, selected="nozzle")
py_4 = PythonScript()  # -> DATA
# ---------- py_4: Python ----------
import os

#package_path = os.path.dirname(mobile_fabrication_control.__file__)
#DATA = os.path.abspath(os.path.join(package_path,"../../data"))

package_path = ghdoc.Path
# package_path = os.path.dirname(ur_fabrication_control.__file__)
#DATA = os.path.abspath(os.path.join(package_path,"../../data"))

# .stl files not stored in am_hackathon repo. but in mobile_fabrication_control
DATA = os.path.abspath(os.path.join(package_path,"../../../mobile_fabrication_control/data"))

print(package_path)
print(DATA)
# ---------- end py_4 ----------
plane_nr = Slider(0, range=0..200)
list_6 = ValueList({"Zero": 0, "One": 1, "Two": 2, "Three": 3, "Four": 4, "Five": 5}, selected="Zero")

# ----
# Robot Model
# Load Model
list_7 = ValueList({"ur_description", "ur_e_description", "ur_setups"}, selected="ur_e_description")
py_5 = PythonScript(
    repositories_path=py_3.repositories_path,
    rbvogui_data_path=py_3.rbvogui_data_path,
    ur_data_path=py_3.ur_data_path,
    package=list_7,
    urdf_name=list_3,
    srdf_name=list_4)  # -> loaders, urdf_filename, srdf_filename
# ---------- py_5: Python ----------
import os
from compas.robots import LocalPackageMeshLoader

#loaders

ur_path = os.path.join(ur_data_path, "robot_description")
ur_packages = ["ur_description", "ur_e_description", "ur_end_effectors", "ur_setups"]
ur_loaders = [LocalPackageMeshLoader(ur_path, pck) for pck in ur_packages]

rbvogui_packages = ["rbvogui_description"]
rbvogui_loaders = [LocalPackageMeshLoader(rbvogui_data_path, pck) for pck in rbvogui_packages]

ewellix_packages = ["ewellix_description"]
ewellix_loaders = [LocalPackageMeshLoader(repositories_path, pck) for pck in ewellix_packages]

sensors_packages = ["robotnik_sensors"]
sensors_loaders = [LocalPackageMeshLoader(repositories_path, pck) for pck in sensors_packages]

loaders = ur_loaders + rbvogui_loaders + ewellix_loaders + sensors_loaders

#files
urdf_filename = os.path.join(repositories_path, r"mobile_fabrication_control\data\rbvogui_xl_lift_ur10e.urdf")
srdf_filename = os.path.join(repositories_path, r"mobile_fabrication_control\data\rbvogui.srdf")

assert os.path.isfile(urdf_filename)
assert os.path.isfile(srdf_filename)
# ---------- end py_5 ----------
units = ValueList({"m": 1, "cm": 100, "mm": 1000}, selected="m")
load = Button()
create = PythonScript(
    load=load,
    ur_base_frame_rhino_local_tf=python.ur_base_frame_rhino_local_tf,
    loaders=py_5.loaders,
    urdf_filename=py_5.urdf_filename,
    srdf_filename=py_5.srdf_filename,
    scale_factor=units)  # -> out, robot, rcf; inputs load: Boolean, loaders: list
# ---------- create: Python ----------
import os
from scriptcontext import sticky as st

import compas

from compas_ghpython import draw_frame
from compas.robots import RobotModel
from compas.robots import LocalPackageMeshLoader

from compas_fab.robots import Robot
from compas_fab.robots import RobotSemantics
from compas_fab.ghpython import RobotArtist

compas.PRECISION = '12f'

# store robot in component
guid = str(ghenv.Component.InstanceGuid)
robot_key = "robot"

if robot_key not in st:
    st[robot_key] = None

#print loaders
if load:
    model = RobotModel.from_urdf_file(urdf_filename)
    
    model.load_geometry(*loaders)
    artist = RobotArtist(model)
    semantics = RobotSemantics.from_srdf_file(srdf_filename, model)
    robot = Robot(model, artist, semantics, client=None)
    
    st[robot_key] = robot

robot = st[robot_key]
print(robot)
rcf = draw_frame(robot.get_RCF())
print(rcf)

if robot:
    robot.scale(scale_factor)
    robot.RCF_in_WCF = ur_base_frame_rhino_local_tf
# ---------- end create ----------
robot = Data(create.robot)

# ----
# Tool
list_8 = ValueList({"measurement_tool": 0, "clay_extruder_7mm": 1, "clay_extruder_7mm_with_2d_laser": 2, "clay_extruder_v2_7mm": 3}, selected="clay_extruder_7mm_with_2d_laser")
show_4 = BooleanToggle(False)
python_4 = PythonScript(data_path=py_4, tool=list_8, tcp_frame=list_5, show=show_4)  # -> tool, M
# ---------- python_4: Python ----------
import os, math
from compas.geometry import Frame, Rotation
from compas.datastructures import Mesh
from compas_ghpython.artists import MeshArtist
from compas_fab.robots import Tool

tolerance = 0

if tool == 0:
    filename = 'measurement_tool_zaxis.stl'
    ee_frame = Frame([0, 0, 0.109], [1, 0, 0], [0, 1, 0])

elif tool == 1:
    filename = 'clay_extruder_7mm.stl'
    # real frame:
    ee_frame = Frame([-0.000502, -0.105348, 0.0662,], [1, 0, 0], [0, 0, 1])
    
    # test frame:
    # ee_frame = Frame([0.0, 0.0, 0.1,], [1, 0, 0], [0, 1, 0])
elif tool == 2:
    filename = 'clay_extruder_7mm_with_2d_laser.stl'
    # non-rotated frame:
    if tcp_frame == "nozzle":
        ee_frame = Frame([-0.0013, -0.0053, 0.3441,], [1, 0, 0], [0, 1, 0])
    elif tcp_frame == "scanner":
        # Original frame
#        ee_frame = Frame([-0.0493, -0.0063, 0.3949,], [-1, 0, 0], [0, -1, 0])
        # Raised frame
        ee_frame = Frame([-0.0493, -0.0063, 0.4200,], [-1, 0, 0], [0, -1, 0])

elif tool == 3:
    filename = 'clay_extruder_v2_7mm.stl'
    ee_frame = Frame([0, 0, 0.31976626739], [1, 0, 0], [0, 1, 0])


data_path = os.path.join(data_path, "tool_geometry")
fullfilename = os.path.join(data_path, filename)
print fullfilename

ee_mesh = Mesh.from_stl(fullfilename)

#R = Rotation.from_axis_and_angle(ee_frame.zaxis, math.radians(180), point=ee_frame.point)
#ee_frame.transform(R)

if show:
    artist = MeshArtist(ee_mesh)
    M = artist.draw()

tool = Tool(ee_mesh, ee_frame)
# ---------- end python_4 ----------
panel_9 = Panel("Attach a custom tool")
py_6 = PythonScript(robot=robot, tool=python_4.tool, attach=Toggle(True))  # -> a
# ---------- py_6: Python ----------
if attach:
    robot.attach_tool(tool, group = "ur10e")
else:
    robot.detach_tool()
# ---------- end py_6 ----------

pln_13 = Plane(create.rcf)

# ----
# Info
info = PythonScript(robot=robot)  # -> out, main_group_name
# ---------- info: Python ----------
if robot:
    robot.info()
    main_group_name = robot.main_group_name
# ---------- end info ----------
panel_10 = Panel(info.out)

# ---- group: forward kinematics
# Configuration
a1 = Slider(45, range=-360..360)
a5 = Slider(-90, range=-360..360)
a2 = Slider(-45, range=-360..360)
a3 = Slider(135, range=-360..360)
a6 = Slider(0, range=-360..360)
a4 = Slider(-180, range=-360..360)
jp = GhPythonScript()  # -> joint_positions
# ---------- jp: Python ----------
import math

joint_positions = [0,-90,90,0,90,0]
joint_positions = [math.radians(a) for a in joint_positions]
#joint_positions = [-3.136, -0.328, -1.218, 3.129, 0.852, 0.008]
#joint_positions = [0] * 6



#joint_positions = [1.6239667567485938, 0.25439606475392273, 4.409424838594969-2*3.14, 3.1901607306255908, 1.5707963267948954, 0.053170429953696939]
#joint_positions = [1.598543436748912, 0.23021224965157744, 4.712232135219824-2*3.14, 6.0531299026928744, 4.7123889803846915, 0.027747109954015234]
#joint_positions = [-1.1373533430447322, 4.0117247163121572, 5.4083762087596021-2*3.14, 1.5754733624925168, 4.7123889803846879, 3.5750356373399574]
print joint_positions
# ---------- end jp ----------
forward_kinematics = PythonScript(robot=robot, set_joint_positions=Button(), joint_positions=jp, a1=a1, a2=a2, a3=a3, a4=a4, a5=a5, a6=a6)  # -> full_configuration; inputs joint_positions: list
# ---------- forward_kinematics: Python ----------
import math
import Grasshopper
from compas.robots import Joint
from compas_fab.robots import Configuration

if set_joint_positions:

    j = 0
    for i in range(ghenv.Component.Params.Input.Count):
        nslider = ghenv.Component.Params.Input[i].Sources[0]
        if nslider.GetType() == Grasshopper.Kernel.Special.GH_NumberSlider:
            nslider.TrySetSliderValue(math.degrees(joint_positions[j]))
            j += 1

if robot:
    joint_positions = [a1, a2, a3, a4, a5, a6]
    joint_types = robot.get_configurable_joint_types()
    for i, joint_type in enumerate(joint_types):
        if joint_type == Joint.REVOLUTE:
            joint_positions[i] = math.radians(joint_positions[i])
    full_configuration = Configuration(joint_positions, joint_types)
    
print(full_configuration)
# ---------- end forward_kinematics ----------

# ---- group: inverse kinematics
select_configuration = Slider(2, range=0..7)
inverse = PythonScript(robot=robot, group=info.main_group_name, idx=select_configuration)  # -> out, plane_tool0_RCS, plane_tcp_RCS, configuration; inputs plane_WCS: Plane, idx: Int32
# ---------- inverse: Python ----------
import Rhino.Geometry as rg
import math
from compas.geometry import Frame, Transformation, Rotation
from compas_fab.robots import Configuration
from ur_fabrication_control.kinematics.ur_kinematics import inverse_kinematics
from ur_fabrication_control.kinematics.ur_params import ur_params
from compas_ghpython import draw_frame

tcp_WCS = Frame(plane_WCS.Origin, plane_WCS.XAxis, plane_WCS.YAxis)

# transform frame to robot coordinate system
print tcp_WCS
print plane_WCS
tcp_RCS = robot.RCF_in_WCF.to_local_coordinates(tcp_WCS)
tool0_RCS = robot.from_tcf_to_t0cf([tcp_RCS])[0]
tool0_RCS_rot = Frame(tool0_RCS.point, tool0_RCS.zaxis, tool0_RCS.yaxis)
print tcp_RCS
print tool0_RCS
plane_tool0_RCS = draw_frame(tool0_RCS)
plane_tcp_RCS = draw_frame(tcp_RCS)
# calculate solutions to frame
ur_params = ur_params["ur10e"] # get the parameters according to the robot model
print ur_params
solutions = inverse_kinematics(tool0_RCS, ur_params)
print solutions

if not len(solutions):
    joint_values = [0,0,0,0,0,0]
    configuration = Configuration.from_revolute_values(joint_values)
else:
    joint_values = solutions[idx]
    #print joint_values
    
    ### ***** HACK ***** ##### TODO: CHECK!!!
    for i, v in enumerate(joint_values):
        if v > math.pi:
            v -= 2*math.pi
        if v < -math.pi:
            v += 2*math.pi
        joint_values[i] = v
    ### ***** HACK ***** ##### TODO: CHECK!!!
    configuration = [Configuration.from_revolute_values(joint_values)]

print(configuration)
# ---------- end inverse ----------
select_configuration_2 = Slider(2, range=0..7)
inverse_2 = PythonScript(robot=robot, plane_nr=plane_nr, idx=select_configuration_2)  # -> out, plane_tool0_RCS, plane_tcp_RCS, configuration; inputs planes_WCS: list of Plane, plane_nr: Int32, idx: Int32
# ---------- inverse_2: Python ----------
import Rhino.Geometry as rg
import math
from compas.geometry import Frame, Transformation, Rotation
from compas_fab.robots import Configuration
from ur_fabrication_control.kinematics.ur_kinematics import inverse_kinematics
from ur_fabrication_control.kinematics.ur_params import ur_params
from compas_ghpython import draw_frame

plane_WCS = planes_WCS[plane_nr]
tcp_WCS = Frame(plane_WCS.Origin, plane_WCS.XAxis, plane_WCS.YAxis)

# transform frame to robot coordinate system
tcp_RCS = robot.RCF_in_WCF.to_local_coordinates(tcp_WCS)
tool0_RCS = robot.from_tcf_to_t0cf([tcp_RCS])[0]

print tcp_RCS
print tool0_RCS
plane_tool0_RCS = draw_frame(tool0_RCS)
plane_tcp_RCS = draw_frame(tcp_RCS)
# calculate solutions to frame
ur_params = ur_params["ur10e"] # get the parameters according to the robot model
solutions = inverse_kinematics(tool0_RCS, ur_params)

if not len(solutions):
    joint_values = [0,0,0,0,0,0]
    configuration = Configuration.from_revolute_values(joint_values)
else:
    joint_values = solutions[idx]
    #print joint_values
    
    ### ***** HACK ***** ##### TODO: CHECK!!!
    for i, v in enumerate(joint_values):
        if v > math.pi:
            v -= 2*math.pi
        if v < -math.pi:
            v += 2*math.pi
        joint_values[i] = v
    ### ***** HACK ***** ##### TODO: CHECK!!!
    
    configuration = [Configuration.from_revolute_values(joint_values)]

print(configuration)
# ---------- end inverse_2 ----------

# ----
list_9 = ValueList({"0 forward_kinematics": 0, "1 inverse_kinematics": 1, "2 inverse_kinematics": 2}, selected="2 inverse_kinematics")
filter = StreamFilter(Gate=list_9, Stream0=forward_kinematics, Stream1=inverse.configuration, Stream2=inverse_2.configuration)

# ----
# Visualisation
show_end_effector_frame = BooleanToggle(True)
show_base_frame = BooleanToggle(True)
show_collision = BooleanToggle(False)
show_frames = BooleanToggle(False)
show_visual = BooleanToggle(True)
show_acm = BooleanToggle(False)
visualize = PythonScript(
    robot=robot,
    tool=python_4.tool,
    group=info.main_group_name,
    configuration=filter,
    redraw=py_6,
    show_visual=show_visual,
    show_collision=show_collision,
    show_end_effector_frame=show_end_effector_frame,
    show_frames=show_frames,
    show_base_frame=show_base_frame,
    show_acm=show_acm,
    station=list_6)  # -> out, robot, visual, collision, attached_meshes, frames, ee_frame, tool0_frame, base_frame, base_pt; inputs redraw: list, attached_collision_meshes: list, station_pts: list
# ---------- visualize: Python ----------
import rhinoscriptsyntax as rs
import Rhino.Geometry as rg
import ghpythonlib.components as ghcomp
from compas.geometry import Vector
from compas.geometry import Point
from compas.geometry import Transformation
from compas.geometry import Frame
from compas_ghpython.artists import MeshArtist
from compas_ghpython.utilities import draw_frame
from compas_fab.robots import Configuration
from ur_fabrication_control.kinematics.ur_kinematics import forward_kinematics
from ur_fabrication_control.kinematics.ur_params import ur_params

print(configuration)

if robot and configuration:
    
    robot.update(configuration, visual=show_visual, collision=show_collision)
    ur_params = ur_params[robot.main_group_name]
    print(ur_params)
    if show_visual:
        visual = robot.artist.draw_visual()
        robot_RCF = draw_frame(robot.RCF_in_WCF)
        init_robot_plane = rg.Plane(rg.Point3d(0.207, 0.0, 1.215), rg.Vector3d(-0.707, 0.707, 0.0), rg.Vector3d(-0.707, -0.707,0.0))
        visual = ghcomp.Orient(visual, init_robot_plane, robot_RCF)[0]
        
    if show_collision:
        collision = robot.artist.draw_collision()
    
    frames = robot.transformed_frames(configuration, group)

    if show_base_frame:
        base_frame = frames[0]

    if show_end_effector_frame:
#        tool0_frame = forward_kinematics(configuration.revolute_values, ur_params)
        tool0_frame = robot.forward_kinematics(configuration, group)
        print tool0_frame
        ee_frame = robot.from_t0cf_to_tcf([tool0_frame])
        print("End-effector", ee_frame)
    
    if not show_frames:
        frames = None

#    frame = forward_kinematics(configuration.revolute_values, ur_params)
    frame = robot.forward_kinematics(configuration, options=dict(solver='model', link_name=robot.attached_tool.link_name))
    #robot.artist.update_tool(visual=visual, collision=collision, transformation=Transformation.from_frame_to_frame(Frame.worldXY(), tool0_frame))
    
    if show_acm:
        M = []
        for acm in attached_collision_meshes:
            frame = robot.forward_kinematics(configuration, options=dict(solver='model', link_name=acm.link_name))
            T = Transformation.from_frame_to_frame(Frame.worldXY(), frame)
            mesh = acm.collision_mesh.mesh.transformed(T)
            M.append(MeshArtist(mesh).draw())
        attached_meshes = M
# ---------- end visualize ----------
geo_2 = Geometry(visualize.visual)
geo_3 = Geometry(visualize.collision)
draw_4 = GhPythonScript(
    frames=[visualize.frames, visualize.ee_frame, visualize.base_frame, visualize.tool0_frame],
    scale=Slider(0.1, range=0..1))  # -> P, V, C, W; inputs frames: list; same code as draw_3
preview_3 = CustomPreview(Geometry=geo_2, Shader=ColourSwatch(SwatchColor=RGB(105, 105, 105)))
preview_4 = CustomPreview(Geometry=visualize.attached_meshes, Shader=ColourSwatch(SwatchColor=RGB(255, 255, 255)))
vdisex_2 = VectorDisplayEx(Point=draw_4.P, Vector=draw_4.V, Colour=draw_4.C, Width=draw_4.W)

# ----
# Spikes, end joints
number_slider_9 = Slider(2, range=0..10)
m = Slider(0.06, range=0..0.1)
m_2 = Slider(0.008, range=0..0.01)
m_3 = Slider(0.003, range=0..0.01)
times_layer_width = Slider(3, range=2..5)

# ----
# Size offset integration
len = Length(Curve=layers.base_crvs)

# ----
# Segmentation
number_slider_10 = Slider(0.016, range=0..0.1)
number_slider_11 = Slider(0.006, range=0..0.1)
number_slider_12 = Slider(25, range=0..100)
number_slider_13 = Slider(6, range=0..10)

dom_2 = ConstructDomain(DomainStart=0, DomainEnd=number_slider_12)
subset = SubList(List=len, Domain=dom_2, Wrap=True)  # -> List, Index
avr = Average(Input=subset.List)
expression_3 = Expression(u_val=number_slider_13, avg=avr, offset=number_slider_3, Expression="offset/(avg/(u_val/2))")
subtraction = Subtraction(A=expression, B=expression_3)
addition = Addition(A=expression_2, B=expression_3)

python_5 = GhPythonScript(
    base_crvs=layers.base_crvs,
    seg_lrs=number_slider_12,
    start_t=dam.DataBase_crv_tstart,
    wave_length=number_slider_10,
    layer_width=number_slider_11,
    u_val=number_slider_13,
    min_seg_width_0=subtraction,
    min_seg_width_1=addition)  # -> out, curve_segments, crvs_pars, crvs_pts, ond_segs, norm_segs; inputs base_crvs: list of Curve, u_val: Int32
# ---------- python_5: Python ----------
__author__ = "Gido"
__version__ = "2022.01.16"
import ghpythonlib.components as ghcomp
import Rhino.Geometry as rg
import rhinoscriptsyntax as rs
import math

crvs_pts = []
crvs_new = []
ond_segs = []
norm_segs = []

def segment_range(start, stop, step):
    count = 0
    while True:
        temp = float(start + count * step)
        if temp > stop:
            break
        yield temp
        count += 1 

def segment_range_loop(start, domain, div):
    step = (domain[1]-domain[0])/div
    count = 0
    while True:
        temp = float(start + count * step)
        if count == div:
            break
        if temp > domain[1]:
            temp -= domain[1]
            temp += domain[0]
        elif temp < domain[0]:
            temp += domain[1]
            temp -= domain[0]
        yield temp
        count += 1 

max_seg_width_0 = 1-min_seg_width_0
max_seg_width_1 = 1-min_seg_width_1

for key, crv in enumerate(base_crvs):
    new_par = start_t
    crv_len = ghcomp.Length(crv)
    crv_dom = ghcomp.CurveDomain(crv)[1]
    
    ### Create segmentation points
    m = key % (2*seg_lrs)
    if m < seg_lrs:
        crv_s0 = ((crv_len*min_seg_width_0)/(u_val/2))+((crv_len*(max_seg_width_1-min_seg_width_0))/(u_val/2)/seg_lrs)*m
    else:
        crv_s0 = ((crv_len*max_seg_width_1)/(u_val/2))-((crv_len*(max_seg_width_1-min_seg_width_0))/(u_val/2)/seg_lrs)*(m%seg_lrs)
    crv_s1 = (crv_len/(u_val/2))-crv_s0
    
    crv_inc_ts = []
    for i in range(u_val):
        if i == 0:
            inc_t = crv_s0/2
        elif i % 2 == 0:
            inc_t = crv_s0
        else:
            inc_t = crv_s1
        crv_inc_ts.append(inc_t)
    len_dom = ghcomp.ConstructDomain(0,crv_len)
    dpars = ghcomp.RemapNumbers(value = crv_inc_ts,
                                source = len_dom,
                                target = crv_dom)[0]
                                
    crv_pars = []
    for dpar in dpars:
        new_par += (dpar - crv_dom[0])
        if new_par > crv_dom[1]:
            new_par = new_par - crv_dom[1] + crv_dom[0]
        crv_pars.append(new_par)
    
    pts = ghcomp.EvaluateCurve(crv, crv_pars)[0]
    crvs_pts.extend(pts)
    
    ### Apply wave to crv globally
    crv_div = ghcomp.Round(crv_len/(wave_length*9))["nearest"]*9
    Ty = [math.sin(((j%4)*2*math.pi/4)+(key%2)*math.pi) for j in range(crv_div*4)]
    crv_range = segment_range_loop(crv_pars[0], crv_dom, (crv_div*4))
    crv_range = list(crv_range)
    crv_range = ghcomp.SortList(crv_range, crv_range)[1]
    crvpts, crvtans, crvangs = ghcomp.EvaluateCurve(crv, crv_range)
    new_pts = []
    vecs = ghcomp.CrossProduct(crvtans, rg.Vector3d.ZAxis, True)[0]
    nvec = []
    for i, vec in enumerate(vecs):
        nvec.append(rg.Vector3d(vec[0]*Ty[i]*layer_width,vec[1]*Ty[i]*layer_width,vec[2]))
    new_pts = ghcomp.Move(crvpts, nvec)[0]
    new_pts.append(new_pts[0])
    crvs_new.append(ghcomp.Interpolate(new_pts,3,False,0)[0])
    crv_new_dom = ghcomp.CurveDomain(crvs_new[key])[1]
    
    ### Segmentize the wavy curve
    cut_planes = ghcomp.PerpFrame(crv, crv_pars)
    new_crv_pars = []
    for cp in cut_planes:
        new_par = ghcomp.CurveXPlane(crvs_new[key], cp)[1]
        parpts = ghcomp.EvaluateCurve(crvs_new[key], new_par)[0]
        lvec = ghcomp.Vector2Pt(cp.Origin, parpts, False)[0]
        lvec_lens = ghcomp.VectorLength(lvec)
        if type(lvec_lens) == list:
            ind = lvec_lens.index(min(ghcomp.VectorLength(lvec)))
        else:
            new_par = [new_par]
            ind = 0
        new_crv_pars.append(new_par[ind])

    curve_segments = ghcomp.Shatter(crvs_new[key], new_crv_pars)
    print len(curve_segments)
    
    ### Combine segment cut at curve start (NO LONGER NECCESARY)
    if len(curve_segments) > 6:
        seg_lens = ghcomp.Length(curve_segments)
        new_segs = [0]*6
        min_len = min(seg_lens)
        shift = True
        
        if seg_lens.index(min_len) == 0:
            crv_cp6 = ghcomp.ControlPoints(curve_segments[6])[0]
            crv_cp0 = ghcomp.ControlPoints(curve_segments[0])[0]
            new_segs[5] = ghcomp.Interpolate(crv_cp6+crv_cp0,3,False,0)[0]
            shift = True
        elif seg_lens.index(min_len) == 6:
            crv_cp6 = ghcomp.ControlPoints(curve_segments[6])[0]
            crv_cp0 = ghcomp.ControlPoints(curve_segments[0])[0]
            new_segs[0] = ghcomp.Interpolate(crv_cp6+crv_cp0,3,False,0)[0]
            shift = True
        else:
            crv_cpn = ghcomp.ControlPoints(curve_segments[seg_lens.index(min_len)])[0]
            crv_cpn1 = ghcomp.ControlPoints(curve_segments[seg_lens.index(min_len)-1])[0]
            new_segs[seg_lens.index(min_len)] = ghcomp.Interpolate(crv_cpn+crv_cpn1,3,False,0)[0]
            shift = True
        
        for i in range(5):
            if seg_lens.index(min_len) == 6:
                new_segs[i+1] = curve_segments[i+1] 
            elif seg_lens.index(min_len) == 0:
                new_segs[i] = curve_segments[i+1] 
            else:
                if i >= seg_lens.index(min_len)-1:
                    k = i+1
                else:
                    k = i
                new_segs[k] = curve_segments[k]
    
    ### FOR 6 SEGMENTS
    else:
        new_segs = curve_segments
        if key != 0:
            seg0start = ghcomp.EndPoints(curve_segments[0])[0]
            segn1start = ghcomp.EndPoints(ond_segs[(key-1)*u_val])[0]
            dvec = ghcomp.Vector2Pt(seg0start, segn1start, False)
            if dvec.length > 0.025:
                shift = True
            else:
                shift = False
        else:
            shift = False
    new_segs = ghcomp.ShiftList(new_segs, -shift, True)
    ond_segs.extend(new_segs)

    new_norm_segs = ghcomp.Shatter(crv, crv_pars)
    if key != 0:
        seg0start = ghcomp.EndPoints(new_norm_segs[0])[0]
        segn1start = ghcomp.EndPoints(norm_segs[(key-1)*u_val])[0]
        dvec = ghcomp.Vector2Pt(seg0start, segn1start, False)
        if dvec.length > 0.025:
            shift = True
        else:
            shift = False
    else:
        shift = False
    new_norm_segs = ghcomp.ShiftList(new_norm_segs, -shift, True)
    norm_segs.extend(new_norm_segs)
#    segs_off = ghcomp.OffsetCurve(curve = segs_unw,
#                                  distance = 0.01,
#                                  corners = 0)

# ------------------------------------------------------------------------------------------------
#    crvs_segs.extend(segs_off)
#    di_crv = 0
#    for seg in curve_segments:
#        seg_off = ghcomp.OffsetCurve(curve = seg,
#                                     distance = 0.01,
#                                     corners = 0)
#        crvs_new.extend([seg, seg_off])
#        seg_len = ghcomp.Length(seg)
#        seg_div = ghcomp.Round(seg_len/wave_length)["nearest"]
##        Ty = [math.sin(((i%4)*2*math.pi/4)+(key%2)*math.pi) for i in range(1+seg_div*4)]
#        rp_seg, seg_dom = ghcomp.CurveDomain(seg)
#        seg_range = segment_range(seg_dom[0], seg_dom[1], (seg_dom[1]-seg_dom[0])/(seg_div*4))
#        segpts, segtans, segangs = ghcomp.EvaluateCurve(seg, seg_range)
#        new_pts = []
#        vecs = ghcomp.CrossProduct(segtans, rg.Vector3d.ZAxis, True)[0]
#        nvec = []
#        for i, vec in enumerate(vecs):
#            nvec.append(rg.Vector3d(vec[0]*Ty[di_crv+i]*layer_width,vec[1]*Ty[di_crv+i]*layer_width,vec[2]))
#        new_pts = ghcomp.Move(segpts, nvec)[0]
#        di_crv += seg_div
#        segs_new.append(ghcomp.Interpolate(new_pts, 3, False, 1)[0])
#    print di_crv
# ---------- end python_5 ----------
pt_6 = Point(python_5.crvs_pts)
crv_7 = Curve(python_5.ond_segs)

crv_8 = Curve(python_5.curve_segments)
crv_9 = Curve(python_5.norm_segs)

spikes = GhPythonScript(
    base_crvs=layers.base_crvs,
    start_t=dam.DataBase_crv_tstart,
    ond_segs=crv_7,
    norm_segs=crv_9,
    min_seg_width_0=subtraction,
    min_seg_width_1=addition,
    u_val=number_slider_13,
    num_spikes=number_slider_9,
    spike_length=m,
    spike_width=m_2,
    path_width=m_3,
    layer_width=number_slider_11)  # -> out, new_ond_segs, norm_segs, a, b, c; inputs base_crvs: list of Curve, ond_segs: list of Curve, norm_segs: list of Curve, u_val: Int32, num_spikes: Int32
# ---------- spikes: Python ----------
__author__ = "Zirui"
__version__ = "2022.05.14"
import rhinoscriptsyntax as rs
import Rhino.Geometry as rg
import ghpythonlib.components as ghcomp
import math
import bisect

### calculate less layers (for development only)
n_layers_calcualted = 400
base_crvs = base_crvs[:n_layers_calcualted]
norm_segs = norm_segs[:u_val*n_layers_calcualted]
ond_segs = ond_segs[:u_val*n_layers_calcualted]

new_ond_segs = []

def sortkey1(tuple):
    par = tuple[2]
    return abs(par-0.5)
    
def sortkey2(tuple):
    return tuple[1]

def sortkey3(par):
    parpt = ghcomp.EvaluateCurve(ond, par)[0]
    dis = ghcomp.Distance(parpt, cp.Origin)
    return dis

a = []
b = []

### each layer
for key, base_crv in enumerate(base_crvs):
    
    ### calculate norm domain
    normlen = base_crv.GetLength()
    normdomain = base_crv.Domain
    normdomainlen = normdomain[1] - normdomain[0]
    
    ### calculate spike parameters (crvpars)
    crvpars = []
    
    d0 = min_seg_width_0*normdomainlen/(u_val/2) # minimal length of first group of segments
    d1 = min_seg_width_1*normdomainlen/(u_val/2) # minimal length of second group of segments
    
    s0 = start_t - d0/2 + d0/num_spikes/2 # start parameter of first group of spikes
    s1 = start_t + normdomainlen/u_val - d1/2 + d1/num_spikes/2 # start parameter of second group of spikes
    
    for i in range(u_val):
        if u_val % 2 == 1:
            if i == 0:
                for j in range(num_spikes):
                    d00 = d0/2 + d1/2
                    s00 = start_t - d1/2 + d00/num_spikes/2
                    par00 = s00 + j*d00/num_spikes
                    if par00 > normdomain[1]:
                        par00 -= normdomainlen
                    crvpars.append(par00)
            elif i % 2 == 0:
                for j in range(num_spikes):
                    par0 = s0 + (i/2)*normdomainlen/(u_val/2) + j*d0/num_spikes
                    if par0 > normdomain[1]:
                        par0 -= normdomainlen
                    crvpars.append(par0)
            else:
                for j in range(num_spikes):
                    par1 = s1 + ((i-1)/2)*normdomainlen/(u_val/2) + j*d1/num_spikes
                    if par1 > normdomain[1]:
                        par1 -= normdomainlen
                    crvpars.append(par1)
        else:
            if i % 2 == 0:
                for j in range(num_spikes):
                    par0 = s0 + (i/2)*normdomainlen/(u_val/2) + j*d0/num_spikes
                    if par0 > normdomain[1]:
                        par0 -= normdomainlen
                    crvpars.append(par0)
            else:
                for j in range(num_spikes):
                    par1 = s1 + ((i-1)/2)*normdomainlen/(u_val/2) + j*d1/num_spikes
                    if par1 > normdomain[1]:
                        par1 -= normdomainlen
                    crvpars.append(par1)
            
    crvpars.sort()
    firstond = ond_segs[u_val*key]
    start_p = ghcomp.CurveClosestPoint(firstond.PointAtStart, base_crv)[1]
    index = bisect.bisect_left(crvpars, start_p)
    crvpars = crvpars[index:] + crvpars[:index]
    
    ### calculate spike points and vectors
    crvpts, crvtans, crvans = ghcomp.EvaluateCurve(base_crv, crvpars)
    vecs = ghcomp.CrossProduct(crvtans, rg.Vector3d.ZAxis, True)[0]
    newvecs = [vec*spike_length for vec in vecs]
    
    ### layer plane
    crvZ = crvpts[0].Z
    plane = ghcomp.PlaneNormal(rg.Point3d(0,0,crvZ), rg.Vector3d.ZAxis)
    
    ### each segment
    for i in range(u_val):
        ond = ond_segs[u_val*key+i]
        segpts = crvpts[i*num_spikes:(i+1)*num_spikes]
        segtans = crvtans[i*num_spikes:(i+1)*num_spikes]
        segpars = crvpars[i*num_spikes:(i+1)*num_spikes]
        segvecs = newvecs[i*num_spikes:(i+1)*num_spikes]
        
        ### offset ond
        offset = ghcomp.OffsetCurve(ond, path_width, plane, 0)
        if offset.GetLength() < 0.5*ond.GetLength():
            print("ond offset rebuilt at layer", key, "segment", i)
            count = ond.GetLength()/0.005
            rebuild = ghcomp.RebuildCurve(ond, 2, count, True)
            offset = ghcomp.OffsetCurve(rebuild, path_width, plane, 0)
        
        ### each joint
        for j, pt in enumerate(segpts):
            
            ### get tangents, vectors, parameters
            tan = segtans[j]
            vec = segvecs[j]
            par = segpars[j]
            
            ### generate spike polyline
            normleft = ghcomp.EvaluateCurve(base_crv, par - normdomainlen*spike_width/normlen)[0]
            normright = ghcomp.EvaluateCurve(base_crv, par + normdomainlen*spike_width/normlen)[0]
            tipleft = pt + vec - 0.5*path_width*tan
            tipright = pt + vec + 0.5*path_width*tan
            spike = ghcomp.PolyLine([normleft, tipleft, tipright, normright], False)
            spike = ghcomp.ExtendCurve(spike, 0, 2*layer_width, 2*layer_width)
            spikedomain = ghcomp.ConstructDomain(0,1)
            spike = ghcomp.CurveDomain(spike, spikedomain)[0]
            
            ### calculate intersection (spike polyline X ond offset)
            xpts, xparsoffset, xparsspike = ghcomp.CurveXCurve(offset, spike)
            
            ### rebuild if intersection fails
            if type(xpts) == list:
                rebuildoffset = offset
            else:
                count = offset.GetLength()/0.005
                rebuildoffset = ghcomp.RebuildCurve(offset, 2, count, False)
                xpts, xparsoffset, xparsspike = ghcomp.CurveXCurve(rebuildoffset, spike)
                print("ond offset rebuilt at layer", key, "segment", i, "joint", j)
            
            ### find correct intersections if more than 2
            xlist = zip(xpts, xparsoffset, xparsspike)
            if len(xlist) != 2:
                xlist.sort(key = sortkey1)
                xlist.sort(key = sortkey2)
            unzipped_object = zip(*xlist)
            unzipped_list = list(unzipped_object)
            xpts = unzipped_list[0]
            xparsoffset = unzipped_list[1]
            xparsspike = unzipped_list[2]
            offsetdom = ghcomp.ConstructDomain(xparsoffset[0], xparsoffset[1])
            spikedom = ghcomp.ConstructDomain(xparsspike[0], xparsspike[1])
            
            ### trim spike polyline and ond offset
            spike = ghcomp.SubCurve(spike, spikedom)
            newoffset = ghcomp.SubCurve(rebuildoffset, offsetdom)
            a.append(spike)
            a.append(newoffset)
            ### joint perp frame
            cp = ghcomp.PerpFrame(base_crv, par)
            
            ### intersect ond and cp
            ond_par = ghcomp.CurveXPlane(ond, cp)[1]
            
            ### find correct intersection if more than 1
            if type(ond_par) != list:
                None
            else:
                ond_par.sort(key = sortkey3)
                ond_par = ond_par[0]
            
            ### split ond
            ondlen = ond.GetLength()
            onddomain = ond.Domain
            onddomainlen = onddomain[1] - onddomain[0]
            ond_parleft = ond_par - (onddomainlen*0.5*path_width)/ondlen
            ond_parright = ond_par + (onddomainlen*0.5*path_width)/ondlen
            
            ond_parpt = ond.PointAt(ond_par)
            ond_parptleft = ond.PointAt(ond_parleft)
            ond_parptright = ond.PointAt(ond_parright)
            
            ondsegs = ghcomp.Shatter(ond, [ond_parleft, ond_parright])
            ondleft = ondsegs[0]
            ondright =ondsegs[-1]
            
            ### split ond offset
            newoffset = ghcomp.RebuildCurve(newoffset, 2, 10, True)
            off_parpt, off_par, distance = ghcomp.CurveClosestPoint(ond_parpt, newoffset)
            offlen = newoffset.GetLength()
            offdomain = newoffset.Domain
            offdomainlen = offdomain[1] - offdomain[0]
            off_parleft = off_par - (offdomainlen*0.5*path_width)/offlen
            off_parright = off_par + (offdomainlen*0.5*path_width)/offlen
            off_parptleft = newoffset.PointAt(off_parleft)
            off_parptright = newoffset.PointAt(off_parright)
            
            offsegs = ghcomp.Shatter(newoffset, [off_parleft, off_parright])
            offleft = offsegs[0]
            offright = offsegs[-1]
            
            ### generate mid lines
            mid1 = ghcomp.Line(ond_parptleft, off_parptright)
            mid2 = ghcomp.Line(off_parptleft, ond_parptright)
            
            ### join segments
            spike = ghcomp.FlipCurve(spike, None)[0]
            newond = ghcomp.JoinCurves([ondleft, mid1, offright, spike, offleft, mid2, ondright], True)
            ond = newond
            
        new_ond_segs.append(ond)
# ---------- end spikes ----------
endjonits = GhPythonScript(
    base_crvs=layers.base_crvs,
    ond_segs=spikes.new_ond_segs,
    norm_segs=spikes.norm_segs,
    u_val=number_slider_13,
    seg_lrs=number_slider_12,
    path_width=m_3,
    layer_width=number_slider_11,
    layer_height=number_slider_5,
    end_joint_type=line_ab,
    tangent_connection=line_ab_tangent_to_ond,
    increase=times_layer_width,
    overhang_angle=degree)  # -> new_ond_segs_chunked, new_ond_segs, norm_segs, a, b, c; inputs base_crvs: list of Curve, ond_segs: list of Curve, norm_segs: list of Curve, u_val: Int32, seg_lrs: Int32, end_joint_type: Int32
# ---------- endjonits: Python ----------
__author__ = "Zirui"
__version__ = "2022.05.21"
import rhinoscriptsyntax as rs
import Rhino.Geometry as rg
import ghpythonlib.components as ghcomp
import math
        
### calculate less layers (for development only)
n_layers_calculated = 400
norm_segs = norm_segs[:u_val*n_layers_calculated]
ond_segs = ond_segs[:u_val*n_layers_calculated]
        
### segment sequence
hseq = [5,1,3,4,0,2]
        
class Chunk():
    def __init__(self, id):
        self.id = id
    @property
    def v(self):
        v = self.id//u_val
        return v
    @property
    def u(self):
        u = self.id%u_val
        return u
    @property
    def layers(self):
        if self.id < u_val/2:
            start_layer = 0
            end_layer = seg_lrs
        else:
            if self.u < u_val/2:
                start_layer = (self.v-1)*seg_lrs*2 + seg_lrs
                end_layer = self.v*seg_lrs*2 + seg_lrs
            else:
                start_layer = self.v*seg_lrs*2
                end_layer = (self.v+1)*seg_lrs*2
        layers = (start_layer, end_layer)
        return layers
    @property
    def layer_count(self):
        count = self.layers[1] - self.layers[0] + 1
        return count
    @property
    def is_valid(self):
        if self.layers[0] >= n_layers_calculated:
            return False
        else:
            return True
    @property
    def segs(self):
        new_u = hseq[self.u]
        segids = []
        for i in range(self.layers[0], self.layers[1]):
            if i < n_layers_calculated:
                segids.append(6*i+new_u)
            else:
                break
        segs = []
        for key, id in enumerate(segids):
            segs.append(Segment(id, self, key))
        return segs
    @property
    def boundary(self):
        normstarts = [seg.norm.PointAtStart for seg in self.segs]
        normends = [seg.norm.PointAtEnd for seg in self.segs]
        btmnorm = self.segs[0].norm
        topnorm = self.segs[-1].norm
        plleft = ghcomp.PolyLine(normstarts, False)
        plright = ghcomp.PolyLine(normends, False)
        plright.Reverse()
        btmnorm.Reverse()
        boundary = ghcomp.JoinCurves([plleft, topnorm, plright, btmnorm], True)
        return boundary
    @property
    def center(self):
        btmnorm = self.segs[0].norm
        topnorm = self.segs[-1].norm
        ct = (ghcomp.CurveMiddle(btmnorm) + ghcomp.CurveMiddle(topnorm))/2
        return ct
            
class Segment():
    def __init__(self, id, chunk, key):
        self.id = id
        self.chunk = chunk
        self.key = key
    @property
    def ond(self):
        ond = ond_segs[self.id]
        return ond
    @property
    def norm(self):
        norm = norm_segs[self.id]
        return norm
    @property
    def base(self):
        base = base_crvs[self.id//u_val]
        return base

def generate_end_joints(chunk):
    topseg = chunk.segs[-1]
    btmseg = chunk.segs[0]
    
    ### calculate parameters
    upper_chunk = Chunk(chunk.id+u_val)
    if upper_chunk.is_valid:
        ref_seg = upper_chunk.segs[0]
        topseg_trimmed = ghcomp.ExtendCurve(ref_seg.norm, 0, -path_width/2, -path_width/2)
    else:
        topseg_trimmed = ghcomp.ExtendCurve(topseg.norm, 0, -path_width/2, -path_width/2)
    base_parameter_left = ghcomp.CurveClosestPoint(topseg_trimmed.PointAtStart, topseg.base)[1]
    base_parameter_right = ghcomp.CurveClosestPoint(topseg_trimmed.PointAtEnd, topseg.base)[1]
    
    ### calculate tangents and vectors
    if len(chunk.segs) <= seg_lrs:
        tan_lower_left = (topseg.norm.TangentAtStart + btmseg.norm.TangentAtStart)/2
        tan_lower_right = (topseg.norm.TangentAtEnd + btmseg.norm.TangentAtEnd)/2
    else:
        midseg1 = chunk.segs[seg_lrs-1]
        midseg2 = chunk.segs[seg_lrs]
        tan_lower_left = (midseg1.norm.TangentAtStart + btmseg.norm.TangentAtStart)/2
        tan_lower_right = (midseg1.norm.TangentAtEnd + btmseg.norm.TangentAtEnd)/2
        tan_upper_left = (midseg2.norm.TangentAtStart + topseg.norm.TangentAtStart)/2
        tan_upper_right = (midseg2.norm.TangentAtEnd + topseg.norm.TangentAtEnd)/2
        vec_upper_left_OD = ghcomp.CrossProduct(tan_upper_left, rg.Vector3d.ZAxis, True)[0]*out_distance
        vec_upper_right_OD = ghcomp.CrossProduct(tan_upper_right, rg.Vector3d.ZAxis, True)[0]*out_distance
        vec_upper_left_OG = vec_upper_left_OD*mid_distance/out_distance
        vec_upper_right_OG = vec_upper_right_OD*mid_distance/out_distance
        vec_upper_left_OC = vec_upper_left_OD*in_distance/out_distance
        vec_upper_right_OC = vec_upper_right_OD*in_distance/out_distance
    vec_lower_left_OD = ghcomp.CrossProduct(tan_lower_left, rg.Vector3d.ZAxis, True)[0]*out_distance
    vec_lower_right_OD = ghcomp.CrossProduct(tan_lower_right, rg.Vector3d.ZAxis, True)[0]*out_distance
    vec_lower_left_OG = vec_lower_left_OD*mid_distance/out_distance
    vec_lower_right_OG = vec_lower_right_OD*mid_distance/out_distance
    vec_lower_left_OC = vec_lower_left_OD*in_distance/out_distance
    vec_lower_right_OC = vec_lower_right_OD*in_distance/out_distance
    base_parameter_shift = math.tan(math.radians(overhang_angle))*chunk.layer_count*layer_height*(btmseg.base.Domain[1]-btmseg.base.Domain[0])/btmseg.base.GetLength()/chunk.layer_count
    
    ### draw curves
    success = False
    for seg in chunk.segs:
        trimmed_norm = ghcomp.ExtendCurve(seg.norm, 0, -path_width/2, -path_width/2)
        norm_parameter_shift = path_width*(seg.base.Domain[1]-seg.base.Domain[0])/seg.base.GetLength()
        norm_parameter_left = ghcomp.CurveClosestPoint(seg.base.PointAt(base_parameter_left-base_parameter_shift*(chunk.layer_count-1-seg.key)), trimmed_norm)[1]+norm_parameter_shift
        norm_parameter_right = ghcomp.CurveClosestPoint(seg.base.PointAt(base_parameter_right+base_parameter_shift*(chunk.layer_count-1-seg.key)), trimmed_norm)[1]-norm_parameter_shift
        norm_shattered = ghcomp.Shatter(trimmed_norm, [norm_parameter_left, norm_parameter_right])
        norm_tan_left = seg.norm.TangentAtStart*path_width
        norm_tan_right = seg.norm.TangentAtEnd*path_width
        cos_lower_left = math.cos(ghcomp.Angle(tan_lower_left,norm_tan_left)[0])
        cos_lower_right = math.cos(ghcomp.Angle(tan_lower_right,norm_tan_right)[0])
        if end_joint_type == 0:
            trimmer_factor = 1
        elif end_joint_type == 1:
            trimmer_factor = 2
        if seg.key < seg_lrs:
            crv_DE_left = ghcomp.Move(norm_shattered[0], vec_lower_left_OD /cos_lower_left)[0]
            crv_DE_right = ghcomp.Move(norm_shattered[2], vec_lower_right_OD /cos_lower_right)[0]
            crv_FG_left = ghcomp.Move(norm_shattered[0], vec_lower_left_OG /cos_lower_left)[0]
            crv_FG_right = ghcomp.Move(norm_shattered[2], vec_lower_right_OG /cos_lower_right)[0]
            pt_C_left = trimmed_norm.PointAtStart + vec_lower_left_OC /cos_lower_left
            pt_C_right = trimmed_norm.PointAtEnd + vec_lower_right_OC /cos_lower_right
            ond_trimmer_left = rg.Plane(trimmed_norm.PointAtStart+norm_tan_left*trimmer_factor, vec_lower_left_OD, rg.Vector3d.ZAxis)
            ond_trimmer_right = rg.Plane(trimmed_norm.PointAtEnd-norm_tan_right*trimmer_factor, vec_lower_right_OD, rg.Vector3d.ZAxis)
        else:
            cos_upper_left = math.cos(ghcomp.Angle(tan_upper_left,norm_tan_left)[0])
            cos_upper_right =math.cos(ghcomp.Angle(tan_upper_right,norm_tan_right)[0])
            crv_DE_left = ghcomp.Move(norm_shattered[0], vec_upper_left_OD /cos_upper_left)[0]
            crv_DE_right = ghcomp.Move(norm_shattered[2], vec_upper_right_OD /cos_upper_right)[0]
            crv_FG_left = ghcomp.Move(norm_shattered[0], vec_upper_left_OG /cos_upper_left)[0]
            crv_FG_right = ghcomp.Move(norm_shattered[2], vec_upper_right_OG /cos_upper_right)[0]
            pt_C_left = trimmed_norm.PointAtStart + vec_upper_left_OC /cos_upper_left
            pt_C_right = trimmed_norm.PointAtEnd + vec_upper_right_OC /cos_upper_right
            ond_trimmer_left = rg.Plane(trimmed_norm.PointAtStart+norm_tan_left*trimmer_factor, vec_upper_left_OD, rg.Vector3d.ZAxis)
            ond_trimmer_right = rg.Plane(trimmed_norm.PointAtEnd-norm_tan_right*trimmer_factor, vec_upper_right_OD, rg.Vector3d.ZAxis)
        ond_trimmer_left = ghcomp.Circle(ond_trimmer_left, 2*layer_width)
        ond_trimmer_right = ghcomp.Circle(ond_trimmer_right, 2*layer_width)
        ond_trimmer_left = ghcomp.BoundarySurfaces(ond_trimmer_left)
        ond_trimmer_right = ghcomp.BoundarySurfaces(ond_trimmer_right)
        X = rs.CurveSurfaceIntersection(seg.ond, ond_trimmer_left, tolerance = 0.0001, angle_tolerance = None)
        if X == None:
            ond_parameter_left = seg.ond.Domain[0]
        else:
            ond_parameter_left = max([event[5] for event in X])
        X = rs.CurveSurfaceIntersection(seg.ond, ond_trimmer_right, tolerance = 0.0001, angle_tolerance = None)
        if X == None:
            ond_parameter_right = seg.ond.Domain[1]
        else:
            ond_parameter_right = min([event[5] for event in X])
        pt_B_left = pt_C_left + norm_tan_left
        pt_B_right = pt_C_right - norm_tan_right
        pt_A_left = seg.ond.PointAt(ond_parameter_left)
        pt_A_right = seg.ond.PointAt(ond_parameter_right)
        
        if tangent_connection:
            seed_shift = 0.05
            max_iteration = 100
            angle_tolerance = math.radians(15)
            # left
            ond_tan_at_A_left= seg.ond.TangentAt(ond_parameter_left)
            vec_BA_left = rg.Vector3d(pt_A_left - pt_B_left)
            dot_product = ond_tan_at_A_left*vec_BA_left
            if dot_product < 0:
                seed_left = ond_parameter_left
                
                for i in range(max_iteration):
                    angle = ghcomp.Angle(seg.ond.TangentAt(seed_left), rg.Vector3d(seg.ond.PointAt(seed_left) - pt_B_left))[0]
                    c.append(seg.ond.PointAt(seed_left))
                    if angle < angle_tolerance:
                        break
                    else:
                        seed_left += seed_shift
                ond_parameter_left = seed_left
                pt_A_left = seg.ond.PointAt(ond_parameter_left)
            # right
            ond_tan_at_A_right= seg.ond.TangentAt(ond_parameter_right)
            vec_AB_right = rg.Vector3d(pt_B_right - pt_A_right)
            dot_product = ond_tan_at_A_right*vec_AB_right
            if dot_product < 0:
                seed_right = ond_parameter_right
                for i in range(max_iteration):
                    angle = ghcomp.Angle(seg.ond.TangentAt(seed_right), rg.Vector3d(pt_B_right - seg.ond.PointAt(seed_right)))[0]
                    c.append(seg.ond.PointAt(seed_right))
                    if angle < angle_tolerance:
                        break
                    else:
                        seed_right -= seed_shift
                ond_parameter_right = seed_right
                pt_A_right = seg.ond.PointAt(ond_parameter_right)
                
        crv_FG_left = ghcomp.ExtendCurve(crv_FG_left, 0, -0.5*path_width, 0)
        crv_FG_right = ghcomp.ExtendCurve(crv_FG_right, 0, 0, -0.5*path_width)
        line_EF_left = rg.Line(crv_FG_left.PointAtEnd, crv_DE_left.PointAtEnd)
        line_EF_right = rg.Line(crv_DE_right.PointAtStart, crv_FG_right.PointAtStart)
        line_CD_left = rg.Line(crv_DE_left.PointAtStart, pt_C_left)
        line_CD_right = rg.Line(pt_C_right, crv_DE_right.PointAtEnd)
        line_BC_left = rg.Line(pt_C_left, pt_B_left)
        line_BC_right = rg.Line(pt_B_right, pt_C_right)
        line_AB_left = rg.Line(pt_B_left, pt_A_left)
        line_AB_right = rg.Line(pt_A_right, pt_B_right)
        trimmed_ond = rs.AddSubCrv(seg.ond, ond_parameter_left, ond_parameter_right)
        trimmed_ond = rs.coercerhinoobject(trimmed_ond).Geometry
        ### join curves
        crv_DE_left.Reverse()
        crv_DE_right.Reverse()
        joint_left = ghcomp.JoinCurves([crv_FG_left, line_EF_left, crv_DE_left, line_CD_left, line_BC_left, line_AB_left], True)
        joint_right = ghcomp.JoinCurves([line_AB_right, line_BC_right, line_CD_right, crv_DE_right, line_EF_right, crv_FG_right], True)
        new_ond = ghcomp.JoinCurves([joint_left, trimmed_ond, joint_right], True)
        if type(new_ond) != list:
            success = True
        new_ond_segs_chunked.append((new_ond, seg.id))
    if success:
        print("Chunk {} successful".format(chunk.id))
    else:
        print("Chunk {} failed".format(chunk.id))

        
### joint parameters
out_distance = (1*increase)*layer_width
mid_distance = layer_width + path_width
in_distance = -layer_width

a = []
b = []
c = []
### generate end joints
new_ond_segs_chunked = []
chunkid = 0
while True:
    chunk = Chunk(chunkid)
    if chunk.is_valid:
        generate_end_joints(chunk)
        a.append(chunk.center)
        b.append(chunk.boundary)
        chunkid += 1
    else:
        break
        
### sort new_ond_segs to original order
def take_id(tuple):
    return tuple[1]
new_ond_segs = new_ond_segs_chunked
new_ond_segs_chunked = [tuple[0] for tuple in new_ond_segs_chunked]
new_ond_segs.sort(key = take_id)
new_ond_segs = [tuple[0] for tuple in new_ond_segs]
# ---------- end endjonits ----------
geometry = Geometry(endjonits.norm_segs)
geometry_2 = Geometry(endjonits.new_ond_segs_chunked)

geo_4 = Geometry(endjonits.c)
geometry_3 = Geometry(endjonits.new_ond_segs)
geometry_4 = Geometry(endjonits.a)
geometry_5 = Geometry(endjonits.b)
dam_2 = DataDam(DataA=geometry_3, DataB=geometry, BufferDelay=10000000, BufferMode=0)  # -> DataA, DataB

ghpython_script = GhPythonScript(segs=geometry_2)  # -> out, segs, parameters; inputs segs: list of Curve
# ---------- ghpython_script: Python ----------
import rhinoscriptsyntax as rs
import Rhino.Geometry as rg
import ghpythonlib.components as ghcomp
import math

lower_limit = 0.01
upper_limit = 1
domain = upper_limit - lower_limit

parameters = [lower_limit + domain*i/len(segs) for i in range(len(segs))]
# ---------- end ghpython_script ----------
colour_swatch = ColourSwatch(SwatchColor=RGB(0, 0, 0))
item_index = ItemIndex(List=geometry_4, Item=geometry_4)
inspect = GhPythonScript(
    ond_segs=geometry_3,
    norm_segs=geometry,
    show_norm=Toggle(False),
    u_val=number_slider_13,
    current_layer=Slider(14, range=0..399))  # -> out, show; inputs ond_segs: list of Curve, norm_segs: list of Curve, show_norm: Boolean, u_val: Int32, current_layer: Int32
# ---------- inspect: Python ----------
import rhinoscriptsyntax as rs
import Rhino.Geometry as rg
import ghpythonlib.components as ghcomp
import math


ond_segs = ond_segs[u_val*current_layer:u_val*(current_layer+1)]

show = []
show.extend(ond_segs)
if show_norm:
    norm_segs = norm_segs[u_val*current_layer:u_val*(current_layer+1)]
    show.extend(norm_segs)
# ---------- end inspect ----------
gradient = Gradient(
    LowerLimit=0,
    UpperLimit=1,
    Parameter=ghpython_script.parameters,
    stops=[0: RGB(224, 165, 70), 0: RGB(52, 248, 100), 0: RGB(176, 97, 0), 0: RGB(2, 179, 186), 0: RGB(142, 202, 70), 0: RGB(228, 177, 76)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])
ghpython_script_2 = GhPythonScript(id=item_index)  # -> text
# ---------- ghpython_script_2: Python ----------
import rhinoscriptsyntax as rs
import Rhino.Geometry as rg
import ghpythonlib.components as ghcomp
import math

u = id%6
v = id//6

text = """id = {}
u = {}
v = {}""".format(id, u, v)
# ---------- end ghpython_script_2 ----------
custom_preview = CustomPreview(Geometry=ghpython_script.segs, Material=gradient)
custom_preview_2 = CustomPreview(Geometry=inspect.show, Material=ColourSwatch(SwatchColor=RGB(255, 255, 255)))
text_tag = TextTag(Location=geometry_4, Text=ghpython_script_2, Colour=colour_swatch)
custom_preview_3 = CustomPreview(Geometry=[geometry_5, loft], Material=colour_swatch)

# ----
# AM Model
number_slider_14 = Slider(0, range=-1..1)
pt_7 = ConstructPoint(XCoordinate=0, YCoordinate=0, ZCoordinate=Slider(0, range=-0.1..0.01))
speed = Slider(8000, range=0..51200)
ind = Slider(0, range=0..30)
list_10 = ValueList({"Full", "Segment"}, selected="Segment")
xy = XYPlane(Origin=pt_7)
ammodel = GhPythonScript(
    output=list_10,
    tangential_z=Toggle(False),
    rotation_z=Slider(5, range=-45..45),
    ond_segs=dam_2.DataA,
    norm_segs=dam_2.DataB,
    div_length=Slider(0.003, range=0..0.1),
    ind_current_seg=ind,
    trim_left=Slider(0, range=0..30),
    trim_right=Slider(0, range=0..30),
    offset_left_bot=Slider(0, range=-1..1),
    offset_right_bot=number_slider_14,
    fade_to_top=Toggle(True),
    ext_speed=speed,
    create=Toggle(True),
    cp=xy)  # -> out, current_seg, a, fab_norm_segs, fab_ond_segs, am_model; inputs ond_segs: list of Curve, norm_segs: list of Curve, ind_current_seg: Int32
# ---------- ammodel: Python ----------
__author__ = "Gido"
__version__ = "2022.01.27"
import math

from am_information_model import AMModel
from am_information_model import Layer
from am_information_model import Node

from compas.geometry import Frame
from compas.geometry import Transformation
from compas.geometry import Rotation
from compas.geometry import Vector

from scriptcontext import sticky as st
import rhinoscriptsyntax as rs
import Rhino.Geometry as rg
import ghpythonlib.components as ghcomp

if "am_model" not in st:
    st["am_model"] = None

hseq = [5,1,3,4,0,2]
vseq = [25]*3+[50]*45+[25]*3

ct = int(len(ond_segs)/len(hseq))
h_ond_segs = [[]]*ct
h_norm_segs = [[]]*ct
for u in range(ct):
    h_ond_segs[u] = ond_segs[u*len(hseq):(u+1)*len(hseq)]
    h_norm_segs[u] = norm_segs[u*len(hseq):(u+1)*len(hseq)]

h_ond_segs = map(list, zip(*h_ond_segs))
h_norm_segs = map(list, zip(*h_norm_segs))

fab_ond_segs = [[]]*len(vseq)
fab_norm_segs = [[]]*len(vseq)
for v in range(len(vseq)):
    hsind = hseq[v%6]
    vsind = int((v-v%6)/6)
    if vsind > 0:
        dom_start = 0
        for i in range(vsind):
            dom_start += vseq[i*6+v%6]
    else:
        dom_start = 0
    fab_ond_segs[v] = h_ond_segs[hsind][dom_start:dom_start+vseq[v]]
    fab_norm_segs[v] = h_norm_segs[hsind][dom_start:dom_start+vseq[v]]

current_seg = fab_ond_segs[ind_current_seg] + fab_norm_segs[ind_current_seg]
a = fab_ond_segs[ind_current_seg]
if create and output=="Segment":
    am_model = AMModel()
    fab_norm_seg = fab_norm_segs[ind_current_seg]
    fab_norm_mid = ghcomp.CurveMiddle(fab_norm_seg)
    if tangential_z:
        zvecs = ghcomp.Vector2Pt(fab_norm_mid[0:len(fab_norm_mid)-1], fab_norm_mid[1:len(fab_norm_mid)], True)[0]
        zvecs.append(zvecs[-1])
    else:
        zvecs = [rg.Vector3d.ZAxis]*len(fab_norm_seg)
    fab_seg = fab_ond_segs[ind_current_seg]
    for i, seg in enumerate(fab_seg):
#        seg_end_pts = ghcomp.EndPoints(fab_norm_seg[i])
#        seg_off_left_bot = ghcomp.OffsetCurve(fab_norm_seg[i], -offset_left_bot+(offset_left_bot/len(fab_seg))*i, corners=0)
#        seg_off_right_bot = ghcomp.OffsetCurve(fab_norm_seg[i], -offset_right_bot+(offset_right_bot/len(fab_seg))*i, corners=0)
#        seg_off_left_bot_end_pts = ghcomp.EndPoints(seg_off_left_bot) 
#        seg_off_right_bot_end_pts = ghcomp.EndPoints(seg_off_right_bot) 
#        vec_off_left = ghcomp.Vector2Pt(seg_end_pts[0], seg_off_left_bot_end_pts[0], False)[0]
#        vec_init = Vector.from_start_end(seg_end_pts[0], seg_end_pts[1])
#        vec_off_right = Vector.from_start_end(seg_off_left_bot_end_pts[0], seg_off_right_bot_end_pts[1])
#        angle_correction = vec_init.angle_signed(vec_off_right, Vector.Zaxis())
        
#        seg_off_left = ghcomp.Move(seg, vec_off_left)[0]
#        seg_corr = ghcomp.Rotate3D(seg_off_left, angle_correction, seg_off_left_bot_end_pts[0], rg.Vector3d.ZAxis)[0]
        
        mid_plane = ghcomp.PerpFrame(fab_norm_seg[i], ghcomp.CurveClosestPoint(fab_norm_mid[i], fab_norm_seg[i])[1])
        cvec = ghcomp.Vector2Pt(mid_plane.Origin, rg.Plane.WorldXY.Origin, True)[0]
        
        if cvec[0]/abs(cvec[0]) == mid_plane.XAxis[0]/abs(mid_plane.XAxis[0]):
            xvec = mid_plane.XAxis
        else:
            xvec = -mid_plane.XAxis
        
        seg_end_pts = ghcomp.EndPoints(fab_norm_seg[i])
        vec_init = Vector.from_start_end(seg_end_pts[0], seg_end_pts[1])
        
        if fade_to_top:
            offset_left = (-offset_left_bot+(offset_left_bot/len(fab_seg))*i)
            offset_right = (-offset_right_bot+(offset_right_bot/len(fab_seg))*i)
        else:
            offset_left = -offset_left_bot
            offset_right = -offset_right_bot
        
        seg_off_left = ghcomp.Move(seg, xvec*offset_left)[0]
        norm_seg_off_left = ghcomp.Move(fab_norm_seg[i], xvec*offset_left)[0]
        norm_seg_off_left_bot_end_pts = ghcomp.EndPoints(norm_seg_off_left)
        
        pt_off_right = ghcomp.Move(seg_end_pts[1], xvec*offset_right)[0]
        vec_off_right = Vector.from_start_end(norm_seg_off_left_bot_end_pts[0], pt_off_right)
        angle_correction = vec_init.angle_signed(vec_off_right, Vector.Zaxis())
        print angle_correction
        
        seg_corr = ghcomp.Rotate3D(seg_off_left, angle_correction, norm_seg_off_left_bot_end_pts[0], rg.Vector3d.ZAxis)[0]
        
        seg_pts = ghcomp.DivideLength(seg_corr, div_length)[0]
        seg_np = len(seg_pts)
        norm_seg_tans = ghcomp.DivideCurve(fab_norm_seg[i], seg_np-1, False)[1]
        norm_seg_tans = ghcomp.UnitVector(norm_seg_tans)
        yvecs = ghcomp.CrossProduct(norm_seg_tans, zvecs[i], True)[0]
        nyvecs = []
        print len(norm_seg_tans), seg_np
        for k, yvec in enumerate(yvecs):
            nyvec = ghcomp.Rotate3D(yvec, math.radians(rotation_z), seg_pts[k], norm_seg_tans[k])[0]
            nyvecs.append(nyvec)
        layer = Layer()
        layer.mid_frame = Frame(fab_norm_mid[i], xvec, -mid_plane.ZAxis)
        if i%2==1:
            seg_pts.reverse()
            norm_seg_tans.reverse()
            nyvecs.reverse()
        for k, pt in enumerate(seg_pts):
            if i%2==0 and (k < trim_left or k>len(seg_pts)-trim_right):
                pass
            elif i%2==1 and (k < trim_right or k>len(seg_pts)-trim_left):
                pass
            else:
                frame = Frame(pt, norm_seg_tans[k], nyvecs[k])
#                R = Rotation.from_axis_and_angle(frame.zaxis, math.pi/6, frame.point)
#                frame.transform(R)
                node = Node(frame, 0.003)
                if k == len(seg_pts)-trim_right:
                    node.ext_state = 0
                    node.air_state = 1
                else:
                    node.ext_state = 1
                    node.air_state = 1
                node.ext_speed = ext_speed
                layer.add_node(node)
        am_model.add_layer(layer)

if create and output=="Full":
    am_model = AMModel()
    for j, fab_seg in enumerate(fab_ond_segs):
        fab_norm_seg = fab_norm_segs[j]
        fab_norm_mid = ghcomp.CurveMiddle(fab_norm_seg)
        zvecs = ghcomp.Vector2Pt(fab_norm_mid[0:len(fab_norm_mid)-1], fab_norm_mid[1:len(fab_norm_mid)], True)[0]
        zvecs.append(zvecs[-1])
        for i, seg in enumerate(fab_seg):
            seg_len = ghcomp.Length(seg)
            seg_np = int(seg_len/0.002)
            seg_pts = ghcomp.DivideCurve(seg, seg_np, False)[0]
            norm_seg_tans = ghcomp.DivideCurve(fab_norm_seg[i], seg_np, False)[1]
            norm_seg_tans = ghcomp.UnitVector(norm_seg_tans)
            yvecs = ghcomp.CrossProduct(norm_seg_tans, zvecs[i], True)[0]
            layer = Layer()
            mid_plane = ghcomp.PerpFrame(fab_norm_seg[i], ghcomp.CurveClosestPoint(fab_norm_mid[i], fab_norm_seg[i])[1])
            cvec = ghcomp.Vector2Pt(mid_plane.Origin, rg.Plane.WorldXY.Origin, True)[0]
            if cvec[0]/abs(cvec[0]) == mid_plane.XAxis[0]/abs(mid_plane.XAxis[0]):
                xvec = mid_plane.XAxis
            else:
                xvec = -mid_plane.XAxis
            layer.mid_frame = Frame(fab_norm_mid[i], xvec, -mid_plane.ZAxis)
            for k, pt in enumerate(seg_pts):
                if k < trim_left or k>len(seg_pts)-trim_right:
                    pass
                else:
                    frame = Frame(pt, norm_seg_tans[k], yvecs[k])
    #                R = Rotation.from_axis_and_angle(frame.zaxis, -math.pi/3, frame.point)
    #                frame.transform(R)
                    node = Node(frame, 0.003)
                    if k == len(seg_pts)-trim_right:
                        node.ext_state = 0
                        node.air_state = 1
                    else:
                        node.ext_state = 1
                        node.air_state = 1
                    node.ext_speed = ext_speed
                    layer.add_node(node)
            am_model.add_layer(layer)

if cp is not None and create:
    cf = Frame(cp.Origin, cp.XAxis, cp.YAxis)
    of = Frame([0,0,0],[1,0,0], [0,1,0])
    T = Transformation.from_frame_to_frame(of,cf)
    am_model_tf = am_model.transformed(T)
    st["am_model"] = am_model_tf
    
am_model = st["am_model"]
# ---------- end ammodel ----------
crv_10 = Curve(ammodel.current_seg)
