# Grasshopper definition mobile_robot_workspace_only_ROS.ghx (Grasshopper 1.0.7)

# ---- group: ROS client
disconnect = Button()
connect = Button()
connect_2 = PythonScript(ip="192.168.0.40", connect=connect, disconnect=disconnect)  # -> out, ros_client
# ---------- connect_2: Python ----------
import sys
import scriptcontext as sc
from compas_fab.backends import RosClient

key = 'rosclient_%s' % str(ghenv.Component.InstanceGuid)
previous_client = sc.sticky.get(key, None)

if previous_client and (connect or disconnect):
    previous_client.close()

if connect:
    ros_client = RosClient(ip, 9090)
    sc.sticky[key] = ros_client
    ros_client.run(5)

ros_client = sc.sticky.get(key, None)
print('ROS connected: {}'.format(ros_client.is_connected if ros_client else 'False'))
# ---------- end connect_2 ----------
is_connected = Panel(connect_2.out)

# ----
# Subscribe to topics
toggle = BooleanToggle(True)
subscriber = GhPythonScript(
    ros_client=connect_2.ros_client,
    subscribe_to_robot_lift_topic=toggle,
    subscribe_to_robotnik_base_topic=toggle,
    subscribe_to_static_tf_topic=toggle,
    subscribe_to_battery_data=toggle)  # -> out
# ---------- subscriber: Python ----------
import time
import logging
import datetime
import Grasshopper
from roslibpy import Topic
from scriptcontext import sticky

LOGGER = logging.getLogger('roslibpy')

robot_lift_pos = 'listener_robot_lift_pos'
robot_base_footprint = 'listener_robot_base_footprint'
tf_static = 'listener_tf_static'
robot_battery_data = 'listener_robot_battery_data'

if subscribe_to_robot_lift_topic:
    if ros_client and ros_client.is_connected:
        print("subscribed to /robot/ewellix_driver/lift/pos topic")
        listener = Topic(ros_client, '/robot/ewellix_driver/lift/pos', 'std_msgs/Float64')
        sticky[robot_lift_pos] = listener
    else:
        sticky[robot_lift_pos] = None
        print("NOT subscribed to /robot/ewellix_driver/lift/pos topic")
else:
    sticky[robot_lift_pos] = None

if subscribe_to_robotnik_base_topic:
    if ros_client and ros_client.is_connected:
        print("subscribed to /robot/robotnik_base_control/odom topic")
        listener = Topic(ros_client, '/robot/robotnik_base_control/odom', 'nav_msgs/Odometry')
        sticky[robot_base_footprint] = listener
    else:
        sticky[robot_base_footprint] = None
        print("NOT subscribed to /robot/robotnik_base_control/odom topic")
else:
    sticky[robot_base_footprint] = None

if subscribe_to_static_tf_topic:
    if ros_client and ros_client.is_connected:
        print("subscribed to /tf_static topic")
        listener = Topic(ros_client, '/tf_static', 'tf2_msgs/TFMessage')
        sticky[tf_static] = listener
        #print sticky[tf_static]
    else:
        sticky[tf_static] = None
        print("NOT subscribed to /tf_static topic")
else:
    sticky[tf_static] = None
    
if subscribe_to_battery_data:
    if ros_client and ros_client.is_connected:
        print("subscribed to /robot/battery_estimator/data topic")
        listener = Topic(ros_client, '/robot/battery_estimator/data', '/robotnik_msgs/BatteryStatus')
        sticky[robot_battery_data] = listener
        #print sticky[robot_battery_data]
    else:
        sticky[robot_battery_data] = None
        print("NOT subscribed to /robot/battery_estimator/data topic")
else:
    sticky[robot_battery_data] = None
# ---------- end subscriber ----------
panel = Panel(subscriber)

# ----
# Listen to topics
start_timer = Button()
stop_timer = Button()
bang = Button()
listener = GhPythonScript(bang=bang, start_timer=start_timer, stop_timer=stop_timer)  # -> out, map_frame_ros, ur_base_frame_ros, mobile_base_frame_ros, map_plane_ros, ur_base_plane_ros, mobile_base_plane_ros, vertical_lift_pos
# ---------- listener: Python ----------
from scriptcontext import sticky
from compas_ghpython.utilities import update_component
from compas.geometry import Frame, Transformation, Translation, Point, Rotation, Vector, Quaternion
from compas_ghpython import draw_frame
import Rhino.Geometry as rg
import math

guid = str(ghenv.Component.InstanceGuid)
timer_running_key = "timer_running_" + guid
counter_key = "counter_" + guid

robot_lift_length = 0.533

if stop_timer or timer_running_key not in sticky:
    sticky[timer_running_key] = False
    sticky[counter_key] = 0

if start_timer:
    sticky[timer_running_key] = True
    sticky[counter_key] = 0
    

if sticky[timer_running_key]:
    update_component(ghenv, 1000)
    
    sticky[counter_key] += 1
    print(sticky[counter_key])


def receive_message_tf_static(message):
    #sticky['message'] = str(datetime.datetime.now()) + ': ' + str(message)
    #print("receiving")
    sticky['ros_msg_tf_static'] = message
    
def receive_message_robot_footprint(message):
    #sticky['message'] = str(datetime.datetime.now()) + ': ' + str(message)
    #print("receiving")
    sticky['ros_msg_robot_footprint'] = message

def receive_message_robot_lift_pos(message):
    #sticky['message'] = str(datetime.datetime.now()) + ': ' + str(message)
    #print("receiving")
    sticky['ros_msg_robot_lift_pos'] = message
    
def receive_message_robot_battery_data(message):
    #sticky['message'] = str(datetime.datetime.now()) + ': ' + str(message)
    #print("receiving")
    sticky['ros_msg_robot_battery_data'] = message


if 'listener_robot_base_footprint' in sticky:
    if sticky['listener_robot_base_footprint']:
    
        listener_robot_base_footprint = sticky['listener_robot_base_footprint']
        listener_robot_base_footprint.subscribe(receive_message_robot_footprint)
    
        if 'ros_msg_robot_footprint' in sticky and sticky['ros_msg_robot_footprint']:
            #bang = True
            
            ros_msg_robot_footprint = sticky['ros_msg_robot_footprint']
            if len(ros_msg_robot_footprint):
                robot_base_footprint = ros_msg_robot_footprint
                p = robot_base_footprint['pose']['pose']
                #print('robot_base_footprint', p)
                mobile_base_frame_ros = Frame.from_quaternion([p['orientation']['w'],p['orientation']['x'], p['orientation']['y'], p['orientation']['z']], point = [p['position']['x'], p['position']['y'], p['position']['z']])
                mobile_base_plane_ros = draw_frame(mobile_base_frame_ros)
                print('++ Listening to ROS MSG ROBOT BASE FOOTPRINT')
                
        else:
            bang = False
            print('NOT receiving ROS MSG ROBOT BASE FOOTPRINT')
    else:
        print('NOT receiving ROS MSG ROBOT BASE FOOTPRINT')


if 'listener_tf_static' in sticky:
    if sticky['listener_tf_static']:
    
        listener_tf_static = sticky['listener_tf_static']
        listener_tf_static.subscribe(receive_message_tf_static)
    
        if 'ros_msg_tf_static' in sticky and sticky['ros_msg_tf_static']:
            #bang = True
            
            ros_msg_tf_static = sticky['ros_msg_tf_static']
            if len(ros_msg_tf_static and ros_msg_tf_static['transforms']):
                
                ### First static transformation from mobile robot base frame to mobile robot base link
                tf0 = ros_msg_tf_static['transforms'][0]
                t0 = tf0['transform']
                #print('robot_base frame to robot_base_link', t0)
                x1, y1, z1 = t0['translation']['x'], t0['translation']['y'], t0['translation']['z']
                
                ## Second static transformation from mobile robot base link to ewellix base link
                tf1 = ros_msg_tf_static['transforms'][2]
                t1 = tf1['transform']
                #print('robot_base_link to ewellix_base_link', t1)
                x2, y2, z2 = t1['translation']['x'], t1['translation']['y'], t1['translation']['z']
                
                print('++ Listening to ROS MSG TF STATIC')

                ## Translations in x, y, z axis from the received static transformations
                T1 = Translation.from_vector(mobile_base_frame_ros.xaxis*(x1+x2))
                T2 = Translation.from_vector(mobile_base_frame_ros.yaxis*(y1+y2))
                T3 = Translation.from_vector(mobile_base_frame_ros.zaxis*(z1+z2))

                T_rbl_ebl = T1*T2*T3
                
                ewellix_base_frame_ros = mobile_base_frame_ros.transformed(T_rbl_ebl)
                ewellix_base_plane_ros = draw_frame(ewellix_base_frame_ros)
        else:
            bang = False
            print('NOT receiving ROS MSG TF STATIC')
    else:
        print('NOT receiving ROS MSG TF STATIC')


if 'listener_robot_lift_pos' in sticky:
    if sticky['listener_robot_lift_pos']:
    
        listener_robot_lift_pos = sticky['listener_robot_lift_pos']
        listener_robot_lift_pos.subscribe(receive_message_robot_lift_pos)
    
        if 'ros_msg_robot_lift_pos' in sticky and sticky['ros_msg_robot_lift_pos']:
            #bang = True
            
            ros_msg_robot_lift_pos = sticky['ros_msg_robot_lift_pos']
            if len(ros_msg_robot_lift_pos):
                vertical_lift_pos = ros_msg_robot_lift_pos['data']
                T_ebl_etl = Transformation.from_frame(Frame.from_quaternion([1.0,0.0,0.0,0.0], point=[0.0,0.0,robot_lift_length + lift_pos]))
                T_static = T_rbl_ebl*T_ebl_etl
                ur_base_frame_ros = ewellix_base_frame_ros.transformed(T_ebl_etl)
                R = Rotation.from_axis_and_angle(ur_base_frame_ros.zaxis, math.radians(135), point=ur_base_frame_ros.point)
                ur_base_frame_ros.transform(R)
                #print(ur_base_frame_ros)
                ur_base_plane_ros = draw_frame(ur_base_frame_ros)
                print('++ Listening to ROS MSG ROBOT LIFT POSITION')
                
        else:
            bang = False
            print('NOT receiving ROS MSG ROBOT LIFT POSITION')
    else:
        print('NOT receiving ROS MSG ROBOT LIFT POSITION')



if 'listener_robot_battery_data' in sticky:
    if sticky['listener_robot_battery_data']:
    
        listener_robot_battery_data = sticky['listener_robot_battery_data']
        listener_robot_battery_data.subscribe(receive_message_robot_battery_data)
    
        if 'ros_msg_robot_battery_data' in sticky and sticky['ros_msg_robot_battery_data']:
            #bang = True
            
            ros_msg_robot_battery_data = sticky['ros_msg_robot_battery_data']
            if len(ros_msg_robot_battery_data):
                robot_battery_data = ros_msg_robot_battery_data

                print('robot_battery_data')

                print('++ Listening to ROS MSG ROBOT BATTERY DATA')
                
        else:
            bang = False
            print('NOT receiving ROS MSG ROBOT BATTERY DATA')
    else:
        print('NOT receiving ROS MSG ROBOT BATTERY DATA')


#### TO DO: get map_frame_ros from rostopic '/tf ... robot_map_frame' ####

map_frame_ros = Frame.from_quaternion([0.99086, 0.0, 0.0, 0.13492], point=[0.028104, -0.38483, 0.0])
map_plane_ros = draw_frame(map_frame_ros)
# ---------- end listener ----------
panel_2 = Panel(listener.out)
panel_3 = Panel(listener.vertical_lift_pos)
draw = GhPythonScript(scale=Slider(0.1, range=0..1))  # -> P, V, C, W; inputs frames: list
# ---------- draw: Python ----------
from System.Drawing import Color
from compas_ghpython.utilities import draw_frame

red = Color.FromArgb(255, 0, 0)
green = Color.FromArgb(0, 255, 0)
blue = Color.FromArgb(0, 0, 255)

P = []
V = []
C = []

scale = float(scale)

for frame in frames:
    if not frame:
        continue
    plane = draw_frame(frame)
    P += [plane.Origin] * 3
    V.append(plane.XAxis * scale)
    V.append(plane.YAxis * scale)
    V.append(plane.ZAxis * scale)
    C += [red, green, blue]

W = 3
# ---------- end draw ----------
vdisex = VectorDisplayEx(Point=draw.P, Vector=draw.V, Colour=draw.C, Width=draw.W)

# ----
# A_00
a_00 = Point([Point(-0.1485, 0.3425511777, 0), Point(-0.0485, 0.3425511777, 0), Point(0.0515, 0.3425511777, 0), Point(0.1515, 0.3425511777, 0), Point(0.222408022, 0.2998803613, 0), Point(0.272408022, 0.2132778209, 0), Point(0.322408022, 0.1266752805, 0), Point(0.372408022, 0.04007274016, 0)])
# D_00a
d_00a = Point([Point(0.270908022, -0.2158758971, 0), Point(0.320908022, -0.1292733567, 0), Point(0.370908022, -0.04267081637, 0), Point(0.372408022, 0.04007274016, 0), Point(0.322408022, 0.1266752805, 0), Point(0.272408022, 0.2132778209, 0)])
# D_00b
d_00b = Point([Point(0.270908022, -0.2158758971, 0), Point(0.320908022, -0.1292733567, 0), Point(0.372408022, 0.04007274016, 0), Point(0.322408022, 0.1266752805, 0), Point(0.272408022, 0.2132778209, 0)])
# B_00
b_00 = Point([Point(-0.220908022, 0.3024784375, 0), Point(-0.270908022, 0.2158758971, 0), Point(-0.320908022, 0.1292733567, 0), Point(-0.370908022, 0.04267081637, 0), Point(-0.372408022, -0.04007274016, 0), Point(-0.322408022, -0.1266752805, 0), Point(-0.272408022, -0.2132778209, 0), Point(-0.222408022, -0.2998803613, 0)])
# C_00
c_00 = Point([Point(-0.1515, -0.3425511777, 0), Point(-0.0515, -0.3425511777, 0), Point(0.0485, -0.3425511777, 0), Point(0.1485, -0.3425511777, 0), Point(0.220908022, -0.3024784375, 0), Point(0.270908022, -0.2158758971, 0), Point(0.320908022, -0.1292733567, 0), Point(0.370908022, -0.04267081637, 0)])

pln = Plane(listener.map_plane_ros)
pln_2 = Plane(listener.ur_base_plane_ros)
pln_3 = Plane(listener.mobile_base_plane_ros)

ros_map = Plane(Plane(origin=(0.33782, 4.6551, 0), x=(0.9992573278, -0.03853300998, 0), y=(0.03853300998, 0.9992573278, 0)))
ros_map_2 = Plane(Plane(origin=(2.5976, 1.7714, 0), x=(0.601898784, -0.7985723848, 0), y=(0.7985723848, 0.601898784, 0)))
ros_map_3 = Plane(Plane(origin=(2.5976, 1.7714, 0), x=(0.601898784, -0.7985723848, 0), y=(0.7985723848, 0.601898784, 0)))
ros_map_4 = Plane(Plane(origin=(-3.7166, -4.7746, 0), x=(-0.7292837566, 0.6842113726, 0), y=(-0.6842113726, -0.7292837566, 0)))
ros_map_5 = Plane(Plane(origin=(4.6994, 4.3827, 0), x=(0.714792974, -0.6993361169, 0), y=(0.6993361169, 0.714792974, 0)))
robot_map = Plane(Plane(origin=(-1.01735241, -1.934181884, -0.2004186426), x=(-0.904179102, 0.4271274346, -0.004722945123), y=(-0.4270118644, -0.9041087006, -0.0157583381)))
robot_map_2 = Plane(Plane(origin=(-1.01735241, -1.934181884, -0.2004186426), x=(-0.904179102, 0.4271274346, -0.004722945123), y=(-0.4270118644, -0.9041087006, -0.0157583381)))
robot_map_2_2 = Plane(Plane(origin=(1.164625643, 0.1646945452, -0.1478210742), x=(-0.9961307436, -0.08719977754, -0.01094260078), y=(0.08717334345, -0.9961890217, 0.00287076639)))
robot_map_3 = Plane(Plane(origin=(-1.01735241, -1.934181884, -0.2004186426), x=(-0.904179102, 0.4271274346, -0.004722945123), y=(-0.4270118644, -0.9041087006, -0.0157583381)))
robot_map_4 = Plane(Plane(origin=(-1.01735241, -1.934181884, -0.2004186426), x=(-0.904179102, 0.4271274346, -0.004722945123), y=(-0.4270118644, -0.9041087006, -0.0157583381)))
robot_map_5 = Plane(Plane(origin=(-1.01735241, -1.934181884, -0.2004186426), x=(-0.904179102, 0.4271274346, -0.004722945123), y=(-0.4270118644, -0.9041087006, -0.0157583381)))
ur_roscp = Plane(Plane(origin=(-0.8045356093, 2.138311754, 1.086838298), x=(-0.9228522332, 0.3851541973, 0), y=(-0.3851541973, -0.9228522332, 0)))
ur_roscp_2 = Plane(Plane(origin=(2.0085235, 3.266643203, 1.086838298), x=(-0.4520254893, 0.8920050207, 0), y=(-0.8920050207, -0.4520254893, 0)))
panel_4 = Panel("[[0.9516, -0.3072, -0.0110, 1.0523], [0.3071, 0.9516, -0.0122, 3.7507], [0.0142, 0.0083, 0.9999, -0.1081], [0.0000, 0.0000, 0.0000, 1.0000]]")
panel_5 = Panel("[[-0.8852, 0.4650, -0.0110, 0.4583],[-0.4649, -0.8853, -0.0122, 0.8416], [-0.0154, -0.0057, 0.9999, -0.1502], [0.0000, 0.0000, 0.0000, 1.0000]]")
panel_6 = Panel("[[-0.8852, 0.4650, -0.0110, 0.4583], [-0.4649, -0.8853, -0.0122, 0.8416], [-0.0154, -0.0057, 0.9999, -0.1502], [0.0000, 0.0000, 0.0000, 1.0000]]")
panel_7 = Panel("""[[   -0.9449,    0.3271,   -0.0110,    1.9897],
 [   -0.3270,   -0.9450,   -0.0122,    3.7438],
 [   -0.0144,   -0.0080,    0.9999,   -0.0979],
 [    0.0000,    0.0000,    0.0000,    1.0000]]""")
panel_8 = Panel("[[-0.9200, -0.3917, -0.0110, 1.1171], [0.3919, -0.9199, -0.0122, 2.2159],[-0.0053, -0.0156, 0.9999, -0.1262], [0.0000, 0.0000, 0.0000, 1.0000]]")

# ----
# Global Localization
map_plane_rhino = Plane(Plane(origin=(1.164625643, 0.1646945452, -0.1478210742), x=(-0.9961307436, -0.08719977754, -0.01094260078), y=(0.08717334345, -0.9961890217, 0.00287076639)))

# ----
# Transform Map
# Locate ROS robot_map frame in reference to the workpiece in Rhino.
# 
# + This transformation is necessary when a new map was created in ROS.
# + Internalise robot_map_wcp in 'T_global' section below!
# Calculate Basis - Point fitting method via RPC
base_plane_fit = Plane(Plane(origin=(-0.557197, 1.017903, 0.918259), x=(0.3538881007, 0.9352852662, 0.002164000616), y=(-0.9352212905, 0.3538895857, -0.01110400436)))
transform_map = GhPythonScript(map_frame_ros=listener.map_frame_ros, base_plane_fit=base_plane_fit, ur_base_frame_ros=listener.ur_base_frame_ros)  # -> out, map_plane_rhino
# ---------- transform_map: Python ----------
from compas.geometry import Frame, Transformation
from compas_ghpython import draw_frame


ur_base_frame_rhino = Frame(base_plane_fit.Origin, base_plane_fit.XAxis, base_plane_fit.YAxis)

if map_frame_ros and ur_base_frame_ros:
    T_map = Transformation.from_frame_to_frame(ur_base_frame_ros, ur_base_frame_rhino)
    map_frame_rhino = map_frame_ros.transformed(T_map)
    map_plane_rhino = draw_frame(robot_map_wcf_tr)
# ---------- end transform_map ----------
map_plane_rhino_2 = Plane(transform_map.map_plane_rhino)

# ----
# T_global
# Transform from ROS to Rhino
ros_to_rhino = GhPythonScript(
    map_plane_rhino=map_plane_rhino,
    map_frame_ros=listener.map_frame_ros,
    ur_base_frame_ros=listener.ur_base_frame_ros,
    mobile_base_frame_ros=listener.mobile_base_frame_ros)  # -> out, T_global, ur_base_frame_rhino_global_tf, mobile_base_frame_rhino_global_tf, ur_base_plane_rhino_global_tf, mobile_base_plane_rhino_global_tf
# ---------- ros_to_rhino: Python ----------
from compas.geometry import Frame, Transformation
from compas_ghpython import draw_frame


if map_frame_ros:
    
    if map_plane_rhino:
        map_frame_rhino = Frame(map_plane_rhino.Origin, map_plane_rhino.XAxis, map_plane_rhino.YAxis)
        
        T_global = Transformation.from_frame_to_frame(map_frame_ros, map_frame_rhino)
        
        print('++ RCF received from ROS')
        print(T_global)
    
    else:
        print('++ NO WCF provided')
    
else:
    print('++ NOT receiving RCF')


if ur_base_frame_ros:
    ur_base_frame_rhino_global_tf = ur_base_roscf.transformed(T_global)
    mobile_base_frame_rhino_global_tf = mobile_base_roscf.transformed(T_global)
    
    ur_base_plane_rhino_global_tf = draw_frame(ur_base_wcf_global_tr)
    mobile_base_plane_rhino_global_tf = draw_frame(mobile_base_wcf_global_tr)

else:
    print('NO ROS Base Coordinate Frame received')
# ---------- end ros_to_rhino ----------
panel_9 = Panel(ros_to_rhino.out)
pln_4 = Plane(ros_to_rhino.ur_base_plane_rhino_global_tf)
pln_5 = Plane(ros_to_rhino.mobile_base_plane_rhino_global_tf)
t_global = Data(ros_to_rhino.T_global)

panel_10 = Panel("""[[0.9993, -0.0375, -0.0036, -0.0159],
 [0.0375, 0.9993, -0.0025, -0.0343],
 [0.0037, 0.0024, 1.0000, -0.0004],
 [0.0000, 0.0000, 0.0000, 1.0000]]""")
panel_11 = Panel("""[[0.9998, 0.0089, 0.0186, -0.0219],
 [ -0.0091, 0.9999, 0.0083, 0.0334],
 [-0.0185, -0.0085, 0.9998, -0.0019],
 [0.0000, 0.0000, 0.0000, 1.0000]]""")
panel_12 = Panel("""[[1.0000, -0.0061, 0.0075, -0.0041],
 [0.0060, 0.9999, 0.0160, 0.0724],
 [-0.0076, -0.0160, 0.9998, 0.0004],
 [0.0000, 0.0000, 0.0000, 1.0000]]""")
panel_13 = Panel("[[0.9993, -0.0370, -0.0090, 0.0810], [0.0372, 0.9992, 0.0149, 0.0185], [0.0084, -0.0152, 0.9998, -0.0030], [0.0000, 0.0000, 0.0000, 1.0000]]")
panel_14 = Panel("""[[    1.0000,    0.0046,   -0.0073,   -0.0785],
 [   -0.0045,    0.9998,    0.0187,    0.0096],
 [    0.0074,   -0.0187,    0.9998,   -0.0060],
 [    0.0000,    0.0000,    0.0000,    1.0000]]""")

# ----
# T_local
# Local Transformation (relative to workpiece)
# Calculate Basis - Point fitting method via RPC
d_00b_2 = Point([Point(0.270908022, -0.2158758971, 0), Point(0.320908022, -0.1292733567, 0), Point(0.372408022, 0.04007274016, 0), Point(0.322408022, 0.1266752805, 0), Point(0.272408022, 0.2132778209, 0)])
a_00_2 = Point([Point(-0.1485, 0.3425511777, 0), Point(-0.0485, 0.3425511777, 0), Point(0.0515, 0.3425511777, 0), Point(0.1515, 0.3425511777, 0), Point(0.222408022, 0.2998803613, 0), Point(0.272408022, 0.2132778209, 0), Point(0.322408022, 0.1266752805, 0), Point(0.372408022, 0.04007274016, 0)])
b_00_2 = Point([Point(-0.220908022, 0.3024784375, 0), Point(-0.270908022, 0.2158758971, 0), Point(-0.320908022, 0.1292733567, 0), Point(-0.370908022, 0.04267081637, 0), Point(-0.372408022, -0.04007274016, 0), Point(-0.322408022, -0.1266752805, 0), Point(-0.272408022, -0.2132778209, 0), Point(-0.222408022, -0.2998803613, 0)])
c_00_2 = Point([Point(-0.1515, -0.3425511777, 0), Point(-0.0515, -0.3425511777, 0), Point(0.0485, -0.3425511777, 0), Point(0.1485, -0.3425511777, 0), Point(0.220908022, -0.3024784375, 0), Point(0.270908022, -0.2158758971, 0), Point(0.320908022, -0.1292733567, 0), Point(0.370908022, -0.04267081637, 0)])
d_00a_2 = Point([Point(0.270908022, -0.2158758971, 0), Point(0.320908022, -0.1292733567, 0), Point(0.370908022, -0.04267081637, 0), Point(0.372408022, 0.04007274016, 0), Point(0.322408022, 0.1266752805, 0), Point(0.272408022, 0.2132778209, 0)])
e_00 = Point([Point(0.0515, 0.3425511777, 0), Point(-0.0485, 0.3425511777, 0), Point(-0.1485, 0.3425511777, 0), Point(-0.220908022, 0.3024784375, 0), Point(-0.270908022, 0.2158758971, 0), Point(-0.320908022, 0.1292733567, 0)])
f_00 = Point([Point(-0.372408022, -0.04007274016, 0), Point(-0.322408022, -0.1266752805, 0), Point(-0.272408022, -0.2132778209, 0), Point(-0.222408022, -0.2998803613, 0), Point(-0.1515, -0.3425511777, 0), Point(-0.0515, -0.3425511777, 0), Point(0.0485, -0.3425511777, 0), Point(0.1485, -0.3425511777, 0)])
init_guess = Plane(pln_4)
calc_base = PythonScript(pts_cad=e_00, base_plane_init_guess=init_guess, calc=Toggle(False))  # -> out, pts_mtip_init_guess, pts_mtip_fit, base_plane_fit; inputs poses: list, pts_cad: list of Point3d, base_plane_init_guess: Plane
# ---------- calc_base: Python ----------
import ghpythonlib.components as ghcomp
import Rhino.Geometry as rg
from scriptcontext import sticky as st
from compas.geometry import Frame
import math as m
import sys
from compas.rpc import Proxy # for calling the numpy function in CPython

#poses = [[-0.38248900000000002, -0.65991, -0.92396800000000001, 1.43926, -2.33921, -0.356576], [-0.40332200000000001, -0.561226, -0.92589100000000002, 1.39317, -2.5024600000000001, -0.45355000000000001], [-0.42333500000000002, -0.46363100000000002, -0.92523200000000005, 1.32002, -2.7929300000000001, -0.42181200000000002], [-0.44414100000000001, -0.364207, -0.92577699999999996, -1.1245799999999999, 2.7569599999999999, 0.54737599999999997], [-0.49800100000000003, -0.303369, -0.92580499999999999, -0.97646200000000005, 2.8092899999999998, 0.66510199999999997], [-0.59415899999999999, -0.27221099999999998, -0.92597399999999996, 0.74782499999999996, -2.8146399999999998, -0.69757899999999995], [-0.69017399999999995, -0.24166299999999999, -0.924068, 0.51681200000000005, -2.6232899999999999, -0.79130500000000004], [-0.78496699999999997, -0.21047299999999999, -0.92393599999999998, 0.396513, -2.6047699999999998, -0.78313699999999997]]

if len(poses):
    
    # get points from poses
    pts_mtip = [rg.Point3d(p[0], p[1], p[2]) for p in poses]
    
    T_W_R_init_guess = rg.Transform.PlaneToPlane(rg.Plane.WorldXY, base_plane_init_guess)
    pts_mtip_init_guess = [ghcomp.Transform(pt, T_W_R_init_guess) for pt in pts_mtip]
    
    # format Rhino transformation
    T_W_R_init_guess_flattened = [float(f) for f in T_W_R_init_guess.ToFloatArray(True)]
    T_W_R_init_guess_list = [T_W_R_init_guess_flattened[i:(i + 4)] for i in range(0, len(T_W_R_init_guess_flattened), 4)]  

    # format ptsA and ptsB
    dataB = [list(pt) for pt in pts_cad]
    dataA = [list(pt) for pt in pts_mtip]
    
    # call the function
    max_iterations = 1000
    
    if calc:
        icp_func = Proxy('ur_fabrication_control.optimisation.icp', python = 'C://Users//lidet//anaconda3//envs//learn//python.exe')
        
        print icp_func._python

        transformation, distances = icp_func.icp(dataA, dataB, init_guess=T_W_R_init_guess_list, max_iterations=max_iterations, tolerance=0.000001)
        
        print "distances", distances
        
        # format result
        T = rg.Transform.Identity
        for i in range(4):
            for j in range(4):
                code = "T.M%i%i = %f" % (i, j, transformation[i][j])
                print code
                exec(code)
        #print T
        
        # now transform the points with the transformation calculated
        pts_mtip_fit = [ghcomp.Transform(pt, T) for pt in pts_mtip]
        base_plane_fit = ghcomp.Transform(rg.Plane.WorldXY, T)
        
        
        #f = Frame(base_plane_fit)
        #print f.get_pose_quaternion()
        
        # correct the zvalue
        #base_plane_fit = ghcomp.Transform(base_plane_fit, rg.Transform.Translation(0,0,-3))
# ---------- end calc_base ----------
panel_15 = Panel(calc_base.out)
pt = Point(calc_base.pts_mtip_init_guess)
pln_6 = Plane(calc_base.base_plane_fit)

pt_2 = Point(<point referenced from the Rhino model>)
crv = Curve(<curve referenced from the Rhino model>)
crv_2 = Curve(<curve referenced from the Rhino model>)
init_gues = ConstructPlane(Origin=pt_2, XAxis=crv, YAxis=crv_2)

# ----
# T_local
# Transfrom from global to local
base_plane_fit_2 = Plane(Plane(origin=(-0.557197, 1.017903, 0.918259), x=(0.3538881007, 0.9352852662, 0.002164000616), y=(-0.9352212905, 0.3538895857, -0.01110400436)))
init_guess_2 = Plane(pln_4)
t_local = GhPythonScript(init_guess=init_guess_2, base_plane_fit=base_plane_fit_2, add=Toggle(False))  # -> out, T_local
# ---------- t_local: Python ----------
import rhinoscriptsyntax as rs
from compas.geometry import Transformation, Frame
from compas_ghpython import draw_frame



if add:
    if base_plane_fit and init_guess:
        init_guess_frame = Frame(init_guess.Origin, init_guess.XAxis, init_guess.YAxis)
        base_frame_fit = Frame(base_plane_fit.Origin, base_plane_fit.XAxis, base_plane_fit.YAxis)
        
        T_local = Transformation.from_frame_to_frame(init_guess_frame, base_frame_fit)
else:
    T_local = None
print(T_local)
# ---------- end t_local ----------

t_local_2 = Data(t_local.T_local)

# ----
# Local Localization
transformations = GhPythonScript(
    T_local=t_local_2,
    ur_base_frame_rhino_global_tf=ros_to_rhino.ur_base_frame_rhino_global_tf,
    mobile_base_frame_rhino_global_tf=ros_to_rhino.mobile_base_frame_rhino_global_tf)  # -> out, ur_base_plane_rhino_local_tf, mobile_base_plane_rhino_local_tf
# ---------- transformations: Python ----------
import rhinoscriptsyntax as rs
from compas.geometry import Frame, Transformation
from compas_ghpython import draw_frame



if T_local:
    ur_base_frame_rhino_local_tf = ur_base_frame_rhino_global_tf.transformed(T_local)
    mobile_base_frame_rhino_local_tf = mobile_base_frame_rhino_global_tf.transformed(T_local)
    
    ur_base_plane_rhino_local_tf = draw_frame(ur_base_frame_rhino_local_tf)
    mobile_base_plane_rhino_local_tf = draw_frame(mobile_base_frame_rhino_local_tf)
    
    print(ur_base_plane_rhino_local_tf)
# ---------- end transformations ----------
panel_16 = Panel(transformations.out)

init_guess_3 = Plane(Plane(origin=(-0.9669326658, -0.06884816316, 0.9100508767), x=(-0.685351111, 0.7282115083, 0.001361541177), y=(-0.7281299393, -0.6852437459, -0.01636459829)))
init_guess_4 = Plane(Plane(origin=(0.5776833486, -0.9211259235, 0.916508893), x=(-0.1799735024, -0.9835716499, -0.01401242339), y=(0.9836099426, -0.1801032964, 0.008618783048)))
init_guess_5 = Plane(Plane(origin=(1.148302673, -0.01301997293, 0.933896152), x=(0.7189053582, -0.6951077135, -0.0005937768215), y=(0.6950209109, 0.7188015404, 0.01644015996)))
ur_roscp_3 = Plane(Plane(origin=(-0.01332921089, 0.04300558802, 1.086838298), x=(-0.9772689763, 0.2120031792, 0), y=(-0.2120031792, -0.9772689763, 0)))
init_guess_6 = Plane(Plane(origin=(1.007828287, -0.08006448112, 0.9315304287), x=(0.6980644493, -0.7160341194, -0.001079074274), y=(0.715950421, 0.6979581131, 0.01641545093)))
base_plane_fit_3 = Plane(Plane(origin=(0.586046, -0.830465, 0.927117), x=(-0.1740749409, -0.9847276658, 0.003055998963), y=(0.9847265004, -0.1740623089, 0.004003999145)))
base_plane_fit_4 = Plane(Plane(origin=(1.082712, -0.010144, 0.938139), x=(0.7240861943, -0.689530185, 0.01572600422), y=(0.689432668, 0.7242533446, 0.01181901455)))
ur_base_plane = Plane(Plane(origin=(0.478186, 0.796471, 0.936426), x=(0.9636909338, 0.2666599817, 0.01386499905), y=(-0.2667934872, 0.9637130496, 0.008853995247)))
base_plane_fit_5 = Plane(Plane(origin=(-0.972287, -0.019032, 0.926469), x=(-0.6786879231, 0.7343849168, 0.007841999112), y=(-0.7343886615, -0.6787227994, 0.002941998222)))
base_plane_fit_6 = Plane(Plane(origin=(1.062842, 0.00892, 0.936526), x=(0.7156859125, -0.6981969147, 0.01774099783), y=(0.6981797734, 0.7158758885, 0.008167996559)))
python = GhPythonScript(a=base_plane_fit_4, b=base_plane_fit_6)  # -> out, c_plane; inputs a: Plane, b: Plane
# ---------- python: Python ----------
import rhinoscriptsyntax as rs
from compas_ghpython import draw_frame

from compas.geometry import Frame, Transformation

a_frame = Frame(a.Origin, a.XAxis, a.YAxis)
b_frame = Frame(b.Origin, b.XAxis, b.YAxis)

T = Transformation.from_frame_to_frame(a_frame, b_frame)
T_icp = Transformation.from_matrix([[0.991149587154931, -0.127721264942246, 0.0361908049670346,	0],
[0.126735489922846,  0.991531481791765, 0.0283449503411728, 0],
[-0.0395045753885004, -0.0235074264303813, 0.998942835915046, 0], [-0.0735686570405960, 0.0541841015219688, -0.0349646881222725, 1]])

#T_icp = Transformation.from_matrix([[0.984465890099332, -0.175575630750670, -0.000330329281510045, 0.0], 
#[0.175574551307781, 0.984448866043392, 0.00583155887823694, 0.0],
#[-0.000698687341702652, -0.00579896821711514, 0.999982941756316, 0.0],
#[-0.0620445944368839, 0.103690057992935, -0.00160683493595570, 1.0]])

c_frame = a_frame.transformed(T_icp)
c_plane = draw_frame(c_frame)
# ---------- end python ----------
pln_7 = Plane(transformations.ur_base_plane_rhino_local_tf)
pln_8 = Plane(transformations.mobile_base_plane_rhino_local_tf)
pt_3 = Point(calc_base.pts_mtip_fit)
new = Plane(Plane(origin=(1.067364177, 0.1855812371, 0.9374253446), x=(0.8338976622, -0.5515843929, 0.01921838973), y=(0.5515578032, 0.8341061384, 0.007137192937)))
old = Plane(Plane(origin=(1.108377162, 0.1537514438, 0.8946136146), x=(0.8063145367, -0.5914777147, 0.003313741699), y=(0.5912560906, 0.8058305883, -0.03245455711)))

# ----
# Labels
number_slider = Slider(0.1, range=0..1)
pt_4 = Point([Point(0.298708097, 0.5173776006, 0), Point(-0.597416194, 0, 0), Point(0.298708097, -0.5173776006, 0), Point(0.597416194, 0, 0), Point(-0.298708097, 0.5173776006, 0), Point(-0.298708097, -0.5173776006, 0)])
python_2 = GhPythonScript(pts=pt_4)  # -> out, pts, labels; inputs pts: list
# ---------- python_2: Python ----------
import rhinoscriptsyntax as rs

labels = ['A','B','C','D','E','F']
# ---------- end python_2 ----------
tag = TextTag3D(Location=python_2.pts, Text=python_2.labels, Size=number_slider, Colour=RGB(0, 0, 0), Justification=5)

# ----
# Fabrication Data Record
add = Button()
ur_base_plane_fit = Plane(base_plane_fit_6)
ur_base_plane_2 = Plane(init_guess_5)
list = ValueList({"A", "B", "C", "D", "E", "F"}, selected="E")
ur_roscp_4 = Plane(ur_roscp_2)
pt_5 = Point(e_00)
python_3 = GhPythonScript(
    segment=list,
    layer=Slider(0, range=0..20),
    pts_cad=pt_5,
    ur_ros_plane=ur_roscp_4,
    ur_rhino_plane=ur_base_plane_2,
    ur_base_measured=ur_base_plane_fit,
    T_global=t_global,
    T_local=t_local.T_local,
    add=add,
    show_record=Toggle(True))  # -> out, point_record; inputs layer: Int32, pts_cad: list
# ---------- python_3: Python ----------
import rhinoscriptsyntax as rs
import os
from compas.geometry import Frame

repositories_path = os.path.abspath(os.path.join(ghdoc.Path,"../../../"))
filepath = os.path.abspath(os.path.join(ghdoc.Path,"../../../mobile_fabrication_control/data/fab_data_record.txt"))

fab_data_record = {}
points_list =[]


segment_id = '{0}{1}{2}'.format(segment, '_0', str(layer))
print segment_id

#print(T_global)
if pts_cad and ur_ros_plane and ur_rhino_plane and T_global:
    
    for p in pts_cad:
        pt = rs.coerce3dpoint(p)
        points_list.append([pt.X, pt.Y, pt.Z])
    
    fab_data_record['points_cad'] = points_list
    fab_data_record['ur_ros_plane'] = Frame(ur_ros_plane.Origin, ur_ros_plane.XAxis, ur_ros_plane.YAxis)
    fab_data_record['ur_rhino_plane'] = Frame(ur_rhino_plane.Origin, ur_rhino_plane.XAxis, ur_rhino_plane.YAxis)
    fab_data_record['ur_base_measured'] = Frame(ur_base_measured.Origin, ur_base_measured.XAxis, ur_base_measured.YAxis)
    fab_data_record['T_global'] = T_global
    fab_data_record['T_local'] = T_local
    fab_data_record['segment_id'] = segment_id
    
    if add:
        f = open(filepath, "a")
        f.write((str(fab_data_record) + "\n" + "\n"))
        f.close()
    
if show_record:
    f = open(filepath, "r")
    point_record=f.read()
# ---------- end python_3 ----------
point_record = Panel(python_3.point_record)
segment_id = Panel(python_3.out)
