# Grasshopper definition mobile_robot_workspace_v2.ghx (Grasshopper 1.0.7)
# plug-ins: Pufferfish

rs_pc_pos = Plane(Plane(origin=(1.041646217, 0.1100385431, 1.1644337), x=(-0.001098070691, -0.9999989341, 0.0009622747508), y=(-0.9999993638, 0.001097821761, -0.0002591791628)))

# ---- group: Toggle true to read .ply file
toggle = BooleanToggle(True)

# ---- group: Click to create new .ply file, when camera connected
button = Button()

# ---- group: Name of the .ply file
list = ValueList({"frame_00.ply", "frame_01.ply", "frame_02.ply", "frame_03.ply", "frame_04.ply", "frame_05.ply", "frame_06.ply", "frame_07.ply", "frame_08.ply", "frame_09.ply"}, selected="frame_00.ply")

# ----
xy = XYPlane(Origin=Point(0, 0, 0))

# ---- group: Change the path to your directory
data = GhPythonScript()  # -> data
# ---------- data: Python ----------
__author__ = "Gido"
__version__ = "2020.01.14"

import rhinoscriptsyntax as rs

# Path to directory containing .ply files
data = r"C:\Users\Gido\Documents"
# ---------- end data ----------

# ----
# DESIGN ENVIRONMENT
# Realsense capture
# -- Rough scan --
panel = Panel("brick_wall_test_06_1.ply")
realsense_d435i = GhPythonScript(data=data, file="221005_brick_wall_test_1.ply", create=button, read=toggle)  # -> out, pc, cmesh, points, mesh
# ---------- realsense_d435i: Python ----------
__author__ = "Gido Dielemans"
__version__ = "2021.06.09"

import os
import rhinoscriptsyntax as rs
import scriptcontext as sc
import Rhino.Geometry as rg
from compas_ghpython.utilities import draw_points
from compas_ghpython.artists import MeshArtist
from compas.geometry import Transformation
from compas.files import PLY
from compas.rpc import Proxy
from compas.datastructures import Mesh
from compas.geometry import Pointcloud
from compas.geometry import Point
from compas_ghpython.artists import PointArtist
#from workshop_aaec_revamp import PointCloudArtist

# create filepath
filepath = os.path.join(data, file)
print(filepath)

# create a new file using RPC
if create:
    realsense = Proxy()
    # Locate script to execute with RPC
    realsense.package = 'workshop_aaec_revamp.sensors.realsense_d435i_methods'
    # Execute method from script using the Proxy
    realsense.export_to_ply(filepath)

# read the .ply file
if read:
    # check if there is a file with the name at the location
    assert os.path.isfile(filepath)
    # in case of an AssertionError please confirm the filepath and ensure the file is present
    
    # read the .ply file
    ply = PLY(filepath)
    ply.read()
    vertices = ply.parser.vertices
    faces = ply.parser.faces
    
    pc = Pointcloud(vertices)
    cmesh = Mesh.from_vertices_and_faces(vertices, faces)
    artist = MeshArtist(cmesh)
    mesh = artist.draw_mesh()
    
    pts = [{"pos":v.data} for i, v in enumerate(pc.points)]
    points = draw_points(pts)
#    points = rg.PointCloud()
#    points.AddRange(rhinopoints)
#    print(points.IsValid)
    
#    pcartist = PointCloudArtist(pc)
#    points = pcartist.draw()

#    print(pc.points[0].data)
#    points = draw_points([pt.data for pt in pc.points])
#    cmesh = Mesh.from_ply(filepath)
#    points = draw_points(points)
    
#    if transformed:
#        T = Transformation.from_frame(tool_frame)
#        npts = []
#        for pt in points:
#            cpt = Point(pt.X, pt.Y, pt.Z)
#            ncpt = cpt.transformed(T)
#            npts.append(PointArtist(ncpt).draw())
##        cpoints = [pt.transformed(T) for pt in cpoints]
#        points = npts
#        cmesh = cmesh.transformed(T)
# ---------- end realsense_d435i ----------

flippln = FlipPlane(Plane=xy, FlipX=False, FlipY=False, FlipZ=True)  # -> Flipped, R
pi = Pi(Factor=0.5)
prot = RotatePlane(Plane=flippln.Flipped, Angle=pi)
pt = Point(realsense_d435i.points)
orient = Orient(Geometry=pt, Source=prot, Target=rs_pc_pos)  # -> Geometry, Transform
list_2 = ValueList({"default", "measured", "initial"}, selected="default")

python = GhPythonScript(choice=list_2, vertical_axis_height=Slider(0, range=0..0.72), vertical_axis_correction=Slider(0, range=-0.1..0.1))  # -> out, ur_base_frame_rhino_local_tf, ur_base_plane
# ---------- python: Python ----------
__author__ = "Gido"
__version__ = "2022.04.11"

import rhinoscriptsyntax as rs
from compas.geometry import Frame
from compas.geometry import Translation
from compas_ghpython.utilities import draw_frame

if choice=="measured":
    ur_base_frame_rhino_local_tf = Frame(ur_base_plane_rhino_local_tf.Origin, 
                                         ur_base_plane_rhino_local_tf.XAxis, 
                                         ur_base_plane_rhino_local_tf.YAxis)
    T = Translation.from_vector(ur_base_frame_rhino_local_tf.zaxis*(vertical_axis_height+vertical_axis_correction))
    ur_base_frame_rhino_local_tf = ur_base_frame_rhino_local_tf.transformed(T)
elif choice=="initial":
    ur_base_frame_rhino_local_tf = Frame(ur_base_plane_init.Origin, 
                                         ur_base_plane_init.XAxis, 
                                         ur_base_plane_init.YAxis)
    T = Translation.from_vector(ur_base_frame_rhino_local_tf.zaxis*(vertical_axis_height+vertical_axis_correction))
    ur_base_frame_rhino_local_tf = ur_base_frame_rhino_local_tf.transformed(T)

elif choice =="default":
    ur_base_frame_rhino_local_tf = Frame([0.275, 0., 1.105], [-0.707, 0.707, 0.0], [-0.707, -0.707,0.0])
    T = Translation.from_vector(ur_base_frame_rhino_local_tf.zaxis*(vertical_axis_height+vertical_axis_correction))
    ur_base_frame_rhino_local_tf = ur_base_frame_rhino_local_tf.transformed(T)


ur_base_plane = draw_frame(ur_base_frame_rhino_local_tf)
# ---------- end python ----------

pln = Plane(python.ur_base_plane)
robot_speed = Slider(0.012, range=0..1)
list_3 = ValueList({"xframes", "yframes"}, selected="xframes")

# ----
# Stop
stop = Button()  # disabled
stop_2 = PythonScript(stop=stop)  # disabled
# ---------- stop_2: Python ----------
from scriptcontext import sticky as st
from ur_fabrication_control.direct_control.common import send_stop

ur_ip = st["ur_ip"]
ur_port = st["ur_port"]

if stop:
    send_stop(ur_ip, ur_port)
# ---------- end stop_2 ----------

number_slider = Slider(0, range=-180..180)  # disabled
number_slider_2 = Slider(0, range=-180..180)  # disabled
number_slider_3 = Slider(0, range=0..100)  # disabled
number_slider_4 = Slider(0, range=0..100)  # disabled

# ----
# Stop Extruder
stop_3 = Button()  # disabled
stop_4 = PythonScript(stop=stop_3)  # disabled
# ---------- stop_4: Python ----------
import time
from scriptcontext import sticky as st
from extruder_control.extruderclient import ExtruderClient

ext_ip = st["ext_ip"]
ext_port = st["ext_port"]

ec = ExtruderClient(ext_ip, ext_port)
wait_for_response = False

if stop:
    ec.connect()
    time.sleep(0.2)
    ec.send_stop(wait_for_response)
    time.sleep(0.2)
    ec.close()
# ---------- end stop_4 ----------

# ----
# Set Extruder data
speed = Slider(2000, range=0..51200)  # disabled
# Direct extruder control
max_speed = Slider(16000, range=0..51200)  # disabled
value = BooleanToggle(True)  # disabled
send = Button()  # disabled
extruder_data = PythonScript(motor_state=value, max_speed=max_speed, speed=speed, send=send)  # -> urscript; inputs motor_state: Boolean; disabled
# ---------- extruder_data: Python ----------
import time
from scriptcontext import sticky as st
from extruder_control.extruderclient import ExtruderClient

ext_ip = st["ext_ip"]
ext_port = st["ext_port"]

ec = ExtruderClient(ext_ip, ext_port)
wait_for_response = False

if send:
    ec.connect()
    time.sleep(0.2)
    ec.send_motordata(motor_state, max_speed, speed, wait_for_response)
    time.sleep(0.2)
    ec.close()
# ---------- end extruder_data ----------

# ----
# Set Digital Out
number = Slider(7, range=0..10)  # disabled
value_2 = BooleanToggle(True)  # disabled
digital_out = PythonScript(number=number, value=value_2)  # -> urscript; inputs number: Int32, value: Boolean; disabled
# ---------- digital_out: Python ----------
from ur_fabrication_control.direct_control import URScript

urscript = URScript()
urscript.start()
urscript.add_line("\tset_digital_out({}, {})".format(number, value))
urscript.end()
urscript = urscript.generate()

print(urscript)
# ---------- end digital_out ----------
send_2 = Button()  # disabled
send_3 = GhPythonScript(urscript=digital_out, send=send_2)  # -> out; inputs send: Boolean; disabled
# ---------- send_3: Python ----------
from scriptcontext import sticky as st
from ur_fabrication_control.direct_control import send_script

ur_ip = st["ur_ip"]
ur_port = st["ur_port"]

if send:
    send_script(urscript, ur_ip, ur_port)
# ---------- end send_3 ----------

# ----
# Toggle Extruder
value_3 = BooleanToggle(False)  # disabled
send_4 = Button()  # disabled
extruder_state = PythonScript(state=value_3, send=send_4)  # -> urscript; inputs state: Boolean; disabled
# ---------- extruder_state: Python ----------
import time
from scriptcontext import sticky as st
from extruder_control.extruderclient import ExtruderClient

ext_ip = st["ext_ip"]
ext_port = st["ext_port"]

ec = ExtruderClient(ext_ip, ext_port)
wait_for_response = False

if send:
    ec.connect()
    time.sleep(0.2)
    ec.send_motorstate(int(state), wait_for_response)
    time.sleep(0.2)
    ec.close()
# ---------- end extruder_state ----------

list_4 = ValueList({"left", "right", "both"}, selected="left")  # disabled

# ----
# SERVER
button_2 = Button()  # disabled
button_3 = Button()  # disabled
button_4 = Button()  # disabled
feedbackserver = GhPythonScript(create=button_2, clear=button_3, close=button_4)  # -> server; disabled
# ---------- feedbackserver: Python ----------
__author__ = "Gido"
__version__ = "2022.05.16"

import rhinoscriptsyntax as rs
from scriptcontext import sticky as st
from fabrication_manager.communication import TCPFeedbackServer

server_ip = st["server_ip"]
server_port = st["server_port"]

server = TCPFeedbackServer(server_ip, server_port)

if clear:
    server.clear()
    
if close:
    server.shutdown()
# ---------- end feedbackserver ----------

# ----
# Toggle Extruder and Air Off
max_speed_2 = Slider(16000, range=0..16000)  # disabled
speed_2 = Slider(1000, range=0..16000)  # disabled
send_5 = Button()  # disabled
value_4 = BooleanToggle(False)  # disabled
list_5 = ValueList({"8"}, selected="8")  # disabled
extruder_data_2 = PythonScript(state=value_4, max_speed=max_speed_2, speed=speed_2, pin=list_5, send=send_5)  # -> urscript; inputs state: Boolean; disabled
# ---------- extruder_data_2: Python ----------
import time
from scriptcontext import sticky as st
from extruder_control.extruderclient import ExtruderClient

ext_ip = st["ext_ip"]
ext_port = st["ext_port"]

ec = ExtruderClient(ext_ip, ext_port)
wait_for_response = False

if send:
    ec.connect()
    time.sleep(0.2)
    ec.send_motordata(int(state), max_speed, speed, wait_for_response)
    ec.send_set_do(pin, int(state), wait_for_response)
    time.sleep(0.2)
    ec.close()
# ---------- end extruder_data_2 ----------

# ----
# Toggle Extruder and Air ON
max_speed_3 = Slider(24000, range=0..24000)  # disabled
speed_3 = Slider(1000, range=0..16000)  # disabled
value_5 = BooleanToggle(True)  # disabled
send_6 = Button()  # disabled
list_6 = ValueList({"8"}, selected="8")  # disabled
extruder_data_3 = PythonScript(state=value_5, max_speed=max_speed_3, speed=speed_3, pin=list_6, send=send_6)  # -> urscript; inputs state: Boolean; disabled; same code as extruder_data_2

# ----
# Toggle air
value_6 = BooleanToggle(True)  # disabled
send_7 = Button()  # disabled
list_7 = ValueList({"8"}, selected="8")  # disabled
digital_out_2 = PythonScript(pin=list_7, state=value_6, send=send_7)  # -> urscript; inputs pin: Int32, state: Boolean; disabled
# ---------- digital_out_2: Python ----------
import time
from scriptcontext import sticky as st
from extruder_control.extruderclient import ExtruderClient

ext_ip = st["ext_ip"]
ext_port = st["ext_port"]

ec = ExtruderClient(ext_ip, ext_port)
wait_for_response = False

if send:
    ec.connect()
    time.sleep(0.2)
    ec.send_set_do(pin, int(state), wait_for_response)
    time.sleep(0.2)
    ec.close()
# ---------- end digital_out_2 ----------

toggle_2 = BooleanToggle(False)  # disabled

# ----
# Get Pose Joint
get = Button()  # disabled
pose = PythonScript(get=get)  # -> configuration, pose_joints; disabled
# ---------- pose: Python ----------
from scriptcontext import sticky as st
from ur_fabrication_control.direct_control.common import get_current_pose_joints
from compas_fab.robots import Configuration


robot = st["robot"]

server_address = st["server_address"]
server_port = st["server_port"]
ur_port = st["ur_port"]
ur_ip = st["ur_ip"]


guid = str(ghenv.Component.InstanceGuid)
pose_joints_key = "pose_joints" + guid


# send script to the robot to receive the current joint configuration
if get:
    st[pose_joints_key] = get_current_pose_joints(server_address, server_port, ur_ip, ur_port, send=True)

if pose_joints_key not in st:
    configuration = Configuration.from_revolute_values([0,0,0,0,0,0])
else:
    configuration = Configuration.from_revolute_values(st[pose_joints_key])

pose_joints = configuration.values
# ---------- end pose ----------
panel_2 = Panel(pose.pose_joints)  # disabled

# ----
# Tool
list_8 = ValueList({"measurement_tool": 0}, selected="measurement_tool")  # disabled
show = BooleanToggle(False)  # disabled
list_9 = ValueList({"nozzle", "scanner"}, selected="nozzle")  # disabled
py = PythonScript()  # -> DATA; disabled
# ---------- py: Python ----------
import os

#package_path = os.path.dirname(mobile_fabrication_control.__file__)
#DATA = os.path.abspath(os.path.join(package_path,"../../data"))

package_path = ghdoc.Path
# package_path = os.path.dirname(ur_fabrication_control.__file__)
#DATA = os.path.abspath(os.path.join(package_path,"../../data"))

# .stl files not stored in am_hackathon repo. but in mobile_fabrication_control
DATA = os.path.abspath(os.path.join(package_path,"../../../mobile_fabrication_control/data"))

print(package_path)
print(DATA)
# ---------- end py ----------
python_2 = PythonScript(data_path=py, tool=list_8, tcp_frame=list_9, show=show)  # -> tool, M; disabled
# ---------- python_2: Python ----------
import os, math
from compas.geometry import Frame, Rotation
from compas.datastructures import Mesh
from compas_ghpython.artists import MeshArtist
from compas_fab.robots import Tool

tolerance = 0

if tool == 0:
    filename = 'measurement_tool_zaxis.stl'
    ee_frame = Frame([0, 0, 0.109], [1, 0, 0], [0, 1, 0])

data_path = os.path.join(data_path, "tool_geometry")
fullfilename = os.path.join(data_path, filename)
print fullfilename

ee_mesh = Mesh.from_stl(fullfilename)

#R = Rotation.from_axis_and_angle(ee_frame.zaxis, math.radians(180), point=ee_frame.point)
#ee_frame.transform(R)

if show:
    artist = MeshArtist(ee_mesh)
    M = artist.draw()

tool = Tool(ee_mesh, ee_frame)
# ---------- end python_2 ----------
panel_3 = Panel("Attach a custom tool")  # disabled

# ----
# Get Pose Cartesian
get_2 = Button()  # disabled
pose_2 = PythonScript(get=get_2, tool=python_2.tool, from_robot=toggle_2)  # -> pose_cartesian, frame_WCS, plane_WCS; disabled
# ---------- pose_2: Python ----------
from scriptcontext import sticky as st
from ur_fabrication_control.direct_control.common import get_current_pose_cartesian
from compas.geometry import Frame
from compas_ghpython import draw_frame

robot = st["robot"]

server_ip = st["server_ip"]
server_port = st["server_port"]
ur_port = st["ur_port"]
ur_ip = st["ur_ip"]

# retrieve the current tool frame in axis angle format
if from_robot:
    if robot.attached_tool:
        tool_angle_axis = list(robot.attached_tool.frame.point) + list(robot.attached_tool.frame.axis_angle_vector)
    else:
        tool0_frame = Frame([0, 0, 0], [1, 0, 0], [0, 1, 0])
        tool_angle_axis = list(tool0_frame.point) + list(tool0_frame.axis_angle_vector)
else:
    tool_angle_axis = list(tool.frame.point) + list(tool.frame.axis_angle_vector)

print(tool_angle_axis)

guid = str(ghenv.Component.InstanceGuid)
pose_cartesian_key = "pose_cartesian" + guid


if get:
    st[pose_cartesian_key] = get_current_pose_cartesian(tool_angle_axis, server_ip, server_port, ur_ip, ur_port, send=True)

if pose_cartesian_key not in st:
    pose_cartesian = []
else:
    pose_cartesian = st[pose_cartesian_key]

print(pose_cartesian)

# get frame and plane of the current pose cartesian in world coordinates for visualization
if pose_cartesian:
    frame_RCS = Frame.from_axis_angle_vector(axis_angle_vector=pose_cartesian[3:], point=pose_cartesian[:3])
    frame_WCS = robot.to_world_coordinates(frame_RCS)
    plane_WCS  = draw_frame(frame_WCS)
    print frame_RCS
    print frame_WCS
# ---------- end pose_2 ----------
number_slider_5 = Slider(0.1, range=0..1)  # disabled
draw = GhPythonScript(frames=pose_2.frame_WCS, scale=number_slider_5)  # -> P, V, W; inputs frames: list; disabled
# ---------- draw: Python ----------
from System.Drawing import Color
from compas_ghpython.utilities import draw_frame

red = Color.FromArgb(255, 0, 0)
green = Color.FromArgb(0, 255, 0)
blue = Color.FromArgb(0, 0, 255)

P = []
V = []
C = []

scale = float(scale)

for frame in frames:
    if not frame:
        continue
    plane = draw_frame(frame)
    P += [plane.Origin] * 3
    V.append(plane.XAxis * scale)
    V.append(plane.YAxis * scale)
    V.append(plane.ZAxis * scale)
    C += [red, green, blue]

W = 3
# ---------- end draw ----------
vdisex = VectorDisplayEx(Point=draw.P, Vector=draw.V, Colour=RGB(0, 0, 0), Width=draw.W)  # disabled
panel_4 = Panel(pose_2.pose_cartesian)  # disabled

# ----
# Move Cartesian
add = Button()
list_10 = ValueList({"send all positions": 0, "send only one position": 1, "from inverse": 2}, selected="send all positions")
clear = Button()
crv = Curve(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)
idx = Slider(0, range=0..100)
hframes = HorizontalFrames(Curve=crv, Count=10)  # -> Frames, Parameters
rec_car = PythonScript(msg=pose_2.plane_WCS, rec=add, clear=clear)  # -> rec
# ---------- rec_car: Python ----------
from scriptcontext import sticky as st

guid = str(ghenv.Component.InstanceGuid)
recorded_key =  "recorded_" + guid
just_cleared_key = "just_cleared_" + guid


if recorded_key not in st:
    st[recorded_key] = []

if just_cleared_key not in st:
    st[just_cleared_key] = False

if clear:
    st[recorded_key] = []
    st[just_cleared_key] = True
else:
    if len(msg):
        if msg != [None] and not st[just_cleared_key] and rec:
            st[recorded_key].append(msg)
    st[just_cleared_key] = False
        


rec = st[recorded_key]

print rec
# ---------- end rec_car ----------
item = ListItem(List=hframes.Frames, Index=idx, Wrap=True)
filter = StreamFilter(Gate=list_10, Stream0=hframes.Frames, Stream1=item, Stream2=rec_car)
radius = Slider(0.002, range=0..0.5)
movel = PythonScript(velocity=Slider(0.05, range=0..0.5), radius=radius)  # -> urscript; inputs planes_WCS: list
# ---------- movel: Python ----------
import Rhino.Geometry as rg
from compas.geometry import Frame
from compas.geometry import Transformation, Rotation
from compas_ghpython import draw_frame
from compas_fab.robots import robot
from ur_fabrication_control import direct_control 
import math

from scriptcontext import sticky as st
from ur_fabrication_control.direct_control import URScript

robot = st["robot"]

# retrieve the current tool frame in axis angle format
if robot.attached_tool:
    tool_angle_axis = list(robot.attached_tool.frame.point) + list(robot.attached_tool.frame.axis_angle_vector)
else:
    tool0_frame = Frame([0, 0, 0], [1, 0, 0], [0, 1, 0])
    tool_angle_axis = list(tool0_frame.point) + list(tool0_frame.axis_angle_vector)

print(tool_angle_axis)

frames_RCS = []
for plane_WCS in planes_WCS:
    frame_WCS = Frame(plane_WCS.Origin, plane_WCS.XAxis, plane_WCS.YAxis)
    frame_RCS = robot.to_local_coordinates(frame_WCS)
    frames_RCS.append(frame_RCS)

urscript = URScript()
urscript.start()
urscript.set_tcp(tool_angle_axis)
urscript.move_linear(frames_RCS[0], velocity, radius)
urscript.end()

urscript = urscript.generate()

print(urscript)
# ---------- end movel ----------
send_8 = Button()
send_9 = GhPythonScript(urscript=movel, send=send_8)  # -> out; inputs send: Boolean; same code as send_3

# ----
# Move Circular
clear_2 = Button()  # disabled
list_11 = ValueList({"send all positions": 0, "send only one position": 1, "from inverse": 2}, selected="from inverse")  # disabled
add_2 = Button()  # disabled
idx_2 = Slider(0, range=0..100)  # disabled
crv_2 = Curve(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)  # disabled
hframes_2 = HorizontalFrames(Curve=crv_2, Count=10)  # -> Frames, Parameters; disabled
rec_viacar = PythonScript(msg=pose_2.plane_WCS, rec=add_2, clear=clear_2)  # -> rec; disabled; same code as rec_car
item_2 = ListItem(List=hframes_2.Frames, Index=idx_2, Wrap=True)  # disabled
filter_2 = StreamFilter(Gate=list_11, Stream0=hframes_2.Frames, Stream1=item_2, Stream2=rec_car)  # disabled
filter_3 = StreamFilter(Gate=list_11, Stream0=hframes_2.Frames, Stream1=item_2, Stream2=rec_viacar)  # disabled
number_slider_6 = Slider(0.075, range=0..0.5)  # disabled
radius_2 = Slider(0.5, range=0..0.5)  # disabled
movec = PythonScript(planes_WCS=filter_2, planes_via_WCS=filter_3, velocity=number_slider_6, radius=radius_2)  # -> urscript; inputs planes_WCS: list, planes_via_WCS: list; disabled
# ---------- movec: Python ----------
import Rhino.Geometry as rg
from compas.geometry import Frame
from compas.geometry import Transformation, Rotation
from compas_ghpython import draw_frame
from compas_fab.robots import robot
from ur_fabrication_control import direct_control 
import math

from scriptcontext import sticky as st
from ur_fabrication_control.direct_control import URScript

robot = st["robot"]

# retrieve the current tool frame in axis angle format
if robot.attached_tool:
    tool_angle_axis = list(robot.attached_tool.frame.point) + list(robot.attached_tool.frame.axis_angle_vector)
else:
    tool0_frame = Frame([0, 0, 0], [1, 0, 0], [0, 1, 0])
    tool_angle_axis = list(tool0_frame.point) + list(tool0_frame.axis_angle_vector)

frames_RCS = []
for plane_WCS in planes_WCS:
    frame_WCS = Frame(plane_WCS.Origin, plane_WCS.XAxis, plane_WCS.YAxis)
    frame_RCS = robot.to_local_coordinates(frame_WCS)
    frames_RCS.append(frame_RCS)

frames_via_RCS = []
for plane_WCS in planes_via_WCS:
    frame_WCS = Frame(plane_WCS.Origin, plane_WCS.XAxis, plane_WCS.YAxis)
    frame_RCS = robot.to_local_coordinates(frame_WCS)
    frames_via_RCS.append(frame_RCS)

urscript = URScript()
urscript.start()
urscript.moves_circular(frames_via_RCS, frames_RCS, velocity, radius)
urscript.end()

urscript = urscript.generate()

print(urscript)
# ---------- end movec ----------
send_10 = Button()  # disabled
send_11 = GhPythonScript(urscript=movec, send=send_10)  # -> out; inputs send: Boolean; disabled; same code as send_3

# ----
# Move Process
list_12 = ValueList({"send all positions": 0, "send only one position": 1, "from inverse": 2}, selected="send all positions")  # disabled
idx_3 = Slider(0, range=0..100)  # disabled
crv_3 = Curve(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)  # disabled
hframes_3 = HorizontalFrames(Curve=crv_3, Count=10)  # -> Frames, Parameters; disabled
item_3 = ListItem(List=hframes_3.Frames, Index=idx_3, Wrap=True)  # disabled
filter_4 = StreamFilter(Gate=list_12, Stream0=hframes_3.Frames, Stream1=item_3, Stream2=rec_car)  # disabled
number_slider_7 = Slider(0.075, range=0..0.5)  # disabled
radius_3 = Slider(0.5, range=0..0.5)  # disabled
movep = PythonScript(planes_WCS=filter_4, velocity=number_slider_7, radius=radius_3)  # -> urscript; inputs planes_WCS: list; disabled
# ---------- movep: Python ----------
import Rhino.Geometry as rg
from compas.geometry import Frame
from compas.geometry import Transformation, Rotation
from compas_ghpython import draw_frame
from compas_fab.robots import robot
from ur_fabrication_control import direct_control 
import math

from scriptcontext import sticky as st
from ur_fabrication_control.direct_control import URScript

robot = st["robot"]

# retrieve the current tool frame in axis angle format
if robot.attached_tool:
    tool_angle_axis = list(robot.attached_tool.frame.point) + list(robot.attached_tool.frame.axis_angle_vector)
else:
    tool0_frame = Frame([0, 0, 0], [1, 0, 0], [0, 1, 0])
    tool_angle_axis = list(tool0_frame.point) + list(tool0_frame.axis_angle_vector)

frames_RCS = []
for plane_WCS in planes_WCS:
    frame_WCS = Frame(plane_WCS.Origin, plane_WCS.XAxis, plane_WCS.YAxis)
    frame_RCS = robot.to_local_coordinates(frame_WCS)
    frames_RCS.append(frame_RCS)

urscript = URScript()
urscript.start()
urscript.moves_process(frames_RCS, velocity, radius)
urscript.end()

urscript = urscript.generate()

print(urscript)
# ---------- end movep ----------
send_12 = Button()  # disabled
send_13 = GhPythonScript(urscript=movep, send=send_12)  # -> out; inputs send: Boolean; disabled; same code as send_3

panel_5 = Panel(pose.configuration)  # disabled

# ----
# Set Extruder data
acceleration = Slider(200, range=0..1000)  # disabled
max_speed_4 = Slider(450, range=0..1000)  # disabled
speed_4 = Slider(300, range=0..1000)  # disabled
# Extruder control through UR
number_2 = Slider(0, range=0..10)  # disabled
value_7 = BooleanToggle(True)  # disabled
send_14 = Button()  # disabled
extruder_data_4 = PythonScript(motor_id=number_2, motor_state=value_7, max_speed=max_speed_4, speed=speed_4, acceleration=acceleration, send=send_14)  # -> urscript; inputs motor_id: Int32, motor_state: Boolean; disabled
# ---------- extruder_data_4: Python ----------
from scriptcontext import sticky as st
from mobile_additive_manufacturing.control.urscript_extrusion import set_extruder_data

ur_ip = st["ur_ip"]
ur_port = st["ur_port"]
ext_ip = st["ext_ip"]
ext_port = st["ext_port"]

if send:
    set_extruder_data(ur_ip, ur_port, ext_ip, ext_port, motor_id, motor_state, max_speed, speed, acceleration)
# ---------- end extruder_data_4 ----------

# ----
# Get Extruder Info
send_15 = Button()  # disabled
get_info = PythonScript(send=send_15)  # -> info; disabled
# ---------- get_info: Python ----------
from scriptcontext import sticky as st
from mobile_additive_manufacturing.control.urscript_extrusion import get_extruder_info

ur_ip = st["ur_ip"]
ur_port = st["ur_port"]
ext_ip = st["ext_ip"]
ext_port = st["ext_port"]

if send:
    get_extruder_info(ur_ip, ur_port, ext_ip, ext_port)
# ---------- end get_info ----------

reset_task = Button()  # disabled
next_task = Button()  # disabled

prev_task = Button()  # disabled

# ----
# Toggle Extruder
value_8 = BooleanToggle(True)  # disabled
send_16 = Button()  # disabled
extruder_state_2 = PythonScript(state=value_8, send=send_16)  # -> urscript; inputs state: Boolean; disabled
# ---------- extruder_state_2: Python ----------
from scriptcontext import sticky as st
from mobile_additive_manufacturing.control.urscript_extrusion import toggle_extruder

ur_ip = st["ur_ip"]
ur_port = st["ur_port"]
ext_ip = st["ext_ip"]
ext_port = st["ext_port"]

if send:
    toggle_extruder(ur_ip, ur_port, ext_ip, ext_port, state)
# ---------- end extruder_state_2 ----------

# ----
# Calculate Basis - 3-Point Method
# Measure basis:
# 1. Clear the recorded poses
# 2. Move robot to origin and press "get pose"
# 3. Move robot to point in positive x-axis and press "get pose"
# 4. Move robot to an other point in your basis and press "get pose"
# (The further away these positions are, the better)
# 
# 5. Alternatively change the order in the component calc base
# 6. Copy output into base component (TODO: check if it has to be inverted)
list_13 = ValueList({"o, pos.x-axis, xy pl": 0, "o, pos.y-axis, xy pl": 1}, selected="o, pos.x-axis, xy pl")  # disabled
clear_3 = Button()  # disabled
rec = PythonScript(msg=pose_2.pose_cartesian, rec=get_2, clear=clear_3)  # -> rec; inputs msg: list; disabled; same code as rec_car
calc_base = PythonScript(poses=rec, input_type=list_13)  # -> out, base_plane; inputs poses: list; disabled
# ---------- calc_base: Python ----------
import Rhino.Geometry as rg
import math


if len(poses) > 2:
    
    O = poses[0]
    P1 = poses[1]
    P2 = poses[2]
    
    if input_type == 0:
        # origin, pt on positive x-axis, pt in xy plane
        origin = rg.Point3d(O[0], O[1], O[2])
        pt_on_xaxis = rg.Point3d(P1[0], P1[1], P1[2])
        pt_in_xyplane = rg.Point3d(P2[0], P2[1], P2[2])
        
        xaxis = pt_on_xaxis - origin
        xaxis.Unitize()
        
        v = pt_in_xyplane - origin
        zaxis = rg.Vector3d.CrossProduct(v, xaxis)
        zaxis.Unitize()
        
        # zaxis must look up!
        if math.acos(rg.Vector3d.ZAxis * zaxis) > math.acos(rg.Vector3d.ZAxis * -zaxis):
            zaxis = -zaxis
        
        yaxis = rg.Vector3d.CrossProduct(zaxis, xaxis)
    
    elif input_type == 1:
        # origin, pt on positive y-axis, pt in xy plane
        origin = rg.Point3d(O[0], O[1], O[2])
        pt_on_yaxis = rg.Point3d(P1[0], P1[1], P1[2])
        pt_in_xyplane = rg.Point3d(P2[0], P2[1], P2[2])
        
        yaxis = pt_on_yaxis - origin
        yaxis.Unitize()
        
        v = pt_in_xyplane - origin
        zaxis = rg.Vector3d.CrossProduct(v, yaxis)
        zaxis.Unitize()
        
        # zaxis must look up!
        if math.acos(rg.Vector3d.ZAxis * zaxis) > math.acos(rg.Vector3d.ZAxis * -zaxis):
            zaxis = -zaxis
        
        xaxis = rg.Vector3d.CrossProduct(yaxis, zaxis)
        
        
    print "Copy the following into base component:"
    print " "
    print "origin = [%.2f, %.2f, %.2f]" % tuple(list(origin))
    print "xaxis = [%.5f, %.5f, %.5f]" % tuple(list(xaxis))
    print "yaxis = [%.5f, %.5f, %.5f]" % tuple(list(yaxis))
    

#print rg.Vector3d.CrossProduct(rg.Vector3d.YAxis, rg.Vector3d.ZAxis)
#print rg.Vector3d.CrossProduct(rg.Vector3d.ZAxis, rg.Vector3d.XAxis)

    base_plane = rg.Plane(origin, xaxis, xaxis)
# ---------- end calc_base ----------
panel_6 = Panel(rec)  # disabled
panel_7 = Panel(calc_base.out)  # disabled

# ----
# Direct UR Control
config = GhPythonScript()  # -> out, joint_configs; disabled
# ---------- config: Python ----------
from compas_fab.robots import Configuration

values=[-0.737876, -1.64531, 1.740348, -0.367801, -0.37385, -0.110741]
joint_configs = [Configuration.from_revolute_values(values)]
# ---------- end config ----------
pln_2 = Plane(calc_base.base_plane)  # disabled

# ----
# Move Joints
clear_4 = Button()  # disabled
add_3 = Button()  # disabled
idx_4 = Slider(0, range=0..100)  # disabled
list_14 = ValueList({"send all positions": 0, "send only one position": 1, "from inverse": 2}, selected="from inverse")  # disabled
rec_joints = PythonScript(msg=pose.configuration, rec=add_3, clear=clear_4)  # -> rec; disabled
# ---------- rec_joints: Python ----------
from scriptcontext import sticky as st

guid = str(ghenv.Component.InstanceGuid)
recorded_key =  "recorded_" + guid
just_cleared_key = "just_cleared_" + guid


if recorded_key not in st:
    st[recorded_key] = []

if just_cleared_key not in st:
    st[just_cleared_key] = False

if clear:
    st[recorded_key] = []
    st[just_cleared_key] = True
else:
    if msg != [None] and not st[just_cleared_key] and rec:
        st[recorded_key].append(msg)
    st[just_cleared_key] = False
        


rec = st[recorded_key]

print rec
# ---------- end rec_joints ----------
item_4 = ListItem(List=config.joint_configs, Index=idx_4, Wrap=True)  # disabled
filter_5 = StreamFilter(Gate=list_14, Stream0=config.joint_configs, Stream1=item_4, Stream2=rec_joints)  # disabled
number_slider_8 = Slider(0.1, range=0..0.5)  # disabled
movej = PythonScript(velocity=number_slider_8)  # -> urscript, values; inputs joint_configurations: list; disabled
# ---------- movej: Python ----------
from ur_fabrication_control.direct_control import URScript
import math


"""
for c in joint_configurations:
    for i,v in enumerate(c.values):
        #print v
        if v>math.pi:
            v-=2*math.pi
        if v<-math.pi:
            v+=2*math.pi
        c.values[i]=v
print joint_configurations
values = joint_configurations[0].values
print([math.degrees(v) for v in values])
"""

#joint_config = ["movej({}, v={})".format(c.values, velocity/10) for c in joint_configurations]

urscript = URScript()
urscript.start()
for jc in joint_configurations:
    urscript.move_joint(jc, velocity)
urscript.end()

urscript = urscript.generate()

print(urscript)
# ---------- end movej ----------
send_17 = Button()  # disabled
send_18 = GhPythonScript(urscript=movej.urscript, send=send_17)  # -> out; inputs send: Boolean; disabled; same code as send_3

# ----
# Calculate Basis - Point fitting method via RPC
plane_init_guess = Plane(Plane(origin=(0, 0, 0), x=(0, -1, 0), y=(1, 0, 0)))  # disabled
toggle_3 = BooleanToggle(False)  # disabled
pt_2 = Point([<point referenced from the Rhino model> x3])  # disabled
calc_base_2 = PythonScript(poses=rec, pts_cad=pt_2, base_plane_init_guess=plane_init_guess, calc=toggle_3)  # -> out, pts_mtip_init_guess, pts_mtip_fit, base_plane_fit; inputs poses: list, pts_cad: list of Point3d, base_plane_init_guess: Plane; disabled
# ---------- calc_base_2: Python ----------
import ghpythonlib.components as ghcomp
import Rhino.Geometry as rg
from scriptcontext import sticky as st
from compas.geometry import Frame
import math as m
import sys
from compas.rpc import Proxy # for calling the numpy function in CPython


if len(poses):
    
    # get points from poses
    pts_mtip = [rg.Point3d(p[0], p[1], p[2]) for p in poses]
    
    T_W_R_init_guess = rg.Transform.PlaneToPlane(rg.Plane.WorldXY, base_plane_init_guess)
    pts_mtip_init_guess = [ghcomp.Transform(pt, T_W_R_init_guess) for pt in pts_mtip]
    
    # format Rhino transformation
    T_W_R_init_guess_flattened = [float(f) for f in T_W_R_init_guess.ToFloatArray(True)]
    T_W_R_init_guess_list = [T_W_R_init_guess_flattened[i:(i + 4)] for i in range(0, len(T_W_R_init_guess_flattened), 4)]  

    # format ptsA and ptsB
    dataB = [list(pt) for pt in pts_cad]
    dataA = [list(pt) for pt in pts_mtip]
    
    # call the function
    max_iterations = 100
    
    if calc:
        icp_func = Proxy('ur_fabrication_control.optimisation.icp', python = 'C://Users//kathrind//anaconda3//envs//ur_fab//python.exe')
        
        print icp_func._python

        transformation, distances = icp_func.icp(dataA, dataB, init_guess=T_W_R_init_guess_list, max_iterations=max_iterations, tolerance=0.000001)
        
        print "distances", distances
        
        # format result
        T = rg.Transform.Identity
        for i in range(4):
            for j in range(4):
                code = "T.M%i%i = %f" % (i, j, transformation[i][j])
                print code
                exec(code)
        #print T
        
        # now transform the points with the transformation calculated
        pts_mtip_fit = [ghcomp.Transform(pt, T) for pt in pts_mtip]
        base_plane_fit = ghcomp.Transform(rg.Plane.WorldXY, T)
        
        
        #f = Frame(base_plane_fit)
        #print f.get_pose_quaternion()
        
        # correct the zvalue
        #base_plane_fit = ghcomp.Transform(base_plane_fit, rg.Transform.Translation(0,0,-3))
# ---------- end calc_base_2 ----------
pt_3 = Point(calc_base_2.pts_mtip_init_guess)  # disabled
pt_4 = Point(calc_base_2.pts_mtip_fit)  # disabled
pln_3 = Plane(calc_base_2.base_plane_fit)  # disabled

# ----
# Stop Extruder
stop_5 = Button()  # disabled
stop_6 = PythonScript(stop=stop_5)  # disabled
# ---------- stop_6: Python ----------
from scriptcontext import sticky as st
from mobile_additive_manufacturing.control.urscript_extrusion import stop_extruder

ur_ip = st["ur_ip"]
ur_port = st["ur_port"]
ext_ip = st["ext_ip"]
ext_port = st["ext_port"]

if stop:
    stop_extruder(ur_ip, ur_port, ext_ip, ext_port)
# ---------- end stop_6 ----------

toggle_4 = BooleanToggle(False)  # disabled

# ----
# FABRICATION STATE  VIEWER
fabrication_state = PythonScript(update=toggle_4)  # -> out, state, num_tasks, num_current_task, num_tasks_left, log_messages; disabled
# ---------- fabrication_state: Python ----------
from scriptcontext import sticky as st
from compas_ghpython.utilities import update_component

fabrication = st["fabrication"]

if hasattr(fabrication, "fab_thread"):
    if fabrication.fab_thread.is_alive():
        state = "THREAD RUNNING"
    else:
        state = "THREAD STOPPED"
else:
    state = "THREAD NOT STARTED"

num_tasks = len(fabrication.tasks)
if fabrication.current_task_key is not None:
    num_current_task = fabrication.current_task_key
else:
    num_current_task = 0
num_tasks_left = num_tasks-num_current_task
log_messages = fabrication.log_messages

if update:
    update_component(ghenv, 1000)
# ---------- end fabrication_state ----------
state = Panel(fabrication_state.state)  # disabled
num_tasks = Panel(fabrication_state.num_tasks)  # disabled
num_current_task = Panel(fabrication_state.num_current_task)  # disabled
log_messages = Panel(fabrication_state.log_messages)  # disabled

list_15 = ValueList({"30", "32", "34"}, selected="30")  # disabled

# ----
# Set Extruder Digital Out
value_9 = BooleanToggle(True)  # disabled
send_19 = Button()  # disabled
digital_out_3 = PythonScript(pin=list_15, state=value_9, send=send_19)  # -> urscript; inputs pin: Int32, state: Boolean; disabled
# ---------- digital_out_3: Python ----------
from scriptcontext import sticky as st
from mobile_additive_manufacturing.control.urscript_extrusion import set_extruder_digital_out

ur_ip = st["ur_ip"]
ur_port = st["ur_port"]
ext_ip = st["ext_ip"]
ext_port = st["ext_port"]

if send:
    set_extruder_digital_out(ur_ip, ur_port, ext_ip, ext_port, pin, state)
# ---------- end digital_out_3 ----------

list_16 = ValueList({"30", "32", "34"}, selected="34")  # disabled

# ----
# Toggle fan
value_10 = BooleanToggle(True)  # disabled
send_20 = Button()  # disabled
digital_out_4 = PythonScript(pin=list_16, state=value_10, send=send_20)  # -> urscript; inputs pin: Int32, state: Boolean; disabled
# ---------- digital_out_4: Python ----------
from scriptcontext import sticky as st
from mobile_additive_manufacturing.control.urscript_extrusion import toggle_fan

ur_ip = st["ur_ip"]
ur_port = st["ur_port"]
ext_ip = st["ext_ip"]
ext_port = st["ext_port"]

if send:
    toggle_fan(ur_ip, ur_port, ext_ip, ext_port, pin, state)
# ---------- end digital_out_4 ----------

list_17 = ValueList({"30", "32", "34"}, selected="32")  # disabled

# ----
# Toggle air
value_11 = BooleanToggle(True)  # disabled
send_21 = Button()  # disabled
digital_out_5 = PythonScript(pin=list_17, state=value_11, send=send_21)  # -> urscript; inputs pin: Int32, state: Boolean; disabled
# ---------- digital_out_5: Python ----------
from scriptcontext import sticky as st
from mobile_additive_manufacturing.control.urscript_extrusion import toggle_air

ur_ip = st["ur_ip"]
ur_port = st["ur_port"]
ext_ip = st["ext_ip"]
ext_port = st["ext_port"]

if send:
    toggle_air(ur_ip, ur_port, ext_ip, ext_port, pin, state)
# ---------- end digital_out_5 ----------

# ----
# Get Pose Cartesian
get_3 = Button()

# ----
# SIMULATION ENVIRONMENT
py_2 = PythonScript()  # -> repositories_path, rbvogui_data_path, ur_data_path
# ---------- py_2: Python ----------
import os

"""
ASSUMING THE BELOW PACKAGES ARE STORED IN THE SAME LOCATION:
    ur_fabrication_control;
    rbvogui_common; and
    mobile_additive_manufacturing.
"""

repositories_path = os.path.abspath(os.path.join(ghdoc.Path,"../../../"))

assert os.path.exists(os.path.join(repositories_path, "ur_fabrication_control/data"))
assert os.path.exists(os.path.join(repositories_path, "rbvogui_common/rbvogui_description"))
assert os.path.exists(os.path.join(repositories_path, "mobile_fabrication_control"))

ur_data_path = os.path.abspath(os.path.join(ghdoc.Path,"../../../ur_fabrication_control/data"))
rbvogui_data_path = os.path.abspath(os.path.join(repositories_path, "rbvogui_common"))
# ---------- end py_2 ----------
list_18 = ValueList({"ur3.urdf", "ur3_rot.urdf", "ur5.urdf", "ur10.urdf", "ur3e.urdf", "ur5e.urdf", "ur10e.urdf", "ur10e_rot.urdf"}, selected="ur10e_rot.urdf")
list_19 = ValueList({"ur3.srdf", "ur5.srdf", "ur10.srdf", "ur3e.srdf", "ur5e.srdf", "ur10e.srdf"}, selected="ur10e.srdf")
list_20 = ValueList({"realsense": 0, "keyence": 1}, selected="realsense")
py_3 = PythonScript()  # -> DATA
# ---------- py_3: Python ----------
import os

#package_path = os.path.dirname(mobile_fabrication_control.__file__)
#DATA = os.path.abspath(os.path.join(package_path,"../../data"))

package_path = ghdoc.Path
# package_path = os.path.dirname(ur_fabrication_control.__file__)
#DATA = os.path.abspath(os.path.join(package_path,"../../data"))

# .stl files not stored in am_hackathon repo. but in mobile_fabrication_control
DATA = os.path.abspath(os.path.join(package_path,"../../../workshop_aaec_revamp/data"))

print(package_path)
print(DATA)
# ---------- end py_3 ----------
plane_nr = Slider(19, range=0..200)
list_21 = ValueList({"Zero": 0, "One": 1, "Two": 2, "Three": 3, "Four": 4, "Five": 5}, selected="Zero")

# ----
# Robot Model
# Load Model
list_22 = ValueList({"ur_description", "ur_e_description", "ur_setups"}, selected="ur_e_description")
py_4 = PythonScript(
    repositories_path=py_2.repositories_path,
    rbvogui_data_path=py_2.rbvogui_data_path,
    ur_data_path=py_2.ur_data_path,
    package=list_22,
    urdf_name=list_18,
    srdf_name=list_19)  # -> loaders, urdf_filename, srdf_filename
# ---------- py_4: Python ----------
import os
from compas.robots import LocalPackageMeshLoader

#loaders

ur_path = os.path.join(ur_data_path, "robot_description")
ur_packages = ["ur_description", "ur_e_description", "ur_end_effectors", "ur_setups"]
ur_loaders = [LocalPackageMeshLoader(ur_path, pck) for pck in ur_packages]

rbvogui_packages = ["rbvogui_description"]
rbvogui_loaders = [LocalPackageMeshLoader(rbvogui_data_path, pck) for pck in rbvogui_packages]

ewellix_packages = ["ewellix_description"]
ewellix_loaders = [LocalPackageMeshLoader(repositories_path, pck) for pck in ewellix_packages]

sensors_packages = ["robotnik_sensors"]
sensors_loaders = [LocalPackageMeshLoader(repositories_path, pck) for pck in sensors_packages]

loaders = ur_loaders + rbvogui_loaders + ewellix_loaders + sensors_loaders

#files
urdf_filename = os.path.join(repositories_path, r"mobile_fabrication_control\data\rbvogui_xl_lift_ur10e.urdf")
srdf_filename = os.path.join(repositories_path, r"mobile_fabrication_control\data\rbvogui.srdf")

assert os.path.isfile(urdf_filename)
assert os.path.isfile(srdf_filename)
# ---------- end py_4 ----------
units = ValueList({"m": 1, "cm": 100, "mm": 1000}, selected="m")
load = Button()
create = PythonScript(
    load=load,
    ur_base_frame_rhino_local_tf=python.ur_base_frame_rhino_local_tf,
    loaders=py_4.loaders,
    urdf_filename=py_4.urdf_filename,
    srdf_filename=py_4.srdf_filename,
    scale_factor=units)  # -> out, robot, rcf; inputs load: Boolean, loaders: list
# ---------- create: Python ----------
import os
from scriptcontext import sticky as st

import compas

from compas_ghpython import draw_frame
from compas.robots import RobotModel
from compas.robots import LocalPackageMeshLoader

from compas_fab.robots import Robot
from compas_fab.robots import RobotSemantics
from compas_fab.ghpython import RobotArtist

compas.PRECISION = '12f'

# store robot in component
guid = str(ghenv.Component.InstanceGuid)
robot_key = "robot"

if robot_key not in st:
    st[robot_key] = None

#print loaders
if load:
    model = RobotModel.from_urdf_file(urdf_filename)
    
    model.load_geometry(*loaders)
    artist = RobotArtist(model)
    semantics = RobotSemantics.from_srdf_file(srdf_filename, model)
    robot = Robot(model, artist, semantics, client=None)
    
    st[robot_key] = robot

robot = st[robot_key]
print(robot)
rcf = draw_frame(robot.get_RCF())
print(rcf)

if robot:
    robot.scale(scale_factor)
    robot.RCF_in_WCF = ur_base_frame_rhino_local_tf
# ---------- end create ----------
robot = Data(create.robot)

# ----
# Tool
list_23 = ValueList({"measurement_tool": 0, "clay_extruder_7mm": 1, "clay_extruder_7mm_with_2d_laser": 2, "clay_extruder_v21_7mm": 3, "scanner_tool": 4}, selected="scanner_tool")
show_2 = BooleanToggle(True)
python_3 = PythonScript(data_path=py_3, tool=list_23, tcp_frame=list_20, show=show_2)  # -> tool, M, ee_plane; inputs tcp_frame: Int32
# ---------- python_3: Python ----------
import os, math
from compas.geometry import Frame, Rotation
from compas.datastructures import Mesh
from compas_ghpython.artists import MeshArtist
from compas_fab.robots import Tool
from compas_ghpython.utilities import draw_frame

tolerance = 0

if tool == 0:
    filename = 'measurement_tool_zaxis.stl'
    ee_frame = Frame([0, 0, 0.109], [1, 0, 0], [0, 1, 0])

elif tool == 1:
    filename = 'clay_extruder_7mm.stl'
    # real frame:
    ee_frame = Frame([-0.000502, -0.105348, 0.0662,], [1, 0, 0], [0, 0, 1])
    
    # test frame:
    # ee_frame = Frame([0.0, 0.0, 0.1,], [1, 0, 0], [0, 1, 0])
elif tool == 2:
    filename = 'clay_extruder_7mm_with_2d_laser.stl'
    # non-rotated frame:
    if tcp_frame == "nozzle":
        ee_frame = Frame([-0.0013, -0.0053, 0.3441,], [1, 0, 0], [0, 1, 0])
    elif tcp_frame == "scanner":
        # Original frame
#        ee_frame = Frame([-0.0493, -0.0063, 0.3949,], [-1, 0, 0], [0, -1, 0])
        # Raised frame
        ee_frame = Frame([-0.0493, -0.0063, 0.4200,], [-1, 0, 0], [0, -1, 0])

elif tool == 3:
    filename = 'clay_extruder_v21_7mm.stl'
    ee_frame = Frame([0, 0, 0.33821], [1, 0, 0], [0, 1, 0])

elif tool == 4:
    filename = 'scanner_end_effector_v2.stl'
    if tcp_frame == 0: # Realsense
        ee_frame = Frame([0.0693178,0.00517868,0.239685], [0,1,0], [-1,0,0])
    elif tcp_frame == 1: # Keyence
        ee_frame = Frame([0.0148607,0.00809854,0.41498], [0,1,0], [-1,0,0])

data_path = os.path.join(data_path, "tool_geometry")
fullfilename = os.path.join(data_path, filename)
print fullfilename

ee_mesh = Mesh.from_stl(fullfilename)

#R = Rotation.from_axis_and_angle(ee_frame.zaxis, math.radians(180), point=ee_frame.point)
#ee_frame.transform(R)

if show:
    artist = MeshArtist(ee_mesh)
    M = artist.draw()

tool = Tool(ee_mesh, ee_frame)
ee_plane = draw_frame(ee_frame)
# ---------- end python_3 ----------
panel_8 = Panel("Attach a custom tool")
py_5 = PythonScript(robot=robot, tool=python_3.tool, attach=Toggle(True))  # -> a
# ---------- py_5: Python ----------
if attach:
    robot.attach_tool(tool, group = "ur10e")
else:
    robot.detach_tool()
# ---------- end py_5 ----------

pose_3 = PythonScript(get=get_3, tool=python_3.tool, from_robot=Toggle(False))  # -> pose_cartesian, frame_WCS, plane_WCS, plane_T0
# ---------- pose_3: Python ----------
from scriptcontext import sticky as st
from ur_fabrication_control.direct_control.common import get_current_pose_cartesian
from compas.geometry import Frame, Transformation
from compas_ghpython import draw_frame

robot = st["robot"]

server_ip = st["server_ip"]
server_port = st["server_port"]
ur_port = st["ur_port"]
ur_ip = st["ur_ip"]

# retrieve the current tool frame in axis angle format
if from_robot:
    if robot.attached_tool:
        tool_angle_axis = list(robot.attached_tool.frame.point) + list(robot.attached_tool.frame.axis_angle_vector)
    else:
        tool0_frame = Frame([0, 0, 0], [1, 0, 0], [0, 1, 0])
        tool_angle_axis = list(tool0_frame.point) + list(tool0_frame.axis_angle_vector)
else:
    tool_angle_axis = list(tool.frame.point) + list(tool.frame.axis_angle_vector)

print(tool_angle_axis)

guid = str(ghenv.Component.InstanceGuid)
pose_cartesian_key = "pose_cartesian" + guid


if get:
    st[pose_cartesian_key] = get_current_pose_cartesian(tool_angle_axis, server_ip, server_port, ur_ip, ur_port, send=True)

if pose_cartesian_key not in st:
    pose_cartesian = []
else:
    pose_cartesian = st[pose_cartesian_key]

print(pose_cartesian)

# get frame and plane of the current pose cartesian in world coordinates for visualization
if pose_cartesian:
    frame_RCS = Frame.from_axis_angle_vector(axis_angle_vector=pose_cartesian[3:], point=pose_cartesian[:3])
    T_RCF = Transformation.from_frame(robot.RCF_in_WCF)
    frame_WCS = frame_RCS.transformed(T_RCF)
    frame_T0 = tool.from_tcf_to_t0cf([frame_WCS])
    plane_WCS  = draw_frame(frame_WCS)
    plane_T0 = draw_frame(frame_T0[0])
    print frame_RCS
    print frame_WCS
# ---------- end pose_3 ----------
draw_2 = GhPythonScript(frames=pose_3.frame_WCS, scale=Slider(0.1, range=0..1))  # -> P, V, W; inputs frames: list; same code as draw
vdisex_2 = VectorDisplayEx(Point=draw_2.P, Vector=draw_2.V, Colour=RGB(0, 0, 0), Width=draw_2.W)
panel_9 = Panel(pose_3.pose_cartesian)

pln_4 = Plane(create.rcf)

# ----
# Info
info = PythonScript(robot=robot)  # -> out, main_group_name
# ---------- info: Python ----------
if robot:
    robot.info()
    main_group_name = robot.main_group_name
# ---------- end info ----------
panel_10 = Panel(info.out)

# ---- group: forward kinematics
# Configuration
a1 = Slider(45, range=-360..360)
a2 = Slider(-45, range=-360..360)
a3 = Slider(135, range=-360..360)
a5 = Slider(-90, range=-360..360)
a6 = Slider(0, range=-360..360)
a4 = Slider(-180, range=-360..360)
jp = GhPythonScript()  # -> joint_positions
# ---------- jp: Python ----------
import math

joint_positions = [0,-90,90,0,90,0]
joint_positions = [math.radians(a) for a in joint_positions]
#joint_positions = [-3.136, -0.328, -1.218, 3.129, 0.852, 0.008]
#joint_positions = [0] * 6



#joint_positions = [1.6239667567485938, 0.25439606475392273, 4.409424838594969-2*3.14, 3.1901607306255908, 1.5707963267948954, 0.053170429953696939]
#joint_positions = [1.598543436748912, 0.23021224965157744, 4.712232135219824-2*3.14, 6.0531299026928744, 4.7123889803846915, 0.027747109954015234]
#joint_positions = [-1.1373533430447322, 4.0117247163121572, 5.4083762087596021-2*3.14, 1.5754733624925168, 4.7123889803846879, 3.5750356373399574]
print joint_positions
# ---------- end jp ----------
forward_kinematics = PythonScript(robot=robot, set_joint_positions=Button(), joint_positions=jp, a1=a1, a2=a2, a3=a3, a4=a4, a5=a5, a6=a6)  # -> full_configuration; inputs joint_positions: list
# ---------- forward_kinematics: Python ----------
import math
import Grasshopper
from compas.robots import Joint
from compas_fab.robots import Configuration

if set_joint_positions:

    j = 0
    for i in range(ghenv.Component.Params.Input.Count):
        nslider = ghenv.Component.Params.Input[i].Sources[0]
        if nslider.GetType() == Grasshopper.Kernel.Special.GH_NumberSlider:
            nslider.TrySetSliderValue(math.degrees(joint_positions[j]))
            j += 1

if robot:
    joint_positions = [a1, a2, a3, a4, a5, a6]
    joint_types = robot.get_configurable_joint_types()
    for i, joint_type in enumerate(joint_types):
        if joint_type == Joint.REVOLUTE:
            joint_positions[i] = math.radians(joint_positions[i])
    full_configuration = Configuration(joint_positions, joint_types)
    
print(full_configuration)
# ---------- end forward_kinematics ----------

# ---- group: inverse kinematics
select_configuration = Slider(2, range=0..7)
inverse = PythonScript(robot=robot, group=info.main_group_name, idx=select_configuration)  # -> out, plane_tool0_RCS, plane_tcp_RCS, configuration; inputs plane_WCS: Plane, idx: Int32
# ---------- inverse: Python ----------
import Rhino.Geometry as rg
import math
from compas.geometry import Frame, Transformation, Rotation
from compas_fab.robots import Configuration
from ur_fabrication_control.kinematics.ur_kinematics import inverse_kinematics
from ur_fabrication_control.kinematics.ur_params import ur_params
from compas_ghpython import draw_frame

tcp_WCS = Frame(plane_WCS.Origin, plane_WCS.XAxis, plane_WCS.YAxis)

# transform frame to robot coordinate system
print tcp_WCS
print plane_WCS
tcp_RCS = robot.RCF_in_WCF.to_local_coordinates(tcp_WCS)
tool0_RCS = robot.from_tcf_to_t0cf([tcp_RCS])[0]
tool0_RCS_rot = Frame(tool0_RCS.point, tool0_RCS.zaxis, tool0_RCS.yaxis)
print tcp_RCS
print tool0_RCS
plane_tool0_RCS = draw_frame(tool0_RCS)
plane_tcp_RCS = draw_frame(tcp_RCS)
# calculate solutions to frame
ur_params = ur_params["ur10e"] # get the parameters according to the robot model
print ur_params
solutions = inverse_kinematics(tool0_RCS, ur_params)
print solutions

if not len(solutions):
    joint_values = [0,0,0,0,0,0]
    configuration = Configuration.from_revolute_values(joint_values)
else:
    joint_values = solutions[idx]
    #print joint_values
    
    ### ***** HACK ***** ##### TODO: CHECK!!!
    for i, v in enumerate(joint_values):
        if v > math.pi:
            v -= 2*math.pi
        if v < -math.pi:
            v += 2*math.pi
        joint_values[i] = v
    ### ***** HACK ***** ##### TODO: CHECK!!!
    configuration = [Configuration.from_revolute_values(joint_values)]

print(configuration)
# ---------- end inverse ----------

select_configuration_2 = Slider(2, range=0..7)
inverse_2 = PythonScript(robot=robot, plane_nr=plane_nr, idx=select_configuration_2)  # -> out, plane_tool0_RCS, plane_tcp_RCS, configuration; inputs planes_WCS: list of Plane, plane_nr: Int32, idx: Int32
# ---------- inverse_2: Python ----------
import Rhino.Geometry as rg
import math
from compas.geometry import Frame, Transformation, Rotation
from compas_fab.robots import Configuration
from ur_fabrication_control.kinematics.ur_kinematics import inverse_kinematics
from ur_fabrication_control.kinematics.ur_params import ur_params
from compas_ghpython import draw_frame

plane_WCS = planes_WCS[plane_nr]
tcp_WCS = Frame(plane_WCS.Origin, plane_WCS.XAxis, plane_WCS.YAxis)

# transform frame to robot coordinate system
tcp_RCS = robot.RCF_in_WCF.to_local_coordinates(tcp_WCS)
tool0_RCS = robot.from_tcf_to_t0cf([tcp_RCS])[0]

print tcp_RCS
print tool0_RCS
plane_tool0_RCS = draw_frame(tool0_RCS)
plane_tcp_RCS = draw_frame(tcp_RCS)
# calculate solutions to frame
ur_params = ur_params["ur10e"] # get the parameters according to the robot model
solutions = inverse_kinematics(tool0_RCS, ur_params)

if not len(solutions):
    joint_values = [0,0,0,0,0,0]
    configuration = Configuration.from_revolute_values(joint_values)
else:
    joint_values = solutions[idx]
    #print joint_values
    
    ### ***** HACK ***** ##### TODO: CHECK!!!
    for i, v in enumerate(joint_values):
        if v > math.pi:
            v -= 2*math.pi
        if v < -math.pi:
            v += 2*math.pi
        joint_values[i] = v
    ### ***** HACK ***** ##### TODO: CHECK!!!
    
    configuration = [Configuration.from_revolute_values(joint_values)]

print(configuration)
# ---------- end inverse_2 ----------

# ----
pln_5 = Plane(inverse.plane_tcp_RCS)
pln_6 = Plane(inverse.plane_tool0_RCS)

list_24 = ValueList({"0 forward_kinematics": 0, "1 inverse_kinematics": 1, "2 inverse_kinematics": 2}, selected="1 inverse_kinematics")
filter_6 = StreamFilter(Gate=list_24, Stream0=forward_kinematics, Stream1=inverse.configuration, Stream2=inverse_2.configuration)

# ----
# Visualisation
show_end_effector_frame = BooleanToggle(True)
show_base_frame = BooleanToggle(True)
show_collision = BooleanToggle(False)
show_frames = BooleanToggle(True)
show_visual = BooleanToggle(True)
show_acm = BooleanToggle(False)
visualize = PythonScript(
    robot=robot,
    tool=python_3.tool,
    group=info.main_group_name,
    configuration=filter_6,
    redraw=py_5,
    show_visual=show_visual,
    show_collision=show_collision,
    show_end_effector_frame=show_end_effector_frame,
    show_frames=show_frames,
    show_base_frame=show_base_frame,
    show_acm=show_acm,
    station=list_21)  # -> out, robot, visual, collision, attached_meshes, frames, ee_frame, tool0_frame, base_frame, base_pt; inputs redraw: list, attached_collision_meshes: list, station_pts: list
# ---------- visualize: Python ----------
import rhinoscriptsyntax as rs
import Rhino.Geometry as rg
import ghpythonlib.components as ghcomp
from compas.geometry import Vector
from compas.geometry import Point
from compas.geometry import Transformation
from compas.geometry import Frame
from compas_ghpython.artists import MeshArtist
from compas_ghpython.utilities import draw_frame
from compas_fab.robots import Configuration
from ur_fabrication_control.kinematics.ur_kinematics import forward_kinematics
from ur_fabrication_control.kinematics.ur_params import ur_params

print(configuration)

if robot and configuration:
    robot.update(configuration, visual=show_visual, collision=show_collision)
    ur_params = ur_params[robot.main_group_name]
    print(ur_params)
    if show_visual:
        visual = robot.artist.draw_visual()
        robot_RCF = draw_frame(robot.RCF_in_WCF)
        init_robot_plane = rg.Plane(rg.Point3d(0.275, 0.0, 1.105), rg.Vector3d(-0.707, 0.707, 0.0), rg.Vector3d(-0.707, -0.707,0.0))
        visual = ghcomp.Orient(visual, init_robot_plane, robot_RCF)[0]
        
    if show_collision:
        collision = robot.artist.draw_collision()
    
    frames = robot.transformed_frames(configuration, group)

    if show_base_frame:
        base_frame = frames[0]

    if show_end_effector_frame:
#        tool0_frame = forward_kinematics(configuration.revolute_values, ur_params)
        tool0_frame = robot.forward_kinematics(configuration, group)
        print tool0_frame
        ee_frame = robot.from_t0cf_to_tcf([tool0_frame])
        print("End-effector", ee_frame)
    
    if not show_frames:
        frames = None

#    frame = forward_kinematics(configuration.revolute_values, ur_params)
    frame = robot.forward_kinematics(configuration, options=dict(solver='model', link_name=robot.attached_tool.link_name))
    #robot.artist.update_tool(visual=visual, collision=collision, transformation=Transformation.from_frame_to_frame(Frame.worldXY(), tool0_frame))
    
    if show_acm:
        M = []
        for acm in attached_collision_meshes:
            frame = robot.forward_kinematics(configuration, options=dict(solver='model', link_name=acm.link_name))
            T = Transformation.from_frame_to_frame(Frame.worldXY(), frame)
            mesh = acm.collision_mesh.mesh.transformed(T)
            M.append(MeshArtist(mesh).draw())
        attached_meshes = M
# ---------- end visualize ----------
geo = Geometry(visualize.visual)
geo_2 = Geometry(visualize.collision)
draw_3 = GhPythonScript(frames=[visualize.frames, visualize.ee_frame, visualize.base_frame], scale=Slider(0.1, range=0..1))  # -> P, V, C, W; inputs frames: list; same code as draw
preview = CustomPreview(Geometry=geo, Shader=ColourSwatch(SwatchColor=RGB(105, 105, 105)))
preview_2 = CustomPreview(Geometry=visualize.attached_meshes, Shader=ColourSwatch(SwatchColor=RGB(255, 255, 255)))
vdisex_3 = VectorDisplayEx(Point=draw_3.P, Vector=draw_3.V, Colour=draw_3.C, Width=draw_3.W)

tasks = GhPythonScript(create=Button(), robot=robot, server=feedbackserver, robot_speed=robot_speed, direction=list_3)  # -> out, tasks; inputs xframes: tree of Plane, yframes: tree of Plane
# ---------- tasks: Python ----------
from scriptcontext import sticky as st
from ur_fabrication_control.direct_control.fabrication_process import URTask
from ur_fabrication_control.direct_control import URScript
from compas.geometry import Frame
from compas_ghpython.utilities import ghtree_to_list


ur_ip = st["ur_ip"]
ur_port = st["ur_port"]
server_ip = st["server_ip"]
server_port = st["server_port"]

list_xframes = ghtree_to_list(xframes)
list_yframes = ghtree_to_list(yframes)

def create_tasks_paths():
    tasks = []
    key = 0

    if direction == "xframes":
        paths = list_xframes[0]
    elif direction == "yframes":
        paths = list_yframes[0]
    print(len(paths))
    for k, path in enumerate(paths):
        req_msg = "Path{}_completed".format(key)
        if k%2==0:
            planes = path
        else:
            planes = path
            
        urscript = urscript_from_planes(planes, key, req_msg)
        new_task = URTask(server, urscript, req_msg, key)
        tasks.append(new_task)
        key += 1
#    ext_task = extruder_task(key, state=0, ext_speed=24000)
#    tasks.append(ext_task)
    return tasks

def planes_to_frames(planes):
    print(planes[0])
    return [Frame(plane.Origin, plane.XAxis, plane.YAxis) for plane in planes]

def get_frames_in_RCS(frames):
    return [robot.RCF_in_WCF.to_local_coordinates(frame) for frame in frames]

def urscript_from_planes(planes, pkey, exit_message):
    print(planes)
    frames = planes_to_frames(planes)
    ur_script = URScript(ur_ip=ur_ip, ur_port=ur_port)
    tool_angle_axis = list(robot.attached_tool.frame.point) + list(robot.attached_tool.frame.axis_angle_vector)
    ur_script.start()
    ur_script.set_tcp(tool_angle_axis)
    RCS_frames = get_frames_in_RCS([frame for frame in frames])
#    RCS_frames = limit_frames_rotation(RCS_frames, layer_number, init_rot_dz, init_rot_dx, init_rot_num_frames, init_rot_side)
    radii = [0.002 for frame in frames]
    ur_script.add_line("textmsg(\">> TASK {}.\")".format(pkey))
    # Initialize first movement (with accelleration)
    ur_script.socket_open(server_ip, server_port, "Feedbackserver")
    ur_script.move_linear(RCS_frames[0], robot_speed, 0.0)
    node_msg = {"LAYER":pkey, "NODE":0}
    ur_script.socket_send_line_string(str(node_msg), socket_name="Feedbackserver")
    # Send all next frames of the layer (constant speed, no accelleration)
    for key, RCS_frame in enumerate(RCS_frames[1:len(RCS_frames)]):
        ur_script.move_linear(RCS_frame, robot_speed, 0)
        node_msg = {"LAYER":pkey, "NODE":key}
        ur_script.socket_send_line_string(str(node_msg), socket_name="Feedbackserver")
    ur_script.socket_close(name="Feedbackserver")# BS: Closing socket at the end of the loop
    # Signify ready
    ur_script.socket_open(server_ip, server_port, "Feedbackserver")
    ur_script.socket_send_line_string(exit_message, socket_name="Feedbackserver")
    ur_script.socket_close(name="Feedbackserver")# BS: Closing socket at the end of the loop
    #Finalize script
    ur_script.end()
    ur_script.generate()
    return ur_script

if create:
    st["tasks"] = create_tasks_paths()

tasks = st["tasks"]
# ---------- end tasks ----------

# ----
# TASKS
robot_speed_2 = Slider(0.012, range=0..1)  # disabled
button_5 = Button()  # disabled
tasks_2 = GhPythonScript(
    create=button_5,
    robot=robot,
    server=feedbackserver,
    robot_speed=robot_speed_2,
    init_rot_dz=number_slider,
    init_rot_dx=number_slider_2,
    init_rot_num_frames=number_slider_3,
    init_rot_side=list_4,
    init_rot_layers=number_slider_4)  # -> tasks; disabled
# ---------- tasks_2: Python ----------
import math
from scriptcontext import sticky as st
from ur_fabrication_control.direct_control.fabrication_process import URTask
from ur_fabrication_control.direct_control import URScript
from extruder_control.fabrication import EXTTask
from compas.geometry import Vector
from compas.geometry import Rotation
from compas.geometry import Frame


ur_ip = st["ur_ip"]
ur_port = st["ur_port"]
server_ip = st["server_ip"]
server_port = st["server_port"]

def create_tasks_from_am_model(am_model):
    tasks = []
    key = 0
#    req_msg = "Initial_pos_Layer{}_completed".format(key)
#    urscript = urscript_initial_position(am_model.layer(0), req_msg)
#    new_task = URTask(server, urscript, req_msg, key)
#    tasks.append(new_task)
#    key += 1
#    ext_task = extruder_task(key, state=1, ext_speed=24000)
#    tasks.append(ext_task)
#    key += 1
    for k, layer in am_model.layers():
        req_msg = "Layer{}_completed".format(key)
        urscript = urscript_from_layer(layer, key, req_msg)
        new_task = URTask(server, urscript, req_msg, key)
        tasks.append(new_task)
        key += 1
#    ext_task = extruder_task(key, state=0, ext_speed=24000)
#    tasks.append(ext_task)
    return tasks

def get_frames_in_RCS(frames):
    return [robot.RCF_in_WCF.to_local_coordinates(frame) for frame in frames]

def urscript_initial_position(layer, exit_message):
    ur_script = URScript(ur_ip=ur_ip, ur_port=ur_port)
    tool_angle_axis = list(robot.attached_tool.frame.point) + list(robot.attached_tool.frame.axis_angle_vector)
    ur_script.start()
    ur_script.set_tcp(tool_angle_axis)
    RCS_frame = get_frames_in_RCS([layer.node(0).frame])
    ur_script.move_linear(RCS_frame[0], robot_speed, 0.0)
    # Signify ready
    ur_script.socket_open(server_ip, server_port, "Feedbackserver")
    ur_script.socket_send_line_string(exit_message, socket_name="Feedbackserver")
    ur_script.socket_close(name="Feedbackserver")# BS: Closing socket at the end of the loop
    #Finalize script
    ur_script.end()
    ur_script.generate()
    return ur_script
    
def extruder_task(key, state, ext_speed):
    exttask = EXTTask(ext_address=("192.168.0.220", 50004), key=key)
    exttask.add_function("send_set_do", 8, state, True)
    exttask.add_function("send_motordata", state, ext_speed, 10000, True)
    return exttask

def limit_frames_rotation(frames, lnum, init_rdz = 90, init_rdx=20, init_rot_frames=10, sides="left"):
    lfrs = []
    veca2ds = []
    yvec2ds = []
    init_rdz_left = -init_rdz
    init_rdz_right = init_rdz
    for i, frame in enumerate(frames):
        new_frame = frame.copy()
        # Maximum rotation based on platform location
        veca3d = Vector.from_start_end(frame.point, Frame.worldXY().point)
        veca2d = Vector(veca3d.x, veca3d.y, 0)
        yvec2d = Vector(new_frame.yaxis[0], new_frame.yaxis[1], 0)
        anglea = yvec2d.angle_signed(veca2d, Vector.Zaxis())
#        print anglea
        if anglea > math.pi/4:
            R = Rotation.from_axis_and_angle(frame.zaxis, math.pi/4-anglea, frame.point)
            new_frame.transform(R)
        elif anglea < -math.pi/4:
            R = Rotation.from_axis_and_angle(frame.zaxis, -math.pi/4-anglea, frame.point)
            new_frame.transform(R)
            
        # Manual manipulations
        if (lnum%2 == 0 and sides in ["left", "both"]):
            if i<init_rot_frames:
                R = Rotation.from_axis_and_angle(new_frame.zaxis, math.radians(init_rdz_left)*math.cos(i*(math.pi/(2*init_rot_frames))), new_frame.point)
                new_frame.transform(R)
                R = Rotation.from_axis_and_angle(new_frame.xaxis, math.radians(init_rdx)*((init_rot_frames-i)/init_rot_frames), new_frame.point)
                new_frame.transform(R)
            elif i>len(frames)-init_rot_frames:
                R = Rotation.from_axis_and_angle(new_frame.zaxis, 0, new_frame.point)
                new_frame.transform(R)
        else:
            pass
        if (lnum%2 == 0 and sides in ["right", "both"]):
            if i<init_rot_frames:
                R = Rotation.from_axis_and_angle(new_frame.zaxis, 0, new_frame.point)
                new_frame.transform(R)
            elif i>=len(frames)-init_rot_frames:
                R = Rotation.from_axis_and_angle(new_frame.zaxis, math.radians(init_rdz_right)*math.cos((math.pi/2)-(i-(len(frames)-init_rot_frames))*(math.pi/(2*init_rot_frames))), new_frame.point)
                new_frame.transform(R)
                R = Rotation.from_axis_and_angle(new_frame.xaxis, math.radians(init_rdx)*((i-(len(frames)-1-init_rot_frames))/(init_rot_frames)), new_frame.point)
                print((i-(len(frames)-1-init_rot_frames))/(init_rot_frames))
                new_frame.transform(R)
        else:
            pass
        if (lnum%2 ==1 and sides in ["left", "both"]):
            if i<init_rot_frames:
                R = Rotation.from_axis_and_angle(new_frame.zaxis, 0, new_frame.point)
                new_frame.transform(R)
            elif i>=len(frames)-init_rot_frames:
                R = Rotation.from_axis_and_angle(new_frame.zaxis, math.radians(-init_rdz_right)*math.cos((math.pi/2)-(i-(len(frames)-init_rot_frames))*(math.pi/(2*init_rot_frames))), new_frame.point)
                new_frame.transform(R)
                R = Rotation.from_axis_and_angle(new_frame.xaxis, math.radians(init_rdx)*((i-(len(frames)-1-init_rot_frames))/(init_rot_frames)), new_frame.point)
                print((i-(len(frames)-1-init_rot_frames))/(init_rot_frames))
                new_frame.transform(R)
        else:
            pass
        if (lnum%2 ==1 and sides in ["right", "both"]):
            if i<init_rot_frames:
                R = Rotation.from_axis_and_angle(new_frame.zaxis, math.radians(-init_rdz_left)*math.cos(i*(math.pi/(2*init_rot_frames))), new_frame.point)
                new_frame.transform(R)
                R = Rotation.from_axis_and_angle(new_frame.xaxis, math.radians(init_rdx)*((init_rot_frames-i)/init_rot_frames), new_frame.point)
                new_frame.transform(R)
            elif i>len(frames)-init_rot_frames:
                R = Rotation.from_axis_and_angle(new_frame.zaxis, 0, new_frame.point)
                new_frame.transform(R)
        else:
            pass
        
        lfrs.append(new_frame)
#        veca2dartist = VectorArtist(veca2d)
#        yvec2dartist = VectorArtist(yvec2d)
#        veca2ds.append(veca2dartist.draw()[0])
#        yvec2ds.append(yvec2dartist.draw()[0])
    return lfrs

def urscript_from_layer(layer, layer_number, exit_message):
    ur_script = URScript(ur_ip=ur_ip, ur_port=ur_port)
    tool_angle_axis = list(robot.attached_tool.frame.point) + list(robot.attached_tool.frame.axis_angle_vector)
    ur_script.start()
    ur_script.set_tcp(tool_angle_axis)
    RCS_frames = get_frames_in_RCS([node.frame for key, node in layer.nodes()])
#    RCS_frames = limit_frames_rotation(RCS_frames, layer_number, init_rot_dz, init_rot_dx, init_rot_num_frames, init_rot_side)
    radii = [node.radius for key, node in layer.nodes()]
    ur_script.add_line("textmsg(\">> TASK {}.\")".format(layer_number))
    # Initialize first movement (with accelleration)
    ur_script.socket_open(server_ip, server_port, "Feedbackserver")
    ur_script.move_linear(RCS_frames[0], robot_speed, 0.0)
    node_msg = {"LAYER":layer_number, "NODE":0}
    ur_script.socket_send_line_string(str(node_msg), socket_name="Feedbackserver")
    # Send all next frames of the layer (constant speed, no accelleration)
    for key, RCS_frame in enumerate(RCS_frames[1:len(RCS_frames)]):
        ur_script.move_linear(RCS_frame, robot_speed, 0)
        node_msg = {"LAYER":layer_number, "NODE":key}
        ur_script.socket_send_line_string(str(node_msg), socket_name="Feedbackserver")
    ur_script.socket_close(name="Feedbackserver")# BS: Closing socket at the end of the loop
    # Signify ready
    ur_script.socket_open(server_ip, server_port, "Feedbackserver")
    ur_script.socket_send_line_string(exit_message, socket_name="Feedbackserver")
    ur_script.socket_close(name="Feedbackserver")# BS: Closing socket at the end of the loop
    #Finalize script
    ur_script.end()
    ur_script.generate()
    return ur_script

if create:
    st["tasks"] = create_tasks_from_am_model(am_model)

tasks = st["tasks"]
# ---------- end tasks_2 ----------

# ----
# CONTROL ENVIRONMENT
# FABRICATION MANAGER
# 3>
reset_fabrication = Button()  # disabled
start_fabrication = Button()  # disabled
stop_fabrication = Button()  # disabled
set_tasks = Button()  # disabled
toggle_5 = BooleanToggle(False)  # disabled
init = Button()  # disabled
fabricationmanager = PythonScript(
    server=feedbackserver,
    tasks=tasks.tasks,
    init=init,
    parallelize=toggle_5,
    set_tasks=set_tasks,
    start=start_fabrication,
    stop=stop_fabrication,
    reset=reset_fabrication,
    next_task=next_task,
    reset_task=reset_task,
    prev_task=prev_task)  # -> out, server; inputs tasks: list; disabled
# ---------- fabricationmanager: Python ----------
from scriptcontext import sticky as st
from fabrication_manager.fabrication import FabricationManager

if init:
    fabrication = FabricationManager(server)
    fabrication.parallelize = parallelize
    st["fabrication"] = fabrication

fabrication = st["fabrication"]

if set_tasks:
    print "setting tasks"    
    fabrication.clear_tasks()
    fabrication.set_tasks(tasks)

if start:
    #if robot.is_connected(): #and arduino.is_connected():
    print "starting process"
    fabrication.start()

if stop:
    print "stopping process"
    fabrication.stop()
    
if reset:
    print "resetting process"
    fabrication.reset()

if next_task:
    t = fabrication.get_next_task()
    task_state_set(True, t)
    
if reset_task:
    t = fabrication.get_next_task()
    task_state_set(False, t)

if prev_task:
    t = fabrication.get_next_task()
    task_state_set(False, t)
    t = fabrication.tasks[fabrication.current_task_key-1]
    task_state_set(False, t)
    fabrication.get_next_task()

def task_state_set(state, t):
    t.is_completed = state
    t.is_running = False

server = fabrication.server
# ---------- end fabricationmanager ----------
num_tasks_left = Panel(fabrication_state.num_tasks_left)  # disabled

# ----
# SERVER STATE  VIEWER
server_state = GhPythonScript(server=fabricationmanager.server)  # -> out, msgs, server_state, processing_state; disabled
# ---------- server_state: Python ----------
__author__ = "Gido"
__version__ = "2022.05.17"

import rhinoscriptsyntax as rs

msgs = server.msgs.values()
if hasattr(server, "server_thread"):
    if server.server_thread.is_alive():
        server_state = "RUNNING"
    else:
        server_state = "HALTED"
else:
    server_state = "NOT RUNNING"

if hasattr(server, "process_thread"):
    if server.process_thread.is_alive():
        processing_state = "RUNNING"
    else:
        processing_state = "HALTED"
else:
    processing_state = "NOT RUNNING"
# ---------- end server_state ----------
server_state_2 = Panel(server_state.server_state)  # disabled
processing_state = Panel(server_state.processing_state)  # disabled
server_messages = Panel(server_state.msgs)  # disabled
