# Grasshopper definition offline_mobile_robot.ghx (Grasshopper 1.0.8)
# plug-ins: RhinoCodePluginGH, MetaHopper

# ----
# IP Settings
# --> Set your IP address
# --> Set robot IP address
server_ip = ValueList({"192.168.0.67", "192.168.10.12", "192.168.10.11", "192.168.10.10", "192.168.10.2", "127.0.0.1", "192.168.10.111", "192.168.0.45", "192.168.0.30", "10.42.0.212", "10.42.0.133"}, selected="192.168.0.45")
ur_ip = ValueList({"192.168.10.10", "192.168.10.20", "192.168.10.11", "192.168.10.12", "127.0.0.1", "192.168.10.111", "192.168.0.210", "192.168.0.211", "192.168.0.235", "192.168.0.30"}, selected="192.168.0.235")
server_port = ValueList({"50002", "50003", "50005", "50006", "50007", "50008", "50009", "50010", "50011", "50012", "50013", "50014", "50015", "50016", "50017", "50018", "50019", "50020", "50021", "50022", "50023", "50024", "50025", "50026", "50027", "50028"}, selected="50020")
ur_port = ValueList({"30002"}, selected="30002")
globals = Python3Script(server_ip=server_ip, server_port=server_port, ur_ip=ur_ip, ur_port=ur_port, clear=Button())  # inputs server_ip: String, server_port: Int32, ur_ip: String, ur_port: Int32
# ---------- globals: Python ----------
from scriptcontext import sticky as st

st["server_ip"] = server_ip
st["server_port"] = server_port

st["ur_ip"] = ur_ip
st["ur_port"] = ur_port

if clear:
    st.clear()
# ---------- end globals ----------

# ----
# Check if UR robot
#  is available
ping = Button()
ping_2 = Python3Script(ip=ur_ip, ping=ping)  # -> out; inputs ip: String
# ---------- ping_2: Python ----------
from scriptcontext import sticky as st
from ur_fabrication_control.direct_control.utilities import is_available

guid = str(ghenv.Component.InstanceGuid)
txt_key = "txt_" + guid
if txt_key not in st:
    st[txt_key] = ""

if ping:
    
    available = is_available(ip)
    
    if available:
        st[txt_key] = "%s is up!" % ip
        trigger = True
    else:
        st[txt_key] = "%s is down!" % ip
        trigger = False

print(st[txt_key])
# ---------- end ping_2 ----------
panel = Panel(ping_2)

list = ValueList({"rbvogui_xl_ur20", "rbvogui_xl_ur10e_indoor", "rbvogui_xl_ur10e_outdoor"}, selected="rbvogui_xl_ur10e_indoor")

py3 = Python3Script()  # -> HERE, DATA, ROBOT_DESCRIPTION
# ---------- py3: Python ----------
import os

HERE = os.path.dirname(ghdoc.Path)
DATA = os.path.abspath(os.path.join(HERE, "..", "data"))
ROBOT_DESCRIPTION = os.path.abspath(os.path.join(DATA, "robot_description"))

print(HERE)
print(DATA)
print(ROBOT_DESCRIPTION)
# ---------- end py3 ----------
reload = Python3Script(reload=Button())  # -> out
# ---------- reload: Python ----------
if reload:
    from compas_rhino import unload_modules
    unload_modules("assembly_information_model")
    unload_modules('mobile_robot_control')
    unload_modules('fabrication_manager')
    unload_modules('ur_fabrication_control')
    unload_modules('spaicr')
# ---------- end reload ----------

# ----
# ROS client
list_2 = ValueList({"local": "127.0.0.1", "linux computer new": "192.168.0.235", "linux computer": "192.168.0.250", "linux eduroam": "10.181.95.254", "linux ccnet": "192.168.0.102", "linux vmware": "192.168.199.36", "robot": "192.168.0.200", "robotAA_wifi": "192.168.0.111", "robotAB_wifi": "192.168.0.112", "robotAB_eduroam": "10.181.67.95"}, selected="linux computer")
connect = BooleanToggle(True)
ros = Python3Script(ip=list_2, port="9090", connect=connect)  # -> out, ros_client, is_connected; inputs ip: String, port: Int32, connect: Boolean
# ---------- ros: Python ----------
"""
Connect or disconnect to ROS.

COMPAS FAB v0.27.0
"""
from scriptcontext import sticky as st

from compas_fab.backends import RosClient

ros_client = None

ip = ip or '127.0.0.1'
port = port or 9090
key = "ros_client_001"
ros_client = st.get(key, None)

if ros_client:
    st[key].close()
if connect:
    st[key] = RosClient(ip, port)
    st[key].run(5)

ros_client = st.get(key, None)
is_connected = ros_client.is_connected if ros_client else False
# ---------- end ros ----------
panel_2 = Panel(ros.is_connected)

# ----
# Load robot from ROS
# Make sure that ros bridge, file server, tf2_web_republisher and moveit config is running on the robot!
ros2 = BooleanToggle(True)
load = Button()
mobile_robot = Python3Script(ros_client=ros.ros_client, ros2=ros2, load=load)  # -> out, mobile_robot; inputs prefix: String
# ---------- mobile_robot: Python ----------
"""
Load robot directly from ROS.

COMPAS FAB v0.27.0
"""
from mobile_robot_control.mobile_robot import MobileRobot
from mobile_robot_control.mobile_robot_client import MobileRobotClient
import compas_robots.ghpython

# from ghpythonlib.componentbase import executingcomponent as component
from scriptcontext import sticky as st
import Rhino
import scriptcontext

scriptcontext.doc = Rhino.RhinoDoc.ActiveDoc

from compas_robots import RobotModel
from compas_robots.ghpython.scene import RobotModelObject
from compas.scene import SceneObject

scriptcontext.doc = ghdoc

key = 'robot_AA'

if ros2:
    rst = "robot_state_publisher:"
    mg = "move_group:"
else:
    rst = ""
    mg = ""

print(key)
if ros_client and ros_client.is_connected and load:
    # Load URDF from ROS
    robot = ros_client.load_robot(
            load_geometry=True, 
            urdf_param_name= '{}/{}robot_description'.format(prefix, rst),
            srdf_param_name= '{}/{}robot_description_semantic'.format(prefix, mg))
    try:
        robot.scene_object = SceneObject(item=robot.model)
    except:
        robot.scene_object = RobotModelObject(robot.model)
    #mobile_robot = MobileRobot(robot.model, robot.scene_object, robot.semantics, client=None)
    st[key] = robot

mobile_robot = st.get(key, None)
if mobile_robot:  # client sometimes need to be restarted, without needing to reload geometry
    mobile_robot.mobile_client = MobileRobotClient(ros_client)
    mobile_robot.client = ros_client
# ---------- end mobile_robot ----------
py3_2 = Python3Script(robot=mobile_robot.mobile_robot, ros_client=ros.ros_client)  # -> out, mobile_robot
# ---------- py3_2: Python ----------
from mobile_robot_control.mobile_robot import MobileRobot
from mobile_robot_control.mobile_robot_client import MobileRobotClient

mobile_robot = MobileRobot(robot.model, robot.scene_object, robot.semantics, client=None)
mobile_robot.mobile_client = MobileRobotClient(ros_client)
#mobile_robot.client = ros_client
# ---------- end py3_2 ----------

py3_3 = Python3Script()  # -> mobile_robot_data_path, ur_data_path
# ---------- py3_3: Python ----------
import os

"""
ASSUMING THE BELOW PACKAGES ARE STORED IN THE SAME LOCATION:
    ur_fabrication_control;
    rbvogui_common; and
    mobile_additive_manufacturing.
"""

repositories_path = os.path.abspath(os.path.join(ghdoc.Path,"../../../"))

assert os.path.exists(os.path.join(repositories_path, "ur_fabrication_control/data"))
assert os.path.exists(os.path.join(repositories_path, "mobile_robot_control/data/robot_description/rbvogui_xl_lift_ur10e"))

ur_data_path = os.path.abspath(os.path.join(ghdoc.Path,"../../../ur_fabrication_control/data"))
mobile_robot_data_path = os.path.abspath(os.path.join(ghdoc.Path,"../../../mobile_robot_control/data"))
# ---------- end py3_3 ----------

# ----
# Import Assembly
import = Button()
path = Python3Script()  # -> out, DATA
# ---------- path: Python ----------
import os
import ghpythonlib.components as ghcomp
import getpass

username = getpass.getuser()
USER_FOLDER = os.path.abspath(os.path.join("C:/Users/", username))
DATA = os.path.abspath(os.path.join(USER_FOLDER,"workspace/projects/spaicr/data/3rd_experiment/assembly_logs"))

ghComp = ghenv.Component
ghDoc = ghComp.OnPingDocument()

path_gh_file = ghDoc.FilePath

print(DATA)
# ---------- end path ----------
import_2 = Python3Script(new=Toggle(False), DATA=path.DATA, import=import)  # -> out, assembly; inputs DATA: String
# ---------- import_2: Python ----------
import os
import json
from assembly_information_model.assembly import Assembly
from scriptcontext import sticky as st

if _import:
    if new:
        filename = "T_brick_bench_3_bricks.json"
    else:
        filename = "brick_bench_test_1_3.json"
    PATH = os.path.join(DATA, filename)
    print(PATH)
    assembly = Assembly.from_json(PATH)

    st['building_structure'] = assembly

assembly = st.get('building_structure')
# ---------- end import_2 ----------

# ----
# Transform
toggle = BooleanToggle(False)
transform_assembly = Python3Script(assembly=import_2.assembly, transform=toggle)  # -> out, assembly
# ---------- transform_assembly: Python ----------
from compas.geometry import Frame, Transformation, Rotation, Translation
from compas_rhino.conversions import plane_to_compas_frame, point_to_rhino, frame_to_rhino

center_frame = Frame.worldXY()
# center_frame_new = plane_to_compas_frame(center_plane_new)

if transform:
    copy_assembly = assembly.copy()
    # T = Transformation.from_frame_to_frame(center_frame, Frame([11.9,7,0],[1,0,0],[0,1,0])) #stack T
    T = Transformation.from_frame_to_frame(center_frame, Frame([12.6,6,0],[0,-1,0],[1,0,0]))
    # assembly = assembly.transformed(T)

    # Here transform both the frame and planned frame of every brick.
    for key in copy_assembly.part_keys():
        p = copy_assembly.part(key)
        p.frame = p.frame.transformed(T)
        copy_assembly.graph.node_attribute(key, "planned_frame", p.frame)
        print(copy_assembly.graph.node_attribute(key, "planned_frame"))

    assembly = copy_assembly
# ---------- end transform_assembly ----------

# ----
# Export to JSON
export = Button()
path_2 = Python3Script()  # -> out, DATA
# ---------- path_2: Python ----------
import os
import getpass

username = getpass.getuser()
USER_FOLDER = os.path.abspath(os.path.join("C:/Users/", username))
DATA = os.path.abspath(os.path.join(USER_FOLDER,"workspace/projects/spaicr/data/3rd_experiment/assembly_logs"))

print(USER_FOLDER)
print(DATA)
# ---------- end path_2 ----------
export_2 = Python3Script(DATA=path_2.DATA, building_structure=transform_assembly.assembly, export=export)  # -> out
# ---------- export_2: Python ----------
import os

if export:
    no = "1_5"

    filename = "brick_stack_test_{}.json".format(str(no))
    PATH = os.path.join(DATA, filename)
    
    # the assembly has to be serialized such that it can be called from CPython
    material_stack.to_json(PATH)

    filename = "brick_bench_test_{}.json".format(str(no))
    PATH = os.path.join(DATA, filename)
    
    # the assembly has to be serialized such that it can be called from CPython
    building_structure.to_json(PATH)
# ---------- end export_2 ----------

# ----
# ROBOT
panel_3 = Panel("ee_link")

py3_4 = Python3Script(mobile_robot_data_path=py3_3.mobile_robot_data_path, ur_data_path=py3_3.ur_data_path, robot_type=list)  # -> loaders, urdf_filename, srdf_filename
# ---------- py3_4: Python ----------
import os
from compas_robots import RobotModel
from compas_robots.resources import LocalPackageMeshLoader

import compas_fab

#loaders

ur_path = os.path.join(ur_data_path, "robot_description")
ur_packages = ["ur_e_description"]
ur_loaders = [LocalPackageMeshLoader(ur_path, pck) for pck in ur_packages]

mobile_robot_path = os.path.join(mobile_robot_data_path, "robot_description", "rbvogui_xl_lift_ur10e")
mobile_robot_packages = ["rbvogui_description", "ewellix_description", "robotnik_sensors"]
mobile_robot_loaders = [LocalPackageMeshLoader(mobile_robot_path, pck) for pck in mobile_robot_packages]

loaders = ur_loaders + mobile_robot_loaders

#files
if robot_type == "rbvogui_xl_ur10e_indoor":
    urdf_filename = os.path.join(mobile_robot_path, r"rbvogui_xl_lift_ur10e_indoor.urdf")
elif robot_type == "rbvogui_xl_ur10e_outdoor":
    urdf_filename = os.path.join(mobile_robot_path, r"rbvogui_xl_lift_ur10e.urdf")
srdf_filename = os.path.join(mobile_robot_path, r"rbvogui.srdf")

assert os.path.isfile(urdf_filename)
assert os.path.isfile(srdf_filename)
# ---------- end py3_4 ----------
units = ValueList({"m": 1, "cm": 100, "mm": 1000}, selected="m")

# ----
# Load robot locally
load_2 = Button()
mobile_robot_2 = Python3Script(
    ros_client=ros.ros_client,
    loaders=py3_4.loaders,
    urdf_filename=py3_4.urdf_filename,
    srdf_filename=py3_4.srdf_filename,
    scale_factor=units,
    load=load_2)  # -> out, mobile_robot; inputs loaders: list
# ---------- mobile_robot_2: Python ----------
"""
Load robot directly from ROS.

COMPAS FAB v0.27.0
"""
from mobile_robot_control.mobile_robot import MobileRobot
from mobile_robot_control.mobile_robot_client import MobileRobotClient
import compas_robots.ghpython
import compas

# from ghpythonlib.componentbase import executingcomponent as component
from scriptcontext import sticky as st
import Rhino
import scriptcontext

scriptcontext.doc = Rhino.RhinoDoc.ActiveDoc

from compas_robots import RobotModel
from compas_robots.ghpython.scene import RobotModelObject
from compas_fab.robots import RobotSemantics
from compas.scene import SceneObject

scriptcontext.doc = ghdoc

compas.PRECISION = '12f'

key = 'robot_AA'


print(key)
if load:
    # Load URDF locally
    model = RobotModel.from_urdf_file(urdf_filename)
    model.load_geometry(*loaders)
    try:
        scene_object = SceneObject(item=model)
    except:
        scene_object = RobotModelObject(model)
    semantics = RobotSemantics.from_srdf_file(srdf_filename, model)
    mobile_robot = MobileRobot(model, scene_object, semantics, client=None)
    if ros_client is not None:
        mobile_robot.mobile_client = MobileRobotClient(ros_client)
        mobile_robot.client = ros_client
    st[key] = mobile_robot

mobile_robot = st.get(key, None)
# if mobile_robot:  # client sometimes need to be restarted, without needing to reload geometry
#     mobile_robot.mobile_client = MobileRobotClient(ros_client)
#     mobile_robot.client = ros_client
# ---------- end mobile_robot_2 ----------

robot = Data(mobile_robot_2.mobile_robot)
info = Python3Script(robot=robot)  # -> out, main_group_name
# ---------- info: Python ----------
if robot:
    robot.info()
    main_group_name = robot.main_group_name
# ---------- end info ----------
panel_4 = Panel(info.out)

# ----
# Attach tool
list_3 = ValueList({"measurement tool": 0, "area gripper": 1, "parallel gripper": 2, "camera": 3}, selected="area gripper")
show = BooleanToggle(False)
path_3 = Python3Script()  # -> DATA
# ---------- path_3: Python ----------
import os

package_path = ghdoc.Path
DATA = os.path.abspath(os.path.join(package_path,"../../data"))

print(package_path)
print(DATA)
# ---------- end path_3 ----------
tool = Python3Script(data_path=path_3, tool=list_3, show=show)  # -> tool, M, ee_plane; inputs data_path: String
# ---------- tool: Python ----------
import os, math
from compas.geometry import Frame, Rotation, Vector, Quaternion
from compas.datastructures import Mesh
from compas_rhino.conversions import mesh_to_rhino, frame_to_rhino_plane
from compas_fab.robots import Tool

tolerance = 0

if tool == 0:
    filename = 'measurement_tool_ur20_zaxis.stl'
    #ee_frame = Frame([0, 0, 0], [1, 0, 0], [0, 1, 0])
    ee_frame = Frame([0, 0, 0.122], [1, 0, 0], [0, 1, 0])

elif tool == 1:
    filename = 'vacuum_gripper_ur20_zaxis.stl'
    ee_frame = Frame([0, 0, 0.145 + tolerance], [1, 0, 0], [0, 1, 0])

elif tool == 2:
    filename = 'parallel_gripper_ur20_zaxis.stl'
    ee_frame = Frame([0, 0, 0.166 + tolerance], [0, -1, 0], [1, 0, 0])

# elif tool == 3:
#     filename = 'long_drill_parallel_gripper_ur20_zaxis.stl'
#     ee_frame = Frame([0.31, -0.063, 0.111], [0, 0, 1], [0, -1, 0]) #Frame([0.20543, -0.065, 0.109], [0, 0, 1], [0, -1, 0])
#     ee_frame = ee_frame.transformed(Rotation.from_axis_and_angle(ee_frame.zaxis, math.radians(0), ee_frame.point))
elif tool == 3:
    filename = 'parallel_gripper_ur20_zaxis.stl'
    #ee_frame = Frame.from_quaternion(Quaternion(0, 0, 0.707106, 0.707106), [0.0175, 0.0572, 0.0850])
    #ee_frame = Frame.from_quaternion(Quaternion(0, 0, 0.707106, 0.707106), [0.0325, 0.0572, 0.0830])
    # adjustments according to gt
    #ee_frame = Frame([0.05, 0.059, 0.0830], [-1, 0, 0], [0, 0, 1])
    ee_frame = Frame([-0.0327, 0.0572, 0.0815], [-1, 0, 0], [0, 0, 1])
    #ee_frame = Frame([0.04, 0.059, 0.0830], [-1, 0, 0], [0, 0, 1])

data_path = os.path.join(data_path, "tool_geometry")
fullfilename = os.path.join(data_path, filename)

ee_mesh = Mesh.from_stl(fullfilename)

if show:
    M = mesh_to_rhino(ee_mesh)

tool = Tool(ee_mesh, ee_frame)
ee_plane = frame_to_rhino_plane(ee_frame)
print(ee_frame.quaternion.xyzw)
ee_framek = Frame([0.0110607,0.00809854,0.41498], [0,1,0], [1,0,0])
print(ee_framek.quaternion.xyzw)
# ---------- end tool ----------
remove = Button()
attach = Button()
mesh = Mesh(tool.M)
attach_tool = Python3Script(robot=robot, tool=tool.tool, attach=Toggle(True), remove=remove)  # -> tool, M, ee_plane, bang
# ---------- attach_tool: Python ----------
print(robot.get_group_names_from_link_name("robot_arm_flange"))

if attach:
    for planning_group in robot.get_group_names_from_link_name("robot_arm_flange"):
        robot.attach_tool(tool, group=planning_group)

if remove:
    for planning_group in robot.get_group_names_from_link_name("robot_arm_flange"):
        robot.detach_tool(group=planning_group)
# ---------- end attach_tool ----------

# ----
# Move mobile robot base
list_4 = ValueList({"isaac_BCF": isaac, "origin", "set_to_BCF", "set_to_RCF"}, selected="origin")
angle = Slider(0, range=0..360)
origin = Point(Point(6.428165567, 2.953839469, 0))
plane = Python3Script(origin=origin, angle=angle)  # -> plane; inputs origin: Point3d
# ---------- plane: Python ----------
import Rhino.Geometry as rg
import math

plane = rg.Plane(origin, rg.Vector3d.XAxis, rg.Vector3d.YAxis)
plane.Rotate(math.radians(angle), rg.Vector3d.ZAxis)
# ---------- end plane ----------
set_frame = Python3Script(robot=robot, set_frame_to=list_4, target_BCF=plane, target_RCF=plane)  # -> bang; inputs target_BCF: Plane, target_RCF: Plane
# ---------- set_frame: Python ----------
from compas.geometry import Frame, Point, Vector, Transformation
from compas.datastructures import Mesh
from compas_fab.robots import CollisionMesh
from compas_rhino.conversions import plane_to_compas_frame

if set_frame_to == "set_to_BCF":
    BCF = plane_to_compas_frame(target_BCF)
elif set_frame_to == "set_to_RCF":
    RCF = plane_to_compas_frame(target_RCF)
    BCF = robot.transform_frame_from_RCF_to_BCF(RCF)
else:
    BCF = Frame.worldXY()

if robot and set_frame_to != "isaac_BCF":
    robot.BCF_slam = BCF
# ---------- end set_frame ----------

path_4 = Python3Script()  # -> out, DATA
# ---------- path_4: Python ----------
import os
import getpass

username = getpass.getuser()
USER_FOLDER = os.path.abspath(os.path.join("C:/Users/", username))
DATA = os.path.abspath(os.path.join(USER_FOLDER,"workspace/projects/spaicr/data/3rd_experiment/BCF_logs"))

print(USER_FOLDER)
print(DATA)
# ---------- end path_4 ----------
# Create snapshots
exportbcflogs = Python3Script(DATA=path_4.DATA, robot=robot, export=export)  # -> out
# ---------- exportbcflogs: Python ----------
import os
from compas.geometry import Frame

print(robot._frame_log)

if export:
    
    filename = "test_1.json"
    PATH = os.path.join(DATA, filename)
    
    robot.export_log(PATH)
# ---------- end exportbcflogs ----------

# ----
# Planning scene
scene = Python3Script(robot=robot)  # -> scene
# ---------- scene: Python ----------
"""
Create a planning scene.

COMPAS FAB v0.28.0
"""

from ghpythonlib.componentbase import executingcomponent as component
from scriptcontext import sticky as st

from compas_fab.robots import PlanningScene


class PlanningSceneComponent(component):
    def RunScript(self, robot):
        key = "planning_scene"
        if robot:
            st[key] = PlanningScene(robot)
        return st.get(key, None)
# ---------- end scene ----------

# ----
# Attach collision mesh to scene
append = Button()
remove_2 = Button()
add = Button()
mesh_object = Mesh(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)
mesh_table = Mesh(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)
collision_mesh = Python3Script(scene=scene, mesh=mesh_table, identifier="table", add=add, append=append, remove=remove_2)  # -> ok, bang; inputs mesh: Mesh, identifier: String
# ---------- collision_mesh: Python ----------
"""
Add or remove a collision mesh from the planning scene.
"""

from compas_rhino.conversions import mesh_to_compas
from compas_fab.robots import CollisionMesh

ok = False
Message = ""

if (add and append) or (append and remove) or (add and remove):
    Message = "Use only one operation at a time\n(add, append or remove)"
    raise Exception(Message)

if scene and mesh and identifier:
    compas_mesh = mesh_to_compas(mesh)
    collision_mesh = CollisionMesh(compas_mesh, identifier)
    if add:
        scene.add_collision_mesh(collision_mesh)
        Message = "Added"
        ok = True
    if append:
        scene.append_collision_mesh(collision_mesh)
        Message = "Appended"
        ok = True
    if remove:
        scene.remove_collision_mesh(identifier)
        Message = "Removed"
        ok = True
# ---------- end collision_mesh ----------
panel_5 = Panel(collision_mesh.ok)

# ----
# Attach collision mesh to robot
panel_6 = Panel("attached_brick")
remove_3 = Button()
add_2 = Button()
mesh_2 = Mesh(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)
attached_collision_mesh = Python3Script(scene=scene, mesh=mesh_2, identifier=panel_6, link_name=panel_3, touch_links=panel_3, add=add_2, remove=remove_3)  # -> out, attached_collision_mesh, bang; inputs mesh: Mesh
# ---------- attached_collision_mesh: Python ----------
"""
Add an attached collision mesh to the robot.

COMPAS FAB v0.28.0
"""

from compas_rhino.conversions import mesh_to_compas
from ghpythonlib.componentbase import executingcomponent as component

from compas_fab.robots import AttachedCollisionMesh
from compas_fab.robots import CollisionMesh

from compas_ghpython import create_id
import Rhino

class AttachedCollisionMeshComponent(component):
    def RunScript(self,
            scene,
            mesh: Rhino.Geometry.Mesh,
            identifier,
            link_name,
            touch_links,
            add,
            remove):
        attached_collision_mesh = None
        if scene and mesh and identifier and link_name:
            compas_mesh = mesh_to_compas(mesh)
            collision_mesh = CollisionMesh(compas_mesh, identifier)
            attached_collision_mesh = AttachedCollisionMesh(collision_mesh, link_name, touch_links)
            if add:
                scene.add_attached_collision_mesh(attached_collision_mesh)
                scene.attach_collision_mesh_to_robot_end_effector(collision_mesh, group="ur20_and_liftkit")
                scene.attach_collision_mesh_to_robot_end_effector(collision_mesh, group="ur20")
            if remove:
                scene.remove_attached_collision_mesh(identifier)
                scene.remove_collision_mesh(identifier)
        return attached_collision_mesh
# ---------- end attached_collision_mesh ----------
panel_7 = Panel(attached_collision_mesh.attached_collision_mesh)

# ----
# real robot values
unsubscribe = Button()
unsubscribe_2 = Button()
subscribe = Button()
subscribe_2 = Button()
get_isaac_joint_states = Python3Script(robot=robot, subscribe=subscribe, unsubscribe=unsubscribe)
# ---------- get_isaac_joint_states: Python ----------
def _receive_joint_states(message):
    print(message)
    for key, joint_name in enumerate(message.get("name")):
        robot.mobile_client.current_joint_values[joint_name] = message.get("position")[key]

def isaac_joint_states_subscribe(m):
    m.topic_subscribe(
        "/isaac_joint_states", "sensor_msgs/JointState", _receive_joint_states
    )

def isaac_joint_states_unsubscribe(m):
    m.topic_unsubscribe("/isaac_joint_states")

if subscribe:
    isaac_joint_states_subscribe(robot.mobile_client)

if unsubscribe:
    isaac_joint_states_unsubscribe(robot.mobile_client)
# ---------- end get_isaac_joint_states ----------
get_isaac_bcf = Python3Script(robot=robot, subscribe=subscribe_2, unsubscribe=unsubscribe_2)
# ---------- get_isaac_bcf: Python ----------
from compas.geometry import Point, Quaternion, Frame

def _receive_BCF(message):
    print(message)
    pose_point = Point(
            message["position"]["x"],
            message["position"]["y"],
            message["position"]["z"],
        )
    pose_quaternion = Quaternion(
        message["orientation"]["w"],
        message["orientation"]["x"],
        message["orientation"]["y"],
        message["orientation"]["z"],
    )
    BCF = Frame.from_quaternion(pose_quaternion, pose_point)
    robot.BCF = BCF

def isaac_BCF_subscribe(m):
    m.topic_subscribe(
        "/isaac_base_frame", "geometry_msgs/Pose", _receive_BCF
    )

def isaac_BCF_unsubscribe(m):
    m.topic_unsubscribe("/isaac_base_frame")

if subscribe:
    isaac_BCF_subscribe(robot.mobile_client)

if unsubscribe:
    isaac_BCF_unsubscribe(robot.mobile_client)

print(robot.BCF)

robot.mobile_client.topic_unsubscribe(
            "/robot/navigate_to_pose/_action/status")
{'position': {'x': -0.0001697540283203125, 'y': 0.025540828704833984, 'z': -2.2113323211669922e-05}, 'orientation': {'x': 3.620515724480997e-08, 'y': 9.80362316552591e-07, 'z': -1.5274385406631945e-05, 'w': 0.9999999998828654}}
# ---------- end get_isaac_bcf ----------
trigger = Trigger(Interval=5000, TimerInterval=5000, Target=draw)  # disabled
draw = Python3Script(robot=robot)  # -> configuration
# ---------- draw: Python ----------
from compas_robots import Configuration

configuration = robot.mobile_client.get_current_configuration()
print(configuration)
# ---------- end draw ----------

# ----
# Draw assembly
start = Button()
stop = Button()
step = Button()
back = Button()
reset = Button()
full = Button()
list_5 = ValueList({"20", "50", "100", "500", "1000", "5000"}, selected="500")
list_6 = ValueList({"show all": "show_all", "show until key": "show_until_key"}, selected="show all")
counter = Python3Script(
    my_assembly=transform_assembly.assembly,
    start=start,
    stop=stop,
    step=step,
    step_back=back,
    reset=reset,
    full=full,
    interval=list_5)  # -> out, counter
# ---------- counter: Python ----------
from scriptcontext import sticky as st
import Grasshopper

def update_component(ghenv, delay):
    """Schedule an update of the Grasshopper component.

    After the specified delay, the GH component will be automatically updated.

    Parameters
    ----------
    ghenv : :class:`GhPython.Component.PythonEnvironment`
        The current GHPython environment.
    delay : :obj:`int`
        Time in milliseconds until the update is performed.

    Raises
    ------
    ValueError
        If the delay is less than zero.

    """
    if delay <= 0:
        raise ValueError("Delay must be greater than zero")

    ghcomp = ghenv.Component
    ghdoc = ghcomp.OnPingDocument()

    def callback(ghdoc):
        if ghdoc.SolutionState != Grasshopper.Kernel.GH_ProcessStep.Process:
            ghcomp.ExpireSolution(False)

    ghdoc.ScheduleSolution(delay, Grasshopper.Kernel.GH_Document.GH_ScheduleDelegate(callback))

L = range(my_assembly.graph.number_of_nodes())

# store data in component
guid = str(ghenv.Component.InstanceGuid)
counter_key = "counter_" + guid
running_key = "running_" + guid

if counter_key not in st:
    st[counter_key] = 0

if running_key not in st:
    st[running_key] = False
    

if st[running_key]:
    if st[counter_key] < len(L) - 1:
        st[counter_key] += 1
        update_component(ghenv, interval)
    else:
        st[counter_key] = 0
        st[running_key] = False
    
if start:
    st[running_key] = True

if stop:
    st[running_key] = False

if step:
    if st[counter_key] < len(L) - 1:
        st[counter_key] += 1

if step_back:
    if st[counter_key] > 0:
        st[counter_key] -= 1

if reset:
    st[counter_key] = 0
    st[running_key] = False

if full:
    st[counter_key] = len(L)-1

if len(L):
    item = L[st[counter_key]]


#st["visualisation_counter"] = st[counter_key]
counter = st[counter_key] +1
# ---------- end counter ----------
visualize = Python3Script(
    assembly=transform_assembly.assembly,
    robot=robot,
    show=list_6,
    highlight_current_part=Toggle(False),
    show_connections=Toggle(False),
    counter=counter.counter)  # -> out, parts_built, parts_not_built, parts_frame, parts_keys, connections, connection_types, current_part_geometry, current_part_frame
# ---------- visualize: Python ----------
from compas_rhino.conversions import mesh_to_rhino, box_to_rhino, frame_to_rhino, line_to_rhino, point_to_rhino
from compas.geometry import Line, Transformation, Point, Vector, Frame, Translation

#print assembly
print(assembly)
#for p in assembly.parts():
#    layer = round(robot.from_RCF_to_BCF(p.frame).point.z/0.08)-1
#    assembly.graph.node_attribute(p.key, "layer", layer)

#get parts datastructure
parts_keys = [p for p in assembly.part_keys()]
parts = [assembly.part(p) for p in parts_keys]
parts_all = []
parts_built = []
parts_not_built = []
parts_frame = []

if show == "show_all":
    for key in parts_keys:
        p = assembly.part(key)
        p_frame = p.frame
        planned_frame = assembly.graph.node_attribute(key, "planned_frame")
        print(planned_frame)
        if assembly.graph.node_attribute(key, "built"):
            parts_built.append(mesh_to_rhino(p.mesh.transformed(Transformation.from_frame((p_frame)))))
        
        if planned_frame is not None:
            parts_not_built.append(mesh_to_rhino(p.mesh.transformed(Transformation.from_frame((planned_frame)))))

        parts_frame.append(frame_to_rhino(p_frame))
   
if show == "show_until_key":
    for p in parts[0:counter]:
        p_frame = p.frame
        
        if assembly.graph.node_attribute(p.key, "built"):
            parts_built.append(mesh_to_rhino(p.mesh.transformed(Transformation.from_frame((p_frame)))))
        else:
            parts_not_built.append(mesh_to_rhino(p.mesh.transformed(Transformation.from_frame((p_frame)))))

        parts_frame.append(frame_to_rhino(p_frame))

key = counter

if highlight_current_part:
    current_part = assembly.part(key)
    print(current_part.shape)
    current_part_geometry = mesh_to_rhino(current_part.mesh)
    current_part_frame = frame_to_rhino(current_part.frame)

if show_connections:
    connections = [line_to_rhino(Line(assembly.find_by_key(start).frame).point, robot.from_RCF_to_BCF(assembly.find_by_key(end).frame).point) for start, end in assembly.graph.edges()]
    connection_types = [assembly.graph.edge_attribute(t, "type") for t in assembly.graph.edges()]
    #extract points of the frame of the parts for visulization (+ converted to rhino point)
    parts_points = [point_to_rhino(p.frame.point) for p in assembly.parts()]
# ---------- end visualize ----------
panel_8 = Panel(visualize.out)
geo = Geometry(visualize.parts_built)
geo_2 = Geometry(visualize.parts_not_built)
geo_3 = Geometry(visualize.parts_frame)
line = Line(visualize.connections)
preview = CustomPreview(Geometry=geo, Material=ColourSwatch(SwatchColor=RGBA(252, 83, 83, 216)))
preview_2 = CustomPreview(Geometry=geo_2, Material=ColourSwatch(SwatchColor=RGBA(255, 138, 138, 137)))
preview_3 = CustomPreview(Geometry=geo_3, Material=ColourSwatch(SwatchColor=RGB(214, 166, 71)))
curve_preview = CustomCurvePreview(Curve=line, Linetype="Continuous", Colour=ColourSwatch(SwatchColor=RGB(255, 125, 157)))
py3_5 = Python3Script(planes=visualize.parts_frame, scale=Slider(0.1, range=0..1))  # -> P, V, C, W; inputs planes: list of Plane, scale: Double
# ---------- py3_5: Python ----------
from Rhino.Display import ColorRGBA
from ghpythonlib.components import ColourRGBf


red = ColourRGBf(255, 255, 0, 0)
green = ColourRGBf(255, 0, 255, 0)
blue = ColourRGBf(255, 0, 0, 255)

P = []
V = []
C = []

# scale = float(scale)

for plane in planes:
    if not plane:
        continue
    P += [plane.Origin] * 3
    V.append(plane.XAxis * scale)
    V.append(plane.YAxis * scale)
    V.append(plane.ZAxis * scale)
    C += [red, green, blue]

W = 3
# ---------- end py3_5 ----------
tag = TextTag(Location=visualize.parts_frame, Text=visualize.parts_keys)
vdisex = VectorDisplayEx(Point=py3_5.P, Vector=py3_5.V, Colour=py3_5.C, Width=py3_5.W)

panel_9 = Panel(counter.counter)

# ----
# Configuration
# zero configuration
zero = Python3Script(robot=robot, group=info.main_group_name)  # -> out, configuration; inputs group: String
# ---------- zero: Python ----------
configuration = robot.zero_configuration(group)
# ---------- end zero ----------

number_slider = Slider(0, range=0..40)

# ----
# forward kinematics
number_slider_2 = Slider(180, range=-400..400)
forward_kinematics = Python3Script(
    robot=robot,
    lift=number_slider,
    j1=Slider(0, range=-180..180),
    j2=Slider(-90, range=-360..360),
    j3=Slider(-90, range=-180..180),
    j4=Slider(-90, range=-400..400),
    j5=Slider(90, range=-125..120),
    j6=number_slider_2)  # -> configuration
# ---------- forward_kinematics: Python ----------
import math

from compas_robots.model import Joint
from compas_robots import Configuration


if robot:
    joint_types = robot.get_configurable_joint_types()
    joint_names = robot.get_configurable_joint_names()
    print(joint_names)
    joint_values = [j1, j2, j3, j4, j5, j6]
    for i, joint_value in enumerate(joint_values):
        joint_values[i] = math.radians(joint_values[i])
    
    if len(robot.get_configurable_joints()) == 6:
        configuration = Configuration(joint_values, joint_types, joint_names)
    else:
        configuration = Configuration.from_prismatic_and_revolute_values([lift], joint_values)
    print (configuration)
# ---------- end forward_kinematics ----------

subscribe_3 = Button()
unsubscribe_3 = Button()
send = Button()
send_2 = Button()
get_tf_frames = Python3Script(robot=robot, subscribe=subscribe_3, unsubscribe=unsubscribe_3)  # -> pose_frame
# ---------- get_tf_frames: Python ----------
from compas_fab.backends.ros.messages import Header

# header = Header()
# header = header.msg.copy()
# header.pop("seq", None)
# print(header)


from roslibpy import Service, ServiceRequest
from compas.geometry import Point, Frame, Quaternion
from scriptcontext import sticky as st


# if not hasattr(st, "pose_frame"):
#     st["pose_frame"] = None

def _receive_base_frame_callback(message):
    pose_point = Point(
        message["translation"]["x"],
        message["translation"]["y"],
        message["translation"]["z"],
    )
    pose_quaternion = Quaternion(
        message["rotation"]["w"],
        message["rotation"]["x"],
        message["rotation"]["y"],
        message["rotation"]["z"],
    )
    st["pose_frame"] = Frame.from_quaternion(pose_quaternion, pose_point)

if subscribe:
    robot.mobile_client.tf_subscribe(
                    "robot_base_footprint", #"base_camera_imu_frame",
                    "gt_world",
                    _receive_base_frame_callback,
                    timeout=5,
                )

pose_frame = st["pose_frame"]
print(pose_frame)

if unsubscribe:
    robot.mobile_client.tf_unsubscribe(
                    "robot_base_footprint", #"base_camera_imu_frame",
                    "gt_world",
                )
# ---------- end get_tf_frames ----------
send_joint_values = Python3Script(robot=robot, config=forward_kinematics, send=send)  # -> out
# ---------- send_joint_values: Python ----------
import roslibpy
import time

def configuration_to_joint_state_msg(config):
    msg = {
        'name': config.joint_names,
        'position': config.joint_values,
    }
    return msg

def publish_one_time_joint_state(client, config):
    publisher = roslibpy.Topic(client, '/isaac_joint_command', 'sensor_msgs/JointState')
    publisher.publish(configuration_to_joint_state_msg(config))
    print("Published one JointState message.")
    time.sleep(0.5)
    # publisher.unadvertise()

print(config)

if send:
    publish_one_time_joint_state(robot.client, config)


# joint_names = ['robot_ewellix_lift_top_joint',
#                 'robot_arm_shoulder_pan_joint', 
#                'robot_arm_shoulder_lift_joint', 
#                'robot_arm_elbow_joint', 
#                'robot_arm_wrist_1_joint', 
#                'robot_arm_wrist_2_joint', 
#                'robot_arm_wrist_3_joint']
# joint_positions = [0.2, 0.0, 0.0, 0.0, 0.0, 5.0, 0.0]

# msg = {
#     'name': joint_names,
#     'position': joint_positions,
# }
# ---------- end send_joint_values ----------
send_nav_action = Python3Script(robot=robot, send=send_2)  # -> out
# ---------- send_nav_action: Python ----------
import roslibpy
import time


# Create the NavigateToPose action client
action_client = roslibpy.ActionClient(
    robot.mobile_client.ros_client,
    '/robot/navigate_to_pose',
    'nav2_msgs/action/NavigateToPose'
)

print(action_client)
# Create the goal message (same structure as the ROS 2 CLI)
goal = roslibpy.Goal(
    {
        'pose': {
            'header': {
                'frame_id': 'robot_map'
            },
            'pose': {
                'position': {'x': 3.0, 'y': 0.0, 'z': 0.0},
                'orientation': {'x': 0.0, 'y': 0.0, 'z': 0.0, 'w': 1.0}
            }
        }
    }
)

def result_callback(msg):
    print("Action result:" + msg)

def feedback_callback(msg):
    print(f"Action feedback: {msg['sequence']}")

def fail_callback(msg):
    print(f"Action failed: {msg}")

# goal_msg.on('feedback', feedback_callback)

if send:
    print('Sending goal...')
    action_client.send_goal(goal, result_callback, feedback_callback, fail_callback)

# # Wait for result (non-blocking versions also possible)
# result = goal_msg.wait(timeout=60)
# print('Result:', result)
# ---------- end send_nav_action ----------
panel_10 = Panel(send_nav_action)
panel_11 = Panel(send_joint_values)
panel_12 = Panel(get_tf_frames)

pln = Plane(visualize.current_part_frame)

# ----
# analytical inverse kinematics
select_configuration = Slider(0, range=0..7)
plane_2 = Plane(Plane(origin=(0.2794500436, -1, 1.304479339), x=(-1, 0, 0), y=(0, 1, 0)))
analytic_inverse = Python3Script(robot=robot, lift=number_slider, plane=plane_2, idx=select_configuration)  # -> out, configuration; inputs plane: Plane, idx: Int32
# ---------- analytic_inverse: Python ----------
import Rhino.Geometry as rg
import math
from compas.geometry import Frame, Transformation, Rotation
from compas_robots import Configuration
from ur_fabrication_control.kinematics.ur_kinematics import inverse_kinematics
from ur_fabrication_control.kinematics.ur_params import ur_params
from compas_rhino.conversions import plane_to_compas_frame

# transform frame to robot coordinate system
frame_WCF = plane_to_compas_frame(plane)
frame_RCF = robot.from_WCF_to_RCF(frame_WCF)

if robot.attached_tool:
    tool0_RCF = robot.from_tcf_to_t0cf([frame_RCF])[0]
else:
    tool0_RCF = frame_RCF

# calculate solutions to frame
if "ur10e" in robot.main_group_name:
    ur_params = ur_params["ur10e"] # get the parameters according to the robot model
else:
    ur_params = ur_params["ur20"]

# print ur_params
solutions = inverse_kinematics(tool0_RCF, ur_params)
# print solutions

if not len(solutions):
    joint_values = [0, 0, 0, 0, 0, 0]
else:
    joint_values = solutions[idx]

if len(robot.get_configurable_joints()) == 6:
    configuration = Configuration.from_revolute_values(joint_values)
else:
    configuration = Configuration.from_prismatic_and_revolute_values([lift], joint_values)

print(configuration)
# ---------- end analytic_inverse ----------

# ----
# inverse kinematics
list_7 = ValueList({"ur20", "ur20_and_liftkit"}, selected="ur20")
compute = Button()
inverse = Python3Script(robot=robot, plane=plane_2, start_configuration=forward_kinematics, group=list_7, compute=compute)  # -> out, configuration
# ---------- inverse: Python ----------
"""
Calculate the robot's inverse kinematic for a given plane.

COMPAS FAB v1.0.2
"""
from compas_robots import Configuration
from compas_rhino.conversions import plane_to_compas_frame
from ghpythonlib.componentbase import executingcomponent as component
from scriptcontext import sticky as st



class InverseKinematics(component):
    def RunScript(self, robot, plane, start_configuration, group, compute):

        key = "inverse_solution"
        configuration = None
        if robot and robot.client and robot.client.is_connected and plane and compute:
            frame = plane_to_compas_frame(plane)
            configuration = robot.inverse_kinematics(frame, start_configuration, group)
            st["inverse_solution"] = configuration
        configuration = st.get("inverse_solution", None)
        print(configuration)
        return configuration
# ---------- end inverse ----------

# ----
# Assembly Model
toggle_2 = GroupToggle(ToggleActive=True, ToggleVisible=False)  # disabled

pln_2 = Plane(Plane(origin=(11.21134803, 6.925148859, 0.7795980044), x=(-0.5191097353, -0.6769932714, 0.5217328753), y=(-0.7928678674, 0.6093907633, 0.001855389413)))
list_8 = ValueList({"0 zero_configuration": 0, "1 forward_kinematics": 1, "2 analytic_inverse_kinematics": 2, "3 inverse_kinematics": 3, "4 motion_planning": 4, "5 real_configuration": 5, "6 assembly": 6}, selected="2 analytic_inverse_kinematics")
show_robot_collision = BooleanToggle(False)
show_rcf = BooleanToggle(True)

# ----
# State viewer
trigger_2 = Trigger(Interval=1000, TimerInterval=1000, Target=fabrication_state)
fabrication_state = Python3Script()  # -> out, state, num_tasks, num_current_task, num_tasks_left, log_messages
# ---------- fabrication_state: Python ----------
from scriptcontext import sticky as st

fabrication = st["fabrication"]

if hasattr(fabrication, "task_thread"):
    if fabrication.task_thread.is_alive():
        state = "THREAD RUNNING"
    else:
        state = "THREAD STOPPED"
print(fabrication.current_task_key)
num_tasks = len(fabrication.tasks)
if fabrication.current_task_key is not None:
    num_current_task = fabrication.current_task_key-1
else:
    num_current_task = 0

num_tasks_left = num_tasks-num_current_task
log_messages = fabrication.log_messages

# assembly = st["assembly"]
# ---------- end fabrication_state ----------
state = Panel(fabrication_state.state)
num_tasks = Panel(fabrication_state.num_tasks)
num_current_task = Panel(fabrication_state.num_current_task)
num_tasks_left = Panel(fabrication_state.num_tasks_left)

list_9 = ValueList({"0 scene": 0, "1 object": 1}, selected="0 scene")

# ----
# Fabrication manager
init = Button()
fabrication = Python3Script(init=init)  # -> fabrication
# ---------- fabrication: Python ----------
from scriptcontext import sticky as st
from fabrication_manager.fabrication import FabricationManager
from assembly_information_model.assembly import Assembly
import os

server_ip = st["server_ip"]
server_port = st["server_port"]

if init_:
    path = os.path.abspath(os.path.join(ghdoc.Path,"../../data/2nd_experiment/fabrication_logs"))
    print(path)
    fabrication = FabricationManager((server_ip, server_port))
    fabrication.path = path
    st["fabrication"] = fabrication

fabrication = st["fabrication"]
# ---------- end fabrication ----------
set_tasks = Button()
next_task = Button()
reset_task = Button()
prev_task = Button()
reset_2 = Button()
start_fabrication = Button()
stop_fabrication = Button()
panel_13 = Panel(fabrication_state.log_messages)

generate_tasks = Python3Script(fabrication=fabrication, robot=robot, plane_WCF=pln_2)  # -> out, tasks, target_planes
# ---------- generate_tasks: Python ----------
import roslibpy
import time
from fabrication_manager.task import Task
from compas_robots import Configuration
from compas.geometry import Translation, Rotation, Frame, Box, Transformation, Point, Quaternion, Vector, distance_point_point
from compas.datastructures import Mesh
from compas_rhino.conversions import plane_to_compas_frame, frame_to_rhino_plane
import numpy as np
import math
from assembly_information_model import Part
import open3d
import random
from scipy.spatial.transform import Rotation as R
from mobile_robot_control.pointcloud_processing.icp import preprocess_point_cloud_icp, evaluate_local_registration, execute_icp_local_registration

from mobile_robot_control import MotionPlanExecutePose

target_planes = []

target_frame = plane_to_compas_frame(plane_WCF)
tasks = [MotionPlanExecutePose(robot, target_frame=target_frame, frame_in_WCF=True)]
target_planes.append(frame_to_rhino_plane(target_frame))
# ---------- end generate_tasks ----------
pln_3 = Plane(generate_tasks.target_planes)

fabrication_manager = Python3Script(
    tasks=generate_tasks.tasks,
    fabrication=fabrication,
    set_tasks=set_tasks,
    start=start_fabrication,
    stop=stop_fabrication,
    reset=reset_2,
    next_task=next_task,
    reset_task=reset_task,
    prev_task=prev_task)  # -> out, server; inputs tasks: list
# ---------- fabrication_manager: Python ----------
def task_state_set(state, t):
    t.is_completed = state
    t.is_running = False
    
if set_tasks:
    print("setting tasks")   
    fabrication.clear_tasks()
    fabrication.set_tasks(tasks)

if start:
    #if robot.is_connected(): #and arduino.is_connected():
    print("starting process")
    fabrication.start()

if stop:
    print("stopping process")
    fabrication.stop()
    
if reset:
    print("resetting process")
    fabrication.reset()

if next_task:
    t = fabrication.get_next_task()
    task_state_set(True, t)
    
if reset_task:
    t = fabrication.get_next_task()
    task_state_set(False, t)

if prev_task:
    t = fabrication.get_next_task()
    task_state_set(False, t)
    t = fabrication.tasks[fabrication.current_task_key-1]
    task_state_set(False, t)
    fabrication.get_next_task()
# ---------- end fabrication_manager ----------

# ----
# Visualisation
filter = StreamFilter(
    Gate=list_8,
    Stream0=zero.configuration,
    Stream1=forward_kinematics,
    Stream2=analytic_inverse.configuration,
    Stream3=inverse.configuration,
    Stream5=draw)
show_collision = BooleanToggle(False)
show_eef = BooleanToggle(False)
show_frames = BooleanToggle(False)
show_visual = BooleanToggle(True)
show_attached_collision = BooleanToggle(False)
show_bcf = BooleanToggle(True)
visualise = Python3Script(
    robot=robot,
    configuration=filter,
    show_frames=show_frames,
    show_visual_meshes=show_visual,
    show_robot_collision_meshes=show_robot_collision,
    show_collision_meshes=show_collision,
    show_attached_collision_meshes=show_attached_collision,
    show_BCF=show_bcf,
    show_RCF=show_rcf,
    show_EEF=show_eef,
    bang=[set_frame, attach_tool.bang, collision_mesh.bang, attached_collision_mesh.bang])  # -> out, joint_planes, visual_meshes, robot_collision_meshes, collision_meshes, attached_meshes, BCF, RCF, EEF, EEF_in_RCF; inputs bang: list
# ---------- visualise: Python ----------
from scriptcontext import sticky as st
import time
from compas_ghpython import create_id
from compas.geometry import Frame
from compas.geometry import Transformation
from compas_rhino.conversions import frame_to_rhino, mesh_to_compas, mesh_to_rhino, frame_to_rhino_plane
from compas.scene import SceneObject
from compas_fab.robots import PlanningScene
import Rhino.Geometry as rg
import ghpythonlib.components as ghcomp

robot.update(configuration)
print(configuration)

if show_visual_meshes == True:
    visual_meshes = robot.draw_visual()
    # orient the robot to its base plane:
    robot_BCF = frame_to_rhino_plane(robot.BCF) 
    init_robot_plane = rg.Plane.WorldXY
    #visual_meshes = ghcomp.Orient(visual_meshes, init_robot_plane, robot_BCF)[0]

if show_frames == True: 
    joint_frames = robot.model.transformed_frames(configuration)
    joint_planes = [frame_to_rhino(a) for a in joint_frames]

if show_BCF:
    BCF = frame_to_rhino(robot.BCF)

if show_RCF:
    RCF = frame_to_rhino(robot.from_BCF_to_WCF(robot.RCF))

if show_EEF:
    # EEF_in_RCF = frame_to_rhino(robot.from_BCF_to_RCF(robot.forward_kinematics(
    #     configuration, options=dict())))
    EEF = frame_to_rhino(robot.from_BCF_to_WCF(robot.forward_kinematics(
        configuration, options=dict())))
    print(EEF)


if show_robot_collision_meshes == True:
    robot_collision_meshes = robot.draw_collision()

cached_scene_key = "cached_scene"

if show_collision_meshes or show_attached_collision_meshes:
    cached_scene = st.get(cached_scene_key)
    if not cached_scene:
        cached_scene = {"time": 0}

    update_scene = True

    if update_scene:
        scene = PlanningScene(robot)
        scene = robot.client.get_planning_scene()

    if update_scene and show_collision_meshes:
        collision_meshes = []

        for co in scene.world.collision_objects:
            print(co)
            header = co.header
            frame_id = header.frame_id
            cms = co.to_collision_meshes()

            for cm in cms:
                if cm.frame != Frame.worldXY():
                    t = Transformation.from_frame(cm.frame)
                    mesh = cm.mesh.transformed(t)
                else:
                    mesh = cm.mesh
                collision_meshes.extend(SceneObject(item=mesh).draw())

        cached_scene["cm"] = collision_meshes

        collision_meshes = cached_scene.get("cm", [])

    if update_scene and show_attached_collision_meshes:
        attached_meshes = []

        for aco in scene.robot_state.attached_collision_objects:
            for acm in aco.to_attached_collision_meshes():
                print(acm)
                frame_id = aco.object["header"]["frame_id"]
                frame = robot.forward_kinematics(configuration, options=dict(link=frame_id))
                t = Transformation.from_frame(frame)

                # Local CM frame
                if acm.collision_mesh.frame and acm.collision_mesh.frame != Frame.worldXY():
                    t = t * Transformation.from_frame(acm.collision_mesh.frame)

                mesh = acm.collision_mesh.mesh.transformed(t)

                attached_meshes.extend(SceneObject(item=mesh).draw())

        cached_scene["acm"] = attached_meshes

        attached_meshes = cached_scene.get("acm", [])
    
    cached_scene["time"] = time.time()
    st[cached_scene_key] = cached_scene
# ---------- end visualise ----------
pln_4 = Plane(visualise.joint_planes)
mesh_3 = Mesh(visualise.collision_meshes)
mesh_4 = Mesh(visualise.visual_meshes)
py3_6 = Python3Script(planes=[visualise.EEF, visualise.BCF, visualise.RCF], scale=Slider(0.2, range=0..1))  # -> P, V, C, W; inputs planes: list of Plane, scale: Double; same code as py3_5
orient = Orient(Geometry=mesh_4, Source=PlaneXY(0, 0, 0), Target=visualise.BCF)  # -> Geometry, Transform
vdisex_2 = VectorDisplayEx(Point=py3_6.P, Vector=py3_6.V, Colour=py3_6.C, Width=py3_6.W)

mesh_5 = Mesh(visualise.robot_collision_meshes)
mesh_6 = Mesh(visualise.attached_meshes)
eef_in_rcf = Plane(visualise.EEF_in_RCF)
eef = Plane(visualise.EEF)
mcol = MeshColours(Mesh=orient.Geometry, Colours=ColourSwatch(SwatchColor=RGB(160, 147, 199)))
mcol_2 = MeshColours(Mesh=orient.Geometry, Colours=ColourSwatch(SwatchColor=RGB(212, 140, 140)))
filter_2 = StreamFilter(Gate=list_9, Stream0=mcol, Stream1=mcol_2)

preview_4 = CustomPreview(Geometry=filter_2, Material=ColourSwatch(SwatchColor=RGB(61, 61, 61)))
