# Grasshopper definition r8_102_mobile_robot_localisation_marker.ghx (Grasshopper 1.0.8)
# plug-ins: RhinoCodePluginGH, MetaHopper

path = FilePath("C:\Users\gido\Documents\workspace\mobile_robot_control\data\measurements\marker_measurements.json")
path_2 = FilePath("C:\Users\gido\Documents\workspace\mobile_robot_control\data\measurements\marker_measurements.json")
pln = Plane([Plane(origin=(-0.1624096597, -0.004368398101, 0.9319200485), x=(-0.04728609483, -0.1483750393, 0.9878000167), y=(-0.0009921318334, -0.9888987558, -0.1485875717)), Plane(origin=(-0.199696539, -0.004556349071, 0.9107181727), x=(-0.1010550555, -0.3082947758, 0.9459081388), y=(0.01535435963, -0.9511453724, -0.3083613532)), Plane(origin=(-0.2411366476, -0.004666639408, 0.9088954163), x=(-0.4349817246, 0.229468821, 0.8707094575), y=(0.03089294074, -0.962610533, 0.269121883)), Plane(origin=(-0.2782315899, -0.005462200543, 0.89321022), x=(-0.1191385544, -0.3569530414, 0.9264936757), y=(0.01502981691, -0.9336812894, -0.3577895392)), Plane(origin=(-0.3194518722, -0.005660550209, 0.891162522), x=(-0.03211316166, -0.1998127865, 0.9793077122), y=(-9.092614403e-05, -0.9798124731, -0.1999187569)), Plane(origin=(-0.1611425808, -0.04412375245, 0.9288819823), x=(0.06792542887, -0.1265434024, 0.9896327114), y=(0.003337260925, -0.9918892896, -0.1270610086))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])
path_3 = FilePath("C:\Users\gido\Documents\workspace\mobile_robot_control\data\measurements\marker_references.json")
path_4 = FilePath(path_2)

# ----
# Robot Model
py3 = Python3Script()  # -> HERE, DATA, ROBOT_DESCRIPTION
# ---------- py3: Python ----------
import os

HERE = os.path.dirname(ghdoc.Path)
DATA = os.path.abspath(os.path.join(HERE, "..", "data"))
ROBOT_DESCRIPTION = os.path.abspath(os.path.join(DATA, "robot_description"))

print(HERE)
print(DATA)
print(ROBOT_DESCRIPTION)
# ---------- end py3 ----------
py3_2 = Python3Script(reload=Toggle(True))  # -> out
# ---------- py3_2: Python ----------
if reload:
    from compas_rhino import unload_modules
    unload_modules("fabrication_manager")
    unload_modules("am_information_model")
    unload_modules('mobile_robot_control')
    unload_modules('mobile_part_based_am')
    unload_modules('ur_fabrication_control')
# ---------- end py3_2 ----------

save_to_file = Button()
reference_points = Point([<point referenced from the Rhino model> x5])
filepath = FilePath("C:\Users\gido\Documents\workspace\mobile_robot_control\data\measurements\point_references.ply")

load = Button()

trigger = Trigger(Interval=10, TimerInterval=10, Target=py3_2)
py3_3 = Python3Script(filepath=path_4, load=Toggle(True))  # -> out, markerset, planes; inputs filepath: String
# ---------- py3_3: Python ----------
import json
from compas.geometry import Frame
from compas_rhino.conversions import frame_to_rhino
from mobile_robot_control.markers import MarkerSet

with open(filepath, 'r') as f:
    data = json.load(f)

frames = []
markerset = MarkerSet("aruco")
for key, marker_data in data["markers"].items():
    # print(marker_data.keys())
    opt = marker_data["optimized"]
    t = opt.get("position")
    # print(t)
    q = opt.get("orientation")
    # print(q)
    frame = Frame.from_quaternion(
        quaternion = q,
        point = t
    )
    frames.append(frame)
    markerset.add_marker(key, t, q)
print(markerset.markers)
planes = [frame_to_rhino(f) for f in frames]
# ---------- end py3_3 ----------
panel = Panel(py3_2)

points_to_pcd = Python3Script(points=reference_points, filepath=filepath, write=save_to_file)  # -> out, pcd; inputs points: list of Point3d
# ---------- points_to_pcd: Python ----------
import open3d

array = [[x,y,z] for x, y, z in iter(points)]
pcd = open3d.geometry.PointCloud()
pcd.points = open3d.utility.Vector3dVector(array)
pcd.voxel_down_sample(0.0001)


if write:
    open3d.io.write_point_cloud(filepath, pcd, write_ascii=True)
    print("file written to ", str(filepath))
# ---------- end points_to_pcd ----------
reference_target = Data(points_to_pcd.pcd)

update = Button()
list = ValueList({"extruder", "camera", "scanner"}, selected="scanner")

# ----
# IP Settings
# --> Set your IP address
# --> Set robot IP address
server_ip = ValueList({"192.168.0.42", "192.168.10.12", "192.168.10.11", "192.168.10.10", "192.168.10.2", "127.0.0.1", "192.168.10.111", "192.168.0.250", "192.168.0.30", "10.42.0.212", "10.42.0.133"}, selected="192.168.0.42")
server_port = ValueList({"50002", "50003", "50005", "50006", "50007", "50008", "50009", "50010", "50011", "50012", "50013", "50014", "50015", "50016", "50017", "50018", "50019", "50020", "50021", "50022", "50023", "50024", "50025", "50026", "50027", "50028"}, selected="50015")
ur_ip = ValueList({"192.168.10.10", "192.168.10.20", "192.168.10.11", "192.168.10.12", "127.0.0.1", "192.168.10.111", "192.168.0.210", "192.168.0.211", "192.168.0.30"}, selected="192.168.0.210")
ur_port = ValueList({"30002"}, selected="30002")
globals = Python3Script(server_ip=server_ip, server_port=server_port, ur_ip=ur_ip, ur_port=ur_port, clear=Button())  # inputs server_ip: String, server_port: Int32, ur_ip: String, ur_port: Int32
# ---------- globals: Python ----------
from scriptcontext import sticky as st

st["server_ip"] = server_ip
st["server_port"] = server_port

st["ur_ip"] = ur_ip
st["ur_port"] = ur_port


if clear:
    st.clear()
# ---------- end globals ----------

# ----
# Check if UR robot
#  is available
ping = Button()
py3_4 = Python3Script(ip=ur_ip, ping=ping)  # -> out; inputs ip: String
# ---------- py3_4: Python ----------
from scriptcontext import sticky as st
from ur_fabrication_control.direct_control.utilities import is_available

guid = str(ghenv.Component.InstanceGuid)
txt_key = "txt_" + guid
if txt_key not in st:
    st[txt_key] = ""

if ping:
    
    available = is_available(ip)
    
    if available:
        st[txt_key] = "%s is up!" % ip
        trigger = True
    else:
        st[txt_key] = "%s is down!" % ip
        trigger = False

print(st[txt_key])
# ---------- end py3_4 ----------
panel_2 = Panel(py3_4)

# ----
# ROBOT AA
# Move mobile robot base
base_origin = Point(Point(-0.02786180272, -1.464113888, 0))
angle = Slider(90, range=0..360)
worldxy = BooleanToggle(False)

list_2 = ValueList({"custom": =, "from_reach": 1, "from_realsense": 2, "from_baumer": 3}, selected="from_baumer")
pln_2 = Plane()
pln_3 = Plane()
pln_4 = Plane()
wiredisplay = ControlWireDisplay(WireDisplay="1", AllObjects_Object=pln_7)
wiredisplay_2 = ControlWireDisplay(WireDisplay="2", AllObjects_Object=[py3_10, toggle_2, number_slider_4])
number_slider = Slider(0.1, range=0..0.1)

# ----
# ROS client
list_3 = ValueList({"local": "127.0.0.1", "linux computer": "192.168.0.99", "linux eduroam": "10.181.95.254", "linux ccnet": "192.168.0.102", "linux vmware": "192.168.199.36", "robot": "192.168.0.200"}, selected="local")
connect = BooleanToggle(True)

ros = Python3Script(ip=list_3, port="9090", connect=connect)  # -> out, ros_client, is_connected; inputs ip: String, port: Int32, connect: Boolean
# ---------- ros: Python ----------
"""
Connect or disconnect to ROS.

COMPAS FAB v0.27.0
"""
from scriptcontext import sticky as st

from compas_fab.backends import RosClient

ros_client = None

ip = ip or '127.0.0.1'
port = port or 9090
key = "ros_client_001"
ros_client = st.get(key, None)

if ros_client:
    st[key].close()
if connect:
    st[key] = RosClient(ip, port)
    st[key].run(1)

ros_client = st.get(key, None)
is_connected = ros_client.is_connected if ros_client else False
# ---------- end ros ----------
py3_5 = Python3Script(ros_client=ros.ros_client, filepath=path, get=Button())  # -> out, tf_frames, tf_planes
# ---------- py3_5: Python ----------
import json
import roslibpy
import time
import traceback
from multiprocessing import Queue

markers = dict()

# 3) subscribe to /tf
def tf_cb(message):
    for tf in message['transforms']:
        frame_id = tf['child_frame_id']
        if frame_id.startswith('marker_'):
            # Get marker id from frame_id
            marker_id = frame_id.split('_')[-1]

            # Extract translation and rotation            
            pt = tf['transform']['translation']
            q = tf['transform']['rotation']
            
            global markers
            # Store the frame in the markers dictionary
            markers[frame_id] = {
                "stamp": tf['header']['stamp'],
                "translation": pt,
                "rotation": q
            }

            print(f"[{time.time():.3f}] Detected marker {marker_id}")

def save_markers():
    """Save markers to file safely."""
    try:
        # Create a serializable copy
        serializable_markers = {}
        for k, v in markers.items():
            serializable_markers[k] = v
            
        with open(filepath, 'w') as f:
            json.dump(serializable_markers, f, indent=2)
        return True
    except Exception as e:
        print(f"Error saving markers: {e}")
        traceback.print_exc()
        return False

if get:
    t0 = time.time()
    try:
        tf_topic = roslibpy.Topic(ros_client, '/tf', 'tf2_msgs/TFMessage')
        tf_topic.subscribe(tf_cb)
        print(markers)

        while time.time() -t0 < 3:
            save_markers()
            time.sleep(0.1)
    except Exception as e:
        print(f"Unexpected error: {e}")
    finally:
        # Clean up and save data
        print("Cleaning up...")
        tf_topic.unsubscribe()
        if save_markers():
            print(f"✅ Successfully saved {len(markers)} marker detections to {filepath}")
        else:
            print("❌ Failed to save marker data")
# ---------- end py3_5 ----------
py3_6 = Python3Script(ros_client=ros.ros_client, get=Button())  # -> out, tf_frames, tf_planes
# ---------- py3_6: Python ----------
from compas.geometry import Point, Quaternion, Frame
from compas_rhino.conversions import frame_to_rhino
from roslibpy import tf 

import time
tf_frames = {}


tf_client = tf.TFClient(
        ros_client,
        fixed_frame="camera_color_optical_frame",
        angular_threshold=0.0,
        rate=10.0,
    )

def tf_subscribe(target_frame, reference_frame, callback, timeout):
    tf_client.subscribe(target_frame, callback)
    # time.sleep(1)
    # tf_client.unsubscribe(target_frame, callback)

def msg_to_frame(message):
    # print(message)
    pose_point = Point(
        message["translation"]["x"],
        message["translation"]["y"],
        message["translation"]["z"],
    )
    pose_quaternion = Quaternion(
        message["rotation"]["w"],
        message["rotation"]["x"],
        message["rotation"]["y"],
        message["rotation"]["z"],
    )
    pose_frame = Frame.from_quaternion(pose_quaternion, pose_point)
    # tf_frames[key] = pose_frame
    return pose_frame
    # except ValueError:
    #     print(f"ValueError on marker {key}")
    #     return None


def run_markers_tf():
    callbacks = [lambda msg : print([f"marker_{i}", msg]) for i in range(35)]
    for key in range(35):
        marker_name = f"marker_{key}"
        
        def add_to_list(message):
            frame = msg_to_frame(message)
            tf_frames[key] = frame

        name = f"marker_{key}"
        
        # callback = lambda msg : tf_frames.append({name: msg})
        # callback = lambda msg : print([name, msg])
        tf_client.subscribe(marker_name, add_to_list)
        time.sleep(0.1)
    
    def dispose_server():
        tf_client.dispose()
    
    ros_client.call_later(1, dispose_server)
        
run_markers_tf()
time.sleep(2)
tf_planes = [0]*35

for key, value in tf_frames.items():
    tf_planes[key] = frame_to_rhino(value)
# ---------- end py3_6 ----------

panel_3 = Panel(ros.is_connected)

rec = DataRecorder(py3_5.out, DataLimit=-10, RecordData=True)
panel_4 = Panel(rec)
cull = CullPattern(List=py3_6.tf_planes, CullPattern=py3_6.tf_planes)
py3_7 = Python3Script(
    ros_client=ros.ros_client,
    create=Button(),
    duration=Slider(0, range=0..10),
    filepath=path_2,
    start=Button(),
    stop=Button(),
    get_state=Button())  # -> out, start_time, end_time, is_recording, markers, tf_frames, tf_planes
# ---------- py3_7: Python ----------
import json
import roslibpy
import time
import traceback
import datetime
from multiprocessing import Queue
from scriptcontext import sticky as st


from mobile_robot_control.marker_utilities import MarkerRecorder

if "marker_recorder" not in st or create:
    markerrecorder = MarkerRecorder(ros_client, duration, output=filepath)
    st["marker_recorder"] = markerrecorder
else:
    markerrecorder = st["marker_recorder"]


start_time = time.strftime("%H:%m:%S", time.localtime(markerrecorder.start_time))
end_time = time.strftime("%H:%m:%S", time.localtime(markerrecorder.end_time))
is_recording = markerrecorder.is_recording
markers = markerrecorder.markers
markerrecorder.duration = duration

if start:
    if duration == 0:
        markerrecorder.duration_limited = False
    else:
        markerrecorder.duration_limited = True
    markerrecorder.start_recording()

if stop:
    markerrecorder.stop_recording()
# ---------- end py3_7 ----------
pln_5 = Plane(cull)
item = ListItem(List=py3_6.tf_planes, Index=Slider(34, range=0..34), Wrap=True)
panel_5 = Panel(py3_7.start_time)
panel_6 = Panel(py3_7.end_time)
panel_7 = Panel(py3_7.is_recording)

# ----
# Attach tool
list_4 = ValueList({"measurement_tool": 0, "earth_extruder_v1": 1, "earth_extruder_v1_16mm_10deg": 2, "earth_extruder_v1_10mm_15deg": 3, "earth_extruder_v3_pbam": 4, "earth_extruder_v3_16mm_15deg_pbam": 5, "earth_extruder_v3_16mm_15deg_pbam_rotleft": 6, "earth_extruder_v3_16mm_15deg_pbam_rotright": 7}, selected="earth_extruder_v3_16mm_15deg_pbam")
multitool = BooleanToggle(True)
show = BooleanToggle(True)
list_5 = ValueList({"extruder", "camera", "scanner"}, selected="extruder")
path_5 = Python3Script()  # -> DATA
# ---------- path_5: Python ----------
import os

package_path = ghdoc.Path
DATA = os.path.abspath(os.path.join(package_path,"../../data"))

print(package_path)
print(DATA)
# ---------- end path_5 ----------
tool = Python3Script(data_path=path_5, tool=list_4, tool_frame=list_5, multitool=multitool, show=show)  # -> tool, M, ee_plane, camera_plane, scanner_plane; inputs tool: Int32
# ---------- tool: Python ----------
import os, math
from compas.geometry import Frame, Rotation, Vector
from compas.datastructures import Mesh
from compas_rhino.conversions import mesh_to_rhino, frame_to_rhino_plane
from compas_fab.robots import Tool
from mobile_part_based_am.multitool import MultiTool

tolerance = 0

if tool == 0:
    filename = 'measurement_tool.stl'
    ee_frame = Frame([0, 0, 0.109], [1, 0, 0], [0, 1, 0])

elif tool == 1:
    filename = 'earth_extruder_v1.stl'
    ee_frame = Frame([-0.0000131542, -0.335947, 0.101034,], [1, 0, 0], [0, 0, 1])

elif tool == 2:
    filename = 'earth_extruder_v1_16mm_10deg.stl'
    vec = Vector.from_start_end([-0,-0.347721,0.100031], [7.5868e-05,-0.349791,0.107758])
    ee_frame = Frame([-0,-0.347721,0.100031], [1, 0, 0], vec)

elif tool == 3:
    filename = 'earth_extruder_v1_10mm_15deg.stl'
    vec = Vector.from_start_end([6.09775e-10,-0.418261,0.121892], [6.09777e-10,-0.419581,0.126818])
    ee_frame = Frame([6.09775e-10,-0.413432,0.123186], [1, 0, 0], vec)

elif tool == 4:
    filename = 'earth_extruder_v3_pbam_small.stl'
    # vec = Vector.from_start_end([6.09775e-10,-0.418261,0.121892], [6.09777e-10,-0.419581,0.126818])
    extruder_frame = Frame([-0.070, -0.405, 0.083], [1, 0, 0], [0,0,1])
    ros_camera_frame = Frame([0.007, -0.2368, 0.118], [0,-1,0], [1,0,0])
    camera_frame = Frame([0.007, -0.2368, 0.118], [1,0,0], [0,0,1])
    ros_scanner_frame = Frame([-0.017, -0.501, 0.083], [0,0,1], [1,0,0])
    scanner_frame = Frame([-0.017, -0.455, 0.083], [1,0,0], [0,0,1])
    tool_frames = {"extruder": extruder_frame, "camera": camera_frame, "scanner": scanner_frame}
    ee_frame = tool_frames.get(tool_frame)

elif tool == 5:
    filename = 'earth_extruder_v3_16mm_15deg_pbam_small.stl'
    vec = Vector.from_start_end([6.09775e-10,-0.418261,0.121892], [6.09777e-10,-0.419581,0.126818])
    extruder_frame = Frame([-0.055, -0.395, 0.073], [1, 0, 0], vec)
    ros_camera_frame = Frame([0.007, -0.2368, 0.118], [0,-1,0], [1,0,0])
    camera_frame = Frame([0.007, -0.2368, 0.118], [1,0,0], [0,0,1])
    ros_scanner_frame = Frame([-0.017, -0.501, 0.083], [0,0,1], [1,0,0])
    scanner_frame = Frame([-0.017, -0.455, 0.083], [1,0,0], [0,0,1])
    tool_frames = {"extruder": extruder_frame, "camera": camera_frame, "scanner": scanner_frame}
    ee_frame = tool_frames.get(tool_frame)

elif tool == 6:
    filename = 'earth_extruder_v3_16mm_15deg_pbam_rotleft.stl'
    # vec = Vector.from_start_end([6.09775e-10,-0.418261,0.121892], [6.09777e-10,-0.419581,0.126818])
    da = math.radians(15)
    vec = Vector(math.cos(da), math.sin(da), 0)
    extruder_frame = Frame([-0.0453, -0.3955, 0.083], vec, [0,0,1])
    ros_camera_frame = Frame([0.007, -0.2368, 0.118], [0,-1,0], [1,0,0])
    camera_frame = Frame([0.007, -0.2368, 0.118], [1,0,0], [0,0,1])
    ros_scanner_frame = Frame([-0.017, -0.501, 0.083], [0,0,1], [1,0,0])
    scanner_frame = Frame([-0.017, -0.455, 0.083], [1,0,0], [0,0,1])
    tool_frames = {"extruder": extruder_frame, "camera": camera_frame, "scanner": scanner_frame}
    ee_frame = tool_frames.get(tool_frame)

elif tool == 7:
    filename = 'earth_extruder_v3_16mm_15deg_pbam_rotright.stl'
    # vec = Vector.from_start_end([6.09775e-10,-0.418261,0.121892], [6.09777e-10,-0.419581,0.126818])
    da = math.radians(-15)
    vec = Vector(math.cos(da), math.sin(da), 0)
    extruder_frame = Frame([-0.0658, -0.3955, 0.083], vec, [0,0,1])
    ros_camera_frame = Frame([0.007, -0.2368, 0.118], [0,-1,0], [1,0,0])
    camera_frame = Frame([0.007, -0.2368, 0.118], [1,0,0], [0,0,1])
    ros_scanner_frame = Frame([-0.017, -0.501, 0.083], [0,0,1], [1,0,0])
    scanner_frame = Frame([-0.017, -0.455, 0.083], [1,0,0], [0,0,1])
    tool_frames = {"extruder": extruder_frame, "camera": camera_frame, "scanner": scanner_frame}
    ee_frame = tool_frames.get(tool_frame)

data_path = os.path.join(data_path, "tool_geometry")
fullfilename = os.path.join(data_path, filename)

ee_mesh = Mesh.from_stl(fullfilename)

if show:
    M = mesh_to_rhino(ee_mesh)

if multitool:
    tool = MultiTool(ee_mesh, tool_frames, primary_tool_name="extruder")
else:
    tool = Tool(ee_mesh, ee_frame)


if camera_frame:
    # tool.camera_frame = camera_frame
    camera_plane = frame_to_rhino_plane(camera_frame)
if scanner_frame:
    # tool.scanner_frame = scanner_frame
    scanner_plane = frame_to_rhino_plane(scanner_frame)

ee_plane = frame_to_rhino_plane(ee_frame)
print(ee_frame.quaternion.xyzw)
ee_framek = Frame([0.0110607,0.00809854,0.41498], [0,1,0], [1,0,0])
print(ee_framek.quaternion.xyzw)
# ---------- end tool ----------
panel_8 = Panel("Attach a custom tool")
remove = Button()
add = Button()
mesh = Mesh(tool.M)

pln_6 = Plane(tool.scanner_plane)

list_6 = ValueList({"get_pose_cartesian": 0, "manual_input": 1, "from_file": 2}, selected="manual_input")
save_to_file_2 = Button()
manual_points = Point([<point referenced from the Rhino model> x5])
filepath_2 = FilePath("C:\Users\gido\Documents\workspace\mobile_robot_control\data\measurements\point_measurements.ply")

# ----
# Point measuring
# Get Pose Cartesian
get = Button()
record = Button()
clear = Button()

# ----
# ROS client
panel_9 = Panel("9090")
# Load robot from ROS
# Load robot from ROS
list_7 = ValueList({"local": "127.0.0.1", "linux computer": "192.168.0.42", "linux eduroam": "10.181.95.254", "linux ccnet": "192.168.0.102", "linux vmware": "192.168.199.36", "robot": "192.168.0.200", "robotAA_wifi": "192.168.0.111", "robotAB_wifi": "192.168.0.112", "robotAB_eduroam": "10.181.67.95"}, selected="local")
connect_2 = BooleanToggle(True)

ros_2 = Python3Script(ip=list_7, port=panel_9, connect=connect_2)  # -> out, ros_client, is_connected; inputs ip: String, port: Int32, connect: Boolean
# ---------- ros_2: Python ----------
"""
Connect or disconnect to ROS.

COMPAS FAB v0.27.0
"""
from scriptcontext import sticky as st

from compas_fab.backends import RosClient

ros_client = None

ip = ip or '127.0.0.1'
port = port or 9090
key = "ros_client_001"
ros_client = st.get(key, None)

if ros_client:
    st[key].close()
if connect:
    st[key] = RosClient(ip, port)
    st[key].run(5)

ros_client = st.get(key, None)
is_connected = ros_client.is_connected if ros_client else False
# ---------- end ros_2 ----------
mobile_robot = Python3Script(ros_client=ros_2.ros_client, load=load)  # -> out, mobile_robot; inputs prefix: String
# ---------- mobile_robot: Python ----------
"""
Load robot directly from ROS.

COMPAS FAB v0.27.0
"""
from compas.scene import SceneObject
from mobile_robot_control.mobile_robot import MobileRobot
from mobile_robot_control.mobile_robot_client import MobileRobotClient

from scriptcontext import sticky as st

key = 'robot_AA'
if ros_client and ros_client.is_connected and load:
    # Load URDF from ROS
    robot = ros_client.load_robot(
            load_geometry=True, 
            urdf_param_name= '{}/robot_description'.format(prefix),
            srdf_param_name= '{}/robot_description_semantic'.format(prefix))
    robot.scene_object = SceneObject(item=robot.model)
    mobile_robot = MobileRobot(robot.model, robot.scene_object, robot.semantics, client=None)
    st[key] = mobile_robot

mobile_robot = st.get(key, None)
if mobile_robot:  # client sometimes need to be restarted, without needing to reload geometry
    mobile_robot.mobile_client = MobileRobotClient(ros_client)
    mobile_robot.client = ros_client
# ---------- end mobile_robot ----------

panel_10 = Panel(ros_2.is_connected)

equals = Equality(FirstNumber=list_6, SecondNumber=2)  # -> Equality, Inequality
pcd_from_file = Python3Script(filepath=filepath_2, read=equals.Equality)  # -> out, pcd
# ---------- pcd_from_file: Python ----------
from compas.datastructures import Mesh
from compas.files import PLY, STL
import os
import open3d

# filepath = os.path.join(data, filename)

if read:
    pcd = open3d.io.read_point_cloud(filepath)
    print("file read from ", str(filepath))
# ---------- end pcd_from_file ----------

robot = Data(mobile_robot.mobile_robot)

py3_8 = Python3Script(filepath=path_3, robot=robot, markerset=py3_3.markerset, append=Button(), clear=Button())  # -> out, markers_WCF, markers
# ---------- py3_8: Python ----------
import json
from json import JSONDecodeError
from mobile_robot_control.markers import MarkerSet

file_markerset = None
# print(markerset.markers)

with open(filepath, "r") as f:
    try:
        data = json.load(f)
        file_markerset = MarkerSet.from_data(data)
        print("loaded markerset")
    except JSONDecodeError:
        print("No data yet")

if append:
    if file_markerset is None:
        print("recreated markerset")
        file_markerset = MarkerSet("aruco")
    
    file_markerset.add_markers(markerset.markers)
    with open(filepath, "w") as f:
        json.dump(file_markerset.to_data(), f)

if clear:
    file_markerset = MarkerSet("aruco")
    with open(filepath, "w") as f:
        json.dump(file_markerset.to_data(), f)

if file_markerset:
    markers = file_markerset.markers
# ---------- end py3_8 ----------

pose = Python3Script(robot=robot, get=get)  # -> out, pose_cartesian
# ---------- pose: Python ----------
from scriptcontext import sticky as st

from ur_fabrication_control.direct_control.common import get_current_pose_cartesian
from compas.geometry import Frame


server_ip = st["server_ip"]
server_port = st["server_port"]
ur_port = st["ur_port1"]
ur_ip = st["ur_ip1"]
pose_cartesian_meter = []
print (ur_ip)

# retrieve the current tool frame in axis angle format
if robot.attached_tool:
    print ("attached")
    tool_angle_axis = list(robot.attached_tool.frame.point) + list(robot.attached_tool.frame.axis_angle_vector)
    
else:
    tool0_frame = Frame([0, 0, 0], [1, 0, 0], [0, 1, 0])
    tool_angle_axis = list(tool0_frame.point) + list(tool0_frame.axis_angle_vector)

guid = str(ghenv.Component.InstanceGuid)
pose_cartesian_key = "pose_cartesian" + guid


if get:
    print ("getting pose")
    st[pose_cartesian_key] = get_current_pose_cartesian(tool_angle_axis, server_ip, server_port, ur_ip, ur_port, send=True)
    

if pose_cartesian_key not in st:
    pose_cartesian = []
else:
    pose_cartesian = st[pose_cartesian_key]
# ---------- end pose ----------
panel_11 = Panel(pose.out)
rec_2 = Python3Script(msg=pose.pose_cartesian, rec=record, clear=clear)  # -> out, record, planes; inputs msg: list
# ---------- rec_2: Python ----------
from scriptcontext import sticky as st
from compas.geometry import Frame
from compas_rhino.conversions import frame_to_rhino_plane

guid = str(ghenv.Component.InstanceGuid)
recorded_key =  "recorded_" + guid

if recorded_key not in st:
    st[recorded_key] = []

if clear:
    st[recorded_key] = []
else:
    if len(msg):
        if msg != [None] and rec:
            st[recorded_key].append(msg)


record = st[recorded_key]
planes = []
for pose in st[recorded_key]:
    frame = Frame.from_axis_angle_vector(pose[3:6], pose[0:3])
    planes.append(frame_to_rhino_plane(frame))
print (rec)
# ---------- end rec_2 ----------
panel_12 = Panel(rec_2.record)

pose_cartesian_planes = Point(rec_2.planes)

filter = StreamFilter(Gate=list_6, Stream0=pose_cartesian_planes, Stream1=manual_points)
points_to_pcd_2 = Python3Script(points=filter, filepath=filepath_2, write=save_to_file_2)  # -> out, pcd; inputs points: list of Point3d; same code as points_to_pcd
filter_2 = StreamFilter(Gate=list_6, Stream0=points_to_pcd_2.pcd, Stream1=points_to_pcd_2.pcd, Stream2=pcd_from_file.pcd)
measurements_source = Data(filter_2)

rec_3 = DataRecorder(py3_8.out, DataLimit=-10, RecordData=True)
panel_13 = Panel(py3_8.markers)
panel_14 = Panel(rec_3)

tool_2 = Python3Script(robot=robot, tool=tool.tool, tool_name=list, attach=add, update=update, remove=remove)  # -> tool, M, ee_plane
# ---------- tool_2: Python ----------
if attach:
    robot.attach_tool(tool)
if remove:
    robot.detach_tool()
if update:
    robot.attached_tool.set_active_tool_frame(tool_name)
# ---------- end tool_2 ----------

info = Python3Script(robot=robot)  # -> out, main_group_name
# ---------- info: Python ----------
if robot:
    robot.info()
    main_group_name = robot.main_group_name
# ---------- end info ----------

measurements_source_2 = Data(measurements_source)
reference_target_2 = Data(reference_target)

panel_15 = Panel(info.out)

# ----
# RANSAC Global registration
toggle = BooleanToggle(True)
py3_9 = Python3Script(source=measurements_source_2, target=reference_target_2, threshold=Slider(0.25, range=0..10), compute=toggle)  # -> out, source_out, target_out, source_at_target, plane_out, T_RANSAC
# ---------- py3_9: Python ----------
from compas.geometry import Transformation

import open3d as o3d
import Rhino.Geometry as rg

from compas.geometry import Point, Frame
from compas_rhino.conversions import point_to_rhino, frame_to_rhino_plane

from mobile_robot_control.pointcloud_processing.ransac import preprocess_point_cloud_global, execute_global_registration2

if compute: 
    source, source_fpfh = preprocess_point_cloud_global(source, threshold)
    target, target_fpfh = preprocess_point_cloud_global(target, threshold)

    result_ransac = execute_global_registration2(source, target,
                                                source_fpfh, target_fpfh,
                                                threshold)
    print(result_ransac)

    T_RANSAC = Transformation.from_matrix(list(result_ransac.transformation))
    print(T_RANSAC)
    source_out = [rg.Point3d(*pt) for pt in source.points]
    target_out = [rg.Point3d(*pt) for pt in target.points]
    source_at_target = [point_to_rhino(Point(*pt).transformed(T_RANSAC)) for pt in source.points]
    frame_out = Frame.worldXY().transformed(T_RANSAC)
    plane_out = frame_to_rhino_plane(frame_out)
# ---------- end py3_9 ----------
panel_16 = Panel(py3_9.out)
number_slider_2 = Slider(0.1, range=0..0.1)
dots = DotDisplay(Point=py3_9.source_out, Colour=ColourSwatch(SwatchColor=RGB(0, 204, 255)), Size=number_slider_2)
dots_2 = DotDisplay(Point=py3_9.target_out, Colour=ColourSwatch(SwatchColor=RGB(255, 0, 0)), Size=number_slider_2)

# ----
# analytical inverse kinematics
list_8 = ValueList({"realsense_camera": 0, "profile_scanner": 1, "extruder": 2}, selected="profile_scanner")
filter_3 = StreamFilter(Gate=list_8)
item_2 = ListItem(List=filter_3, Index=Slider(0, range=0..150), Wrap=False)
select_configuration = Slider(0, range=0..7)
plane = Plane(item_2)
analytic_inverse = Python3Script(robot=robot, plane_WCS=plane, idx=select_configuration, reload=Button())  # -> out, configuration, plane_RCS, plane_tool0_RCS; inputs plane_WCS: Plane, idx: Int32
# ---------- analytic_inverse: Python ----------
import Rhino.Geometry as rg
import math
from compas.geometry import Frame, Transformation, Rotation
from compas_robots import Configuration
from ur_fabrication_control.kinematics.ur_kinematics import inverse_kinematics
from ur_fabrication_control.kinematics.ur_params import ur_params
from compas_rhino.conversions import plane_to_compas_frame
from compas_ghpython import draw_frame

robot.lift_height = 0.0059263829787234035

frame_WCS = plane_to_compas_frame(plane_WCS)

from roslibpy import tf
tf_client = tf.TFClient(robot.mobile_client.ros_client, fixed_frame="robot_base_footprint", angular_threshold=0.0, rate=10.0)
tf_client.subscribe("robot_arm_base", robot._receive_base_frame_callback)
print(robot._RCF)

# transform frame to robot coordinate system
# frame_BCS = frame_WCS.transformed(robot.transformation_WCF_BCF())
# frame_RCS = frame_BCS.transformed(robot.transformation_BCF_RCF())
frame_RCS = robot.from_WCF_to_RCF(frame_WCS)
print(frame_RCS)
# print(frame_WCS, frame_BCS, frame_RCS)
if robot.attached_tool:
    tool0_RCS = robot.from_tcf_to_t0cf([frame_RCS])[0]
else:
    tool0_RCS = frame_RCS

plane_tool0_RCS = draw_frame(tool0_RCS)
plane_RCS = draw_frame(frame_RCS)

# calculate solutions to frame
ur_params = ur_params["ur20"] # get the parameters according to the robot model
# print ur_params
solutions = inverse_kinematics(tool0_RCS, ur_params)
# print solutions

if not len(solutions):
    joint_values = [0, 0, 0, 0, 0, 0]
    configuration = Configuration.from_prismatic_and_revolute_values([0], joint_values)
else:
    joint_values = solutions[idx]
    configuration = [Configuration.from_prismatic_and_revolute_values([robot.lift_height], joint_values)]

print(configuration)
# ---------- end analytic_inverse ----------

# ----
# forward kinematics
number_slider_3 = Slider(90, range=-125..120)
forward_kinematics = Python3Script(
    robot=robot,
    l=Slider(0, range=0..0.7),
    j1=Slider(153.8, range=-180..180),
    j2=Slider(-50, range=-270..150),
    j3=Slider(110, range=-180..180),
    j4=Slider(-60, range=-400..400),
    j5=number_slider_3,
    j6=Slider(0, range=-400..400))  # -> configuration
# ---------- forward_kinematics: Python ----------
import math

from compas_robots.model import Joint
from compas_robots import Configuration


if robot:
    joint_positions = [l, j1, j2, j3, j4, j5, j6]
    print (joint_positions)
    joint_types = robot.model.get_joint_types()[4:11]
    print(joint_types)
    joint_names = robot.model.get_configurable_joint_names()[4:11]
    print(joint_names)

    for i, joint_type in enumerate(joint_types):
        if joint_type == Joint.REVOLUTE:
            joint_positions[i] = math.radians(joint_positions[i])
        if joint_type == Joint.PRISMATIC:
            joint_positions[i] = joint_positions[i]
    
    configuration = Configuration(joint_positions, joint_types, joint_names)
    print (configuration)
# ---------- end forward_kinematics ----------

# ----
# Configuration
# zero configuration
zero = Python3Script(robot=robot, group=info.main_group_name)  # -> out, configuration; inputs group: String
# ---------- zero: Python ----------
configuration = robot.zero_configuration(group)
# ---------- end zero ----------

dots_3 = DotDisplay(Point=py3_9.source_at_target, Colour=ColourSwatch(SwatchColor=RGB(255, 144, 0)), Size=number_slider_2)

list_9 = ValueList({"0 zero_configuration": 0, "1 forward_kinematics": 1, "2 inverse_kinematics": 2, "3 motion_planning": 3, "4 cartesian_motion_planning": 4}, selected="1 forward_kinematics")
filter_4 = StreamFilter(Gate=list_9, Stream0=zero.configuration, Stream1=forward_kinematics, Stream2=analytic_inverse.configuration)

# ----
# ICP
toggle_2 = BooleanToggle(True)
number_slider_4 = Slider(0.05, range=0..1)
py3_10 = Python3Script(
    source=measurements_source_2,
    target=reference_target_2,
    initial_guess=py3_9.plane_out,
    threshold=number_slider_4,
    compute=toggle_2)  # -> out, source_out, target_out, source_at_target, plane_out, T_ICP
# ---------- py3_10: Python ----------
from compas.geometry import Point, Frame, Transformation
from compas_rhino.conversions import point_to_rhino, frame_to_rhino_plane
import Rhino.Geometry as rg

from mobile_robot_control.pointcloud_processing.icp import preprocess_point_cloud_icp, evaluate_local_registration, execute_icp_local_registration

# source_down = preprocess_point_cloud_icp(source, voxel_size)
# target_down = preprocess_point_cloud_icp(target, voxel_size)

trans_init, evaluation = evaluate_local_registration(source, target, threshold, initial_guess)
print(evaluation)

if compute:
    registration_icp = execute_icp_local_registration(source, target, threshold, trans_init)

    print("Inlier Fitness: ", registration_icp.fitness)
    print("Inlier RMSE: ", registration_icp.inlier_rmse)

    print("Transformation: \n", registration_icp.transformation)

source_out = [rg.Point3d(*pt) for pt in source.points]
target_out = [rg.Point3d(*pt) for pt in target.points]
T_ICP = Transformation.from_matrix(list(registration_icp.transformation))
source_at_target = [point_to_rhino(Point(*pt).transformed(T_ICP)) for pt in source.points]
frame_out = Frame.worldXY().transformed(T_ICP)
plane_out = frame_to_rhino_plane(frame_out)
# ---------- end py3_10 ----------
panel_17 = Panel(py3_10.out)

dots_4 = DotDisplay(Point=py3_10.source_out, Colour=ColourSwatch(SwatchColor=RGB(0, 204, 255)), Size=number_slider)
dots_5 = DotDisplay(Point=py3_10.target_out, Colour=ColourSwatch(SwatchColor=RGB(255, 0, 0)), Size=number_slider)
dots_6 = DotDisplay(Point=py3_10.source_at_target, Colour=ColourSwatch(SwatchColor=RGB(255, 144, 0)), Size=number_slider)

# ----
# Robot plane
pln_7 = Plane(py3_10.plane_out)

# ----
# Visualisation
show_frames = BooleanToggle(True)
show_visual = BooleanToggle(True)
show_collision = BooleanToggle(True)
show_base_frame = BooleanToggle(True)
show_end_effector_frame = BooleanToggle(True)
show_acm = BooleanToggle(True)
visualise = Python3Script(
    robot=robot,
    configuration=filter_4,
    show_frames=show_frames,
    show_visual_meshes=show_visual,
    show_collision_meshes=show_collision,
    show_base_frame=show_base_frame,
    show_end_effector_frame=show_end_effector_frame,
    show_attached_collision_meshes=show_acm,
    reload=Button())  # -> out, joint_planes, visual_meshes, collision_meshes, base_plane, end_effector_plane, attched_collision_meshes
# ---------- visualise: Python ----------
from compas.geometry import Frame
from compas.geometry import Transformation
from compas_rhino.conversions import frame_to_rhino

import ghpythonlib.components as ghcomp
import Rhino.Geometry as rg

robot.update(configuration)

if show_frames == True: 
    #print(configuration)
    joint_frames = robot.model.transformed_frames(configuration)
    joint_planes = [frame_to_rhino(a) for a in joint_frames]
    joint_planes = ghcomp.Orient(joint_planes, rg.Plane.WorldXY, frame_to_rhino(robot.BCF))[0]

if show_base_frame == True:
    show_base_frame = robot.model.forward_kinematics(configuration, robot.model.get_base_link_name())
    #print(show_base_frame)
    base_plane = frame_to_rhino(show_base_frame) 

if show_end_effector_frame == True:
    # print(robot.get_joint_by_name("robot_arm_flange-tool0"))
    tool0_frame = robot.model.forward_kinematics(configuration, "robot_arm_tool0")
    end_effector_frame = robot.from_t0cf_to_tcf([tool0_frame])[0]
    #print(end_effector_frame)
    end_effector_plane = frame_to_rhino(end_effector_frame)
    end_effector_plane = ghcomp.Orient(end_effector_plane, rg.Plane.WorldXY, frame_to_rhino(robot.BCF))[0]

if show_visual_meshes == True:
    visual_meshes = robot.draw_visual()
    visual_meshes = ghcomp.Orient(visual_meshes, rg.Plane.WorldXY, frame_to_rhino(robot.BCF))[0]

if show_collision_meshes == True:
    collision_meshes = robot.draw_collision()

if show_attached_collision_meshes == True:
    pass
# ---------- end visualise ----------
py3_11 = Python3Script(planes=[visualise.joint_planes, visualise.end_effector_plane], scale=Slider(0.2, range=0..1))  # -> P, V, C, W; inputs planes: list of Plane, scale: Double
# ---------- py3_11: Python ----------
from Rhino.Display import ColorRGBA
from ghpythonlib.components import ColourRGBf


red = ColourRGBf(255, 255, 0, 0)
green = ColourRGBf(255, 0, 255, 0)
blue = ColourRGBf(255, 0, 0, 255)

P = []
V = []
C = []

# scale = float(scale)

for plane in planes:
    if not plane:
        continue
    P += [plane.Origin] * 3
    V.append(plane.XAxis * scale)
    V.append(plane.YAxis * scale)
    V.append(plane.ZAxis * scale)
    C += [red, green, blue]

W = 3
# ---------- end py3_11 ----------
mesh_2 = Mesh(visualise.visual_meshes)
pln_8 = Plane(visualise.joint_planes)
pln_9 = Plane(visualise.base_plane)
pln_10 = Plane(visualise.end_effector_plane)
mesh_3 = Mesh(visualise.collision_meshes)
preview = CustomPreview(Geometry=mesh_2, Material=ColourSwatch(SwatchColor=RGB(255, 255, 255)))
vdisex = VectorDisplayEx(Point=py3_11.P, Vector=py3_11.V, Colour=py3_11.C, Width=py3_11.W)

bp = Python3Script(point=base_origin, angle=angle)  # -> base_plane; inputs point: Point3d
# ---------- bp: Python ----------
import Rhino.Geometry as rg
import math

base_plane = rg.Plane(point, rg.Vector3d.XAxis, rg.Vector3d.YAxis)
base_plane.Rotate(math.radians(angle), rg.Vector3d.ZAxis)
# ---------- end bp ----------

filter_5 = StreamFilter(Gate=list_2, Stream0=bp, Stream1=pln_4, Stream2=pln_2, Stream3=pln_3)

py3_12 = Python3Script(robot=robot, use_rhino_worldXY=worldxy, custom_plane=filter_5)  # -> out, base_plane, arm_base_plane; inputs custom_plane: Plane
# ---------- py3_12: Python ----------
from compas.geometry import Frame
from compas_rhino.conversions import frame_to_rhino_plane

if use_rhino_worldXY:
    base_frame = Frame.worldXY()
else:
    base_frame = Frame(custom_plane.Origin, custom_plane.XAxis, custom_plane.YAxis)


# Base_frame is BCF in WCF
if robot:
    robot.BCF = base_frame
    print(robot.BCF)

base_plane = frame_to_rhino_plane(base_frame)
arm_base_plane = frame_to_rhino_plane(robot.RCF)
# ---------- end py3_12 ----------
