# Grasshopper definition r8_103_mobile_robot_localisation_scanning.ghx (Grasshopper 1.0.8)
# plug-ins: RhinoCodePluginGH, MetaHopper

# ----
# Robot Model
py3 = Python3Script()  # -> HERE, DATA, ROBOT_DESCRIPTION
# ---------- py3: Python ----------
import os

HERE = os.path.dirname(ghdoc.Path)
DATA = os.path.abspath(os.path.join(HERE, "..", "data"))
ROBOT_DESCRIPTION = os.path.abspath(os.path.join(DATA, "robot_description"))

print(HERE)
print(DATA)
print(ROBOT_DESCRIPTION)
# ---------- end py3 ----------
py3_2 = Python3Script(reload=Toggle(True))  # -> out
# ---------- py3_2: Python ----------
if reload:
    from compas_rhino import unload_modules
    unload_modules("fabrication_manager")
    unload_modules("am_information_model")
    unload_modules('mobile_robot_control')
    unload_modules('mobile_part_based_am')
    unload_modules('ur_fabrication_control')
# ---------- end py3_2 ----------

save_to_file = Button()
reference_points = Point([<point referenced from the Rhino model> x5])
filepath = FilePath("C:\Users\gido\Documents\workspace\mobile_robot_control\data\measurements\point_references.ply")

# ----
# Load pointcloud from file
toggle = BooleanToggle(False)
path = FilePath("C:\Users\Gido\Documents\workspace\development\mobile_part_based_am\data\2024-07-04_depth_camera_pointcloud_seg0_v0.json")
from_file = Python3Script(json_cloud=path, show_points=toggle)  # -> out, points_out
# ---------- from_file: Python ----------
from compas.geometry import Point
from compas_rhino.conversions import point_to_rhino
from mobile_part_based_am.pointcloud_publisher import PointCloud2

import csv
import json

def load_points_from_file(list_file):
    with open(list_file, "r") as f:
        data = json.load(f)
    return data


if show_points:
    msg = load_points_from_file(json_cloud)
    pointcloud = PointCloud2.from_msg(msg)
    points_out = [point_to_rhino(pt) for pt in pointcloud.points]
# ---------- end from_file ----------

# ----
# Service calls
start = Button()
stop = Button()
py3_3 = Python3Script(start_assembly=start, stop_assembly=stop)  # -> out
# ---------- py3_3: Python ----------
from roslibpy import Service, ServiceRequest

if start_assembly:
    start_srv = Service(ros_client, "/line_scanner/assemble/start", "std_srvs/Trigger")
    start_srv.call(ServiceRequest())

if stop_assembly:
    finish_srv = Service(ros_client, "/line_scanner/assemble/finish", "std_srvs/Trigger")
    finish_srv.call(ServiceRequest())
# ---------- end py3_3 ----------

load = Button()

trigger = Trigger(Interval=10, TimerInterval=10, Target=py3_2)

# ----
# Load pointcloud from file
toggle_2 = BooleanToggle(False)
path_2 = FilePath("C:\Users\Gido\Documents\workspace\development\mobile_part_based_am\data\2024-07-04_depth_camera_pointcloud_seg0_v0.json")
from_file_2 = Python3Script(json_cloud=path_2, show_points=toggle_2)  # -> out, points_out; same code as from_file

mesh = Mesh()
pt = Point()
mesh_2 = Mesh()
volume = Volume(Geometry=mesh)  # -> Volume, Centroid
panel = Panel(py3_2)
scale = Scale(Geometry=mesh, Center=volume.Centroid, Factor=1.5)  # -> Geometry, Transform

# ----
# Reference pointcloud from depth camera fov
minc = MeshInclusion(Mesh=scale.Geometry, Point=pt, Strict=False)
cull = CullPattern(List=pt, CullPattern=minc)

points_to_pcd = Python3Script(points=reference_points, filepath=filepath, write=save_to_file)  # -> out, pcd; inputs points: list of Point3d
# ---------- points_to_pcd: Python ----------
import open3d

array = [[x,y,z] for x, y, z in iter(points)]
pcd = open3d.geometry.PointCloud()
pcd.points = open3d.utility.Vector3dVector(array)
pcd.voxel_down_sample(0.0001)


if write:
    open3d.io.write_point_cloud(filepath, pcd, write_ascii=True)
    print("file written to ", str(filepath))
# ---------- end points_to_pcd ----------
reference_target = Data(points_to_pcd.pcd)

update = Button()
list = ValueList({"extruder", "pin", "camera", "scanner"}, selected="pin")

# ----
# IP Settings
# --> Set your IP address
# --> Set robot IP address
server_ip = ValueList({"192.168.0.42", "192.168.10.12", "192.168.10.11", "192.168.10.10", "192.168.10.2", "127.0.0.1", "192.168.10.111", "192.168.0.250", "192.168.0.30", "10.42.0.212", "10.42.0.133"}, selected="192.168.0.42")
ur_ip = ValueList({"192.168.10.10", "192.168.10.20", "192.168.10.11", "192.168.10.12", "127.0.0.1", "192.168.10.111", "192.168.0.210", "192.168.0.211", "192.168.0.30"}, selected="192.168.0.210")
server_port = ValueList({"50002", "50003", "50005", "50006", "50007", "50008", "50009", "50010", "50011", "50012", "50013", "50014", "50015", "50016", "50017", "50018", "50019", "50020", "50021", "50022", "50023", "50024", "50025", "50026", "50027", "50028"}, selected="50015")
ur_port = ValueList({"30002"}, selected="30002")
globals = Python3Script(server_ip=server_ip, server_port=server_port, ur_ip=ur_ip, ur_port=ur_port, clear=Button())  # inputs server_ip: String, server_port: Int32, ur_ip: String, ur_port: Int32
# ---------- globals: Python ----------
from scriptcontext import sticky as st

st["server_ip"] = server_ip
st["server_port"] = server_port

st["ur_ip"] = ur_ip
st["ur_port"] = ur_port


if clear:
    st.clear()
# ---------- end globals ----------

# ----
# Check if UR robot
#  is available
ping = Button()
py3_4 = Python3Script(ip=ur_ip, ping=ping)  # -> out; inputs ip: String
# ---------- py3_4: Python ----------
from scriptcontext import sticky as st
from ur_fabrication_control.direct_control.utilities import is_available

guid = str(ghenv.Component.InstanceGuid)
txt_key = "txt_" + guid
if txt_key not in st:
    st[txt_key] = ""

if ping:
    
    available = is_available(ip)
    
    if available:
        st[txt_key] = "%s is up!" % ip
        trigger = True
    else:
        st[txt_key] = "%s is down!" % ip
        trigger = False

print(st[txt_key])
# ---------- end py3_4 ----------
panel_2 = Panel(py3_4)

# ----
# ROBOT AA
# Move mobile robot base
base_origin = Point(Point(-0.02786180272, -1.464113888, 0))
angle = Slider(90, range=0..360)
worldxy = BooleanToggle(True)

list_2 = ValueList({"custom": 0, "from_reach": 1, "from_realsense": 2, "from_baumer": 3}, selected="custom")
pln = Plane()
pln_2 = Plane()
pln_3 = Plane()
wiredisplay = ControlWireDisplay(WireDisplay="1", AllObjects_Object=pln_8)

# ----
# from_file
toggle_3 = BooleanToggle(False)
path_3 = FilePath("C:\Users\Gido\Documents\workspace\development\mobile_part_based_am\data\2024-07-04_depth_camera_pointcloud_seg1_v0.ply")
py3_5 = Python3Script(filepath=path_3, read=toggle_3)  # -> out, pcd
# ---------- py3_5: Python ----------
from compas.datastructures import Mesh
from compas.files import PLY, STL
import os
import open3d

# filepath = os.path.join(data, filename)

if read:
    # mesh = Mesh()
    # array = [[x,y,z] for x, y, z in iter(points)]
    # pcd = open3d.geometry.PointCloud()
    # pcd.points = open3d.utility.Vector3dVector(array)
    # open3d.io.write_point_cloud(filepath, pcd, write_ascii=True)
    pcd = open3d.io.read_point_cloud(filepath)
    cl, ind = pcd.remove_statistical_outlier(nb_neighbors=20, std_ratio=2.0)
        # mesh.add_vertex(x=x, y=y, z=z)
    # stl = STL(filepath)
    # stl.write(mesh, precision="3f")
    # ply = PLY(filepath)
    # ply.write(mesh, precision="6f")
    
    print("file read from ", str(filepath))
# ---------- end py3_5 ----------

# ----
# from_file
toggle_4 = BooleanToggle(True)
path_4 = FilePath("C:\Users\Gido\Documents\workspace\development\mobile_part_based_am\data\2024-08-08_profile_sensor_pointcloud_seg14_v0.ply")
py3_6 = Python3Script(filepath=path_4, read=toggle_4)  # -> out, pcd; same code as py3_5

# ----
# Load pointcloud from .pcd
toggle_5 = BooleanToggle(False)
path_5 = FilePath("C:\Users\Gido\Documents\workspace\development\mobile_part_based_am\data\2024-07-23_depth_camera_pointcloud_seg0_v0.ply")
py3_7 = Python3Script(filepath=path_5, read=toggle_5)  # -> out, pcd; same code as py3_5

# ----
# from_file
toggle_6 = BooleanToggle(False)
path_6 = FilePath("C:\Users\Gido\Documents\workspace\development\mobile_part_based_am\data\2024-07-04_depth_camera_pointcloud_seg1_v0.ply")
py3_8 = Python3Script(filepath=path_6, read=toggle_6)  # -> out, pcd; same code as py3_5

wiredisplay_2 = ControlWireDisplay(WireDisplay="2", AllObjects_Object=[py3_31, toggle_11, number_slider_11])
number_slider = Slider(0.1, range=0..0.1)

# ----
# Attach tool
list_3 = ValueList({"measurement_tool": 0, "earth_extruder_v1": 1, "earth_extruder_v1_16mm_10deg": 2, "earth_extruder_v1_10mm_15deg": 3, "earth_extruder_v3_pbam": 4, "earth_extruder_v3_16mm_15deg_pbam": 5, "earth_extruder_v3_16mm_15deg_pbam_rotleft": 6, "earth_extruder_v3_16mm_15deg_pbam_rotright": 7, "measurement_x3": 8}, selected="measurement_x3")
multitool = BooleanToggle(True)
show = BooleanToggle(True)
list_4 = ValueList({"extruder", "pin", "camera", "scanner"}, selected="pin")
path_7 = Python3Script()  # -> DATA
# ---------- path_7: Python ----------
import os

package_path = ghdoc.Path
DATA = os.path.abspath(os.path.join(package_path,"../../data"))

print(package_path)
print(DATA)
# ---------- end path_7 ----------
tool = Python3Script(data_path=path_7, tool=list_3, tool_frame=list_4, multitool=multitool, show=show)  # -> tool, M, ee_plane, camera_plane, scanner_plane; inputs tool: Int32
# ---------- tool: Python ----------
import os, math
from compas.geometry import Frame, Rotation, Vector
from compas.datastructures import Mesh
from compas_rhino.conversions import mesh_to_rhino, frame_to_rhino_plane
from compas_fab.robots import Tool
from mobile_part_based_am.multitool import MultiTool

tolerance = 0

if tool == 0:
    filename = 'measurement_tool.stl'
    ee_frame = Frame([0, 0, 0.109], [1, 0, 0], [0, 1, 0])

elif tool == 1:
    filename = 'earth_extruder_v1.stl'
    ee_frame = Frame([-0.0000131542, -0.335947, 0.101034,], [1, 0, 0], [0, 0, 1])

elif tool == 2:
    filename = 'earth_extruder_v1_16mm_10deg.stl'
    vec = Vector.from_start_end([-0,-0.347721,0.100031], [7.5868e-05,-0.349791,0.107758])
    ee_frame = Frame([-0,-0.347721,0.100031], [1, 0, 0], vec)

elif tool == 3:
    filename = 'earth_extruder_v1_10mm_15deg.stl'
    vec = Vector.from_start_end([6.09775e-10,-0.418261,0.121892], [6.09777e-10,-0.419581,0.126818])
    ee_frame = Frame([6.09775e-10,-0.413432,0.123186], [1, 0, 0], vec)

elif tool == 4:
    filename = 'earth_extruder_v3_pbam_small.stl'
    # vec = Vector.from_start_end([6.09775e-10,-0.418261,0.121892], [6.09777e-10,-0.419581,0.126818])
    extruder_frame = Frame([-0.070, -0.405, 0.083], [1, 0, 0], [0,0,1])
    ros_camera_frame = Frame([0.007, -0.2368, 0.118], [0,-1,0], [1,0,0])
    camera_frame = Frame([0.007, -0.2368, 0.118], [1,0,0], [0,0,1])
    ros_scanner_frame = Frame([-0.017, -0.501, 0.083], [0,0,1], [1,0,0])
    scanner_frame = Frame([-0.017, -0.455, 0.083], [1,0,0], [0,0,1])
    tool_frames = {"extruder": extruder_frame, "camera": camera_frame, "scanner": scanner_frame}
    ee_frame = tool_frames.get(tool_frame)

elif tool == 5:
    filename = 'earth_extruder_v3_16mm_15deg_pbam_small.stl'
    vec = Vector.from_start_end([6.09775e-10,-0.418261,0.121892], [6.09777e-10,-0.419581,0.126818])
    extruder_frame = Frame([-0.055, -0.395, 0.073], [1, 0, 0], vec)
    ros_camera_frame = Frame([0.007, -0.2368, 0.118], [0,-1,0], [1,0,0])
    camera_frame = Frame([0.007, -0.2368, 0.118], [1,0,0], [0,0,1])
    ros_scanner_frame = Frame([-0.017, -0.501, 0.083], [0,0,1], [1,0,0])
    scanner_frame = Frame([-0.017, -0.455, 0.083], [1,0,0], [0,0,1])
    tool_frames = {"extruder": extruder_frame, "camera": camera_frame, "scanner": scanner_frame}
    ee_frame = tool_frames.get(tool_frame)

elif tool == 6:
    filename = 'earth_extruder_v3_16mm_15deg_pbam_rotleft.stl'
    # vec = Vector.from_start_end([6.09775e-10,-0.418261,0.121892], [6.09777e-10,-0.419581,0.126818])
    da = math.radians(15)
    vec = Vector(math.cos(da), math.sin(da), 0)
    extruder_frame = Frame([-0.0453, -0.3955, 0.083], vec, [0,0,1])
    ros_camera_frame = Frame([0.007, -0.2368, 0.118], [0,-1,0], [1,0,0])
    camera_frame = Frame([0.007, -0.2368, 0.118], [1,0,0], [0,0,1])
    ros_scanner_frame = Frame([-0.017, -0.501, 0.083], [0,0,1], [1,0,0])
    scanner_frame = Frame([-0.017, -0.455, 0.083], [1,0,0], [0,0,1])
    tool_frames = {"extruder": extruder_frame, "camera": camera_frame, "scanner": scanner_frame}
    ee_frame = tool_frames.get(tool_frame)

elif tool == 7:
    filename = 'earth_extruder_v3_16mm_15deg_pbam_rotright.stl'
    # vec = Vector.from_start_end([6.09775e-10,-0.418261,0.121892], [6.09777e-10,-0.419581,0.126818])
    da = math.radians(-15)
    vec = Vector(math.cos(da), math.sin(da), 0)
    extruder_frame = Frame([-0.0658, -0.3955, 0.083], vec, [0,0,1])
    ros_camera_frame = Frame([0.007, -0.2368, 0.118], [0,-1,0], [1,0,0])
    camera_frame = Frame([0.007, -0.2368, 0.118], [1,0,0], [0,0,1])
    ros_scanner_frame = Frame([-0.017, -0.501, 0.083], [0,0,1], [1,0,0])
    scanner_frame = Frame([-0.017, -0.455, 0.083], [1,0,0], [0,0,1])
    tool_frames = {"extruder": extruder_frame, "camera": camera_frame, "scanner": scanner_frame}
    ee_frame = tool_frames.get(tool_frame)

elif tool == 8:
    filename = 'measurement_toolx3.stl'

    pin_frame =  Frame([0.000, 0.000, 0.302], [-1,0,0], [0,1,0])
    ros_camera_frame = Frame([0.0060,0.0881,0.1714], [-1,0,0], [0,1,0])
    camera_frame = Frame([0.0060,0.0881,0.1714], [-1,0,0], [0,1,0])
    ros_scanner_frame = Frame([-0.0167,0.0431,0.3908], [-1,0,0], [0,1,0])
    scanner_frame = Frame([-0.0167,0.0431,0.3908], [-1,0,0], [0,1,0])

    tool_frames = {"pin": pin_frame, "camera": camera_frame, "scanner": scanner_frame}
    ee_frame = tool_frames.get(tool_frame)


data_path = os.path.join(data_path, "tool_geometry")
fullfilename = os.path.join(data_path, filename)

ee_mesh = Mesh.from_stl(fullfilename)

if show:
    M = mesh_to_rhino(ee_mesh)

if multitool:
    tool = MultiTool(ee_mesh, tool_frames, primary_tool_name=list(tool_frames.keys())[0])
else:
    tool = Tool(ee_mesh, ee_frame)


if camera_frame:
    # tool.camera_frame = camera_frame
    camera_plane = frame_to_rhino_plane(camera_frame)
if scanner_frame:
    # tool.scanner_frame = scanner_frame
    scanner_plane = frame_to_rhino_plane(scanner_frame)

ee_plane = frame_to_rhino_plane(ee_frame)
print(ee_frame.quaternion.xyzw)
ee_framek = Frame([0.0110607,0.00809854,0.41498], [0,1,0], [1,0,0])
print(ee_framek.quaternion.xyzw)
# ---------- end tool ----------
panel_3 = Panel("Attach a custom tool")
remove = Button()
add = Button()
mesh_3 = Mesh(tool.M)

pln_4 = Plane([tool.scanner_plane, tool.camera_plane, tool.ee_plane])

list_5 = ValueList({"get_pose_cartesian": 0, "manual_input": 1, "from_file": 2}, selected="manual_input")
save_to_file_2 = Button()
manual_points = Point([<point referenced from the Rhino model> x5])
filepath_2 = FilePath("C:\Users\gido\Documents\workspace\mobile_robot_control\data\measurements\point_measurements.ply")

# ----
# Point measuring
# Get Pose Cartesian
get = Button()
record = Button()
clear = Button()

# ----
# Sensing
dam = DataDam(BufferDelay=10000000, BufferMode=0)  # -> DataRobot_base_plane, DataSegment, DataSegment_mesh, DataSegment_index, DataRobot
pt_2 = Point()
Z = UnitZ(Factor=Slider(0, range=0..1))
# Profile Scanner Reference cloud .pcd file
cullpt = CullDuplicates(Tolerance=0.001, CullMode=3)  # -> Points, Indices, Valence
pt_3 = Point()
swatch = ColourSwatch(SwatchColor=RGB(0, 191, 255))
preview = CustomPreview(Geometry=pt_3, Material=swatch)

# ----
# Load pointcloud from ROS
panel_4 = Panel("depth_camera_pointcloud")
number_slider_2 = Slider(1, range=0..10)
py3_9 = Python3Script(segment_nr=dam.DataSegment_index, name=panel_4, version=number_slider_2)  # -> out, filename; inputs segment_nr: Int32, version: Int32
# ---------- py3_9: Python ----------
import datetime
dt = str(datetime.date.today())
filename = dt+'_'+name+'_seg'+str(segment_nr)+'_v'+str(version)+'.json'
# ---------- end py3_9 ----------

number_slider_3 = Slider(0, range=0..10)
# Load pointcloud from ROS
panel_5 = Panel("profile_sensor_pointcloud_printed")
py3_10 = Python3Script(segment_nr=dam.DataSegment_index, name=panel_5, version=number_slider_3)  # -> out, filename; inputs segment_nr: Int32, version: Int32; same code as py3_9

# ----
# Write to .pcd from .json
number_slider_4 = Slider(0.05, range=0..1)
# Depth camera .pcd file
panel_6 = Panel("depth_camera_pointcloud")
number_slider_5 = Slider(1, range=0..10)
data = Python3Script()  # -> DATA
# ---------- data: Python ----------
import os

package_path = ghdoc.Path
DATA = os.path.abspath(os.path.join(package_path,"../../../mobile_part_based_am/data"))

print(package_path)
print(DATA)
# ---------- end data ----------
pt_4 = Point()
py3_11 = Python3Script(segment_nr=dam.DataSegment_index, name=panel_6, version=number_slider_2)  # -> out, filename; inputs segment_nr: Int32, version: Int32
# ---------- py3_11: Python ----------
import datetime
dt = str(datetime.date.today())
filename = dt+'_'+name+'_seg'+str(segment_nr)+'_v'+str(version)+'.ply'
# ---------- end py3_11 ----------
py3_12 = Python3Script(
    data=data,
    filename=py3_11.filename,
    points=pt_4,
    write=Toggle(True),
    remove_outliers=Toggle(True),
    remove_floor=Toggle(False),
    distance_threshold=number_slider_4,
    resolution=Slider(0.001, range=0..0.1))  # -> out, pcd_raw, pcd_pp; inputs points: list of Point3d
# ---------- py3_12: Python ----------
from compas.datastructures import Mesh
from compas.files import PLY, STL
import os
import open3d

filepath = os.path.join(data, filename)
if points:
    array = [[x,y,z] for x, y, z in iter(points)]
    pcd_raw = open3d.geometry.PointCloud()
    pcd_raw.points = open3d.utility.Vector3dVector(array)
    pcd_raw.voxel_down_sample(resolution)

    if remove_outliers:
        pcd_pp, ind = pcd_raw.remove_statistical_outlier(nb_neighbors=20, std_ratio=2.0)
    else:
        pcd_pp = pcd_raw

    if remove_floor:
        plane_model, inliers = pcd_pp.segment_plane(distance_threshold, ransac_n=5, num_iterations=1000)
        pcd_pp = pcd_pp.select_by_index(inliers, invert=True)

    if write:
        open3d.io.write_point_cloud(filepath, pcd_pp, write_ascii=True)
        print("file written to ", str(filepath))
# ---------- end py3_12 ----------
panel_7 = Panel(py3_12.out)

# ----
# from_robot
number_slider_6 = Slider(0.007, range=0..0.1)
# Depth Camera Reference cloud .pcd file
panel_8 = Panel("cam_reference_pointcloud")
data_2 = Python3Script()  # -> DATA; same code as data
pt_5 = Point(cull)
py3_13 = Python3Script(segment_nr=dam.DataSegment_index, name=panel_8, version=Slider(0, range=0..10))  # -> out, filename; inputs segment_nr: Int32, version: Int32; same code as py3_11
py3_14 = Python3Script(
    data=data_2,
    filename=py3_13.filename,
    points=pt_5,
    write=Toggle(True),
    remove_outliers=Toggle(True),
    remove_floor=Toggle(False),
    distance_threshold=number_slider_6,
    resolution=Slider(0.00025, range=0..0.1))  # -> out, pcd_raw, pcd_pp; inputs points: list of Point3d
# ---------- py3_14: Python ----------
from compas.geometry import Vector
from compas.datastructures import Mesh
from compas.files import PLY, STL
from compas_rhino.conversions import mesh_to_compas
import os
import open3d
import numpy as np

filepath = os.path.join(data, filename)

if points:
    array = [[x,y,z] for x, y, z in iter(points)]
    pcd_raw = open3d.geometry.PointCloud()
    pcd_raw.points = open3d.utility.Vector3dVector(array)
    pcd_raw = pcd_raw.voxel_down_sample(resolution)

    if write:
        open3d.io.write_point_cloud(filepath, pcd_raw, write_ascii=True)
        print("file written to ", str(filepath))

    if remove_outliers:
        pcd_pp, ind = pcd_raw.remove_statistical_outlier(nb_neighbors=20, std_ratio=2.0)
    else:
        pcd_pp = pcd_raw

    if remove_floor:
        plane_model, inliers = pcd_pp.segment_plane(distance_threshold, ransac_n=3, num_iterations=1000)
        pcd_pp = pcd_pp.select_by_index(inliers, invert=True)
# ---------- end py3_14 ----------
panel_9 = Panel(py3_14.out)

list_6 = ValueList({"from_robot": 0, "from_file": 1}, selected="from_robot")
list_7 = ValueList({"worldXY": 0, "robot_base_plane": 1}, selected="worldXY")
filter = StreamFilter(Gate=list_6, Stream0=py3_12.pcd_pp, Stream1=py3_7.pcd)
py3_15 = Python3Script(source=filter, base_plane=dam.DataRobot_base_plane, anchor=list_7)  # -> out, cloud_out
# ---------- py3_15: Python ----------
from compas.geometry import Point, Frame, Transformation
from compas_rhino.conversions import point_to_rhino, frame_to_rhino_plane

if source:
    if anchor == 1:
        robot_frame = frame_to_rhino_plane(base_plane)
        transformation = Transformation.from_change_of_basis(Frame.worldXY(), robot_frame)
        points = [Point(*pt).transformed(transformation) for pt in source.points]
    elif anchor == 0:
        points = [Point(*pt) for pt in source.points]

    cloud_out = [point_to_rhino(pt) for pt in points]
# ---------- end py3_15 ----------
pt_6 = Point(py3_15.cloud_out)

list_8 = ValueList({"from_robot": 0, "from_file": 1}, selected="from_robot")
list_9 = ValueList({"worldXY": 0, "robot_base_plane": 1}, selected="worldXY")
filter_2 = StreamFilter(Gate=list_8, Stream0=py3_14.pcd_pp, Stream1=py3_8.pcd)
py3_16 = Python3Script(source=filter_2, anchor=list_9)  # -> out, cloud_out; same code as py3_15
pt_7 = Point(py3_16.cloud_out)

# ----
# RANSAC Global registration
toggle_7 = BooleanToggle(True)
py3_17 = Python3Script(source=filter, target=filter_2, voxel_size=Slider(0.025, range=0..1), compute=toggle_7)  # -> out, cloud_out, T_RANSAC
# ---------- py3_17: Python ----------
from compas.geometry import Transformation

import open3d as o3d
import Rhino.Geometry as rg

from mobile_part_based_am.pointcloud_processing.ransac import preprocess_point_cloud_global, execute_global_registration

if compute: 
    source_down, source_fpfh = preprocess_point_cloud_global(source, voxel_size)
    target_down, target_fpfh = preprocess_point_cloud_global(target, voxel_size)

    result_ransac = execute_global_registration(source_down, target_down,
                                                source_fpfh, target_fpfh,
                                                voxel_size)
    print(result_ransac)

    T_RANSAC = Transformation.from_matrix(list(result_ransac.transformation))
    cloud_out = [rg.Point3d(*pt) for pt in source_down.points]
# ---------- end py3_17 ----------
py3_18 = Python3Script(source=py3_17.cloud_out, transformation=py3_17.T_RANSAC)  # -> out, robot_plane, cloud_out; inputs source: list of Point3d
# ---------- py3_18: Python ----------
from compas.geometry import Point, Frame
from compas_rhino.conversions import point_to_rhino, frame_to_rhino_plane

robot_frame = Frame.worldXY().transformed(transformation)
robot_plane = frame_to_rhino_plane(robot_frame)
points = [Point(*pt).transformed(transformation) for pt in source]
cloud_out = [point_to_rhino(pt) for pt in points]
# ---------- end py3_18 ----------
pln_5 = Plane(py3_18.robot_plane)
pt_8 = Point(py3_18.cloud_out)
preview_2 = CustomPreview(Geometry=pt_8, Material=ColourSwatch(SwatchColor=RGB(255, 0, 0)))

# ----
# ICP
toggle_8 = BooleanToggle(True)
py3_19 = Python3Script(
    source=filter,
    target=filter_2,
    initial_guess=pln_5,
    voxel_size=Slider(0.03, range=0..1),
    threshold=Slider(0.08, range=0..1),
    compute=toggle_8)  # -> out, cloud_out, target_out, T_ICP
# ---------- py3_19: Python ----------
from compas.geometry import Transformation
import Rhino.Geometry as rg

from mobile_part_based_am.pointcloud_processing.icp import preprocess_point_cloud_icp, evaluate_local_registration, execute_icp_local_registration

source_down = preprocess_point_cloud_icp(source, voxel_size)
target_down = preprocess_point_cloud_icp(target, voxel_size)

trans_init, evaluation = evaluate_local_registration(source_down, target_down, threshold, initial_guess)
print(evaluation)

if compute:
    registration_icp = execute_icp_local_registration(source_down, target_down, threshold, trans_init)

    print("Inlier Fitness: ", registration_icp.fitness)
    print("Inlier RMSE: ", registration_icp.inlier_rmse)

    print("Transformation: ", registration_icp.transformation)

cloud_out = [rg.Point3d(*pt) for pt in source_down.points]
target_out = [rg.Point3d(*pt) for pt in target_down.points]
T_ICP = Transformation.from_matrix(list(registration_icp.transformation))
# ---------- end py3_19 ----------
py3_20 = Python3Script(source=py3_19.cloud_out, transformation=py3_19.T_ICP)  # -> out, robot_plane, cloud_out; inputs source: list of Point3d; same code as py3_18
panel_10 = Panel(py3_19.out)
pln_6 = Plane(py3_20.robot_plane)
pt_9 = Point(py3_20.cloud_out)
preview_3 = CustomPreview(Geometry=pt_9, Material=ColourSwatch(SwatchColor=RGB(255, 115, 0)))

preview_4 = CustomPreview(Geometry=py3_19.target_out, Material=ColourSwatch(SwatchColor=RGB(0, 191, 255)))

# ----
# Load robot from ROS
# Load robot from ROS
# ROS client
list_10 = ValueList({"local": "127.0.0.1", "linux computer": "192.168.0.42", "linux eduroam": "10.181.95.254", "linux ccnet": "192.168.0.102", "linux vmware": "192.168.199.36", "robot": "192.168.0.200", "robotAA_wifi": "192.168.0.111", "robotAB_wifi": "192.168.0.112", "robotAB_eduroam": "10.181.67.95"}, selected="local")
connect = BooleanToggle(True)

ros = Python3Script(ip=list_10, port="9090", connect=connect)  # -> out, ros_client, is_connected; inputs ip: String, port: Int32, connect: Boolean
# ---------- ros: Python ----------
"""
Connect or disconnect to ROS.

COMPAS FAB v0.27.0
"""
from scriptcontext import sticky as st

from compas_fab.backends import RosClient

ros_client = None

ip = ip or '127.0.0.1'
port = port or 9090
key = "ros_client_001"
ros_client = st.get(key, None)

if ros_client:
    st[key].close()
if connect:
    st[key] = RosClient(ip, port)
    st[key].run(5)

ros_client = st.get(key, None)
is_connected = ros_client.is_connected if ros_client else False
# ---------- end ros ----------
ros_client = Data(ros.ros_client)

save_to_file_3 = Button()
clear_2 = Button()
get_2 = Button()
toggle_9 = BooleanToggle(False)
data_3 = Python3Script()  # -> DATA; same code as data
py3_21 = Python3Script(
    ros_client=ros_client,
    get=get_2,
    save_to_file=save_to_file_3,
    clear=clear_2,
    show=Toggle(True),
    data=data_3,
    filename=py3_10.filename)  # -> out, pc, points
# ---------- py3_21: Python ----------
from scriptcontext import sticky
from roslibpy import Topic
from mobile_part_based_am.pointcloud_publisher import PointCloud2
from compas_ghpython.drawing import draw_points
from compas_rhino.conversions import point_to_rhino
import time
import os
import json

filepath = os.path.join(data, filename)

pc_key = 'pc_' + "baumer"
mr_key = 'mr_' + "baumer_msg"

def pointcloud_callback(msg):
    sticky[pc_key] = msg
    sticky[mr_key] = True

if ros_client and ros_client.is_connected:
    print("ROSClient Connected!")
    topic = Topic(ros_client, "/line_scanner/cloud_accumulated", "sensor_msgs/PointCloud2")

if clear:
    pc = sticky[pc_key]
    pc.clear()

if get:
    # pcr = sticky[pcr_key]
    sticky[mr_key] = False
    topic.subscribe(pointcloud_callback)
    d0 = time.time()
    while not sticky[mr_key]:
        if time.time()-d0 > 30:
            break
        pass
    topic.unsubscribe()  

if save_to_file:
    pc = sticky[pc_key]
    with open(filepath, 'w') as f:
        json.dump(pc, f)
    # pc.save_to_file(filepath)
    
if show:
    try:
        pc = sticky[pc_key]
        pointcloud = PointCloud2.from_msg(pc)
        points = [point_to_rhino(pt) for pt in pointcloud.points]
    except KeyError:
        print("No pointcloud loaded")
# ---------- end py3_21 ----------

save_to_file_4 = Button()
clear_3 = Button()
get_3 = Button()
data_4 = Python3Script()  # -> DATA; same code as data
py3_22 = Python3Script(
    ros_client=ros_client,
    get=get_3,
    save_to_file=save_to_file_4,
    clear=clear_3,
    show=Toggle(True),
    data=data_4,
    filename=py3_9.filename)  # -> out, pc, points
# ---------- py3_22: Python ----------
from scriptcontext import sticky
from roslibpy import Topic
from mobile_part_based_am.pointcloud_publisher import PointCloud2
from compas_ghpython.drawing import draw_points
from compas_rhino.conversions import point_to_rhino
import time
import os
import json

filepath = os.path.join(data, filename)

pc_key = 'pc_' + "realsense"
mr_key = 'mr_' + "realsense_msg"

def pointcloud_callback(msg):
    sticky[pc_key] = msg
    sticky[mr_key] = True

if ros_client and ros_client.is_connected:
    print("ROSclient connected!")
    topic = Topic(ros_client, "/camera/depth/color/points_transformed", "sensor_msgs/PointCloud2")

if clear:
    pc = sticky[pc_key]
    pc.clear()

if get:
    # pcr = sticky[pcr_key]
    sticky[mr_key] = False
    topic.subscribe(pointcloud_callback)
    d0 = time.time()
    while not sticky[mr_key]:
        if time.time()-d0 > 5:
            break
        pass
    topic.unsubscribe()  

if save_to_file:
    pc = sticky[pc_key]
    with open(filepath, 'w') as f:
        json.dump(pc, f)
    # pc.save_to_file(filepath)
    
if show:
    try:
        pc = sticky[pc_key]
        pointcloud = PointCloud2.from_msg(pc)
        points = [point_to_rhino(pt) for pt in pointcloud.points]
    except KeyError:
        print("No pointcloud loaded")
# ---------- end py3_22 ----------

panel_11 = Panel(ros.is_connected)

mobile_robot = Python3Script(ros_client=ros.ros_client, load=load)  # -> out, mobile_robot; inputs prefix: String
# ---------- mobile_robot: Python ----------
"""
Load robot directly from ROS.

COMPAS FAB v0.27.0
"""
from compas.scene import SceneObject
from mobile_robot_control.mobile_robot import MobileRobot
from mobile_robot_control.mobile_robot_client import MobileRobotClient

from scriptcontext import sticky as st

key = 'robot_AA'
if ros_client and ros_client.is_connected and load:
    # Load URDF from ROS
    robot = ros_client.load_robot(
            load_geometry=True, 
            urdf_param_name= '{}/robot_description'.format(prefix),
            srdf_param_name= '{}/robot_description_semantic'.format(prefix))
    robot.scene_object = SceneObject(item=robot.model)
    mobile_robot = MobileRobot(robot.model, robot.scene_object, robot.semantics, client=None)
    st[key] = mobile_robot

mobile_robot = st.get(key, None)
if mobile_robot:  # client sometimes need to be restarted, without needing to reload geometry
    mobile_robot.mobile_client = MobileRobotClient(ros_client)
    mobile_robot.client = ros_client
# ---------- end mobile_robot ----------

# ----
# 1. Realsense
list_11 = ValueList({"from_ROS": 0, "from_file": 1}, selected="from_ROS")
filter_3 = StreamFilter(Gate=list_11, Stream0=py3_22.points, Stream1=from_file.points_out)
pt_10 = Point(filter_3)

# ----
# 2. Baumer OXP200
list_12 = ValueList({"from_ROS": 0, "from_file": 1}, selected="from_ROS")
filter_4 = StreamFilter(Gate=list_12, Stream0=py3_21.points, Stream1=from_file_2.points_out)
pt_11 = Point(filter_4)

# ----
# from_robot
number_slider_7 = Slider(0.015, range=0..0.1)
# Profile scanner .pcd file
data_5 = Python3Script()  # -> DATA; same code as data
pt_12 = Point(pt_11)
py3_23 = Python3Script(segment_nr=dam.DataSegment_index, name=panel_5, version=number_slider_3)  # -> out, filename; inputs segment_nr: Int32, version: Int32; same code as py3_11
py3_24 = Python3Script(
    data=data_5,
    filename=py3_23.filename,
    points=pt_12,
    write=Toggle(True),
    remove_outliers=Toggle(True),
    remove_floor=Toggle(False),
    distance_threshold=number_slider_7,
    resolution=Slider(0.00025, range=0..0.1))  # -> out, pcd_raw, pcd_pp; inputs points: list of Point3d
# ---------- py3_24: Python ----------
from compas.datastructures import Mesh
from compas.files import PLY, STL
import os
import open3d

filepath = os.path.join(data, filename)

array = [[x,y,z] for x, y, z in iter(points)]
pcd_raw = open3d.geometry.PointCloud()
pcd_raw.points = open3d.utility.Vector3dVector(array)
pcd_raw = pcd_raw.voxel_down_sample(resolution)

if write:
    open3d.io.write_point_cloud(filepath, pcd_raw, write_ascii=True)
    print("file written to ", str(filepath))

if remove_outliers:
    pcd_pp, ind = pcd_raw.remove_statistical_outlier(nb_neighbors=20, std_ratio=2.0)
else:
    pcd_pp = pcd_raw

if remove_floor:
    plane_model, inliers = pcd_pp.segment_plane(distance_threshold, ransac_n=3, num_iterations=1000)
    pcd_pp = pcd_pp.select_by_index(inliers, invert=True)
# ---------- end py3_24 ----------
panel_12 = Panel(py3_24.out)

list_13 = ValueList({"from_robot": 0, "from_file": 1}, selected="from_robot")
list_14 = ValueList({"worldXY": 0, "robot_base_plane": 1}, selected="worldXY")
filter_5 = StreamFilter(Gate=list_13, Stream0=py3_24.pcd_pp, Stream1=py3_6.pcd)
py3_25 = Python3Script(source=filter_5, base_plane=dam.DataRobot_base_plane, anchor=list_14)  # -> out, cloud_out
# ---------- py3_25: Python ----------
from compas.geometry import Point, Frame, Transformation
from compas_rhino.conversions import point_to_rhino, frame_to_rhino_plane

if anchor == 1:
    robot_frame = frame_to_rhino_plane(base_plane)
    transformation = Transformation.from_change_of_basis(Frame.worldXY(), robot_frame)
    points = [Point(*pt).transformed(transformation) for pt in source.points]
elif anchor == 0:
    points = [Point(*pt) for pt in source.points]

cloud_out = [point_to_rhino(pt) for pt in points]
# ---------- end py3_25 ----------
pt_13 = Point(py3_25.cloud_out)

# ----
# Reference pointcloud from segment bounding box
mesh_4 = Mesh()
bbox = BoundingBox(Content=mesh_4, Plane=PlaneXY(0, 0, 0), UnionBox=True)  # -> Box, Box_2
volume_2 = Volume(Geometry=mesh_4)  # -> Volume, Centroid
scale_2 = Scale(Geometry=bbox.Box, Center=volume_2.Centroid, Factor=Slider(1.5, range=0..10))  # -> Geometry, Transform

equals = Equality(FirstNumber=list_5, SecondNumber=2)  # -> Equality, Inequality
pcd_from_file = Python3Script(filepath=filepath_2, read=equals.Equality)  # -> out, pcd
# ---------- pcd_from_file: Python ----------
from compas.datastructures import Mesh
from compas.files import PLY, STL
import os
import open3d

# filepath = os.path.join(data, filename)

if read:
    pcd = open3d.io.read_point_cloud(filepath)
    print("file read from ", str(filepath))
# ---------- end pcd_from_file ----------

move = Move(Geometry=scale_2.Geometry, Motion=Z)  # -> Geometry, Transform
cullpt_2 = CullDuplicates(Points=pt_11, Tolerance=0.001, CullMode=3)  # -> Points, Indices, Valence
pt_14 = Point(cullpt_2.Points)
del = DelaunayMesh(Points=pt_14, Plane=PlaneXY(0, 0, 0))

minc_2 = MeshInclusion(Mesh=move.Geometry, Point=pt_2, Strict=False)
cull_2 = CullPattern(List=pt_2, CullPattern=minc_2)

# ----
# from_robot
number_slider_8 = Slider(0.0005, range=0..0.1)
data_6 = Python3Script()  # -> DATA; same code as data
pt_15 = Point(reverse(cull_2))
py3_26 = Python3Script(segment_nr=dam.DataSegment_index, name="ps_reference_pointcloud", version=Slider(0, range=0..10))  # -> out, filename; inputs segment_nr: Int32, version: Int32; same code as py3_11
py3_27 = Python3Script(
    data=data_6,
    filename=py3_26.filename,
    points=pt_15,
    write=Toggle(False),
    remove_outliers=Toggle(True),
    remove_floor=Toggle(False),
    distance_threshold=Slider(0.006, range=0..0.1),
    resolution=number_slider_8)  # -> out, pcd_raw, pcd_pp; inputs points: list of Point3d
# ---------- py3_27: Python ----------
from compas.geometry import Vector
from compas.datastructures import Mesh
from compas.files import PLY, STL
from compas_rhino.conversions import mesh_to_compas
import os
import open3d
import numpy as np

filepath = os.path.join(data, filename)

array = [[x,y,z] for x, y, z in iter(points)]
pcd_raw = open3d.geometry.PointCloud()
pcd_raw.points = open3d.utility.Vector3dVector(array)
pcd_raw = pcd_raw.voxel_down_sample(resolution)

if write:
    open3d.io.write_point_cloud(filepath, pcd_raw, write_ascii=True)
    print("file written to ", str(filepath))

if remove_outliers:
    pcd_pp, ind = pcd_raw.remove_statistical_outlier(nb_neighbors=20, std_ratio=2.0)
else:
    pcd_pp = pcd_raw

if remove_floor:
    plane_model, inliers = pcd_pp.segment_plane(distance_threshold, ransac_n=3, num_iterations=1000)
    pcd_pp = pcd_pp.select_by_index(inliers, invert=True)
# ---------- end py3_27 ----------
panel_13 = Panel(py3_27.out)

list_15 = ValueList({"from_robot": 0, "from_file": 1}, selected="from_robot")
list_16 = ValueList({"worldXY": 0, "robot_base_plane": 1}, selected="worldXY")
filter_6 = StreamFilter(Gate=list_15, Stream0=py3_27.pcd_pp, Stream1=py3_5.pcd)
py3_28 = Python3Script(source=filter_6, base_plane=dam.DataRobot_base_plane, anchor=list_16)  # -> out, cloud_out; same code as py3_25
pt_16 = Point(py3_28.cloud_out)

robot = Data(mobile_robot.mobile_robot)

pose = Python3Script(robot=robot, get=get)  # -> out, pose_cartesian
# ---------- pose: Python ----------
from scriptcontext import sticky as st

from ur_fabrication_control.direct_control.common import get_current_pose_cartesian
from compas.geometry import Frame


server_ip = st["server_ip"]
server_port = st["server_port"]
ur_port = st["ur_port"]
ur_ip = st["ur_ip"]
pose_cartesian_meter = []
print (ur_ip)

# retrieve the current tool frame in axis angle format
if robot.attached_tool:
    print ("attached")
    tool_angle_axis = list(robot.attached_tool.frame.point) + list(robot.attached_tool.frame.axis_angle_vector)
    
else:
    tool0_frame = Frame([0, 0, 0], [1, 0, 0], [0, 1, 0])
    tool_angle_axis = list(tool0_frame.point) + list(tool0_frame.axis_angle_vector)

guid = str(ghenv.Component.InstanceGuid)
pose_cartesian_key = "pose_cartesian" + guid


if get:
    print ("getting pose")
    st[pose_cartesian_key] = get_current_pose_cartesian(tool_angle_axis, server_ip, server_port, ur_ip, ur_port, send=True)
    

if pose_cartesian_key not in st:
    pose_cartesian = []
else:
    pose_cartesian = st[pose_cartesian_key]
# ---------- end pose ----------
panel_14 = Panel(pose.out)
rec = Python3Script(msg=pose.pose_cartesian, rec=record, clear=clear)  # -> out, record, planes; inputs msg: list
# ---------- rec: Python ----------
from scriptcontext import sticky as st
from compas.geometry import Frame
from compas_rhino.conversions import frame_to_rhino_plane

guid = str(ghenv.Component.InstanceGuid)
recorded_key =  "recorded_" + guid

if recorded_key not in st:
    st[recorded_key] = []

if clear:
    st[recorded_key] = []
else:
    if len(msg):
        if msg != [None] and rec:
            st[recorded_key].append(msg)


record = st[recorded_key]
planes = []
for pose in st[recorded_key]:
    frame = Frame.from_axis_angle_vector(pose[3:6], pose[0:3])
    planes.append(frame_to_rhino_plane(frame))
print (rec)
# ---------- end rec ----------
panel_15 = Panel(rec.record)

pose_cartesian_planes = Point(rec.planes)

filter_7 = StreamFilter(Gate=list_5, Stream0=pose_cartesian_planes, Stream1=manual_points)
points_to_pcd_2 = Python3Script(points=filter_7, filepath=filepath_2, write=save_to_file_2)  # -> out, pcd; inputs points: list of Point3d; same code as points_to_pcd
filter_8 = StreamFilter(Gate=list_5, Stream0=points_to_pcd_2.pcd, Stream1=points_to_pcd_2.pcd, Stream2=pcd_from_file.pcd)
measurements_source = Data(filter_8)

tool_2 = Python3Script(robot=robot, tool=tool.tool, tool_name=list, attach=add, update=update, remove=remove)  # -> tool, M, ee_plane
# ---------- tool_2: Python ----------
if attach:
    robot.attach_tool(tool)
if remove:
    robot.detach_tool()
if update:
    robot.attached_tool.set_active_tool_frame(tool_name)
# ---------- end tool_2 ----------

info = Python3Script(robot=robot)  # -> out, main_group_name
# ---------- info: Python ----------
if robot:
    robot.info()
    main_group_name = robot.main_group_name
# ---------- end info ----------

measurements_source_2 = Data(measurements_source)
reference_target_2 = Data(reference_target)

panel_16 = Panel(info.out)

# ----
# RANSAC Global registration
toggle_10 = BooleanToggle(True)
py3_29 = Python3Script(source=measurements_source_2, target=reference_target_2, threshold=Slider(0.25, range=0..10), compute=toggle_10)  # -> out, source_out, target_out, source_at_target, plane_out, T_RANSAC
# ---------- py3_29: Python ----------
from compas.geometry import Transformation

import open3d as o3d
import Rhino.Geometry as rg

from compas.geometry import Point, Frame
from compas_rhino.conversions import point_to_rhino, frame_to_rhino_plane

from mobile_robot_control.pointcloud_processing.ransac import preprocess_point_cloud_global, execute_global_registration2

if compute: 
    source, source_fpfh = preprocess_point_cloud_global(source, threshold)
    target, target_fpfh = preprocess_point_cloud_global(target, threshold)

    result_ransac = execute_global_registration2(source, target,
                                                source_fpfh, target_fpfh,
                                                threshold)
    print(result_ransac)

    T_RANSAC = Transformation.from_matrix(list(result_ransac.transformation))
    print(T_RANSAC)
    source_out = [rg.Point3d(*pt) for pt in source.points]
    target_out = [rg.Point3d(*pt) for pt in target.points]
    source_at_target = [point_to_rhino(Point(*pt).transformed(T_RANSAC)) for pt in source.points]
    frame_out = Frame.worldXY().transformed(T_RANSAC)
    plane_out = frame_to_rhino_plane(frame_out)
# ---------- end py3_29 ----------
panel_17 = Panel(py3_29.out)
number_slider_9 = Slider(0.1, range=0..0.1)
dots = DotDisplay(Point=py3_29.source_out, Colour=ColourSwatch(SwatchColor=RGB(0, 204, 255)), Size=number_slider_9)
dots_2 = DotDisplay(Point=py3_29.target_out, Colour=ColourSwatch(SwatchColor=RGB(255, 0, 0)), Size=number_slider_9)

py3_30 = Python3Script(robot=robot, plane_RCS=rec.planes)  # -> out, plane_WCS
# ---------- py3_30: Python ----------
from compas_rhino.conversions import plane_to_compas_frame
from compas_ghpython.drawing import draw_frame

frame_RCS = plane_to_compas_frame(plane_RCS)
frame_WCS = robot.from_RCF_to_WCF(frame_RCS)

plane_WCS = draw_frame(frame_WCS)
# ---------- end py3_30 ----------

# ----
# forward kinematics
number_slider_10 = Slider(90, range=-125..120)
forward_kinematics = Python3Script(
    robot=robot,
    l=Slider(0, range=0..0.7),
    j1=Slider(153.8, range=-180..180),
    j2=Slider(-50, range=-270..150),
    j3=Slider(110, range=-180..180),
    j4=Slider(-60, range=-400..400),
    j5=number_slider_10,
    j6=Slider(0, range=-400..400))  # -> configuration
# ---------- forward_kinematics: Python ----------
import math

from compas_robots.model import Joint
from compas_robots import Configuration


if robot:
    joint_positions = [l, j1, j2, j3, j4, j5, j6]
    print (joint_positions)
    joint_types = robot.model.get_joint_types()[4:11]
    print(joint_types)
    joint_names = robot.model.get_configurable_joint_names()[4:11]
    print(joint_names)

    for i, joint_type in enumerate(joint_types):
        if joint_type == Joint.REVOLUTE:
            joint_positions[i] = math.radians(joint_positions[i])
        if joint_type == Joint.PRISMATIC:
            joint_positions[i] = joint_positions[i]
    
    configuration = Configuration(joint_positions, joint_types, joint_names)
    print (configuration)
# ---------- end forward_kinematics ----------

# ----
# Configuration
# zero configuration
zero = Python3Script(robot=robot, group=info.main_group_name)  # -> out, configuration; inputs group: String
# ---------- zero: Python ----------
configuration = robot.zero_configuration(group)
# ---------- end zero ----------

dots_3 = DotDisplay(Point=py3_29.source_at_target, Colour=ColourSwatch(SwatchColor=RGB(255, 144, 0)), Size=number_slider_9)
pln_7 = Plane(py3_30.plane_WCS)

# ----
# analytical inverse kinematics
list_17 = ValueList({"pose_cartesian": 0}, selected="pose_cartesian")
filter_9 = StreamFilter(Gate=list_17, Stream0=pln_7)
item = ListItem(List=filter_9, Index=Slider(0, range=0..150), Wrap=False)
select_configuration = Slider(0, range=0..7)
plane = Plane(item)
analytic_inverse = Python3Script(robot=robot, plane_WCS=plane, idx=select_configuration, reload=Button())  # -> out, configuration, plane_RCS, plane_tool0_RCS; inputs plane_WCS: Plane, idx: Int32
# ---------- analytic_inverse: Python ----------
import Rhino.Geometry as rg
import math
from compas.geometry import Frame, Transformation, Rotation
from compas_robots import Configuration
from ur_fabrication_control.kinematics.ur_kinematics import inverse_kinematics
from ur_fabrication_control.kinematics.ur_params import ur_params
from compas_rhino.conversions import plane_to_compas_frame
from compas_ghpython.drawing import draw_frame

robot.lift_height = 0.0059263829787234035

frame_WCS = plane_to_compas_frame(plane_WCS)

from roslibpy import tf
tf_client = tf.TFClient(robot.mobile_client.ros_client, fixed_frame="robot_base_footprint", angular_threshold=0.0, rate=10.0)
tf_client.subscribe("robot_arm_base", robot._receive_base_frame_callback)
print(robot._RCF)

# transform frame to robot coordinate system
# frame_BCS = frame_WCS.transformed(robot.transformation_WCF_BCF())
# frame_RCS = frame_BCS.transformed(robot.transformation_BCF_RCF())
frame_RCS = robot.from_WCF_to_RCF(frame_WCS)
print(frame_RCS)
# print(frame_WCS, frame_BCS, frame_RCS)
if robot.attached_tool:
    tool0_RCS = robot.from_tcf_to_t0cf([frame_RCS])[0]
else:
    tool0_RCS = frame_RCS

plane_tool0_RCS = draw_frame(tool0_RCS)
plane_RCS = draw_frame(frame_RCS)

# calculate solutions to frame
ur_params = ur_params["ur20"] # get the parameters according to the robot model
# print ur_params
solutions = inverse_kinematics(tool0_RCS, ur_params)
# print solutions

if not len(solutions):
    joint_values = [0, 0, 0, 0, 0, 0]
    configuration = Configuration.from_prismatic_and_revolute_values([0], joint_values)
else:
    joint_values = solutions[idx]
    configuration = [Configuration.from_prismatic_and_revolute_values([robot.lift_height], joint_values)]

print(configuration)
# ---------- end analytic_inverse ----------

list_18 = ValueList({"0 zero_configuration": 0, "1 forward_kinematics": 1, "2 inverse_kinematics": 2, "3 motion_planning": 3, "4 cartesian_motion_planning": 4}, selected="1 forward_kinematics")
filter_10 = StreamFilter(Gate=list_18, Stream0=zero.configuration, Stream1=forward_kinematics, Stream2=analytic_inverse.configuration)

# ----
# ICP
toggle_11 = BooleanToggle(True)
number_slider_11 = Slider(0.05, range=0..1)
py3_31 = Python3Script(
    source=measurements_source_2,
    target=reference_target_2,
    initial_guess=py3_29.plane_out,
    threshold=number_slider_11,
    compute=toggle_11)  # -> out, source_out, target_out, source_at_target, plane_out, T_ICP
# ---------- py3_31: Python ----------
from compas.geometry import Point, Frame, Transformation
from compas_rhino.conversions import point_to_rhino, frame_to_rhino_plane
import Rhino.Geometry as rg

from mobile_robot_control.pointcloud_processing.icp import preprocess_point_cloud_icp, evaluate_local_registration, execute_icp_local_registration

# source_down = preprocess_point_cloud_icp(source, voxel_size)
# target_down = preprocess_point_cloud_icp(target, voxel_size)

trans_init, evaluation = evaluate_local_registration(source, target, threshold, initial_guess)
print(evaluation)

if compute:
    registration_icp = execute_icp_local_registration(source, target, threshold, trans_init)

    print("Inlier Fitness: ", registration_icp.fitness)
    print("Inlier RMSE: ", registration_icp.inlier_rmse)

    print("Transformation: \n", registration_icp.transformation)

source_out = [rg.Point3d(*pt) for pt in source.points]
target_out = [rg.Point3d(*pt) for pt in target.points]
T_ICP = Transformation.from_matrix(list(registration_icp.transformation))
source_at_target = [point_to_rhino(Point(*pt).transformed(T_ICP)) for pt in source.points]
frame_out = Frame.worldXY().transformed(T_ICP)
plane_out = frame_to_rhino_plane(frame_out)
# ---------- end py3_31 ----------
panel_18 = Panel(py3_31.out)

dots_4 = DotDisplay(Point=py3_31.source_out, Colour=ColourSwatch(SwatchColor=RGB(0, 204, 255)), Size=number_slider)
dots_5 = DotDisplay(Point=py3_31.target_out, Colour=ColourSwatch(SwatchColor=RGB(255, 0, 0)), Size=number_slider)
dots_6 = DotDisplay(Point=py3_31.source_at_target, Colour=ColourSwatch(SwatchColor=RGB(255, 144, 0)), Size=number_slider)

# ----
# Robot plane
pln_8 = Plane(py3_31.plane_out)

# ----
# Visualisation
show_frames = BooleanToggle(True)
show_visual = BooleanToggle(True)
show_collision = BooleanToggle(True)
show_base_frame = BooleanToggle(True)
show_end_effector_frame = BooleanToggle(True)
show_acm = BooleanToggle(True)
visualise = Python3Script(
    robot=robot,
    configuration=filter_10,
    show_frames=show_frames,
    show_visual_meshes=show_visual,
    show_collision_meshes=show_collision,
    show_base_frame=show_base_frame,
    show_end_effector_frame=show_end_effector_frame,
    show_attached_collision_meshes=show_acm,
    reload=Button())  # -> out, joint_planes, visual_meshes, collision_meshes, base_plane, end_effector_plane, attched_collision_meshes
# ---------- visualise: Python ----------
from compas.geometry import Frame
from compas.geometry import Transformation
from compas_rhino.conversions import frame_to_rhino

import ghpythonlib.components as ghcomp
import Rhino.Geometry as rg

robot.update(configuration)

if show_frames == True: 
    #print(configuration)
    joint_frames = robot.model.transformed_frames(configuration)
    joint_planes = [frame_to_rhino(a) for a in joint_frames]
    joint_planes = ghcomp.Orient(joint_planes, rg.Plane.WorldXY, frame_to_rhino(robot.BCF))[0]

if show_base_frame == True:
    show_base_frame = robot.model.forward_kinematics(configuration, robot.model.get_base_link_name())
    #print(show_base_frame)
    base_plane = frame_to_rhino(show_base_frame) 

if show_end_effector_frame == True:
    # print(robot.get_joint_by_name("robot_arm_flange-tool0"))
    tool0_frame = robot.model.forward_kinematics(configuration, "robot_arm_tool0")
    end_effector_frame = robot.from_t0cf_to_tcf([tool0_frame])[0]
    #print(end_effector_frame)
    end_effector_plane = frame_to_rhino(end_effector_frame)
    end_effector_plane = ghcomp.Orient(end_effector_plane, rg.Plane.WorldXY, frame_to_rhino(robot.BCF))[0]

if show_visual_meshes == True:
    visual_meshes = robot.draw_visual()
    visual_meshes = ghcomp.Orient(visual_meshes, rg.Plane.WorldXY, frame_to_rhino(robot.BCF))[0]

if show_collision_meshes == True:
    collision_meshes = robot.draw_collision()

if show_attached_collision_meshes == True:
    pass
# ---------- end visualise ----------
py3_32 = Python3Script(planes=[visualise.joint_planes, visualise.end_effector_plane], scale=Slider(0.2, range=0..1))  # -> P, V, C, W; inputs planes: list of Plane, scale: Double
# ---------- py3_32: Python ----------
from Rhino.Display import ColorRGBA
from ghpythonlib.components import ColourRGBf


red = ColourRGBf(255, 255, 0, 0)
green = ColourRGBf(255, 0, 255, 0)
blue = ColourRGBf(255, 0, 0, 255)

P = []
V = []
C = []

# scale = float(scale)

for plane in planes:
    if not plane:
        continue
    P += [plane.Origin] * 3
    V.append(plane.XAxis * scale)
    V.append(plane.YAxis * scale)
    V.append(plane.ZAxis * scale)
    C += [red, green, blue]

W = 3
# ---------- end py3_32 ----------
mesh_5 = Mesh(visualise.visual_meshes)
pln_9 = Plane(visualise.joint_planes)
pln_10 = Plane(visualise.base_plane)
mesh_6 = Mesh(visualise.collision_meshes)
pln_11 = Plane(visualise.end_effector_plane)
preview_5 = CustomPreview(Geometry=mesh_5, Material=ColourSwatch(SwatchColor=RGB(255, 255, 255)))
vdisex = VectorDisplayEx(Point=py3_32.P, Vector=py3_32.V, Colour=py3_32.C, Width=py3_32.W)

bp = Python3Script(point=base_origin, angle=angle)  # -> base_plane; inputs point: Point3d
# ---------- bp: Python ----------
import Rhino.Geometry as rg
import math

base_plane = rg.Plane(point, rg.Vector3d.XAxis, rg.Vector3d.YAxis)
base_plane.Rotate(math.radians(angle), rg.Vector3d.ZAxis)
# ---------- end bp ----------

filter_11 = StreamFilter(Gate=list_2, Stream0=bp, Stream1=pln_3, Stream2=pln, Stream3=pln_2)

py3_33 = Python3Script(robot=robot, use_rhino_worldXY=worldxy, custom_plane=filter_11)  # -> out, base_plane, arm_base_plane; inputs custom_plane: Plane
# ---------- py3_33: Python ----------
from compas.geometry import Frame
from compas_rhino.conversions import frame_to_rhino_plane

if use_rhino_worldXY:
    base_frame = Frame.worldXY()
else:
    base_frame = Frame(custom_plane.Origin, custom_plane.XAxis, custom_plane.YAxis)


# Base_frame is BCF in WCF
if robot:
    robot.BCF = base_frame
    print(robot.BCF)

base_plane = frame_to_rhino_plane(base_frame)
arm_base_plane = frame_to_rhino_plane(robot.RCF)
# ---------- end py3_33 ----------

# ----
# ICP
number_slider_12 = Slider(0.02, range=0..1)

py3_34 = Python3Script(
    source=filter_5,
    target=filter_6,
    initial_guess=pln_6,
    voxel_size=number_slider_12,
    threshold=Slider(0.02, range=0..0.5),
    compute=Toggle(True))  # -> out, cloud_out, target_out, T_ICP; same code as py3_19
preview_6 = CustomPreview(Geometry=py3_34.target_out, Material=swatch)

py3_35 = Python3Script(source=py3_34.cloud_out, transformation=py3_34.T_ICP)  # -> out, robot_plane, cloud_out; inputs source: list of Point3d; same code as py3_18
panel_19 = Panel(py3_34.out)
pt_17 = Point(py3_35.cloud_out)
pln_12 = Plane(py3_35.robot_plane)
preview_7 = CustomPreview(Geometry=pt_17, Material=ColourSwatch(SwatchColor=RGB(26, 176, 0)))
