# Grasshopper definition r8_example_mobile_robot_brick_assembly.ghx (Grasshopper 1.0.8)
# plug-ins: RhinoCodePluginGH, MetaHopper

# ----
# IP Settings
# --> Set your IP address
# --> Set robot IP address
server_ip = ValueList({"192.168.10.44", "192.168.10.12", "192.168.10.11", "192.168.10.10", "192.168.10.2", "127.0.0.1", "192.168.10.111", "192.168.0.250", "192.168.0.30", "10.42.0.212", "10.42.0.133"}, selected="192.168.0.250")
server_port = ValueList({"50002", "50003", "50005", "50006", "50007", "50008", "50009", "50010", "50011", "50012", "50013", "50014", "50015", "50016", "50017", "50018", "50019", "50020", "50021", "50022", "50023", "50024", "50025", "50026", "50027", "50028"}, selected="50012")
ur_ip = ValueList({"192.168.10.10", "192.168.10.20", "192.168.10.11", "192.168.10.12", "127.0.0.1", "192.168.10.111", "192.168.0.210", "192.168.0.211", "192.168.0.30"}, selected="192.168.0.210")
ur_port = ValueList({"30002"}, selected="30002")
globals = Python3Script(server_ip=server_ip, server_port=server_port, ur_ip=ur_ip, ur_port=ur_port, clear=Button())  # inputs server_ip: String, server_port: Int32, ur_ip: String, ur_port: Int32
# ---------- globals: Python ----------
from scriptcontext import sticky as st

st["server_ip"] = server_ip
st["server_port"] = server_port

st["ur_ip"] = ur_ip
st["ur_port"] = ur_port

if clear:
    st.clear()
# ---------- end globals ----------

# ----
# Check if UR robot
#  is available
ping = Button()
ping_2 = Python3Script(ip=ur_ip, ping=ping)  # -> out; inputs ip: String
# ---------- ping_2: Python ----------
from scriptcontext import sticky as st
from ur_fabrication_control.direct_control.utilities import is_available

guid = str(ghenv.Component.InstanceGuid)
txt_key = "txt_" + guid
if txt_key not in st:
    st[txt_key] = ""

if ping:
    
    available = is_available(ip)
    
    if available:
        st[txt_key] = "%s is up!" % ip
        trigger = True
    else:
        st[txt_key] = "%s is down!" % ip
        trigger = False

print(st[txt_key])
# ---------- end ping_2 ----------
panel = Panel(ping_2)

reload = Button()
# ROBOT
py3 = Python3Script()  # -> HERE, DATA, ROBOT_DESCRIPTION
# ---------- py3: Python ----------
import os

HERE = os.path.dirname(ghdoc.Path)
DATA = os.path.abspath(os.path.join(HERE, "..", "data"))
ROBOT_DESCRIPTION = os.path.abspath(os.path.join(DATA, "robot_description"))

print(HERE)
print(DATA)
print(ROBOT_DESCRIPTION)
# ---------- end py3 ----------
reload_2 = Python3Script(reload=reload)  # -> out
# ---------- reload_2: Python ----------
if reload:
    from compas_rhino import unload_modules
    unload_modules("assembly_information_model")
    unload_modules('ur_fabrication_control')
# ---------- end reload_2 ----------

list = ValueList({"left": 0, "right": 1}, selected="right")

# ----
# ROS client
list_2 = ValueList({"local": "127.0.0.1", "linux computer": "192.168.0.42", "linux eduroam": "10.181.95.254", "linux ccnet": "192.168.0.102", "linux vmware": "192.168.199.36", "robot": "192.168.0.200", "robotAA_wifi": "192.168.0.111", "robotAB_wifi": "192.168.0.112", "robotAB_eduroam": "10.181.67.95"}, selected="robot")
connect = BooleanToggle(True)
ros = Python3Script(ip=list_2, port="9090", connect=connect)  # -> out, ros_client, is_connected; inputs ip: String, port: Int32, connect: Boolean
# ---------- ros: Python ----------
"""
Connect or disconnect to ROS.

COMPAS FAB v0.27.0
"""
from scriptcontext import sticky as st

from compas_fab.backends import RosClient

ros_client = None

ip = ip or '127.0.0.1'
port = port or 9090
key = "ros_client_001"
ros_client = st.get(key, None)

if ros_client:
    st[key].close()
if connect:
    st[key] = RosClient(ip, port)
    st[key].run(5)

ros_client = st.get(key, None)
is_connected = ros_client.is_connected if ros_client else False
# ---------- end ros ----------
panel_2 = Panel(ros.is_connected)

# ----
# Load robot from ROS
load = Button()
# Make sure that ros bridge, file server, tf2_web_republisher and moveit config is running on the robot!
panel_3 = Panel("")
mobile_robot = Python3Script(ros_client=ros.ros_client, prefix=panel_3, load=load)  # -> out, mobile_robot; inputs prefix: String
# ---------- mobile_robot: Python ----------
"""
Load robot directly from ROS.

COMPAS FAB v0.27.0
"""
from mobile_robot_control.mobile_robot import MobileRobot
from mobile_robot_control.mobile_robot_client import MobileRobotClient
import compas_robots.ghpython

# from ghpythonlib.componentbase import executingcomponent as component
from scriptcontext import sticky as st
import Rhino
import scriptcontext

scriptcontext.doc = Rhino.RhinoDoc.ActiveDoc

from compas_robots import RobotModel
from compas_robots.ghpython.scene import RobotModelObject

scriptcontext.doc = ghdoc

key = 'robot_AA'
print(key)
if ros_client and ros_client.is_connected and load:
    # Load URDF from ROS
    robot = ros_client.load_robot(
            load_geometry=True, 
            urdf_param_name= '{}/robot_description'.format(prefix),
            srdf_param_name= '{}/robot_description_semantic'.format(prefix))
    robot.scene_object = RobotModelObject(robot.model)
    mobile_robot = MobileRobot(robot.model, robot.scene_object, robot.semantics, client=None)
    st[key] = mobile_robot

mobile_robot = st.get(key, None)
if mobile_robot:  # client sometimes need to be restarted, without needing to reload geometry
    mobile_robot.mobile_client = MobileRobotClient(ros_client)
    mobile_robot.client = ros_client
# ---------- end mobile_robot ----------

controller_active = BooleanToggle(True)
controller_active_2 = BooleanToggle(True)
compute = Button()
place = Button()
next = Button()
selobj = GetSelectedObjects(AllObjects_Object=next)  # -> ComponentObjects, ParamObjects, OtherObjects
selobj_2 = GetSelectedObjects(AllObjects_Object=compute)  # -> ComponentObjects, ParamObjects, OtherObjects
selobj_3 = GetSelectedObjects(AllObjects_Object=place)  # -> ComponentObjects, ParamObjects, OtherObjects

robot = Data(mobile_robot.mobile_robot)
info = Python3Script(robot=robot)  # -> out, main_group_name
# ---------- info: Python ----------
if robot:
    robot.info()
    main_group_name = robot.main_group_name
# ---------- end info ----------
panel_4 = Panel(info.out)

# ----
# Attach tool
list_3 = ValueList({"measurement tool": 0, "area gripper": 1}, selected="area gripper")
show = BooleanToggle(False)
path = Python3Script()  # -> DATA
# ---------- path: Python ----------
import os

package_path = ghdoc.Path
DATA = os.path.abspath(os.path.join(package_path,"../../data"))

print(package_path)
print(DATA)
# ---------- end path ----------
tool = Python3Script(data_path=path, tool=list_3, show=show)  # -> tool, M, ee_plane; inputs data_path: String
# ---------- tool: Python ----------
import os, math
from compas.geometry import Frame, Rotation, Vector
from compas.datastructures import Mesh
from compas_rhino.conversions import mesh_to_rhino, frame_to_rhino_plane
from compas_fab.robots import Tool

tolerance = 0

if tool == 0:
    filename = 'measurement_tool_zaxis.stl'
    ee_frame = Frame([0, 0, 0.109], [1, 0, 0], [0, 1, 0])

elif tool == 1:
    filename = 'vacuum_gripper_ur20_zaxis.stl'
    ee_frame = Frame([0, 0, 0.145 + tolerance], [1, 0, 0], [0, 1, 0])

data_path = os.path.join(data_path, "tool_geometry")
fullfilename = os.path.join(data_path, filename)

ee_mesh = Mesh.from_stl(fullfilename)

if show:
    M = mesh_to_rhino(ee_mesh)

tool = Tool(ee_mesh, ee_frame)
ee_plane = frame_to_rhino_plane(ee_frame)
print(ee_frame.quaternion.xyzw)
ee_framek = Frame([0.0110607,0.00809854,0.41498], [0,1,0], [1,0,0])
print(ee_framek.quaternion.xyzw)
# ---------- end tool ----------
remove = Button()
attach = Button()
mesh = Mesh(tool.M)
attach_tool = Python3Script(robot=robot, tool=tool.tool, attach=attach, remove=remove)  # -> tool, M, ee_plane, bang
# ---------- attach_tool: Python ----------
print(robot.get_group_names_from_link_name("robot_arm_flange"))

if attach:
    for planning_group in robot.get_group_names_from_link_name("robot_arm_flange"):
        robot.attach_tool(tool, group=planning_group)
if remove:
    for planning_group in robot.get_group_names_from_link_name("robot_arm_flange"):
        robot.detach_tool(group=planning_group)
# ---------- end attach_tool ----------

# ----
# Move mobile robot base
list_4 = ValueList({"origin", "set_to_BCF", "set_to_RCF"}, selected="origin")
origin = Point(Point(1, -1, 0))
angle = Slider(0, range=0..360)
plane = Python3Script(origin=origin, angle=angle)  # -> plane; inputs origin: Point3d
# ---------- plane: Python ----------
import Rhino.Geometry as rg
import math

plane = rg.Plane(origin, rg.Vector3d.XAxis, rg.Vector3d.YAxis)
plane.Rotate(math.radians(angle), rg.Vector3d.ZAxis)
# ---------- end plane ----------
set_frame = Python3Script(robot=robot, set_frame_to=list_4, target_BCF=plane, target_RCF=plane)  # -> bang; inputs target_BCF: Plane, target_RCF: Plane
# ---------- set_frame: Python ----------
from compas_ghpython import draw_frame
from compas.geometry import Frame, Point, Vector, Transformation
from compas.datastructures import Mesh
from compas_fab.robots import CollisionMesh
from compas_rhino.conversions import plane_to_compas_frame

if set_frame_to == "set_to_BCF":
    BCF = plane_to_compas_frame(target_BCF)
elif set_frame_to == "set_to_RCF":
    RCF = plane_to_compas_frame(target_RCF)
    BCF = robot.transform_frame_from_RCF_to_BCF(RCF)
else:
    BCF = Frame.worldXY()

if robot:
    robot.BCF = BCF
# ---------- end set_frame ----------

# ----
# Planning scene
scene = Python3Script(robot=robot)  # -> scene
# ---------- scene: Python ----------
"""
Create a planning scene.

COMPAS FAB v0.28.0
"""

from ghpythonlib.componentbase import executingcomponent as component
from scriptcontext import sticky as st

from compas_fab.ghpython.components import create_id
from compas_fab.robots import PlanningScene


class PlanningSceneComponent(component):
    def RunScript(self, robot):
        key = "planning_scene"
        if robot:
            st[key] = PlanningScene(robot)
        return st.get(key, None)
# ---------- end scene ----------

# ----
# Attach collision mesh to scene
append = Button()
remove_2 = Button()
add = Button()
mesh_object = Mesh(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)
mesh_table = Mesh(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)
collision_mesh = Python3Script(scene=scene, mesh=mesh_table, identifier="table", add=add, append=append, remove=remove_2)  # -> ok, bang; inputs mesh: Mesh, identifier: String
# ---------- collision_mesh: Python ----------
"""
Add or remove a collision mesh from the planning scene.
"""

from compas_rhino.conversions import mesh_to_compas
from compas_fab.robots import CollisionMesh

ok = False
Message = ""

if (add and append) or (append and remove) or (add and remove):
    Message = "Use only one operation at a time\n(add, append or remove)"
    raise Exception(Message)

if scene and mesh and identifier:
    compas_mesh = mesh_to_compas(mesh)
    collision_mesh = CollisionMesh(compas_mesh, identifier)
    if add:
        scene.add_collision_mesh(collision_mesh)
        Message = "Added"
        ok = True
    if append:
        scene.append_collision_mesh(collision_mesh)
        Message = "Appended"
        ok = True
    if remove:
        scene.remove_collision_mesh(identifier)
        Message = "Removed"
        ok = True
# ---------- end collision_mesh ----------
panel_5 = Panel(collision_mesh.ok)

# ----
# Attach collision mesh to robot
panel_6 = Panel("attached_brick")
remove_3 = Button()
add_2 = Button()
mesh_2 = Mesh(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)
attached_collision_mesh = Python3Script(scene=scene, mesh=mesh_2, identifier=panel_6, link_name="ee_link", touch_links="ee_link", add=add_2, remove=remove_3)  # -> out, attached_collision_mesh, bang; inputs mesh: Mesh
# ---------- attached_collision_mesh: Python ----------
"""
Add an attached collision mesh to the robot.

COMPAS FAB v0.28.0
"""

from compas_rhino.conversions import mesh_to_compas
from ghpythonlib.componentbase import executingcomponent as component

from compas_fab.robots import AttachedCollisionMesh
from compas_fab.robots import CollisionMesh

from compas_ghpython import create_id
import Rhino

class AttachedCollisionMeshComponent(component):
    def RunScript(self,
            scene,
            mesh: Rhino.Geometry.Mesh,
            identifier,
            link_name,
            touch_links,
            add,
            remove):
        attached_collision_mesh = None
        if scene and mesh and identifier and link_name:
            compas_mesh = mesh_to_compas(mesh)
            collision_mesh = CollisionMesh(compas_mesh, identifier)
            attached_collision_mesh = AttachedCollisionMesh(collision_mesh, link_name, touch_links)
            if add:
                scene.add_attached_collision_mesh(attached_collision_mesh)
            if remove:
                scene.remove_attached_collision_mesh(identifier)
                scene.remove_collision_mesh(identifier)
        return attached_collision_mesh
# ---------- end attached_collision_mesh ----------
panel_7 = Panel(attached_collision_mesh.attached_collision_mesh)

keyslider = KeyboardSlider(button=selobj.ParamObjects, active=controller_active)  # inputs active: Boolean
# ---------- keyslider: C# usings ----------
using System.Windows.Forms;
using Grasshopper.Kernel.Special;
# ---------- keyslider: C# ----------
    _btn = (GH_ButtonObject) button;
    Instances.DocumentEditor.KeyDown -= new KeyEventHandler(KeyDownEventHandler1);
    Instances.DocumentEditor.KeyUp -= new KeyEventHandler(KeyUpEventHandler1);
    if(active)
    {
      Instances.DocumentEditor.KeyDown += new KeyEventHandler(KeyDownEventHandler1);
      Instances.DocumentEditor.KeyUp += new KeyEventHandler(KeyUpEventHandler1);
    }
# ---------- keyslider: C# additional code ----------
  GH_ButtonObject _btn;
  void KeyDownEventHandler1(object sender, KeyEventArgs e)
  {
    if(e.KeyCode != Keys.F12|| _btn.ButtonDown) return;
    _btn.ButtonDown = true;
    _btn.ExpireSolution(true);
  }
  void KeyUpEventHandler1(object sender, KeyEventArgs e)
  {
    if(e.KeyCode != Keys.F12 || !_btn.ButtonDown) return;
    _btn.ButtonDown = false;
    _btn.ExpireSolution(true);
  }
# ---------- end keyslider ----------
keyslider_2 = KeyboardSlider(btn_1=selobj_2.ParamObjects, btn_2=selobj_3.ParamObjects, active=controller_active_2)  # inputs active: Boolean
# ---------- keyslider_2: C# ----------
    _btn1 = (GH_ButtonObject) btn_1;
    Instances.DocumentEditor.KeyDown -= new KeyEventHandler(KeyDownEventHandler_1);
    Instances.DocumentEditor.KeyUp -= new KeyEventHandler(KeyUpEventHandler_1);

    _btn2 = (GH_ButtonObject) btn_2;
    Instances.DocumentEditor.KeyDown -= new KeyEventHandler(KeyDownEventHandler_2);
    Instances.DocumentEditor.KeyUp -= new KeyEventHandler(KeyUpEventHandler_2);

    if(active)
    {
      Instances.DocumentEditor.KeyDown += new KeyEventHandler(KeyDownEventHandler_1);
      Instances.DocumentEditor.KeyUp += new KeyEventHandler(KeyUpEventHandler_1);

      Instances.DocumentEditor.KeyDown += new KeyEventHandler(KeyDownEventHandler_2);
      Instances.DocumentEditor.KeyUp += new KeyEventHandler(KeyUpEventHandler_2);
    }
# ---------- keyslider_2: C# additional code ----------
  GH_ButtonObject _btn1;
  void KeyDownEventHandler_1(object sender, KeyEventArgs e)
  {
    if(e.KeyCode != Keys.F9 || _btn1.ButtonDown) return;
    _btn1.ButtonDown = true;
    _btn1.ExpireSolution(true);
  }
  void KeyUpEventHandler_1(object sender, KeyEventArgs e)
  {
    if(e.KeyCode != Keys.F9 || !_btn1.ButtonDown) return;
    _btn1.ButtonDown = false;
    _btn1.ExpireSolution(true);
  }

  GH_ButtonObject _btn2;
  void KeyDownEventHandler_2(object sender, KeyEventArgs e)
  {
    if(e.KeyCode != Keys.F11 || _btn2.ButtonDown) return;
    _btn2.ButtonDown = true;
    _btn2.ExpireSolution(true);
  }
  void KeyUpEventHandler_2(object sender, KeyEventArgs e)
  {
    if(e.KeyCode != Keys.F11 || !_btn2.ButtonDown) return;
    _btn2.ButtonDown = false;
    _btn2.ExpireSolution(true);
  }
# ---------- end keyslider_2 ----------

# ----
# Import from JSON
# Import assembly, make sure it is at a correct location.
# 
# Fabrication steps:
# 
# 1. In Draw, select "show until key" and choose the brick you want to assemble with the counter.
# 
# 2. In Plan Motion, compute the motion plan for the selected brick.
# 
# 3. In Fabrication routines, select the routine you want to execute, your speed, and send the command to the robot.
import = Button()
# Assembly
path_2 = Python3Script()  # -> out, DATA
# ---------- path_2: Python ----------
import os
import ghpythonlib.components as ghcomp
import getpass

username = getpass.getuser()
USER_FOLDER = os.path.abspath(os.path.join("C:/Users/", username))
DATA = os.path.abspath(os.path.join(USER_FOLDER,"workspace/mobile_robot_control/data/assembly_example"))

ghComp = ghenv.Component
ghDoc = ghComp.OnPingDocument()

# the full path of the gh file
path_gh_file = ghDoc.FilePath

# the directory of the gh file
#HERE = os.path.dirname(path_gh_file)
#DATA = os.path.join(HERE, 'data')

print(DATA)
# ---------- end path_2 ----------
import_2 = Python3Script(DATA=path_2.DATA, import=import)  # -> out, assembly; inputs DATA: String
# ---------- import_2: Python ----------
import os
import json
from assembly_information_model.assembly import Assembly
from scriptcontext import sticky as st

if _import:
    filename = "bench_v03.json"
    PATH = os.path.join(DATA, filename)
    print(PATH)
    # the assembly has to be serialized such that it can be called from CPython
    assembly = Assembly.from_json(PATH)
    st['assembly'] = assembly

assembly = st.get('assembly')
# ---------- end import_2 ----------

# ----
# real robot values
subscribe = Button()
unsubscribe = Button()
get_joint_states = Python3Script(robot=robot, subscribe=subscribe, unsubscribe=unsubscribe)
# ---------- get_joint_states: Python ----------
if subscribe:
    robot.mobile_client.joint_states_subscribe()

if unsubscribe:
    robot.mobile_client.joint_states_unsubscribe()

#robot.mobile_client.tf_subscribe("robot_arm_base", "robot_base_footprint")
#print('x')
# ---------- end get_joint_states ----------
trigger = Trigger(Interval=2000, TimerInterval=2000, Target=draw)  # disabled
draw = Python3Script(robot=robot)  # -> configuration
# ---------- draw: Python ----------
from compas_robots import Configuration

configuration = robot.mobile_client.get_current_configuration()
print(configuration)
# ---------- end draw ----------

right_plane = Plane(Plane(origin=(0, -0.6, 1.1), x=(-1, 0, 0), y=(0, 1, 0)))
left_plane = Plane(Plane(origin=(0, 0.6, 1.1), x=(1, 0, 0), y=(0, -1, 0)))
number_slider = Slider(0, range=0..40)

# ----
# forward kinematics
number_slider_2 = Slider(-60, range=-180..180)
forward_kinematics = Python3Script(
    robot=robot,
    lift=number_slider,
    j1=number_slider_2,
    j2=Slider(-67, range=-360..360),
    j3=Slider(119, range=-180..180),
    j4=Slider(-47, range=-400..400),
    j5=Slider(119, range=-125..120),
    j6=Slider(0, range=-400..400))  # -> configuration
# ---------- forward_kinematics: Python ----------
import math

from compas_robots.model import Joint
from compas_robots import Configuration


if robot:
    joint_types = robot.get_configurable_joint_types()
    joint_names = robot.get_configurable_joint_names()

    joint_values = [j1, j2, j3, j4, j5, j6]
    for i, joint_value in enumerate(joint_values):
        joint_values[i] = math.radians(joint_values[i])
    
    if len(robot.get_configurable_joints()) == 6:
        configuration = Configuration(joint_values, joint_types, joint_names)
    else:
        configuration = Configuration.from_prismatic_and_revolute_values([lift], joint_values)
    print (configuration)
    configuration = Configuration((0.006, -0.716, -1.187, 2.378, 0.448, 1.464,  0.852), (2, 0, 0, 0, 0, 0, 0), ('robot_ewellix_lift_top_joint', 'robot_arm_shoulder_pan_joint', 'robot_arm_shoulder_lift_joint', 'robot_arm_elbow_joint', 'robot_arm_wrist_1_joint', 'robot_arm_wrist_2_joint', 'robot_arm_wrist_3_joint'))
# ---------- end forward_kinematics ----------

# ----
# Configuration
# zero configuration
zero = Python3Script(robot=robot, group=info.main_group_name)  # -> out, configuration; inputs group: String
# ---------- zero: Python ----------
configuration = robot.zero_configuration(group)
# ---------- end zero ----------

# ----
# inverse kinematics
list_5 = ValueList({"ur20", "ur20_and_liftkit"}, selected="ur20")
compute_2 = Button()
inverse = Python3Script(robot=robot, group=list_5, compute=compute_2)  # -> out, configuration
# ---------- inverse: Python ----------
"""
Calculate the robot's inverse kinematic for a given plane.

COMPAS FAB v1.0.2
"""

from compas_rhino.conversions import plane_to_compas_frame
from ghpythonlib.componentbase import executingcomponent as component
from scriptcontext import sticky as st


class InverseKinematics(component):
    def RunScript(self, robot, plane, start_configuration, group, compute):
        key = "inverse_solution"
        configuration = None
        if robot and robot.client and robot.client.is_connected and plane and compute:
            frame = plane_to_compas_frame(plane)
            configuration = robot.inverse_kinematics(frame, start_configuration, group)
            st["inverse_solution"] = configuration
        configuration = st.get("inverse_solution", None)
        print(configuration)
        return configuration
# ---------- end inverse ----------

# ----
# Transform Assembly
toggle = BooleanToggle(True)
cp_new = Plane(Plane(origin=(0.6, 0, 0), x=(0, -1, 0), y=(1, 0, 0)))
cp = Plane(PlaneXY(0, 0, 0))
transform_assembly = Python3Script(assembly=import_2.assembly, transform=toggle, center_plane=cp, center_plane_new=cp_new)  # -> out, assembly
# ---------- transform_assembly: Python ----------
from compas.geometry import Frame, Transformation, Rotation, Translation
from compas_rhino.conversions import plane_to_compas_frame, point_to_rhino

center_frame = plane_to_compas_frame(center_plane)
center_frame_new = plane_to_compas_frame(center_plane_new)


if transform:
    T = Transformation.from_frame_to_frame(center_frame, center_frame_new)
    assembly = assembly.transformed(T)
# ---------- end transform_assembly ----------

# ----
# 1.
reset = Button()
list_6 = ValueList({"20", "50", "100", "500", "1000", "5000"}, selected="500")
back = Button()
start = Button()
stop = Button()
step = Button()
full = Button()
counter = Python3Script(
    my_assembly=transform_assembly.assembly,
    start=start,
    stop=stop,
    step=next,
    step_back=back,
    reset=reset,
    full=full,
    interval=list_6)  # -> out, counter
# ---------- counter: Python ----------
from scriptcontext import sticky as st
import Grasshopper

def update_component(ghenv, delay):
    """Schedule an update of the Grasshopper component.

    After the specified delay, the GH component will be automatically updated.

    Parameters
    ----------
    ghenv : :class:`GhPython.Component.PythonEnvironment`
        The current GHPython environment.
    delay : :obj:`int`
        Time in milliseconds until the update is performed.

    Raises
    ------
    ValueError
        If the delay is less than zero.

    """
    if delay <= 0:
        raise ValueError("Delay must be greater than zero")

    ghcomp = ghenv.Component
    ghdoc = ghcomp.OnPingDocument()

    def callback(ghdoc):
        if ghdoc.SolutionState != Grasshopper.Kernel.GH_ProcessStep.Process:
            ghcomp.ExpireSolution(False)

    ghdoc.ScheduleSolution(delay, Grasshopper.Kernel.GH_Document.GH_ScheduleDelegate(callback))

L = range(my_assembly.graph.number_of_nodes())

# store data in component
guid = str(ghenv.Component.InstanceGuid)
counter_key = "counter_" + guid
running_key = "running_" + guid

if counter_key not in st:
    st[counter_key] = 0

if running_key not in st:
    st[running_key] = False
    

if st[running_key]:
    if st[counter_key] < len(L) - 1:
        st[counter_key] += 1
        update_component(ghenv, interval)
    else:
        st[counter_key] = 0
        st[running_key] = False
    
if start:
    st[running_key] = True

if stop:
    st[running_key] = False

if step:
    if st[counter_key] < len(L) - 1:
        st[counter_key] += 1

if step_back:
    if st[counter_key] < len(L) - 1:
        st[counter_key] -= 1

if reset:
    st[counter_key] = 0
    st[running_key] = False

if full:
    st[counter_key] = len(L)-1

if len(L):
    item = L[st[counter_key]]


#st["visualisation_counter"] = st[counter_key]
counter = st[counter_key]+1
# ---------- end counter ----------
panel_8 = Panel(counter.counter)

# ----
# Draw
list_7 = ValueList({"show all": "show_all", "show until key": "show_until_key"}, selected="show until key")
visualize = Python3Script(
    assembly=transform_assembly.assembly,
    show=list_7,
    highlight_current_part=Toggle(True),
    show_connections=Toggle(False),
    counter=counter.counter)  # -> out, parts_geometry, parts_frame, parts_points, current_part_geometry, current_part_frame, connections
# ---------- visualize: Python ----------
from compas_rhino.conversions import mesh_to_rhino, box_to_rhino, frame_to_rhino, line_to_rhino, point_to_rhino
from compas.geometry import Line

#print assembly
print(assembly)

#get parts datastructure
parts = [p for p in assembly.parts()]

if show == "show_all":
    
    #extract the mesh of the parts for visulization (+ converted to rhino mesh)
    parts_geometry = [mesh_to_rhino(p.mesh) for p in parts]
    
    #extract the frame of the parts for visulization (+ converted to rhino plane)
    parts_frame = [frame_to_rhino(p.frame) for p in parts]

    key = assembly.graph.number_of_nodes()-1

if show == "show_until_key":
    #extract the mesh of the parts for visulization (+ converted to rhino mesh)
    parts_geometry = [mesh_to_rhino(p.mesh) for p in parts[0:counter]]
    
    #extract the frame of the parts for visulization (+ converted to rhino plane)
    parts_frame = [frame_to_rhino(p.frame) for p in parts[0:counter]]

    key = counter-1

if highlight_current_part:
    current_part = assembly.part(key)
    current_part_geometry = mesh_to_rhino(current_part.mesh)
    current_part_frame = frame_to_rhino(current_part.frame)

if show_connections:
    connections = [line_to_rhino(Line(assembly.find_by_key(start).frame.point, assembly.find_by_key(end).frame.point)) for start, end in assembly.graph.edges()]
    
    #extract points of the frame of the parts for visulization (+ converted to rhino point)
    parts_points = [point_to_rhino(p.frame.point) for p in assembly.parts()]
# ---------- end visualize ----------
panel_9 = Panel(visualize.out)
geo = Geometry(visualize.parts_geometry)
geo_2 = Geometry(visualize.parts_frame)
geo_3 = Geometry([visualize.current_part_geometry, visualize.current_part_frame])
line = Line(visualize.connections)
preview = CustomPreview(Geometry=geo, Material=ColourSwatch(SwatchColor=RGBA(255, 227, 227, 216)))
preview_2 = CustomPreview(Geometry=geo_2, Material=ColourSwatch(SwatchColor=RGB(214, 71, 152)))
preview_3 = CustomPreview(Geometry=visualize.parts_points, Material=ColourSwatch(SwatchColor=RGB(0, 0, 0)))
preview_4 = CustomPreview(Geometry=geo_3, Material=ColourSwatch(SwatchColor=RGB(235, 16, 71)))
preview_5 = CustomPreview(Geometry=line, Material=ColourSwatch(SwatchColor=RGB(255, 125, 157)))

show_rcf = BooleanToggle(True)
show_robot_collision = BooleanToggle(False)
pln = Plane(Plane(origin=(1.630467741, 0.2394988522, 1.123755367), x=(-0.4120286439, -0.7623659212, -0.4990296572), y=(-0.6723263342, 0.6240251434, -0.3982083885)))

# ----
# Assembly fabrication
# Fabrication Settings
safe_planes = Python3Script(assembly=transform_assembly.assembly, counter=counter.counter)  # -> approaching_from, pick_config, safe_pick_config, mid_config, place_plane, safe_place_plane
# ---------- safe_planes: Python ----------
from compas_rhino.conversions import plane_to_compas_frame, frame_to_rhino
from compas.geometry import Translation, Vector, Rotation
from compas_robots import Configuration
import math

T = Translation.from_vector(Vector.Zaxis()*0.2)

#pick_frame = plane_to_compas_frame(pick_plane)
#safe_pick_frame = pick_frame.transformed(T)
#safe_pick_plane = frame_to_rhino(safe_pick_frame)

key = counter-1
current_part = assembly.part(key)

place_frame = current_part.frame
place_plane = frame_to_rhino(place_frame)
safe_place_plane = frame_to_rhino(place_frame.transformed(T))

#callibrate pick config and safe pick config
pick_config = Configuration((-0.660, -0.781, 2.383, 0.030, 1.460, 0.912), (0, 0, 0, 0, 0, 0), ('robot_arm_shoulder_pan_joint', 'robot_arm_shoulder_lift_joint', 'robot_arm_elbow_joint', 'robot_arm_wrist_1_joint', 'robot_arm_wrist_2_joint', 'robot_arm_wrist_3_joint'))
safe_pick_config = Configuration((-0.716, -1.187, 2.378, 0.448, 1.464,  0.852), (0, 0, 0, 0, 0, 0), ('robot_arm_shoulder_pan_joint', 'robot_arm_shoulder_lift_joint', 'robot_arm_elbow_joint', 'robot_arm_wrist_1_joint', 'robot_arm_wrist_2_joint', 'robot_arm_wrist_3_joint'))



#if approach_from == 0:
if place_frame.point.y > 0:
    approaching_from = "left"
    mid_config = Configuration((0.000, -1.450, -1.063, 2.103, 0.531, 1.571, 0.121), (2, 0, 0, 0, 0, 0, 0))

else:
    approaching_from = "right"
    mid_config = Configuration((0.000, 0.832, -1.063, 2.103, 0.531, 1.571, -0.739), (2, 0, 0, 0, 0, 0, 0))
# ---------- end safe_planes ----------
panel_10 = Panel(safe_planes.approaching_from)

# ----
# analytical inverse kinematics
select_configuration = Slider(0, range=0..7)
plane_2 = Plane(Plane(origin=(0, -1, 0), x=(-1, 0, 0), y=(0, 1, 0)))
analytic_inverse = Python3Script(robot=robot, lift=number_slider, plane=safe_planes.place_plane, idx=select_configuration)  # -> out, configuration, plane_RCF, plane_tool0_RCF; inputs plane: Plane, idx: Int32
# ---------- analytic_inverse: Python ----------
import Rhino.Geometry as rg
import math
from compas.geometry import Frame, Transformation, Rotation
from compas_robots import Configuration
from ur_fabrication_control.kinematics.ur_kinematics import inverse_kinematics
from ur_fabrication_control.kinematics.ur_params import ur_params
from compas_rhino.conversions import plane_to_compas_frame
from compas_ghpython import draw_frame

# transform frame to robot coordinate system
frame_WCF = plane_to_compas_frame(plane)
frame_RCF = robot.from_WCF_to_RCF(frame_WCF)

if robot.attached_tool:
    tool0_RCF = robot.from_tcf_to_t0cf([frame_RCF])[0]
else:
    tool0_RCF = frame_RCF

plane_tool0_RCF = draw_frame(tool0_RCF)
plane_RCS = draw_frame(frame_RCF)

# calculate solutions to frame
ur_params = ur_params["ur20"] # get the parameters according to the robot model
# print ur_params
solutions = inverse_kinematics(tool0_RCF, ur_params)
# print solutions

if not len(solutions):
    joint_values = [0, 0, 0, 0, 0, 0]
else:
    joint_values = solutions[idx]

if len(robot.get_configurable_joints()) == 6:
    configuration = Configuration.from_revolute_values(joint_values)
else:
    configuration = Configuration.from_prismatic_and_revolute_values([lift], joint_values)

print(configuration)
# ---------- end analytic_inverse ----------

# ----
# Pick brick
pick_brick = Python3Script(robot=robot, pick_config=safe_planes.pick_config)  # -> out, brick, pick_plane
# ---------- pick_brick: Python ----------
from compas.geometry import Frame, Vector, Box, Translation, Transformation
from compas_rhino.conversions import box_to_rhino, frame_to_rhino, plane_to_compas_frame
from assembly_information_model import Part

# dimensions full brick
width = 0.11
length = 0.240
height = 0.0750

pick_frame = robot.from_BCF_to_WCF(robot.forward_kinematics(pick_config, options=dict()))
pick_plane = frame_to_rhino(pick_frame)

# create bricks
T = Translation.from_vector(-Vector.Zaxis()*height/2)
brick_frame = pick_frame.transformed(T)
brick_geometry = Box(length, width, height, brick_frame, 'box')
brick = box_to_rhino(brick_geometry)
# ---------- end pick_brick ----------
pln_2 = Plane(pick_brick.pick_plane)
geo_4 = Geometry(pick_brick.brick)
preview_6 = CustomPreview(Geometry=geo_4, Material=ColourSwatch(SwatchColor=RGB(255, 125, 157)))

# ----
# Move Cartesian
list_8 = ValueList({"send one cartesian position": 0, "send all cartesian positions": 1}, selected="send one cartesian position")
filter = StreamFilter(Gate=list_8, Stream0=plane_2, Stream1=pln)
radius = Slider(0.003, range=0..0.5)
movel = Python3Script(robot=robot, planes_WCS=filter, velocity=Slider(0.05, range=0..0.5), radius=radius)  # -> urscript; inputs planes_WCS: list of Plane
# ---------- movel: Python ----------
import Rhino.Geometry as rg
from compas.geometry import Frame
from compas.geometry import Transformation, Rotation
from compas_rhino.conversions import plane_to_compas_frame
from compas_ghpython import draw_frame
from ur_fabrication_control import direct_control 
import math

from scriptcontext import sticky as st
from ur_fabrication_control.direct_control import URScript

# retrieve the current tool frame in axis angle format
if robot.attached_tool:
    tool_angle_axis = list(robot.attached_tool.frame.point) + list(robot.attached_tool.frame.axis_angle_vector)
else:
    tool0_frame = Frame([0, 0, 0], [1, 0, 0], [0, 1, 0])
    tool_angle_axis = list(tool0_frame.point) + list(tool0_frame.axis_angle_vector)

frames_RCS = []
for plane_WCS in planes_WCS:
    frame_WCS = plane_to_compas_frame(plane_WCS)
    frame_RCS = robot.from_WCF_to_RCF(frame_WCS)
    pose = frame_RCS.point.__data__ + frame_RCS.axis_angle_vector.__data__
    x = "p[{}, {}, {}, {}, {}, {}]".format(*pose)
    print(x)
    frames_RCS.append(frame_RCS)

urscript = URScript()
urscript.start()
urscript.set_tcp(tool_angle_axis)
for frame_RCS in frames_RCS:
    urscript.move_linear(frame=frame_RCS, velocity=velocity, radius=radius)
urscript.end()

urscript = urscript.generate()

print(urscript)
# ---------- end movel ----------
send = Button()
ur_send = Python3Script(urscript=movel, send=send)  # -> out; inputs urscript: String
# ---------- ur_send: Python ----------
from scriptcontext import sticky as st
from ur_fabrication_control.direct_control import send_script

ur_ip = st["ur_ip"]
ur_port = st["ur_port"]

if send:
    send_script(urscript, ur_ip, ur_port)
# ---------- end ur_send ----------

# ----
# Plan motion
list_9 = ValueList({"ur20", "ur20_and_liftkit"}, selected="ur20")
plane_3 = Plane(Plane(origin=(0.9373701784, -0.2091342998, 0.4795403412), x=(-0.7236318944, -0.6901861209, 0), y=(-0.5107925263, 0.5355450541, -0.672519509)))
constraints_from_plane = Python3Script(robot=robot, plane=safe_planes.safe_place_plane, group=list_9)  # -> constraints
# ---------- constraints_from_plane: Python ----------
"""
Create a position and an orientation constraint from a plane calculated for the group's end-effector link.

COMPAS FAB v1.0.2
"""

import math

from compas_rhino.conversions import plane_to_compas_frame
from ghpythonlib.componentbase import executingcomponent as component


class ConstraintsFromPlane(component):
    def RunScript(self,
            robot,
            plane,
            group,
            tolerance_position,
            tolerance_xaxis,
            tolerance_yaxis,
            tolerance_zaxis):
        goal_constraints = None
        if robot and plane:
            tolerance_position = tolerance_position or 0.001
            tolerance_xaxis = tolerance_xaxis or 1.0
            tolerance_yaxis = tolerance_yaxis or 1.0
            tolerance_zaxis = tolerance_zaxis or 1.0

            frame = plane_to_compas_frame(plane)
            tolerances_axes = [
                math.radians(tolerance_xaxis),
                math.radians(tolerance_yaxis),
                math.radians(tolerance_zaxis),
            ]
            goal_constraints = robot.constraints_from_frame(frame, tolerance_position, tolerances_axes, group)

        return goal_constraints
# ---------- end constraints_from_plane ----------
plan_motion = Python3Script(
    robot=robot,
    goal_constraints=constraints_from_plane,
    start_configuration=safe_planes.mid_config,
    group=list_9,
    compute=compute)  # -> out, trajectory; inputs goal_constraints: list
# ---------- plan_motion: Python ----------
"""
Calculate a motion path.

COMPAS FAB v1.0.2
"""
import System
from ghpythonlib.componentbase import executingcomponent as component
from scriptcontext import sticky as st

from compas_fab.ghpython.components import create_id


class PlanMotion(component):
    def RunScript(self,
            robot,
            goal_constraints: System.Collections.Generic.IList[object],
            start_configuration,
            group,
            attached_collision_meshes,
            path_constraints,
            planner_id,
            compute):
        key = "trajectory"

        path_constraints = list(path_constraints) if path_constraints else None
        attached_collision_meshes = list(attached_collision_meshes) if attached_collision_meshes else None
        planner_id = str(planner_id) if planner_id else "RRTConnect"

        if (
            robot
            and robot.client
            and robot.client.is_connected
            and start_configuration
            and goal_constraints
            and compute
        ):
            st[key] = robot.plan_motion(
                goal_constraints,
                start_configuration=start_configuration,
                group=group,
                options=dict(
                    attached_collision_meshes=attached_collision_meshes,
                    path_constraints=path_constraints,
                    planner_id=planner_id,
                ),
            )

        trajectory = st.get(key, None)
        return trajectory
# ---------- end plan_motion ----------
trajectory_visualize = Python3Script(robot=robot, group=list_9, trajectory=plan_motion.trajectory)  # -> out, start_configuration, configurations, fraction, time, planes, P, V, A
# ---------- trajectory_visualize: Python ----------
"""
Visualizes a trajectory.

COMPAS FAB v1.0.2
"""

from compas_ghpython import draw_frame
from compas_ghpython.sets import list_to_ghtree
from ghpythonlib.componentbase import executingcomponent as component


class TrajectoryVisualize(component):
    def RunScript(self, robot, group, trajectory):
        start_configuration = None
        configurations = []
        fraction = 0.0
        time = 0.0

        planes = []
        positions = []
        velocities = []
        accelerations = []

        if robot and trajectory:
            group = group or robot.main_group_name

            for c in trajectory.points:
                configurations.append(c)
                #configurations.append(
                #    robot.merge_group_with_full_configuration(c, trajectory.start_configuration, group)
                #)
                frame = robot.forward_kinematics(c, group, options=dict(solver="model"))
                planes.append(draw_frame(frame))
                positions.append(c.positions)
                velocities.append(c.velocities)
                accelerations.append(c.accelerations)

            start_configuration = trajectory.start_configuration
            fraction = trajectory.fraction
            time = trajectory.time_from_start

        P = list_to_ghtree(list(zip(*positions)))
        V = list_to_ghtree(list(zip(*velocities)))
        A = list_to_ghtree(list(zip(*accelerations)))
        print(configurations)
        # return outputs if you have them; here I try it for you:
        return (start_configuration, configurations, fraction, time, planes, P, V, A)
# ---------- end trajectory_visualize ----------
pln_3 = Python3Script(P=trajectory_visualize.planes)  # -> P
# ---------- pln_3: Python ----------
print("hi")
# ---------- end pln_3 ----------
pline = PolyLine(Vertices=pln_3, Closed=False)
select = Python3Script(L=trajectory_visualize.configurations, i=Slider(0, range=0..100))  # -> a; inputs L: list, i: Int32
# ---------- select: Python ----------
print(len(L))

if i < len(L):
    a = L[i]
else:
    a = L[-1]
# ---------- end select ----------
preview_7 = CustomPreview(Geometry=pline, Material=ColourSwatch(SwatchColor=RGB(59, 137, 161)))

# ----
# Move Joints
list_10 = ValueList({"send forward configuration": 0, "send ik configuration": 1, "send one motion configuration": 2, "send all motion configurations": 3}, selected="send forward configuration")
filter_2 = StreamFilter(
    Gate=list_10,
    Stream0=forward_kinematics,
    Stream1=inverse.configuration,
    Stream2=select,
    Stream3=trajectory_visualize.configurations)
movej = Python3Script(configurations=filter_2, velocity=Slider(0.108, range=0..0.5))  # -> urscript, lift, values; inputs configurations: list
# ---------- movej: Python ----------
from ur_fabrication_control.direct_control import URScript
from compas_robots import Configuration
import math

urscript = URScript()
urscript.start()
for configuration in configurations:
    joint_configuration = Configuration.from_revolute_values(configuration.revolute_values)
    print(joint_configuration)
    lift = configuration
    urscript.move_joint(joint_configuration, velocity)
urscript.end()

urscript = urscript.generate()

print(urscript)
# ---------- end movej ----------
send_2 = Button()
ur_send_2 = Python3Script(urscript=movej.urscript, send=send_2)  # -> out; inputs urscript: String
# ---------- ur_send_2: Python ----------
from scriptcontext import sticky as st
from ur_fabrication_control.direct_control import send_script

ur_ip = st["ur_ip"]
ur_port = st["ur_port"]

print(urscript)

if send:
    send_script(urscript, ur_ip, ur_port)
# ---------- end ur_send_2 ----------

# ----
# 2.
compute_3 = Button()

# ----
# Get Pose Joint
get = Button()
pose = Python3Script(robot=robot, get=get)  # -> out, configuration, pose_joints
# ---------- pose: Python ----------
from scriptcontext import sticky as st
from ur_fabrication_control.direct_control.common import get_current_pose_joints
from compas.geometry import Frame
from compas_robots import Configuration


server_ip = st["server_ip"]
server_port = st["server_port"]
ur_port = st["ur_port"]
ur_ip = st["ur_ip"]
print(ur_ip)

guid = str(ghenv.Component.InstanceGuid)
pose_joints_key = "pose_joints" + guid

if pose_joints_key not in st:
    st[pose_joints_key] = None

# retrieve the current tool frame in axis angle format
if robot.attached_tool:
    tool_angle_axis = list(robot.attached_tool.frame.point) + list(robot.attached_tool.frame.axis_angle_vector)
else:
    tool0_frame = Frame([0, 0, 0], [1, 0, 0], [0, 1, 0])
    tool_angle_axis = list(tool0_frame.point) + list(tool0_frame.axis_angle_vector)

print(tool_angle_axis)

# send script to the robot to receive the current joint configuration
if get:
    st[pose_joints_key] = get_current_pose_joints(server_ip, server_port, ur_ip, ur_port, tool_angle_axis)

if st[pose_joints_key] is not None:
    print(st[pose_joints_key])
    configuration = Configuration.from_revolute_values(st[pose_joints_key])
    pose_joints = configuration.joint_values
"""
if pose_joints_key not in st:
    configuration = Configuration.from_revolute_values([0,0,0,0,0,0])
else:
    configuration = Configuration.from_revolute_values(st[pose_joints_key])

pose_joints = configuration.values
"""
# ---------- end pose ----------
panel_11 = Panel(pose.pose_joints)

# ----
# Fabrication routines
number_slider_3 = Slider(0.14, range=0..0.35)
radius_2 = Slider(0.015, range=0..0.1)
create_urscript = Python3Script(
    robot=robot,
    velocity=number_slider_3,
    radius=radius_2,
    pick_config=safe_planes.pick_config,
    safe_pick_config=safe_planes.safe_pick_config,
    place_plane=safe_planes.place_plane,
    safe_place_plane=safe_planes.safe_place_plane,
    place_configs=trajectory_visualize.configurations)  # -> urscript; inputs place_configs: list
# ---------- create_urscript: Python ----------
from ur_fabrication_control.direct_control import URScript
from ur_fabrication_control.direct_control.mixins import AreaGripMixins
from compas_robots import Configuration
from compas.geometry import Frame
from compas_rhino.conversions import plane_to_compas_frame
import math

place_frame = plane_to_compas_frame(place_plane)
place_frame_RCF = robot.from_WCF_to_RCF(place_frame)

# retrieve the current tool frame in axis angle format
if robot.attached_tool:
    tool_angle_axis = list(robot.attached_tool.frame.point) + list(robot.attached_tool.frame.axis_angle_vector)
else:
    tool0_frame = Frame([0, 0, 0], [1, 0, 0], [0, 1, 0])
    tool_angle_axis = list(tool0_frame.point) + list(tool0_frame.axis_angle_vector)

class URScript_AreaGrip(URScript, AreaGripMixins):
    pass

urscript = URScript_AreaGrip()
urscript.start()
urscript.set_tcp(tool_angle_axis)

#if routine == 0:
urscript.set_payload(0.1)
urscript.move_joint(safe_pick_config, velocity, radius=0.0)
urscript.move_joint(pick_config, velocity, radius=0.0)
urscript.areagrip_on()
urscript.set_payload(3.7)
urscript.move_joint(safe_pick_config, velocity, radius=0.0)

for place_config in place_configs:
    urscript.move_joint(place_config, velocity, radius)

final_config = place_configs[-1]
urscript.move_joint(final_config, velocity, radius=0.0)

#if routine == 1:
#    urscript.set_payload(3.7)

#if routine == 1:
urscript.set_payload(3.7)
urscript.add_line("\tsleep({})".format(1.0))
urscript.get_force()
    
urscript.force_mode_in_z(10.0, 0.03)
urscript.stop_by_force(15.0)
urscript.end_force_mode()
urscript.add_line("\tsleep({})".format(1.0))

urscript.areagrip_off()
urscript.set_payload(0.1)
urscript.add_line("\tsleep({})".format(1.0))

reverse_configs = list(reversed(place_configs))
for reverse_config in reverse_configs:
    urscript.move_joint(reverse_config, velocity, radius)

urscript.move_joint(safe_pick_config, velocity, radius=0.0)

#    final_config = place_configs[-1]
#    urscript.move_joint(final_config, velocity, radius=0.0)

#if routine == 3:
#    urscript.set_payload(0.1)


urscript.end()
urscript = urscript.generate()

print(urscript)
# ---------- end create_urscript ----------
list_11 = ValueList({"Pick brick": 0, "Place brick": 1}, selected="Pick brick")
ur_send_3 = Python3Script(urscript=create_urscript, send=place)  # -> out; inputs urscript: String; same code as ur_send

# ----
# Stop
stop_2 = Button()
stop_3 = Python3Script(stop=stop_2)
# ---------- stop_3: Python ----------
from scriptcontext import sticky as st
from ur_fabrication_control.direct_control.common import send_stop

ur_ip = st["ur_ip"]
ur_port = st["ur_port"]

if stop:
    send_stop(ur_ip, ur_port)
# ---------- end stop_3 ----------

# ----
# 3.
send_3 = Button()

list_12 = ValueList({"0 pick_config": 0, "1 safe_pick_config": 1, "2 mid_config": 2, "3 place_motion": 3}, selected="3 place_motion")
filter_3 = StreamFilter(
    Gate=list_12,
    Stream0=safe_planes.pick_config,
    Stream1=safe_planes.safe_pick_config,
    Stream2=safe_planes.mid_config,
    Stream3=select)

# ----
# Visualisation
list_13 = ValueList({"0 zero_configuration": 0, "1 forward_kinematics": 1, "2 analytic_inverse_kinematics": 2, "3 inverse_kinematics": 3, "4 motion_planning": 4, "5 real_configuration": 5, "6 assembly": 6}, selected="6 assembly")
filter_4 = StreamFilter(
    Gate=list_13,
    Stream0=zero.configuration,
    Stream1=forward_kinematics,
    Stream2=analytic_inverse.configuration,
    Stream3=inverse.configuration,
    Stream4=select,
    Stream5=draw,
    Stream6=filter_3)
show_eef = BooleanToggle(True)
show_frames = BooleanToggle(True)
show_visual = BooleanToggle(True)
show_collision = BooleanToggle(True)
show_attached_collision = BooleanToggle(True)
show_bcf = BooleanToggle(True)
visualise = Python3Script(
    robot=robot,
    configuration=filter_4,
    show_frames=show_frames,
    show_visual_meshes=show_visual,
    show_robot_collision_meshes=show_robot_collision,
    show_collision_meshes=show_collision,
    show_attached_collision_meshes=show_attached_collision,
    show_BCF=show_bcf,
    show_RCF=show_rcf,
    show_EEF=show_eef,
    bang=[set_frame, attach_tool.bang, collision_mesh.bang])  # -> out, joint_planes, visual_meshes, robot_collision_meshes, collision_meshes, attached_meshes, BCF, RCF, EEF; inputs bang: list
# ---------- visualise: Python ----------
from scriptcontext import sticky as st
import time
from compas_ghpython import create_id
from compas.geometry import Frame
from compas.geometry import Transformation
from compas_rhino.conversions import frame_to_rhino, mesh_to_compas, mesh_to_rhino, frame_to_rhino_plane
from compas.scene import SceneObject
from compas_fab.robots import PlanningScene
import Rhino.Geometry as rg
import ghpythonlib.components as ghcomp

robot.update(configuration)

if show_frames == True: 
    #print(configuration)
    joint_frames = robot.model.transformed_frames(configuration)
    joint_planes = [frame_to_rhino(a) for a in joint_frames]

if show_BCF:
    BCF = frame_to_rhino(robot.BCF)

if show_RCF:
    print(robot.RCF)
    RCF = frame_to_rhino(robot.from_BCF_to_WCF(robot.RCF))

if show_EEF:
    EEF = frame_to_rhino(robot.from_BCF_to_WCF(robot.forward_kinematics(
        configuration, options=dict()
        )))

if show_visual_meshes == True:
    visual_meshes = robot.draw_visual()
    # orient the robot to its base plane:
    robot_BCF = frame_to_rhino_plane(robot.BCF) 
    print(type(robot_BCF))
    init_robot_plane = rg.Plane.WorldXY
    #visual_meshes = ghcomp.Orient(visual_meshes, init_robot_plane, robot_BCF)[0]

if show_robot_collision_meshes == True:
    robot_collision_meshes = robot.draw_collision()

cached_scene_key = "cached_scene"

if show_collision_meshes or show_attached_collision_meshes:
    cached_scene = st.get(cached_scene_key)
    if not cached_scene:
        cached_scene = {"time": 0}

    # # expire cache if the component has not been executed in the last 2 seconds
    # # this allows to slide through a list of configurations
    # # without triggering refreshes of the scene in the middle of it

    # if time.time() - cached_scene["time"] > 2:
    #     update_scene = True
    # else:
    #     update_scene = False

    update_scene = True

    if update_scene:
        scene = PlanningScene(robot)
        scene = robot.client.get_planning_scene()

    if update_scene and show_collision_meshes:
        collision_meshes = []

        for co in scene.world.collision_objects:
            print(co)
            header = co.header
            frame_id = header.frame_id
            cms = co.to_collision_meshes()

            for cm in cms:
                if cm.frame != Frame.worldXY():
                    t = Transformation.from_frame(cm.frame)
                    mesh = cm.mesh.transformed(t)
                else:
                    mesh = cm.mesh
                collision_meshes.extend(SceneObject(item=mesh).draw())

        cached_scene["cm"] = collision_meshes

        collision_meshes = cached_scene.get("cm", [])

    if update_scene and show_attached_collision_meshes:
        attached_meshes = []

        for aco in scene.robot_state.attached_collision_objects:
            for acm in aco.to_attached_collision_meshes():
                frame_id = aco.object["header"]["frame_id"]
                frame = robot.forward_kinematics(configuration, options=dict(link=frame_id))
                t = Transformation.from_frame(frame)

                # Local CM frame
                if acm.collision_mesh.frame and acm.collision_mesh.frame != Frame.worldXY():
                    t = t * Transformation.from_frame(acm.collision_mesh.frame)

                mesh = acm.collision_mesh.mesh.transformed(t)

                attached_meshes.extend(SceneObject(item=mesh).draw())

        cached_scene["acm"] = attached_meshes

        attached_meshes = cached_scene.get("acm", [])
    
    cached_scene["time"] = time.time()
    st[cached_scene_key] = cached_scene
# ---------- end visualise ----------
py3_2 = Python3Script(planes=[visualise.EEF, visualise.RCF, visualise.BCF], scale=Slider(0.2, range=0..1))  # -> P, V, C, W; inputs planes: list of Plane, scale: Double
# ---------- py3_2: Python ----------
from Rhino.Display import ColorRGBA
from ghpythonlib.components import ColourRGBf


red = ColourRGBf(255, 255, 0, 0)
green = ColourRGBf(255, 0, 255, 0)
blue = ColourRGBf(255, 0, 0, 255)

P = []
V = []
C = []

# scale = float(scale)

for plane in planes:
    if not plane:
        continue
    P += [plane.Origin] * 3
    V.append(plane.XAxis * scale)
    V.append(plane.YAxis * scale)
    V.append(plane.ZAxis * scale)
    C += [red, green, blue]

W = 3
# ---------- end py3_2 ----------
pln_4 = Plane(visualise.joint_planes)
mesh_3 = Mesh(visualise.visual_meshes)
mesh_4 = Mesh(visualise.collision_meshes)
orient = Orient(Geometry=visualise.visual_meshes, Source=PlaneXY(0, 0, 0), Target=visualise.BCF)  # -> Geometry, Transform
vdisex = VectorDisplayEx(Point=py3_2.P, Vector=py3_2.V, Colour=py3_2.C, Width=py3_2.W)
preview_8 = CustomPreview(Geometry=orient.Geometry, Material=ColourSwatch(SwatchColor=RGB(74, 74, 74)))

mesh_5 = Mesh(visualise.robot_collision_meshes)
mesh_6 = Mesh(visualise.attached_meshes)

# ----
# Get Pose Cartesian
get_2 = Button()
pose_2 = Python3Script(robot=robot, get=get_2)  # -> out, pose_cartesian
# ---------- pose_2: Python ----------
from scriptcontext import sticky as st
#from ur_fabrication_control.online_control.ur_direct import get_current_pose_cartesian

from ur_fabrication_control.direct_control.common import get_current_pose_cartesian
from compas.geometry import Frame
from compas_ghpython import draw_frame


server_ip = st["server_ip"]
server_port = st["server_port"]
ur_port = st["ur_port"]
ur_ip = st["ur_ip"]
pose_cartesian_meter = []

# retrieve the current tool frame in axis angle format
if robot.attached_tool:
    print("attached")
    tool_angle_axis = list(robot.attached_tool.frame.point) + list(robot.attached_tool.frame.axis_angle_vector)
    
else:
    tool0_frame = Frame([0, 0, 0], [1, 0, 0], [0, 1, 0])
    tool_angle_axis = list(tool0_frame.point) + list(tool0_frame.axis_angle_vector)

guid = str(ghenv.Component.InstanceGuid)
pose_cartesian_key = "pose_cartesian" + guid

if pose_cartesian_key not in st:
    st[pose_cartesian_key] = None

if get:
    print("getting pose")
    st[pose_cartesian_key] = get_current_pose_cartesian(tool_angle_axis, server_ip, server_port, ur_ip, ur_port, send=True)
    
pose_cartesian = st[pose_cartesian_key]
# ---------- end pose_2 ----------
python = Python3Script(pose=pose_2.pose_cartesian)  # -> out, plane
# ---------- python: Python ----------
__author__ = "Gido"
__version__ = "2023.07.05"

import rhinoscriptsyntax as rs
from compas.geometry import Frame
from compas_ghpython import draw_frame

if pose is not None:
    frame_RCS = Frame.from_axis_angle_vector(pose[3:6], pose[0:3])
    T = Transformation.from_change_of_basis(robot.RCF, Frame.worldXY())
    frame_WCS = frame_RCS.transformed(T)
    plane = draw_frame(frame_WCS)
# ---------- end python ----------

# ----
# Direct UR control
rec = DataRecorder(pose_2.out, DataLimit=-10, RecordData=True)

panel_12 = Panel(rec)
